vi "collision detection.gvi"   [LabVIEW Conversion 5.1.0.3763]
inputs:
  "y values": f64[]
  "x values 2": f64[]
  "x values": f64[]
  "y values 2": f64[]
outputs:
  "Collision": bool
diagram:
  for {
    w1 = each element of $"x values 2"
    w2 = each element of $"y values 2"
    for {
      w3 = each element of $"x values"
      w4 = each element of $"y values"
      Is Equal(x=w3, y=w1) -> w5
      Is Equal(x=w4, y=w2) -> w6
      Logical And(w5, w6) -> w7
      case (w7) {
        frame False, Default { }
        frame True {
          $Collision <- w7
        }
      }
    }
  }
