vi "index.gviweb"   [LabVIEW NXG 3.1.0]
panel controls:
  "stop": bool
  "Difficulty": f64
  "Height": i32
  "Position": f64
  "right": bool
  "left": bool
panel indicators:
  "Level Completion": f64
  "Current Score": i32
  "Graph": cluster{"Element 1": f64[], "Element 2": i32[]}
uses:
  Application::collision detection.gvi
diagram:
  sequence {
    frame 0 {
      $"Current Score" <- 0
      $"Level Completion" <- 0
      $Position <- 50
      $Height <- 0
      $Difficulty <- 1
      $stop <- FALSE
    }
    frame 1 {
      for (N = 250) (iteration -> i1) {
        Is Greater Or Equal(x=i1, y=20) -> w3
        case (w3) {
          frame True {
            Random Number() -> (number (0 to 1)=w5)
            Multiply(w5, 100) -> w4
          }
          frame False {
            Random Number() -> (number (0 to 1)=w6)
            Multiply(w6, -100) -> w4
          }
        }
        Round To Nearest(number=w4) -> w7
        append w7 to w1
        append i1 to w2
      }
    }
  }
  for (N = 250) (iteration -> i2) {
    Increment(x=i2) -> w8
    Increment(x=i1) -> w9
    Divide(x=w8, y=w9) -> w10
    Multiply(w10, 100) -> w11
    Round To Nearest(number=w11) -> w12
    $"Level Completion" <- w12
    Multiply($Difficulty, w8) -> w13
    $"Current Score" <- w13
    Array Subset(array=w1, index0=i2, length0=100) -> w14
    Build Array(0, 1, 2, 0, 1, 2, 1, 1, 1) -> w15
    Add(w15, $Position) -> w16
    Insert Into Array(inArray=w14, index0=0, new=w16) -> w17
    Array Subset(array=w2, index0=0, length0=100) -> w18
    Build Array(0, 0, 0, 1, 1, 1, 2, 3, 4) -> w19
    Add(w19, $Height) -> w20
    Insert Into Array(inArray=w18, index0=0, new=w20) -> w21
    w22 = cluster{"Element 1": f64[], "Element 2": i32[]} {all zero or empty}
    Property Node(instance in=w22, "Element 1"=w17, "Element 2"=w21) -> (instance out=w23)
    $Graph <- w23
    call "collision detection.gvi"(y values=w14, x values 2=w20, x values=w18, y values 2=w16) -> (Collision=w24)
    $stop <- w24
    Multiply(2, $Difficulty) -> w25
    Subtract(x=50, y=w25) -> w26
    Wait Until Next Multiple(multiple to wait=w26)
    stop if w24
  }
  sequence (after w13) {
    frame 0 {
      $stop <- TRUE
    }
  }
  disable {
    frame Disabled {
      Is Less Or Equal(x=$Height, y=2) -> w27
      # down
      Select(s=w27, t=2, f=$Height) -> w28
      Subtract(x=w28, y=2) -> w29
      $Height <- w29
    }
    frame Enabled { }
  }
  while {
    case ($right) {
      frame False, Default { }
      frame True {
        Is Greater Or Equal(x=$Position, y=96) -> w30
        Select(s=w30, t=96, f=$Position) -> w31
        Add(w31, 2) -> w32
        # Right
        $Position <- w32
      }
    }
    case ($left) {
      frame False, Default { }
      frame True {
        Is Less Or Equal(x=$Position, y=2) -> w33
        # Left
        Select(s=w33, t=2, f=$Position) -> w34
        Subtract(x=w34, y=2) -> w35
        $Position <- w35
      }
    }
    stop if $stop
  }
  disable {
    frame Disabled {
      Is Greater Or Equal(x=$Height, y=94) -> w36
      Select(s=w36, t=94, f=$Height) -> w37
      Add(w37, 2) -> w38
      # up
      $Height <- w38
    }
    frame Enabled { }
  }
