vi "index.gviweb"   [G Web Development Software 22.3.0]
panel controls:
  "City Distance": i32 = 32
  "Avenue Width": i32 = 27
  "Building Width": i32 = 9
  "Building Depth": i32 = 8
  "Background": bool
  "Texture": bool
  "Texture OFF": bool
  "Building Height": i32 = 45
  "Ground Plane": i32 = 6
  "Avenue Period": i32 = 99
  "Hyperlink Control": string = "https://forums.ni.com/t5/BreakPoint/City-In-a-Intensity-Graph/m-p/4375000"
panel indicators:
  "City in Bottle": f32[][]
  "ms per frame": i32
diagram:
  Tick Count() -> (timer value=w1)
  # Y>=GROUND_PLANE-(CITY_DISTANCE<Z&AVENUE_WIDTH<(X%AVENUE_PERIOD)&&X/BUILDING_WIDTH^Z/BUILDING_DEPTH)*8%(BUILDING_HEIGHT+1);
  s1 = w1  # shift register
  while (iteration -> i1) {
    Multiply(60, 100) -> w2
    s2 = w2  # shift register
    for (N = 60) {
      s3 = s2  # shift register
      for (N = 100) {
        Decrement(x=s3) -> w5
        Divide(x=w5, y=4000) -> w6
        Subtract(x=1, y=w6) -> w7
        Quotient And Remainder(x=w5, y=100) -> (x-y*floor(x/y)=w8)
        Divide(x=w8, y=50) -> w9
        Decrement(x=w9) -> w10
        w11 = $"Building Width"
        w12 = $"Building Depth"
        w13 = $"City Distance"
        Multiply(w10, w7) -> w14
        Select(s=$Background, t=w14, f=w7) -> w15
        w16 = $"Avenue Width"
        s4 = 1  # shift register
        s5 = i1  # shift register
        s6 = 1  # shift register
        s7 = w10  # shift register
        s8 = w7  # shift register
        s9 = w15  # shift register
        while (iteration -> i2) {
          Add(2, i2) -> w17
          Is Greater Or Equal(x=w17, y=100) -> w18
          Divide(x=s5, y=w11) -> w19
          Divide(x=w17, y=w12) -> w20
          Logical Exclusive Or(w19, w20) -> w21
          # Ray Tracing
          Multiply(w21, 8) -> w22
          Is Greater(x=w17, y=w13) -> w23
          Quotient And Remainder(x=s5, y=$"Avenue Period") -> (x-y*floor(x/y)=w24)
          Is Less(x=w16, y=w24) -> w25
          Logical And(w23, w25) -> w26
          Select(s=w26, t=w22, f=0) -> w27
          Quotient And Remainder(x=w27, y=$"Building Height") -> (x-y*floor(x/y)=w28)
          Subtract(x=$"Ground Plane", y=w28) -> w29
          Is Greater Or Equal(x=s4, y=w29) -> w30
          Is Less(x=s6, y=1) -> w31
          Logical And(w31, w30) -> w32
          Logical Or(w18, w32) -> w33
          Logical And(s4, 4) -> w34
          # XYZ
          Logical And(s4, s5, w17) -> w35
          Quotient And Remainder(x=w35, y=3) -> (x-y*floor(x/y)=w36)
          Select(s=$Texture, t=w34, f=w36) -> w37
          Select(s=$"Texture OFF", t=1, f=w37) -> w38
          Divide(x=w38, y=w17) -> w39: f32
          Select(s=w30, t=w39, f=s9) -> w40
          Select(s=w30, t=1, f=s8) -> w41
          Subtract(x=s4, y=w41) -> w42
          Divide(x=w17, y=100) -> w43: f32
          Select(s=w30, t=w43, f=s6) -> w44
          Select(s=w30, t=1, f=s7) -> w45
          Add(w45, s5) -> w46
          next s4 = w42
          next s5 = w46
          next s6 = w44
          next s7 = w45
          next s8 = w41
          next s9 = w40
          stop if w33
        }
        Increment(x=s9) -> w47
        Multiply(s6, w17) -> w48
        Divide(x=w48, y=100) -> w49
        Subtract(x=w47, y=w49) -> w50
        Subtract(x=1, y=w50) -> w51
        append w51 to w4
        next s3 = w5
      }
      append w4 to w3
      next s2 = s3
    }
    Transpose 2D Array(2D array=w3) -> (transposed array=w52)
    $"City in Bottle" <- w52
    Tick Count() -> (timer value=w53)
    Subtract(x=w53, y=s1) -> w54
    $"ms per frame" <- w54
    next s1 = w53
    stop if FALSE
  }
