vi "Number to Digital Display.gvi"   [LabVIEW NXG 5.1.0]
inputs:
  "number": i32
outputs:
  "digital display": cluster{"High": T1, "Low": T1}
types:
  T1 = cluster{"a": bool, "b": bool, "c": bool, "d": bool, "e": bool, "f": bool, "g": bool}
uses:
  WebApp::Support::Lookup Digit.gvi
diagram:
  Quotient And Remainder(x=$number, y=100) -> (x-y*floor(x/y)=w1)
  Quotient And Remainder(x=w1, y=10) -> (floor(x/y)=w2, x-y*floor(x/y)=w3)
  call "Lookup Digit.gvi"(number=w3) -> (digit=w4)
  call "Lookup Digit.gvi"(number=w2) -> (digit=w5)
  Property Node(instance in=cluster{"High": T1, "Low": T1} {all zero or empty}, "Low"=w4, "High"=w5) -> (instance out=w6)
  $"digital display" <- w6
