vi "index.gviweb"   [LabVIEW NXG 5.1.0]
panel indicators:
  "Hours": cluster{"High": T1, "Low": T1}
  "Cluster": cluster{"LED": bool, "LED_2": bool}
  "Cluster_2": cluster{"LED": bool, "LED_2": bool}
  "Seconds": cluster{"High": T1, "Low": T1}
  "Minutes": cluster{"High": T1, "Low": T1}
types:
  T1 = cluster{"a": bool, "b": bool, "c": bool, "d": bool, "e": bool, "f": bool, "g": bool}
uses:
  WebApp::Support::Number to Digital Display.gvi
diagram:
  while {
    Get Current Time() -> (current time=w1)
    Timestamp To Date And Time(time stamp=w1) -> (date time rec=w2)
    Property Node(instance in=w2) -> ("hour"=w3, "minute"=w4, "second"=w5)
    call "Number to Digital Display.gvi"(number=w3) -> (digital display=w6)
    $Hours <- w6
    call "Number to Digital Display.gvi"(number=w4) -> (digital display=w7)
    $Minutes <- w7
    call "Number to Digital Display.gvi"(number=w5) -> (digital display=w8)
    $Seconds <- w8
    Wait(time to wait=10)
    stop if FALSE
  }
