vi "ArrayNotEqual.gvi"   [LabVIEW Conversion 3.1.0]
inputs:
  "grid 2": i8[][]
  "grid 3": i8[][]
outputs:
  "Not Equal": bool
diagram:
  s1 = FALSE  # shift register
  while (iteration -> i1) {
    w1 = each element of $"grid 3"
    w2 = each element of $"grid 2"
    s2 = s1  # shift register
    while (iteration -> i2) {
      w3 = each element of w1
      w4 = each element of w2
      Is Not Equal(x=w4, y=w3) -> w5
      Logical Or(w5, s2) -> w6
      Is Greater(x=i2, y=7) -> w7
      Logical Or(w5, w7) -> w8
      next s2 = w6
      stop if w8
    }
    Is Greater(x=i1, y=15) -> w9
    Logical Or(s2, w9) -> w10
    next s1 = s2
    stop if w10
  }
  $"Not Equal" <- s1
