vi "ChooseRandomBlankLocation.gvi"   [LabVIEW Conversion 3.1.0]
inputs:
  "grid": i8[][]
  "Upper Limit": i32
outputs:
  "X": i32
  "Y": i32
diagram:
  # Checks random locations in grid until it finds a blank location
  # to insert a virus into
  while {
    To Double Precision Float(number=$"Upper Limit") -> w1
    Subtract(x=16, y=w1) -> w2
    To Long Integer(number=w2) -> w3
    Random Number() -> (number (0 to 1)=w4)
    Multiply(w4, w1) -> w5
    Round Toward Negative Infinity(x=w5) -> w6
    To Long Integer(number=w6) -> w7
    Add(w7, w3) -> w8
    Random Number() -> (number (0 to 1)=w9)
    Multiply(w9, 8) -> w10
    Round Toward Negative Infinity(x=w10) -> w11
    To Long Integer(number=w11) -> w12
    Array Index(array=$grid) -> (out0[w8, w12]=w13)
    Is Equal(x=w13, y=0) -> w14
    stop if w14
  }
  $X <- w8
  $Y <- w12
