vi "DropPill.gvi"   [LabVIEW Conversion 3.1.0]
inputs:
  "grid": i8[][]
  "LeftSide": i8
  "RightSide": i8
  "error in (no error)": error
outputs:
  "grid 2": i8[][]
  "Lost": bool
  "error out": error
diagram:
  Replace Array Subset(inArray=$grid, index=0, index=3, new=$LeftSide) -> w1
  Replace Array Subset(inArray=w1, index=0, index=4, new=$RightSide) -> w2
  $"grid 2" <- w2
  Array Index(array=$grid) -> (out0[0, 3]=w3)
  Is Not Equal(x=w3, y=0) -> w4
  Array Index(array=$grid) -> (out0[0, 4]=w5)
  Is Not Equal(x=w5, y=0) -> w6
  Logical Or(w6, w4) -> w7
  $Lost <- w7
  $"error out" <- $"error in (no error)"
