vi "GravitateGrid.gvi"   [LabVIEW NXG 3.1.0]
inputs:
  "grid 2": i8[][]
outputs:
  "grid 3": i8[][]
uses:
  WebApp::GravitatePill.gvi
  WebApp::GravitateSegment.gvi
diagram:
  w1 = 15  # row
  # Takes in current grid and drops every floating pill down one block
  s1 = $"grid 2"  # shift register
  s2 = w1  # shift register
  while {
    w2 = 7  # col
    s3 = s1  # shift register
    s4 = w2  # shift register
    while {
      Array Index(array=s3) -> (out0[s2, s4]=w3)
      case (w3) {
        frame Default {
          w4 = s3
        }
        frame 3..6, 11..14, 19..22 {
          call "GravitatePill.gvi"(grid 2=s3, element=w3, row=s2, col=s4) -> (grid 3=w4)
        }
        frame 1, 9, 17 {
          call "GravitateSegment.gvi"(grid 2=s3, row=s2, col=s4) -> (grid 3=w4)
        }
      }
      Decrement(x=s4) -> w5
      Is Equal(x=s4, y=0) -> w6
      next s3 = w4
      next s4 = w5
      stop if w6
    }
    Decrement(x=s2) -> w7
    Is Equal(x=s2, y=0) -> w8
    next s1 = s3
    next s2 = w7
    stop if w8
  }
  $"grid 3" <- s1
