vi "GravitateSegment.gvi"   [LabVIEW NXG 3.1.0]
inputs:
  "grid 2": i8[][]
  "row": i32
  "col": i32
outputs:
  "grid 3": i8[][]
uses:
  WebApp::MovePillSegmentDown.gvi
diagram:
  Increment(x=$row) -> w1
  Array Index(array=$"grid 2") -> (out0[w1, $col]=w2)
  Is Equal(x=w2, y=0) -> w3
  Is Less Or Equal(x=$row, y=14) -> w4
  Logical And(w3, w4) -> w5
  case (w5) {
    frame False, Default {
      w6 = $"grid 2"
    }
    frame True {
      call "MovePillSegmentDown.gvi"(grid 2=$"grid 2", row=$row, col=$col) -> (output array=w6)
    }
  }
  $"grid 3" <- w6
