vi "InitGrid.gvi"   [LabVIEW Conversion 3.1.0]
inputs:
  "error in (no error)": error
outputs:
  "Array": i8[][]
  "error out": error
diagram:
  $"error out" <- $"error in (no error)"
  for (N = 16) {
    for (N = 8) {
      Random Number() -> (number (0 to 1)=w3)
      Multiply(w3, 25) -> w4
      Round Toward Negative Infinity(x=w4) -> w5
      To Byte Integer(number=w5)
      append 0 to w2
    }
    append w2 to w1
  }
  $Array <- w1
