vi "MovePillDown.gvi"   [LabVIEW NXG 3.1.0]
inputs:
  "grid 2": i8[][]
  "row": i32
  "col": i32
outputs:
  "output array": i8[][]
uses:
  WebApp::MovePillSegmentDown.gvi
diagram:
  Array Index(array=$"grid 2") -> (out0[$row, $col]=w1)
  case (w1) {
    frame 4, 12, 20 {
      call "MovePillSegmentDown.gvi"(grid 2=$"grid 2", row=$row, col=$col) -> (output array=w3)
      Decrement(x=$col) -> w4
      call "MovePillSegmentDown.gvi"(grid 2=w3, row=$row, col=w4) -> (output array=w2)
    }
    frame 5, 13, 21 {
      call "MovePillSegmentDown.gvi"(grid 2=$"grid 2", row=$row, col=$col) -> (output array=w5)
      Increment(x=$col) -> w6
      call "MovePillSegmentDown.gvi"(grid 2=w5, row=$row, col=w6) -> (output array=w2)
    }
    frame 6, 14, 22 {
      call "MovePillSegmentDown.gvi"(grid 2=$"grid 2", row=$row, col=$col) -> (output array=w7)
      Decrement(x=$row) -> w8
      call "MovePillSegmentDown.gvi"(grid 2=w7, row=w8, col=$col) -> (output array=w2)
    }
    frame 3, 11, 19, Default {
      Increment(x=$row) -> w9
      call "MovePillSegmentDown.gvi"(grid 2=$"grid 2", row=w9, col=$col) -> (output array=w10)
      call "MovePillSegmentDown.gvi"(grid 2=w10, row=$row, col=$col) -> (output array=w2)
    }
  }
  $"output array" <- w2
