vi "RandomPill.gvi"   [LabVIEW Conversion 3.1.0]
outputs:
  "Left": i8
  "Right": i8
diagram:
  Random Number() -> (number (0 to 1)=w1)
  Multiply(w1, 3) -> w2
  Round Toward Negative Infinity(x=w2) -> w3
  To Byte Integer(number=w3) -> w4
  Multiply(w4, 8) -> w5
  Add(w5, 5) -> w6
  $Left <- w6
  Random Number() -> (number (0 to 1)=w7)
  Multiply(w7, 3) -> w8
  Round Toward Negative Infinity(x=w8) -> w9
  To Byte Integer(number=w9) -> w10
  Multiply(w10, 8) -> w11
  Add(w11, 4) -> w12
  $Right <- w12
