vi "RandomVirus.gvi"   [LabVIEW Conversion 3.1.0]
outputs:
  "virus": i8
diagram:
  # This vi generates an integer representing either a blue, red, or
  # yellow virus
  Random Number() -> (number (0 to 1)=w1)
  Multiply(w1, 3) -> w2
  Round Toward Negative Infinity(x=w2) -> w3
  To Byte Integer(number=w3) -> w4
  Multiply(w4, 8) -> w5
  Add(w5, 7) -> w6
  $virus <- w6
