vi "lose.gvi"   [LabVIEW Conversion 3.1.0]
outputs:
  "Output": i32
panel controls:
  "OK Button": bool
  "New Game button": bool
  "Exit button": bool
diagram:
  while {
    Wait(time to wait=30)
    Select(s=$"OK Button", t=0, f=1) -> w1
    Select(s=$"Exit button", t=2, f=w1) -> w2
    Logical Or($"OK Button", $"New Game button") -> w3
    Logical Or(w3, $"Exit button") -> w4
    stop if w4
  }
  $Output <- w2
