vi "BreakPill.gvi"   [LabVIEW NXG 3.1.0]
inputs:
  "grid 2": i8[][]
  "Row": i32
  "Col": i32
outputs:
  "grid 3": i8[][]
uses:
  WebApp::PillHalf2Segment.gvi
diagram:
  Array Index(array=$"grid 2") -> (out0[$Row, $Col]=w1)
  case (w1) {
    frame Default {
      w2 = $"grid 2"
    }
    frame 3, 11, 19 {
      Increment(x=$Row) -> w3
      call "PillHalf2Segment.gvi"(grid 2=$"grid 2", Row=w3, Col=$Col) -> (grid 3=w2)
    }
    frame 4, 12, 20 {
      Decrement(x=$Col) -> w4
      call "PillHalf2Segment.gvi"(grid 2=$"grid 2", Row=$Row, Col=w4) -> (grid 3=w2)
    }
    frame 5, 13, 21 {
      Increment(x=$Col) -> w5
      call "PillHalf2Segment.gvi"(grid 2=$"grid 2", Row=$Row, Col=w5) -> (grid 3=w2)
    }
    frame 6, 14, 22 {
      Decrement(x=$Row) -> w6
      call "PillHalf2Segment.gvi"(grid 2=$"grid 2", Row=w6, Col=$Col) -> (grid 3=w2)
    }
  }
  $"grid 3" <- w2
