vi "FindStraights.gvi"   [LabVIEW NXG 3.1.0]
inputs:
  "grid 2": i8[][]
outputs:
  "grid 3": i8[][]
  "Straight Count": i32
  "Remaining Viruses": i32
uses:
  WebApp::GetColumnStraights.gvi
  WebApp::GetRowStraights.gvi
diagram:
  s1 = 0  # shift register
  s2 = $"grid 2"  # shift register
  for (N = 8) (iteration -> i1) {
    call "GetColumnStraights.gvi"(grid 2=s2, Column=i1) -> (grid 3=w1, straight count=w2)
    Add(w2, s1) -> w3
    next s1 = w3
    next s2 = w1
  }
  s3 = s1  # shift register
  s4 = s2  # shift register
  for (N = 16) (iteration -> i2) {
    call "GetRowStraights.gvi"(grid 2=s4, Row=i2) -> (grid 3=w4, straight count=w5)
    Add(w5, s3) -> w6
    next s3 = w6
    next s4 = w4
  }
  $"grid 3" <- s4
  $"Straight Count" <- s3
  s5 = 0  # shift register
  for {
    w7 = each element of s4
    s6 = s5  # shift register
    for {
      w8 = each element of w7
      case (w8) {
        frame Default {
          w9 = s6
        }
        frame 7..8, 15..16, 23..24 {
          Increment(x=s6) -> w9
        }
      }
      next s6 = w9
    }
    next s5 = s6
  }
  $"Remaining Viruses" <- s5
