vi "GetColumnStraights.gvi"   [LabVIEW NXG 3.1.0]
inputs:
  "grid 2": i8[][]
  "Column": i32
outputs:
  "grid 3": i8[][]
  "straight count": i32
uses:
  WebApp::GetColor.gvi
  WebApp::BreakPill.gvi
diagram:
  Array Index(array=$"grid 2") -> (out0[_, $Column]=w1)
  Array Index(array=$"grid 2") -> (out0[0, $Column]=w2)
  # Straight Length
  call "GetColor.gvi"(Numeric=w2) -> (Numeric 2=w3)
  # index
  # Last Color
  s1 = w3  # shift register
  s2 = 1  # shift register
  s3 = 1  # shift register
  s4 = $"grid 2"  # shift register
  s5 = 0  # shift register
  while {
    Increment(x=s3) -> w4
    Is Not Equal To 0(x=s1) -> w5
    Array Index(array=w1) -> (out0[s3]=w6)
    call "GetColor.gvi"(Numeric=w6) -> (Numeric 2=w7)
    Is Not Equal(x=w7, y=s1) -> w8
    Is Greater Or Equal(x=s2, y=4) -> w9
    Logical And(w8, w9) -> w10
    Logical And(w5, w10) -> w11
    case (w11) {
      frame False, Default {
        w12 = s4
        w13 = s5
      }
      frame True {
        s6 = s4  # shift register
        for (N = s2) (iteration -> i1) {
          Increment(x=i1) -> w14
          Subtract(x=s3, y=w14) -> w15
          Multiply(s1, 8) -> w16
          Subtract(x=w16, y=6) -> w17
          call "BreakPill.gvi"(grid 2=s6, Row=w15, Col=$Column) -> (grid 3=w18)
          Replace Array Subset(inArray=w18, index=w15, index=$Column, new=w17) -> w19
          next s6 = w19
        }
        Increment(x=s5) -> w13
        w12 = s6
      }
    }
    Increment(x=s2) -> w20
    Select(s=w8, t=1, f=w20) -> w21
    Is Greater Or Equal(x=s3, y=15) -> w22
    next s1 = w7
    next s2 = w21
    next s3 = w4
    next s4 = w12
    next s5 = w13
    stop if w22
  }
  Is Greater Or Equal(x=s2, y=4) -> w23
  Is Not Equal To 0(x=s1) -> w24
  Logical And(w24, w23) -> w25
  case (w25) {
    frame False, Default {
      w26 = s4
      w27 = s5
    }
    frame True {
      s7 = s4  # shift register
      for (N = s2) (iteration -> i2) {
        Subtract(x=15, y=i2) -> w28
        Multiply(s1, 8) -> w29
        Subtract(x=w29, y=6) -> w30
        call "BreakPill.gvi"(grid 2=s7, Row=w28, Col=$Column) -> (grid 3=w31)
        Replace Array Subset(inArray=w31, index=w28, index=$Column, new=w30) -> w32
        next s7 = w32
      }
      Increment(x=s5) -> w27
      w26 = s7
    }
  }
  $"grid 3" <- w26
  $"straight count" <- w27
