vi "GravitatePill.gvi"   [LabVIEW NXG 3.1.0]
inputs:
  "grid 2": i8[][]
  "element": i8
  "row": i32
  "col": i32
outputs:
  "grid 3": i8[][]
uses:
  WebApp::MovePillDown.gvi
diagram:
  case ($element) {
    frame Default {
      w1 = $row
      w2 = $col
    }
    frame 4, 12, 20 {
      Decrement(x=$col) -> w2
      w1 = $row
    }
    frame 3, 11, 19 {
      Increment(x=$row) -> w1
      w2 = $col
    }
  }
  # Ignoring if it is top of a pill, because should have already been gravitated once
  case ($element) {
    frame Default {
      w3 = $"grid 2"
    }
    frame 4..5, 12..13, 20..21 {
      Increment(x=w1) -> w4
      Increment(x=w2) -> w5
      Array Index(array=$"grid 2") -> (out0[w4, w5]=w6)
      Is Equal(x=w6, y=0) -> w7
      Increment(x=w1) -> w8
      Array Index(array=$"grid 2") -> (out0[w8, w2]=w9)
      Is Equal(x=w9, y=0) -> w10
      Logical And(w7, w10) -> w11
      Is Less Or Equal(x=w1, y=14) -> w12
      Logical And(w11, w12) -> w13
      case (w13) {
        frame False, Default {
          w3 = $"grid 2"
        }
        frame True {
          call "MovePillDown.gvi"(grid 2=$"grid 2", row=w1, col=w2) -> (output array=w3)
        }
      }
    }
    frame 6, 14, 22 {
      Increment(x=w1) -> w14
      Array Index(array=$"grid 2") -> (out0[w14, w2]=w15)
      Is Equal(x=w15, y=0) -> w16
      Is Less Or Equal(x=w1, y=14) -> w17
      Logical And(w17, w16) -> w18
      case (w18) {
        frame False, Default {
          w3 = $"grid 2"
        }
        frame True {
          call "MovePillDown.gvi"(grid 2=$"grid 2", row=w1, col=w2) -> (output array=w3)
        }
      }
    }
  }
  $"grid 3" <- w3
