vi "Insert viruses.gvi"   [LabVIEW NXG 3.1.0]
inputs:
  "grid": i8[][]
  "viruses": i32
  "error in (no error)": error
outputs:
  "grid 2": i8[][]
  "error out": error
uses:
  WebApp::ChooseRandomBlankLocation.gvi
  WebApp::RandomVirus.gvi
diagram:
  Subtract(x=$viruses, y=4) -> w1
  To Double Precision Float(number=w1) -> w2
  Divide(x=w2, y=8) -> w3
  Round Toward Negative Infinity(x=w3)
  To Long Integer(number=w3) -> w4
  Add(w4, 3) -> w5
  # Generate a random pill and insert it into a blank location in the graph
  s1 = $grid  # shift register
  for (N = $viruses) {
    call "ChooseRandomBlankLocation.gvi"(grid=s1, Upper Limit=w5) -> (X=w6, Y=w7)
    call "RandomVirus.gvi"() -> (virus=w8)
    Replace Array Subset(inArray=s1, index=w6, index=w7, new=w8) -> w9
    next s1 = w9
  }
  $"grid 2" <- s1
  $"error out" <- $"error in (no error)"
