vi "MovePill.gvi"   [LabVIEW NXG 3.1.0]
inputs:
  "grid 2": i8[][]
  "Move how?": i32
  "row": i32
  "col": i32
outputs:
  "Output Array": i8[][]
  "Fallen": bool
  "Reset Timer": bool
  "row 2": i32
  "col 2": i32
uses:
  WebApp::MovePillRotateA.gvi
  WebApp::MovePillRotateB.gvi
  WebApp::MovePillLeft.gvi
  WebApp::MovePillDown.gvi
  WebApp::MovePillRight.gvi
diagram:
  # Move how?
  # 0 - Rotation A
  # 1 - Rotation B
  # 2 - Move Left
  # 3 - Move Down
  # 4 - Move Right
  # Takes in grid, row and column of active pill, and integer specifying how to move the pill.
  # Returns resulting grid, new row and column of active pill, and booleans specifying whether pill
  # has fallen fully and whether timer should be reset.
  case ($"Move how?") {
    frame Default {
      w1 = $"grid 2"
      w2 = FALSE
      w3 = $col
      w4 = $row
    }
    frame 0 {
      Array Index(array=$"grid 2") -> (out0[$row, $col]=w5)
      case (w5) {
        frame Default {
          w6 = $col
          w7 = $row
        }
        frame 3, 11, 19 {
          Increment(x=$row) -> w7
          w6 = $col
        }
        frame 4, 12, 20 {
          Decrement(x=$col) -> w6
          w7 = $row
        }
      }
      case (w5) {
        frame Default {
          w1 = $"grid 2"
          w2 = FALSE
          w3 = w6
          w4 = w7
        }
        frame 4..5, 12..13, 20..21 {
          Decrement(x=w7) -> w8
          Array Index(array=$"grid 2") -> (out0[w8, w6]=w9)
          Is Equal(x=w9, y=0) -> w10
          # The pointed to half of the pill is on the bottom
          Is Greater Or Equal(x=w7, y=1) -> w11
          Logical And(w10, w11) -> w12
          case (w12) {
            frame False, Default {
              w1 = $"grid 2"
              w2 = FALSE
              w4 = w7
              w3 = w6
            }
            frame True {
              call "MovePillRotateA.gvi"(grid 2=$"grid 2", row=w7, col=w6) -> (output array=w1)
              w2 = FALSE
              w4 = w7
              w3 = w6
            }
          }
        }
        frame 3, 6, 11, 14, 19, 22 {
          Increment(x=w6) -> w13
          Array Index(array=$"grid 2") -> (out0[w7, w13]=w14)
          Is Equal(x=w14, y=0) -> w15
          # The pointed to half of the pill is on the bottom
          Is Less Or Equal(x=w6, y=6) -> w16
          Logical And(w15, w16) -> w17
          case (w17) {
            frame False, Default {
              w1 = $"grid 2"
              w2 = FALSE
              w4 = w7
              w3 = w6
            }
            frame True {
              call "MovePillRotateA.gvi"(grid 2=$"grid 2", row=w7, col=w6) -> (output array=w1)
              w2 = FALSE
              w4 = w7
              w3 = w6
            }
          }
        }
      }
    }
    frame 1 {
      Array Index(array=$"grid 2") -> (out0[$row, $col]=w18)
      case (w18) {
        frame Default {
          w19 = $col
          w20 = $row
        }
        frame 3, 11, 19 {
          Increment(x=$row) -> w20
          w19 = $col
        }
        frame 4, 12, 20 {
          Decrement(x=$col) -> w19
          w20 = $row
        }
      }
      # Adjust row an col of active
      # pill to point at left or bottom, not top or right.
      case (w18) {
        frame Default {
          w1 = $"grid 2"
          w2 = FALSE
          w3 = w19
          w4 = w20
        }
        frame 4..5, 12..13, 20..21 {
          Decrement(x=w20) -> w21
          Array Index(array=$"grid 2") -> (out0[w21, w19]=w22)
          Is Equal(x=w22, y=0) -> w23
          # The pointed to half of the pill is on the bottom
          Is Greater Or Equal(x=w20, y=1) -> w24
          Logical And(w23, w24) -> w25
          case (w25) {
            frame False, Default {
              w1 = $"grid 2"
              w2 = FALSE
              w4 = w20
              w3 = w19
            }
            frame True {
              call "MovePillRotateB.gvi"(grid 2=$"grid 2", row=w20, col=w19) -> (output array=w1)
              w2 = FALSE
              w4 = w20
              w3 = w19
            }
          }
        }
        frame 3, 6, 11, 14, 19, 22 {
          Increment(x=w19) -> w26
          Array Index(array=$"grid 2") -> (out0[w20, w26]=w27)
          Is Equal(x=w27, y=0) -> w28
          # The pointed to half of the pill is on the bottom
          Is Less Or Equal(x=w19, y=6) -> w29
          Logical And(w28, w29) -> w30
          case (w30) {
            frame False, Default {
              w1 = $"grid 2"
              w2 = FALSE
              w4 = w20
              w3 = w19
            }
            frame True {
              call "MovePillRotateB.gvi"(grid 2=$"grid 2", row=w20, col=w19) -> (output array=w1)
              w2 = FALSE
              w4 = w20
              w3 = w19
            }
          }
        }
      }
    }
    frame 2 {
      Array Index(array=$"grid 2") -> (out0[$row, $col]=w31)
      case (w31) {
        frame Default {
          w1 = $"grid 2"
          w2 = FALSE
          w3 = $col
          w4 = $row
        }
        frame 3, 11, 19 {
          Is Greater Or Equal(x=$col, y=1) -> w32
          Increment(x=$row) -> w33
          Decrement(x=$col) -> w34
          Array Index(array=$"grid 2") -> (out0[w33, w34]=w35)
          Is Equal(x=w35, y=0) -> w36
          Array Index(array=$"grid 2") -> (out0[$row, w34]=w37)
          # The pointed to half of the pill is on the bottom
          Is Equal(x=w37, y=0) -> w38
          Logical And(w36, w38) -> w39
          Logical And(w39, w32) -> w40
          case (w40) {
            frame False, Default {
              w1 = $"grid 2"
              w2 = FALSE
              w3 = $col
              w4 = $row
            }
            frame True {
              call "MovePillLeft.gvi"(grid 2=$"grid 2", row=$row, col=$col) -> (output array=w1)
              Decrement(x=$col) -> w3
              w2 = FALSE
              w4 = $row
            }
          }
        }
        frame 4, 12, 20 {
          Subtract(x=$col, y=2) -> w41
          Array Index(array=$"grid 2") -> (out0[$row, w41]=w42)
          Is Equal(x=w42, y=0) -> w43
          Is Greater Or Equal(x=$col, y=2) -> w44
          Logical And(w43, w44) -> w45
          case (w45) {
            frame False, Default {
              w1 = $"grid 2"
              w2 = FALSE
              w4 = $row
              w3 = $col
            }
            frame True {
              call "MovePillLeft.gvi"(grid 2=$"grid 2", row=$row, col=$col) -> (output array=w1)
              Decrement(x=$col) -> w3
              w2 = FALSE
              w4 = $row
            }
          }
        }
        frame 5, 13, 21 {
          Decrement(x=$col) -> w46
          Array Index(array=$"grid 2") -> (out0[$row, w46]=w47)
          Is Equal(x=w47, y=0) -> w48
          Is Greater Or Equal(x=$col, y=1) -> w49
          Logical And(w48, w49) -> w50
          case (w50) {
            frame False, Default {
              w1 = $"grid 2"
              w2 = FALSE
              w4 = $row
              w3 = $col
            }
            frame True {
              call "MovePillLeft.gvi"(grid 2=$"grid 2", row=$row, col=$col) -> (output array=w1)
              Decrement(x=$col) -> w3
              w2 = FALSE
              w4 = $row
            }
          }
        }
        frame 6, 14, 22 {
          Is Greater Or Equal(x=$col, y=1) -> w51
          Decrement(x=$row) -> w52
          Decrement(x=$col) -> w53
          Array Index(array=$"grid 2") -> (out0[w52, w53]=w54)
          Is Equal(x=w54, y=0) -> w55
          Array Index(array=$"grid 2") -> (out0[$row, w53]=w56)
          # The pointed to half of the pill is on the bottom
          Is Equal(x=w56, y=0) -> w57
          Logical And(w55, w57) -> w58
          Logical And(w58, w51) -> w59
          case (w59) {
            frame False, Default {
              w1 = $"grid 2"
              w2 = FALSE
              w4 = $row
              w3 = $col
            }
            frame True {
              call "MovePillLeft.gvi"(grid 2=$"grid 2", row=$row, col=$col) -> (output array=w1)
              Decrement(x=$col) -> w3
              w2 = FALSE
              w4 = $row
            }
          }
        }
      }
    }
    frame 3 {
      Array Index(array=$"grid 2") -> (out0[$row, $col]=w60)
      case (w60) {
        frame Default {
          w1 = $"grid 2"
          w2 = FALSE
        }
        frame 3, 11, 19 {
          Increment(x=$row) -> w61
          Increment(x=w61) -> w62
          Array Index(array=$"grid 2") -> (out0[w62, $col]=w63)
          Is Equal(x=w63, y=0) -> w64
          # The pointed to half of the pill is on the top
          Is Less Or Equal(x=$row, y=13) -> w65
          Logical And(w64, w65) -> w66
          case (w66) {
            frame False, Default {
              # Space below filled
              # make pill inactive
              w1 = $"grid 2"
              w2 = TRUE
            }
            frame True {
              call "MovePillDown.gvi"(grid 2=$"grid 2", row=$row, col=$col) -> (output array=w1)
              # Space below empty
              # Move Block Down
              w2 = FALSE
            }
          }
        }
        frame 4, 12, 20 {
          Increment(x=$row) -> w67
          Array Index(array=$"grid 2") -> (out0[w67, $col]=w68)
          Is Equal(x=w68, y=0) -> w69
          Increment(x=$row) -> w70
          Decrement(x=$col) -> w71
          Array Index(array=$"grid 2") -> (out0[w70, w71]=w72)
          Is Equal(x=w72, y=0) -> w73
          Logical And(w69, w73) -> w74
          Is Less Or Equal(x=$row, y=14) -> w75
          Logical And(w74, w75) -> w76
          case (w76) {
            frame False, Default {
              # Space below filled
              # make pill inactive
              w1 = $"grid 2"
              w2 = TRUE
            }
            frame True {
              call "MovePillDown.gvi"(grid 2=$"grid 2", row=$row, col=$col) -> (output array=w1)
              # Space below empty
              # Move Block Down
              w2 = FALSE
            }
          }
        }
        frame 5, 13, 21 {
          Increment(x=$row) -> w77
          Array Index(array=$"grid 2") -> (out0[w77, $col]=w78)
          Is Equal(x=w78, y=0) -> w79
          Increment(x=$row) -> w80
          Increment(x=$col) -> w81
          Array Index(array=$"grid 2") -> (out0[w80, w81]=w82)
          Is Equal(x=w82, y=0) -> w83
          Logical And(w79, w83) -> w84
          Is Less Or Equal(x=$row, y=14) -> w85
          Logical And(w84, w85) -> w86
          case (w86) {
            frame False, Default {
              # Space below filled
              # make pill inactive
              w1 = $"grid 2"
              w2 = TRUE
            }
            frame True {
              call "MovePillDown.gvi"(grid 2=$"grid 2", row=$row, col=$col) -> (output array=w1)
              # Space below empty
              # Move Block Down
              w2 = FALSE
            }
          }
        }
        frame 6, 14, 22 {
          Increment(x=$row) -> w87
          Array Index(array=$"grid 2") -> (out0[w87, $col]=w88)
          Is Equal(x=w88, y=0) -> w89
          # The pointed to half of the pill is on the bottom
          Is Less Or Equal(x=$row, y=14) -> w90
          Logical And(w89, w90) -> w91
          case (w91) {
            frame False, Default {
              # Space below filled
              # make pill inactive
              w1 = $"grid 2"
              w2 = TRUE
            }
            frame True {
              call "MovePillDown.gvi"(grid 2=$"grid 2", row=$row, col=$col) -> (output array=w1)
              # Space below empty
              # Move Block Down
              w2 = FALSE
            }
          }
        }
      }
      Increment(x=$row) -> w4
      w3 = $col
    }
    frame 4 {
      Array Index(array=$"grid 2") -> (out0[$row, $col]=w92)
      case (w92) {
        frame Default {
          w1 = $"grid 2"
          w2 = FALSE
          w3 = $col
          w4 = $row
        }
        frame 3, 11, 19 {
          Is Less Or Equal(x=$col, y=6) -> w93
          Increment(x=$row) -> w94
          Increment(x=$col) -> w95
          Array Index(array=$"grid 2") -> (out0[w94, w95]=w96)
          Is Equal(x=w96, y=0) -> w97
          Array Index(array=$"grid 2") -> (out0[$row, w95]=w98)
          # The pointed to half of the pill is on the bottom
          Is Equal(x=w98, y=0) -> w99
          Logical And(w97, w99) -> w100
          Logical And(w100, w93) -> w101
          case (w101) {
            frame False, Default {
              w1 = $"grid 2"
              w2 = FALSE
              w3 = $col
              w4 = $row
            }
            frame True {
              call "MovePillRight.gvi"(grid 2=$"grid 2", row=$row, col=$col) -> (output array=w1)
              Increment(x=$col) -> w3
              w2 = FALSE
              w4 = $row
            }
          }
        }
        frame 4, 12, 20 {
          Decrement(x=$col) -> w102
          Add(2, w102) -> w103
          Array Index(array=$"grid 2") -> (out0[$row, w103]=w104)
          Is Equal(x=w104, y=0) -> w105
          Is Less Or Equal(x=w102, y=6) -> w106
          Logical And(w105, w106) -> w107
          case (w107) {
            frame False, Default {
              w1 = $"grid 2"
              w2 = FALSE
              w4 = $row
              w3 = $col
            }
            frame True {
              call "MovePillRight.gvi"(grid 2=$"grid 2", row=$row, col=w102) -> (output array=w1)
              Increment(x=$col) -> w3
              w2 = FALSE
              w4 = $row
            }
          }
        }
        frame 5, 13, 21 {
          Add(2, $col) -> w108
          Array Index(array=$"grid 2") -> (out0[$row, w108]=w109)
          Is Equal(x=w109, y=0) -> w110
          Is Less Or Equal(x=$col, y=5) -> w111
          Logical And(w110, w111) -> w112
          case (w112) {
            frame False, Default {
              w1 = $"grid 2"
              w2 = FALSE
              w4 = $row
              w3 = $col
            }
            frame True {
              call "MovePillRight.gvi"(grid 2=$"grid 2", row=$row, col=$col) -> (output array=w1)
              Increment(x=$col) -> w3
              w2 = FALSE
              w4 = $row
            }
          }
        }
        frame 6, 14, 22 {
          Is Less Or Equal(x=$col, y=6) -> w113
          Decrement(x=$row) -> w114
          Increment(x=$col) -> w115
          Array Index(array=$"grid 2") -> (out0[w114, w115]=w116)
          Is Equal(x=w116, y=0) -> w117
          Array Index(array=$"grid 2") -> (out0[$row, w115]=w118)
          # The pointed to half of the pill is on the bottom
          Is Equal(x=w118, y=0) -> w119
          Logical And(w117, w119) -> w120
          Logical And(w120, w113) -> w121
          case (w121) {
            frame False, Default {
              w1 = $"grid 2"
              w2 = FALSE
              w4 = $row
              w3 = $col
            }
            frame True {
              call "MovePillRight.gvi"(grid 2=$"grid 2", row=$row, col=$col) -> (output array=w1)
              Increment(x=$col) -> w3
              w2 = FALSE
              w4 = $row
            }
          }
        }
      }
    }
  }
  $"Output Array" <- w1
  $Fallen <- w2
  Is Equal(x=$"Move how?", y=3) -> w122
  $"Reset Timer" <- w122
  $"row 2" <- w4
  $"col 2" <- w3
