vi "MovePillRight.gvi"   [LabVIEW NXG 3.1.0]
inputs:
  "grid 2": i8[][]
  "row": i32
  "col": i32
outputs:
  "output array": i8[][]
uses:
  WebApp::MovePillSegmentRight.gvi
diagram:
  Array Index(array=$"grid 2") -> (out0[$row, $col]=w1)
  case (w1) {
    frame 4, 12, 20 {
      call "MovePillSegmentRight.gvi"(grid 2=$"grid 2", row=$row, col=$col) -> (output array=w3)
      Decrement(x=$col) -> w4
      call "MovePillSegmentRight.gvi"(grid 2=w3, row=$row, col=w4) -> (output array=w2)
    }
    frame 5, 13, 21 {
      Increment(x=$col) -> w5
      call "MovePillSegmentRight.gvi"(grid 2=$"grid 2", row=$row, col=w5) -> (output array=w6)
      call "MovePillSegmentRight.gvi"(grid 2=w6, row=$row, col=$col) -> (output array=w2)
    }
    frame 6, 14, 22 {
      call "MovePillSegmentRight.gvi"(grid 2=$"grid 2", row=$row, col=$col) -> (output array=w7)
      Decrement(x=$row) -> w8
      call "MovePillSegmentRight.gvi"(grid 2=w7, row=w8, col=$col) -> (output array=w2)
    }
    frame 3, 11, 19, Default {
      Increment(x=$row) -> w9
      call "MovePillSegmentRight.gvi"(grid 2=$"grid 2", row=w9, col=$col) -> (output array=w10)
      call "MovePillSegmentRight.gvi"(grid 2=w10, row=$row, col=$col) -> (output array=w2)
    }
  }
  $"output array" <- w2
