vi "MovePillRotateA.gvi"   [LabVIEW NXG 3.1.0]
inputs:
  "grid 2": i8[][]
  "row": i32
  "col": i32
outputs:
  "output array": i8[][]
uses:
  WebApp::SwapLocations.gvi
diagram:
  Array Index(array=$"grid 2") -> (out0[$row, $col]=w1)
  case (w1) {
    frame 4, 12, 20 {
      Decrement(x=$row) -> w3
      Decrement(x=$col) -> w4
      call "SwapLocations.gvi"(grid 2=$"grid 2", row1=$row, col1=w4, row2=w3, col2=w4) -> (output array=w5)
      call "SwapLocations.gvi"(grid 2=w5, row1=$row, col1=$col, row2=$row, col2=w3) -> (output array=w6)
      Array Index(array=w6) -> (out0[$row, w4]=w7)
      Increment(x=w7) -> w8
      Increment(x=w8) -> w9
      Replace Array Subset(inArray=w6, index=$row, index=w4, new=w9) -> w10
      Array Index(array=w10) -> (out0[w3, w4]=w11)
      Subtract(x=w11, y=2) -> w12
      Replace Array Subset(inArray=w10, index=w3, index=w4, new=w12) -> w2
    }
    frame 5, 13, 21 {
      Decrement(x=$row) -> w13
      Increment(x=$col) -> w14
      Decrement(x=w14) -> w15
      call "SwapLocations.gvi"(grid 2=$"grid 2", row1=$row, col1=w15, row2=w13, col2=w15) -> (output array=w16)
      call "SwapLocations.gvi"(grid 2=w16, row1=$row, col1=w14, row2=$row, col2=w15) -> (output array=w17)
      Array Index(array=w17) -> (out0[$row, w15]=w18)
      Increment(x=w18) -> w19
      Increment(x=w19) -> w20
      Replace Array Subset(inArray=w17, index=$row, index=w15, new=w20) -> w21
      Array Index(array=w21) -> (out0[w13, w15]=w22)
      Subtract(x=w22, y=2) -> w23
      Replace Array Subset(inArray=w21, index=w13, index=w15, new=w23) -> w2
    }
    frame 6, 14, 22 {
      Decrement(x=$row) -> w24
      Increment(x=w24) -> w25
      Increment(x=$col) -> w26
      call "SwapLocations.gvi"(grid 2=$"grid 2", row1=w24, col1=$col, row2=w25, col2=w26) -> (output array=w27)
      Array Index(array=w27) -> (out0[w25, $col]=w28)
      Decrement(x=w28) -> w29
      Replace Array Subset(inArray=w27, index=w25, index=$col, new=w29) -> w30
      Array Index(array=w30) -> (out0[w25, w26]=w31)
      Increment(x=w31) -> w32
      Replace Array Subset(inArray=w30, index=w25, index=w26, new=w32) -> w2
    }
    frame 3, 11, 19, Default {
      Increment(x=$row) -> w33
      Increment(x=$col) -> w34
      call "SwapLocations.gvi"(grid 2=$"grid 2", row1=$row, col1=$col, row2=w33, col2=w34) -> (output array=w35)
      Array Index(array=w35) -> (out0[w33, $col]=w36)
      Decrement(x=w36) -> w37
      Replace Array Subset(inArray=w35, index=w33, index=$col, new=w37) -> w38
      Array Index(array=w38) -> (out0[w33, w34]=w39)
      Increment(x=w39) -> w40
      Replace Array Subset(inArray=w38, index=w33, index=w34, new=w40) -> w2
    }
  }
  $"output array" <- w2
