vi "MovePillRotateB.gvi"   [LabVIEW NXG 3.1.0]
inputs:
  "grid 2": i8[][]
  "row": i32
  "col": i32
outputs:
  "output array": i8[][]
uses:
  WebApp::MovePillRotateA.gvi
diagram:
  Array Index(array=$"grid 2") -> (out0[$row, $col]=w1)
  case (w1) {
    frame 3, 11, 19 {
      Increment(x=$row) -> w3
      w2 = $col
    }
    frame Default {
      w2 = $row
      w3 = $col
    }
    frame 4, 12, 20 {
      Decrement(x=$col) -> w2
      w3 = $row
    }
  }
  call "MovePillRotateA.gvi"(grid 2=$"grid 2", row=w2, col=w3) -> (output array=w4)
  call "MovePillRotateA.gvi"(grid 2=w4, row=w2, col=w3) -> (output array=w5)
  call "MovePillRotateA.gvi"(grid 2=w5, row=w2, col=w3) -> (output array=w6)
  $"output array" <- w6
