vi "MovePillSegmentRight.gvi"   [LabVIEW Conversion 3.1.0]
inputs:
  "grid 2": i8[][]
  "row": i32
  "col": i32
outputs:
  "output array": i8[][]
diagram:
  Array Index(array=$"grid 2") -> (out0[$row, $col]=w1)
  Increment(x=$col) -> w2
  Replace Array Subset(inArray=$"grid 2", index=$row, index=w2, new=w1) -> w3
  Replace Array Subset(inArray=w3, index=$row, index=$col, new=0) -> w4
  $"output array" <- w4
