vi "PillHalf2Segment.gvi"   [LabVIEW NXG 3.1.0]
inputs:
  "grid 2": i8[][]
  "Row": i32
  "Col": i32
outputs:
  "grid 3": i8[][]
uses:
  WebApp::GetColor.gvi
diagram:
  Array Index(array=$"grid 2") -> (out0[$Row, $Col]=w1)
  call "GetColor.gvi"(Numeric=w1) -> (Numeric 2=w2)
  Multiply(w2, 8) -> w3
  Subtract(x=w3, y=7) -> w4
  Replace Array Subset(inArray=$"grid 2", index=$Row, index=$Col, new=w4) -> w5
  $"grid 3" <- w5
