vi "SwapLocations.gvi"   [LabVIEW Conversion 3.1.0]
inputs:
  "grid 2": i8[][]
  "row1": i32
  "col1": i32
  "row2": i32
  "col2": i32
outputs:
  "output array": i8[][]
diagram:
  Array Index(array=$"grid 2") -> (out0[$row1, $col1]=w1)
  Array Index(array=$"grid 2") -> (out0[$row2, $col2]=w2)
  sequence {
    frame 0 {
      Replace Array Subset(inArray=$"grid 2", index=$row1, index=$col1, new=w2) -> w3
      Replace Array Subset(inArray=w3, index=$row2, index=$col2, new=w1) -> w4
    }
  }
  $"output array" <- w4
