vi "display_array.gvi"   [LabVIEW Conversion 3.1.0]
inputs:
  "picsArray": string[]
  "grid": i8[][]
  "LeftSide": i8
  "RightSide": i8
  "error in (no error)": error
outputs:
  "pillbox": string[][]
  "NextPill": string[]
  "error out": error
diagram:
  To Long Integer(number=$LeftSide) -> w1
  Array Index(array=$picsArray) -> (out0[w1]=w2)
  To Long Integer(number=$RightSide) -> w3
  Array Index(array=$picsArray) -> (out0[w3]=w4)
  Build Array(w2, w4) -> w5
  $NextPill <- w5
  for (N = 16) {
    w6 = each element of $grid
    for (N = 8) {
      w8 = each element of w6
      To Long Integer(number=w8) -> w10
      Array Index(array=$picsArray) -> (out0[w10]=w11)
      append w11 to w9
    }
    append w9 to w7
  }
  $pillbox <- w7
  $"error out" <- $"error in (no error)"
