vi "index.gviweb"   [LabVIEW NXG 3.1.0]
panel controls:
  "error in (no error)": error
  "PicsArray": string[]
  "Volume": i32 = 78
  "rotateleft": bool
  "rotateright": bool
  "left": bool
  "right": bool
  "down": bool
panel indicators:
  "error out": error
  "Virus Count": i32
  "Stop": bool
  "Pill State": enum{"Gravitating", "Gravitated"}
  "wait": u32
  "Speed": string
  "Output Vol": f64
  "NextPill": string[]
  "pillbox": string[][]
  "grid 2": i8[][]
  "State": T1
  "Level": i32
  "Sound": bool
types:
  T1 = enum{"Initializing", "Throwing", "Falling", "Fallen", "Adjusting", "Won", "Lost"}
uses:
  WebApp::InitPics.gvi
  WebApp::InitGrid.gvi
  WebApp::RandomPill.gvi
  WebApp::display_array.gvi
  WebApp::MovePill.gvi
  WebApp::DropPill.gvi
  WebApp::FindStraights.gvi
  WebApp::DissipateStraights.gvi
  WebApp::GravitateGrid.gvi
  WebApp::ArrayNotEqual.gvi
  WebApp::win.gvi
  WebApp::lose.gvi
  WebApp::menu.gvi
  WebApp::Insert viruses.gvi
  WebApp::mywait.gvi
diagram:
  w1 = $"error in (no error)"
  sequence (after 75) {
    frame 0 {
      case (0) {
        frame 0 {
          $Speed <- "Low"
          $wait <- 800
        }
        frame 1, Default {
          $Speed <- "Medium"
          $wait <- 400
        }
        frame 2 {
          $Speed <- "High"
          $wait <- 200
        }
        frame 3 {
          $Speed <- "AE"
          $wait <- 75
        }
      }
      $"Pill State" <- "Gravitating"
      $Stop <- FALSE
    }
  }
  To Long Integer(number=0) -> w2
  Add(w2, 1) -> w3
  Multiply(w3, 4) -> w4
  $"Virus Count" <- w4
  $"Output Vol" <- 75
  call "InitPics.gvi"() -> (Array=w5)
  $PicsArray <- w5
  call "InitGrid.gvi"(error in (no error)=w1) -> (Array=w6, error out=w7)
  call "RandomPill.gvi"() -> (Left=w8, Right=w9)
  call "display_array.gvi"(picsArray=w5, grid=w6, LeftSide=w8, RightSide=w9, error in (no error)=w7) -> (pillbox=w10, NextPill=w11, error out=w12)
  $pillbox <- w10
  Obtain Queue(create if not found=TRUE, element data type=string "", error in=w12, name="EventsToProcess") -> (error out=w13, queue out=w14)
  s1 = "Initializing"  # shift register
  s2 = w6  # shift register
  s3 = 0  # shift register
  s4 = 3  # shift register
  s5 = w12  # shift register
  s6 = w2  # shift register
  s7 = w9  # shift register
  s8 = w8  # shift register
  while {
    case (s1) {
      frame "Falling", Default {
        Flush Queue(error in=s5, queue=w14) -> (error out=w24, queue out=w25)
        sequence {
          frame 0 {
            $"Pill State" <- "Gravitated"
          }
        }
        Dequeue Element(error in=w24, queue=w25, timeout in ms=1000) -> (element=w26)
        case (w26) {
          frame "", Default {
            w15 = s2
            w16 = s3
            w17 = s4
            w27 = FALSE
          }
          frame "rotation_a" {
            call "MovePill.gvi"(grid 2=s2, Move how?=1, row=s3, col=s4) -> (Output Array=w15, Fallen=w27, row 2=w16, col 2=w17)
          }
          frame "rotation_b" {
            call "MovePill.gvi"(grid 2=s2, Move how?=0, row=s3, col=s4) -> (Output Array=w15, Fallen=w27, row 2=w16, col 2=w17)
          }
          frame "left" {
            call "MovePill.gvi"(grid 2=s2, Move how?=2, row=s3, col=s4) -> (Output Array=w15, Fallen=w27, row 2=w16, col 2=w17)
          }
          frame "down" {
            call "MovePill.gvi"(grid 2=s2, Move how?=3, row=s3, col=s4) -> (Output Array=w15, Fallen=w27, row 2=w16, col 2=w17)
          }
          frame "right" {
            call "MovePill.gvi"(grid 2=s2, Move how?=4, row=s3, col=s4) -> (Output Array=w15, Fallen=w27, row 2=w16, col 2=w17)
          }
          frame "Gravitate" {
            call "MovePill.gvi"(grid 2=s2, Move how?=3, row=s3, col=s4) -> (Output Array=w15, Fallen=w27, row 2=w16, col 2=w17)
          }
        }
        Select(s=w27, t="Fallen", f="Falling") -> w19
        w18 = s5
        w20 = FALSE
        w21 = s6
        w22 = s7
        w23 = s8
      }
      frame "Throwing" {
        call "DropPill.gvi"(grid=s2, LeftSide=s8, RightSide=s7, error in (no error)=s5) -> (grid 2=w15, Lost=w28, error out=w18)
        call "RandomPill.gvi"() -> (Left=w23, Right=w22)
        call "display_array.gvi"(picsArray=$PicsArray, grid=w15, LeftSide=w23, RightSide=w22) -> (pillbox=w29, NextPill=w30)
        $pillbox <- w29
        $NextPill <- w30
        Select(s=w28, t="Lost", f="Falling") -> w19
        w16 = 0
        w17 = 3
        w20 = FALSE
        w21 = s6
      }
      frame "Fallen" {
        call "FindStraights.gvi"(grid 2=s2) -> (grid 3=w31, Straight Count=w32, Remaining Viruses=w33)
        Is Greater Than 0(x=w32) -> w34
        Select(s=w34, t="Adjusting", f="Throwing") -> w35
        Is Equal To 0(x=w33) -> w36
        Select(s=w36, t="Won", f=w35) -> w19
        $"Virus Count" <- w33
        case (w34) {
          frame False, Default {
            call "display_array.gvi"(picsArray=$PicsArray, grid=w31, LeftSide=s8, RightSide=s7) -> (pillbox=w37)
            $pillbox <- w37
            sequence {
              frame 0 {
                Wait(time to wait=250)
              }
            }
            w15 = w31
          }
          frame True {
            sequence {
              frame 0 {
                call "display_array.gvi"(picsArray=$PicsArray, grid=w31, LeftSide=s8, RightSide=s7) -> (pillbox=w38)
                $pillbox <- w38
              }
            }
            sequence {
              frame 0 {
                Wait(time to wait=250)
              }
            }
            call "DissipateStraights.gvi"(grid 2=w31) -> (grid 3=w15)
            sequence {
              frame 0 {
                call "display_array.gvi"(picsArray=$PicsArray, grid=w15, LeftSide=s8, RightSide=s7) -> (pillbox=w39)
                $pillbox <- w39
              }
            }
            sequence {
              frame 0 {
                Wait(time to wait=250)
              }
            }
          }
        }
        while {
          Get Queue Status(queue=w14) -> (# elements in queue=w40, queue out=w41)
          Is Greater Than 0(x=w40) -> w42
          case (w42) {
            frame False, Default { }
            frame True {
              Dequeue Element(queue=w41)
            }
          }
          continue if w42
        }
        w16 = 0
        w17 = 3
        w18 = s5
        w20 = FALSE
        w21 = s6
        w22 = s7
        w23 = s8
      }
      frame "Adjusting" {
        s9 = s2  # shift register
        while {
          call "GravitateGrid.gvi"(grid 2=s9) -> (grid 3=w43)
          call "display_array.gvi"(picsArray=$PicsArray, grid=w43, LeftSide=s8, RightSide=s7) -> (pillbox=w44)
          $pillbox <- w44
          call "ArrayNotEqual.gvi"(grid 2=w43, grid 3=s9) -> (Not Equal=w45)
          sequence {
            frame 0 {
              Wait(time to wait=250)
            }
          }
          next s9 = w43
          continue if w45
        }
        w15 = s9
        w16 = 0
        w17 = 3
        w18 = s5
        w19 = "Fallen"
        w20 = FALSE
        w21 = s6
        w22 = s7
        w23 = s8
      }
      frame "Won" {
        Increment(x=s6) -> w21
        call "InitGrid.gvi"() -> (Array=w15)
        sequence {
          frame 0 { }
        }
        call "win.gvi"() -> (Boolean=w46)
        sequence (after w46) {
          frame 0 {
            Wait(time to wait=1000)
          }
        }
        w16 = s3
        w17 = s4
        w18 = s5
        w19 = "Initializing"
        w20 = FALSE
        w22 = s7
        w23 = s8
      }
      frame "Lost" {
        call "lose.gvi"() -> (Output=w47)
        case (w47) {
          frame 0, Default {
            Add(s6, 1) -> w48
            Multiply(w48, 4) -> w49
            $"Virus Count" <- w49
            call "InitGrid.gvi"() -> (Array=w15)
            w20 = FALSE
            w18 = s5
            w17 = s4
            w16 = s3
            w21 = s6
            w19 = "Initializing"
          }
          frame 1 {
            call "menu.gvi"() -> (Virus Level=w50, Speed=w51, Music=w52)
            To Long Integer(number=w50) -> w21
            Add(w21, 1) -> w53
            Multiply(w53, 4) -> w54
            $"Virus Count" <- w54
            case (w51) {
              frame 0 {
                $Speed <- "Low"
                $wait <- 800
              }
              frame 1, Default {
                $Speed <- "Medium"
                $wait <- 400
              }
              frame 2 {
                $Speed <- "High"
                $wait <- 200
              }
              frame 3 {
                $Speed <- "AE"
                $wait <- 75
              }
            }
            case (w52) {
              frame 0, Default {
                To Double Precision Float(number=$Volume) -> w55
                $"Output Vol" <- w55
                $Sound <- FALSE
              }
              frame 1 {
                To Double Precision Float(number=$Volume) -> w56
                $"Output Vol" <- w56
                $Sound <- FALSE
              }
              frame 2 {
                To Double Precision Float(number=0) -> w57
                $"Output Vol" <- w57
                $Sound <- TRUE
              }
            }
            call "InitGrid.gvi"() -> (Array=w15)
            w20 = FALSE
            w18 = s5
            w17 = s4
            w16 = s3
            w19 = "Initializing"
          }
          frame 2 {
            w20 = TRUE
            w18 = s5
            w17 = s4
            w16 = s3
            w15 = s2
            w21 = s6
            w19 = "Lost"
          }
        }
        $Stop <- w20
        w22 = s7
        w23 = s8
      }
      frame "Initializing" {
        Add(s6, 1) -> w58
        Multiply(w58, 4) -> w59
        $"Virus Count" <- w59
        call "Insert viruses.gvi"(grid=s2, viruses=w59) -> (grid 2=w15)
        call "display_array.gvi"(picsArray=$PicsArray, grid=w15, LeftSide=s8, RightSide=s7) -> (pillbox=w60)
        $pillbox <- w60
        w16 = s3
        w17 = s4
        w18 = s5
        w19 = "Throwing"
        w20 = FALSE
        w21 = s6
        w22 = s7
        w23 = s8
      }
    }
    Logical Or(w20, $Stop) -> w61
    $"Pill State" <- $"Pill State"
    $Level <- s6
    call "display_array.gvi"(picsArray=w5, grid=s2, LeftSide=s8, RightSide=s7) -> (pillbox=w62, NextPill=w63)
    $pillbox <- w62
    $State <- s1
    $NextPill <- w63
    $"grid 2" <- s2
    next s1 = w19
    next s2 = w15
    next s3 = w16
    next s4 = w17
    next s5 = w18
    next s6 = w21
    next s7 = w22
    next s8 = w23
    stop if w61
  }
  $"error out" <- s5
  $NextPill <- w11
  while {  # User Interface Event Handling Loop
    Wait(time to wait=40)
    event (timeout = 40) {
      on "rotateleft" Value changed {
        Enqueue Element(element="rotation_a", error in=w13, queue=w14) -> (error out=w64)
      }
      on "rotateright" Value changed {
        Enqueue Element(element="rotation_b", error in=w13, queue=w14) -> (error out=w64)
      }
      on "left" Value changed {
        Enqueue Element(element="left", error in=w13, queue=w14) -> (error out=w64)
      }
      on "right" Value changed {
        Enqueue Element(element="right", error in=w13, queue=w14) -> (error out=w64)
      }
      on "down" Value changed {
        $"Pill State" <- "Gravitating"
        Enqueue Element(element="down", error in=w13, queue=w14) -> (error out=w64)
      }
      on Timeout {
        w64 = w13
      }
    }
    stop if $Stop
  }
  Merge Errors(s5, w64)
  while {
    Is Equal(x=$State, y="Falling") -> w65
    Is Equal(x=$"Pill State", y="Gravitated") -> w66
    Logical And(w65, w66) -> w67
    case (w67) {
      frame False, Default {
        Wait(time to wait=25)
      }
      frame True {
        call "mywait.gvi"(milliseconds to wait=$wait, error in (no error)=w13) -> (error out=w68)
        sequence {
          frame 0 {
            $"Pill State" <- "Gravitating"
          }
        }
        Enqueue Element(element="Gravitate", error in=w68, queue=w14)
      }
    }
    stop if $Stop
  }
