vi "Get Click Position.gvi"   [LabVIEW NXG 3.1.0]
# Converts click position from screen pixel coordinates to graph coordinates.
inputs:
  "Intensity Graph Ref": "IntensityGraph reference", required
  "Coordinates": "Position (Old).gtype", required
outputs:
  "Click Position": cluster{"Element 1": i32, "Element 2": i32}
types:
  "Position (Old).gtype" = cluster{"Horizontal": i32, "Vertical": i32}
diagram:
  Property Node(instance in=$"Intensity Graph Ref")
  Subtract(x=0, y=0) -> w1
  Property Node(instance in=$Coordinates) -> ("Horizontal"=w2, "Vertical"=w3)
  Subtract(x=w2, y=0) -> w4
  Divide(x=w4, y=w1) -> w5
  Multiply(0, w5) -> w6
  To Long Integer(number=w6) -> w7
  Subtract(x=0, y=0) -> w8
  Subtract(x=w3, y=0) -> w9
  Divide(x=w9, y=w8) -> w10
  Multiply(0, w10) -> w11
  To Long Integer(number=w11) -> w12
  w13 = cluster{"Element 1": i32, "Element 2": i32} {all zero or empty}
  Property Node(instance in=w13, "Element 1"=w7, "Element 2"=w12) -> (instance out=w14)
  $"Click Position" <- w14
