vi "Fire.gvi"   [G Web Development Software 22.3.0]
# LabVIEW port of the Doom PSX fire effect. See Fabien Sanglard's write-up for more info:
# http://fabiensanglard.net/doom_fire_psx/
panel controls:
  "FPS": i32 = 27
  "Start Fire": bool
  "Stop Fire": bool
panel indicators:
  "Demonic Intensity Graph": i32[][]
uses:
  Library::Init Pixel Array.gvi
  Library::Add Fire Source.gvi
  Library::Add Fire Pixel Source.gvi
  Library::Stop Fire.gvi
  Library::Do Fire.gvi
diagram:
  w1 = cluster{"Element 1": i32, "Element 2": i32} {all zero or empty}
  # SEQ containing latest mouse click coordinate.
  Obtain Queue(element data type=w1, max queue size=1) -> (queue out=w2)
  w3 = cluster{"Element 1": i32, "Element 2": i32} {"Element 1"=45, "Element 2"=45}
  Lossy Enqueue Element(element=w3, queue=w2)
  # R, G, B
  # 0x07,0x07,0x07,
  # 0x1F,0x07,0x07,
  # 0x2F,0x0F,0x07,
  # 0x47,0x0F,0x07,
  # 0x57,0x17,0x07,
  # 0x67,0x1F,0x07,
  # 0x77,0x1F,0x07,
  # 0x8F,0x27,0x07,
  # 0x9F,0x2F,0x07,
  # 0xAF,0x3F,0x07,
  # 0xBF,0x47,0x07,
  # 0xC7,0x47,0x07,
  # 0xDF,0x4F,0x07,
  # 0xDF,0x57,0x07,
  # 0xDF,0x57,0x07,
  # 0xD7,0x5F,0x07,
  # 0xD7,0x5F,0x07,
  # 0xD7,0x67,0x0F,
  # 0xCF,0x6F,0x0F,
  # 0xCF,0x77,0x0F,
  # 0xCF,0x7F,0x0F,
  # 0xCF,0x87,0x17,
  # 0xC7,0x87,0x17,
  # 0xC7,0x8F,0x17,
  # 0xC7,0x97,0x1F,
  # 0xBF,0x9F,0x1F,
  # 0xBF,0x9F,0x1F,
  # 0xBF,0xA7,0x27,
  # 0xBF,0xA7,0x27,
  # 0xBF,0xAF,0x2F,
  # 0xB7,0xAF,0x2F,
  # 0xB7,0xB7,0x2F,
  # 0xB7,0xB7,0x37,
  # 0xCF,0xCF,0x6F,
  # 0xDF,0xDF,0x9F,
  # 0xEF,0xEF,0xC7,
  # 0xFF,0xFF,0xFF
  call "Init Pixel Array.gvi"(Width=320, Height=168) -> (Pixel Array=w4)
  call "Add Fire Source.gvi"(Pixel Array In=w4, Width=320) -> (Pixel Array Out=w5)
  s1 = w5  # shift register
  s2 = FALSE  # shift register
  while {
    Reciprocal(x=$FPS) -> w6
    Multiply(w6, 1000) -> w7
    Wait(time to wait=w7)
    Dequeue Element(queue=w2, timeout in ms=0) -> (element=w8, error out=w9, timed out?=w10)
    case (w10) {
      frame False, Default {
        call "Add Fire Pixel Source.gvi"(Pixel Array In=s1, Width=320, Height=168, Click Position=w8) -> (Pixel Array Out=w11)
      }
      frame True {
        w11 = s1
      }
    }
    case ($"Start Fire") {
      frame False, Default {
        w12 = w11
        w13 = s2
      }
      frame True {
        call "Add Fire Source.gvi"(Pixel Array In=w11, Width=320) -> (Pixel Array Out=w12)
        w13 = FALSE
      }
    }
    Logical Or(w13, $"Stop Fire") -> w14
    case (w14) {
      frame False, Default {
        w15 = w12
        w16 = w13
      }
      frame True {
        call "Stop Fire.gvi"(Pixel Array In=w12, Width=320, Height=168) -> (Pixel Array Out=w15)
        w16 = TRUE
      }
    }
    call "Do Fire.gvi"(Pixel Array In=w15, Width=320, Height=168) -> (Pixel Array Out=w17)
    Reshape Array(inArray=w17, size=168, size=320) -> w18
    Transpose 2D Array(2D array=w18) -> (transposed array=w19)
    $"Demonic Intensity Graph" <- w19
    next s1 = w17
    next s2 = w16
    stop if w9
  }
