vi "main.gvi"   [LabVIEW NXG 5.1.0]
panel indicators:
  "XY Graph": cluster{"x": f64[], "y": f64[]}[]
types:
  "Vertex.gtype" = cluster{"x": u8, "y": u8}
  "Frame Info (XY Graph).gtype" = cluster{"Clear Screen": bool, "Palette Data": bool, "Indexed": bool, "Indexed Verts": "Vertex.gtype"[], "Frame": i32, "Plots": cluster{"x": f64[], "y": f64[]}[]}
uses:
  NICCC::Read Bytes from Scene.gvi
  NICCC::Read Byte.gvi
  NICCC::Read Word.gvi
  NI::G Core::Color Picker::RGBA to Color.gvi
diagram:
  Initialize Array(element=cluster{"x": f64[], "y": f64[]} {all zero or empty}, size=16) -> w1
  w2 = "Init"  # State
  # See http://arsantica-online.com/st-niccc-competition/ for binary file + format details.
  s1 = w2  # shift register
  s2 = "Frame Info (XY Graph).gtype" {all zero or empty}  # shift register
  while {
    case (s1) {
      frame "Init" {
        call "Read Bytes from Scene.gvi"(bytes to read=0) -> (error out=w5)
        Property Node(instance in="Frame Info (XY Graph).gtype" {all zero or empty}, "Plots"=w1) -> (instance out=w3)
        w7 = "Read Flags"  # State
        w4 = w7
        w6 = default
      }
      frame "Read Flags" {
        call "Read Byte.gvi"() -> (Word=w8, error out=w5)
        Number To Boolean Array(number=w8) -> (Boolean array=w9)
        Array Index(array=w9) -> (out0[_]=w10, out1[_]=w11, out2[_]=w12)
        Property Node(instance in=s2) -> ("Frame"=w13)
        Increment(x=w13) -> w14
        Property Node(instance in=s2, "Frame"=w14, "Clear Screen"=w10, "Palette Data"=w11, "Indexed"=w12) -> (instance out=w3)
        w15 = "Clear Screen"  # State
        w4 = w15
        w6 = default
      }
      frame "Clear Screen" {
        Property Node(instance in=s2)
        # While the scene file contains a flag to clear the screen every so often, there are instances where hundreds of vertexes and filled shapes accumulate in the canvas. LabVIEW's 2D picture chokes as it is drawing each and every shape regardless of visibility. Instead just clear every frame.
        case (TRUE) {
          frame False, Default {
            w3 = s2
          }
          frame True {
            Property Node(instance in=s2, "Plots"=w1) -> (instance out=w3)
          }
        }
        w16 = "Update Palette"  # State
        w4 = w16
        w5 = default
        w6 = default
      }
      frame "Update Palette" {
        Property Node(instance in=s2) -> ("Palette Data"=w17, "Indexed"=w18)
        case (w17) {
          frame False, Default {
            w3 = s2
            w5 = default
          }
          frame True {
            call "Read Word.gvi"() -> (Word=w19, error out=w20)
            Number To Boolean Array(number=w19) -> (Boolean array=w21)
            Reverse 1D Array(array=w21) -> (reversed array=w22)
            s3 = w20  # shift register
            for (iteration -> i1) {
              w23 = each element of w22
              case (w23) {
                frame False, Default {
                  w24 = s3
                }
                frame True {
                  Property Node(instance in=reference to "XY Graph", "ActivePlot"=i1) -> ("Plot"=w25)  # Graph properties
                  call "Read Word.gvi"(error in=s3) -> (Word=w26, error out=w24)
                  Scale By Power Of 2(n=-8, x=w26) -> w27
                  Logical And(0x7, w27) -> w28
                  Multiply(36, w28) -> w29
                  Scale By Power Of 2(n=-4, x=w26) -> w30
                  Logical And(0x7, w30) -> w31
                  Multiply(36, w31) -> w32
                  Logical And(0x7, w26) -> w33
                  # Multiply by 36 to scale 3 bit color to 8 bit color
                  Multiply(36, w33) -> w34
                  call "RGBA to Color.gvi"(red=w29, green=w32, blue=w34, alpha=0xFF) -> (color=w35)
                  Property Node(instance in=w25, "Color"=w35)
                }
              }
              next s3 = w24
            }
            w3 = s2
            w5 = s3
          }
        }
        w36 = "Read Indexed"  # State
        w37 = "Draw Polygons"  # State
        Select(s=w18, t=w36, f=w37) -> w4
        w6 = default
      }
      frame "Read Indexed" {
        call "Read Byte.gvi"() -> (Word=w38, error out=w39)
        s4 = w39  # shift register
        for (N = w38) {
          call "Read Byte.gvi"(error in=s4) -> (Word=w41, error out=w42)
          call "Read Byte.gvi"(error in=w42) -> (Word=w43, error out=w44)
          Property Node(instance in="Vertex.gtype" {all zero or empty}, "y"=w43, "x"=w41) -> (instance out=w45)
          append w45 to w40
          next s4 = w44
        }
        Property Node(instance in=s2, "Indexed Verts"=w40) -> (instance out=w3)
        w46 = "Draw Polygons"  # State
        w4 = w46
        w5 = s4
        w6 = default
      }
      frame "Draw Polygons" {
        call "Read Byte.gvi"() -> (Word=w47, error out=w48)
        case (w47) {
          frame Default {
            Property Node(instance in=s2) -> ("Indexed"=w50)
            Logical And(w47, 0xF) -> w51
            case (w50) {
              frame True {
                s5 = s2  # shift register
                s6 = w48  # shift register
                for (N = w51) {
                  Property Node(instance in=s5) -> ("Indexed Verts"=w55)
                  call "Read Byte.gvi"(error in=s6) -> (Word=w56, error out=w57)
                  Array Index(array=w55) -> (out0[w56]=w58)
                  Property Node(instance in=w58) -> ("x"=w59, "y"=w60)
                  append w59 to w52
                  append w60 to w54
                  next s6 = w57
                }
                w53 = s5
                w5 = s6
              }
              frame False {
                s7 = s2  # shift register
                s8 = w48  # shift register
                for (N = w51) {
                  call "Read Byte.gvi"(error in=s8) -> (Word=w61, error out=w62)
                  call "Read Byte.gvi"(error in=w62) -> (Word=w63, error out=w64)
                  append w61 to w52
                  append w63 to w54
                  next s8 = w64
                }
                w53 = s7
                w5 = s8
              }
            }
            Scale By Power Of 2(n=-4, x=w47) -> w65
            Logical And(0xF, w65) -> w66
            Property Node(instance in=w53) -> ("Plots"=w67)
            Array Index(array=w52) -> (out0[_]=w68)
            # Insert NaN between polygons on same plot to prevent line being drawn between them.
            Array Index(array=w67) -> (out0[w66]=w69)
            Property Node(instance in=w69) -> ("x"=w70, "y"=w71)
            Build Array(w70, w52, w68, NaN) -> w72
            Array Index(array=w54) -> (out0[_]=w73)
            Build Array(w71, w54, w73, NaN) -> w74
            w75 = cluster{"Element 1": f64[], "Element 2": f64[]} {all zero or empty}
            Property Node(instance in=w75, "Element 1"=w72, "Element 2"=w74) -> (instance out=w76)
            Replace Array Subset(inArray=w67, index=w66, new=w76) -> w49
            Property Node(instance in=w53, "Plots"=w49) -> (instance out=w3)
            w77 = "Draw Polygons"  # State
            w4 = w77
          }
          frame 253..255 {
            To Double Precision Float(number=24) -> w78
            Reciprocal(x=w78) -> w79
            Multiply(w79, 1000) -> w80
            To Unsigned 32 Bit Integer(number=w80) -> w81
            Wait(time to wait=w81)
            case (w47) {
              frame Default {
                w82 = "Finish"  # State
                w4 = w82
              }
              frame 255 {
                w83 = "Read Flags"  # State
                w4 = w83
              }
              frame 254 {
                w84 = "Skip 64kB"  # State
                w4 = w84
              }
            }
            Property Node(instance in=s2) -> ("Plots"=w49)
            w3 = s2
            w5 = w48
          }
        }
        $"XY Graph" <- w49
        w6 = default
      }
      frame "Skip 64kB" {
        call "Read Bytes from Scene.gvi"(bytes to read=65535) -> (error out=w5)
        w85 = "Read Flags"  # State
        w3 = s2
        w4 = w85
        w6 = default
      }
      frame "Finish" {
        w86 = "Finish"  # State
        w3 = s2
        w4 = w86
        w5 = default
        w6 = FALSE
      }
    }
    w87 = "Finish"  # State
    Select(s=w5, t=w87, f=w4) -> w88
    next s1 = w88
    next s2 = w3
    stop if w6
  }
