vi "Main Loop.gvi"   [LabVIEW NXG 5.1.0]
inputs:
  "graph": "Graph reference"
panel controls:
  "frame info": "Frame Info (XY Graph).gtype"
types:
  "Vertex.gtype" = cluster{"x": u8, "y": u8}
  "Frame Info (XY Graph).gtype" = cluster{"Clear Screen": bool, "Palette Data": bool, "Indexed": bool, "Indexed Verts": "Vertex.gtype"[], "Frame": i32, "Plots": cluster{"x": f64[], "y": f64[]}[]}
  "Color.gtype" = u32
uses:
  NICCC::Read Bytes from Scene.gvi
  NICCC::Read Byte.gvi
  NICCC::Read Word.gvi
diagram:
  Initialize Array(element=cluster{"x": f64[], "y": f64[]} {all zero or empty}, size=16) -> w1
  w2 = "Init"  # State
  # See http://arsantica-online.com/st-niccc-competition/ for binary file + format details.
  s1 = w2  # shift register
  while {
    case (s1) {
      frame "Init" {
        call "Read Bytes from Scene.gvi"(bytes to read=0) -> (error out=w4)
        Property Node(instance in="Frame Info (XY Graph).gtype" {all zero or empty}, "Plots"=w1) -> (instance out=w6)
        $"frame info" <- w6
        w7 = "Read Flags"  # State
        w3 = w7
        w5 = default
      }
      frame "Read Flags" {
        call "Read Byte.gvi"() -> (Word=w8, error out=w4)
        Number To Boolean Array(number=w8) -> (Boolean array=w9)
        Array Index(array=w9) -> (out0[_]=w10, out1[_]=w11, out2[_]=w12)
        Property Node(instance in=$"frame info") -> ("Frame"=w13)
        Increment(x=w13) -> w14
        Property Node(instance in=$"frame info", "Frame"=w14, "Clear Screen"=w10, "Palette Data"=w11, "Indexed"=w12) -> (instance out=w15)
        $"frame info" <- w15
        w16 = "Clear Screen"  # State
        w3 = w16
        w5 = default
      }
      frame "Clear Screen" {
        Property Node(instance in=$"frame info") -> ("Plots"=w17)
        for {
          w18 = each element of w17
          Property Node(instance in=w18) -> ("y"=w20, instance out=w21)
          Subtract(x=200, y=w20) -> w22
          Property Node(instance in=w21, "y"=w22) -> (instance out=w23)
          append w23 to w19
        }
        Property Node(instance in=$graph, "Value"=w19) -> (error out=w24)
        # While the scene file contains a flag to clear the screen every so often, there are instances where hundreds of vertexes and filled shapes accumulate in the canvas. LabVIEW's 2D picture chokes as it is drawing each and every shape regardless of visibility. Instead just clear every frame.
        case (TRUE) {
          frame False, Default { }
          frame True {
            Property Node(instance in=$"frame info", "Plots"=w1) -> (instance out=w25)
            $"frame info" <- w25
          }
        }
        w26 = "Update Palette"  # State
        w3 = w26
        w4 = default
        w5 = default
      }
      frame "Update Palette" {
        Property Node(instance in=$"frame info") -> ("Palette Data"=w27, "Indexed"=w28)
        case (w27) {
          frame False, Default {
            w4 = default
          }
          frame True {
            call "Read Word.gvi"() -> (Word=w29, error out=w30)
            Number To Boolean Array(number=w29) -> (Boolean array=w31)
            Reverse 1D Array(array=w31) -> (reversed array=w32)
            s2 = w30  # shift register
            for (iteration -> i1) {
              w33 = each element of w32
              case (w33) {
                frame False, Default {
                  w34 = s2
                }
                frame True {
                  Property Node(instance in=$graph, "ActivePlot"=i1) -> ("Plot"=w35)  # Graph properties
                  To Unsigned 32 Bit Integer(number=0xFF) -> w36
                  Scale By Power Of 2(n=24, x=w36) -> w37
                  call "Read Word.gvi"(error in=s2) -> (Word=w38, error out=w34)
                  Scale By Power Of 2(n=-8, x=w38) -> w39
                  Logical And(0x7, w39) -> w40
                  Multiply(36, w40) -> w41
                  To Unsigned 32 Bit Integer(number=w41) -> w42
                  Scale By Power Of 2(n=16, x=w42) -> w43
                  Scale By Power Of 2(n=-4, x=w38) -> w44
                  Logical And(0x7, w44) -> w45
                  Multiply(36, w45) -> w46
                  To Unsigned 32 Bit Integer(number=w46) -> w47
                  Scale By Power Of 2(n=8, x=w47) -> w48
                  Logical And(0x7, w38) -> w49
                  Multiply(36, w49) -> w50
                  To Unsigned 32 Bit Integer(number=w50) -> w51
                  # Multiply by 36 to scale 3 bit color to 8 bit color
                  Scale By Power Of 2(n=0, x=w51) -> w52
                  Logical Or(w37, w43, w48, w52) -> w53
                  To Variant(anything=w53) -> w54
                  Variant To Data(type="Color.gtype" 4278190080, variant=w54) -> (data=w55)
                  Property Node(instance in=w35, "Color"=w55)
                }
              }
              next s2 = w34
            }
            w4 = s2
          }
        }
        w56 = "Draw Polygons"  # State
        w57 = "Read Indexed"  # State
        Select(s=w28, t=w57, f=w56) -> w3
        w5 = default
      }
      frame "Read Indexed" {
        call "Read Byte.gvi"() -> (Word=w58, error out=w59)
        s3 = w59  # shift register
        for (N = w58) {
          call "Read Byte.gvi"(error in=s3) -> (Word=w61, error out=w62)
          call "Read Byte.gvi"(error in=w62) -> (Word=w63, error out=w64)
          Property Node(instance in="Vertex.gtype" {all zero or empty}, "y"=w63, "x"=w61) -> (instance out=w65)
          append w65 to w60
          next s3 = w64
        }
        Property Node(instance in=$"frame info", "Indexed Verts"=w60) -> (instance out=w66)
        $"frame info" <- w66
        w67 = "Draw Polygons"  # State
        w3 = w67
        w4 = s3
        w5 = default
      }
      frame "Draw Polygons" {
        call "Read Byte.gvi"() -> (Word=w68, error out=w69)
        case (w68) {
          frame Default {
            Scale By Power Of 2(n=-4, x=w68) -> w70
            Logical And(0xF, w70) -> w71
            Property Node(instance in=$"frame info") -> ("Plots"=w72)
            Property Node(instance in=$"frame info") -> ("Indexed"=w73)
            Logical And(w68, 0xF) -> w74
            case (w73) {
              frame True {
                s4 = w69  # shift register
                for (N = w74) {
                  Property Node(instance in=$"frame info") -> ("Indexed Verts"=w77)
                  call "Read Byte.gvi"(error in=s4) -> (Word=w78, error out=w79)
                  Array Index(array=w77) -> (out0[w78]=w80)
                  Property Node(instance in=w80) -> ("x"=w81, "y"=w82)
                  append w81 to w75
                  append w82 to w76
                  next s4 = w79
                }
                w4 = s4
              }
              frame False {
                s5 = w69  # shift register
                for (N = w74) {
                  call "Read Byte.gvi"(error in=s5) -> (Word=w83, error out=w84)
                  call "Read Byte.gvi"(error in=w84) -> (Word=w85, error out=w86)
                  append w83 to w75
                  append w85 to w76
                  next s5 = w86
                }
                w4 = s5
              }
            }
            Array Index(array=w75) -> (out0[_]=w87)
            # Insert NaN between polygons on same plot to prevent line being drawn between them.
            Array Index(array=w72) -> (out0[w71]=w88)
            Property Node(instance in=w88) -> ("x"=w89, "y"=w90)
            Build Array(w89, w75, w87, NaN) -> w91
            Array Index(array=w76) -> (out0[_]=w92)
            Build Array(w90, w76, w92, NaN) -> w93
            w94 = cluster{"Element 1": f64[], "Element 2": f64[]} {all zero or empty}
            Property Node(instance in=w94, "Element 1"=w91, "Element 2"=w93) -> (instance out=w95)
            Replace Array Subset(inArray=w72, index=w71, new=w95) -> w96
            Property Node(instance in=$"frame info", "Plots"=w96) -> (instance out=w97)
            $"frame info" <- w97
            w98 = "Draw Polygons"  # State
            w3 = w98
          }
          frame 253..255 {
            To Double Precision Float(number=24) -> w99
            Reciprocal(x=w99) -> w100
            Multiply(w100, 1000) -> w101
            To Unsigned 32 Bit Integer(number=w101) -> w102
            Wait(time to wait=w102)
            case (w68) {
              frame Default {
                w103 = "Finish"  # State
                w3 = w103
              }
              frame 255 {
                w104 = "Read Flags"  # State
                w3 = w104
              }
              frame 254 {
                w105 = "Skip 64kB"  # State
                w3 = w105
              }
            }
            w4 = w69
          }
        }
        w5 = default
      }
      frame "Skip 64kB" {
        call "Read Bytes from Scene.gvi"(bytes to read=65535) -> (error out=w4)
        w106 = "Read Flags"  # State
        w3 = w106
        w5 = default
      }
      frame "Finish" {
        w107 = "Init"  # State
        w3 = w107
        w4 = default
        w5 = FALSE
      }
    }
    w108 = "Finish"  # State
    Select(s=w4, t=w108, f=w3) -> w109
    next s1 = w109
    stop if w5
  }
  $"frame info" <- "Frame Info (XY Graph).gtype" {all zero or empty}
