vi "Read Byte.gvi"   [LabVIEW NXG 5.1.0]
inputs:
  "error in": error
outputs:
  "Word": u8
  "error out": error
uses:
  NICCC::Read Bytes from Scene.gvi
diagram:
  call "Read Bytes from Scene.gvi"(bytes to read=1, error in=$"error in") -> (bytes=w1, error out=w2)
  Array Index(array=w1) -> (out0[_]=w3)
  $Word <- w3
  $"error out" <- w2
