vi "Read Bytes from Scene.gvi"   [LabVIEW NXG 5.1.0]
inputs:
  "error in": error
  "bytes to read": i32, required
outputs:
  "error out": error
  "bytes": u8[]
uses:
  LoadScene::Load Scene.gvi
diagram:
  s1 = uninitialised  # shift register
  s2 = uninitialised  # shift register
  while {
    Is Less Or Equal To 0(x=$"bytes to read") -> w1
    case (w1) {
      frame False, Default {
        Array Subset(array=s1, index0=s2, length0=$"bytes to read") -> w4
        Array Size(array=w4) -> (size(s)=w6)
        Is Equal To 0(x=w6) -> w7
        Select(s=w7, t=error {"status"=TRUE, "code"=80000, "source"="done!"}, f=no error) -> w8
        Merge Errors($"error in", w8) -> (error out=w5)
        Add($"bytes to read", s2) -> w3
        w2 = s1
      }
      frame True {
        disable {
          frame TARGET_TYPE == "WebServer" {
            case ($"error in") {
              frame Error {
                w2 = u8[] []
                w5 = $"error in"
              }
              frame No Error {
                call "Load Scene.gvi"(error in=$"error in") -> (scene data=w2, error out=w5)
              }
            }
          }
          frame TARGET_TYPE == "Windows", Default {
            Get Component Directory() -> (Path=w9)
            Build Path(base path=w9, name or relative path=path "scene1.bin") -> (appended path=w10)
            Open Or Create Or Replace File(access (0:read/write)="read-only", error in=$"error in", file path (use dialog)=w10) -> (error out=w11, refnum out=w12)
            w13 = u8 0  # U8
            Read From Binary File(count=-1, data type=w13, error in=w11, file (use dialog)=w12) -> (data=w2, error out=w14, refnum out=w15)
            Close File(error in=w14, refnum=w15) -> (error out=w5)
          }
        }
        w3 = 0
        w4 = u8[] []
      }
    }
    next s1 = w2
    next s2 = w3
    stop if TRUE
  }
  $bytes <- w4
  $"error out" <- w5
