vi "Read Word.gvi"   [G Web Development Software 22.3.0]
inputs:
  "error in": error
outputs:
  "Word": u16
  "error out": error
uses:
  NICCC::Read Bytes from Scene.gvi
diagram:
  call "Read Bytes from Scene.gvi"(bytes to read=2, error in=$"error in") -> (bytes=w1, error out=w2)
  Multiply(w1, [256, 1]) -> w3
  Add Array Elements(numeric array=w3) -> (sum=w4)
  $Word <- w4
  $"error out" <- w2
