vi "index.gviweb"   [LabVIEW NXG 5.1.0]
panel indicators:
  "Graph": cluster{"x": f64[], "y": f64[]}[]
types:
  "Vertex.gtype" = cluster{"x": u8, "y": u8}
  "Frame Info (XY Graph).gtype" = cluster{"Clear Screen": bool, "Palette Data": bool, "Indexed": bool, "Indexed Verts": "Vertex.gtype"[], "Frame": i32, "Plots": cluster{"x": f64[], "y": f64[]}[]}
  "Color.gtype" = u32
uses:
  NICCC::Read Bytes from Scene.gvi
  NICCC::Read Byte.gvi
  NICCC::Read Word.gvi
diagram:
  Initialize Array(element=cluster{"x": f64[], "y": f64[]} {all zero or empty}, size=16) -> w1
  w2 = "Init"  # State
  # See http://arsantica-online.com/st-niccc-competition/ for binary file + format details.
  s1 = w2  # shift register
  s2 = "Frame Info (XY Graph).gtype" {all zero or empty}  # shift register
  while {
    case (s1) {
      frame "Init" {
        call "Read Bytes from Scene.gvi"(bytes to read=0) -> (error out=w5)
        Property Node(instance in="Frame Info (XY Graph).gtype" {all zero or empty}, "Plots"=w1) -> (instance out=w3)
        w7 = "Read Flags"  # State
        w4 = w7
        w6 = default
      }
      frame "Read Flags" {
        call "Read Byte.gvi"() -> (Word=w8, error out=w5)
        Number To Boolean Array(number=w8) -> (Boolean array=w9)
        Array Index(array=w9) -> (out0[_]=w10, out1[_]=w11, out2[_]=w12)
        Property Node(instance in=s2) -> ("Frame"=w13)
        Increment(x=w13) -> w14
        Property Node(instance in=s2, "Frame"=w14, "Clear Screen"=w10, "Palette Data"=w11, "Indexed"=w12) -> (instance out=w3)
        w15 = "Clear Screen"  # State
        w4 = w15
        w6 = default
      }
      frame "Clear Screen" {
        Property Node(instance in=s2)
        # While the scene file contains a flag to clear the screen every so often, there are instances where hundreds of vertexes and filled shapes accumulate in the canvas. LabVIEW's 2D picture chokes as it is drawing each and every shape regardless of visibility. Instead just clear every frame.
        case (TRUE) {
          frame False, Default {
            w3 = s2
          }
          frame True {
            Property Node(instance in=s2, "Plots"=w1) -> (instance out=w3)
          }
        }
        w16 = "Update Palette"  # State
        w4 = w16
        w5 = default
        w6 = default
      }
      frame "Update Palette" {
        Property Node(instance in=s2) -> ("Palette Data"=w17, "Indexed"=w18)
        case (w17) {
          frame False, Default {
            w3 = s2
            w5 = default
          }
          frame True {
            call "Read Word.gvi"() -> (Word=w19, error out=w20)
            Number To Boolean Array(number=w19) -> (Boolean array=w21)
            Reverse 1D Array(array=w21) -> (reversed array=w22)
            s3 = w20  # shift register
            for (iteration -> i1) {
              w23 = each element of w22
              case (w23) {
                frame False, Default {
                  w24 = s3
                }
                frame True {
                  Property Node(instance in=reference to "Graph", "ActivePlot"=i1) -> ("Plot"=w25)  # Graph properties
                  To Unsigned 32 Bit Integer(number=0xFF) -> w26
                  Scale By Power Of 2(n=24, x=w26) -> w27
                  call "Read Word.gvi"(error in=s3) -> (Word=w28, error out=w24)
                  Scale By Power Of 2(n=-8, x=w28) -> w29
                  Logical And(0x7, w29) -> w30
                  Multiply(36, w30) -> w31
                  To Unsigned 32 Bit Integer(number=w31) -> w32
                  Scale By Power Of 2(n=16, x=w32) -> w33
                  Scale By Power Of 2(n=-4, x=w28) -> w34
                  Logical And(0x7, w34) -> w35
                  Multiply(36, w35) -> w36
                  To Unsigned 32 Bit Integer(number=w36) -> w37
                  Scale By Power Of 2(n=8, x=w37) -> w38
                  Logical And(0x7, w28) -> w39
                  Multiply(36, w39) -> w40
                  To Unsigned 32 Bit Integer(number=w40) -> w41
                  # Multiply by 36 to scale 3 bit color to 8 bit color
                  Scale By Power Of 2(n=0, x=w41) -> w42
                  Logical Or(w27, w33, w38, w42) -> w43
                  To Variant(anything=w43) -> w44
                  Variant To Data(type="Color.gtype" 4278190080, variant=w44) -> (data=w45)
                  Property Node(instance in=w25, "Color"=w45)
                }
              }
              next s3 = w24
            }
            w3 = s2
            w5 = s3
          }
        }
        w46 = "Read Indexed"  # State
        w47 = "Draw Polygons"  # State
        Select(s=w18, t=w46, f=w47) -> w4
        w6 = default
      }
      frame "Read Indexed" {
        call "Read Byte.gvi"() -> (Word=w48, error out=w49)
        s4 = w49  # shift register
        for (N = w48) {
          call "Read Byte.gvi"(error in=s4) -> (Word=w51, error out=w52)
          call "Read Byte.gvi"(error in=w52) -> (Word=w53, error out=w54)
          Property Node(instance in="Vertex.gtype" {all zero or empty}, "y"=w53, "x"=w51) -> (instance out=w55)
          append w55 to w50
          next s4 = w54
        }
        Property Node(instance in=s2, "Indexed Verts"=w50) -> (instance out=w3)
        w56 = "Draw Polygons"  # State
        w4 = w56
        w5 = s4
        w6 = default
      }
      frame "Draw Polygons" {
        call "Read Byte.gvi"() -> (Word=w57, error out=w58)
        case (w57) {
          frame Default {
            Property Node(instance in=s2) -> ("Indexed"=w60)
            Logical And(w57, 0xF) -> w61
            case (w60) {
              frame True {
                s5 = s2  # shift register
                s6 = w58  # shift register
                for (N = w61) {
                  Property Node(instance in=s5) -> ("Indexed Verts"=w65)
                  call "Read Byte.gvi"(error in=s6) -> (Word=w66, error out=w67)
                  Array Index(array=w65) -> (out0[w66]=w68)
                  Property Node(instance in=w68) -> ("x"=w69, "y"=w70)
                  append w69 to w62
                  append w70 to w64
                  next s6 = w67
                }
                w63 = s5
                w5 = s6
              }
              frame False {
                s7 = s2  # shift register
                s8 = w58  # shift register
                for (N = w61) {
                  call "Read Byte.gvi"(error in=s8) -> (Word=w71, error out=w72)
                  call "Read Byte.gvi"(error in=w72) -> (Word=w73, error out=w74)
                  append w71 to w62
                  append w73 to w64
                  next s8 = w74
                }
                w63 = s7
                w5 = s8
              }
            }
            Scale By Power Of 2(n=-4, x=w57) -> w75
            Logical And(0xF, w75) -> w76
            Property Node(instance in=w63) -> ("Plots"=w77)
            Array Index(array=w62) -> (out0[_]=w78)
            # Insert NaN between polygons on same plot to prevent line being drawn between them.
            Array Index(array=w77) -> (out0[w76]=w79)
            Property Node(instance in=w79) -> ("x"=w80, "y"=w81)
            Build Array(w80, w62, w78, NaN) -> w82
            Array Index(array=w64) -> (out0[_]=w83)
            Build Array(w81, w64, w83, NaN) -> w84
            w85 = cluster{"Element 1": f64[], "Element 2": f64[]} {all zero or empty}
            Property Node(instance in=w85, "Element 1"=w82, "Element 2"=w84) -> (instance out=w86)
            Replace Array Subset(inArray=w77, index=w76, new=w86) -> w59
            Property Node(instance in=w63, "Plots"=w59) -> (instance out=w3)
            w87 = "Draw Polygons"  # State
            w4 = w87
          }
          frame 253..255 {
            To Double Precision Float(number=24) -> w88
            Reciprocal(x=w88) -> w89
            Multiply(w89, 1000) -> w90
            To Unsigned 32 Bit Integer(number=w90) -> w91
            Wait(time to wait=w91)
            case (w57) {
              frame Default {
                w92 = "Finish"  # State
                w4 = w92
              }
              frame 255 {
                w93 = "Read Flags"  # State
                w4 = w93
              }
              frame 254 {
                w94 = "Skip 64kB"  # State
                w4 = w94
              }
            }
            Property Node(instance in=s2) -> ("Plots"=w59)
            w3 = s2
            w5 = w58
          }
        }
        for {
          w95 = each element of w59
          Property Node(instance in=w95) -> ("y"=w97, instance out=w98)
          Subtract(x=200, y=w97) -> w99
          Property Node(instance in=w98, "y"=w99) -> (instance out=w100)
          append w100 to w96
        }
        $Graph <- w96
        w6 = default
      }
      frame "Skip 64kB" {
        call "Read Bytes from Scene.gvi"(bytes to read=65535) -> (error out=w5)
        w101 = "Read Flags"  # State
        w3 = s2
        w4 = w101
        w6 = default
      }
      frame "Finish" {
        w102 = "Init"  # State
        w3 = s2
        w4 = w102
        w5 = default
        w6 = FALSE
      }
    }
    w103 = "Finish"  # State
    Select(s=w5, t=w103, f=w4) -> w104
    next s1 = w104
    next s2 = w3
    stop if w6
  }
  w105 = [{"x"=[], "y"=[]}, {"x"=[180, 184, 180, 177, 180, NaN, 78, 76, 76, 78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], "y"=[96, 92, 82, 87, 96, NaN, 80, 73, 87, 94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]}, {"x"=[206, 229, 225, 206, NaN, 221, 229, 206, 221, NaN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], "y"=[79, 87, 80, 79, NaN, 86, 87, 79, 86, NaN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]}, {"x"=[158, 162, 165, 162, 158, NaN, 255, 240, 234, 255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], "y"=[85, 82, 77, 80, 85, NaN, 103, 81, 83, 115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]}, {"x"=[255, 250, 255, 255, NaN, 220, 227, 219, 212, 220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], "y"=[83, 84, 90, 83, NaN, 96, 91, 90, 96, 96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]}, {"x"=[123, 122, 129, 128, 123, NaN, 97, 94, 85, 88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], "y"=[76, 73, 101, 96, 76, NaN, 74, 71, 93, 97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]}, {"x"=[39, 34, 39, 44, 39, NaN, 137, 137, 139, 140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], "y"=[79, 71, 81, 88, 79, NaN, 110, 107, 132, 136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]}, {"x"=[244, 255, 255, 227, 218, 244, NaN, 203, 211, 200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], "y"=[139, 136, 136, 136, 139, 139, NaN, 139, 136, 136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]}, {"x"=[34, 30, 35, 39, 34, NaN], "y"=[71, 68, 77, 81, 71, NaN]}, {"x"=[], "y"=[]}, {"x"=[], "y"=[]}, {"x"=[], "y"=[]}, {"x"=[], "y"=[]}, {"x"=[], "y"=[]}, {"x"=[], "y"=[]}, {"x"=[], "y"=[]}]
  $Graph <- w105
