vi "index.gviweb"   [LabVIEW NXG 3.1.0]
panel controls:
  "Power Button": bool
  "Tab": i32
panel indicators:
  "LED": bool
  "Score": f64
  "High Score": f64
  "Score History": f64
uses:
  WebApp::DetermineHighScore.gvi
diagram:
  w1 = "Prepare First Run"  # GameStates
  s1 = w1  # shift register
  while {
    case (s1) {
      frame "Prepare First Run" {
        $LED <- FALSE
        $"Power Button" <- FALSE
        w3 = "Wait to Start"  # GameStates
        $Score <- 0
        $"High Score" <- 0
        w2 = w3
      }
      frame "Wait to Start", Default {
        while {
          Wait(time to wait=0)
          stop if $"Power Button"
        }
        w4 = "Prepare Tester"  # GameStates
        w2 = w4
      }
      frame "Prepare Tester" {
        $LED <- FALSE
        w5 = "Run Tester"  # GameStates
        $Score <- 0
        w2 = w5
      }
      frame "Run Tester" {
        w6 = "Clean-up Tester"  # GameStates
        Tick Count() -> (timer value=w7)
        Random Number() -> (number (0 to 1)=w8)
        Multiply(w8, 5000) -> w9
        while {
          Tick Count() -> (timer value=w10)
          Subtract(x=w10, y=w7) -> w11
          To Double Precision Float(number=w11) -> w12
          Is Greater(x=w12, y=w9) -> w13
          $LED <- w13
          Subtract(x=w12, y=w9) -> w14
          continue if $"Power Button"
        }
        call "DetermineHighScore.gvi"(Current High Score=$"High Score", New Score=w14) -> (New High Score=w15)
        $"High Score" <- w15
        $Score <- w14
        $"Score History" <- w14
        w2 = w6
      }
      frame "Clean-up Tester" {
        $"Power Button" <- FALSE
        w16 = "Wait to Start"  # GameStates
        $LED <- FALSE
        w2 = w16
      }
    }
    next s1 = w2
    stop if FALSE
  }
