vi "angleToSize.gvi"   [LabVIEW Platform Developer Preview 0.1.0]
inputs:
  "angle": f64
  "length": f64
outputs:
  "size": cluster{"w": f64, "h": f64}
diagram:
  Cosine(x=$angle) -> w1
  Multiply(w1, $length) -> w2
  Sine(x=$angle) -> w3
  Multiply(w3, $length) -> w4
  Build Cluster(w2, w4) -> w5
  $size <- w5
