vi "game.gvi"   [LabVIEW NXG 4.0.0]
inputs:
  "fire": "BooleanControl reference"
  "angle": "SliderDouble reference"
  "shaft": "GObject reference"
  "bullet": "GObject reference"
  "target": "GObject reference"
  "hud": "StringControl reference"
uses:
  ShootStar::angleToSize.gvi
  ShootStar::initializeSpeed.gvi
  ShootStar::getPosition.gvi
  ShootStar::shouldStop.gvi
diagram:
  Property Node(instance in=$shaft) -> ("TotalBounds"=w1, instance out=w2)
  # I find there is an offset
  # somehow, I guess it's
  # due to the border.
  Property Node(instance in=w1) -> ("Left"=w3, "Top"=w4, "Height"=w5)
  Add(w4, w5) -> w6
  Subtract(x=w6, y=3) -> w7
  while {
    # Left -bottom
    while {
      Property Node(instance in=$fire) -> ("Value"=w8, instance out=w9)
      Property Node(instance in=$angle) -> ("Value"=w10)
      call "angleToSize.gvi"(angle=w10, length=80) -> (size=w11)
      Property Node(instance in=w11) -> ("h"=w12)
      Subtract(x=w7, y=w12) -> w13
      # Adjust the angle.
      Property Node(instance in=w11, "w"=w3, "h"=w13) -> (instance out=w14)
      Property Node(instance in=w2, "Size"=w11, "Position"=w14) -> (instance out=w15)
      Wait(time to wait=100)
      stop if w8
    }
    Property Node(instance in=w9, "Value"=FALSE)
    Property Node(instance in=$bullet, "Visible"=FALSE)
    Property Node(instance in=$target) -> ("TotalBounds"=w16)
    Property Node(instance in=w15) -> ("TotalBounds"=w17)
    Property Node(instance in=w17) -> ("Left"=w18, "Top"=w19, "Width"=w20)
    Add(w18, w20) -> w21
    Build Cluster(w21, w19) -> w22
    Property Node(instance in=$bullet, "Position"=w22) -> (instance out=w23)
    Property Node(instance in=w23, "Visible"=TRUE) -> (instance out=w24)
    call "initializeSpeed.gvi"(angle=w10, speed=80) -> (vy=w25, vx=w26)
    s1 = w26  # shift register
    s2 = w25  # shift register
    while {
      # Control bullet move
      Property Node(instance in=w24) -> ("Position"=w27, instance out=w28)
      Property Node(instance in=w27) -> ("Left"=w29, "Top"=w30, instance out=w31)
      call "getPosition.gvi"(x=w29, y=w30, vx=s1, vy=s2, g=5) -> (x_out=w32, vx_out=w33, y_out=w34, vy_out=w35)
      Property Node(instance in=w31, "Left"=w32, "Top"=w34) -> (instance out=w36)
      Property Node(instance in=w28, "Position"=w36)
      Wait(time to wait=100)
      call "shouldStop.gvi"(bounds=w16, x=w32, y=w34) -> (fly out=w37, hit=w38)
      Logical Or(w37, w38) -> w39
      next s1 = w33
      next s2 = w35
      stop if w39
    }
    case (w38) {
      frame False, Default {
        Property Node(instance in=$hud, "Value"="You \nmiss...")
      }
      frame True {
        Property Node(instance in=$hud, "Value"="Nice!")
      }
    }
    stop if FALSE
  }
  Property Node(instance in=$hud, "Value"="Shot\nThe\nStar -->")
