vi "getPosition.gvi"   [LabVIEW Platform Developer Preview 0.1.0]
inputs:
  "x": f64
  "y": f64
  "vx": f64
  "vy": f64
  "g": f64
outputs:
  "x_out": f64
  "vx_out": f64
  "y_out": f64
  "vy_out": f64
diagram:
  Add($x, $vx) -> w1
  $x_out <- w1
  $vx_out <- $vx
  Add($vy, $g) -> w2
  $vy_out <- w2
  Add($y, w2) -> w3
  $y_out <- w3
