vi "initializeSpeed.gvi"   [LabVIEW Platform Developer Preview 0.1.0]
inputs:
  "angle": f64
  "speed": f64
outputs:
  "vy": f64
  "vx": f64
diagram:
  Sine(x=$angle) -> w1
  Multiply(w1, $speed) -> w2
  $vx <- w2
  Cosine(x=$angle)
  Negate(x=w1) -> w3
  Multiply($speed, w3) -> w4
  $vy <- w4
