vi "shouldStop.gvi"   [LabVIEW Platform Developer Preview 0.1.0]
inputs:
  "bounds": T1
  "x": i32
  "y": i32
outputs:
  "fly out": bool
  "hit": bool
types:
  T1 = cluster{"Left": f32, "Top": f32, "Width": f32, "Height": f32}
diagram:
  Property Node(instance in=$bounds) -> ("Left"=w1, "Top"=w2, "Width"=w3, "Height"=w4)
  Add(w1, w3) -> w5
  Is Greater(x=$x, y=w5) -> w6
  $"fly out" <- w6
  Is Greater(x=$x, y=w1) -> w7
  Is Greater(x=$y, y=w2) -> w8
  Is Greater(x=w5, y=$x) -> w9
  Add(w2, w4) -> w10
  Is Greater(x=w10, y=$y) -> w11
  Logical And(w7, w8, w9, w11) -> w12
  $hit <- w12
