vi "Rotate Direction.gvi"   [LabVIEW NXG 3.1.0]
inputs:
  "game state in": "Game State.gtype", required
  "user action": "User Action.gtype" = "rotate ccw", required
  "entity index in": i32, required
outputs:
  "game state out": "Game State.gtype"
  "enitity index out": i32
types:
  "User Action.gtype" = enum{"rotate ccw", "rotate cw"}
  "Direction.gtype" = enum{"⬆️", "↗️", "➡️", "↘️", "⬇️", "↙️", "⬅️", "↖️"}
  "Edible.gtype" = bool
  "Snake Body.gtype" = bool
  "Entity.gtype" = cluster{"Direction": "Direction.gtype"[], "Edible": "Edible.gtype"[], "Position": "Position.gtype"[], "Snake Body": "Snake Body.gtype"[], "Snake Head": "Snake Head.gtype"[]}
  "Game State.gtype" = cluster{"World Size": cluster{"Width": u32, "Height": u32}, "Entities": "Entity.gtype"[], "User Actions": Queue<"User Action.gtype">}
uses:
  Snek::Entity Components::Direction::Direction Get.gvi
  Snek::Entity Components::Direction::Direction Set.gvi
diagram:
  call "Direction Get.gvi"(game state in=$"game state in", entity index in=$"entity index in") -> (game state out=w1, enitity index out=w2, direction=w3, exists?=w4)
  case (w4) {
    frame False, Default {
      w5 = w1
      w6 = w2
    }
    frame True {
      case ($"user action") {
        frame "rotate ccw" {
          Is Equal To 0(x=w3) -> w8
          Decrement(x=w3) -> w9
          Select(s=w8, t="↖️", f=w9) -> w7
        }
        frame "rotate cw" {
          Increment(x=w3) -> w10
          Is Equal(x=w3, y="↖️") -> w11
          Select(s=w11, t="⬆️", f=w10) -> w7
        }
        frame Default {
          w7 = w3
        }
      }
      call "Direction Set.gvi"(game state in=w1, enitity index in=w2, direction=w7) -> (game state out=w5, enitity index out=w6)
    }
  }
  $"game state out" <- w5
  $"enitity index out" <- w6
