vi "Entity Get.gvi"   [LabVIEW NXG 3.1.0]
inputs:
  "game state in": "Game State.gtype", required
  "enitity index in": i32, required
outputs:
  "entity": "Entity.gtype"
  "game state out": "Game State.gtype"
  "enitity index out": i32
  "exists?": bool
types:
  "Direction.gtype" = enum{"⬆️", "↗️", "➡️", "↘️", "⬇️", "↙️", "⬅️", "↖️"}
  "Edible.gtype" = bool
  "Snake Body.gtype" = bool
  "Entity.gtype" = cluster{"Direction": "Direction.gtype"[], "Edible": "Edible.gtype"[], "Position": "Position.gtype"[], "Snake Body": "Snake Body.gtype"[], "Snake Head": "Snake Head.gtype"[]}
  "User Action.gtype" = enum{"rotate ccw", "rotate cw"}
  "Game State.gtype" = cluster{"World Size": cluster{"Width": u32, "Height": u32}, "Entities": "Entity.gtype"[], "User Actions": Queue<"User Action.gtype">}
diagram:
  $"game state out" <- $"game state in"
  Property Node(instance in=$"game state in") -> ("Entities"=w1)
  Array Index(array=w1) -> (out0[$"enitity index in"]=w2)
  $entity <- w2
  $"enitity index out" <- $"enitity index in"
  Array Size(array=w1) -> (size(s)=w3)
  Is Less(x=$"enitity index in", y=w3) -> w4
  Is Greater Or Equal To 0(x=$"enitity index in") -> w5
  Logical And(w4, w5) -> w6
  $"exists?" <- w6
