vi "Entity Set.gvi"   [LabVIEW NXG 3.1.0]
inputs:
  "game state in": "Game State.gtype", required
  "enitity index in": i32, required
  "entity": "Entity.gtype", required
outputs:
  "game state out": "Game State.gtype"
  "enitity index out": i32
types:
  "Direction.gtype" = enum{"⬆️", "↗️", "➡️", "↘️", "⬇️", "↙️", "⬅️", "↖️"}
  "Edible.gtype" = bool
  "Snake Body.gtype" = bool
  "Entity.gtype" = cluster{"Direction": "Direction.gtype"[], "Edible": "Edible.gtype"[], "Position": "Position.gtype"[], "Snake Body": "Snake Body.gtype"[], "Snake Head": "Snake Head.gtype"[]}
  "User Action.gtype" = enum{"rotate ccw", "rotate cw"}
  "Game State.gtype" = cluster{"World Size": cluster{"Width": u32, "Height": u32}, "Entities": "Entity.gtype"[], "User Actions": Queue<"User Action.gtype">}
diagram:
  Property Node(instance in=$"game state in") -> ("Entities"=w1, instance out=w2)
  Replace Array Subset(inArray=w1, index=$"enitity index in", new=$entity) -> w3
  Property Node(instance in=w2, "Entities"=w3) -> (instance out=w4)
  $"game state out" <- w4
  $"enitity index out" <- $"enitity index in"
