vi "Translate Position.gvi"   [LabVIEW NXG 3.1.0]
inputs:
  "game state in": "Game State.gtype", required
  "direction": "Direction.gtype" = "⬆️", required
  "spaces": i32 = 1
  "entity index in": i32, required
outputs:
  "game state out": "Game State.gtype"
  "enitity index out": i32
  "updated position": "Position.gtype"
types:
  "Direction.gtype" = enum{"⬆️", "↗️", "➡️", "↘️", "⬇️", "↙️", "⬅️", "↖️"}
  "Edible.gtype" = bool
  "Snake Body.gtype" = bool
  "Entity.gtype" = cluster{"Direction": "Direction.gtype"[], "Edible": "Edible.gtype"[], "Position": "Position.gtype"[], "Snake Body": "Snake Body.gtype"[], "Snake Head": "Snake Head.gtype"[]}
  "User Action.gtype" = enum{"rotate ccw", "rotate cw"}
  "Game State.gtype" = cluster{"World Size": cluster{"Width": u32, "Height": u32}, "Entities": "Entity.gtype"[], "User Actions": Queue<"User Action.gtype">}
  "Position.gtype" = cluster{"X": i32, "Y": i32}
uses:
  Snek::Entity Components::Position::Position Get.gvi
  Snek::Entity Components::Position::Position Set.gvi
diagram:
  call "Position Get.gvi"(game state in=$"game state in", entity index=$"entity index in") -> (game state out=w1, enitity index out=w2, position=w3, exists?=w4)
  case (w4) {
    frame False, Default {
      w5 = w1
      w6 = w2
    }
    frame True {
      Property Node(instance in=w3) -> ("X"=w7, "Y"=w8, instance out=w9)
      # w10: reverse spaces
      Multiply($spaces, -1) -> w10
      w11 = 0  # no spaces
      case ($direction) {
        frame "⬆️" {
          w12 = w11
          w13 = $spaces
        }
        frame "↗️" {
          w12 = $spaces
          w13 = $spaces
        }
        frame "➡️" {
          w12 = $spaces
          w13 = w11
        }
        frame "↘️" {
          w12 = $spaces
          w13 = w10
        }
        frame "⬇️" {
          w12 = w11
          w13 = w10
        }
        frame "↙️" {
          w12 = w10
          w13 = w10
        }
        frame "⬅️" {
          w12 = w10
          w13 = w11
        }
        frame "↖️" {
          w12 = w10
          w13 = $spaces
        }
      }
      Add(w8, w13) -> w14
      Add(w7, w12) -> w15
      Property Node(instance in=w9, "X"=w15, "Y"=w14) -> (instance out=w16)
      call "Position Set.gvi"(game state in=w1, enitity index=w2, position=w16) -> (game state out=w5, enitity index out=w6)
      $"updated position" <- w16
    }
  }
  $"game state out" <- w5
  $"enitity index out" <- w6
