vi "Append Head.gvi"   [LabVIEW NXG 3.1.0]
inputs:
  "position": "Position.gtype"
  "game state in": "Game State.gtype"
outputs:
  "game state out": "Game State.gtype"
types:
  "Position.gtype" = cluster{"X": i32, "Y": i32}
  "Direction.gtype" = enum{"⬆️", "↗️", "➡️", "↘️", "⬇️", "↙️", "⬅️", "↖️"}
  "Edible.gtype" = bool
  "Snake Body.gtype" = bool
  "Entity.gtype" = cluster{"Direction": "Direction.gtype"[], "Edible": "Edible.gtype"[], "Position": "Position.gtype"[], "Snake Body": "Snake Body.gtype"[], "Snake Head": "Snake Head.gtype"[]}
  "User Action.gtype" = enum{"rotate ccw", "rotate cw"}
  "Game State.gtype" = cluster{"World Size": cluster{"Width": u32, "Height": u32}, "Entities": "Entity.gtype"[], "User Actions": Queue<"User Action.gtype">}
  "Snake Head.gtype" = cluster{"Snake Body Entities Index": i32[]}
uses:
  Snek::Entity Components::Entity Create.gvi
  Snek::Entity Components::Snake Head::Snake Head Set.gvi
  Snek::Entity Components::Position::Position Set.gvi
  Snek::Entity Components::Direction::Direction Set.gvi
diagram:
  call "Entity Create.gvi"(game state in=$"game state in") -> (game state out=w1, entity index=w2)
  call "Snake Head Set.gvi"(game state in=w1, enitity index=w2, snake head="Snake Head.gtype" {all zero or empty}) -> (game state out=w3, enitity index out=w4)
  call "Position Set.gvi"(game state in=w3, enitity index=w4, position=$position) -> (game state out=w5, enitity index out=w6)
  call "Direction Set.gvi"(game state in=w5, enitity index in=w6, direction="⬆️") -> (game state out=w7)
  $"game state out" <- w7
