vi "Snake Head Get.gvi"   [LabVIEW NXG 3.1.0]
inputs:
  "game state in": "Game State.gtype", required
  "entity index": i32, required
outputs:
  "snake head": "Snake Head.gtype"
  "game state out": "Game State.gtype"
  "enitity index out": i32
  "exists?": bool
types:
  "Direction.gtype" = enum{"⬆️", "↗️", "➡️", "↘️", "⬇️", "↙️", "⬅️", "↖️"}
  "Edible.gtype" = bool
  "Snake Body.gtype" = bool
  "Entity.gtype" = cluster{"Direction": "Direction.gtype"[], "Edible": "Edible.gtype"[], "Position": "Position.gtype"[], "Snake Body": "Snake Body.gtype"[], "Snake Head": "Snake Head.gtype"[]}
  "User Action.gtype" = enum{"rotate ccw", "rotate cw"}
  "Game State.gtype" = cluster{"World Size": cluster{"Width": u32, "Height": u32}, "Entities": "Entity.gtype"[], "User Actions": Queue<"User Action.gtype">}
  "Snake Head.gtype" = cluster{"Snake Body Entities Index": i32[]}
uses:
  Snek::Entity Components::Entity Get.gvi
diagram:
  call "Entity Get.gvi"(game state in=$"game state in", enitity index in=$"entity index") -> (game state out=w1, enitity index out=w2, entity=w3)
  $"game state out" <- w1
  $"enitity index out" <- w2
  Property Node(instance in=w3) -> ("Snake Head"=w4)
  Array Index(array=w4) -> (out0[_]=w5)
  $"snake head" <- w5
  Array Size(array=w4) -> (size(s)=w6)
  Is Greater Than 0(x=w6) -> w7
  $"exists?" <- w7
