vi "Snake Head Set.gvi"   [LabVIEW NXG 3.1.0]
inputs:
  "game state in": "Game State.gtype", required
  "snake head": "Snake Head.gtype", required
  "enitity index": i32, required
outputs:
  "game state out": "Game State.gtype"
  "enitity index out": i32
types:
  "Direction.gtype" = enum{"⬆️", "↗️", "➡️", "↘️", "⬇️", "↙️", "⬅️", "↖️"}
  "Edible.gtype" = bool
  "Snake Body.gtype" = bool
  "Entity.gtype" = cluster{"Direction": "Direction.gtype"[], "Edible": "Edible.gtype"[], "Position": "Position.gtype"[], "Snake Body": "Snake Body.gtype"[], "Snake Head": "Snake Head.gtype"[]}
  "User Action.gtype" = enum{"rotate ccw", "rotate cw"}
  "Game State.gtype" = cluster{"World Size": cluster{"Width": u32, "Height": u32}, "Entities": "Entity.gtype"[], "User Actions": Queue<"User Action.gtype">}
  "Snake Head.gtype" = cluster{"Snake Body Entities Index": i32[]}
uses:
  Snek::Entity Components::Entity Get.gvi
  Snek::Entity Components::Entity Set.gvi
diagram:
  call "Entity Get.gvi"(game state in=$"game state in", enitity index in=$"enitity index") -> (game state out=w1, enitity index out=w2, entity=w3, exists?=w4)
  case (w4) {
    frame False, Default {
      w5 = w1
      w6 = w2
    }
    frame True {
      Build Array($"snake head") -> w7
      Property Node(instance in=w3, "Snake Head"=w7) -> (instance out=w8)
      call "Entity Set.gvi"(game state in=w1, enitity index in=w2, entity=w8) -> (game state out=w5, enitity index out=w6)
    }
  }
  $"game state out" <- w5
  $"enitity index out" <- w6
