vi "Milliseconds Per Iteration.gvi"   [LabVIEW NXG 3.1.0]
outputs:
  "ms per iteration": u32
diagram:
  s1 = uninitialised  # shift register
  while {
    Tick Count() -> (timer value=w1)
    Subtract(x=w1, y=s1) -> w2
    next s1 = w1
    stop if TRUE
  }
  $"ms per iteration" <- w2
