vi "Grow Snake Body.gvi"   [LabVIEW NXG 3.1.0]
inputs:
  "game state in": "Game State.gtype"
  "number of body segments": i32
  "position": "Position.gtype"
outputs:
  "game state out": "Game State.gtype"
types:
  "Position.gtype" = cluster{"X": i32, "Y": i32}
  "Direction.gtype" = enum{"⬆️", "↗️", "➡️", "↘️", "⬇️", "↙️", "⬅️", "↖️"}
  "Edible.gtype" = bool
  "Snake Body.gtype" = bool
  "Entity.gtype" = cluster{"Direction": "Direction.gtype"[], "Edible": "Edible.gtype"[], "Position": "Position.gtype"[], "Snake Body": "Snake Body.gtype"[], "Snake Head": "Snake Head.gtype"[]}
  "User Action.gtype" = enum{"rotate ccw", "rotate cw"}
  "Game State.gtype" = cluster{"World Size": cluster{"Width": u32, "Height": u32}, "Entities": "Entity.gtype"[], "User Actions": Queue<"User Action.gtype">}
uses:
  Snek::Entity Components::Entity Create.gvi
  Snek::Entity Components::Position::Position Set.gvi
  Snek::Entity Components::Position::Translate Position.gvi
  Snek::Entity Components::Snake Body::Snake Body Set.gvi
  Snek::SubVIs::Snake Head Index.gvi
  Snek::Entity Components::Snake Head::Snake Head Get.gvi
  Snek::Entity Components::Snake Head::Snake Head Set.gvi
diagram:
  s1 = $position  # shift register
  s2 = $"game state in"  # shift register
  for (N = $"number of body segments") {
    call "Entity Create.gvi"(game state in=s2) -> (game state out=w2, entity index=w3)
    call "Position Set.gvi"(game state in=w2, enitity index=w3, position=s1) -> (game state out=w4, enitity index out=w5)
    call "Translate Position.gvi"(game state in=w4, entity index in=w5, direction="⬆️") -> (game state out=w6, enitity index out=w7, updated position=w8)
    call "Snake Body Set.gvi"(game state in=w6, enitity index in=w7, snake body?=TRUE) -> (game state out=w9, enitity index out=w10)
    append w10 to w1
    next s1 = w8
    next s2 = w9
  }
  call "Snake Head Index.gvi"() -> (Index=w11)
  call "Snake Head Get.gvi"(game state in=s2, entity index=w11) -> (game state out=w12, enitity index out=w13, snake head=w14)
  Property Node(instance in=w14) -> ("Snake Body Entities Index"=w15, instance out=w16)
  Build Array(w15, w1) -> w17
  Property Node(instance in=w16, "Snake Body Entities Index"=w17) -> (instance out=w18)
  call "Snake Head Set.gvi"(game state in=w12, enitity index=w13, snake head=w18) -> (game state out=w19)
  $"game state out" <- w19
