vi "Initialization System.gvi"   [LabVIEW NXG 3.1.0]
outputs:
  "game state out": "Game State.gtype"
types:
  "Direction.gtype" = enum{"⬆️", "↗️", "➡️", "↘️", "⬇️", "↙️", "⬅️", "↖️"}
  "Edible.gtype" = bool
  "Snake Body.gtype" = bool
  "Entity.gtype" = cluster{"Direction": "Direction.gtype"[], "Edible": "Edible.gtype"[], "Position": "Position.gtype"[], "Snake Body": "Snake Body.gtype"[], "Snake Head": "Snake Head.gtype"[]}
  "User Action.gtype" = enum{"rotate ccw", "rotate cw"}
  "Game State.gtype" = cluster{"World Size": cluster{"Width": u32, "Height": u32}, "Entities": "Entity.gtype"[], "User Actions": Queue<"User Action.gtype">}
  "Position.gtype" = cluster{"X": i32, "Y": i32}
  "Snake Head.gtype" = cluster{"Snake Body Entities Index": i32[]}
uses:
  Snek::SubVIs::Grow Snake Body.gvi
diagram:
  Property Node(instance in="Position.gtype" {all zero or empty}, "X"=500, "Y"=500) -> (instance out=w1)
  Obtain Queue(element data type="User Action.gtype" "rotate ccw") -> (queue out=w2)
  # Create the Snake Head as first index
  Build Array("Snake Head.gtype" {all zero or empty}) -> w3
  Build Array(w1) -> w4
  Random Number() -> (number (0 to 1)=w5)
  Multiply(w5, 8) -> w6
  Build Array(w6) -> w7
  Property Node(instance in="Entity.gtype" {all zero or empty}, "Snake Head"=w3, "Position"=w4, "Direction"=w7) -> (instance out=w8)
  Build Array(w8) -> w9
  Property Node(instance in="Game State.gtype" {all zero or empty}, "World Size:Width"=1000, "World Size:Height"=1000, "Entities"=w9, "User Actions"=w2) -> (instance out=w10)
  call "Grow Snake Body.gvi"(game state in=w10, number of body segments=50, position=w1) -> (game state out=w11)
  $"game state out" <- w11
