vi "Process User Input System.gvi"   [LabVIEW NXG 3.1.0]
inputs:
  "game state in": "Game State.gtype"
outputs:
  "game state out": "Game State.gtype"
types:
  "Direction.gtype" = enum{"⬆️", "↗️", "➡️", "↘️", "⬇️", "↙️", "⬅️", "↖️"}
  "Edible.gtype" = bool
  "Snake Body.gtype" = bool
  "Entity.gtype" = cluster{"Direction": "Direction.gtype"[], "Edible": "Edible.gtype"[], "Position": "Position.gtype"[], "Snake Body": "Snake Body.gtype"[], "Snake Head": "Snake Head.gtype"[]}
  "User Action.gtype" = enum{"rotate ccw", "rotate cw"}
  "Game State.gtype" = cluster{"World Size": cluster{"Width": u32, "Height": u32}, "Entities": "Entity.gtype"[], "User Actions": Queue<"User Action.gtype">}
uses:
  Snek::SubVIs::Snake Head Index.gvi
  Snek::Entity Components::Direction::Direction Get.gvi
  Snek::Entity Components::Direction::Rotate Direction.gvi
  Snek::Entity Components::Direction::Direction Set.gvi
diagram:
  Property Node(instance in=$"game state in") -> ("User Actions"=w1, instance out=w2)
  call "Snake Head Index.gvi"() -> (Index=w3)
  call "Direction Get.gvi"(game state in=w2, entity index=w3) -> (direction=w4)
  s1 = w4  # shift register
  while {
    Dequeue Element(queue=w1, timeout in ms=0) -> (element=w5, timed out?=w6)
    case (w6) {
      frame False, Default {
        call "Rotate Direction.gvi"(direction in=s1, user action=w5) -> (direction out=w7)
      }
      frame True {
        w7 = s1
      }
    }
    next s1 = w7
    stop if w6
  }
  call "Snake Head Index.gvi"() -> (Index=w8)
  call "Direction Set.gvi"(game state in=w2, enitity index=w8, direction=s1) -> (game state out=w9)
  $"game state out" <- w9
