vi "Render System.gvi"   [LabVIEW NXG 3.1.0]
inputs:
  "game state in": "Game State.gtype", required
outputs:
  "game state rendered": cluster{"X": i32[], "Y": i32[]}[]
types:
  "Direction.gtype" = enum{"⬆️", "↗️", "➡️", "↘️", "⬇️", "↙️", "⬅️", "↖️"}
  "Edible.gtype" = bool
  "Snake Body.gtype" = bool
  "Entity.gtype" = cluster{"Direction": "Direction.gtype"[], "Edible": "Edible.gtype"[], "Position": "Position.gtype"[], "Snake Body": "Snake Body.gtype"[], "Snake Head": "Snake Head.gtype"[]}
  "User Action.gtype" = enum{"rotate ccw", "rotate cw"}
  "Game State.gtype" = cluster{"World Size": cluster{"Width": u32, "Height": u32}, "Entities": "Entity.gtype"[], "User Actions": Queue<"User Action.gtype">}
diagram:
  Property Node(instance in=$"game state in") -> ("Entities"=w1)
  w2 = i32[] []  # Y
  w3 = i32[] []  # X
  s1 = w3  # shift register
  s2 = w2  # shift register
  for {
    w4 = each element of w1
    Property Node(instance in=w4) -> ("Position"=w5)
    Array Size(array=w5) -> (size(s)=w6)
    Is Greater Than 0(x=w6) -> w7
    case (w7) {
      frame False, Default {
        w8 = s1
        w9 = s2
      }
      frame True {
        Array Index(array=w5) -> (out0[_]=w10)
        Property Node(instance in=w10) -> ("X"=w11, "Y"=w12)
        Build Array(s1, w11) -> w8
        Build Array(s2, w12) -> w9
      }
    }
    next s1 = w8
    next s2 = w9
  }
  Property Node(instance in=cluster{"X": i32[], "Y": i32[]} {all zero or empty}, "X"=s1, "Y"=s2) -> (instance out=w13)
  Build Array(w13) -> w14
  # Array of
  #   Cluster of
  #     Array of X nums
  #     Array of Y nums
  $"game state rendered" <- w14
