vi "Translate Position in Direction.gvi"   [LabVIEW NXG 3.1.0]
inputs:
  "position in": "Position.gtype"
  "direction": "Direction.gtype" = "⬆️"
  "spaces": i32 = 1
outputs:
  "position out": "Position.gtype"
types:
  "Position.gtype" = cluster{"X": i32, "Y": i32}
  "Direction.gtype" = enum{"⬆️", "↗️", "➡️", "↘️", "⬇️", "↙️", "⬅️", "↖️"}
diagram:
  Property Node(instance in=$"position in") -> ("X"=w1, "Y"=w2, instance out=w3)
  # w4: reverse spaces
  Multiply($spaces, -1) -> w4
  w5 = 0  # no spaces
  case ($direction) {
    frame "⬆️" {
      w6 = w5
      w7 = $spaces
    }
    frame "↗️" {
      w6 = $spaces
      w7 = $spaces
    }
    frame "➡️" {
      w6 = $spaces
      w7 = w5
    }
    frame "↘️" {
      w6 = $spaces
      w7 = w4
    }
    frame "⬇️" {
      w6 = w5
      w7 = w4
    }
    frame "↙️" {
      w6 = w4
      w7 = w4
    }
    frame "⬅️" {
      w6 = w4
      w7 = w5
    }
    frame "↖️" {
      w6 = w4
      w7 = $spaces
    }
  }
  Add(w2, w7) -> w8
  Add(w1, w6) -> w9
  Property Node(instance in=w3, "X"=w9, "Y"=w8) -> (instance out=w10)
  $"position out" <- w10
