vi "Snake Move System.gvi"   [LabVIEW NXG 3.1.0]
inputs:
  "game state in": "Game State.gtype"
outputs:
  "game state out": "Game State.gtype"
types:
  "Direction.gtype" = enum{"⬆️", "↗️", "➡️", "↘️", "⬇️", "↙️", "⬅️", "↖️"}
  "Edible.gtype" = bool
  "Snake Body.gtype" = bool
  "Entity.gtype" = cluster{"Direction": "Direction.gtype"[], "Edible": "Edible.gtype"[], "Position": "Position.gtype"[], "Snake Body": "Snake Body.gtype"[], "Snake Head": "Snake Head.gtype"[]}
  "Game State.gtype" = cluster{"World Size": cluster{"Width": u32, "Height": u32}, "Entities": "Entity.gtype"[]}
uses:
  WebApp::SubVIs::Snake Head Index.gvi
  WebApp::Entitiy Components::Direction::Direction Get.gvi
  WebApp::Entitiy Components::Position::Position Get.gvi
  WebApp::SubVIs::Translate Position in Direction.gvi
  WebApp::Entitiy Components::Position::Position Set.gvi
diagram:
  call "Snake Head Index.gvi"() -> (Index=w1)
  call "Direction Get.gvi"(game state in=$"game state in", entity index=w1) -> (direction=w2)
  call "Position Get.gvi"(game state in=$"game state in", entity index=w1) -> (position=w3)
  call "Translate Position in Direction.gvi"(position in=w3, direction=w2) -> (position out=w4)
  call "Position Set.gvi"(game state in=$"game state in", enitity index=w1, position=w4) -> (game state out=w5)
  $"game state out" <- w5
