vi "index.gviweb"   [LabVIEW NXG 3.1.0]
panel controls:
  "left": bool
  "right": bool
panel indicators:
  "Snake Game": cluster{"X": i32[], "Y": i32[]}[]
  "X": i32[]
  "Y": i32[]
  "loop iteration": i32
  "ms per iteration": u32
uses:
  Snek::Systems::Initialization System.gvi
  Snek::Milliseconds Per Iteration.gvi
  Snek::Systems::Process User Input System.gvi
  Snek::Systems::Snake Move System.gvi
  Snek::Systems::Render System.gvi
  Snek::SubVIs::Snake Head Index.gvi
diagram:
  call "Initialization System.gvi"() -> (game state out=w1)
  Property Node(instance in=w1) -> ("User Actions"=w2, instance out=w3)
  while {
    event {
      on "left" Value changed {
        Enqueue Element(element="rotate ccw", queue=w2)
      }
      on "right" Value changed {
        Enqueue Element(element="rotate cw", queue=w2)
      }
    }
    stop if FALSE
  }
  s1 = w3  # shift register
  while (iteration -> i1) {
    call "Milliseconds Per Iteration.gvi"() -> (ms per iteration=w4)
    $"ms per iteration" <- w4
    Wait(time to wait=10)
    call "Process User Input System.gvi"(game state in=s1) -> (game state out=w5)
    call "Snake Move System.gvi"(game state in=w5) -> (game state out=w6)
    call "Render System.gvi"(game state in=w6) -> (game state rendered=w7)
    $"Snake Game" <- w7
    call "Snake Head Index.gvi"() -> (Index=w8)
    Array Index(array=w7) -> (out0[w8]=w9)
    Property Node(instance in=w9) -> ("X"=w10, "Y"=w11)
    $X <- w10
    $Y <- w11
    $"loop iteration" <- i1
    next s1 = w6
    stop if FALSE
  }
