vi "Position.gvi"   [LabVIEW NXG 3.1.0]
inputs:
  "entity attributes in": "entity attributes.gtype"
  "x": f64, required
  "y": f64, required
  "z": f64, required
outputs:
  "entity attributes out": "entity attributes.gtype"
types:
  "property value config.gtype" = cluster{"type": string, "propertyValueJSON": string}
  "property value configs.gtype" = "property value config.gtype"[]
  "attribute value config.gtype" = cluster{"attributeValue": string, "exists": bool}
  "attribute value configs.gtype" = "attribute value config.gtype"[]
  "entity attributes.gtype" = cluster{"property names": string[], "property value configs": "property value configs.gtype", "attribute names": string[], "attribute value configs": "attribute value configs.gtype"}
uses:
  DOM::Shared::Append Property Value Config as Double.gvi
diagram:
  Property Node(instance in=$"entity attributes in") -> ("property names"=w1, "property value configs"=w2, instance out=w3)
  Build Array(w1, "object3D.position.x", "object3D.position.y", "object3D.position.z") -> w4
  call "Append Property Value Config as Double.gvi"(property value configs in=w2, value=$x) -> (property value configs out=w5)
  call "Append Property Value Config as Double.gvi"(property value configs in=w5, value=$y) -> (property value configs out=w6)
  call "Append Property Value Config as Double.gvi"(property value configs in=w6, value=$z) -> (property value configs out=w7)
  Property Node(instance in=w3, "property names"=w4, "property value configs"=w7) -> (instance out=w8)
  $"entity attributes out" <- w8
