vi "Rotation.gvi"   [LabVIEW NXG 3.1.0]
inputs:
  "entity attributes in": "entity attributes.gtype"
  "x": f64
  "y": f64
  "z": f64
outputs:
  "entity attributes out": "entity attributes.gtype"
types:
  "property value config.gtype" = cluster{"type": string, "propertyValueJSON": string}
  "property value configs.gtype" = "property value config.gtype"[]
  "attribute value config.gtype" = cluster{"attributeValue": string, "exists": bool}
  "attribute value configs.gtype" = "attribute value config.gtype"[]
  "entity attributes.gtype" = cluster{"property names": string[], "property value configs": "property value configs.gtype", "attribute names": string[], "attribute value configs": "attribute value configs.gtype"}
uses:
  DOM::Shared::Append Property Value Config as Double.gvi
diagram:
  Property Node(instance in=$"entity attributes in") -> ("property names"=w1, "property value configs"=w2, instance out=w3)
  Build Array(w1, "object3D.rotation.x", "object3D.rotation.y", "object3D.rotation.z") -> w4
  Divide(x=f64 default, y=180) -> w5
  Multiply($x, w5) -> w6
  call "Append Property Value Config as Double.gvi"(property value configs in=w2, value=w6) -> (property value configs out=w7)
  Multiply($y, w5) -> w8
  call "Append Property Value Config as Double.gvi"(property value configs in=w7, value=w8) -> (property value configs out=w9)
  Multiply($z, w5) -> w10
  call "Append Property Value Config as Double.gvi"(property value configs in=w9, value=w10) -> (property value configs out=w11)
  Property Node(instance in=w3, "property names"=w4, "property value configs"=w11) -> (instance out=w12)
  $"entity attributes out" <- w12
