vi "Create Entity.gvi"   [LabVIEW NXG 3.1.0]
inputs:
  "error in": error
  "entity attributes in": "entity attributes.gtype"
  "scene reference in": "scene reference.gtype"
outputs:
  "entity reference": "entity reference.gtype"
  "error out": error
  "scene reference out": "scene reference.gtype"
types:
  "attribute.gtype" = cluster{"name": string, "valueJSON": string}
  "entity attributes.gtype" = "attribute.gtype"[]
  "scene reference.gtype" = i32
  "entity reference.gtype" = u32
uses:
  AugmentedReality::Support::AugmentedReality.jsli::CreateEntity
diagram:
  $"scene reference out" <- $"scene reference in"
  Flatten To JSON(anything=$"entity attributes in") -> (JSON string=w1)
  call "CreateEntity"(scene reference=$"scene reference in", attributesJSON=w1, error in=$"error in") -> (entity reference=w2, error out=w3)
  $"entity reference" <- w2
  $"error out" <- w3
