vi "Create GLTF Model Entity.gvi"   [LabVIEW NXG 3.1.0]
inputs:
  "scene reference in": "scene reference.gtype", required
  "error in": error
  "src": string, required
  "entity attributes in": "entity attributes.gtype"
outputs:
  "scene reference out": "scene reference.gtype"
  "entity reference": "entity reference.gtype"
  "error out": error
types:
  "entity reference.gtype" = u32
  "attribute.gtype" = cluster{"name": string, "valueJSON": string}
  "entity attributes.gtype" = "attribute.gtype"[]
  "scene reference.gtype" = i32
uses:
  AugmentedReality::Support::Append Attribute.gvi
  AugmentedReality::Support::AugmentedReality.jsli::CreateGLTFModelEntity
diagram:
  $"scene reference out" <- $"scene reference in"
  Property Node(instance in=cluster{"data": string} {all zero or empty}, "data"=$src) -> (instance out=w1)
  Flatten To JSON(anything=w1) -> (JSON string=w2)
  call "Append Attribute.gvi"(entity attributes in=$"entity attributes in", name="src", valueJSON=w2) -> (entity attributes out=w3)
  Flatten To JSON(anything=w3) -> (JSON string=w4)
  call "CreateGLTFModelEntity"(scene reference=$"scene reference in", attributesJSON=w4, error in=$"error in") -> (entity reference=w5, error out=w6)
  $"entity reference" <- w5
  $"error out" <- w6
