vi "Destroy Entity.gviweb"   [LabVIEW NXG 3.1.0]
inputs:
  "error in": error
  "entity reference": "entity reference.gtype", required
outputs:
  "error out": error
types:
  "entity reference.gtype" = u32
uses:
  AugmentedReality::Support::AugmentedReality.jsli::DestroyEntity
diagram:
  call "DestroyEntity"(entity reference=$"entity reference") -> (error out=w1)
  Merge Errors($"error in", w1) -> (error out=w2)
  $"error out" <- w2
