vi "Update Entity.gvi"   [LabVIEW NXG 3.1.0]
inputs:
  "error in": error
  "entity reference in": "entity reference.gtype", required
  "entity attributes": "entity attributes.gtype", required
outputs:
  "error out": error
  "entity reference out": "entity reference.gtype"
types:
  "entity reference.gtype" = u32
  "property value config.gtype" = cluster{"type": string, "propertyValueJSON": string}
  "property value configs.gtype" = "property value config.gtype"[]
  "attribute value config.gtype" = cluster{"attributeValue": string, "exists": bool}
  "attribute value configs.gtype" = "attribute value config.gtype"[]
  "entity attributes.gtype" = cluster{"property names": string[], "property value configs": "property value configs.gtype", "attribute names": string[], "attribute value configs": "attribute value configs.gtype"}
uses:
  DOM::Configure::Set Properties.gvi
  DOM::Configure::Set Attributes.gvi
diagram:
  $"entity reference out" <- $"entity reference in"
  Property Node(instance in=$"entity attributes") -> ("property names"=w1, "property value configs"=w2, instance out=w3)
  call "Set Properties.gvi"(element reference in=$"entity reference in", property names=w1, property value configs=w2, error in=$"error in") -> (error out=w4)
  Property Node(instance in=w3) -> ("attribute names"=w5, "attribute value configs"=w6)
  call "Set Attributes.gvi"(element reference in=$"entity reference in", attribute names=w5, attribute value configs=w6, error in=w4) -> (error out=w7)
  $"error out" <- w7
