vi "Update Entity.gviweb"   [LabVIEW NXG 3.1.0]
inputs:
  "entity reference in": "entity reference.gtype", required
  "error in": error
  "entity attributes": "entity attributes.gtype", required
outputs:
  "error out": error
panel indicators:
  "entity reference out": "entity reference.gtype"
types:
  "entity reference.gtype" = u32
  "attribute.gtype" = cluster{"name": string, "valueJSON": string}
  "entity attributes.gtype" = "attribute.gtype"[]
uses:
  AugmentedReality::Support::AugmentedReality.jsli::UpdateEntity
diagram:
  $"entity reference out" <- $"entity reference in"
  Flatten To JSON(anything=$"entity attributes") -> (JSON string=w1)
  call "UpdateEntity"(entity reference=$"entity reference in", attributesJSON=w1, error in=$"error in") -> (error out=w2)
  $"error out" <- w2
