vi "Create GLTF Model.gviweb"   [LabVIEW NXG 3.1.0]
inputs:
  "src": string, required
  "attributes": cluster{"name": string, "value": string}[]
  "error in": error
  "scene refnum": "scene refnum.gtype", required
outputs:
  "error out": error
  "gltf model refnum": "gltf model refnum.gtype"
types:
  "gltf model refnum.gtype" = u32
  "scene refnum.gtype" = i32
uses:
  AugmentedReality::Support::AugmentedReality.jsli::CreateGLTFModel
diagram:
  Flatten To JSON(anything=$attributes) -> (JSON string=w1)
  call "CreateGLTFModel"(scene refnum=$"scene refnum", src=$src, attributesJSON=w1, error in=$"error in") -> (gltf model refnum=w2, error out=w3)
  $"gltf model refnum" <- w2
  $"error out" <- w3
