vi "Destroy GLTF Model.gviweb"   [LabVIEW NXG 3.1.0]
inputs:
  "error in": error
  "gltf model refnum": "gltf model refnum.gtype", required
outputs:
  "error out": error
types:
  "gltf model refnum.gtype" = u32
uses:
  AugmentedReality::Support::AugmentedReality.jsli::DestroyGLTFModel
diagram:
  call "DestroyGLTFModel"(gltf model refnum=$"gltf model refnum") -> (error out=w1)
  Merge Errors($"error in", w1) -> (error out=w2)
  $"error out" <- w2
