vi "Update GLTF Model.gviweb"   [LabVIEW NXG 3.1.0]
inputs:
  "gltf model refnum": "gltf model refnum.gtype", required
  "error in": error
  "attributes": cluster{"name": string, "value": string}[], required
outputs:
  "error out": error
types:
  "gltf model refnum.gtype" = u32
uses:
  AugmentedReality::Support::AugmentedReality.jsli::UpdateGLTFModel
diagram:
  Flatten To JSON(anything=$attributes) -> (JSON string=w1)
  call "UpdateGLTFModel"(gltf model refnum=$"gltf model refnum", attributesJSON=w1, error in=$"error in") -> (error out=w2)
  $"error out" <- w2
