vi "Destroy Scene.gvi"   [LabVIEW NXG 3.1.0]
inputs:
  "error in": error
  "scene reference": "scene reference.gtype", required
outputs:
  "error out": error
types:
  "scene reference.gtype" = i32
uses:
  AugmentedReality::Support::AugmentedReality.jsli::DestroyScene
diagram:
  call "DestroyScene"(scene reference=$"scene reference") -> (error out=w1)
  Merge Errors($"error in", w1) -> (error out=w2)
  $"error out" <- w2
