vi "Destroy Scene.gviweb"   [LabVIEW NXG 3.1.0]
inputs:
  "error in": error
  "scene refnum": "scene refnum.gtype"
outputs:
  "error out": error
types:
  "scene refnum.gtype" = i32
uses:
  AugmentedReality::Support::AugmentedReality.jsli::DestroyScene
diagram:
  call "DestroyScene"(scene refnum=$"scene refnum") -> (error out=w1)
  Merge Errors($"error in", w1) -> (error out=w2)
  $"error out" <- w2
