vi "Append Attribute.gvi"   [LabVIEW NXG 3.1.0]
inputs:
  "entity attributes in": "entity attributes.gtype", required
  "name": string, required
  "valueJSON": string, required
outputs:
  "entity attributes out": "entity attributes.gtype"
types:
  "attribute.gtype" = cluster{"name": string, "valueJSON": string}
  "entity attributes.gtype" = "attribute.gtype"[]
diagram:
  Property Node(instance in="attribute.gtype" {all zero or empty}, "name"=$name, "valueJSON"=$valueJSON) -> (instance out=w1)
  Build Array($"entity attributes in", w1) -> w2
  $"entity attributes out" <- w2
