vi "Set Model Height.gviweb"   [LabVIEW NXG 3.1.0]
inputs:
  "gltf model reference": "gltf model reference.gtype"
  "height": u32
  "error in": error
outputs:
  "error out": error
types:
  "gltf model reference.gtype" = u32
uses:
  AugmentedReality::GLTF Model::Update GLTF Model.gviweb
diagram:
  Format Into String(formatString="0 %d 0", $height) -> w1
  w2 = cluster{"name": string, "value": string} {"name"="position", "value"=""}
  Property Node(instance in=w2, "value"=w1) -> (instance out=w3)
  Build Array(w3) -> w4
  call "Update GLTF Model.gviweb"(gltf model reference=$"gltf model reference", attributes=w4, error in=$"error in") -> (error out=w5)
  $"error out" <- w5
