vi "index.gviweb"   [LabVIEW NXG 3.1.0]
panel controls:
  "Height Offset of Box": u32
  "start camera": bool
  "Tab": i32
  "Hyperlink Control": string = "https://sketchfab.com/models/031875966a5740f18ac4cffa8b14031d#"
  "Hyperlink Control_2": string = "https://medium.com/arjs/augmented-reality-in-10-lines-of-html-4e193ea9fdbf"
  "clear model": bool
  "clear scene": bool
panel indicators:
  "URL Image": string
  "Output": error
uses:
  AugmentedReality::Scene::Create Scene.gviweb
  AugmentedReality::GLTF Model::Create GLTF Model.gviweb
  WebApp::Set Model Height.gviweb
  AugmentedReality::GLTF Model::Destroy GLTF Model.gviweb
  AugmentedReality::Scene::Destroy Scene.gviweb
diagram:
  while {
    Wait(time to wait=10)
    stop if $"start camera"
  }
  call "Create Scene.gviweb"(selector=".eagle-demo", error in=no error) -> (scene reference=w1, error out=w2)
  # This path is based on the deployed output the path from AugmentedReality.html to the models stored in this WebApp.
  #
  # Because edit and deploy paths differ this will only work in deployment.
  call "Create GLTF Model.gviweb"(scene reference=w1, src="../../scene.gltf", error in=w2) -> (gltf model reference=w3, error out=w4)
  s1 = w4  # shift register
  while {
    call "Set Model Height.gviweb"(gltf model reference=w3, height=$"Height Offset of Box", error in=s1) -> (error out=w5)
    Wait(time to wait=10)
    next s1 = w5
    stop if $"clear model"
  }
  call "Destroy GLTF Model.gviweb"(gltf model reference=w3, error in=s1) -> (error out=w6)
  while {
    Wait(time to wait=10)
    stop if $"clear scene"
  }
  call "Destroy Scene.gviweb"(scene reference=w1, error in=w6) -> (error out=w7)
  $Output <- w7
