vi "Create Navbar.gvi"   [LabVIEW NXG 3.1.0]
inputs:
  "error in": error
  "relative path to root": string, required
outputs:
  "error out": error
uses:
  Bootstrap::Load Bootstrap.gvi
  Navigation::Insert Html Before Front Panel Wrapper.gvi
diagram:
  # All the urls should be relative from the Web Application Component root. Note the %s replacements to handle relative urls between WebVIs.
  # Documentation for bootstrap navbars:
  # https://getbootstrap.com/docs/4.0/components/navbar/
  #
  # More bootstrap navbar examples:
  # https://getbootstrap.com/docs/4.0/examples/#navbars
  w1 = """<nav class="navbar navbar-expand-md navbar-dark bg-dark">
    <a class="navbar-brand" href="%sindex.html">Fixed navbar</a>
    <button class="navbar-toggler" type="button" data-toggle="collapse" data-target="#webviNavbar" aria-controls="webviNavbar" aria-expanded="false" aria-label="Toggle navigation">
        <span class="navbar-toggler-icon"></span>
    </button>
    <div class="collapse navbar-collapse" id="webviNavbar">
        <ul class="navbar-nav mr-auto">
            <li class="nav-item">
                <a class="nav-link" href="%sindex.html">Home</a>
            </li>
            <li class="nav-item">
                <a class="nav-link" href="%sdevices/cpu.html">CPU</a>
            </li>
        </ul>
    </div>
</nav>
"""
  call "Load Bootstrap.gvi"(error in=$"error in") -> (error out=w2)
  Format Into String(formatString=w1, errIn=w2, $"relative path to root", $"relative path to root", $"relative path to root") -> (outString=w3, errOut=w4)
  call "Insert Html Before Front Panel Wrapper.gvi"(html to insert=w3, error in=w4) -> (error out=w5)
  $"error out" <- w5
