vi "index.gviweb"   [LabVIEW NXG 3.1.0]
panel controls:
  "String": string
  "Make Busy": bool
  "Busy time (s)": f64 = 5
panel indicators:
  "String_2": string
  "loop iteration": i32
uses:
  BusyStateAPI::BusyStateAPI.jsli::SetBusy
  BusyStateAPI::BusyStateAPI.jsli::UnsetBusy
diagram:
  while (iteration -> i1) {
    Wait(time to wait=10)
    $"loop iteration" <- i1
    stop if FALSE
  }
  Obtain Queue(element data type=f64 0) -> (queue out=w1)
  while {
    event {
      on "Make Busy" Value changed {
        Enqueue Element(element=$"Busy time (s)", queue=w1)
      }
      on "String" Value changed {
        Event Data() -> ("New Value"=w2)
        $String_2 <- w2
      }
    }
    stop if FALSE
  }
  while {
    Dequeue Element(queue=w1) -> (element=w3, error out=w4)
    call "SetBusy"(error in=w4) -> (error out=w5)
    sequence {
      frame 0 {
        Multiply(w3, 1000) -> w6
        Wait(time to wait=w6)
      }
    }
    call "UnsetBusy"(error in=w5)
    stop if FALSE
  }
