vi "Button - Glyph - Create Image URL Style.gvi"   [G Web Development Software 22.0.0]
inputs:
  "error in": error
  "reference in": "BooleanControl reference", required
  "url": string, required
outputs:
  "reference out": "BooleanControl reference"
  "style reference": "style reference.gtype"
  "error out": error
types:
  "style reference.gtype" = "NI.JavaScriptReference"
uses:
  ControlExtensions::Support::Obtain JavaScript Reference - GObject.gvi
  ControlExtensions::Support::ControlExtensions.jsli::ButtonGlyphCreateImageURLStyle
diagram:
  $"reference out" <- $"reference in"
  call "Obtain JavaScript Reference - GObject.gvi"(reference in=$"reference in", error in=$"error in") -> (error out=w1, javascript reference out=w2)
  call "ButtonGlyphCreateImageURLStyle"(element=w2, url=$url, error in=w1) -> (style=w3, error out=w4)
  $"style reference" <- w3
  Close Reference(error in=w4, reference=w2) -> (error out=w5)
  $"error out" <- w5
