vi "Data Grid - Column by Index - Set Gouping.gvi"   [G Web Development Software 22.3.0]
inputs:
  "reference in": "DataGrid reference", required
  "column indexes": u32[], required
  "error in": error
outputs:
  "error out": error
  "reference out": "DataGrid reference"
uses:
  ControlExtensions::Support::Obtain JavaScript Reference - GObject.gvi
  ControlExtensions::Support::ControlExtensions.jsli::DataGridColumnByIndexSetGrouping
diagram:
  $"reference out" <- $"reference in"
  call "Obtain JavaScript Reference - GObject.gvi"(reference in=$"reference in", error in=$"error in") -> (error out=w1, javascript reference out=w2)
  call "DataGridColumnByIndexSetGrouping"(element=w2, index=$"column indexes", error in=w1) -> (error out=w3)
  Close Reference(error in=w3, reference=w2) -> (error out=w4)
  $"error out" <- w4
