vi "Data Grid - Column by Index - Set Sorting.gvi"   [G Web Development Software 22.0.0]
inputs:
  "reference in": "DataGrid reference", required
  "column index": u32, required
  "sort": "sort.gtype" = "none", required
  "error in": error
outputs:
  "error out": error
  "reference out": "DataGrid reference"
types:
  "sort.gtype" = enum{"none", "ascending", "descending"}
uses:
  ControlExtensions::Support::Obtain JavaScript Reference - GObject.gvi
  ControlExtensions::Support::ControlExtensions.jsli::DataGridColumnByIndexSetSorting
diagram:
  $"reference out" <- $"reference in"
  Format Into String(errIn=$"error in", $sort) -> (outString=w1, errOut=w2)
  call "Obtain JavaScript Reference - GObject.gvi"(reference in=$"reference in", error in=w2) -> (error out=w3, javascript reference out=w4)
  call "DataGridColumnByIndexSetSorting"(element=w4, index=$"column index", sort=w1, error in=w3) -> (error out=w5)
  Close Reference(error in=w5, reference=w4) -> (error out=w6)
  $"error out" <- w6
