vi "Data Grid - String Column - Create Background Color Style.gvi"   [G Web Development Software 22.3.0]
inputs:
  "reference in": "DataGrid reference", required
  "error in": error
  "column index": u32, required
  "color": "Color.gtype", required
  "match operator": "match operator.gtype" = "disabled"
  "match text": string
outputs:
  "error out": error
  "reference out": "DataGrid reference"
  "style reference": "style reference.gtype"
types:
  "Color.gtype" = u32
  "style reference.gtype" = "NI.JavaScriptReference"
  "match operator.gtype" = enum{"disabled", "exact match", "starts with", "ends with", "contains"}
uses:
  ControlExtensions::Support::Obtain JavaScript Reference - GObject.gvi
  ControlExtensions::Support::Color to CSS hex.gvi
  ControlExtensions::Support::ControlExtensions.jsli::DataGridStringColumnCreateBackgroundColorStyle
diagram:
  $"reference out" <- $"reference in"
  Format Into String(errIn=$"error in", $"match operator") -> (outString=w1, errOut=w2)
  call "Obtain JavaScript Reference - GObject.gvi"(reference in=$"reference in", error in=w2) -> (error out=w3, javascript reference out=w4)
  call "Color to CSS hex.gvi"(color=$color) -> (css hex color=w5)
  call "DataGridStringColumnCreateBackgroundColorStyle"(element=w4, index=$"column index", matchOperator=w1, matchText=$"match text", color=w5, error in=w3) -> (style=w6, error out=w7)
  Close Reference(error in=w7, reference=w4) -> (error out=w8)
  $"error out" <- w8
  $"style reference" <- w6
