vi "Data Grid - String Column - Create Text Overflow Scrollbar Style.gvi"   [G Web Development Software 22.3.0]
inputs:
  "reference in": "DataGrid reference", required
  "error in": error
  "column index": u32, required
outputs:
  "error out": error
  "reference out": "DataGrid reference"
  "style reference": "style reference.gtype"
types:
  "style reference.gtype" = "NI.JavaScriptReference"
uses:
  ControlExtensions::Support::Obtain JavaScript Reference - GObject.gvi
  ControlExtensions::Support::ControlExtensions.jsli::DataGridStringColumnCreateTextOverflowScrollbarStyle
diagram:
  $"reference out" <- $"reference in"
  call "Obtain JavaScript Reference - GObject.gvi"(reference in=$"reference in", error in=$"error in") -> (error out=w1, javascript reference out=w2)
  call "DataGridStringColumnCreateTextOverflowScrollbarStyle"(element=w2, index=$"column index", error in=w1) -> (style=w3, error out=w4)
  Close Reference(error in=w4, reference=w2) -> (error out=w5)
  $"error out" <- w5
  $"style reference" <- w3
