vi "GObject - Tooltip - Set.gvi"   [G Web Development Software 22.3.0]
# Sets the Tooltip of a control.
# Note: Tooltips are only visible on desktop via mouse hover.
# Note: URL Image controls must configure the “Alternate text” property instead of this VI.
inputs:
  "reference in": "GObject reference", required
  "tooltip": string, required
  "error in": error
outputs:
  "reference out": "GObject reference"
  "error out": error
uses:
  ControlExtensions::Support::Obtain JavaScript Reference - GObject.gvi
  ControlExtensions::Support::ControlExtensions.jsli::GObjectTooltipSet
diagram:
  $"reference out" <- $"reference in"
  call "Obtain JavaScript Reference - GObject.gvi"(reference in=$"reference in", error in=$"error in") -> (error out=w1, javascript reference out=w2)
  call "GObjectTooltipSet"(element=w2, tooltip=$tooltip, error in=w1) -> (error out=w3)
  Close Reference(error in=w3, reference=w2) -> (error out=w4)
  $"error out" <- w4
