vi "Gauge - Needle - Set Arrow.gvi"   [G Web Development Software 22.3.0]
inputs:
  "reference in": "RadialNumericPointer reference", required
  "enabled": bool
  "error in": error
outputs:
  "reference out": "RadialNumericPointer reference"
  "error out": error
uses:
  ControlExtensions::Support::Obtain JavaScript Reference - GObject.gvi
  ControlExtensions::Support::ControlExtensions.jsli::GaugeNeedleSetArrow
diagram:
  $"reference out" <- $"reference in"
  call "Obtain JavaScript Reference - GObject.gvi"(reference in=$"reference in", error in=$"error in") -> (error out=w1, javascript reference out=w2)
  call "GaugeNeedleSetArrow"(element=w2, enabled=$enabled, error in=w1) -> (error out=w3)
  Close Reference(error in=w3, reference=w2) -> (error out=w4)
  $"error out" <- w4
