vi "Listbox - Items - Enable Tooltip.gvi"   [G Web Development Software 22.0.0]
inputs:
  "reference in": "Listbox reference", required
  "error in": error
outputs:
  "reference out": "Listbox reference"
  "error out": error
uses:
  ControlExtensions::Support::Obtain JavaScript Reference - GObject.gvi
  ControlExtensions::Support::ControlExtensions.jsli::ListboxItemsEnableTooltip
diagram:
  $"reference out" <- $"reference in"
  call "Obtain JavaScript Reference - GObject.gvi"(reference in=$"reference in", error in=$"error in") -> (error out=w1, javascript reference out=w2)
  call "ListboxItemsEnableTooltip"(element=w2, error in=w1) -> (error out=w3)
  Close Reference(error in=w3, reference=w2) -> (error out=w4)
  $"error out" <- w4
