vi "Numeric - Fill - Set.gvi"   [G Web Development Software 22.3.0]
# Sets the Maximum of a Numeric Control.
# Note: Numeric Text controls must be used with property nodes instead of this VI.
inputs:
  "reference in": "NumericControl reference", required
  "error in": error
  "color": "Color.gtype" = 16777215, required
outputs:
  "reference out": "NumericControl reference"
  "error out": error
types:
  "Color.gtype" = u32
uses:
  ControlExtensions::Support::Obtain JavaScript Reference - GObject.gvi
  ControlExtensions::Support::Color to CSS hex.gvi
  ControlExtensions::Support::ControlExtensions.jsli::NumericFillSet
diagram:
  $"reference out" <- $"reference in"
  call "Obtain JavaScript Reference - GObject.gvi"(reference in=$"reference in", error in=$"error in") -> (error out=w1, javascript reference out=w2)
  call "Color to CSS hex.gvi"(color=$color) -> (css hex color=w3)
  call "NumericFillSet"(element=w2, color=w3, error in=w1) -> (error out=w4)
  Close Reference(error in=w4, reference=w2) -> (error out=w5)
  $"error out" <- w5
