vi "Numeric - Scale - Set Maximum.gvi"   [G Web Development Software 22.3.0]
# Sets the Maximum of a Numeric Control.
# Note: Numeric Text controls must be used with property nodes instead of this VI.
inputs:
  "reference in": "NumericControl reference", required
  "error in": error
  "maximum": f64, required
outputs:
  "reference out": "NumericControl reference"
  "error out": error
uses:
  ControlExtensions::Support::Obtain JavaScript Reference - GObject.gvi
  ControlExtensions::Support::ControlExtensions.jsli::NumericScaleSetMaximum
diagram:
  $"reference out" <- $"reference in"
  call "Obtain JavaScript Reference - GObject.gvi"(reference in=$"reference in", error in=$"error in") -> (error out=w1, javascript reference out=w2)
  call "NumericScaleSetMaximum"(element=w2, maximum=$maximum, error in=w1) -> (error out=w3)
  Close Reference(error in=w3, reference=w2) -> (error out=w4)
  $"error out" <- w4
