vi "Numeric - Scale - Set Minimum.gvi"   [G Web Development Software 22.3.0]
# Sets the Minimum of a Numeric Control.
# Note: Numeric Text controls must be used with property nodes instead of this VI.
inputs:
  "error in": error
  "reference in": "NumericControl reference", required
  "minimum": f64, required
outputs:
  "error out": error
  "reference out": "NumericControl reference"
uses:
  ControlExtensions::Support::Obtain JavaScript Reference - GObject.gvi
  ControlExtensions::Support::ControlExtensions.jsli::NumericScaleSetMinimum
diagram:
  $"reference out" <- $"reference in"
  call "Obtain JavaScript Reference - GObject.gvi"(reference in=$"reference in", error in=$"error in") -> (error out=w1, javascript reference out=w2)
  call "NumericScaleSetMinimum"(element=w2, minimum=$minimum, error in=w1) -> (error out=w3)
  Close Reference(error in=w3, reference=w2) -> (error out=w4)
  $"error out" <- w4
