vi "Style Remove.gvi"   [G Web Development Software 22.3.0]
inputs:
  "error in": error
  "style reference": "style reference.gtype", required
outputs:
  "error out": error
types:
  "style reference.gtype" = "NI.JavaScriptReference"
uses:
  ControlExtensions::Support::ControlExtensions.jsli::StyleRemove
diagram:
  call "StyleRemove"(style=$"style reference") -> (error out=w1)
  Merge Errors($"error in", w1) -> (error out=w2)
  Close Reference(error in=w2, reference=$"style reference") -> (error out=w3)
  $"error out" <- w3
