vi "Color to CSS hex.gvi"   [G Web Development Software 22.3.0]
inputs:
  "color": "Color.gtype", required
outputs:
  "css hex color": string
types:
  "Color.gtype" = u32
uses:
  ControlExtensions::Support::Color to RGBA.gvi
diagram:
  call "Color to RGBA.gvi"(Color Constant=$color) -> (red=w1, green=w2, blue=w3, alpha=w4)
  Format Into String(formatString="#%02x%02x%02x%02x", w1, w2, w3, w4) -> w5
  $"css hex color" <- w5
