vi "Tree - Column - Set Width.gvi"   [G Web Development Software 22.0.0]
inputs:
  "reference in": "TreeControl reference", required
  "error in": error
  "column index": u32, required
  "width": u32 = 100, required
outputs:
  "reference out": "TreeControl reference"
  "error out": error
uses:
  ControlExtensions::Support::Obtain JavaScript Reference - GObject.gvi
  ControlExtensions::Support::ControlExtensions.jsli::TreeColumnSetWidth
diagram:
  $"reference out" <- $"reference in"
  call "Obtain JavaScript Reference - GObject.gvi"(reference in=$"reference in", error in=$"error in") -> (error out=w1, javascript reference out=w2)
  call "TreeColumnSetWidth"(element=w2, index=$"column index", width=$width, error in=w1) -> (error out=w3)
  Close Reference(error in=w3, reference=w2) -> (error out=w4)
  $"error out" <- w4
