vi "index.gviweb"   [G Web Development Software 22.3.0]
panel controls:
  "tab": i32
  "tab selector visible?": bool = TRUE
  "listbox": i32 = -1
  "color absolute link": string = "backgrounds/color-absolute.html"
  "color flexible link": string = "backgrounds/color-flexible.html"
  "Gadient flexible link": string = "backgrounds/gradient-flexible.html"
  "Gadient absolute link": string = "backgrounds/gradient-absolute.html"
  "Plain absolute link": string = "backgrounds/plain-absolute.html"
  "Plain flexible link": string = "backgrounds/plain-flexible.html"
  "tree column width": u32 = 100
  "data grid column sorting": enum{"none", "ascending", "descending"} = "none"
  "button": bool
  "numeric slider": f64 = 5
  "numeric set minimum": f64
  "numeric set maximum": f64 = 10
  "data grid column grouping": enum{"none", "by color", "by farm then color"} = "none"
  "enable arrow?": bool
  "Gauge": f64 = 3.4098059503
  "Data Grid Styled": T2[] = [{"Custom Colors"="A", "Highlight Pass Exact"="pass", "Highlight Fail Contain"="fail", "Long Text Scrollbar"="Lorem ipsum dolor sit amet, consectetur adipiscing elit, sed do eiusmod tempor incididunt ut labore et dolore magna aliqua. Ut enim ad minim veniam, quis nostrud exercitation ullamco laboris nisi ut aliquip ex ea commodo consequat. Duis aute irure dolor in reprehenderit in voluptate velit esse cillum dolore eu fugiat nulla pariatur. Excepteur sint occaecat cupidatat non proident, sunt in culpa qui officia deserunt mollit anim id est laborum."}, {"Custom Colors"="B", "Highlight Pass Exact"="passage", "Highlight Fail Contain"="failure", "Long Text Scrollbar"=""}, {"Custom Colors"="C", "Highlight Pass Exact"="success", "Highlight Fail Contain"="error", "Long Text Scrollbar"=""}, {"Custom Colors"="", "Highlight Pass Exact"="", "Highlight Fail Contain"="", "Long Text Scrollbar"=""}, {"Custom Colors"="", "Highlight Pass Exact"="", "Highlight Fail Contain"="", "Long Text Scrollbar"=""}]
  "clear button glyph style": bool
  "chart clear history": bool
  "color absolute link_2": string = "kitchensink/arrays.html"
  "color absolute link_3": string = "kitchensink/buttons.html"
  "color absolute link_4": string = "kitchensink/charts.html"
  "color absolute link_5": string = "kitchensink/clusters.html"
  "color absolute link_6": string = "kitchensink/decorations.html"
  "color absolute link_7": string = "kitchensink/layouts.html"
  "color absolute link_8": string = "kitchensink/numerics.html"
  "color absolute link_9": string = "kitchensink/selectors.html"
  "color absolute link_10": string = "kitchensink/text.html"
  "numeric fill color": "Color.gtype" = 4282615481
panel indicators:
  "tree": cluster{"location": string}[]
  "data grid": T1[]
  "numeric gauge": f64
  "numeric tank": f64
  "numeric linear progress bar": f64
  "numeric radial progress bar": f64
  "Chart": f64
types:
  T1 = cluster{"Food": string, "Color": string, "Farm": string}
  T2 = cluster{"Custom Colors": string, "Highlight Pass Exact": string, "Highlight Fail Contain": string, "Long Text Scrollbar": string}
  "Color.gtype" = u32
uses:
  ControlExtensions::Button - Glyph - Create Image URL Style.gvi
  ControlExtensions::Data Grid - Column by Index - Set Sorting.gvi
  WebApp::Support::Show Error Dialog.gvi
  ControlExtensions::Tab - Selector - Visible.gvi
  ControlExtensions::Tree - Column - Set Width.gvi
  ControlExtensions::Numeric - Scale - Set Maximum.gvi
  ControlExtensions::Numeric - Scale - Set Minimum.gvi
  ControlExtensions::Data Grid - Column by Index - Set Gouping.gvi
  ControlExtensions::Gauge - Needle - Set Arrow.gvi
  ControlExtensions::Style Remove.gvi
  ControlExtensions::Chart - History - Clear.gvi
  ControlExtensions::Numeric - Fill - Set.gvi
  ControlExtensions::Listbox - Items - Enable Tooltip.gvi
  ControlExtensions::Tree - Cells - Enable Tooltip.gvi
  ControlExtensions::Data Grid - String Column - Create Background Color Style.gvi
  ControlExtensions::Data Grid - String Column - Create Font Color Style.gvi
  ControlExtensions::Data Grid - String Column - Create Text Overflow Scrollbar Style.gvi
diagram:
  call "Button - Glyph - Create Image URL Style.gvi"(reference in=reference to "button", url="Support/lightbulb.svg") -> (style reference=w1, error out=w2)
  while {
    event {
      on "data grid column sorting" Value changed {
        Event Data() -> ("New Value"=w3)
        call "Data Grid - Column by Index - Set Sorting.gvi"(reference in=reference to "data grid", column index=0, sort=w3) -> (error out=w4)
        call "Show Error Dialog.gvi"(error in=w4)
      }
      on "tab selector visible?" Value changed {
        Event Data() -> ("New Value"=w5)
        call "Tab - Selector - Visible.gvi"(reference in=reference to "tab", visible?=w5) -> (error out=w6)
        call "Show Error Dialog.gvi"(error in=w6)
      }
      on "tree column width" Value changed {
        Event Data() -> ("New Value"=w7)
        call "Tree - Column - Set Width.gvi"(reference in=reference to "tree", column index=0, width=w7) -> (error out=w8)
        call "Show Error Dialog.gvi"(error in=w8)
      }
      on "numeric set maximum" Value changed {
        Event Data() -> ("New Value"=w9)
        call "Numeric - Scale - Set Maximum.gvi"(reference in=reference to "numeric radial progress bar", maximum=w9) -> (error out=w10)
        call "Show Error Dialog.gvi"(error in=w10)
        call "Numeric - Scale - Set Maximum.gvi"(reference in=reference to "numeric tank", maximum=w9) -> (error out=w11)
        call "Show Error Dialog.gvi"(error in=w11)
        call "Numeric - Scale - Set Maximum.gvi"(reference in=reference to "numeric linear progress bar", maximum=w9) -> (error out=w12)
        call "Show Error Dialog.gvi"(error in=w12)
        call "Numeric - Scale - Set Maximum.gvi"(reference in=reference to "numeric slider", maximum=w9) -> (error out=w13)
        call "Show Error Dialog.gvi"(error in=w13)
        call "Numeric - Scale - Set Maximum.gvi"(reference in=reference to "numeric gauge", maximum=w9) -> (error out=w14)
        call "Show Error Dialog.gvi"(error in=w14)
      }
      on "numeric set minimum" Value changed {
        Event Data() -> ("New Value"=w15)
        call "Numeric - Scale - Set Minimum.gvi"(reference in=reference to "numeric radial progress bar", minimum=w15) -> (error out=w16)
        call "Show Error Dialog.gvi"(error in=w16)
        call "Numeric - Scale - Set Minimum.gvi"(reference in=reference to "numeric tank", minimum=w15) -> (error out=w17)
        call "Show Error Dialog.gvi"(error in=w17)
        call "Numeric - Scale - Set Minimum.gvi"(reference in=reference to "numeric linear progress bar", minimum=w15) -> (error out=w18)
        call "Show Error Dialog.gvi"(error in=w18)
        call "Numeric - Scale - Set Minimum.gvi"(reference in=reference to "numeric slider", minimum=w15) -> (error out=w19)
        call "Show Error Dialog.gvi"(error in=w19)
        call "Numeric - Scale - Set Minimum.gvi"(reference in=reference to "numeric gauge", minimum=w15) -> (error out=w20)
        call "Show Error Dialog.gvi"(error in=w20)
      }
      on "data grid column grouping" Value changed {
        Event Data() -> ("New Value"=w21)
        case (w21) {
          frame "none" {
            w22 = u32[] []
          }
          frame "by color" {
            w22 = [1]
          }
          frame "by farm then color" {
            w22 = [2, 1]
          }
        }
        call "Data Grid - Column by Index - Set Gouping.gvi"(reference in=reference to "data grid", column indexes=w22) -> (error out=w23)
        call "Show Error Dialog.gvi"(error in=w23)
      }
      on "enable arrow?" Value changed {
        Event Data() -> ("New Value"=w24)
        call "Gauge - Needle - Set Arrow.gvi"(reference in=reference to "Gauge", enabled=w24) -> (error out=w25)
        call "Show Error Dialog.gvi"(error in=w25)
      }
      on "clear button glyph style" Value changed {
        call "Style Remove.gvi"(style reference=w1) -> (error out=w26)
        call "Show Error Dialog.gvi"(error in=w26)
        Property Node(instance in=reference to "clear button glyph style", "Disabled"=TRUE)
      }
      on "chart clear history" Value changed {
        call "Chart - History - Clear.gvi"(reference in=reference to "Chart") -> (error out=w27)
        call "Show Error Dialog.gvi"(error in=w27)
      }
      on "numeric fill color" Value changed {
        Event Data() -> ("New Value"=w28)
        call "Numeric - Fill - Set.gvi"(reference in=reference to "numeric radial progress bar", color=w28) -> (error out=w29)
        call "Show Error Dialog.gvi"(error in=w29)
        call "Numeric - Fill - Set.gvi"(reference in=reference to "numeric tank", color=w28) -> (error out=w30)
        call "Show Error Dialog.gvi"(error in=w30)
        call "Numeric - Fill - Set.gvi"(reference in=reference to "numeric linear progress bar", color=w28) -> (error out=w31)
        call "Show Error Dialog.gvi"(error in=w31)
        call "Numeric - Fill - Set.gvi"(reference in=reference to "numeric slider", color=w28) -> (error out=w32)
        call "Show Error Dialog.gvi"(error in=w32)
        call "Numeric - Fill - Set.gvi"(reference in=reference to "numeric gauge", color=w28) -> (error out=w33)
        call "Show Error Dialog.gvi"(error in=w33)
      }
    }
    stop if FALSE
  }
  call "Show Error Dialog.gvi"(error in=w2)
  call "Listbox - Items - Enable Tooltip.gvi"(reference in=reference to "listbox") -> (error out=w34)
  call "Show Error Dialog.gvi"(error in=w34)
  call "Tree - Cells - Enable Tooltip.gvi"(reference in=reference to "tree") -> (error out=w35)
  call "Show Error Dialog.gvi"(error in=w35)
  while {
    Wait(time to wait=100)
    Random Number() -> (number (0 to 1)=w36)
    $Chart <- w36
    stop if FALSE
  }
  call "Data Grid - String Column - Create Background Color Style.gvi"(reference in=reference to "Data Grid Styled", column index=0, color=4284885905) -> (reference out=w37, error out=w38)
  call "Data Grid - String Column - Create Font Color Style.gvi"(reference in=w37, column index=0, color=4294967295, error in=w38) -> (reference out=w39, error out=w40)
  call "Data Grid - String Column - Create Background Color Style.gvi"(reference in=w39, column index=1, color=4286827165, error in=w40, match operator="exact match", match text="pass") -> (reference out=w41, error out=w42)
  call "Data Grid - String Column - Create Background Color Style.gvi"(reference in=w41, column index=2, color=4294748303, error in=w42, match operator="contains", match text="fail") -> (reference out=w43, error out=w44)
  call "Data Grid - String Column - Create Text Overflow Scrollbar Style.gvi"(reference in=w43, column index=3, error in=w44) -> (error out=w45)
  call "Show Error Dialog.gvi"(error in=w45)
