vi "arrays.gviweb"   [G Web Development Software 22.3.0]
panel controls:
  "Array": f64[]
  "Data Grid": cluster{"A": string}[]
panel indicators:
  "Tree": cluster{"location": string, "data": string}[]
uses:
  ControlExtensions::GObject - Tooltip - Set.gvi
  WebApp::Support::Show Error Dialog.gvi
diagram:
  call "GObject - Tooltip - Set.gvi"(reference in=reference to "Array", tooltip="My Array") -> (error out=w1)
  call "Show Error Dialog.gvi"(error in=w1)
  call "GObject - Tooltip - Set.gvi"(reference in=reference to "Data Grid", tooltip="My Data Grid") -> (error out=w2)
  call "Show Error Dialog.gvi"(error in=w2)
  call "GObject - Tooltip - Set.gvi"(reference in=reference to "Tree", tooltip="My Tree") -> (error out=w3)
  call "Show Error Dialog.gvi"(error in=w3)
