vi "buttons.gviweb"   [G Web Development Software 22.3.0]
panel controls:
  "Button": bool
  "Stop": bool
  "Power Button": bool
  "Checkbox": bool
  "Switch": bool
  "Switch Horizontal": bool
panel indicators:
  "LED": bool
  "LED Round": bool
uses:
  ControlExtensions::GObject - Tooltip - Set.gvi
  WebApp::Support::Show Error Dialog.gvi
diagram:
  call "GObject - Tooltip - Set.gvi"(reference in=reference to "Button", tooltip="My Button") -> (error out=w1)
  call "Show Error Dialog.gvi"(error in=w1)
  call "GObject - Tooltip - Set.gvi"(reference in=reference to "Checkbox", tooltip="My Checkbox") -> (error out=w2)
  call "Show Error Dialog.gvi"(error in=w2)
  call "GObject - Tooltip - Set.gvi"(reference in=reference to "LED", tooltip="My LED") -> (error out=w3)
  call "Show Error Dialog.gvi"(error in=w3)
  call "GObject - Tooltip - Set.gvi"(reference in=reference to "LED Round", tooltip="My LED Round") -> (error out=w4)
  call "Show Error Dialog.gvi"(error in=w4)
  call "GObject - Tooltip - Set.gvi"(reference in=reference to "Power Button", tooltip="My Power Button") -> (error out=w5)
  call "Show Error Dialog.gvi"(error in=w5)
  call "GObject - Tooltip - Set.gvi"(reference in=reference to "Stop", tooltip="My Stop") -> (error out=w6)
  call "Show Error Dialog.gvi"(error in=w6)
  call "GObject - Tooltip - Set.gvi"(reference in=reference to "Switch", tooltip="My Switch") -> (error out=w7)
  call "Show Error Dialog.gvi"(error in=w7)
  call "GObject - Tooltip - Set.gvi"(reference in=reference to "Switch Horizontal", tooltip="My Horizontal") -> (error out=w8)
  call "Show Error Dialog.gvi"(error in=w8)
