vi "charts.gviweb"   [G Web Development Software 22.3.0]
panel indicators:
  "Graph": f64[]
  "Chart": f64
  "Intensity Graph": f64[][]
uses:
  ControlExtensions::GObject - Tooltip - Set.gvi
  WebApp::Support::Show Error Dialog.gvi
diagram:
  call "GObject - Tooltip - Set.gvi"(reference in=reference to "Graph", tooltip="My Graph") -> (error out=w1)
  call "Show Error Dialog.gvi"(error in=w1)
  call "GObject - Tooltip - Set.gvi"(reference in=reference to "Chart", tooltip="My Chart") -> (error out=w2)
  call "Show Error Dialog.gvi"(error in=w2)
  call "GObject - Tooltip - Set.gvi"(reference in=reference to "Intensity Graph", tooltip="My Intensity Graph") -> (error out=w3)
  call "Show Error Dialog.gvi"(error in=w3)
