vi "clusters.gviweb"   [G Web Development Software 22.3.0]
panel controls:
  "Error In": error
  "Cluster": cluster{"Numeric": f64}
panel indicators:
  "Error Out": error
uses:
  ControlExtensions::GObject - Tooltip - Set.gvi
  WebApp::Support::Show Error Dialog.gvi
diagram:
  call "GObject - Tooltip - Set.gvi"(reference in=reference to "Cluster", tooltip="My Cluster") -> (error out=w1)
  call "Show Error Dialog.gvi"(error in=w1)
  call "GObject - Tooltip - Set.gvi"(reference in=reference to "Error In", tooltip="My Error In") -> (error out=w2)
  call "Show Error Dialog.gvi"(error in=w2)
  call "GObject - Tooltip - Set.gvi"(reference in=reference to "Error Out", tooltip="My Error Out") -> (error out=w3)
  call "Show Error Dialog.gvi"(error in=w3)
