vi "decorations.gviweb"   [G Web Development Software 22.3.0]
panel indicators:
  "URL Image": string
  "url image correctly errors?": bool
uses:
  ControlExtensions::GObject - Tooltip - Set.gvi
  WebApp::Support::Show Error Dialog.gvi
  NI::G Core::Error::Is Error.gvi
diagram:
  call "GObject - Tooltip - Set.gvi"(reference in=reference to "HTML Container", tooltip="My HTML Container") -> (error out=w1)
  call "Show Error Dialog.gvi"(error in=w1)
  call "GObject - Tooltip - Set.gvi"(reference in=reference to "URL Image", tooltip="My URL Image") -> (error out=w2)
  call "Is Error.gvi"(error in=w2) -> (error?=w3)
  $"url image correctly errors?" <- w3
