vi "layouts.gviweb"   [G Web Development Software 22.3.0]
panel controls:
  "Tab": i32
uses:
  ControlExtensions::GObject - Tooltip - Set.gvi
  WebApp::Support::Show Error Dialog.gvi
diagram:
  call "GObject - Tooltip - Set.gvi"(reference in=reference to "Tab", tooltip="My Tab") -> (error out=w1)
  call "Show Error Dialog.gvi"(error in=w1)
