vi "numerics.gviweb"   [G Web Development Software 22.3.0]
panel controls:
  "Numeric": f64
  "Slider": f64
  "Slider Vertical": f64
  "Timestamp": timestamp
panel indicators:
  "Gauge": f64
  "Tank": f64
  "Linear Progress Bar": f64
  "Radial Progress Bar": f64
uses:
  ControlExtensions::GObject - Tooltip - Set.gvi
  WebApp::Support::Show Error Dialog.gvi
diagram:
  call "GObject - Tooltip - Set.gvi"(reference in=reference to "Gauge", tooltip="My Gauge") -> (error out=w1)
  call "Show Error Dialog.gvi"(error in=w1)
  call "GObject - Tooltip - Set.gvi"(reference in=reference to "Linear Progress Bar", tooltip="My Linear Progress Bar") -> (error out=w2)
  call "Show Error Dialog.gvi"(error in=w2)
  call "GObject - Tooltip - Set.gvi"(reference in=reference to "Numeric", tooltip="My Numeric") -> (error out=w3)
  call "Show Error Dialog.gvi"(error in=w3)
  call "GObject - Tooltip - Set.gvi"(reference in=reference to "Radial Progress Bar", tooltip="My Radial Progress Bar") -> (error out=w4)
  call "Show Error Dialog.gvi"(error in=w4)
  call "GObject - Tooltip - Set.gvi"(reference in=reference to "Slider", tooltip="My Slider") -> (error out=w5)
  call "Show Error Dialog.gvi"(error in=w5)
  call "GObject - Tooltip - Set.gvi"(reference in=reference to "Slider Vertical", tooltip="My Slider Vertical") -> (error out=w6)
  call "Show Error Dialog.gvi"(error in=w6)
  call "GObject - Tooltip - Set.gvi"(reference in=reference to "Tank", tooltip="My Tank") -> (error out=w7)
  call "Show Error Dialog.gvi"(error in=w7)
  call "GObject - Tooltip - Set.gvi"(reference in=reference to "Timestamp", tooltip="My Timestamp") -> (error out=w8)
  call "Show Error Dialog.gvi"(error in=w8)
