vi "selectors.gviweb"   [G Web Development Software 22.3.0]
panel controls:
  "Enum": enum{"a"} = "a"
  "Text Ring": i32 = "a"(0)
  "Combo Box": string
  "Radio Button Group": enum{"Item 0", "Item 1"} = "Item 0"
  "Listbox": i32 = -1
  "Color": "Color.gtype" = 4278190080
types:
  "Color.gtype" = u32
uses:
  ControlExtensions::GObject - Tooltip - Set.gvi
  WebApp::Support::Show Error Dialog.gvi
diagram:
  call "GObject - Tooltip - Set.gvi"(reference in=reference to "Color", tooltip="My Color") -> (error out=w1)
  call "Show Error Dialog.gvi"(error in=w1)
  call "GObject - Tooltip - Set.gvi"(reference in=reference to "Combo Box", tooltip="My Combo Box") -> (error out=w2)
  call "Show Error Dialog.gvi"(error in=w2)
  call "GObject - Tooltip - Set.gvi"(reference in=reference to "Enum", tooltip="My Enum") -> (error out=w3)
  call "Show Error Dialog.gvi"(error in=w3)
  call "GObject - Tooltip - Set.gvi"(reference in=reference to "Listbox", tooltip="My Listbox") -> (error out=w4)
  call "Show Error Dialog.gvi"(error in=w4)
  call "GObject - Tooltip - Set.gvi"(reference in=reference to "Radio Button Group", tooltip="My Radio Button Group") -> (error out=w5)
  call "Show Error Dialog.gvi"(error in=w5)
  call "GObject - Tooltip - Set.gvi"(reference in=reference to "Text Ring", tooltip="My Text Ring") -> (error out=w6)
  call "Show Error Dialog.gvi"(error in=w6)
