vi "text.gviweb"   [G Web Development Software 22.3.0]
panel controls:
  "String": string
  "Masked Input": string
  "Hyperlink Control": string
uses:
  ControlExtensions::GObject - Tooltip - Set.gvi
  WebApp::Support::Show Error Dialog.gvi
diagram:
  call "GObject - Tooltip - Set.gvi"(reference in=reference to "Hyperlink Control", tooltip="My Hyperlink Control") -> (error out=w1)
  call "Show Error Dialog.gvi"(error in=w1)
  call "GObject - Tooltip - Set.gvi"(reference in=reference to "Masked Input", tooltip="My Masked Input") -> (error out=w2)
  call "Show Error Dialog.gvi"(error in=w2)
  call "GObject - Tooltip - Set.gvi"(reference in=reference to "String", tooltip="My String") -> (error out=w3)
  call "Show Error Dialog.gvi"(error in=w3)
  call "GObject - Tooltip - Set.gvi"(reference in=reference to unnamed text, tooltip="My Text") -> (error out=w4)
  call "Show Error Dialog.gvi"(error in=w4)
