vi "DataGrid - Column - Set Sorting.gvi"   [LabVIEW NXG 5.1.0]
inputs:
  "selector": string, required
  "column index": i32, required
  "sort": "sort.gtype" = "ascending"
  "error in": error
outputs:
  "error out": error
types:
  "sort.gtype" = enum{"none", "ascending", "descending"}
uses:
  ControlTools::Support::ControlTools.jsli::DataGridSortColumn
diagram:
  Format Into String(errIn=$"error in", $sort) -> (outString=w1, errOut=w2)
  call "DataGridSortColumn"(selector=$selector, indexNum=$"column index", sort=w1, error in=w2) -> (error out=w3)
  $"error out" <- w3
