vi "index.gviweb"   [G Web Development Software 21.0.0]
panel controls:
  "sort": enum{"none", "ascending", "descending"} = "none"
  "Listbox": i32 = -1
  "update listbox": bool
  "column width": u32 = 100
  "Hyperlink Control": string = "backgrounds/color-absolute.html"
  "Hyperlink Control_2": string = "backgrounds/color-flexible.html"
  "Hyperlink Control_3": string = "backgrounds/gradient-absolute.html"
  "Hyperlink Control_4": string = "backgrounds/gradient-flexible.html"
  "Hyperlink Control_5": string = "backgrounds/plain-absolute.html"
  "Hyperlink Control_6": string = "backgrounds/plain-flexible.html"
  "Tab": i32
  "show tab selector": bool = TRUE
panel indicators:
  "Data Grid": T1[]
  "Tree": cluster{"location": string, "data": string}[]
types:
  T1 = cluster{"Some Value": string, "Some Other Value": string}
uses:
  ControlTools::Listbox - Item - Enable Tooltip.gvi
  WebApp::Support::Show Error Dialog.gvi
  ControlTools::Tree - Grid Cell - Enable Tooltip.gvi
  ControlTools::DataGrid - Column - Set Sorting.gvi
  ControlTools::Tree - Column - Set Width.gvi
  ControlTools::Tab - Selector - Visible.gvi
diagram:
  w1 = [{"location"="zero", "data"="Lorem ipsum dolor sit amet, consectetur adipiscing elit, sed do eiusmod tempor incididunt ut labore et dolore magna aliqua. Ut enim ad minim veniam, quis nostrud exercitation ullamco laboris nisi ut aliquip ex ea commodo consequat. Duis aute irure dolor in reprehenderit in voluptate velit esse cillum dolore eu fugiat nulla pariatur. Excepteur sint occaecat cupidatat non proident, sunt in culpa qui officia deserunt mollit anim id est laborum."}, {"location"="zero\\hi", "data"="other"}, {"location"="zero\\hi\\subhi", "data"="Lorem ipsum dolor sit amet, consectetur adipiscing elit, sed do eiusmod tempor incididunt ut labore et dolore magna aliqua. Ut enim ad minim veniam, quis nostrud exercitation ullamco laboris nisi ut aliquip ex ea commodo consequat. Duis aute irure dolor in reprehenderit in voluptate velit esse cillum dolore eu fugiat nulla pariatur. Excepteur sint occaecat cupidatat non proident, sunt in culpa qui officia deserunt mollit anim id est laborum."}]
  $Tree <- w1
  call "Listbox - Item - Enable Tooltip.gvi"(selector=".my-listbox") -> (error out=w2)
  # For instructions configuring the selector input follow the Choosing a control in the page portion of: https://forums.ni.com/t5/Example-Code/Declarative-Style-for-WebVI/ta-p/4141973
  call "Show Error Dialog.gvi"(error in=w2)
  call "Tree - Grid Cell - Enable Tooltip.gvi"(selector=".my-tree") -> (error out=w3)
  call "Show Error Dialog.gvi"(error in=w3)
  w4 = [{"Some Value"="b", "Some Other Value"="z"}, {"Some Value"="c", "Some Other Value"="y"}, {"Some Value"="d", "Some Other Value"="x"}, {"Some Value"="a", "Some Other Value"="w"}]
  $"Data Grid" <- w4
  while (iteration -> i1) {
    event {
      on "sort" Value changed {
        # For instructions configuring the selector input follow the Choosing a control in the page portion of: https://forums.ni.com/t5/Example-Code/Declarative-Style-for-WebVI/ta-p/4141973
        Event Data() -> ("New Value"=w5)
        call "DataGrid - Column - Set Sorting.gvi"(selector=".my-grid", column index=0, sort=w5) -> (error out=w6)
        call "Show Error Dialog.gvi"(error in=w6)
      }
      on "update listbox" Value changed {
        for (N = 100) (iteration -> i2) {
          Format Into String(formatString="%d - %d - %s", i2, i1, "a long string that needs a tooltip ") -> w8
          append w8 to w7
        }
        Property Node(instance in=reference to "Listbox", "Items"=w7)
      }
      on "column width" Value changed {
        Event Data() -> ("New Value"=w9)
        Property Node(instance in=reference to "Tree") -> ("ColumnHeaders"=w10)
        Array Size(array=w10) -> (size(s)=w11)
        for (N = w11) (iteration -> i3) {
          call "Tree - Column - Set Width.gvi"(selector=".my-tree", column index=i3, width=w9) -> (error out=w12)
          call "Show Error Dialog.gvi"(error in=w12)
        }
      }
      on "show tab selector" Value changed {
        Event Data() -> ("New Value"=w13)
        call "Tab - Selector - Visible.gvi"(selector=".my-tab", visible=w13) -> (error out=w14)
        call "Show Error Dialog.gvi"(error in=w14)
      }
    }
    stop if FALSE
  }
