vi "index.gviweb"   [LabVIEW NXG 5.0.0]
panel controls:
  "Stop": bool
  "Get Date": bool
  "value": string
  "Set Date": bool
panel indicators:
  "return_2": string
  "loop iteration_2": i32
  "event data": string
  "loop iteration": i32
uses:
  CustomInputControl::Support::CustomInputControl.jsli::CreateAndListenForChange
  CustomInputControl::Support::CustomInputControl.jsli::WaitForChange
  CustomInputControl::Support::CustomInputControl.jsli::StopListeningForChange
  CustomInputControl::Support::CustomInputControl.jsli::GetProperty
  CustomInputControl::Support::CustomInputControl.jsli::SetProperty
diagram:
  # For attributes available on all inputs see:
  # https://developer.mozilla.org/en-US/docs/Web/HTML/Element/input#Attributes_common_to_all_input_types
  #
  # For additional attributes available on type date controls see:
  # https://developer.mozilla.org/en-US/docs/Web/HTML/Element/input/date#Additional_attributes
  #
  # Make sure to take note of browser compatibility:
  # https://developer.mozilla.org/en-US/docs/Web/HTML/Element/input/date#Browser_compatibility
  Flatten To Json(anything=[{"name"="type", "value"="date"}]) -> (JSON string=w1)
  call "CreateAndListenForChange"(selector=".example-date", attributesJSON=w1) -> (refnum=w2, error out=w3)
  Create User Event[EventName="Date Value Change"](user event data type=string "") -> (user event out=w4)
  while {
    call "WaitForChange"(refnum=w2, error in=w3) -> (value=w5, error out=w6)
    Generate User Event(error in=w6, event data=w5, user event=w4) -> (error out=w7)
    stop if w7
  }
  Register For Events("Date Value Change"=w4) -> (event registration refnum out=w8)
  # For attributes available on all inputs see:
  # https://developer.mozilla.org/en-US/docs/Web/HTML/Element/input#Attributes_common_to_all_input_types
  #
  # For additional attributes available on type date controls see:
  # https://developer.mozilla.org/en-US/docs/Web/HTML/Element/input/password#Additional_attributes
  #
  # Make sure to take note of browser compatibility:
  # https://developer.mozilla.org/en-US/docs/Web/HTML/Element/input/password#Browser_compatibility
  Flatten To Json(anything=[{"name"="type", "value"="password"}]) -> (JSON string=w9)
  call "CreateAndListenForChange"(selector=".example-password", attributesJSON=w9) -> (refnum=w10, error out=w11)
  while (iteration -> i1) {
    event (dynamic events = w8) {
      on dynamic event 0 {
        Event Data() -> ("event data"=w13)
        $"event data" <- w13
        w12 = FALSE
      }
      on "Stop" Value changed {
        call "StopListeningForChange"(refnum=w2)
        call "StopListeningForChange"(refnum=w10)
        w12 = TRUE
      }
      on "Get Date" Value changed {
        # Note: we use JS property
        # for GET instead of HTML
        # Attribute so names may be
        # different
        call "GetProperty"(refnum=w2, name="value") -> (value=w14)
        $value <- w14
        w12 = FALSE
      }
      on "Set Date" Value changed {
        # Note: we use JS property
        # for Set instead of HTML
        # Attribute so names may be
        # different
        call "SetProperty"(refnum=w2, name="value", value=$value)
        w12 = FALSE
      }
    }
    $"loop iteration" <- i1
    stop if w12
  }
  while (iteration -> i2) {
    call "WaitForChange"(refnum=w10, error in=w11) -> (value=w15, error out=w16)
    $return_2 <- w15
    $"loop iteration_2" <- i2
    stop if w16
  }
