vi "Create Document Fragment.gvi"   [LabVIEW NXG 3.1.0]
inputs:
  "fragment content": string
  "selectors": string[]
  "error in": error
outputs:
  "error out": error
  "element references": "dom reference.gtype"[]
  "fragment reference": "dom reference.gtype"
types:
  "dom reference.gtype" = i32
  T1 = cluster{"documentFragmentReference": "dom reference.gtype", "elementReferences": "dom reference.gtype"[]}
uses:
  DOM::Support::DOM.jsli::CreateDocumentFragment
diagram:
  Flatten To JSON(anything=$selectors) -> (JSON string=w1)
  call "CreateDocumentFragment"(fragmentContent=$"fragment content", selectorsJSON=w1, error in=$"error in") -> (fragmentAndElementsJSON=w2, error out=w3)
  Unflatten From JSON(JSON string=w2, type and defaults=T1 {all zero or empty}) -> (value=w4)
  Property Node(instance in=w4) -> ("documentFragmentReference"=w5, "elementReferences"=w6)
  $"fragment reference" <- w5
  $"element references" <- w6
  $"error out" <- w3
