vi "Create CSS Style Attribute Value.gvi"   [LabVIEW NXG 3.1.0]
inputs:
  "error in": error
  "style property names": string[], required
  "style property values": string[], required
outputs:
  "style attribute value": string
  "error out": error
uses:
  DOM::Support::Build DOM Error Cluster.gvi
diagram:
  w1 = "Style property names and style property values arrays must be same length."
  Array Size(array=$"style property names") -> (size(s)=w2)
  Array Size(array=$"style property values") -> (size(s)=w3)
  Is Not Equal(x=w2, y=w3) -> w4
  call "Build DOM Error Cluster.gvi"(dom error="names_and_values_count_mismatch", description=w1, error in=$"error in", is error?=w4) -> (error out=w5)
  case (w5) {
    frame Error, Default {
      w6 = ""
      w7 = w5
    }
    frame No Error {
      for (N -> w8) (iteration -> i1) {
        w9 = each element of $"style property names"
        w10 = each element of $"style property values"
        Decrement(x=w8) -> w12
        Is Equal(x=w12, y=i1) -> w13
        Select(s=w13, t="", f="; ") -> w14
        Concatenate Strings(w9, ": ", w10, w14) -> w15
        append w15 to w11
      }
      Concatenate Strings(w11) -> w6
      w7 = w5
    }
  }
  $"style attribute value" <- w6
  $"error out" <- w7
