vi "Get Attributes.gvi"   [LabVIEW NXG 3.1.0]
inputs:
  "element reference in": "dom reference.gtype", required
  "attribute names in": string[]
  "error in": error
outputs:
  "error out": error
  "element reference out": "dom reference.gtype"
  "attribute names out": string[]
  "attribute values out": string[]
  "attribute exist out": bool[]
types:
  "dom reference.gtype" = i32
  "attribute value config.gtype" = cluster{"attributeValue": string, "exists": bool}
  "attribute value configs.gtype" = "attribute value config.gtype"[]
  T1 = cluster{"attributeNames": string[], "attributeValueConfigs": "attribute value configs.gtype"}
uses:
  DOM::Support::DOM.jsli::GetAttributes
diagram:
  $"element reference out" <- $"element reference in"
  Flatten To JSON(anything=$"attribute names in") -> (JSON string=w1)
  call "GetAttributes"(elementReference=$"element reference in", attributeNamesJSON=w1, error in=$"error in") -> (attributeValueResultsJSON=w2, error out=w3)
  Unflatten From JSON(JSON string=w2, type and defaults=T1 {all zero or empty}) -> (value=w4)
  Property Node(instance in=w4) -> ("attributeNames"=w5, "attributeValueConfigs"=w6)
  $"attribute names out" <- w5
  $"error out" <- w3
  for {
    w7 = each element of w6
    Property Node(instance in=w7) -> ("attributeValue"=w10, "exists"=w11)
    append w10 to w8
    append w11 to w9
  }
  $"attribute values out" <- w8
  $"attribute exist out" <- w9
