vi "Get Properties.gvi"   [LabVIEW NXG 3.1.0]
inputs:
  "element reference in": "dom reference.gtype", required
  "property names": string[], required
  "error in": error
outputs:
  "property value configs": "property value configs.gtype"
  "error out": error
  "element reference out": "dom reference.gtype"
types:
  "dom reference.gtype" = i32
  "property value config.gtype" = cluster{"type": string, "propertyValueJSON": string}
  "property value configs.gtype" = "property value config.gtype"[]
uses:
  DOM::Support::DOM.jsli::GetProperties
diagram:
  $"element reference out" <- $"element reference in"
  Flatten To JSON(anything=$"property names") -> (JSON string=w1)
  call "GetProperties"(elementReference=$"element reference in", propertyNamesJSON=w1, error in=$"error in") -> (propertyValueConfigsJSON=w2, error out=w3)
  Unflatten From JSON(JSON string=w2, type and defaults="property value configs.gtype" []) -> (value=w4)
  $"property value configs" <- w4
  $"error out" <- w3
