vi "Get References.gvi"   [LabVIEW NXG 4.0.0]
inputs:
  "element reference in": "dom reference.gtype", required
  "error in": error
  "property names": string[], required
outputs:
  "element reference out": "dom reference.gtype"
  "error out": error
  "dom references": "dom reference.gtype"[]
types:
  "dom reference.gtype" = i32
uses:
  DOM::Support::DOM.jsli::GetReferences
diagram:
  $"element reference out" <- $"element reference in"
  Flatten To JSON(anything=$"property names") -> (JSON string=w1)
  call "GetReferences"(elementReference=$"element reference in", propertyNamesJSON=w1, error in=$"error in") -> (referencesTypedArray=w2, error out=w3)
  $"dom references" <- w2
  $"error out" <- w3
