vi "Parse Style Attribute Value.gvi"   [LabVIEW NXG 3.1.0]
inputs:
  "attribute value string": string, required
  "error in": error
outputs:
  "error out": error
  "style property names": string[]
  "style property values": string[]
uses:
  NI::G Core::Strings::Trim Whitespace.gvi
  DOM::Support::Build DOM Error Cluster.gvi
  NI::G Core::Error::Is Error.gvi
diagram:
  w1 = string[] []  # style property names
  w2 = string[] []  # style property values
  call "Trim Whitespace.gvi"(string=$"attribute value string") -> (trimmed string=w3)
  s1 = w3  # shift register
  s2 = w1  # shift register
  s3 = w2  # shift register
  s4 = $"error in"  # shift register
  while {
    Match Pattern(regular expression=";", string=s1) -> (after substring=w4, before substring=w5)
    Match Pattern(regular expression=":", string=w5) -> (after substring=w6, before substring=w7, offset past match=w8)
    call "Trim Whitespace.gvi"(string=w7) -> (trimmed string=w9)
    call "Trim Whitespace.gvi"(string=w6) -> (trimmed string=w10)
    String Length(string=w9) -> (length=w11)
    Is Not Equal To 0(x=w11) -> w12
    String Length(string=w10) -> (length=w13)
    Is Not Equal To 0(x=w13) -> w14
    Is Not Equal(x=w8, y=-1) -> w15
    Logical And(w12, w14, w15) -> w16
    case (w16) {
      frame False, Default {
        w20 = "style attribute must have an equal number of style property names and style property values."
        call "Build DOM Error Cluster.gvi"(dom error="names_and_values_count_mismatch", description=w20, error in=s4) -> (error out=w19)
        w17 = s2
        w18 = s3
      }
      frame True {
        Build Array(s2, w9) -> w17
        Build Array(s3, w10) -> w18
        w19 = s4
      }
    }
    call "Is Error.gvi"(error in=w19) -> (error?=w21)
    String Length(string=w4) -> (length=w22)
    Is Equal To 0(x=w22) -> w23
    Logical Or(w21, w23) -> w24
    next s1 = w4
    next s2 = w17
    next s3 = w18
    next s4 = w19
    stop if w24
  }
  $"style property names" <- s2
  $"style property values" <- s3
  $"error out" <- s4
