vi "Set Attributes.gvi"   [LabVIEW NXG 3.1.0]
inputs:
  "element reference in": "dom reference.gtype", required
  "attribute names": string[], required
  "error in": error
  "attribute value configs": "attribute value configs.gtype", required
outputs:
  "error out": error
  "element reference out": "dom reference.gtype"
types:
  "dom reference.gtype" = i32
  "attribute value config.gtype" = cluster{"attributeValue": string, "exists": bool}
  "attribute value configs.gtype" = "attribute value config.gtype"[]
uses:
  DOM::Support::DOM.jsli::SetAttributes
diagram:
  $"element reference out" <- $"element reference in"
  Flatten To JSON(anything=$"attribute names") -> (JSON string=w1)
  Flatten To JSON(anything=$"attribute value configs") -> (JSON string=w2)
  call "SetAttributes"(elementReference=$"element reference in", attributeNamesJSON=w1, attributeValueConfigsJSON=w2, error in=$"error in") -> (error out=w3)
  $"error out" <- w3
