vi "Set Properties.gvi"   [LabVIEW NXG 3.1.0]
inputs:
  "element reference in": "dom reference.gtype", required
  "property names": string[], required
  "property value configs": "property value configs.gtype", required
  "error in": error
outputs:
  "error out": error
  "element reference out": "dom reference.gtype"
types:
  "dom reference.gtype" = i32
  "property value config.gtype" = cluster{"type": string, "propertyValueJSON": string}
  "property value configs.gtype" = "property value config.gtype"[]
uses:
  DOM::Support::DOM.jsli::SetProperties
diagram:
  $"element reference out" <- $"element reference in"
  Flatten To JSON(anything=$"property names") -> (JSON string=w1)
  Flatten To JSON(anything=$"property value configs") -> (JSON string=w2)
  call "SetProperties"(elementReference=$"element reference in", propertyNamesJSON=w1, propertyValueConfigsJSON=w2, error in=$"error in") -> (error out=w3)
  $"error out" <- w3
