vi "Set References.gvi"   [LabVIEW NXG 4.0.0]
inputs:
  "element reference in": "dom reference.gtype", required
  "property names": string[], required
  "dom references": "dom reference.gtype"[], required
  "error in": error
outputs:
  "error out": error
  "element reference out": "dom reference.gtype"
types:
  "dom reference.gtype" = i32
uses:
  DOM::Support::DOM.jsli::SetReferences
diagram:
  $"element reference out" <- $"element reference in"
  Flatten To JSON(anything=$"property names") -> (JSON string=w1)
  call "SetReferences"(elementReference=$"element reference in", propertyNamesJSON=w1, references=$"dom references", error in=$"error in") -> (error out=w2)
  $"error out" <- w2
