vi "Add Event Listener.gvi"   [LabVIEW NXG 3.1.0]
inputs:
  "element reference in": "dom reference.gtype", required
  "event name": string, required
  "property names": string[]
  "error in": error
outputs:
  "error out": error
  "event manager reference": "event manager reference.gtype"
  "element reference out": "dom reference.gtype"
types:
  "dom reference.gtype" = i32
  "event manager reference.gtype" = i32
uses:
  DOM::Support::DOM.jsli::AddEventListener
diagram:
  $"element reference out" <- $"element reference in"
  Flatten To JSON(anything=$"property names") -> (JSON string=w1)
  call "AddEventListener"(elementReference=$"element reference in", eventName=$"event name", propertyNamesJSON=w1, error in=$"error in") -> (eventManagerReference=w2, error out=w3)
  $"event manager reference" <- w2
  $"error out" <- w3
