vi "Wait For Event.gvi"   [LabVIEW NXG 3.1.0]
inputs:
  "event manager reference in": "event manager reference.gtype", required
  "error in": error
outputs:
  "event manager reference out": "event manager reference.gtype"
  "error out": error
  "property value configs": "property value configs.gtype"
types:
  "event manager reference.gtype" = i32
  "property value config.gtype" = cluster{"type": string, "propertyValueJSON": string}
  "property value configs.gtype" = "property value config.gtype"[]
uses:
  DOM::Support::DOM.jsli::WaitForEvent
diagram:
  $"event manager reference out" <- $"event manager reference in"
  call "WaitForEvent"(eventManagerReference=$"event manager reference in", error in=$"error in") -> (propertyValueConfigsJSON=w1, error out=w2)
  Unflatten From JSON(JSON string=w1, type and defaults="property value configs.gtype" []) -> (value=w3)
  $"property value configs" <- w3
  $"error out" <- w2
