vi "Get Attributes.gvi"   [LabVIEW NXG 3.1.0]
inputs:
  "element reference": "dom reference.gtype", required
  "names": string[]
  "error in": error
outputs:
  "error out": error
  "value": string[]
  "found": bool[]
  "name": string[]
types:
  "dom reference.gtype" = i32
  T1 = cluster{"value": string, "found": bool, "name": string}
uses:
  DOM::Support::DOM.jsli::GetAttributes
diagram:
  Flatten To JSON(anything=$names) -> (JSON string=w1)
  call "GetAttributes"(elementReference=$"element reference", namesJSON=w1, error in=$"error in") -> (attributeResultsJSON=w2, error out=w3)
  Unflatten From JSON(JSON string=w2, type and defaults=T1[] []) -> (value=w4)
  for {
    w5 = each element of w4
    Property Node(instance in=w5) -> ("name"=w9, "value"=w10, "found"=w11)
    append w10 to w6
    append w11 to w7
    append w9 to w8
  }
  $name <- w8
  $value <- w6
  $"error out" <- w3
  $found <- w7
