vi "Set Attributes Options Append.gvi"   [LabVIEW NXG 3.1.0]
inputs:
  "set attributes options in": "set attributes options.gtype"
  "name": string, required
  "value": string
  "remove": bool
outputs:
  "set attributes options out": "set attributes options.gtype"
types:
  "set attributes option.gtype" = cluster{"name": string, "value": string, "remove": bool}
  "set attributes options.gtype" = "set attributes option.gtype"[]
diagram:
  Property Node(instance in="set attributes option.gtype" {all zero or empty}, "name"=$name, "value"=$value, "remove"=$remove) -> (instance out=w1)
  Build Array($"set attributes options in", w1) -> w2
  $"set attributes options out" <- w2
