vi "Set Attributes.gvi"   [LabVIEW NXG 3.1.0]
inputs:
  "dom reference in": "dom reference.gtype", required
  "attribute set options": "set attributes options.gtype", required
  "error in": error
outputs:
  "error out": error
  "dom reference out": "dom reference.gtype"
types:
  "dom reference.gtype" = i32
  "set attributes option.gtype" = cluster{"name": string, "value": string, "remove": bool}
  "set attributes options.gtype" = "set attributes option.gtype"[]
uses:
  DOM::Support::DOM.jsli::SetAttributes
diagram:
  $"dom reference out" <- $"dom reference in"
  Flatten To JSON(anything=$"attribute set options") -> (JSON string=w1)
  call "SetAttributes"(elementReference=$"dom reference in", attributesJSON=w1, error in=$"error in") -> (error out=w2)
  $"error out" <- w2
