vi "Invoke Element Method.gvi"   [LabVIEW NXG 4.0.0]
inputs:
  "error in": error
  "element reference": "dom reference.gtype", required
  "method name": string, required
  "parameter dom values": "dom values.gtype"
outputs:
  "error out": error
  "return dom values": "dom values.gtype"
types:
  "dom reference.gtype" = i32
  "dom value type.gtype" = enum{"unknown", "attribute", "absent", "undefined", "boolean", "number", "string"}
  "dom value.gtype" = cluster{"type": "dom value type.gtype", "name": string, "value": string}
  "dom values.gtype" = "dom value.gtype"[]
uses:
  DOM::Support::DOM Values to JSON.gvi
  DOM::Support::DOM.jsli::InvokeElementMethod
  DOM::Support::DOM Values from JSON.gvi
diagram:
  call "DOM Values to JSON.gvi"(dom values=$"parameter dom values", error in=$"error in") -> (json=w1, error out=w2)
  call "InvokeElementMethod"(elementReference=$"element reference", methodName=$"method name", parameterDomValuesJSON=w1, error in=w2) -> (returnDomValueJSON=w3, error out=w4)
  call "DOM Values from JSON.gvi"(json=w3, error in=w4) -> (dom values=w5, error out=w6)
  $"return dom values" <- w5
  $"error out" <- w6
