vi "Query Selector All.gvi"   [LabVIEW NXG 5.0.0]
inputs:
  "selector": string, required
  "dom target reference in (global document)": "dom reference.gtype"
  "error in": error
outputs:
  "error out": error
  "element references": "dom reference.gtype"[]
panel indicators:
  "dom target reference out": "dom reference.gtype"
types:
  "dom reference.gtype" = "NI.JavaScriptReference"
uses:
  DOM::Support::Default or Global.gvi
  DOM::Support::DOM.jsli::QuerySelectorAll
diagram:
  $"dom target reference out" <- $"dom target reference in (global document)"
  call "Default or Global.gvi"(input target=$"dom target reference in (global document)") -> (document=w1)
  call "QuerySelectorAll"(domTarget=w1, selector=$selector, error in=$"error in") -> (elements=w2, error out=w3)
  $"element references" <- w2
  $"error out" <- w3
