vi "Query Selector.gvi"   [LabVIEW NXG 3.1.0]
inputs:
  "error in": error
  "selector": string, required
  "document reference": "dom reference.gtype"
outputs:
  "element reference": "dom reference.gtype"
  "error out": error
types:
  "dom reference.gtype" = i32
uses:
  DOM::Search::Query Selector All.gvi
  NI::G Core::Error::Build Error Cluster.gvi
diagram:
  call "Query Selector All.gvi"(selector=$selector, error in=$"error in", document reference=$"document reference") -> (element references=w1, error out=w2)
  Array Size(array=w1) -> (size(s)=w3)
  Is Equal(x=1, y=w3) -> w4
  case (w4) {
    frame False, Default {
      w7 = 0  # dom reference
      w8 = "Expected selector (%s) to match one element. Instead matched %d."
      Format Into String(formatString=w8, $selector, w3) -> w9
      call "Build Error Cluster.gvi"(error in=w2, code=672500, description=w9) -> (error out=w6)
      w5 = w7
    }
    frame True {
      Array Index(array=w1) -> (out0[_]=w5)
      w6 = w2
    }
  }
  $"element reference" <- w5
  $"error out" <- w6
