vi "Query Selectors.gvi"   [LabVIEW NXG 3.1.0]
inputs:
  "error in": error
  "selectors": string[], required
  "dom target reference in (global document)": "dom reference.gtype"
outputs:
  "element references": "dom reference.gtype"[]
  "error out": error
  "dom target reference out": "dom reference.gtype"
types:
  "dom reference.gtype" = i32
uses:
  DOM::Support::DOM.jsli::QuerySelectors
diagram:
  $"dom target reference out" <- $"dom target reference in (global document)"
  Flatten To JSON(anything=$selectors) -> (JSON string=w1)
  call "QuerySelectors"(domTargetReference=$"dom target reference in (global document)", selectorsJSON=w1, error in=$"error in") -> (elementReferences=w2, error out=w3)
  $"element references" <- w2
  $"error out" <- w3
