vi "Append Attribute Value Config.gvi"   [LabVIEW NXG 3.1.0]
inputs:
  "attribute value configs in": "attribute value configs.gtype"
  "attribute value": string
  "exists": bool = TRUE
outputs:
  "attribute value configs out": "attribute value configs.gtype"
types:
  "attribute value config.gtype" = cluster{"attributeValue": string, "exists": bool}
  "attribute value configs.gtype" = "attribute value config.gtype"[]
diagram:
  Property Node(instance in="attribute value config.gtype" {all zero or empty}, "attributeValue"=$"attribute value", "exists"=$exists) -> (instance out=w1)
  Build Array($"attribute value configs in", w1) -> w2
  $"attribute value configs out" <- w2
