vi "Append Property Value Config as Boolean.gvi"   [LabVIEW NXG 3.1.0]
inputs:
  "property value configs in": "property value configs.gtype", required
  "value": bool, required
outputs:
  "property value configs out": "property value configs.gtype"
types:
  "property value config.gtype" = cluster{"type": string, "propertyValueJSON": string}
  "property value configs.gtype" = "property value config.gtype"[]
diagram:
  Format Into String("boolean") -> w1
  Property Node(instance in=cluster{"data": bool} {all zero or empty}, "data"=$value) -> (instance out=w2)
  Flatten To JSON(anything=w2) -> (JSON string=w3)
  Property Node(instance in="property value config.gtype" {all zero or empty}, "type"=w1, "propertyValueJSON"=w3) -> (instance out=w4)
  Build Array($"property value configs in", w4) -> w5
  $"property value configs out" <- w5
