vi "Append Property Value Config as Undefined.gvi"   [LabVIEW NXG 3.1.0]
inputs:
  "property value configs in": "property value configs.gtype", required
outputs:
  "property value configs out": "property value configs.gtype"
types:
  "property value config.gtype" = cluster{"type": string, "propertyValueJSON": string}
  "property value configs.gtype" = "property value config.gtype"[]
diagram:
  Format Into String("undefined") -> w1
  Property Node(instance in="property value config.gtype" {all zero or empty}, "type"=w1) -> (instance out=w2)
  Build Array($"property value configs in", w2) -> w3
  $"property value configs out" <- w3
