vi "Close DOM References.gvi"   [LabVIEW NXG 3.1.0]
inputs:
  "dom references": "dom reference.gtype"[], required
  "error in": error
outputs:
  "error out": error
types:
  "dom reference.gtype" = i32
uses:
  DOM::Support::DOM.jsli::CloseDOMReferences
diagram:
  call "CloseDOMReferences"(domReferences=$"dom references") -> (error out=w1)
  Merge Errors($"error in", w1) -> (error out=w2)
  $"error out" <- w2
