vi "Get Property Value Config Type.gvi"   [LabVIEW NXG 3.1.0]
inputs:
  "property value configs": "property value configs.gtype", required
  "index": i32
outputs:
  "type": "property value config type.gtype"
types:
  "property value config.gtype" = cluster{"type": string, "propertyValueJSON": string}
  "property value configs.gtype" = "property value config.gtype"[]
  "property value config type.gtype" = enum{"undefined", "number", "string", "boolean", "reference", "json"}
diagram:
  Array Index(array=$"property value configs") -> (out0[$index]=w1)
  Property Node(instance in=w1) -> ("type"=w2)
  Scan From String(inputString=w2, default="undefined") -> (out0=w3)
  $type <- w3
