vi "Get Property Value Config as JSON.gvi"   [LabVIEW NXG 3.1.0]
inputs:
  "property value configs": "property value configs.gtype", required
  "index": i32
outputs:
  "JSON value": string
types:
  "property value config.gtype" = cluster{"type": string, "propertyValueJSON": string}
  "property value configs.gtype" = "property value config.gtype"[]
diagram:
  Array Index(array=$"property value configs") -> (out0[$index]=w1)
  Property Node(instance in=w1) -> ("propertyValueJSON"=w2)
  $"JSON value" <- w2
