vi "Get Property Value Config as String.gvi"   [LabVIEW NXG 3.1.0]
inputs:
  "property value configs": "property value configs.gtype", required
  "index": i32
outputs:
  "value": string
types:
  "property value config.gtype" = cluster{"type": string, "propertyValueJSON": string}
  "property value configs.gtype" = "property value config.gtype"[]
diagram:
  Array Index(array=$"property value configs") -> (out0[$index]=w1)
  Property Node(instance in=w1) -> ("propertyValueJSON"=w2)
  Unflatten From JSON(JSON string=w2, type and defaults=cluster{"data": string} {all zero or empty}) -> (value=w3)
  Property Node(instance in=w3) -> ("data"=w4)
  $value <- w4
