vi "DOM Values to JSON.gvi"   [LabVIEW NXG 4.0.0]
inputs:
  "dom values": "dom values.gtype", required
  "error in": error
outputs:
  "json": string
  "error out": error
types:
  "dom value type.gtype" = enum{"unknown", "attribute", "absent", "undefined", "boolean", "number", "string"}
  "dom value.gtype" = cluster{"type": "dom value type.gtype", "name": string, "value": string}
  "dom values.gtype" = "dom value.gtype"[]
  T1 = cluster{"type": string, "name": string, "value": string}
diagram:
  s1 = $"error in"  # shift register
  for {
    w1 = each element of $"dom values"
    Property Node(instance in=w1) -> ("name"=w3, "value"=w4, "type"=w5)
    w6 = T1 {all zero or empty}  # dom value json
    Format Into String(errIn=s1, w5) -> (outString=w7, errOut=w8)
    Property Node(instance in=w6, "name"=w3, "value"=w4, "type"=w7) -> (instance out=w9)
    append w9 to w2
    next s1 = w8
    stop if w8
  }
  Flatten To JSON(anything=w2, error in (no error)=s1) -> (JSON string=w10, error out=w11)
  $json <- w10
  $"error out" <- w11
