vi "Scan for DOM Error.gvi"   [LabVIEW NXG 3.1.0]
inputs:
  "source": string
outputs:
  "found dom error?": bool
  "dom error": "dom error.gtype"
types:
  "dom error.gtype" = enum{"webvidom_unknown_error", "webvidom_test_error"}
uses:
  NI::G Core::Error::Clear Error Cluster.gvi
diagram:
  String Length(string="WebVIDOMError(") -> (length=w1)
  Concatenate Strings("WebVIDOMError(", "[a-z_]+", ")") -> w2
  Match Pattern(regular expression=w2, string=$source) -> (match substring=w3)
  String Length(string=w3) -> (length=w4)
  Increment(x=w1) -> w5
  Subtract(x=w4, y=w5) -> w6
  String Subset(length (rest)=w6, offset (0)=w1, string=w3) -> w7
  String Length(string=w7) -> (length=w8)
  Is Not Equal To 0(x=w8) -> w9
  $"found dom error?" <- w9
  Scan From String(inputString=w7, default="webvidom_unknown_error") -> (errOut=w10, out0=w11)
  call "Clear Error Cluster.gvi"(error in=w10)
  $"dom error" <- w11
