vi "Create Document Fragment.gvi"   [LabVIEW NXG 3.1.0]
inputs:
  "fragment content": string, required
  "selectors": string[]
  "error in": error
  "document target": "dom reference.gtype"
outputs:
  "error out": error
  "element references": "dom reference.gtype"[]
  "fragment reference": "dom reference.gtype"
types:
  "dom reference.gtype" = i32
uses:
  DOM::Build::Create Elements.gvi
  DOM::Shared::Append Property Value Config as String.gvi
  DOM::Configure::Set Properties.gvi
  DOM::Configure::Get Properties.gvi
  DOM::Shared::Get Property Value Config as DOM Reference.gvi
  DOM::Shared::Close DOM References.gvi
  DOM::Search::Query Selectors.gvi
diagram:
  call "Create Elements.gvi"(tag names=["template"], error in=$"error in", document target=$"document target") -> (element references=w1, error out=w2)
  Array Index(array=w1) -> (out0[_]=w3)
  call "Append Property Value Config as String.gvi"(value=$"fragment content") -> (property value configs out=w4)
  call "Set Properties.gvi"(element reference in=w3, property names=["innerHTML"], property value configs=w4, error in=w2) -> (element reference out=w5, error out=w6)
  call "Get Properties.gvi"(element reference in=w5, property names=["content"], error in=w6) -> (property value configs=w7, error out=w8)
  call "Get Property Value Config as DOM Reference.gvi"(property value configs=w7) -> (dom reference=w9)
  $"fragment reference" <- w9
  call "Close DOM References.gvi"(dom references=w1, error in=w8) -> (error out=w10)
  call "Query Selectors.gvi"(selectors=$selectors, error in=w10, document target=w9) -> (element references=w11, error out=w12)
  $"element references" <- w11
  $"error out" <- w12
