vi "Select Element and Replace Contents.gvi"   [LabVIEW NXG 3.1.0]
inputs:
  "error in": error
  "parent selector": string, required
  "dom reference": "dom reference.gtype", required
  "document target reference (document target)": "dom reference.gtype"
outputs:
  "error out": error
types:
  "dom reference.gtype" = i32
uses:
  DOM::Search::Query Selectors.gvi
  DOM::Build::Append Children.gvi
  DOM::Shared::Close DOM References.gvi
diagram:
  Build Array($"parent selector") -> w1
  call "Query Selectors.gvi"(dom target reference (global document)=$"document target reference (document target)", selectors=w1, error in=$"error in") -> (element references=w2, error out=w3)
  Array Index(array=w2) -> (out0[_]=w4)
  Build Array($"dom reference") -> w5
  call "Append Children.gvi"(parent reference=w4, child references=w5, clear parent content=TRUE, error in=w3) -> (error out=w6)
  call "Close DOM References.gvi"(dom references=w2, error in=w6) -> (error out=w7)
  $"error out" <- w7
