vi "Append Property as Integer.gvi"   [LabVIEW NXG 4.0.0]
inputs:
  "dom values in": "dom values.gtype"
  "value": i32, required
outputs:
  "dom values out": "dom values.gtype"
panel controls:
  "name": string
types:
  "dom value type.gtype" = enum{"unknown", "attribute", "absent", "undefined", "boolean", "number", "string"}
  "dom value.gtype" = cluster{"type": "dom value type.gtype", "name": string, "value": string}
  "dom values.gtype" = "dom value.gtype"[]
diagram:
  Format Into String($value) -> w1
  Property Node(instance in="dom value.gtype" {all zero or empty}, "name"=$name, "value"=w1, "type"="number") -> (instance out=w2)
  Build Array($"dom values in", w2) -> w3
  $"dom values out" <- w3
