vi "Append Property as Undefined.gvi"   [LabVIEW NXG 4.0.0]
inputs:
  "dom values in": "dom values.gtype"
outputs:
  "dom values out": "dom values.gtype"
panel controls:
  "name": string
types:
  "dom value type.gtype" = enum{"unknown", "attribute", "absent", "undefined", "boolean", "double", "integer", "string"}
  "dom value.gtype" = cluster{"type": "dom value type.gtype", "name": string, "value": string}
  "dom values.gtype" = "dom value.gtype"[]
diagram:
  Property Node(instance in="dom value.gtype" {all zero or empty}, "name"=$name, "type"="undefined") -> (instance out=w1)
  Build Array($"dom values in", w1) -> w2
  $"dom values out" <- w2
