vi "Get Attribute.gvi"   [LabVIEW NXG 4.0.0]
inputs:
  "dom values in": "dom values.gtype", required
  "index": i32, required
  "error in": error
outputs:
  "dom values out": "dom values.gtype"
  "name": string
  "value": string
  "exists": bool
  "error out": error
types:
  "dom value type.gtype" = enum{"unknown", "attribute", "absent", "undefined", "boolean", "number", "string"}
  "dom value.gtype" = cluster{"type": "dom value type.gtype", "name": string, "value": string}
  "dom values.gtype" = "dom value.gtype"[]
uses:
  DOM::Support::Build DOM Error Cluster.gvi
diagram:
  $"dom values out" <- $"dom values in"
  Array Index(array=$"dom values in") -> (out0[$index]=w1)
  Property Node(instance in=w1) -> ("type"=w2, "name"=w3, "value"=w4)
  case (w2) {
    frame Default {
      Format Into String(formatString="Expected attribute, found: %s", errIn=$"error in", w2) -> (errOut=w6)
      call "Build DOM Error Cluster.gvi"(dom error="unexpected_dom_value_type", error in=w6) -> (error out=w5)
    }
    frame "attribute", "absent" {
      Is Equal(x="attribute", y=w2) -> w7
      $exists <- w7
      $name <- w3
      $value <- w4
      w5 = $"error in"
    }
  }
  $"error out" <- w5
