vi "Get Property as Boolean.gvi"   [LabVIEW NXG 4.0.0]
inputs:
  "dom values in": "dom values.gtype", required
  "index": i32
  "error in": error
outputs:
  "value": bool
  "dom values out": "dom values.gtype"
  "error out": error
types:
  "dom value type.gtype" = enum{"unknown", "attribute", "absent", "undefined", "boolean", "number", "string"}
  "dom value.gtype" = cluster{"type": "dom value type.gtype", "name": string, "value": string}
  "dom values.gtype" = "dom value.gtype"[]
uses:
  DOM::Support::Build DOM Error Cluster.gvi
diagram:
  $"dom values out" <- $"dom values in"
  Array Index(array=$"dom values in") -> (out0[$index]=w1)
  Property Node(instance in=w1) -> ("value"=w2, "type"=w3)
  case (w3) {
    frame Default {
      Format Into String(formatString="Expected boolean, found: %s", errIn=$"error in", w3) -> (errOut=w5)
      call "Build DOM Error Cluster.gvi"(dom error="unexpected_dom_value_type", error in=w5) -> (error out=w4)
    }
    frame "boolean" {
      case (w2) {
        frame "false" {
          w6 = FALSE
          w4 = $"error in"
        }
        frame Default {
          call "Build DOM Error Cluster.gvi"(description="unexpected boolean value", error in=$"error in") -> (error out=w4)
          w6 = FALSE
        }
        frame "true" {
          w6 = TRUE
          w4 = $"error in"
        }
      }
      $value <- w6
    }
  }
  $"error out" <- w4
