vi "aframe.gviweb"   [LabVIEW NXG 3.1.0]
panel controls:
  "Slider": f64
uses:
  DOM::Build::Create Document Fragment.gvi
  DOM::Search::Query Selectors.gvi
  DOM::Tasks::Select Element and Append Content.gvi
  DOM::Shared::Append Property Value Config as Double.gvi
  DOM::Configure::Set Properties.gvi
diagram:
  w1 = """    <a-scene background="color: #FAFAFA" embedded>
      <a-box position="-1 0.5 -3" rotation="0 45 0" color="#4CC3D9" shadow></a-box>
      <a-sphere position="0 1.25 -5" radius="1.25" color="#EF2D5E" shadow></a-sphere>
      <a-cylinder position="1 0.75 -3" radius="0.5" height="1.5" color="#FFC65D" shadow></a-cylinder>
      <a-plane position="0 0 -4" rotation="-90 0 0" width="4" height="4" color="#7BC8A4" shadow></a-plane>
    </a-scene>"""
  # Inert false needed to workaround https://github.com/aframevr/aframe/issues/3182
  call "Create Document Fragment.gvi"(content=w1, inert?=FALSE) -> (document fragment reference=w2, error out=w3)
  call "Query Selectors.gvi"(dom target reference in (global document)=w2, selectors=["a-box", "a-sphere", "a-cylinder"], error in=w3) -> (dom target reference out=w4, element references=w5, error out=w6)
  call "Select Element and Append Content.gvi"(parent selector=".my-vr-scene", dom reference=w4, clear parent content=TRUE, error in=w6)
  Array Index(array=w5) -> (out0[_]=w7)
  while {
    Wait(time to wait=10)
    call "Append Property Value Config as Double.gvi"(value=$Slider) -> (property value configs out=w8)
    call "Set Properties.gvi"(element reference in=w7, property names=["object3D.rotation.x"], property value configs=w8)
    stop if FALSE
  }
