vi "index.gviweb"   [LabVIEW NXG 5.0.0]
panel indicators:
  "name": string[]
  "value": string[]
  "found": bool[]
  "name_2": string[]
  "value_2": string[]
  "found_2": bool[]
  "iframe load time": timestamp
  "iframe load time_2": timestamp
uses:
  DOM::Build::HTML Placeholder Container to DOM Reference.gvi
  DOM::Build::Create Document Fragment.gvi
  DOM::Search::Query Selectors.gvi
  DOM::Build::Append Children.gvi
  DOM::Values::Append Attribute.gvi
  DOM::Configure::Set Attributes and Properties.gvi
  DOM::Configure::Get Attributes.gvi
  DOM::Values::Get Attribute.gvi
  DOM::Monitor::Add Event Listener.gvi
  DOM::Monitor::Wait For Event.gvi
  DOM::Monitor::Remove Event Listener.gvi
diagram:
  call "HTML Placeholder Container to DOM Reference.gvi"(container=reference to "container") -> (element reference=w1)
  while (after w1) {
    Wait(time to wait=50)
    stop if FALSE
  }
  call "Create Document Fragment.gvi"(content="<iframe random=\"lol\"></iframe>") -> (document fragment reference=w2)
  call "Query Selectors.gvi"(dom target reference in (global document)=w2, selectors=["iframe"]) -> (dom target reference out=w3, element references=w4)
  Build Array(w3) -> w5
  call "Append Children.gvi"(parent reference in=w1, child references=w5, clear parent content=TRUE)
  Array Index(array=w4) -> (out0[_]=w6)
  call "Append Attribute.gvi"(name="src", value="http://www.ni.com") -> (dom values out=w7)
  call "Set Attributes and Properties.gvi"(element reference in=w6, dom values=w7) -> (element reference out=w8)
  call "Get Attributes.gvi"(element reference in=w8) -> (dom values=w9)
  Array Size(array=w9) -> (size(s)=w10)
  for (N = w10) (iteration -> i1) {
    call "Get Attribute.gvi"(dom values in=w9, index=i1) -> (name=w14, value=w15, exists=w16)
    append w14 to w11
    append w15 to w12
    append w16 to w13
  }
  $found <- w13
  $name <- w11
  $value <- w12
  call "Get Attributes.gvi"(element reference in=w8, attribute names in=["random", "fakenews"]) -> (dom values=w17)
  Array Size(array=w17) -> (size(s)=w18)
  for (N = w18) (iteration -> i2) {
    call "Get Attribute.gvi"(dom values in=w17, index=i2) -> (name=w22, value=w23, exists=w24)
    append w22 to w19
    append w23 to w20
    append w24 to w21
  }
  $found_2 <- w21
  $name_2 <- w19
  $value_2 <- w20
  call "Add Event Listener.gvi"(element reference in=w8, event name="load") -> (event manager reference=w25, error out=w26)
  call "Wait For Event.gvi"(event manager reference in=w25, error in=w26) -> (event manager reference out=w27, error out=w28)
  sequence {
    frame 0 {
      Get Current Time() -> (current time=w29)
      $"iframe load time" <- w29
    }
  }
  call "Remove Event Listener.gvi"(event manager reference=w27, error in=w28)
  call "Create Document Fragment.gvi"(content="<iframe src=\"https://www.reddit.com\"></iframe>") -> (document fragment reference=w30, error out=w31)
  call "Query Selectors.gvi"(dom target reference in (global document)=w30, selectors=["iframe"], error in=w31) -> (element references=w32, error out=w33)
  Array Index(array=w32) -> (out0[_]=w34)
  call "Add Event Listener.gvi"(element reference in=w34, event name="load", error in=w33) -> (element reference out=w35, event manager reference=w36, error out=w37)
  Build Array(w35) -> w38
  call "HTML Placeholder Container to DOM Reference.gvi"(container=reference to "container 2", error in=w37) -> (element reference=w39, error out=w40)
  call "Append Children.gvi"(parent reference in=w39, child references=w38, error in=w40) -> (error out=w41)
  call "Wait For Event.gvi"(event manager reference in=w36, error in=w41) -> (dom values=w42)
  sequence (after w42) {
    frame 0 {
      Get Current Time() -> (current time=w43)
      $"iframe load time_2" <- w43
    }
  }
