vi "svg.gviweb"   [LabVIEW NXG 3.1.0]
uses:
  DOM::Search::Query Selector All.gvi
  DOM::Build::Create Document Fragment.gvi
  DOM::Build::Append Children.gvi
  DOM::Build::Create Elements.gvi
  DOM::Shared::Append Attribute Value Config.gvi
  DOM::Configure::Set Attributes.gvi
diagram:
  call "Query Selector All.gvi"(selector=".placeholder") -> (element references=w1)
  Array Index(array=w1) -> (out0[_]=w2)
  w3 = """<svg height="100" width="100">
  <circle cx="50" cy="50" r="40" stroke="black" stroke-width="3" fill="red" />
  <image xlink:href="https://mdn.mozillademos.org/files/6457/mdn_logo_only_color.png" height="200" width="200"/>
</svg>"""
  call "Create Document Fragment.gvi"(content=w3) -> (document fragment reference=w4)
  Build Array(w4) -> w5
  call "Append Children.gvi"(parent reference in=w2, child references=w5, clear parent content=TRUE)
  call "Query Selector All.gvi"(selector=".placeholder2") -> (element references=w6)
  Array Index(array=w6) -> (out0[_]=w7)
  call "Create Elements.gvi"(tag names=["svg"]) -> (element references=w8)
  Array Index(array=w8) -> (out0[_]=w9)
  call "Append Attribute Value Config.gvi"(attribute value="100") -> (attribute value configs out=w10)
  call "Append Attribute Value Config.gvi"(attribute value configs in=w10, attribute value="100") -> (attribute value configs out=w11)
  call "Set Attributes.gvi"(element reference in=w9, attribute names=["height", "width"], attribute value configs=w11) -> (element reference out=w12)
  # Todo can't use setAttribute because need xlink namespace, this is a workaround
  # Todo can't use createElement because need a way to pass the namespace, this is a workaround
  call "Create Document Fragment.gvi"(content="<svg><image xlink:href=\"\"/></svg>") -> (document fragment reference=w13)
  call "Query Selector All.gvi"(dom target reference in (global document)=w13, selector="image") -> (element references=w14)
  Array Index(array=w14) -> (out0[_]=w15)
  w16 = "https://mdn.mozillademos.org/files/6457/mdn_logo_only_color.png"
  call "Append Attribute Value Config.gvi"(attribute value="200") -> (attribute value configs out=w17)
  call "Append Attribute Value Config.gvi"(attribute value configs in=w17, attribute value="200") -> (attribute value configs out=w18)
  call "Append Attribute Value Config.gvi"(attribute value configs in=w18, attribute value=w16) -> (attribute value configs out=w19)
  call "Set Attributes.gvi"(element reference in=w15, attribute names=["width", "height", "xlink:href"], attribute value configs=w19) -> (element reference out=w20)
  # This works because the circle element is created inside an svg context in the document fragment. If it was created outside via createElements or as a circle tag standalone it would be in the html context and fail to work.
  call "Create Document Fragment.gvi"(content="<svg><circle/></svg>") -> (document fragment reference=w21)
  call "Query Selector All.gvi"(dom target reference in (global document)=w21, selector="circle") -> (element references=w22)
  Array Index(array=w22) -> (out0[_]=w23)
  # Todo can't use createElement because need a way to pass the namespace, this is a workaround
  w24 = ["cx", "cy", "r", "stroke", "stroke-width", "fill", "pathLength"]
  call "Append Attribute Value Config.gvi"(attribute value="50") -> (attribute value configs out=w25)
  call "Append Attribute Value Config.gvi"(attribute value configs in=w25, attribute value="50") -> (attribute value configs out=w26)
  call "Append Attribute Value Config.gvi"(attribute value configs in=w26, attribute value="40") -> (attribute value configs out=w27)
  call "Append Attribute Value Config.gvi"(attribute value configs in=w27, attribute value="black") -> (attribute value configs out=w28)
  call "Append Attribute Value Config.gvi"(attribute value configs in=w28, attribute value="3") -> (attribute value configs out=w29)
  call "Append Attribute Value Config.gvi"(attribute value configs in=w29, attribute value="red") -> (attribute value configs out=w30)
  call "Append Attribute Value Config.gvi"(attribute value configs in=w30, attribute value="7") -> (attribute value configs out=w31)
  call "Set Attributes.gvi"(element reference in=w23, attribute names=w24, attribute value configs=w31) -> (element reference out=w32)
  Build Array(w32, w20) -> w33
  call "Append Children.gvi"(parent reference in=w12, child references=w33) -> (parent reference out=w34)
  Build Array(w34) -> w35
  call "Append Children.gvi"(parent reference in=w7, child references=w35, clear parent content=TRUE)
  while {
    stop if FALSE
  }
