vi "Color to CSS hex.gvi"   [LabVIEW NXG 5.1.0]
inputs:
  "Input": "Color.gtype"
outputs:
  "Output": string
types:
  "Color.gtype" = u32
uses:
  DataGridCellStyle::Support::Color to RGBA.gvi
  DebugTools::Debug Log.gvi
diagram:
  call "Color to RGBA.gvi"(Color Constant=$Input) -> (red=w1, green=w2, blue=w3)
  Format Into String(formatString="#%02x%02x%02x", w1, w2, w3) -> w4
  $Output <- w4
  call "Debug Log.gvi"(prefix="css color", value=w4)
