vi "index.gviweb"   [LabVIEW NXG 5.1.0]
panel indicators:
  "Data Grid": cluster{"A": string, "String": string}[]
uses:
  DataGridCellStyle::Support::Color to CSS hex.gvi
  DataGridCellStyle::Support::DataGridCellStyle.jsli::CreateStyle
diagram:
  w1 = [{"A"="fail", "String"="fail"}, {"A"="pass", "String"="pass"}]
  $"Data Grid" <- w1
  call "Color to CSS hex.gvi"(Input=4278232655) -> (Output=w2)
  call "CreateStyle"(selector=".my-element", index=0, text="pass", color=w2)
  # Place setup code before the loop. For example, perform initial data communication and wire the results into the loop.
  # Top-Level WebVIs usually contain a While Loop that never stops so that they can continue running as long as the web page is open in the user's web browser.
  while {
    Wait(time to wait=50)
    stop if FALSE
  }
