vi "index.gviweb"   [LabVIEW NXG 5.1.0]
panel controls:
  "sort": enum{"none", "ascending", "descending"} = "none"
panel indicators:
  "Data Grid": T1[]
types:
  T1 = cluster{"Some Value": string, "Some Other Value": string}
uses:
  DataGridTools::DataGrid - Column - Set Sorting.gvi
  WebApp::Support::Show Error Dialog.gvi
diagram:
  w1 = [{"Some Value"="b", "Some Other Value"="z"}, {"Some Value"="c", "Some Other Value"="y"}, {"Some Value"="d", "Some Other Value"="x"}, {"Some Value"="a", "Some Other Value"="w"}]
  $"Data Grid" <- w1
  while {
    event {
      on "sort" Value changed {
        # For instructions configuring the selector input follwo the Choosing a control in the page portion of: https://forums.ni.com/t5/Example-Code/Declarative-Style-for-WebVI/ta-p/4141973
        Event Data() -> ("New Value"=w2)
        call "DataGrid - Column - Set Sorting.gvi"(selector=".my-grid", column index=0, sort=w2) -> (error out=w3)
        call "Show Error Dialog.gvi"(error in=w3)
      }
    }
    stop if FALSE
  }
