vi "My SubVI.gvi"   [LabVIEW NXG 5.0.0]
uses:
  DebugTools::Debug Log.gvi
diagram:
  s1 = uninitialised  # shift register
  while {
    Is First Call() -> w1
    case (w1) {
      frame False, Default {
        Array Index(array=s1) -> (out0[_]=w3)
        Property Node(instance in=w3) -> ("inner array"=w4, instance out=w5)
        Array Index(array=w4) -> (out0[_]=w6)
        Property Node(instance in=w6) -> ("numeric value"=w7, "variant value"=w8, instance out=w9)
        Increment(x=w7) -> w10
        Set Variant Attribute(name="my attribute", value=w10, variant=w8) -> (variant out=w11)
        Property Node(instance in=w9, "numeric value"=w10, "variant value"=w11) -> (instance out=w12)
        Replace Array Subset(inArray=w4, index=_, new=w12) -> w13
        Property Node(instance in=w5, "inner array"=w13) -> (instance out=w14)
        Replace Array Subset(inArray=s1, index=_, new=w14) -> w2
      }
      frame True {
        w15 = [{"inner array"=[{"numeric value"=0, "queue reference"=refnum, "variant value"=variant(), "javascript reference value"=refnum}]}]  # My Type
        w2 = w15
      }
    }
    call "Debug Log.gvi"(prefix="[My Type]", value=w2)
    next s1 = w2
    stop if TRUE
  }
