vi "index.gviweb"   [LabVIEW NXG 5.0.0]
uses:
  WebApp::My SubVI.gvi
  DebugTools::Debug Log.gvi
diagram:
  while (iteration -> i1) {
    call "My SubVI.gvi"()
    Wait(time to wait=1000)
    call "Debug Log.gvi"(prefix="[increment]", value=i1)
    stop if FALSE
  }
