vi "Create Style.gvi"   [LabVIEW NXG 5.1.0]
inputs:
  "rule selector": "rule selector.gtype", required
  "rule properties": "rule properties.gtype", required
  "error in": error
outputs:
  "error out": error
  "style reference": "style reference.gtype"
types:
  "rule property.gtype" = cluster{"name": string, "value": string}
  "rule properties.gtype" = "rule property.gtype"[]
  "rule selector.gtype" = cluster{"type": string, "configJSON": string}
  "style reference.gtype" = "NI.JavaScriptReference"
uses:
  DeclarativeStyle::Support::DeclarativeStyle.jsli::CreateStyle
diagram:
  Flatten To Json(anything=$"rule selector", error in (no error)=$"error in") -> (JSON string=w1, error out=w2)
  Flatten To Json(anything=$"rule properties", error in (no error)=w2) -> (JSON string=w3, error out=w4)
  call "CreateStyle"(ruleSelector=w1, ruleProperties=w3, error in=w4) -> (styleReference=w5, error out=w6)
  $"style reference" <- w5
  $"error out" <- w6
