vi "DataGrid - String Column - Value-Based - Background Color.gvi"   [LabVIEW NXG 5.1.0]
inputs:
  "error in": error
  "selector": string, required
  "column index": u32, required
  "text": string, required
  "color": "Color.gtype", required
outputs:
  "error out": error
panel controls:
  "operator": "operator.gtype" = "contains"
  "case-insensitive": bool
types:
  "Color.gtype" = u32
  "operator.gtype" = enum{"equals", "starts with", "ends with", "contains"}
uses:
  DeclarativeStyle::Support::Color to CSS hex.gvi
  DeclarativeStyle::Support::DeclarativeStyle.jsli::DataGridStringColumnValueBasedBackgroundColor
diagram:
  call "Color to CSS hex.gvi"(Input=$color) -> (Output=w1)
  call "DataGridStringColumnValueBasedBackgroundColor"(selector=$selector, index=$"column index", text=$text, color=w1, error in=$"error in") -> (error out=w2)
  $"error out" <- w2
