vi "Background Color.gvi"   [LabVIEW NXG 5.1.0]
inputs:
  "rule properties in": "rule properties.gtype"
  "background color": "Color.gtype" = 4278190080, required
outputs:
  "rule properties out": "rule properties.gtype"
types:
  "rule property.gtype" = cluster{"name": string, "value": string}
  "rule properties.gtype" = "rule property.gtype"[]
  "Color.gtype" = u32
uses:
  DeclarativeStyle::Support::Color to CSS hex.gvi
  DeclarativeStyle::Property::Custom Property.gvi
diagram:
  call "Color to CSS hex.gvi"(color=$"background color") -> (css hex color=w1)
  call "Custom Property.gvi"(rule properties in=$"rule properties in", name="background", value=w1) -> (rule properties out=w2)
  $"rule properties out" <- w2
