vi "Custom Property.gvi"   [LabVIEW NXG 5.1.0]
inputs:
  "rule properties in": "rule properties.gtype"
  "name": string, required
  "value": string, required
outputs:
  "rule properties out": "rule properties.gtype"
types:
  "rule property.gtype" = cluster{"name": string, "value": string}
  "rule properties.gtype" = "rule property.gtype"[]
diagram:
  Property Node(instance in="rule property.gtype" {all zero or empty}, "name"=$name, "value"=$value) -> (instance out=w1)
  Build Array($"rule properties in", w1) -> w2
  $"rule properties out" <- w2
