vi "Remove Style.gvi"   [LabVIEW NXG 5.1.0]
inputs:
  "error in": error
  "style reference": "style reference.gtype", required
outputs:
  "error out": error
types:
  "style reference.gtype" = "NI.JavaScriptReference"
uses:
  DeclarativeStyle::Support::DeclarativeStyle.jsli::RemoveStyle
diagram:
  call "RemoveStyle"(styleReference=$"style reference") -> (error out=w1)
  Merge Errors($"error in", w1) -> (error out=w2)
  Close Reference(error in=w2, reference=$"style reference") -> (error out=w3)
  $"error out" <- w3
