vi "Button - Glyph.gvi"   [G Web Development Software 21.0.0]
inputs:
  "selector": string
outputs:
  "rule selector": "rule selector.gtype"
types:
  "rule selector.gtype" = cluster{"type": string, "configJSON": string}
diagram:
  w1 = "rule selector.gtype" {"type"="button-glyph", "configJSON"=""}
  Property Node(instance in=cluster{"selector": string} {all zero or empty}, "selector"=$selector) -> (instance out=w2)
  Flatten To Json(anything=w2) -> (JSON string=w3)
  Property Node(instance in=w1, "configJSON"=w3) -> (instance out=w4)
  $"rule selector" <- w4
