vi "DataGrid - String Column - Text Match.gvi"   [LabVIEW NXG 5.1.0]
# Create a selector for a data grid string column.
# Note: The matching text is case insensitive so an exact match of the value pass will match the values Pass, PaSs, etc.
inputs:
  "text match options": "text match options.gtype", required
  "selector": string, required
  "column index": u32, required
outputs:
  "rule selector": "rule selector.gtype"
types:
  "operator.gtype" = enum{"exact match", "starts with", "ends with", "contains"}
  "text match options.gtype" = cluster{"operator": "operator.gtype", "text": string}
  "rule selector.gtype" = cluster{"type": string, "configJSON": string}
  T1 = cluster{"selector": string, "index": i32, "operator": string, "text": string}
diagram:
  w1 = "rule selector.gtype" {"type"="datagrid-stringcolumn-textmatch", "configJSON"=""}
  Property Node(instance in=$"text match options") -> ("operator"=w2, "text"=w3)
  Format Into String(w2) -> w4
  Property Node(instance in=T1 {all zero or empty}, "selector"=$selector, "index"=$"column index", "operator"=w4, "text"=w3) -> (instance out=w5)
  Flatten To Json(anything=w5) -> (JSON string=w6)
  Property Node(instance in=w1, "configJSON"=w6) -> (instance out=w7)
  $"rule selector" <- w7
