vi "DataGrid - String Column.gvi"   [LabVIEW NXG 5.1.0]
# Create a selector for a data grid string column.
# Note: The matching text is case insensitive so an exact match of the value pass will match the values Pass, PaSs, etc.
inputs:
  "selector": string, required
  "column index": u32, required
outputs:
  "rule selector": "rule selector.gtype"
types:
  "rule selector.gtype" = cluster{"type": string, "configJSON": string}
diagram:
  w1 = "rule selector.gtype" {"type"="datagrid-stringcolumn", "configJSON"=""}
  w2 = cluster{"selector": string, "index": i32} {all zero or empty}
  Property Node(instance in=w2, "selector"=$selector, "index"=$"column index") -> (instance out=w3)
  Flatten To Json(anything=w3) -> (JSON string=w4)
  Property Node(instance in=w1, "configJSON"=w4) -> (instance out=w5)
  $"rule selector" <- w5
