vi "Color to RGBA.gvi"   [LabVIEW NXG 3.1.0]
inputs:
  "Color Constant": "Color.gtype" = 4278190080
outputs:
  "red": u8
  "green": u8
  "blue": u8
  "alpha": u8
types:
  "Color.gtype" = u32
diagram:
  To Unsigned Long Integer(number=$"Color Constant") -> w1
  Logical And(0xFF000000, w1) -> w2
  Scale By Power Of 2(n=-24, x=w2) -> w3
  To Unsigned Byte Integer(number=w3) -> w4
  $alpha <- w4
  Logical And(0xFF0000, w1) -> w5
  Scale By Power Of 2(n=-16, x=w5) -> w6
  To Unsigned Byte Integer(number=w6) -> w7
  $red <- w7
  Logical And(0xFF00, w1) -> w8
  Scale By Power Of 2(n=-8, x=w8) -> w9
  To Unsigned Byte Integer(number=w9) -> w10
  $green <- w10
  Logical And(0xFF, w1) -> w11
  Scale By Power Of 2(n=0, x=w11) -> w12
  To Unsigned Byte Integer(number=w12) -> w13
  $blue <- w13
