vi "Contains Message.gvi"   [LabVIEW NXG 5.1.0]
inputs:
  "error in": error, required
  "message": string, required
outputs:
  "error contains message?": bool
diagram:
  Property Node(instance in=$"error in") -> ("source"=w1)
  Search Or Split String(search string/char=$message, string=w1) -> (offset of match=w2)
  Is Not Equal(x=w2, y=-1) -> w3
  $"error contains message?" <- w3
