vi "errors.gviweb"   [LabVIEW NXG 5.1.0]
panel controls:
  "Data Grid": cluster{"String": string, "Numeric": f64}[]
  "String": string
panel indicators:
  "non-existing element": error
  "non-existant column": error
  "non-datagrid element": error
  "unexpected column type": error
  "non-existing element pass?": bool
  "non-datagrid element pass?": bool
  "non-existant column pass?": bool
  "unexpected column type pass?": bool
types:
  "operator.gtype" = enum{"exact match", "starts with", "ends with", "contains"}
  "text match options.gtype" = cluster{"operator": "operator.gtype", "text": string}
uses:
  DeclarativeStyle::Selector::DataGrid - String Column - Text Match.gvi
  DeclarativeStyle::Property::Background Color.gvi
  DeclarativeStyle::Create Style.gvi
  WebApp::Tests::Contains Message.gvi
diagram:
  w1 = "text match options.gtype" {"operator"="exact match", "text"="pass"}
  call "DataGrid - String Column - Text Match.gvi"(selector=".non-existant-element", column index=0, text match options=w1) -> (rule selector=w2)
  call "Background Color.gvi"(background color=1711318607) -> (rule properties out=w3)
  call "Create Style.gvi"(rule selector=w2, rule properties=w3) -> (error out=w4)
  $"non-existing element" <- w4
  w5 = "Expected a single element with selector (.non-existant-element) but found: 0"
  call "Contains Message.gvi"(error in=w4, message=w5) -> (error contains message?=w6)
  $"non-existing element pass?" <- w6
  w7 = "text match options.gtype" {"operator"="exact match", "text"="pass"}
  call "DataGrid - String Column - Text Match.gvi"(selector=".non-datagrid-element", column index=0, text match options=w7) -> (rule selector=w8)
  call "Background Color.gvi"(background color=1711318607) -> (rule properties out=w9)
  call "Create Style.gvi"(rule selector=w8, rule properties=w9) -> (error out=w10)
  $"non-datagrid element" <- w10
  w11 = "Error: Expected selector (.non-datagrid-element) to target a data grid but instead found NI-STRING-CONTROL"
  call "Contains Message.gvi"(error in=w10, message=w11) -> (error contains message?=w12)
  $"non-datagrid element pass?" <- w12
  w13 = "text match options.gtype" {"operator"="exact match", "text"="pass"}
  call "DataGrid - String Column - Text Match.gvi"(selector=".my-element", column index=20, text match options=w13) -> (rule selector=w14)
  call "Background Color.gvi"(background color=1711318607) -> (rule properties out=w15)
  call "Create Style.gvi"(rule selector=w14, rule properties=w15) -> (error out=w16)
  $"non-existant column" <- w16
  w17 = "Expected column index 20 to be in range [0-1] for data grid."
  call "Contains Message.gvi"(error in=w16, message=w17) -> (error contains message?=w18)
  $"non-existant column pass?" <- w18
  w19 = "text match options.gtype" {"operator"="exact match", "text"="pass"}
  call "DataGrid - String Column - Text Match.gvi"(selector=".my-element", column index=1, text match options=w19) -> (rule selector=w20)
  call "Background Color.gvi"(background color=1711318607) -> (rule properties out=w21)
  call "Create Style.gvi"(rule selector=w20, rule properties=w21) -> (error out=w22)
  $"unexpected column type" <- w22
  call "Contains Message.gvi"(error in=w22, message="String column not found at column index 1 for data grid.") -> (error contains message?=w23)
  $"unexpected column type pass?" <- w23
