vi "index.gviweb"   [G Web Development Software 21.0.0]
panel controls:
  "Highlight text": T1[]
  "Button with custom glyph": bool
types:
  T1 = cluster{"Highlight pass and fail exact": string, "Highlight fail contains": string, "Lots of text": string}
  "operator.gtype" = enum{"exact match", "starts with", "ends with", "contains"}
  "text match options.gtype" = cluster{"operator": "operator.gtype", "text": string}
uses:
  DeclarativeStyle::Selector::DataGrid - String Column - Text Match.gvi
  DeclarativeStyle::Property::Background Color.gvi
  DeclarativeStyle::Create Style.gvi
  DeclarativeStyle::Property::Custom Property.gvi
  DeclarativeStyle::Property::Font Color.gvi
  DeclarativeStyle::Selector::DataGrid - String Column.gvi
  DeclarativeStyle::Selector::Button - Glyph.gvi
  DeclarativeStyle::Value::Url Image Value.gvi
  WebApp::Support::Show Error Dialog.gvi
diagram:
  # check for strings in a datagrid column that exactly match the text "fail" case-insensitively
  w1 = "text match options.gtype" {"operator"="exact match", "text"="pass"}
  # check for strings in a datagrid column that exactly match the text "pass" case-insensitively
  call "DataGrid - String Column - Text Match.gvi"(selector=".my-element", column index=0, text match options=w1) -> (rule selector=w2)
  call "Background Color.gvi"(background color=4289451121) -> (rule properties out=w3)
  call "Create Style.gvi"(rule selector=w2, rule properties=w3) -> (error out=w4)
  w5 = "text match options.gtype" {"operator"="exact match", "text"="fail"}
  call "DataGrid - String Column - Text Match.gvi"(selector=".my-element", column index=0, text match options=w5) -> (rule selector=w6)
  call "Background Color.gvi"(background color=4294142798) -> (rule properties out=w7)
  call "Create Style.gvi"(rule selector=w6, rule properties=w7) -> (error out=w8)
  # check for strings in a datagrid column that contain the text "fail" case-insensitively
  w9 = "text match options.gtype" {"operator"="contains", "text"="fail"}
  call "DataGrid - String Column - Text Match.gvi"(selector=".my-element", column index=1, text match options=w9) -> (rule selector=w10)
  w11 = "linear-gradient( -10deg, #f10d5e 0%, #ffb43e 25%, #43e03c 50%, #6528ff 100%)"
  call "Custom Property.gvi"(name="background-image", value=w11) -> (rule properties out=w12)
  call "Font Color.gvi"(rule properties in=w12, font color=4294967295) -> (rule properties out=w13)
  call "Create Style.gvi"(rule selector=w10, rule properties=w13) -> (error out=w14)
  # Enable the horizontal scrollbar for a string column in a datagrid and make the font green
  call "DataGrid - String Column.gvi"(selector=".my-element", column index=2) -> (rule selector=w15)
  call "Font Color.gvi"(font color=4278229861) -> (rule properties out=w16)
  call "Custom Property.gvi"(rule properties in=w16, name="--ni-overflow-x", value="auto") -> (rule properties out=w17)
  call "Create Style.gvi"(rule selector=w15, rule properties=w17) -> (error out=w18)
  call "Button - Glyph.gvi"(selector=".my-button") -> (rule selector=w19)
  # Images need to have explicit sizing. Not an issue for png / jpg, but something to be aware of for svg.
  call "Url Image Value.gvi"(url="Support/lightbulb.svg") -> (url image value=w20)
  call "Custom Property.gvi"(name="content", value=w20) -> (rule properties out=w21)
  call "Create Style.gvi"(rule selector=w19, rule properties=w21) -> (error out=w22)
  Merge Errors(w4, w8, w14, w18, w22) -> (error out=w23)
  sequence {
    frame 0 {
      # Set data grid values after creating styles to prevent Flash of Unstyled Content (FOUC)
      w24 = [{"Highlight pass and fail exact"="pass", "Highlight fail contains"="fail", "Lots of text"="Lorem ipsum dolor sit amet, consectetur adipiscing elit, sed do eiusmod tempor incididunt ut labore et dolore magna aliqua. Ut enim ad minim veniam, quis nostrud exercitation ullamco laboris nisi ut aliquip ex ea commodo consequat. Duis aute irure dolor in reprehenderit in voluptate velit esse cillum dolore eu fugiat nulla pariatur. Excepteur sint occaecat cupidatat non proident, sunt in culpa qui officia deserunt mollit anim id est laborum."}, {"Highlight pass and fail exact"="Pass", "Highlight fail contains"="Fail", "Lots of text"=""}, {"Highlight pass and fail exact"="PaSs", "Highlight fail contains"="Failure", "Lots of text"=""}, {"Highlight pass and fail exact"="fail", "Highlight fail contains"="It failed", "Lots of text"=""}, {"Highlight pass and fail exact"="Fail", "Highlight fail contains"="fial", "Lots of text"=""}, {"Highlight pass and fail exact"="failure", "Highlight fail contains"="", "Lots of text"=""}, {"Highlight pass and fail exact"="other", "Highlight fail contains"="", "Lots of text"=""}]
      $"Highlight text" <- w24
    }
  }
  call "Show Error Dialog.gvi"(error in=w23)
  while {
    Wait(time to wait=10)
    stop if FALSE
  }
