vi "3D Settings.gvi"   [LabVIEW NXG 5.0.0]
inputs:
  "echart reference in": "echart reference.gtype"
  "error in": error
outputs:
  "echart reference out": "echart reference.gtype"
  "error out": error
types:
  "echart reference.gtype" = "NI.JavaScriptReference"
uses:
  ECharts::Shared Options 3D::Set Grid 3D.gvi
  ECharts::Shared Options 3D::Set Axis 3D.gvi
  ECharts::Core::Update EChart Options.gvi
diagram:
  call "Set Grid 3D.gvi"() -> (echart options out=w1)
  call "Set Axis 3D.gvi"(echart options in=w1, axis 3d="x") -> (echart options out=w2)
  call "Set Axis 3D.gvi"(echart options in=w2, axis 3d="y") -> (echart options out=w3)
  call "Set Axis 3D.gvi"(echart options in=w3, axis 3d="z") -> (echart options out=w4)
  call "Update EChart Options.gvi"(echart reference in=$"echart reference in", echart options=w4, error in=$"error in") -> (echart reference out=w5, error out=w6)
  $"echart reference out" <- w5
  $"error out" <- w6
