vi "index.gviweb"   [G Web Development Software 22.3.0]
panel controls:
  "Load Data": bool
  "Sample Data URL": string = "Support/data.json"
uses:
  ECharts::Core::Create EChart.gvi
  WebApp::Support::3D Settings.gvi
  Uppy::Set Uppy Core Options.gvi
  Uppy::Request Files.gvi
  WebApp::Support::Parse File.gvi
  ECharts::Surface Options::Append Surface Series Options.gvi
  ECharts::Core::Update EChart Options.gvi
diagram:
  call "Create EChart.gvi"(container=reference to "graph") -> (echart reference=w1, error out=w2)
  call "3D Settings.gvi"(echart reference in=w1, error in=w2) -> (echart reference out=w3, error out=w4)
  while {
    event {
      on "Load Data" Value changed {
        call "Set Uppy Core Options.gvi"(max file size=10000000, max number of files=1, allowed file types=[".json"]) -> (uppy options out=w5)
        call "Request Files.gvi"(uppy options=w5) -> (file references=w6, error out=w7)
        call "Parse File.gvi"(uppy file references=w6, error in=w7) -> (value=w8)
        call "Append Surface Series Options.gvi"(data=w8) -> (echart options out=w9)
        call "Update EChart Options.gvi"(echart reference in=w3, echart options=w9, error in=w4)
      }
    }
    stop if FALSE
  }
