vi "index.gviweb"   [G Web Development Software 22.3.0]
panel controls:
  "Tag Value": string
  "update tag": bool
  "websocket test": bool
  "update file": bool
  "File content": string
panel indicators:
  "loop iteration": i32
  "tag update response": string
  "websocket test response": string
  "update file response": string
uses:
  URL::URL::URL Build Relative Path.gvi
  URL::URL::URL Parameters::URL Set Search Parameter.gvi
  NI::HTTP::GET.gvi
  Application::Support::Simple Display Error.gvi
diagram:
  while {
    event {
      on "update tag" Value changed {
        call "URL Build Relative Path.gvi"(relative url="/api/systemlink") -> (url=w1, error out=w2)
        call "URL Set Search Parameter.gvi"(url=w1, key="tag-value", value=$"Tag Value", error in=w2) -> (updated url=w3, error out=w4)
        call "GET.gvi"(url=w3, error in=w4) -> (body=w5, error out=w6)
        $"tag update response" <- w5
        call "Simple Display Error.gvi"(error In=w6)
      }
      on "websocket test" Value changed {
        call "GET.gvi"(url="/websocket") -> (body=w7)
        $"websocket test response" <- w7
      }
      on "update file" Value changed {
        call "URL Build Relative Path.gvi"(relative url="/api/systemlinkfile") -> (url=w8, error out=w9)
        call "URL Set Search Parameter.gvi"(url=w8, key="file-value", value=$"File content", error in=w9) -> (updated url=w10, error out=w11)
        call "GET.gvi"(url=w10, error in=w11) -> (body=w12, error out=w13)
        $"update file response" <- w12
        call "Simple Display Error.gvi"(error In=w13)
      }
    }
    stop if FALSE
  }
  while (iteration -> i1) {
    Wait(time to wait=100)
    $"loop iteration" <- i1
    stop if FALSE
  }
