vi "index.gviweb"   [G Web Development Software 22.3.0]
panel controls:
  "name": string
  "message": string
  "send": bool
panel indicators:
  "messages": cluster{"name": string, "message": string}[]
types:
  "message.gtype" = cluster{"name": string, "message": string}
uses:
  NI::HTTP::POST Buffer.gvi
  ChatClient::Support::Simple Display Error.gvi
  NI::HTTP::GET.gvi
diagram:
  while {
    event {
      on "send" Value changed {
        Property Node(instance in="message.gtype" {all zero or empty}, "name"=$name, "message"=$message) -> (instance out=w1)
        Flatten To Json(anything=w1) -> (JSON string=w2, error out=w3)
        call "POST Buffer.gvi"(url="/message", buffer=w2, error in=w3) -> (error out=w4)
        call "Simple Display Error.gvi"(error In=w4)
      }
    }
    stop if FALSE
  }
  while {
    call "GET.gvi"(url="/message") -> (body=w5, error out=w6)
    Unflatten From Json(JSON string=w5, error in (no error)=w6, type and defaults=string[] []) -> (error out=w7, value=w8)
    for {
      w9 = each element of w8
      Unflatten From Json(JSON string=w9, error in (no error)=w7, type and defaults="message.gtype" {all zero or empty}) -> (error out=w11, value=w12)
      append w12 to w10
    }
    $messages <- w10
    Wait(time to wait=500)
    stop if w11
  }
  call "Simple Display Error.gvi"(error In=w11)
