vi "Simple Log Error.gvi"   [G Web Development Software 22.3.0]
# Show a dismissible one button dialog with the error code and source.
inputs:
  "error In": error
uses:
  NI::G Core::Error::Read Error Code.gvi
  NI::G Core::Operating System::Write to System Log.gvi
diagram:
  # Creates a string representation of the error state to show using the available dialog functions. The VI does not provide explicit support for multiplexed errors which may result in long error messages.
  case ($"error In") {
    frame No Error { }
    frame Error {
      call "Read Error Code.gvi"(error in=$"error In") -> (code=w1)
      # The Read Location VI is not available on the Web Server target, so the source property of error in is accessed directly. It is recommended to use the Read Location VI when it is available.
      Property Node(instance in=$"error In") -> ("source"=w2)
      Is Empty String Or Path(string/path=w2) -> w3
      Select(s=w3, t="an unidentified location", f=w2) -> w4
      Format Into String(formatString="Error %d occurred at %s", w1, w4) -> w5
      call "Write to System Log.gvi"(message=w5)
    }
  }
