vi "Upload File.gvi"   [G Web Development Software 22.3.0]
inputs:
  "error in": error
  "value": string, required
  "api key": string, required
outputs:
  "error out": error
uses:
  NI::Skyline::Configuration::Open Configuration API Key.gvi
  SystemLinkFileExtensions::Send File::Send File Ext (Buffer).gvi
  NI::Skyline::Configuration::Close Configuration.gvi
diagram:
  call "Open Configuration API Key.gvi"(server url="https://test-api.lifecyclesolutions.ni.com", api key=$"api key", error in=$"error in") -> (configuration=w1, error out=w2)
  call "Send File Ext (Buffer).gvi"(data=$value, file name=$value, error in=w2, configuration=w1) -> (error out=w3)
  call "Close Configuration.gvi"(configuration=w1, error in=w3) -> (error out=w4)
  $"error out" <- w4
