vi "main.gviweb"   [G Web Development Software 22.3.0]
uses:
  Deno::Environment Variable Get.gvi
  Deno::Current Working Directory Get.gvi
  URL::URL::URL Build Relative Path.gvi
  DenoKV::KV Open.gvi
  DenoHTTP::Simple URL Pattern.gvi
  DenoHTTP::HTTP Create Listeners.gvi
  DenoHTTP::HTTP Wait On Listener.gvi
  DenoHTTP::HTTP Read Request Body String.gvi
  DenoKV::KV Monotonic ULID.gvi
  DenoKV::KV Set String.gvi
  DenoHTTP::HTTP Write Response.gvi
  ChatServer::Support::Simple Log Error.gvi
  DenoKV::KV List String.gvi
  DenoKV::KV Delete.gvi
  DenoHTTP::HTTP Serve Files.gvi
diagram:
  call "Environment Variable Get.gvi"(name="DENO_DEPLOYMENT_ID") -> (error out=w1)
  case (w1) {
    frame No Error {
      # running on deno deploy
      w2 = ""
    }
    frame Error {
      # running locally
      call "Current Working Directory Get.gvi"() -> (current working directory url=w3)
      call "URL Build Relative Path.gvi"(base url (window location)=w3, relative url="./chat.db") -> (url=w2)
    }
  }
  call "KV Open.gvi"(path url=w2) -> (kv reference=w4, error out=w5)
  call "Simple URL Pattern.gvi"(pathname="/message") -> (url pattern=w6)
  call "Simple URL Pattern.gvi"() -> (url pattern=w7)
  Build Array(w6, w7) -> w8
  call "HTTP Create Listeners.gvi"(url patterns=w8) -> (http listener references=w9, error out=w10)
  Array Index(array=w9) -> (out0[_]=w11, out1[_]=w12)
  while {
    call "HTTP Wait On Listener.gvi"(http listener reference=w11, error in=w5) -> (http connection reference=w13, error out=w14, method=w15)
    case (w15) {
      frame "POST" {
        call "HTTP Read Request Body String.gvi"(http connection reference in=w13, error in=w14) -> (http connection reference out=w16, body=w17, error out=w18)
        call "KV Monotonic ULID.gvi"(error in=w18) -> (monotonic ulid=w19, error out=w20)
        Build Array("messages", w19) -> w21
        call "KV Set String.gvi"(kv reference in=w4, key=w21, value=w17, error in=w20) -> (error out=w22)
        call "HTTP Write Response.gvi"(http connection reference=w16, body="saved", error in=w22) -> (error out=w23)
        call "Simple Log Error.gvi"(error In=w23)
      }
      frame "DELETE" {
        Build Array("messages") -> w24
        call "KV List String.gvi"(kv reference in=w4, key=w24, error in=w14) -> (kv reference out=w25, kv entries=w26, error out=w27)
        s1 = w27  # shift register
        for {
          w28 = each element of w26
          Property Node(instance in=w28) -> ("key"=w29)
          call "KV Delete.gvi"(kv reference in=w25, key=w29, error in=s1) -> (error out=w30)
          next s1 = w30
        }
        call "HTTP Write Response.gvi"(http connection reference=w13, body="cleared", error in=s1) -> (error out=w31)
        call "Simple Log Error.gvi"(error In=w31)
      }
      frame Default {
        call "Simple Log Error.gvi"(error In=w14)
      }
      frame "GET" {
        Build Array("messages") -> w32
        call "KV List String.gvi"(kv reference in=w4, key=w32, error in=w14, limit=20, reverse=TRUE) -> (kv entries=w33, error out=w34)
        for {
          w35 = each element of w33
          Property Node(instance in=w35) -> ("value"=w37)
          append w37 to w36
        }
        Flatten To Json(anything=w36, error in (no error)=w34) -> (JSON string=w38, error out=w39)
        call "HTTP Write Response.gvi"(http connection reference=w13, body=w38, error in=w39) -> (error out=w40)
        call "Simple Log Error.gvi"(error In=w40)
      }
    }
    stop if FALSE
  }
  call "Current Working Directory Get.gvi"() -> (current working directory url=w41)
  call "URL Build Relative Path.gvi"(base url (window location)=w41, relative url="./Builds/ChatClient_Default Web Server/") -> (url=w42)
  call "HTTP Serve Files.gvi"(http listener reference=w12, root path url=w42, error in=w10) -> (error out=w43)
  call "Simple Log Error.gvi"(error In=w43)
