vi "main.gviweb"   [G Web Development Software 22.3.0]
uses:
  DenoHTTP::Simple URL Pattern.gvi
  DenoHTTP::HTTP Create Listeners.gvi
  DenoHTTP::HTTP Wait On Listener.gvi
  URL::URL::URL Parameters::URL Get Search Parameter.gvi
  Deno::Support::Deno.jsli::EnvGet
  WebApp::Support::Upload File.gvi
  DenoHTTP::HTTP Write Response.gvi
  WebApp::Support::Simple Log Error.gvi
  WebApp::Support::WebSocket Echo Test.gvi
  WebApp::Support::Update Tag.gvi
  Deno::Support::Deno.jsli::CwdGet
  URL::URL::URL Build Relative Path.gvi
  DenoHTTP::HTTP Serve Files.gvi
diagram:
  call "Simple URL Pattern.gvi"(pathname="/api/systemlinkfile") -> (url pattern=w1)
  call "Simple URL Pattern.gvi"(pathname="/websocket") -> (url pattern=w2)
  call "Simple URL Pattern.gvi"() -> (url pattern=w3)
  call "Simple URL Pattern.gvi"(pathname="/api/systemlink") -> (url pattern=w4)
  Build Array(w1, w2, w4, w3) -> w5
  call "HTTP Create Listeners.gvi"(url patterns=w5) -> (http listener references=w6, error out=w7)
  Array Index(array=w6) -> (out0[_]=w8, out1[_]=w9, out2[_]=w10, out3[_]=w11)
  while {
    call "HTTP Wait On Listener.gvi"(http listener reference=w8, error in=w7) -> (http connection reference=w12, url=w13, error out=w14)
    call "URL Get Search Parameter.gvi"(url=w13, key="file-value", error in=w14) -> (value=w15, error out=w16)
    call "EnvGet"(name="deno-sl-cloud-key") -> (value=w17, error out=w18)
    case (w18) {
      frame Error, Default {
        Concatenate Strings("file update skipped for value:", w15) -> w20
        w19 = w16
      }
      frame No Error {
        call "Upload File.gvi"(api key=w17, value=w15, error in=w16) -> (error out=w19)
        Concatenate Strings("file made for value:", w15) -> w20
      }
    }
    call "HTTP Write Response.gvi"(http connection reference=w12, body=w20, error in=w19) -> (error out=w21)
    call "Simple Log Error.gvi"(error In=w21)
    stop if FALSE
  }
  while (iteration -> i1) {
    call "HTTP Wait On Listener.gvi"(http listener reference=w9, error in=w7) -> (http connection reference=w22, error out=w23)
    call "WebSocket Echo Test.gvi"(error in=w23) -> (error out=w24)
    Format Into String(formatString="done iteration %d", errIn=w24, i1) -> (outString=w25, errOut=w26)
    call "HTTP Write Response.gvi"(http connection reference=w22, body=w25, error in=w26) -> (error out=w27)
    call "Simple Log Error.gvi"(error In=w27)
    stop if FALSE
  }
  while {
    call "HTTP Wait On Listener.gvi"(http listener reference=w10, error in=w7) -> (http connection reference=w28, url=w29, error out=w30)
    call "URL Get Search Parameter.gvi"(url=w29, key="tag-value", error in=w30) -> (value=w31, error out=w32)
    call "EnvGet"(name="deno-sl-cloud-key") -> (value=w33, error out=w34)
    case (w34) {
      frame Error, Default {
        Concatenate Strings("tag update skipped value:", w31) -> w36
        w35 = w32
      }
      frame No Error {
        call "Update Tag.gvi"(api key=w33, value=w31, error in=w32) -> (error out=w35)
        Concatenate Strings("updated tag value:", w31) -> w36
      }
    }
    call "HTTP Write Response.gvi"(http connection reference=w28, body=w36, error in=w35) -> (error out=w37)
    call "Simple Log Error.gvi"(error In=w37)
    stop if FALSE
  }
  # Expect to run from root of Deno project.
  # So paths relative to that location.
  call "CwdGet"() -> (return=w38)
  call "URL Build Relative Path.gvi"(base url (window location)=w38, relative url="./Builds/SimpleClient_Default Web Server/") -> (url=w39)
  call "HTTP Serve Files.gvi"(http listener reference=w11, root path url=w39, error in=w7) -> (error out=w40)
  call "Simple Log Error.gvi"(error In=w40)
