vi "environment variable.test.gviweb"   [G Web Development Software 22.3.0]
uses:
  Deno::Environment Variable Get.gvi
  NI::G Core::Operating System::Write to System Log.gvi
diagram:
  call "Environment Variable Get.gvi"(name="TEMP") -> (value=w1, error out=w2)
  Concatenate Strings("[variable]", "TEMP", "[value]", w1) -> w3
  call "Write to System Log.gvi"(message=w3, error in=w2)
