vi "simple.test.gviweb"   [G Web Development Software 22.3.0]
uses:
  DenoKV::KV Open.gvi
  NI::G Core::Operating System::Write to System Log.gvi
  DenoKV::KV Set String.gvi
  DenoKV::KV Get String.gvi
  DenoKV::KV Close.gvi
diagram:
  call "KV Open.gvi"(path url=":memory:") -> (kv reference=w1, error out=w2)
  call "Write to System Log.gvi"(message="writing kv", error in=w2) -> (error out=w3)
  call "KV Set String.gvi"(kv reference in=w1, key=["test", "simple"], value="my value", error in=w3) -> (kv reference out=w4, error out=w5)
  call "Write to System Log.gvi"(message="read kv", error in=w5) -> (error out=w6)
  call "KV Get String.gvi"(kv reference in=w4, key=["test", "simple"], error in=w6) -> (kv reference out=w7, value=w8, error out=w9)
  Concatenate Strings("key result:", w8) -> w10
  call "Write to System Log.gvi"(message=w10, error in=w9) -> (error out=w11)
  call "KV Close.gvi"(kv reference=w7, error in=w11)
