vi "file.test.gviweb"   [G Web Development Software 22.3.0]
uses:
  SmokeTests::Automated::SystemLink Data APIs::Support::Open Test Configuration.gvi
  NI::G Core::Operating System::Write to System Log.gvi
  SystemLinkFileExtensions::Send File::Send File Ext (Buffer).gvi
  NI::Skyline::Configuration::Close Configuration.gvi
diagram:
  call "Open Test Configuration.gvi"() -> (configuration=w1, error out=w2)
  Get Current Time() -> (current time=w3)
  Format Into String(formatString="mraj-deno-test-%T.txt", w3) -> w4
  Concatenate Strings("writing file name:", w4, "value:", "hello world!") -> w5
  call "Write to System Log.gvi"(message=w5, error in=w2) -> (error out=w6)
  call "Send File Ext (Buffer).gvi"(data="hello world!", file name=w4, error in=w6, configuration=w1) -> (error out=w7)
  call "Close Configuration.gvi"(configuration=w1, error in=w7)
