vi "tag.test.gviweb"   [G Web Development Software 22.3.0]
uses:
  SmokeTests::Automated::SystemLink Data APIs::Support::Open Test Configuration.gvi
  NI::G Core::Operating System::Write to System Log.gvi
  NI::Skyline::TagHTTP::Open Tag.gvi
  NI::Skyline::TagHTTP::Write Tag (String).gvi
  NI::Skyline::Configuration::Close Configuration.gvi
diagram:
  call "Open Test Configuration.gvi"() -> (configuration=w1, error out=w2)
  Get Current Time() -> (current time=w3)
  Format Into String(formatString="new tag %T", w3) -> w4
  Concatenate Strings("writing string tag:", "mraj/test/deno-deploy-string", "value:", w4) -> w5
  call "Write to System Log.gvi"(message=w5, error in=w2) -> (error out=w6)
  call "Open Tag.gvi"(path="mraj/test/deno-deploy-string", data type="String", error in=w6, configuration=w1) -> (tag=w7, error out=w8)
  call "Write Tag (String).gvi"(tag in=w7, value=w4, error in=w8) -> (error out=w9)
  call "Close Configuration.gvi"(configuration=w1, error in=w9)
