vi "current working directory.test.gviweb"   [G Web Development Software 22.3.0]
uses:
  Deno::Current Working Directory Get.gvi
  NI::G Core::Operating System::Write to System Log.gvi
diagram:
  call "Current Working Directory Get.gvi"() -> (current working directory url=w1, error out=w2)
  call "Write to System Log.gvi"(message=w1, error in=w2)
