vi "Open Test Configuration.gvi"   [G Web Development Software 22.3.0]
inputs:
  "error in": error
outputs:
  "configuration": "Configuration.gtype"
  "error out": error
types:
  "Client Handle.gtype" = u32
  "Workspace.gtype" = cluster{"id": string, "name": string, "archived?": bool, "default?": bool}
  "Configuration.gtype" = cluster{"Server URL": string, "Session": "Client Handle.gtype", "Raw Session Queue": Queue<"Client Handle.gtype">, "Workspace": "Workspace.gtype"}
uses:
  Deno::Environment Variable Get.gvi
  NI::Skyline::Configuration::Open Configuration API Key.gvi
diagram:
  call "Environment Variable Get.gvi"(name="deno-sl-key", error in=$"error in") -> (value=w1, error out=w2)
  call "Open Configuration API Key.gvi"(server url="https://test-api.lifecyclesolutions.ni.com", api key=w1, error in=w2) -> (configuration=w3, error out=w4)
  $configuration <- w3
  $"error out" <- w4
