vi "echo.test.gviweb"   [G Web Development Software 22.3.0]
uses:
  NI::G Core::Operating System::Write to System Log.gvi
  NI::WebSockets::Open WebSocket.gvi
  NI::WebSockets::Write String.gvi
  NI::WebSockets::Read String.gvi
  NI::WebSockets::Close WebSocket.gvi
diagram:
  Concatenate Strings("Connecting to:", "wss://ws.ifelse.io/") -> w1
  call "Write to System Log.gvi"(message=w1) -> (error out=w2)
  call "Open WebSocket.gvi"(url="wss://ws.ifelse.io/", error in=w2) -> (websocket session out=w3, error out=w4)
  Concatenate Strings("sending:", "[Echo]") -> w5
  call "Write to System Log.gvi"(message=w5, error in=w4) -> (error out=w6)
  call "Write String.gvi"(websocket session in=w3, string message="[Echo]", error in=w6) -> (websocket session out=w7, error out=w8)
  call "Read String.gvi"(websocket session in=w7, timeout=3, error in=w8) -> (websocket session out=w9, string response=w10, error out=w11)
  Concatenate Strings("received:", w10) -> w12
  call "Write to System Log.gvi"(message=w12, error in=w11) -> (error out=w13)
  call "Close WebSocket.gvi"(websocket session in=w9, error in=w13)
