vi "main.gviweb"   [G Web Development Software 22.3.0]
uses:
  SmokeTests::Deno::current working directory.test.gviweb
  SmokeTests::Deno::environment variable.test.gviweb
  SmokeTests::DenoKV::simple.test.gviweb
  SmokeTests::SystemLink Data APIs::file.test.gviweb
  SmokeTests::SystemLink Data APIs::tag.test.gviweb
  SmokeTests::WebSocket::echo.test.gviweb
  NI::G Core::Operating System::Write to System Log.gvi
diagram:
  sequence {
    frame 0 {
      call "current working directory.test.gviweb"()
    }
    frame 1 {
      call "environment variable.test.gviweb"()
    }
    frame 2 {
      call "simple.test.gviweb"()
    }
    frame 3 {
      call "file.test.gviweb"()
    }
    frame 4 {
      call "tag.test.gviweb"()
    }
    frame 5 {
      call "echo.test.gviweb"()
    }
    frame 6 {
      call "Write to System Log.gvi"(message="done")
    }
  }
