vi "Complete Request.gvi"   [G Web Development Software 22.3.0]
inputs:
  "request handler": "NI.JavaScriptReference", required
  "error in": error
  "body": string, required
outputs:
  "error out": error
uses:
  DenoHTTP::Support::DenoHTTP.jsli::HTTPWriteResponse
diagram:
  call "HTTPWriteResponse"(requestHandler=$"request handler", body=$body, error in=$"error in") -> (error out=w1)
  Close Reference(error in=w1, reference=$"request handler") -> (error out=w2)
  $"error out" <- w2
