vi "HTTP Create Listeners.gvi"   [G Web Development Software 22.3.0]
inputs:
  "port": u32 = 8000
  "hostname": string = "0.0.0.0"
  "error in": error
  "url patterns": "url pattern.gtype"[], required
outputs:
  "http listener references": "http listener reference.gtype"[]
  "error out": error
types:
  "http listener reference.gtype" = "NI.JavaScriptReference"
  "url pattern.gtype" = cluster{"hash": string, "hostname": string, "password": string, "pathname": string, "port": string, "protocol": string, "search": string, "username": string}
  T1 = cluster{"urlPatternConfigs": "url pattern.gtype"[], "port": u32, "hostname": string}
uses:
  DenoHTTP::Support::DenoHTTP.jsli::HTTPCreateListeners
diagram:
  Property Node(instance in=T1 {all zero or empty}, "urlPatternConfigs"=$"url patterns", "port"=$port, "hostname"=$hostname) -> (instance out=w1)
  Flatten To Json(anything=w1, error in (no error)=$"error in") -> (JSON string=w2, error out=w3)
  call "HTTPCreateListeners"(urlPatternConfigsJSON=w2, error in=w3) -> (httpListeners=w4, error out=w5)
  $"http listener references" <- w4
  $"error out" <- w5
