vi "HTTP Wait On Listener.gvi"   [G Web Development Software 22.3.0]
inputs:
  "error in": error
  "http listener reference": "http listener reference.gtype", required
outputs:
  "error out": error
  "http connection reference": "http connection reference.gtype"
  "method": string
  "headers": "header.gtype"[]
  "url": string
types:
  "http connection reference.gtype" = "NI.JavaScriptReference"
  "http listener reference.gtype" = "NI.JavaScriptReference"
  "header.gtype" = cluster{"name": string, "value": string}
  "http request.gtype" = cluster{"headers": "header.gtype"[], "method": string, "url": string}
uses:
  DenoHTTP::Support::DenoHTTP.jsli::HTTPWaitOnListener
  DenoHTTP::Support::DenoHTTP.jsli::HttpConnectionGetRequest
diagram:
  call "HTTPWaitOnListener"(httpListener=$"http listener reference", error in=$"error in") -> (httpConnection=w1, error out=w2)
  $"http connection reference" <- w1
  call "HttpConnectionGetRequest"(httpConnection=w1, error in=w2) -> (requestJSON=w3, error out=w4)
  Unflatten From Json(JSON string=w3, error in (no error)=w4, type and defaults="http request.gtype" {all zero or empty}) -> (error out=w5, value=w6)
  Property Node(instance in=w6) -> ("headers"=w7, "method"=w8, "url"=w9)
  $headers <- w7
  $method <- w8
  $url <- w9
  $"error out" <- w5
