vi "HTTP Write Response.gvi"   [G Web Development Software 22.3.0]
inputs:
  "http connection reference": "http connection reference.gtype", required
  "error in": error
  "body": string, required
outputs:
  "error out": error
types:
  "http connection reference.gtype" = "NI.JavaScriptReference"
uses:
  DenoHTTP::Support::DenoHTTP.jsli::HTTPWriteResponse
diagram:
  call "HTTPWriteResponse"(httpConnection=$"http connection reference", body=$body, error in=$"error in") -> (error out=w1)
  Close Reference(error in=w1, reference=$"http connection reference") -> (error out=w2)
  $"error out" <- w2
