vi "Listen for Request.gvi"   [G Web Development Software 22.3.0]
inputs:
  "error in": error
  "request listener": "NI.JavaScriptReference", required
outputs:
  "error out": error
  "request handler": "NI.JavaScriptReference"
  "done?": bool
uses:
  DenoHTTP::Support::DenoHTTP.jsli::HTTPWaitOnListener
diagram:
  call "HTTPWaitOnListener"(requestListener=$"request listener", error in=$"error in") -> (requestHandler=w1, error out=w2)
  Array Index(array=w1) -> (out0[_]=w3)
  $"request handler" <- w3
  Array Size(array=w1) -> (size(s)=w4)
  Is Equal To 0(x=w4) -> w5
  $"done?" <- w5
  $"error out" <- w2
