vi "KV Close.gvi"   [G Web Development Software 22.3.0]
inputs:
  "error in": error
  "kv reference": "kv reference.gtype", required
outputs:
  "error out": error
types:
  "kv reference.gtype" = "NI.JavaScriptReference"
uses:
  DenoKV::Support::DenoKV.jsli::KvClose
diagram:
  call "KvClose"(kv reference=$"kv reference") -> (error out=w1)
  Merge Errors($"error in", w1) -> (error out=w2)
  $"error out" <- w2
