vi "KV Delete.gvi"   [G Web Development Software 22.3.0]
inputs:
  "error in": error
  "kv reference in": "kv reference.gtype", required
  "key": string[], required
outputs:
  "error out": error
  "kv reference out": "kv reference.gtype"
types:
  "kv reference.gtype" = "NI.JavaScriptReference"
uses:
  DenoKV::Support::DenoKV.jsli::KvDelete
diagram:
  $"kv reference out" <- $"kv reference in"
  Flatten To Json(anything=$key, error in (no error)=$"error in") -> (JSON string=w1, error out=w2)
  call "KvDelete"(kvReference=$"kv reference in", keyJSON=w1, error in=w2) -> (error out=w3)
  $"error out" <- w3
