vi "KV Get String.gvi"   [G Web Development Software 22.3.0]
inputs:
  "error in": error
  "kv reference in": "kv reference.gtype", required
  "key": string[], required
outputs:
  "error out": error
  "kv reference out": "kv reference.gtype"
  "value": string
types:
  "kv reference.gtype" = "NI.JavaScriptReference"
uses:
  DenoKV::Support::DenoKV.jsli::KvGetString
diagram:
  $"kv reference out" <- $"kv reference in"
  Flatten To Json(anything=$key, error in (no error)=$"error in") -> (JSON string=w1, error out=w2)
  call "KvGetString"(kv reference=$"kv reference in", keyJSON=w1, error in=w2) -> (value=w3, error out=w4)
  $value <- w3
  $"error out" <- w4
