vi "KV Set String.gvi"   [G Web Development Software 22.3.0]
inputs:
  "error in": error
  "kv reference in": "kv reference.gtype", required
  "key": string[], required
  "value": string, required
outputs:
  "error out": error
  "kv reference out": "kv reference.gtype"
types:
  "kv reference.gtype" = "NI.JavaScriptReference"
uses:
  DenoKV::Support::DenoKV.jsli::KvSetString
diagram:
  $"kv reference out" <- $"kv reference in"
  Flatten To Json(anything=$key, error in (no error)=$"error in") -> (JSON string=w1, error out=w2)
  call "KvSetString"(kv reference=$"kv reference in", keyJSON=w1, value=$value, error in=w2) -> (error out=w3)
  $"error out" <- w3
