vi "Update Tag.gvi"   [G Web Development Software 22.3.0]
inputs:
  "error in": error
  "value": string, required
  "api key": string, required
outputs:
  "error out": error
uses:
  NI::Skyline::Configuration::Open Configuration API Key.gvi
  NI::Skyline::TagHTTP::Open Tag.gvi
  NI::Skyline::TagHTTP::Configure Retention (Count).gvi
  NI::Skyline::TagHTTP::Write Tag (String).gvi
  NI::Skyline::Configuration::Close Configuration.gvi
diagram:
  call "Open Configuration API Key.gvi"(server url="https://test-api.lifecyclesolutions.ni.com", api key=$"api key", error in=$"error in") -> (configuration=w1, error out=w2)
  call "Open Tag.gvi"(path="mraj/test/deno-deploy-string", data type="String", error in=w2, configuration=w1) -> (tag=w3, error out=w4)
  call "Configure Retention (Count).gvi"(tag in=w3, maximum count=10000, error in=w4) -> (tag out=w5, error out=w6)
  call "Write Tag (String).gvi"(tag in=w5, value=$value, error in=w6) -> (error out=w7)
  call "Close Configuration.gvi"(configuration=w1, error in=w7) -> (error out=w8)
  $"error out" <- w8
