vi "WebSocket Echo Test.gvi"   [G Web Development Software 22.3.0]
inputs:
  "error in": error
outputs:
  "error out": error
uses:
  NI::WebSockets::Open WebSocket.gvi
  NI::WebSockets::Write String.gvi
  NI::WebSockets::Read String.gvi
  NI::WebSockets::Close WebSocket.gvi
diagram:
  call "Open WebSocket.gvi"(url="wss://ws.ifelse.io/", error in=$"error in") -> (websocket session out=w1, error out=w2)
  call "Write String.gvi"(websocket session in=w1, string message="[Echo]", error in=w2) -> (websocket session out=w3, error out=w4)
  s1 = w4  # shift register
  s2 = w3  # shift register
  while {
    call "Read String.gvi"(websocket session in=s2, timeout=3, error in=s1) -> (websocket session out=w5, string response=w6, error out=w7)
    Search Or Split String(search string/char="[Echo]", string=w6) -> (offset of match=w8)
    Is Greater Or Equal To 0(x=w8) -> w9
    Logical Or(w7, w9) -> w10
    next s1 = w7
    next s2 = w5
    stop if w10
  }
  call "Close WebSocket.gvi"(websocket session in=s2, error in=s1) -> (error out=w11)
  $"error out" <- w11
