vi "main.test.gviweb"   [G Web Development Software 22.3.0]
uses:
  Deno::Support::Deno.jsli::CwdGet
  URL::URL::URL Build Relative Path.gvi
  NI::G Core::Operating System::Write to System Log.gvi
diagram:
  call "CwdGet"() -> (return=w1)
  call "URL Build Relative Path.gvi"(base url (window location)=w1, relative url="../") -> (url=w2)
  call "Write to System Log.gvi"(message=w2)
