vi "main.gviweb"   [G Web Development Software 22.3.0]
uses:
  DenoHTTP::Create URL Pattern.gvi
  DenoHTTP::Support::DenoHTTP.jsli::StartServer
  DenoHTTP::Listen for Request.gvi
  DenoHTTP::Support::DenoHTTP.jsli::RequestUrl
  URL::URL::URL Parameters::URL Get Search Parameter.gvi
  Deno::Support::Deno.jsli::Deno env get
  WebApp::Support::Upload File.gvi
  DenoHTTP::Complete Request.gvi
  WebApp::Support::Simple Log Error.gvi
  WebApp::Support::WebSocket Echo Test.gvi
  WebApp::Support::Update Tag.gvi
  Deno::Support::Deno.jsli::GetWebAppRoot
  URL::URL::URL Build Relative Path.gvi
  DenoHTTP::Support::DenoHTTP.jsli::ServeFileRequests
diagram:
  call "Create URL Pattern.gvi"(pathname="/api/systemlinkfile") -> (url pattern=w1)
  call "Create URL Pattern.gvi"(pathname="/websocket") -> (url pattern=w2)
  call "Create URL Pattern.gvi"(pathname="/api/systemlink") -> (url pattern=w3)
  call "Create URL Pattern.gvi"(pathname="*") -> (url pattern=w4)
  Build Array(w1, w2, w3, w4) -> w5
  Flatten To Json(anything=w5) -> (JSON string=w6, error out=w7)
  call "StartServer"(urlPatternConfigsJSON=w6, error in=w7) -> (requestListeners=w8, error out=w9)
  Array Index(array=w8) -> (out0[_]=w10, out1[_]=w11, out2[_]=w12, out3[_]=w13)
  while {
    call "Listen for Request.gvi"(request listener=w10, error in=w9) -> (request handler=w14, error out=w15)
    call "RequestUrl"(requestHandler=w14, error in=w15) -> (url=w16, error out=w17)
    call "URL Get Search Parameter.gvi"(url=w16, key="file-value", error in=w17) -> (value=w18, error out=w19)
    call "Deno env get"(arg="deno-sl-cloud-key") -> (return=w20, error out=w21)
    case (w21) {
      frame Error, Default {
        Concatenate Strings("file update skipped for value:", w18) -> w23
        w22 = w19
      }
      frame No Error {
        call "Upload File.gvi"(api key=w20, value=w18, error in=w19) -> (error out=w22)
        Concatenate Strings("file made for value:", w18) -> w23
      }
    }
    call "Complete Request.gvi"(request handler=w14, body=w23, error in=w22) -> (error out=w24)
    call "Simple Log Error.gvi"(error In=w24)
    stop if FALSE
  }
  while (iteration -> i1) {
    call "Listen for Request.gvi"(request listener=w11, error in=w9) -> (request handler=w25, error out=w26)
    call "WebSocket Echo Test.gvi"(error in=w26) -> (error out=w27)
    Format Into String(formatString="done iteration %d", errIn=w27, i1) -> (outString=w28, errOut=w29)
    call "Complete Request.gvi"(request handler=w25, body=w28, error in=w29) -> (error out=w30)
    call "Simple Log Error.gvi"(error In=w30)
    stop if FALSE
  }
  while {
    call "Listen for Request.gvi"(request listener=w12, error in=w9) -> (request handler=w31, error out=w32)
    call "RequestUrl"(requestHandler=w31, error in=w32) -> (url=w33, error out=w34)
    call "URL Get Search Parameter.gvi"(url=w33, key="tag-value", error in=w34) -> (value=w35, error out=w36)
    call "Deno env get"(arg="deno-sl-cloud-key") -> (return=w37, error out=w38)
    case (w38) {
      frame Error, Default {
        Concatenate Strings("tag update skipped value:", w35) -> w40
        w39 = w36
      }
      frame No Error {
        call "Update Tag.gvi"(api key=w37, value=w35, error in=w36) -> (error out=w39)
        Concatenate Strings("updated tag value:", w35) -> w40
      }
    }
    call "Complete Request.gvi"(request handler=w31, body=w40, error in=w39) -> (error out=w41)
    call "Simple Log Error.gvi"(error In=w41)
    stop if FALSE
  }
  call "GetWebAppRoot"() -> (return=w42)
  call "URL Build Relative Path.gvi"(base url (window location)=w42, relative url="../Client_Default Web Server/") -> (url=w43)
  call "ServeFileRequests"(requestListener=w13, serveRootUrl=w43, error in=w9) -> (error out=w44)
  call "Simple Log Error.gvi"(error In=w44)
