vi "index.gviweb"   [G Web Development Software 22.3.0]
panel controls:
  "Tag Value": string
  "update tag": bool
  "websocket test": bool
panel indicators:
  "loop iteration": i32
  "tag update response": string
  "websocket test response": string
uses:
  URL::URL::URL Build Relative Path.gvi
  URL::URL::URL Parameters::URL Set Search Parameter.gvi
  NI::HTTP::GET.gvi
  WebApp::Support::Simple Display Error.gvi
diagram:
  while {
    event {
      on "update tag" Value changed {
        call "URL Build Relative Path.gvi"(relative url="/api/systemlink") -> (url=w1, error out=w2)
        call "URL Set Search Parameter.gvi"(url=w1, key="tag-value", value=$"Tag Value", error in=w2) -> (updated url=w3, error out=w4)
        call "GET.gvi"(url=w3, error in=w4) -> (body=w5, error out=w6)
        $"tag update response" <- w5
        call "Simple Display Error.gvi"(error In=w6)
      }
      on "websocket test" Value changed {
        call "GET.gvi"(url="/websocket") -> (body=w7)
        $"websocket test response" <- w7
      }
    }
    stop if FALSE
  }
  while (iteration -> i1) {
    Wait(time to wait=100)
    $"loop iteration" <- i1
    stop if FALSE
  }
