vi "main.gviweb"   [G Web Development Software 22.3.0]
uses:
  NI::G Core::Operating System::Write to System Log.gvi
  NI::WebSockets::Open WebSocket.gvi
  NI::WebSockets::Write String.gvi
  NI::WebSockets::Read String.gvi
  NI::WebSockets::Close WebSocket.gvi
  URL::URL::Advanced::URL Parts::URL Get Parts.gvi
  DenoHTTP::Create URL Pattern.gvi
  DenoHTTP::Support::DenoHTTP.jsli::StartServer
  DenoHTTP::Support::DenoHTTP.jsli::ListenForRequest
  Deno::Support::Deno.jsli::Deno env get
  NI::Skyline::Configuration::Open Configuration API Key.gvi
  NI::Skyline::TagHTTP::Open Tag.gvi
  NI::Skyline::TagHTTP::Write Tag (Timestamp).gvi
  NI::Skyline::Configuration::Close Configuration.gvi
  DenoHTTP::Support::DenoHTTP.jsli::CompleteRequest
  DenoHTTP::Support::DenoHTTP.jsli::ServeDirRequest
diagram:
  Concatenate Strings("Opening websocket echo server connection to: ", "wss://ws.ifelse.io/") -> w1
  call "Write to System Log.gvi"(message="hello world!") -> (error out=w2)
  call "Write to System Log.gvi"(message=w1, error in=w2) -> (error out=w3)
  call "Open WebSocket.gvi"(url="wss://ws.ifelse.io/", error in=w3) -> (websocket session out=w4, error out=w5)
  call "Write String.gvi"(websocket session in=w4, string message="[Echo]", error in=w5) -> (websocket session out=w6, error out=w7)
  s1 = w7  # shift register
  s2 = w6  # shift register
  while {
    call "Read String.gvi"(websocket session in=s2, timeout=3, error in=s1) -> (websocket session out=w8, string response=w9, error out=w10)
    call "Write to System Log.gvi"(message=w9, error in=w10) -> (error out=w11)
    Search Or Split String(search string/char="[Echo]", string=w9) -> (offset of match=w12)
    Is Greater Or Equal To 0(x=w12) -> w13
    Logical Or(w11, w13) -> w14
    next s1 = w11
    next s2 = w8
    stop if w14
  }
  call "Close WebSocket.gvi"(websocket session in=s2, error in=s1) -> (error out=w15)
  call "Write to System Log.gvi"(message="Finished WebSocket connection.", error in=w15)
  call "URL Get Parts.gvi"(url="http://www.google.com") -> (url parts=w16)
  Property Node(instance in=w16) -> ("href"=w17)
  call "Write to System Log.gvi"(message=w17)
  call "Create URL Pattern.gvi"(pathname="/api/systemlink") -> (url pattern=w18)
  call "Create URL Pattern.gvi"() -> (url pattern=w19)
  Build Array(w18, w19) -> w20
  Flatten To Json(anything=w20) -> (JSON string=w21, error out=w22)
  call "StartServer"(urlPatternConfigsJSON=w21, error in=w22) -> (requestListeners=w23, error out=w24)
  Array Index(array=w23) -> (out0[_]=w25, out1[_]=w26)
  s3 = uninitialised  # shift register
  while {
    call "ListenForRequest"(requestListener=w25, error in=s3) -> (requestHandler=w27, error out=w28)
    Array Index(array=w27) -> (out0[_]=w29)
    call "Deno env get"(arg="deno-sl-cloud-key", error in=w28) -> (return=w30, error out=w31)
    case (w31) {
      frame Error, Default {
        w32 = "skipping tag"
      }
      frame No Error {
        call "Open Configuration API Key.gvi"(server url="https://api.systemlinkcloud.com", api key=w30) -> (configuration=w33, error out=w34)
        call "Open Tag.gvi"(path="deno-deploy-last-modified", data type="Timestamp", error in=w34, configuration=w33) -> (tag=w35, error out=w36)
        Get Current Time() -> (current time=w37)
        call "Write Tag (Timestamp).gvi"(tag in=w35, value=w37, error in=w36) -> (error out=w38)
        call "Close Configuration.gvi"(configuration=w33, error in=w38)
        w32 = "writing tag"
      }
    }
    call "CompleteRequest"(requestHandler=w29, body=w32, error in=w28) -> (error out=w39)
    Close Reference(error in=w39, reference=w29) -> (error out=w40)
    next s3 = w40
    stop if w40
  }
  s4 = w24  # shift register
  while {
    call "ListenForRequest"(requestListener=w26, error in=s4) -> (requestHandler=w41, error out=w42)
    Array Index(array=w41) -> (out0[_]=w43)
    call "ServeDirRequest"(requestHandler=w43, error in=w42) -> (error out=w44)
    Close Reference(error in=w44, reference=w43) -> (error out=w45)
    next s4 = w45
    stop if w45
  }
