vi "Create EChart.gvi"   [G Web Development Software 22.3.0]
inputs:
  "container": "HtmlContainer reference", required
  "error in": error
outputs:
  "error out": error
  "echart reference": "echart reference.gtype"
types:
  "echart reference.gtype" = "NI.JavaScriptReference"
uses:
  ECharts::Shared Options::Set Animation Options.gvi
  ECharts::Shared Options::Set Color Options.gvi
  ECharts::Shared Options::Set Text Style Options.gvi
  ECharts::Support::ECharts.jsli::CreateEChart
  ECharts::Core::Update EChart Options.gvi
diagram:
  w1 = [4286191129, 4278882018, 4292982147, 4290161445, 4289584110, 4288645807, 4286479998, 4282058533]
  call "Set Animation Options.gvi"(animation?=FALSE) -> (echart options out=w2)
  call "Set Color Options.gvi"(echart options in=w2, color=w1) -> (echart options out=w3)
  # Create the echart and set defaults. This will disable animations by default, use an NXG color palette, and NXG default fonts.
  call "Set Text Style Options.gvi"(echart options in=w3, color=4281020467, font family="Segoe UI", font size=9) -> (echart options out=w4)
  Obtain JavaScript Reference(reference in=$container, error in=$"error in") -> (error out=w5, javascript reference out=w6)
  call "CreateEChart"(container=w6, error in=w5) -> (echart=w7, error out=w8)
  call "Update EChart Options.gvi"(echart reference in=w7, echart options=w4, error in=w8) -> (echart reference out=w9, error out=w10)
  $"echart reference" <- w9
  $"error out" <- w10
