vi "Update EChart Options.gvi"   [LabVIEW NXG 5.0.0]
inputs:
  "echart reference in": "echart reference.gtype", required
  "echart options": "echart options.gtype", required
  "error in": error
outputs:
  "error out": error
  "echart reference out": "echart reference.gtype"
types:
  "echart reference.gtype" = "NI.JavaScriptReference"
  "option.gtype" = cluster{"path": string[], "propertiesJSON": string}
  "echart options.gtype" = "option.gtype"[]
uses:
  ECharts::Support::ECharts.jsli::UpdateEChart
diagram:
  $"echart reference out" <- $"echart reference in"
  Flatten To Json(anything=$"echart options") -> (JSON string=w1)
  call "UpdateEChart"(echart=$"echart reference in", optionsArrayJSON=w1, error in=$"error in") -> (error out=w2)
  $"error out" <- w2
