vi "Append Gauge Series Options.gvi"   [LabVIEW NXG 5.0.0]
inputs:
  "echart options in": "echart options.gtype"
  "data": f64, required
outputs:
  "echart options out": "echart options.gtype"
types:
  "option.gtype" = cluster{"path": string[], "propertiesJSON": string}
  "echart options.gtype" = "option.gtype"[]
  T1 = cluster{"series": cluster{"type": string, "data": f64[]}}
  T2 = cluster{"axisLine": cluster{"lineStyle": cluster{"color": f64[][]}}}
uses:
  ECharts::Support::Append Option.gvi
diagram:
  Build Array($data) -> w1
  Property Node(instance in=T1 {"series"={"type"="gauge", "data"=[]}}, "series:data"=w1) -> (instance out=w2)
  Flatten To Json(anything=w2) -> (JSON string=w3)
  call "Append Option.gvi"(echart options in=$"echart options in", propertiesJSON=w3) -> (echart options out=w4)
  # axisLine: {            // 坐标轴线
  #                 lineStyle: {       // 属性lineStyle控制线条样式
  #                     color: [[0.09, 'lime'],[0.82, '#1e90ff'],[1, '#ff4500']],
  #                     width: 3,
  #                     shadowColor : '#fff', //默认透明
  #                     shadowBlur: 10
  #                 }
  #             },
  w5 = cluster{"series": T2} {"series"={"axisLine"={"lineStyle"={"color"=[[0.5]]}}}}
  Flatten To Json(anything=w5) -> (JSON string=w6)
  call "Append Option.gvi"(echart options in=w4, propertiesJSON=w6) -> (echart options out=w7)
  Flatten To Json(anything=["lime"]) -> (JSON string=w8)
  call "Append Option.gvi"(echart options in=w7, path=["series", "axisLine", "lineStyle", "color", ":end"], propertiesJSON=w8) -> (echart options out=w9)
  w10 = [[1]]  # color
  Flatten To Json(anything=w10) -> (JSON string=w11)
  call "Append Option.gvi"(echart options in=w9, path=["series", "axisLine", "lineStyle", "color"], propertiesJSON=w11) -> (echart options out=w12)
  Flatten To Json(anything=["red"]) -> (JSON string=w13)
  call "Append Option.gvi"(echart options in=w12, path=["series", "axisLine", "lineStyle", "color", ":end"], propertiesJSON=w13) -> (echart options out=w14)
  $"echart options out" <- w14
