vi "Add Pie Series Options.gvi"   [LabVIEW NXG 3.1.0]
inputs:
  "echart options in": "echart options.gtype"
  "data": cluster{"name": string, "value": f64}[], required
outputs:
  "echart options out": "echart options.gtype"
types:
  "option.gtype" = cluster{"name": string, "propertiesJSON": string}
  "echart options.gtype" = "option.gtype"[]
  T1 = cluster{"data": cluster{"name": string, "value": f64}[], "type": string}
diagram:
  Property Node(instance in=T1 {"data"=[], "type"="pie"}, "data"=$data) -> (instance out=w1)
  Flatten To JSON(anything=w1) -> (JSON string=w2)
  Property Node(instance in="option.gtype" {"name"="series", "propertiesJSON"=""}, "propertiesJSON"=w2) -> (instance out=w3)
  Build Array($"echart options in", w3) -> w4
  $"echart options out" <- w4
