vi "Append Pie Series Options.gvi"   [LabVIEW NXG 3.1.0]
inputs:
  "echart options in": "echart options.gtype"
  "data": cluster{"name": string, "value": f64}[], required
outputs:
  "echart options out": "echart options.gtype"
types:
  "option.gtype" = cluster{"path": string[], "propertiesJSON": string}
  "echart options.gtype" = "option.gtype"[]
  T1 = cluster{"data": cluster{"name": string, "value": f64}[], "type": string}
uses:
  ECharts::Support::Append Option.gvi
diagram:
  Property Node(instance in=cluster{"series": T1} {"series"={"data"=[], "type"="pie"}}, "series:data"=$data) -> (instance out=w1)
  # https://ecomfe.github.io/echarts-doc/public/en/option.html#series-pie
  Flatten To JSON(anything=w1) -> (JSON string=w2)
  call "Append Option.gvi"(echart options in=$"echart options in", propertiesJSON=w2) -> (echart options out=w3)
  $"echart options out" <- w3
