vi "Set Axis 3D.gvi"   [LabVIEW NXG 3.1.0]
inputs:
  "echart options in": "echart options.gtype"
  "axis 3d": "axis 3d.gtype" = "x", required
  "type": "axis 3d type.gtype" = "value"
outputs:
  "echart options out": "echart options.gtype"
types:
  "option.gtype" = cluster{"path": string[], "propertiesJSON": string}
  "echart options.gtype" = "option.gtype"[]
  "axis 3d.gtype" = enum{"x", "y", "z"}
  "axis 3d type.gtype" = enum{"value", "category", "time", "log"}
uses:
  ECharts::Support::Append Option.gvi
diagram:
  Format Into String($type) -> w1
  # https://ecomfe.github.io/echarts-doc/public/cn/option-gl.html#yAxis3D
  # https://ecomfe.github.io/echarts-doc/public/cn/option-gl.html#zAxis3D
  case ($"axis 3d") {
    frame "x" {
      w3 = cluster{"xAxis3D": cluster{"type": string}} {all zero or empty}
      Property Node(instance in=w3, "xAxis3D:type"=w1) -> (instance out=w4)
      Flatten To JSON(anything=w4) -> (JSON string=w2)
    }
    frame "y" {
      w5 = cluster{"yAxis3D": cluster{"type": string}} {all zero or empty}
      Property Node(instance in=w5, "yAxis3D:type"=w1) -> (instance out=w6)
      Flatten To JSON(anything=w6) -> (JSON string=w2)
    }
    frame "z" {
      w7 = cluster{"zAxis3D": cluster{"type": string}} {all zero or empty}
      Property Node(instance in=w7, "zAxis3D:type"=w1) -> (instance out=w8)
      Flatten To JSON(anything=w8) -> (JSON string=w2)
    }
  }
  # https://ecomfe.github.io/echarts-doc/public/cn/option-gl.html#xAxis3D
  call "Append Option.gvi"(echart options in=$"echart options in", propertiesJSON=w2) -> (echart options out=w9)
  $"echart options out" <- w9
