vi "Set Grid 3D.gvi"   [LabVIEW NXG 3.1.0]
inputs:
  "echart options in": "echart options.gtype"
  "projection": "projection.gtype" = "orthographic"
outputs:
  "echart options out": "echart options.gtype"
types:
  "option.gtype" = cluster{"path": string[], "propertiesJSON": string}
  "echart options.gtype" = "option.gtype"[]
  "projection.gtype" = enum{"orthographic", "perspective"}
  T1 = cluster{"viewControl": cluster{"projection": string}}
uses:
  ECharts::Support::Append Option.gvi
diagram:
  Format Into String($projection) -> w1
  Property Node(instance in=cluster{"grid3D": T1} {all zero or empty}, "grid3D:viewControl:projection"=w1) -> (instance out=w2)
  Flatten To JSON(anything=w2) -> (JSON string=w3)
  call "Append Option.gvi"(echart options in=$"echart options in", propertiesJSON=w3) -> (echart options out=w4)
  # https://ecomfe.github.io/echarts-doc/public/cn/option-gl.html#grid3D
  $"echart options out" <- w4
