vi "Set Animation Options.gvi"   [LabVIEW NXG 3.1.0]
inputs:
  "echart options in": "echart options.gtype"
  "animation?": bool
outputs:
  "echart options out": "echart options.gtype"
types:
  "option.gtype" = cluster{"path": string[], "propertiesJSON": string}
  "echart options.gtype" = "option.gtype"[]
uses:
  ECharts::Support::Append Option.gvi
diagram:
  Property Node(instance in=cluster{"animation": bool} {all zero or empty}, "animation"=$"animation?") -> (instance out=w1)
  Flatten To JSON(anything=w1) -> (JSON string=w2)
  call "Append Option.gvi"(echart options in=$"echart options in", propertiesJSON=w2) -> (echart options out=w3)
  # https://ecomfe.github.io/echarts-doc/public/en/option.html#animation
  $"echart options out" <- w3
