vi "Set Color Options.gvi"   [LabVIEW NXG 3.1.0]
inputs:
  "echart options in": "echart options.gtype"
  "color": "Color.gtype"[]
outputs:
  "echart options out": "echart options.gtype"
types:
  "option.gtype" = cluster{"path": string[], "propertiesJSON": string}
  "echart options.gtype" = "option.gtype"[]
  "Color.gtype" = u32
uses:
  ECharts::Support::Color to CSS rgba.gvi
  ECharts::Support::Append Option.gvi
diagram:
  for {
    w1 = each element of $color
    call "Color to CSS rgba.gvi"(Input=w1) -> (Output=w3)
    append w3 to w2
  }
  Property Node(instance in=cluster{"color": string[]} {all zero or empty}, "color"=w2) -> (instance out=w4)
  Flatten To JSON(anything=w4) -> (JSON string=w5)
  # https://ecomfe.github.io/echarts-doc/public/en/option.html#color
  call "Append Option.gvi"(echart options in=$"echart options in", propertiesJSON=w5) -> (echart options out=w6)
  $"echart options out" <- w6
