vi "Set Text Style Options.gvi"   [LabVIEW NXG 3.1.0]
inputs:
  "color": "Color.gtype" = 4281020467
  "font style": "font style.gtype" = "normal"
  "font weight": "font weight.gtype" = "normal"
  "font family": string = "Segoe UI"
  "font size": u32 = 9
  "text border color": "Color.gtype" = 16777215
  "text border width": u32
  "text shadow color": "Color.gtype" = 16777215
  "text shadow blur": u32
  "text shadow offset x": u32
  "text shadow offset y": u32
  "echart options in": "echart options.gtype"
outputs:
  "echart options out": "echart options.gtype"
types:
  "Color.gtype" = u32
  "font style.gtype" = enum{"normal", "italic", "oblique"}
  "font weight.gtype" = enum{"thin", "extra light", "light", "normal", "medium", "semi bold", "bold", "extra bold", "black"}
  "option.gtype" = cluster{"path": string[], "propertiesJSON": string}
  "echart options.gtype" = "option.gtype"[]
  T1 = cluster{"color": string, "fontStyle": string, "fontWeight": i32, "fontFamily": string, "fontSize": u32, "textBorderColor": string, "textBorderWidth": u32, "textShadowColor": string, "textShadowBlur": u32, "textShadowOffsetX": u32, "textShadowOffsetY": u32}
uses:
  ECharts::Support::Color to CSS rgba.gvi
  ECharts::Support::Append Option.gvi
diagram:
  Format Into String($"font style") -> w1
  To Long Integer(number=$"font weight") -> w2
  Add(w2, 1) -> w3
  Multiply(w3, 100) -> w4
  call "Color to CSS rgba.gvi"(Input=$color) -> (Output=w5)
  call "Color to CSS rgba.gvi"(Input=$"text border color") -> (Output=w6)
  call "Color to CSS rgba.gvi"(Input=$"text shadow color") -> (Output=w7)
  To Double Precision Float(number=$"font size") -> w8
  Multiply(w8, 96) -> w9
  Divide(x=w9, y=72) -> w10
  To Unsigned Long Integer(number=w10) -> w11
  Property Node(instance in=cluster{"textStyle": T1} {all zero or empty}, "textStyle:color"=w5, "textStyle:fontStyle"=w1, "textStyle:fontWeight"=w4, "textStyle:fontFamily"=$"font family", "textStyle:fontSize"=w11, "textStyle:textBorderColor"=w6, "textStyle:textBorderWidth"=$"text border width", "textStyle:textShadowColor"=w7, "textStyle:textShadowBlur"=$"text shadow blur", "textStyle:textShadowOffsetX"=$"text shadow offset x", "textStyle:textShadowOffsetY"=$"text shadow offset y") -> (instance out=w12)
  # https://ecomfe.github.io/echarts-doc/public/en/option.html#textStyle
  Flatten To JSON(anything=w12) -> (JSON string=w13)
  call "Append Option.gvi"(echart options in=$"echart options in", propertiesJSON=w13) -> (echart options out=w14)
  $"echart options out" <- w14
