vi "Append Option.gvi"   [LabVIEW NXG 3.1.0]
inputs:
  "echart options in": "echart options.gtype", required
  "path": string[]
  "propertiesJSON": string, required
outputs:
  "echart options out": "echart options.gtype"
types:
  "option.gtype" = cluster{"path": string[], "propertiesJSON": string}
  "echart options.gtype" = "option.gtype"[]
diagram:
  Property Node(instance in="option.gtype" {all zero or empty}, "path"=$path, "propertiesJSON"=$propertiesJSON) -> (instance out=w1)
  Build Array($"echart options in", w1) -> w2
  $"echart options out" <- w2
