vi "Color to CSS rgba.gvi"   [LabVIEW NXG 3.1.0]
inputs:
  "Input": "Color.gtype"
outputs:
  "Output": string
types:
  "Color.gtype" = u32
uses:
  ECharts::Support::Color to RGBA.gvi
diagram:
  call "Color to RGBA.gvi"(Color Constant=$Input) -> (red=w1, green=w2, blue=w3, alpha=w4)
  Format Into String(formatString="rgba(%d,%d,%d,%d)", w1, w2, w3, w4) -> w5
  $Output <- w5
