vi "Append Surface Series Options.gvi"   [LabVIEW NXG 5.0.0]
inputs:
  "echart options in": "echart options.gtype"
  "data": cluster{"value": f64[]}[], required
outputs:
  "echart options out": "echart options.gtype"
types:
  "option.gtype" = cluster{"path": string[], "propertiesJSON": string}
  "echart options.gtype" = "option.gtype"[]
  T1 = cluster{"type": string, "data": cluster{"value": f64[]}[]}
uses:
  ECharts::Support::Append Option.gvi
diagram:
  w1 = cluster{"series": T1} {"series"={"type"="surface", "data"=[]}}
  Property Node(instance in=w1, "series:data"=$data) -> (instance out=w2)
  # https://ecomfe.github.io/echarts-doc/public/cn/option-gl.html#series-surface
  Flatten To Json(anything=w2) -> (JSON string=w3)
  call "Append Option.gvi"(echart options in=$"echart options in", propertiesJSON=w3) -> (echart options out=w4)
  $"echart options out" <- w4
