vi "Create Pie.gviweb"   [LabVIEW NXG 3.1.0]
inputs:
  "placeholder text": string = "ECharts-webvi-pie", required
  "data": cluster{"Label": string, "Value": f64}[]
  "error in": error
  "plot colors": string[] = ["#7A1619", "#0A8EE2", "#E1B583", " #B6AB25", "#ADDBEE", "#9F8AAF", "#7E7E7E", "#3B0725"]
outputs:
  "pie refnum": i32
  "error out": error
types:
  T1 = cluster{"show": bool, "fontFamily": string, "color": string}
uses:
  WebApp::EChartsSupport::wrapper::ECharts Library Interface.jsli::Create EChart
  WebApp::ECharts Pie API::SubVIs::Set Pie Option.gviweb
diagram:
  w1 = T1 {"show"=TRUE, "fontFamily"="Segoe UI, Frutiger, Frutiger Linotype, Dejavu Sans, Helvetica Neue, Arial, sans-serif", "color"="#2B3033"}
  call "Create EChart"(placeholderText=$"placeholder text", error in=$"error in") -> (echartRefnum=w2, error out=w3)
  call "Set Pie Option.gviweb"(pie refnum=w2, plot colors=$"plot colors", label options=w1, labelLine options=cluster{"show": bool} {all zero or empty}, error in=w3, data=$data) -> (pie refnum out=w4, error out=w5)
  $"pie refnum" <- w4
  $"error out" <- w5
