vi "Format Pie Data.gviweb"   [LabVIEW NXG 3.1.0]
inputs:
  "data": cluster{"Label": string, "Value": f64}[], required
outputs:
  "value properties json": string
diagram:
  for {
    w1 = each element of $data
    Property Node(instance in=w1) -> ("Value"=w3, "Label"=w4)
    Property Node(instance in=cluster{"value": f64, "name": string} {all zero or empty}, "value"=w3, "name"=w4) -> (instance out=w5)
    append w5 to w2
  }
  Flatten To JSON(anything=w2) -> (JSON string=w6)
  $"value properties json" <- w6
