vi "Set Pie Option.gviweb"   [LabVIEW NXG 3.1.0]
inputs:
  "pie refnum": i32
  "data": cluster{"name": string, "value": f64}[]
  "label options": T1 = {"show"=TRUE, "fontFamily"="", "color"="#FF2B3033"}
  "error in": error
  "plot colors": string[] = ["#7A1619", "#0A8EE2", "#E1B583", " #B6AB25", "#ADDBEE", "#9F8AAF", "#7E7E7E", "#3B0725"]
  "labelLine options": cluster{"show": bool} = {"show"=TRUE}
outputs:
  "error out": error
  "pie refnum out": i32
types:
  T1 = cluster{"show": bool, "fontFamily": string, "color": string}
  T2 = cluster{"type": string, "data": cluster{"name": string, "value": f64}[], "color": string[], "label": T1, "labelLine": cluster{"show": bool}}
uses:
  WebApp::EChartsSupport::wrapper::ECharts Library Interface.jsli::Update EChart Options
diagram:
  $"pie refnum out" <- $"pie refnum"
  # Add more information to the option cluster to configure more options on the EChart.
  # Pie series option documentation: https://ecomfe.github.io/echarts-doc/public/en/option.html#series-pie
  w1 = cluster{"series": T2[]} {"series"=[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]}  # option
  Property Node(instance in=w1) -> ("series"=w2, instance out=w3)
  Array Index(array=w2) -> (out0[0]=w4)
  Property Node(instance in=w4, "data"=$data, "color"=$"plot colors", "label"=$"label options", "labelLine"=$"labelLine options") -> (instance out=w5)
  Replace Array Subset(inArray=w2, index=0, new=w5) -> w6
  Property Node(instance in=w3, "series"=w6) -> (instance out=w7)
  Flatten To JSON(anything=w7, error in (no error)=$"error in") -> (JSON string=w8, error out=w9)
  call "Update EChart Options"(echartRefnum=$"pie refnum", optionsJSON=w8, error in=w9) -> (error out=w10)
  $"error out" <- w10
