vi "Update Pie Data.gviweb"   [LabVIEW NXG 3.1.0]
inputs:
  "pie refnum": i32
  "data": cluster{"Label": string, "Value": f64}[] = [{"Label"="Alpha", "Value"=10}, {"Label"="Beta", "Value"=25}, {"Label"="Gamma", "Value"=65}]
  "error in": error
outputs:
  "error out": error
uses:
  WebApp::ECharts Pie API::SubVIs::Format Pie Data.gviweb
  WebApp::EChartsSupport::wrapper::ECharts Library Interface.jsli::Update EChart Data
diagram:
  call "Format Pie Data.gviweb"(data=$data) -> (value properties json=w1)
  call "Update EChart Data"(echartRefnum=$"pie refnum", valuePropertiesJSON=w1, error in=$"error in") -> (error out=w2)
  $"error out" <- w2
