vi "index.gviweb"   [LabVIEW NXG 3.1.0]
panel controls:
  "data": cluster{"Label": string, "Value": f64}[] = [{"Label"="Alpha", "Value"=10}, {"Label"="Beta", "Value"=20}, {"Label"="Gamma", "Value"=40}]
  "More information about ECharts:": string = "https://ecomfe.github.io/echarts-doc/public/en/index.html"
panel indicators:
  "Notes": string
uses:
  WebApp::ECharts Pie API::Create Pie.gviweb
  WebApp::ECharts Pie API::Update Pie Data.gviweb
diagram:
  call "Create Pie.gviweb"(placeholder text="ECharts-webvi-pie placeholder", data=$data) -> (pie refnum=w1, error out=w2)
  while (after w2) {
    event {
      on "data" Value changed {
        Event Data() -> ("New Value"=w3)
        call "Update Pie Data.gviweb"(pie refnum=w1, data=w3)
      }
    }
    stop if FALSE
  }
