vi "Function.gviweb"   [LabVIEW NXG 3.1.0]
panel indicators:
  "JSON string": string
uses:
  WebApp::Generate Surface Data.gvi
diagram:
  call "Generate Surface Data.gvi"() -> (Output=w1)
  Flatten To JSON(anything=w1) -> (JSON string=w2)
  $"JSON string" <- w2
