vi "Generate Pie Data.gvi"   [LabVIEW NXG 3.1.0]
outputs:
  "pie data": cluster{"name": string, "value": f64}[]
diagram:
  Random Number() -> (number (0 to 1)=w1)
  w2 = cluster{"name": string, "value": f64} {"name"="sansa", "value"=0}
  Property Node(instance in=w2, "value"=w1) -> (instance out=w3)
  w4 = cluster{"name": string, "value": f64} {"name"="arya", "value"=0}
  Random Number() -> (number (0 to 1)=w5)
  Property Node(instance in=w4, "value"=w5) -> (instance out=w6)
  w7 = cluster{"name": string, "value": f64} {"name"="jon", "value"=0}
  Random Number() -> (number (0 to 1)=w8)
  Property Node(instance in=w7, "value"=w8) -> (instance out=w9)
  Build Array(w6, w9, w3) -> w10
  $"pie data" <- w10
