vi "Generate Surface Data.gvi"   [LabVIEW NXG 3.1.0]
outputs:
  "Output": cluster{"value": f64[]}[]
diagram:
  for (N = 40) (iteration -> i1) {
    To Double Precision Float(number=i1) -> w2
    for (N = 40) (iteration -> i2) {
      To Double Precision Float(number=i2) -> w4
      Divide(x=w4, y=4.2) -> w5
      Sine(x=w5) -> w6
      Divide(x=w2, y=4.2) -> w7
      Sine(x=w7) -> w8
      Multiply(w6, w8) -> w9
      Random Number() -> (number (0 to 1)=w10)
      Divide(x=w10, y=10) -> w11
      Add(w9, w11) -> w12
      Build Array(w4, w2, w12) -> w13
      Property Node(instance in=cluster{"value": f64[]} {all zero or empty}, "value"=w13) -> (instance out=w14)
      append w14 to w3
    }
    concatenate w3 onto w1
  }
  $Output <- w1
