vi "gauge.gviweb"   [LabVIEW NXG 3.1.0]
panel indicators:
  "loop iteration": i32
  "error out": error
uses:
  ECharts::Core::Create EChart.gvi
  ECharts::Gauge Options::Append Gauge Series Options.gvi
  ECharts::Core::Update EChart Options.gvi
  ECharts::Core::Destroy EChart.gvi
diagram:
  call "Create EChart.gvi"(selector=".my-pie-chart") -> (echart reference=w1, error out=w2)
  s1 = w2  # shift register
  while (iteration -> i1) {
    call "Append Gauge Series Options.gvi"(data=i1) -> (echart options out=w3)
    call "Update EChart Options.gvi"(echart reference in=w1, error in=s1, echart options=w3) -> (echart reference out=w4, error out=w5)
    Wait(time to wait=10)
    $"loop iteration" <- i1
    next s1 = w5
    stop if w5
  }
  call "Destroy EChart.gvi"(echart reference=w4, error in=s1) -> (error out=w6)
  $"error out" <- w6
