vi "index.gviweb"   [LabVIEW NXG 5.0.0]
uses:
  ECharts::Core::Create EChart.gvi
  ECharts::Shared Options 3D::Set Grid 3D.gvi
  ECharts::Shared Options 3D::Set Axis 3D.gvi
  ECharts::Core::Update EChart Options.gvi
  WebApp::Generate Pie Data.gvi
  ECharts::Pie Options::Append Pie Series Options.gvi
  ECharts::Gauge Options::Append Gauge Series Options.gvi
  WebApp::Generate Surface Data.gvi
  ECharts::Surface Options::Append Surface Series Options.gvi
  ECharts::Core::Destroy EChart.gvi
diagram:
  call "Create EChart.gvi"(container=reference to "pie chart") -> (echart reference=w1, error out=w2)
  call "Create EChart.gvi"(container=reference to "gauge") -> (echart reference=w3, error out=w4)
  call "Create EChart.gvi"(container=reference to "scatter") -> (echart reference=w5, error out=w6)
  call "Set Grid 3D.gvi"() -> (echart options out=w7)
  call "Set Axis 3D.gvi"(echart options in=w7, axis 3d="x") -> (echart options out=w8)
  call "Set Axis 3D.gvi"(echart options in=w8, axis 3d="y") -> (echart options out=w9)
  call "Set Axis 3D.gvi"(echart options in=w9, axis 3d="z") -> (echart options out=w10)
  call "Update EChart Options.gvi"(echart reference in=w5, echart options=w10, error in=w6) -> (echart reference out=w11, error out=w12)
  s1 = w2  # shift register
  s2 = w12  # shift register
  s3 = w4  # shift register
  while (iteration -> i1) {
    Wait(time to wait=10)
    call "Generate Pie Data.gvi"() -> (pie data=w13)
    call "Append Pie Series Options.gvi"(data=w13) -> (echart options out=w14)
    call "Update EChart Options.gvi"(echart reference in=w1, echart options=w14, error in=s1) -> (echart reference out=w15, error out=w16)
    Quotient And Remainder(x=i1, y=100) -> (x-y*floor(x/y)=w17)
    call "Append Gauge Series Options.gvi"(data=w17) -> (echart options out=w18)
    call "Update EChart Options.gvi"(echart reference in=w3, echart options=w18, error in=s3) -> (echart reference out=w19, error out=w20)
    call "Generate Surface Data.gvi"() -> (Output=w21)
    call "Append Surface Series Options.gvi"(data=w21) -> (echart options out=w22)
    call "Update EChart Options.gvi"(echart reference in=w11, echart options=w22, error in=s2) -> (echart reference out=w23, error out=w24)
    Merge Errors(w20, w16, w24) -> (error out=w25)
    next s1 = w16
    next s2 = w24
    next s3 = w20
    stop if w25
  }
  call "Destroy EChart.gvi"(echart reference=w19, error in=s3)
  call "Destroy EChart.gvi"(echart reference=w15, error in=s1)
  call "Destroy EChart.gvi"(echart reference=w23, error in=s2)
