vi "Add Keyboard Event Listener - Document.gvi"   [LabVIEW NXG 4.0.0]
inputs:
  "prevent default": bool
  "error in": error
  "keyboard event type": "keyboard event type.gtype" = "keydown", required
outputs:
  "error out": error
  "event manager reference": "event manager reference.gtype"
types:
  "keyboard event type.gtype" = enum{"keydown", "keyup"}
  "event manager reference.gtype" = i32
uses:
  EventTarget::Support::EventTarget.jsli::AddKeyboardEventListener
diagram:
  Format Into String($"keyboard event type") -> w1
  call "AddKeyboardEventListener"(targetType="document", targetSelector="", eventName=w1, preventDefault=$"prevent default", error in=$"error in") -> (eventManagerReference=w2, error out=w3)
  $"event manager reference" <- w2
  $"error out" <- w3
