vi "Add Keyboard Event Listener - Element.gvi"   [LabVIEW NXG 4.0.0]
inputs:
  "error in": error
  "prevent default": bool
  "keyboard event type": "keyboard event type.gtype" = "keydown", required
  "selector": string, required
outputs:
  "event manager reference": "event manager reference.gtype"
  "error out": error
types:
  "keyboard event type.gtype" = enum{"keydown", "keyup"}
  "event manager reference.gtype" = i32
uses:
  EventTarget::Support::EventTarget.jsli::AddKeyboardEventListener
diagram:
  Format Into String($"keyboard event type") -> w1
  call "AddKeyboardEventListener"(targetType="element", targetSelector=$selector, eventName=w1, preventDefault=$"prevent default", error in=$"error in") -> (eventManagerReference=w2, error out=w3)
  $"event manager reference" <- w2
  $"error out" <- w3
