vi "Add Keyboard Event Listener.gvi"   [LabVIEW NXG 5.0.0]
inputs:
  "error in": error
  "prevent default": bool
  "keyboard event type": "keyboard event type.gtype" = "keydown", required
  "target in": "NI.JavaScriptReference", required
outputs:
  "target out": "NI.JavaScriptReference"
  "error out": error
  "event listener configuration out": "event listener configuration.gtype"
  "keyboard user event": "event keyboard event"
types:
  "keyboard event type.gtype" = enum{"keydown", "keyup"}
  "event listener configuration.gtype" = cluster{"event stream reader": "NI.JavaScriptReference", "keyboard user event": "event keyboard event", "error in": error}
uses:
  EventTarget::Support::EventTarget.jsli::AddKeyboardEventListener
diagram:
  $"target out" <- $"target in"
  Format Into String(errIn=$"error in", $"keyboard event type") -> (outString=w1, errOut=w2)
  call "AddKeyboardEventListener"(target=$"target in", eventName=w1, preventDefault=$"prevent default", error in=w2) -> (eventStreamReader=w3, error out=w4)
  Create User Event[EventName="keyboard event"](error in=w4, user event data type=cluster{"code": string, "key": string} {all zero or empty}) -> (error out=w5, user event out=w6)  # Create User Event: keyboard event
  Property Node(instance in="event listener configuration.gtype" {all zero or empty}, "event stream reader"=w3, "keyboard user event"=w6, "error in"=w5) -> (instance out=w7)
  $"event listener configuration out" <- w7
  $"keyboard user event" <- w6
  $"error out" <- w5
