vi "Listen For Keyboard Events.gvi"   [LabVIEW NXG 5.0.0]
inputs:
  "event listener configuration": "event listener configuration.gtype", required
outputs:
  "error out (warning: blocking)": error
types:
  "event listener configuration.gtype" = cluster{"event stream reader": "NI.JavaScriptReference", "keyboard user event": "event keyboard event", "error in": error}
  T1 = cluster{"code": string, "key": string, "done": bool}
uses:
  EventTarget::Support::EventTarget.jsli::WaitForKeyboardEvent
diagram:
  Property Node(instance in=$"event listener configuration") -> ("keyboard user event"=w1, "event stream reader"=w2, "error in"=w3)
  # Note: This VI must be reentrant
  s1 = w3  # shift register
  while {
    call "WaitForKeyboardEvent"(eventStreamReader=w2, error in=s1) -> (eventDataJSON=w4, error out=w5)
    Unflatten From Json(JSON string=w4, error in (no error)=w5, type and defaults=T1 {all zero or empty}) -> (error out=w6, value=w7)
    Property Node(instance in=w7) -> ("code"=w8, "key"=w9, "done"=w10)
    case (w10) {
      frame False, Default {
        Property Node(instance in=cluster{"code": string, "key": string} {all zero or empty}, "code"=w8, "key"=w9) -> (instance out=w13)
        Generate User Event(error in=w6, event data=w13, user event=w1) -> (error out=w12)
        w11 = w10
      }
      frame True {
        w11 = w10
        w12 = w6
      }
    }
    Logical Or(w12, w11) -> w14
    next s1 = w12
    stop if w14
  }
  $"error out (warning: blocking)" <- s1
