vi "Remove Event Listener.gvi"   [LabVIEW NXG 5.0.0]
inputs:
  "event manager reference": "event manager reference.gtype", required
  "error in": error
outputs:
  "error out": error
types:
  "event manager reference.gtype" = "NI.JavaScriptReference"
uses:
  EventTarget::Support::EventTarget.jsli::RemoveEventListener
diagram:
  call "RemoveEventListener"(eventStreamReader=$"event manager reference") -> (error out=w1)
  Merge Errors($"error in", w1) -> (error out=w2)
  $"error out" <- w2
