vi "Calculate.gvi"   [G Web Development Software 21.0.0]
inputs:
  "error in": error
  "expression": string, required
  "symbolTable": T1
outputs:
  "error out": error
  "return": f64
  "value": f64[]
types:
  T1 = cluster{"variables": cluster{"name": string}[], "vectors": cluster{"name": string, "size": u32}[]}
uses:
  Exorbitant::Support::Exorbitant.jsli::CreateExorbitant
  Exorbitant::Support::Exorbitant.jsli::ExorbitantValue
  Exorbitant::Support::Exorbitant.jsli::ExorbitantGetVector
diagram:
  w1 = cluster{"expression": string, "symbolTable": T1} {all zero or empty}
  Property Node(instance in=w1, "expression"=$expression, "symbolTable"=$symbolTable) -> (instance out=w2)
  Flatten To Json(anything=w2, error in (no error)=$"error in") -> (JSON string=w3, error out=w4)
  call "CreateExorbitant"(configurationJSON=w3, error in=w4) -> (exorbitant=w5, error out=w6)
  call "ExorbitantValue"(exorbitant=w5, error in=w6) -> (return=w7, error out=w8)
  # export type configuration = {
  #     expression: string,
  #     symbolTable?: {
  #         variables?:
  #         {
  #             name: string,
  #             value?: number
  #         }[],
  #         vectors?:
  #         {
  #             name: string,
  #             size: number,
  #             // Allow array-like objects (ie Float32Array) or any[]
  #             // Use any[] to avoid checking type of each member at runtime
  #             value?: {length: number} | any[]
  #         }[]
  #     }
  # };
  call "ExorbitantGetVector"(exorbitant=w5, name="c", error in=w8) -> (return=w9, error out=w10)
  $value <- w9
  $return <- w7
  $"error out" <- w10
