vi "server.get.gviweb"   [LabVIEW NXG 3.1.0]
panel controls:
  "server": "server.gtype"
types:
  "server.gtype" = i32
  "data.gtype" = cluster{"data": string}
uses:
  NodeFS::Read File.gvi
  Express::Write Server JSON Response.gviweb
diagram:
  call "Read File.gvi"(path on server="C:\\Users\\lvadmin\\Desktop\\hyde.txt") -> (data=w1)
  Property Node(instance in="data.gtype" {all zero or empty}, "data"=w1) -> (instance out=w2)
  Flatten To JSON(anything=w2) -> (JSON string=w3)
  call "Write Server JSON Response.gviweb"(server=$server, json response=w3)
