vi "index.gviweb"   [G Web Development Software 22.3.0]
uses:
  Fabric::Support::Fabric.jsli::CreateCanvas
diagram:
  Obtain JavaScript Reference(reference in=reference to "HTML Container") -> (javascript reference out=w1)
  call "CreateCanvas"(placeholder=w1)
  # Place setup code before the loop. For example, perform initial data communication and wire the results into the loop.
  # Top-Level WebVIs usually contain a While Loop that never stops so that they can continue running as long as the web page is open in the user's web browser.
  while {
    Wait(time to wait=50)
    stop if FALSE
  }
