vi "Create Data Url.gvi"   [LabVIEW NXG 5.0.0]
inputs:
  "data": u8[], required
  "error in": error
  "content type": string = "image/jpeg", required
outputs:
  "error out": error
  "data url": string
uses:
  Base64::Base64 Encode.gvi
diagram:
  call "Base64 Encode.gvi"(data=$data, error in=$"error in") -> (encoded data=w1, error out=w2)
  Concatenate Strings("data:", $"content type", ";base64,", w1) -> w3
  $"data url" <- w3
  $"error out" <- w2
