vi "Close File.gvi"   [LabVIEW NXG 5.0.0]
inputs:
  "file reference": "file reference.gtype"
  "error in": error
outputs:
  "error out": error
types:
  "file reference.gtype" = string
uses:
  FileApi::Support::File.jsli::CloseFile
diagram:
  call "CloseFile"(fileObjectUrl=$"file reference") -> (error out=w1)
  Merge Errors($"error in", w1) -> (error out=w2)
  $"error out" <- w2
