vi "Close File Url.gvi"   [LabVIEW NXG 5.0.0]
inputs:
  "url": string, required
  "error in": error
outputs:
  "error out": error
uses:
  File::Support::File.jsli::CloseFileUrl
diagram:
  call "CloseFileUrl"(url=$url) -> (error out=w1)
  Merge Errors($"error in", w1) -> (error out=w2)
  $"error out" <- w2
