vi "Download File Text.gvi"   [LabVIEW NXG 5.0.0]
inputs:
  "error in": error
  "file contents": string, required
  "file name": string, required
  "content type": string = "text/plain"
outputs:
  "error out": error
uses:
  FileTasks::Download File Binary.gvi
diagram:
  String To Byte Array(error in (no error)=$"error in", string=$"file contents") -> (error out=w1, unsigned byte array=w2)
  call "Download File Binary.gvi"(file contents=w2, file name=$"file name", content type=$"content type", error in=w1) -> (error out=w3)
  $"error out" <- w3
