vi "Read File Text.gvi"   [LabVIEW NXG 5.0.0]
inputs:
  "error in": error
  "allowed file types": string[]
outputs:
  "error out": error
  "file content": string
  "file name": string
uses:
  FileTasks::Read File Binary.gvi
diagram:
  call "Read File Binary.gvi"(allowed file types=$"allowed file types", error in=$"error in") -> (file contents=w1, file name=w2, error out=w3)
  Byte Array To String(error in=w3, unsigned byte array=w1) -> (error out=w4, string=w5)
  $"file content" <- w5
  $"error out" <- w4
  $"file name" <- w2
