vi "GET Ext - File.gvi"   [G Web Development Software 21.0.0]
# Sends a Web request that returns headers and body data from a server, Web page, or Web service. This VI uses the GET HTTP method and does not submit any data to the server. You also can save the body data to an output file.
inputs:
  "client handle": "Client Handle.gtype"  # client handle specifies the client handle to associate with the Web request. Use client handles to wire together multiple HTTP Client VIs while preserving authentication credentials, HTTP headers, and cookies. Client handles are not required when making independent Web requests without persistent data such as headers or credentials.
  "url": string, required  # URL specifies the URL of the server, Web page, or Web service which this VI sends the Web request.
  "error in": error
  "output file": path  # output file specifies a file to save body data returned by the server. If you do not specify an output file, the VI does not save the body data to a file.
  "timeout": i32 = 10000  # timeout specifies the amount of time in milliseconds to wait for a response from the server before the Web request times out. The default value is 10000 ms. A value of -1 defers timeout monitoring to the operating system.
outputs:
  "status code": u32
  "client handle out": "Client Handle.gtype"  # client handle out returns the client handle associated with the Web request. Use client handles to wire together multiple HTTP Client VIs while preserving authentication credentials, HTTP headers, and cookies. Client handles are not required when making independent Web requests without persistent data such as headers or credentials.
  "headers": string  # headers returns the header fields returned by the server. Refer to the World Wide Web Consortium website at www.w3.org for more information about header field definitions including available headers, descriptions, and syntax.
  "body": "NI.JavaScriptReference"
  "error out": error
types:
  "Client Handle.gtype" = u32
uses:
  HTTPExtensions::Support::Validate Empty Path.gvi
  HTTPExtensions::Support::HTTPExtensions.jsli::GetExtFile
  HTTPExtensions::Support::Handle Result - File.gvi
diagram:
  $"client handle out" <- $"client handle"
  call "Validate Empty Path.gvi"(path=$"output file", error in=$"error in") -> (error out=w1)
  call "GetExtFile"(requestConfigurationJSON=$"client handle", url=$url, timeout=$timeout, error in=w1) -> (result=w2, error out=w3)
  call "Handle Result - File.gvi"(http result=w2, error in=w3) -> (status code=w4, headers=w5, body=w6, error out=w7)
  $"status code" <- w4
  $headers <- w5
  $body <- w6
  $"error out" <- w7
