vi "POST Multipart Ext - String.gvi"   [G Web Development Software 21.0.0]
inputs:
  "client handle": "Client Handle.gtype"
  "timeout": i32 = 10000  # timeout specifies the amount of time in milliseconds to wait for a response from the server before the Web request times out. The default value is 10000 ms. A value of -1 defers timeout monitoring to the operating system.
  "error in": error
  "data": "Multipart Data Ext.gtype"[]
    # data is the array of clusters specifying the data attributes and values to submit to the server. The POSTMultipart VI determines which data format to accept from the client and which format to send the data to the server based upon the controls specified within data.
    # Name specifies a name for the submitted data. This control is required for all Web requests with buffer data or files.
    # Value specifies the buffer data string to submit to the server. Assign a Value and do not assign a File to configure the VI to accept a buffer data string as the source data.
    # File specifies a file JavaScript reference to submit to the server. Assign a File and do not assign a Value to configure the VI to accept a file as the source data.
    # Filename specifies a filename to save the submitted data on the server. Assign a Filename to instruct the server to save the source data as a file. If you do not assign a Filename, the server saves the source data as a buffer data string.
    # MIME Type specifies the MIME type for the Web request. The default value is application/octet-stream.
  "url": string, required  # URL specifies the URL of the server, Web page, or Web service which this VI sends the Web request.
  "output file": path  # output file specifies a file to save body data returned by the server. If you do not specify an output file, the VI does not save the body data to a file.
outputs:
  "client handle out": "Client Handle.gtype"
  "headers": string  # headers returns the header fields returned by the server. Refer to the World Wide Web Consortium website at www.w3.org for more information about header field definitions including available headers, descriptions, and syntax.
  "body": string  # body returns body data returned by the server.
  "error out": error
  "status code": u32
types:
  "Multipart Data Ext.gtype" = cluster{"Name": string, "Value": string, "File": "NI.JavaScriptReference", "Filename": string, "MIME type": string}
  "Client Handle.gtype" = u32
uses:
  HTTPExtensions::Support::Validate Empty Path.gvi
  HTTPExtensions::Support::Format Post Data.gvi
  HTTPExtensions::Support::HTTPExtensions.jsli::PostMultipartExtString
  HTTPExtensions::Support::Handle Result - String.gvi
diagram:
  $"client handle out" <- $"client handle"
  call "Validate Empty Path.gvi"(path=$"output file", error in=$"error in") -> (error out=w1)
  call "Format Post Data.gvi"(data=$data, error in=w1) -> (post data json=w2, post data files=w3, error out=w4)
  call "PostMultipartExtString"(requestConfigurationJSON=$"client handle", url=$url, timeout=$timeout, postDataJSON=w2, postDataFiles=w3, error in=w4) -> (result=w5, error out=w6)
  call "Handle Result - String.gvi"(http result=w5, error in=w6) -> (status code=w7, headers=w8, body=w9, error out=w10)
  $"status code" <- w7
  $headers <- w8
  $body <- w9
  $"error out" <- w10
