vi "Handle Response - String.gvi"   [G Web Development Software 22.0.0]
inputs:
  "http response": "NI.JavaScriptReference"[], required
  "error in": error
outputs:
  "status code": i32
  "headers": string  # headers returns the header fields returned by the server. Refer to the World Wide Web Consortium website at www.w3.org for more information about header field definitions including available headers, descriptions, and syntax.
  "body": string  # body returns body data returned by the server.
  "error out": error
uses:
  HTTPExtensions::Support::HTTPExtensions.jsli::CastInteger32
  HTTPExtensions::Support::HTTPExtensions.jsli::CastString
diagram:
  Array Index(array=$"http response") -> (out0[_]=w1, out1[_]=w2, out2[_]=w3)
  call "CastInteger32"(value=w1, error in=$"error in") -> (return=w4, error out=w5)
  $"status code" <- w4
  call "CastString"(value=w2, error in=w5) -> (return=w6, error out=w7)
  $headers <- w6
  call "CastString"(value=w3, error in=w7) -> (return=w8, error out=w9)
  $body <- w8
  Close Reference(error in=w9, reference=$"http response") -> (error out=w10)
  $"error out" <- w10
