vi "Handle Result - File.gvi"   [G Web Development Software 21.0.0]
inputs:
  "http result": "NI.JavaScriptReference"[], required
  "error in": error
outputs:
  "status code": u32
  "headers": string  # headers returns the header fields returned by the server. Refer to the World Wide Web Consortium website at www.w3.org for more information about header field definitions including available headers, descriptions, and syntax.
  "body": "NI.JavaScriptReference"
  "error out": error
uses:
  HTTPExtensions::Support::HTTPExtensions.jsli::CastUInt32
  HTTPExtensions::Support::HTTPExtensions.jsli::CastString
diagram:
  Array Index(array=$"http result") -> (out0[_]=w1, out1[_]=w2, out2[_]=w3)
  call "CastUInt32"(value=w1, error in=$"error in") -> (return=w4, error out=w5)
  call "CastString"(value=w2, error in=w5) -> (return=w6, error out=w7)
  Array Subset(array=$"http result", length0=2) -> w8
  Close Reference(error in=w7, reference=w8) -> (error out=w9)
  case (w9) {
    frame Error, Default {
      # Workaround for issue 1374910. When error output, manually use default value for other terminals.
      w10 = 0
      w11 = ""
      w12 = "NI.JavaScriptReference" constant
      w13 = w9
    }
    frame No Error {
      w10 = w4
      w11 = w6
      w12 = w3
      w13 = w9
    }
  }
  $"status code" <- w10
  $headers <- w11
  $body <- w12
  $"error out" <- w13
