vi "Handle Result - String.gvi"   [G Web Development Software 21.0.0]
inputs:
  "http result": "NI.JavaScriptReference"[], required
  "error in": error
outputs:
  "status code": i32
  "headers": string  # headers returns the header fields returned by the server. Refer to the World Wide Web Consortium website at www.w3.org for more information about header field definitions including available headers, descriptions, and syntax.
  "body": string  # body returns body data returned by the server.
  "error out": error
uses:
  HTTPExtensions::Support::HTTPExtensions.jsli::CastInteger32
  HTTPExtensions::Support::HTTPExtensions.jsli::CastString
diagram:
  Array Index(array=$"http result") -> (out0[_]=w1, out1[_]=w2, out2[_]=w3)
  call "CastInteger32"(value=w1, error in=$"error in") -> (return=w4, error out=w5)
  call "CastString"(value=w2, error in=w5) -> (return=w6, error out=w7)
  call "CastString"(value=w3, error in=w7) -> (return=w8, error out=w9)
  Close Reference(error in=w9, reference=$"http result") -> (error out=w10)
  case (w10) {
    frame Error, Default {
      # Workaround for issue 1374910. When error output, manually use default value for other terminals.
      w11 = 0
      w12 = ""
      w13 = ""
      w14 = w10
    }
    frame No Error {
      w11 = w4
      w12 = w6
      w13 = w8
      w14 = w10
    }
  }
  $"status code" <- w11
  $headers <- w12
  $body <- w13
  $"error out" <- w14
