vi "Validate Empty Path.gvi"   [G Web Development Software 21.0.0]
inputs:
  "path": path  # output file specifies a file to save body data returned by the server. If you do not specify an output file, the VI does not save the body data to a file.
  "error in": error
outputs:
  "error out": error
uses:
  NI::G Core::Error::Build Error Cluster.gvi
diagram:
  Is Empty String Or Path(string/path=$path) -> w1
  Is Not A Number Or Path Or Refnum(number=$path) -> w2
  Logical Or(w1, w2) -> w3
  case (w3) {
    frame False, Default {
      w5 = "This target does not support usage of an output file. Set output file as either Not a path or an empty path for this target."
      call "Build Error Cluster.gvi"(error in=$"error in", code=363654, description=w5) -> (error out=w4)
    }
    frame True {
      # Empty paths are valid
      w4 = $"error in"
    }
  }
  $"error out" <- w4
