vi "Build Workspace Filter.gvi"   [G Web Development Software 22.0.0]
inputs:
  "configuration": "Configuration.gtype", required
  "limit to configured workspace?": bool, required
  "error in": error
outputs:
  "configuration out": "Configuration.gtype"
  "filter": string[]
  "error out": error
types:
  "Client Handle.gtype" = u32
  "Workspace.gtype" = cluster{"id": string, "name": string, "archived?": bool, "default?": bool}
  "Configuration.gtype" = cluster{"Server URL": string, "Session": "Client Handle.gtype", "Raw Session Queue": Queue<"Client Handle.gtype">, "Workspace": "Workspace.gtype"}
uses:
  SystemLinkFileExtensions::Verify Query Files Workspace Support.gvi
diagram:
  $"configuration out" <- $configuration
  case ($"error in") {
    frame No Error {
      case ($"limit to configured workspace?") {
        frame False, Default {
          call "Verify Query Files Workspace Support.gvi"(configuration=$configuration, error in=$"error in") -> (error out=w3)
          # Filter for '*' if supported, otherwise no filter
          w4 = string[] []  # empty filter
          Select(s=w3, t=w4, f=["*"]) -> w2
          w1 = default
        }
        frame True {
          Property Node(instance in=$configuration) -> ("Workspace:id"=w5)
          case (w5) {
            frame Default {
              # Filter to specified.
              # Errors if unsupported.
              Build Array(w5) -> w2
              call "Verify Query Files Workspace Support.gvi"(configuration=$configuration, error in=$"error in") -> (error out=w1)
            }
            frame "" {
              # No filter if Default is specified
              w2 = default
              w1 = $"error in"
            }
          }
        }
      }
    }
    frame Error {
      w1 = $"error in"
      w2 = default
    }
  }
  $filter <- w2
  $"error out" <- w1
