vi "Create Filter (Created Time Stamp).gvi"   [G Web Development Software 22.0.0]
# Creates or adds to an existing file query filter a created time stamp query. When wired to Query Files.vi, the results contain only files that have Created attributes that satisfy the query entry. Combining conflicting created time stamp queries results in the last created time stamp query entry overriding any previous entries.
inputs:
  "filter in": "File Filter.gtype"
  "time stamp": timestamp, required
  "error in": error
  "operator": "Filter Operator (DateTime).gtype" = "greater than or equal"
outputs:
  "filter out": "File Filter.gtype"
  "error out": error
types:
  "Filter Operator (DateTime).gtype" = enum{"less than", "greater than", "less than or equal", "greater than or equal"}
  T1 = cluster{"key": string, "operation": string, "value": string}
  "File Filter.gtype" = cluster{"extension query": cluster{"value": string, "operation": string}, "size min query": cluster{"operation": string, "value": i32}, "size max query": cluster{"operation": string, "value": i32}, "created query": cluster{"operation": string, "value": string}, "properties query": T1[]}
uses:
  NI::Skyline::Utilities::Timestamp to Posix String.gvi
diagram:
  case ($"error in") {
    frame No Error {
      case ($operator) {
        frame "less than" {
          w3 = "LESS_THAN"
        }
        frame "greater than" {
          w3 = "GREATER_THAN"
        }
        frame "less than or equal" {
          w3 = "LESS_THAN_OR_EQUAL"
        }
        frame "greater than or equal" {
          w3 = "GREATER_THAN_OR_EQUAL"
        }
      }
      call "Timestamp to Posix String.gvi"(time stamp=$"time stamp") -> (posix time string=w4)
      Property Node(instance in=$"filter in", "created query:operation"=w3, "created query:value"=w4) -> (instance out=w1)
      w2 = $"error in"
    }
    frame Error {
      w1 = $"filter in"
      w2 = $"error in"
    }
  }
  $"error out" <- w2
  $"filter out" <- w1
