vi "Create Filter (Property).gvi"   [G Web Development Software 22.0.0]
# Creates or adds to an existing file query filter a property query. When wired to Query Files.vi, the results contain only files that have property attributes that satisfy the query entry. When specifying multiple queries for the same property, only files that match all queries are opened.
inputs:
  "filter in": "File Filter.gtype"
  "key": string, required
  "value": string, required
  "error in": error
  "operator": "Filter Operator (String).gtype" = "contains"
outputs:
  "filter out": "File Filter.gtype"
  "error out": error
types:
  T1 = cluster{"key": string, "operation": string, "value": string}
  "File Filter.gtype" = cluster{"extension query": cluster{"value": string, "operation": string}, "size min query": cluster{"operation": string, "value": i32}, "size max query": cluster{"operation": string, "value": i32}, "created query": cluster{"operation": string, "value": string}, "properties query": T1[]}
  "Filter Operator (String).gtype" = enum{"contains", "not contains", "equal", "not equal"}
diagram:
  case ($"error in") {
    frame No Error {
      Property Node(instance in=$"filter in") -> ("properties query"=w3)
      case ($operator) {
        frame "contains" {
          w4 = "CONTAINS"
        }
        frame "not contains" {
          w4 = "NOT_CONTAINS"
        }
        frame "equal" {
          w4 = "EQUAL"
        }
        frame "not equal" {
          w4 = "NOT_EQUAL"
        }
      }
      Property Node(instance in=T1 {all zero or empty}, "key"=$key, "operation"=w4, "value"=$value) -> (instance out=w5)
      Insert Into Array(inArray=w3, new=w5) -> w6
      Property Node(instance in=$"filter in", "properties query"=w6) -> (instance out=w1)
      w2 = $"error in"
    }
    frame Error {
      w1 = $"filter in"
      w2 = $"error in"
    }
  }
  $"error out" <- w2
  $"filter out" <- w1
