vi "Create Filter (Size in bytes).gvi"   [G Web Development Software 22.0.0]
# Creates or adds to an existing file query filter a size query. When wired to Query Files.vi, the results contain only files that have Size attributes that satisfy the query entry. Combining conflicting size queries results in the last size query entry overriding any previous entries.
inputs:
  "filter in": "File Filter.gtype"
  "size": i32, required
  "error in": error
  "operator": "Filter Operator (Int).gtype" = "greater than or equal"
outputs:
  "filter out": "File Filter.gtype"
  "error out": error
types:
  T1 = cluster{"key": string, "operation": string, "value": string}
  "File Filter.gtype" = cluster{"extension query": cluster{"value": string, "operation": string}, "size min query": cluster{"operation": string, "value": i32}, "size max query": cluster{"operation": string, "value": i32}, "created query": cluster{"operation": string, "value": string}, "properties query": T1[]}
  "Filter Operator (Int).gtype" = enum{"equal", "not equal", "less than", "greater than", "less than or equal", "greater than or equal"}
diagram:
  case ($"error in") {
    frame No Error {
      case ($operator) {
        frame "less than" {
          w3 = "LESS_THAN"
        }
        frame "greater than" {
          w3 = "GREATER_THAN"
        }
        frame "less than or equal" {
          w3 = "LESS_THAN_OR_EQUAL"
        }
        frame "greater than or equal" {
          w3 = "GREATER_THAN_OR_EQUAL"
        }
        frame "not equal" {
          w3 = "NOT_EQUAL"
        }
        frame "equal" {
          w3 = "EQUAL"
        }
      }
      # Query logic from client dll
      case ($operator) {
        frame "greater than", "greater than or equal" {
          Property Node(instance in=$"filter in", "size min query:operation"=w3, "size min query:value"=$size) -> (instance out=w1)
        }
        frame "less than", "less than or equal" {
          Property Node(instance in=$"filter in", "size max query:operation"=w3, "size max query:value"=$size) -> (instance out=w1)
        }
        frame "equal".."not equal", Default {
          Property Node(instance in=$"filter in", "size min query:operation"=w3, "size min query:value"=$size, "size max query:operation"=w3, "size max query:value"=$size) -> (instance out=w1)
        }
      }
      w2 = $"error in"
    }
    frame Error {
      w1 = $"filter in"
      w2 = $"error in"
    }
  }
  $"filter out" <- w1
  $"error out" <- w2
