vi "Delete File (Multiple).gvi"   [G Web Development Software 22.0.0]
# Removes a group of files from the server.
# Use force file deletion? to force file deletion from the server in case of corrupted files.
inputs:
  "files": "File.gtype"[], required
  "error in": error
  "force file deletion?": bool
outputs:
  "error out": error
types:
  "Property.gtype" = cluster{"key": string, "value": string}
  "Client Handle.gtype" = u32
  "Configuration.gtype" = cluster{"Server URL": string, "Session": "Client Handle.gtype", "Raw Session Queue": Queue<"Client Handle.gtype">, "Workspace": "Workspace.gtype"}
  "File.gtype" = cluster{"id": string, "workspace id": string, "metadata revision": i64, "created": timestamp, "size": i64, "properties": "Property.gtype"[], "configuration": "Configuration.gtype"}
uses:
  SystemLinkFileExtensions::Sort By Session.gvi
  SystemLinkFileExtensions::Form Request Delete.gvi
  SystemLinkFileExtensions::Verify Force Delete Files Support.gvi
  SystemLinkFileExtensions::Form URL Delete.gvi
  NI::Skyline::Utilities::Execute HTTP Verb.gvi
  NI::G Core::Error::Legacy::Clear Errors.gvi
  NI::G Core::Error::Legacy::Error Cluster From Error Code.gvi
diagram:
  call "Sort By Session.gvi"(file clusters=$files, error in=$"error in") -> (sorted file clusters=w1, error out=w2)
  case (w2) {
    frame No Error {
      s1 = w2  # shift register
      for {
        w4 = each element of w1
        Property Node(instance in=w4) -> ("file clusters"=w5)
        for {
          w6 = each element of w5
          Property Node(instance in=w6) -> ("id"=w8, "configuration"=w9)
          append w8 to w7
        }
        Property Node(instance in=w9) -> ("Session"=w10, "Server URL"=w11)
        call "Form Request Delete.gvi"(ids=w7) -> (request body=w12)
        case ($"force file deletion?") {
          frame False, Default {
            w13 = s1
          }
          frame True {
            call "Verify Force Delete Files Support.gvi"(configuration=w9, error in=s1) -> (error out=w13)
          }
        }
        call "Form URL Delete.gvi"(server url=w11, force file deletion?=$"force file deletion?") -> (url=w14)
        call "Execute HTTP Verb.gvi"(session=w10, URL=w14, buffer=w12, error in=w13, HTTP verb="POST") -> (error out=w15)
        Property Node(instance in=w15) -> ("code"=w16)
        case (w16) {
          frame 0, Default {
            w17 = w15
          }
          frame -251041 {
            # This error contains a list of innerErrors and suggest to the user to look at it.
            # This list, however, is not accessible in LabVIEW.
            # Thus, replacing the error with the same error message that is shown in the Web UI.
            call "Clear Errors.gvi"(specific error code to clear=w16, error in=w15) -> (error out=w18)
            w19 = "-251637: The request to delete files failed partially. One or more files couldn't be deleted."
            call "Error Cluster From Error Code.gvi"(error code=-251637, error message=w19, show call chain?=TRUE, is warning?=FALSE) -> (error out=w20)
            Merge Errors(w18, w20) -> (error out=w17)
          }
        }
        next s1 = w17
      }
      w3 = s1
    }
    frame Error {
      w3 = w2
    }
  }
  $"error out" <- w3
