vi "Delete File Ext (Single).gvi"   [G Web Development Software 22.3.0]
# Removes a file from the server.
# Use force file deletion? to force file deletion from the server in case of corrupted files.
inputs:
  "file": "File.gtype", required
  "error in": error
  "force file deletion?": bool
outputs:
  "error out": error
types:
  "Property.gtype" = cluster{"key": string, "value": string}
  "Client Handle.gtype" = u32
  "Configuration.gtype" = cluster{"Server URL": string, "Session": "Client Handle.gtype", "Raw Session Queue": Queue<"Client Handle.gtype">, "Workspace": "Workspace.gtype"}
  "File.gtype" = cluster{"id": string, "workspace id": string, "metadata revision": i64, "created": timestamp, "size": i64, "properties": "Property.gtype"[], "configuration": "Configuration.gtype"}
uses:
  SystemLinkFileExtensions::Delete File::Delete File Ext (Multiple).gvi
diagram:
  Build Array($file) -> w1
  call "Delete File Ext (Multiple).gvi"(files=w1, error in=$"error in", force file deletion?=$"force file deletion?") -> (error out=w2)
  $"error out" <- w2
