vi "Download File (Single).gvi"   [G Web Development Software 22.0.0]
inputs:
  "file in": "File.gtype", required
  "selected path": path, required
  "error in": error
outputs:
  "file out": "File.gtype"
  "path out": path
  "error out": error
types:
  "Property.gtype" = cluster{"key": string, "value": string}
  "Client Handle.gtype" = u32
  "Configuration.gtype" = cluster{"Server URL": string, "Session": "Client Handle.gtype", "Raw Session Queue": Queue<"Client Handle.gtype">, "Workspace": "Workspace.gtype"}
  "File.gtype" = cluster{"id": string, "workspace id": string, "metadata revision": i64, "created": timestamp, "size": i64, "properties": "Property.gtype"[], "configuration": "Configuration.gtype"}
uses:
  SystemLinkFileExtensions::Form URL Download.gvi
  NI::Skyline::Utilities::Execute HTTP Verb.gvi
diagram:
  $"path out" <- $"selected path"
  $"file out" <- $"file in"
  Property Node(instance in=$"file in") -> ("id"=w1, "configuration"=w2)
  Property Node(instance in=w2) -> ("Session"=w3, "Server URL"=w4)
  call "Form URL Download.gvi"(server url=w4, id=w1) -> (url=w5)
  call "Execute HTTP Verb.gvi"(session=w3, URL=w5, error in=$"error in", HTTP verb="GET", output file=$"selected path") -> (error out=w6)
  $"error out" <- w6
