vi "Download File Ext (Multiple).gvi"   [G Web Development Software 21.0.0]
# Receives an array of files synchronously from the SystemLink file service.
# When you call this VI, it blocks additional calls until the files are downloaded or it returns an error.
inputs:
  "files in": "File.gtype"[], required
  "paths": path[], required
  "error in": error
outputs:
  "files out": "File.gtype"[]
  "paths out": path[]
  "error out": error
types:
  "Property.gtype" = cluster{"key": string, "value": string}
  "Client Handle.gtype" = u32
  "Configuration.gtype" = cluster{"Server URL": string, "Session": "Client Handle.gtype", "Raw Session Queue": Queue<"Client Handle.gtype">, "Workspace": "Workspace.gtype"}
  "File.gtype" = cluster{"id": string, "workspace id": string, "metadata revision": i64, "created": timestamp, "size": i64, "properties": "Property.gtype"[], "configuration": "Configuration.gtype"}
uses:
  SystemLinkFileExtensions::Download File Ext (Single).gvi
diagram:
  case ($"error in") {
    frame No Error {
      s1 = $"error in"  # shift register
      for {
        w4 = each element of $paths
        w5 = each element of $"files in"
        call "Download File Ext (Single).gvi"(file in=w5, selected path=w4) -> (file out=w6, path out=w7, error out=w8)
        Merge Errors(s1, w8) -> (error out=w9)
        append w7 to w3
        append w6 to w2
        next s1 = w9
      }
      w1 = s1
    }
    frame Error {
      w1 = $"error in"
      w2 = $"files in"
      w3 = $paths
    }
  }
  $"error out" <- w1
  $"files out" <- w2
  $"paths out" <- w3
