vi "Download File Ext (Single).gvi"   [G Web Development Software 21.0.0]
inputs:
  "file in": "File.gtype", required
  "error in": error
outputs:
  "file reference": "NI.JavaScriptReference"
  "file out": "File.gtype"
  "error out": error
types:
  "Property.gtype" = cluster{"key": string, "value": string}
  "Client Handle.gtype" = u32
  "Configuration.gtype" = cluster{"Server URL": string, "Session": "Client Handle.gtype", "Raw Session Queue": Queue<"Client Handle.gtype">, "Workspace": "Workspace.gtype"}
  "File.gtype" = cluster{"id": string, "workspace id": string, "metadata revision": i64, "created": timestamp, "size": i64, "properties": "Property.gtype"[], "configuration": "Configuration.gtype"}
uses:
  NI::Skyline::File::Form URL Download.gvi
  SystemLinkFileExtensions::Support::Execute HTTP Verb.gvi
diagram:
  Property Node(instance in=$"file in") -> ("id"=w1, "configuration"=w2)
  Property Node(instance in=w2) -> ("Session"=w3, "Server URL"=w4)
  call "Form URL Download.gvi"(server url=w4, id=w1) -> (url=w5)
  call "Execute HTTP Verb.gvi"(session=w3, URL=w5, error in=$"error in") -> (body=w6, error out=w7)
  $"file reference" <- w6
  $"file out" <- $"file in"
  $"error out" <- w7
