vi "Download File Ext (Multiple).gvi"   [G Web Development Software 22.3.0]
# Receives an array of files synchronously from the SystemLink file service.
# When you call this VI, it blocks additional calls until the files are downloaded or it returns an error.
inputs:
  "files in": "File.gtype"[], required
  "error in": error
outputs:
  "file references": "NI.JavaScriptReference"[]
  "files out": "File.gtype"[]
  "error out": error
types:
  "Property.gtype" = cluster{"key": string, "value": string}
  "Client Handle.gtype" = u32
  "Configuration.gtype" = cluster{"Server URL": string, "Session": "Client Handle.gtype", "Raw Session Queue": Queue<"Client Handle.gtype">, "Workspace": "Workspace.gtype"}
  "File.gtype" = cluster{"id": string, "workspace id": string, "metadata revision": i64, "created": timestamp, "size": i64, "properties": "Property.gtype"[], "configuration": "Configuration.gtype"}
uses:
  SystemLinkFileExtensions::Download File::Download File Ext (Single).gvi
diagram:
  case ($"error in") {
    frame No Error {
      s1 = $"error in"  # shift register
      for {
        w4 = each element of $"files in"
        call "Download File Ext (Single).gvi"(file in=w4) -> (file out=w5, file reference=w6, error out=w7)
        Merge Errors(s1, w7) -> (error out=w8)
        append w6 to w3
        append w5 to w2
        next s1 = w8
      }
      w1 = s1
    }
    frame Error {
      w1 = $"error in"
      w2 = $"files in"
      w3 = "NI.JavaScriptReference"[] []
    }
  }
  $"error out" <- w1
  $"files out" <- w2
  $"file references" <- w3
