vi "Extract ID From Upload Response.gvi"   [LabVIEW NXG 5.0.0]
inputs:
  "body": string, required
outputs:
  "id": string
diagram:
  Unflatten From Json(JSON string=$body, path=["uri"], type and defaults=string "") -> (value=w1)
  Match Pattern(regular expression=".*/", string=w1) -> (after substring=w2)
  $id <- w2
