vi "Form Request Delete.gvi"   [LabVIEW NXG 5.0.0]
inputs:
  "ids": string[], required
outputs:
  "request body": string
diagram:
  Property Node(instance in=cluster{"ids": string[]} {all zero or empty}, "ids"=$ids) -> (instance out=w1)
  Flatten To Json(anything=w1) -> (JSON string=w2)
  $"request body" <- w2
