vi "Form Request Query.gvi"   [G Web Development Software 22.0.0]
inputs:
  "filter": "File Filter.gtype", required
outputs:
  "request body": string
types:
  T1 = cluster{"key": string, "operation": string, "value": string}
  "File Filter.gtype" = cluster{"extension query": cluster{"value": string, "operation": string}, "size min query": cluster{"operation": string, "value": i32}, "size max query": cluster{"operation": string, "value": i32}, "created query": cluster{"operation": string, "value": string}, "properties query": T1[]}
uses:
  NI::G Core::Strings::Trim Whitespace.gvi
diagram:
  Property Node(instance in=$filter) -> ("extension query"=w1, "extension query:operation"=w2, "created query"=w3, "created query:operation"=w4, "size min query"=w5, "size min query:operation"=w6, "size max query"=w7, "size max query:operation"=w8, "properties query"=w9)
  Is Empty String Or Path(string/path=w2) -> w10
  case (w10) {
    frame False, Default {
      Flatten To Json(anything=w1) -> (JSON string=w12)
      Concatenate Strings("\"extensionQuery\":", w12) -> w11
    }
    frame True {
      w11 = default
    }
  }
  Is Empty String Or Path(string/path=w4) -> w13
  case (w13) {
    frame False, Default {
      Flatten To Json(anything=w3) -> (JSON string=w15)
      Concatenate Strings("\"createdQuery\":", w15) -> w14
    }
    frame True {
      w14 = default
    }
  }
  Is Empty String Or Path(string/path=w6) -> w16
  case (w16) {
    frame False, Default {
      Flatten To Json(anything=w5) -> (JSON string=w18)
      Concatenate Strings("\"sizeMinQuery\":", w18) -> w17
    }
    frame True {
      w17 = default
    }
  }
  Is Empty String Or Path(string/path=w8) -> w19
  case (w19) {
    frame False, Default {
      Flatten To Json(anything=w7) -> (JSON string=w21)
      Concatenate Strings("\"sizeMaxQuery\":", w21) -> w20
    }
    frame True {
      w20 = default
    }
  }
  Is Empty Array(array=w9) -> w22
  case (w22) {
    frame False, Default {
      Flatten To Json(anything=w9) -> (JSON string=w24)
      Concatenate Strings("\"propertiesQuery\":", w24) -> w23
    }
    frame True {
      w23 = default
    }
  }
  Build Array(w11, w14, w17, w20, w23) -> w25
  for {
    w26 = each element of w25
    # Remove empty elements
    Is Empty String Or Path(string/path=w26) -> w28
    Not(x=w28) -> w29
    append w26 to w27 if w29
  }
  s1 = ""  # shift register
  for {
    w30 = each element of w27
    Concatenate Strings(w30, ",", s1) -> w31
    next s1 = w31
  }
  String Length(string=s1) -> (length=w32)
  # Remove trailing comma (fencepost problem)
  Subtract(x=w32, y=1) -> w33
  String Subset(length (rest)=w33, string=s1) -> w34
  call "Trim Whitespace.gvi"(string=w34) -> (trimmed string=w35)
  # Add brackets
  Concatenate Strings("{", w35, "}") -> w36
  $"request body" <- w36
