vi "Form Request Update Metadata.gvi"   [LabVIEW NXG 5.0.0]
inputs:
  "properties": "Property.gtype"[], required
  "replace existing": bool = TRUE
  "metadata revision": i64
outputs:
  "request body": string
types:
  "Property.gtype" = cluster{"key": string, "value": string}
uses:
  NI::Skyline::JSON::Serialize Properties.gvi
diagram:
  w1 = "{\n    \"replaceExisting\": %s,\n    %s\n     \"properties\": %s  \n}"
  call "Serialize Properties.gvi"(properties=$properties) -> (properties string=w2)
  Select(s=$"replace existing", t="true", f="false") -> w3
  Format Into String(formatString="\"expectedRevision\": %d,", $"metadata revision") -> w4
  Is Equal To 0(x=$"metadata revision") -> w5
  Select(s=w5, t="", f=w4) -> w6
  Format Into String(formatString=w1, w3, w6, w2) -> w7
  $"request body" <- w7
