vi "Form URL Delete.gvi"   [LabVIEW NXG 5.0.0]
inputs:
  "server url": string, required
  "force file deletion?": bool
outputs:
  "url": string
diagram:
  Select(s=$"force file deletion?", t="force=True", f="") -> w1
  Format Into String(formatString="%s/nifile/v1/service-groups/Default/delete-files?%s", $"server url", w1) -> w2
  $url <- w2
