vi "Form URL Query.gvi"   [LabVIEW NXG 5.0.0]
inputs:
  "skip": string
  "take": string
  "server url": string, required
  "workspaces": string[], required
outputs:
  "url": string
diagram:
  Is Empty Array(array=$workspaces) -> w1
  case (w1) {
    frame False, Default {
      s1 = ""  # shift register
      for (iteration -> i1) {
        w3 = each element of $workspaces
        case (i1) {
          frame Default {
            Format Into String(formatString=",%s", initString=s1, w3) -> w4
          }
          frame 0 {
            Format Into String(formatString="workspace=%s", initString=s1, w3) -> w4
          }
        }
        next s1 = w4
      }
      w2 = s1
    }
    frame True {
      w2 = ""
    }
  }
  Is Empty String Or Path(string/path=$skip) -> w5
  case (w5) {
    frame False, Default {
      Format Into String(formatString="skip=%s", $skip) -> w6
    }
    frame True {
      w6 = ""
    }
  }
  Is Empty String Or Path(string/path=$take) -> w7
  case (w7) {
    frame False, Default {
      Format Into String(formatString="take=%s", $take) -> w8
    }
    frame True {
      w8 = ""
    }
  }
  Build Array(w2, w6, w8) -> w9
  s2 = ""  # shift register
  for {
    w10 = each element of w9
    case (s2) {
      frame "" {
        w11 = w10
      }
      frame Default {
        case (w10) {
          frame "" {
            w11 = s2
          }
          frame Default {
            Format Into String(formatString="&%s", initString=s2, w10) -> w11
          }
        }
      }
    }
    next s2 = w11
  }
  Format Into String(formatString="%s/nifile/v1/service-groups/Default/query-files?%s", $"server url", s2) -> w12
  $url <- w12
