vi "Form URL Upload.gvi"   [LabVIEW NXG 5.0.0]
inputs:
  "server url": string, required
  "workspace": string, required
outputs:
  "url": string
diagram:
  case ($workspace) {
    frame "" {
      Format Into String(formatString="%s/nifile/v1/service-groups/Default/upload-files", $"server url") -> w1
    }
    frame Default {
      w2 = "%s/nifile/v1/service-groups/Default/upload-files?workspace=%s"
      Format Into String(formatString=w2, $"server url", $workspace) -> w1
    }
  }
  $url <- w1
