vi "Get File Metadata.gvi"   [G Web Development Software 22.0.0]
inputs:
  "file in": "File.gtype", required
outputs:
  "file out": "File.gtype"
  "id": string
  "metadata": "File Metadata.gtype"
types:
  "Property.gtype" = cluster{"key": string, "value": string}
  "Client Handle.gtype" = u32
  "Configuration.gtype" = cluster{"Server URL": string, "Session": "Client Handle.gtype", "Raw Session Queue": Queue<"Client Handle.gtype">, "Workspace": "Workspace.gtype"}
  "File.gtype" = cluster{"id": string, "workspace id": string, "metadata revision": i64, "created": timestamp, "size": i64, "properties": "Property.gtype"[], "configuration": "Configuration.gtype"}
  "File Metadata.gtype" = cluster{"name": string, "extension": string, "created": timestamp, "size": i64, "workspace id": string, "properties": "Property.gtype"[]}
uses:
  SystemLinkFileExtensions::Get Property Core.gvi
diagram:
  $"file out" <- $"file in"
  Property Node(instance in=$"file in") -> ("id"=w1, "workspace id"=w2, "created"=w3, "size"=w4, "properties"=w5)
  $id <- w1
  call "Get Property Core.gvi"(properties=w5, key="Name") -> (index=w6)
  Array Index(array=w5) -> (out0[w6]=w7)
  Property Node(instance in=w7) -> ("value"=w8)
  Match Pattern(regular expression=".*\\.", string=w8) -> (after substring=w9)
  Property Node(instance in="File Metadata.gtype" {all zero or empty}, "workspace id"=w2, "created"=w3, "size"=w4, "properties"=w5, "name"=w8, "extension"=w9) -> (instance out=w10)
  $metadata <- w10
