vi "Get Property Core.gvi"   [LabVIEW NXG 5.0.0]
inputs:
  "properties": "Property.gtype"[], required
  "key": string, required
outputs:
  "found?": bool
  "index": i32
types:
  "Property.gtype" = cluster{"key": string, "value": string}
diagram:
  for (iteration -> i1) {
    w1 = each element of $properties
    Property Node(instance in=w1) -> ("key"=w2)
    Is Equal(x=$key, y=w2) -> w3
    stop if w3
  }
  $"found?" <- w3
  Select(s=w3, t=i1, f=-1) -> w4
  $index <- w4
