vi "Get Property.gvi"   [G Web Development Software 22.0.0]
# Returns the property value of the file that corresponds to the key.
inputs:
  "file in": "File.gtype", required
  "key": string, required
  "error in": error
outputs:
  "file out": "File.gtype"
  "value": string
  "found?": bool
  "error out": error
types:
  "Property.gtype" = cluster{"key": string, "value": string}
  "Client Handle.gtype" = u32
  "Configuration.gtype" = cluster{"Server URL": string, "Session": "Client Handle.gtype", "Raw Session Queue": Queue<"Client Handle.gtype">, "Workspace": "Workspace.gtype"}
  "File.gtype" = cluster{"id": string, "workspace id": string, "metadata revision": i64, "created": timestamp, "size": i64, "properties": "Property.gtype"[], "configuration": "Configuration.gtype"}
uses:
  SystemLinkFileExtensions::Get Property Core.gvi
diagram:
  $"file out" <- $"file in"
  Property Node(instance in=$"file in") -> ("properties"=w1)
  call "Get Property Core.gvi"(properties=w1, key=$key) -> (found?=w2, index=w3)
  $"found?" <- w2
  case (w2) {
    frame False, Default {
      w4 = default
    }
    frame True {
      Array Index(array=w1) -> (out0[w3]=w5)
      Property Node(instance in=w5) -> ("value"=w4)
    }
  }
  $value <- w4
  $"error out" <- $"error in"
