vi "Get Session Value.gvi"   [G Web Development Software 22.0.0]
inputs:
  "file in": "File.gtype", required
outputs:
  "file out": "File.gtype"
  "session value": u32
types:
  "Property.gtype" = cluster{"key": string, "value": string}
  "Client Handle.gtype" = u32
  "Configuration.gtype" = cluster{"Server URL": string, "Session": "Client Handle.gtype", "Raw Session Queue": Queue<"Client Handle.gtype">, "Workspace": "Workspace.gtype"}
  "File.gtype" = cluster{"id": string, "workspace id": string, "metadata revision": i64, "created": timestamp, "size": i64, "properties": "Property.gtype"[], "configuration": "Configuration.gtype"}
diagram:
  Property Node(instance in=$"file in") -> ("configuration:Session"=w1)
  Type Cast(type=u32 0, x=w1) -> w2
  $"session value" <- w2
  $"file out" <- $"file in"
