vi "Get Version.gvi"   [G Web Development Software 22.0.0]
inputs:
  "configuration": "Configuration.gtype"
  "error in": error
outputs:
  "version": i32
  "error out": error
types:
  "Client Handle.gtype" = u32
  "Workspace.gtype" = cluster{"id": string, "name": string, "archived?": bool, "default?": bool}
  "Configuration.gtype" = cluster{"Server URL": string, "Session": "Client Handle.gtype", "Raw Session Queue": Queue<"Client Handle.gtype">, "Workspace": "Workspace.gtype"}
uses:
  SystemLinkFileExtensions::Form URL Base.gvi
  NI::Skyline::Utilities::Execute HTTP Verb.gvi
  SystemLinkFileExtensions::Parse Version.gvi
diagram:
  s1 = $"error in"  # shift register
  s2 = uninitialised  # shift register
  while {
    Property Node(instance in=$configuration) -> ("Server URL"=w1)
    Is Empty String Or Path(string/path=w1) -> w2
    # Variant attribute names cannot be empty
    Select(s=w2, t="*", f=w1) -> w3
    Get Variant Attribute(default value=0, error in=s1, name=w3, variant=s2) -> (error out=w4, found?=w5, value=w6)
    case (w5) {
      frame False {
        Property Node(instance in=$configuration) -> ("Session"=w10, "Server URL"=w11)
        call "Form URL Base.gvi"(server url=w11) -> (url=w12)
        call "Execute HTTP Verb.gvi"(session=w10, URL=w12, error in=w4, HTTP verb="GET") -> (body=w13, error out=w14)
        call "Parse Version.gvi"(JSON=w13, error in=w14) -> (version=w8, error out=w15)
        Set Variant Attribute(error in=w15, name=w3, value=w8, variant=s2) -> (error out=w7, variant out=w9)
      }
      frame True {
        w7 = w4
        w8 = w6
        w9 = s2
      }
    }
    next s1 = w7
    next s2 = w9
    stop if TRUE
  }
  $version <- w8
  $"error out" <- s1
