vi "Merge Properties Core.gvi"   [G Web Development Software 22.0.0]
# Updates metadata properties of a file after querying the server for the latest values.
# Unlike Update Metadata Properties, Merge Metadata Properties verifies and merges properties according to the latest values available on the server. Therefore, use this VI to safely modify the metadata properties of a file.
# When you use this VI to communicate to a server with SystemLink Server 19.5 or later installed, it provides the safe modification guarantee. However, if you use it with an earlier version of SystemLink Server, it acts similar to Update Metadata Properties.
# This VI only supports an HTTP configuration.
inputs:
  "file in": "File.gtype", required
  "add": "Property.gtype"[]
  "remove": string[]
  "error in": error
  "attempts": i32 = 5
outputs:
  "file out": "File.gtype"
  "error out": error
types:
  "Property.gtype" = cluster{"key": string, "value": string}
  "Client Handle.gtype" = u32
  "Configuration.gtype" = cluster{"Server URL": string, "Session": "Client Handle.gtype", "Raw Session Queue": Queue<"Client Handle.gtype">, "Workspace": "Workspace.gtype"}
  "File.gtype" = cluster{"id": string, "workspace id": string, "metadata revision": i64, "created": timestamp, "size": i64, "properties": "Property.gtype"[], "configuration": "Configuration.gtype"}
uses:
  SystemLinkFileExtensions::Form URL Update Metadata.gvi
  SystemLinkFileExtensions::Set Property Core.gvi
  SystemLinkFileExtensions::Remove Property.gvi
  SystemLinkFileExtensions::Form Request Update Metadata.gvi
  NI::Skyline::Utilities::Execute HTTP Verb.gvi
  NI::G Core::Error::Legacy::Clear Errors.gvi
  SystemLinkFileExtensions::Open File.gvi
diagram:
  case ($"error in") {
    frame No Error {
      Property Node(instance in=$"file in") -> ("configuration:Server URL"=w3, "id"=w4)
      call "Form URL Update Metadata.gvi"(server url=w3, id=w4) -> (url=w5)
      s1 = $"file in"  # shift register
      for (N = $attempts) {
        in-place {
          Unbundle Bundle Read Poser() -> ("properties"=w6)
          s2 = w6  # shift register
          for {
            w7 = each element of $add
            Property Node(instance in=w7) -> ("key"=w8, "value"=w9)
            call "Set Property Core.gvi"(properties in=s2, key=w8, value=w9) -> (properties out=w10)
            next s2 = w10
          }
          s3 = s2  # shift register
          for {
            w11 = each element of $remove
            call "Remove Property.gvi"(properties in=s3, key=w11) -> (properties out=w12)
            next s3 = w12
          }
          Unbundle Bundle Write Poser("properties"=s3)
        }
        Property Node(instance in=w13) -> ("properties"=w14, "metadata revision"=w15, "configuration:Session"=w16)
        call "Form Request Update Metadata.gvi"(properties=w14, replace existing=TRUE, metadata revision=w15) -> (request body=w17)
        call "Execute HTTP Verb.gvi"(session=w16, URL=w5, buffer=w17, error in=$"error in", HTTP verb="POST") -> (error out=w18)
        case (w18) {
          frame No Error {
            w1 = w18
            w19 = w13
            w20 = TRUE
          }
          frame Error {
            Wait(time to wait=100)
            # Metadata revision mismatch
            Property Node(instance in=w13) -> ("configuration"=w21, "id"=w22)
            call "Clear Errors.gvi"(specific error code to clear=-251632, error in=w18) -> (error out=w23)
            # Stop if open fails
            call "Open File.gvi"(file id=w22, error in=w23, configuration=w21) -> (file=w24, error out=w25)
            Select(s=w25, t=w13, f=w24) -> w19
            # Return the last error
            Merge Errors(w25, w18) -> (error out=w1)
            Property Node(instance in=w25) -> ("status"=w20)
          }
        }
        next s1 = w19
        stop if w20
      }
      w2 = s1
    }
    frame Error {
      w1 = $"error in"
      w2 = $"file in"
    }
  }
  $"file out" <- w2
  $"error out" <- w1
