vi "Open File.gvi"   [G Web Development Software 22.0.0]
# Opens a reference to an existing file on the Skyline file service defined by the given configuration.
inputs:
  "file id": string, required
  "error in": error
  "configuration": "Configuration.gtype"
outputs:
  "file": "File.gtype"
  "error out": error
types:
  "Client Handle.gtype" = u32
  "Workspace.gtype" = cluster{"id": string, "name": string, "archived?": bool, "default?": bool}
  "Configuration.gtype" = cluster{"Server URL": string, "Session": "Client Handle.gtype", "Raw Session Queue": Queue<"Client Handle.gtype">, "Workspace": "Workspace.gtype"}
  "Property.gtype" = cluster{"key": string, "value": string}
  "File.gtype" = cluster{"id": string, "workspace id": string, "metadata revision": i64, "created": timestamp, "size": i64, "properties": "Property.gtype"[], "configuration": "Configuration.gtype"}
uses:
  SystemLinkFileExtensions::Form URL Query.gvi
  SystemLinkFileExtensions::Form Request Open.gvi
  NI::Skyline::Utilities::Execute HTTP Verb.gvi
  SystemLinkFileExtensions::Parse Files.gvi
  NI::G Core::Error::Legacy::Error Cluster From Error Code.gvi
diagram:
  # Don't pass specified workspace for opening an existing file specified by id. file id is unique across all workspaces.
  Property Node(instance in=$configuration) -> ("Session"=w1, "Server URL"=w2)
  call "Form URL Query.gvi"(server url=w2, workspaces=string[] []) -> (url=w3)
  call "Form Request Open.gvi"(id=$"file id") -> (request body=w4)
  call "Execute HTTP Verb.gvi"(session=w1, URL=w3, buffer=w4, error in=$"error in", HTTP verb="POST") -> (body=w5, error out=w6)
  call "Parse Files.gvi"(JSON=w5, configuration=$configuration, error in=w6) -> (files=w7, total count=w8, error out=w9)
  Is Equal To 0(x=w8) -> w10
  case (w10) {
    frame False, Default {
      Array Index(array=w7) -> (out0[0]=w12)
      w11 = w9
    }
    frame True {
      Format Into String(formatString="-251608: File with id '%s' not found.", $"file id") -> w13
      call "Error Cluster From Error Code.gvi"(error code=-251608, error message=w13, show call chain?=TRUE, is warning?=FALSE) -> (error out=w14)
      Merge Errors(w9, w14) -> (error out=w11)
      w12 = default
    }
  }
  $"error out" <- w11
  $file <- w12
