vi "Parse Files.gvi"   [G Web Development Software 22.0.0]
# Parses the query files JSON response into an array of file objects
inputs:
  "JSON": string, required
  "configuration": "Configuration.gtype", required
  "error in": error
outputs:
  "files": "File.gtype"[]
  "total count": u32
  "error out": error
types:
  "Client Handle.gtype" = u32
  "Workspace.gtype" = cluster{"id": string, "name": string, "archived?": bool, "default?": bool}
  "Configuration.gtype" = cluster{"Server URL": string, "Session": "Client Handle.gtype", "Raw Session Queue": Queue<"Client Handle.gtype">, "Workspace": "Workspace.gtype"}
  "Property.gtype" = cluster{"key": string, "value": string}
  "File.gtype" = cluster{"id": string, "workspace id": string, "metadata revision": i64, "created": timestamp, "size": i64, "properties": "Property.gtype"[], "configuration": "Configuration.gtype"}
  T1 = cluster{"created": string, "id": string, "size64": i64, "metaDataRevision": i64}
  T2 = cluster{"availableFiles": T1[], "totalCount": u32}
  T3 = cluster{"created": string, "id": string, "size64": i64, "metaDataRevision": i64, "workspace": string}
  T4 = cluster{"availableFiles": T3[], "totalCount": u32}
  T5 = cluster{"created": string, "id": string, "size64": i64}
  T6 = cluster{"availableFiles": T5[], "totalCount": u32}
  T7 = cluster{"created": string, "id": string, "size64": i64, "workspace": string}
  T8 = cluster{"availableFiles": T7[], "totalCount": u32}
uses:
  NI::Skyline::JSON::Find Object Element.gvi
  NI::Skyline::JSON::Find Next Array Element.gvi
  NI::Skyline::Utilities::Posix String to Timestamp.gvi
  NI::Skyline::JSON::Unflatten Dictionary From JSON.gvi
diagram:
  call "Find Object Element.gvi"(JSON in=$JSON, element name="availableFiles", error in=$"error in") -> (JSON out=w1, value start=w2, error out=w3)
  call "Find Next Array Element.gvi"(JSON in=w1, offset=w2) -> (JSON out=w4, value start=w5)
  call "Find Object Element.gvi"(JSON in=w4, element name="metaDataRevision", object offset=w5, error in=w3) -> (JSON out=w6, value start=w7, error out=w8)
  call "Find Object Element.gvi"(JSON in=w6, element name="workspace", object offset=w5, error in=w8) -> (JSON out=w9, value start=w10, error out=w11)
  Is Less Than 0(x=w7) -> w12
  case (w12) {
    frame False {
      Is Less Than 0(x=w10) -> w16
      # Parse V2, which has a metadata revision.
      case (w16) {
        frame True {
          Unflatten From Json(JSON string=w9, error in (no error)=w11, type and defaults=T2 {all zero or empty}) -> (error out=w14, value=w17)
          Property Node(instance in=w17) -> ("availableFiles"=w18, "totalCount"=w15)
          # Parse JSON, which doesn't have a workspace.
          for {
            w19 = each element of w18
            Property Node(instance in=w19) -> ("created"=w20, "metaDataRevision"=w21, "id"=w22, "size64"=w23)
            call "Posix String to Timestamp.gvi"(posix time string=w20) -> (time stamp=w24)
            Property Node(instance in="File.gtype" {all zero or empty}, "configuration"=$configuration, "created"=w24, "metadata revision"=w21, "id"=w22, "size"=w23) -> (instance out=w25)
            append w25 to w13
          }
        }
        frame False {
          Unflatten From Json(JSON string=w9, error in (no error)=w11, type and defaults=T4 {all zero or empty}) -> (error out=w14, value=w26)
          Property Node(instance in=w26) -> ("availableFiles"=w27, "totalCount"=w15)
          # Parse JSON, which has a workspace.
          for {
            w28 = each element of w27
            Property Node(instance in=w28) -> ("created"=w29, "metaDataRevision"=w30, "id"=w31, "size64"=w32, "workspace"=w33)
            call "Posix String to Timestamp.gvi"(posix time string=w29) -> (time stamp=w34)
            Property Node(instance in="File.gtype" {all zero or empty}, "configuration"=$configuration, "created"=w34, "metadata revision"=w30, "id"=w31, "size"=w32, "workspace id"=w33) -> (instance out=w35)
            append w35 to w13
          }
        }
      }
    }
    frame True {
      Is Less Than 0(x=w10) -> w36
      # Parse V1, which doesn't have a metadata revision.
      case (w36) {
        frame True {
          Unflatten From Json(JSON string=w9, error in (no error)=w11, type and defaults=T6 {all zero or empty}) -> (error out=w14, value=w37)
          Property Node(instance in=w37) -> ("availableFiles"=w38, "totalCount"=w15)
          # Parse JSON, which doesn't have a workspace.
          for {
            w39 = each element of w38
            Property Node(instance in=w39) -> ("created"=w40, "id"=w41, "size64"=w42)
            call "Posix String to Timestamp.gvi"(posix time string=w40) -> (time stamp=w43)
            Property Node(instance in="File.gtype" {all zero or empty}, "configuration"=$configuration, "created"=w43, "id"=w41, "size"=w42) -> (instance out=w44)
            append w44 to w13
          }
        }
        frame False {
          Unflatten From Json(JSON string=w9, error in (no error)=w11, type and defaults=T8 {all zero or empty}) -> (error out=w14, value=w45)
          Property Node(instance in=w45) -> ("availableFiles"=w46, "totalCount"=w15)
          # Parse JSON, which has a workspace.
          for {
            w47 = each element of w46
            Property Node(instance in=w47) -> ("created"=w48, "id"=w49, "size64"=w50, "workspace"=w51)
            call "Posix String to Timestamp.gvi"(posix time string=w48) -> (time stamp=w52)
            Property Node(instance in="File.gtype" {all zero or empty}, "configuration"=$configuration, "created"=w52, "id"=w49, "size"=w50, "workspace id"=w51) -> (instance out=w53)
            append w53 to w13
          }
        }
      }
    }
  }
  $"total count" <- w15
  # Separately pull out the property dictionaries, as unflatten from JSON cannot parse arbitrary property dictionaries.
  s1 = w2  # shift register
  s2 = w14  # shift register
  for {
    w54 = each element of w13
    call "Find Next Array Element.gvi"(JSON in=w9, offset=s1) -> (JSON out=w56, value start=w57, offset past element=w58)
    call "Find Object Element.gvi"(JSON in=w56, element name="properties", object offset=w57, error in=s2) -> (JSON out=w59, value start=w60, error out=w61, value is null?=w62)
    case (w62) {
      frame False, Default {
        call "Unflatten Dictionary From JSON.gvi"(JSON in=w59, offset=w60, error in=w61) -> (properties=w65, error out=w64)
        Property Node(instance in=w54, "properties"=w65) -> (instance out=w63)
      }
      frame True {
        w63 = w54
        w64 = w61
      }
    }
    append w63 to w55
    next s1 = w58
    next s2 = w64
  }
  $files <- w55
  $"error out" <- s2
