vi "Query Files.gvi"   [G Web Development Software 22.0.0]
# Queries the Skyline file service defined by configuration for files matching filter. If no filter is provided, opens references to every file on the service. The Skyline file service limits the maximum number of results that a single query can return at once.
# limit to configured workspace? determines whether this VI queries only for files in the workspace you specify in configuration. By default, the VI queries for files from all accessible workspaces.
# The skip and take parameters can be used to limit the number of files returned from the SystemLink server. If no values are provided the query will return the first 1000 results by default.
inputs:
  "skip": i32
  "take": i32 = 1000
  "filter in": "File Filter.gtype"
  "error in": error
  "configuration": "Configuration.gtype"
  "limit to configured workspace?": bool
outputs:
  "files": "File.gtype"[]
  "error out": error
types:
  "Property.gtype" = cluster{"key": string, "value": string}
  "Client Handle.gtype" = u32
  "Configuration.gtype" = cluster{"Server URL": string, "Session": "Client Handle.gtype", "Raw Session Queue": Queue<"Client Handle.gtype">, "Workspace": "Workspace.gtype"}
  "File.gtype" = cluster{"id": string, "workspace id": string, "metadata revision": i64, "created": timestamp, "size": i64, "properties": "Property.gtype"[], "configuration": "Configuration.gtype"}
  T1 = cluster{"key": string, "operation": string, "value": string}
  "File Filter.gtype" = cluster{"extension query": cluster{"value": string, "operation": string}, "size min query": cluster{"operation": string, "value": i32}, "size max query": cluster{"operation": string, "value": i32}, "created query": cluster{"operation": string, "value": string}, "properties query": T1[]}
uses:
  SystemLinkFileExtensions::Build Workspace Filter.gvi
  SystemLinkFileExtensions::Form URL Query.gvi
  SystemLinkFileExtensions::Form Request Query.gvi
  NI::Skyline::Utilities::Execute HTTP Verb.gvi
  SystemLinkFileExtensions::Parse Files.gvi
diagram:
  Property Node(instance in=$configuration) -> ("Session"=w1, "Server URL"=w2)
  call "Build Workspace Filter.gvi"(configuration=$configuration, limit to configured workspace?=$"limit to configured workspace?", error in=$"error in") -> (filter=w3, error out=w4)
  Number To Decimal String(number=$skip) -> (decimal integer string=w5)
  Number To Decimal String(number=$take) -> (decimal integer string=w6)
  call "Form URL Query.gvi"(skip=w5, take=w6, server url=w2, workspaces=w3) -> (url=w7)
  call "Form Request Query.gvi"(filter=$"filter in") -> (request body=w8)
  call "Execute HTTP Verb.gvi"(session=w1, URL=w7, buffer=w8, error in=w4, HTTP verb="POST") -> (body=w9, error out=w10)
  call "Parse Files.gvi"(JSON=w9, configuration=$configuration, error in=w10) -> (files=w11, error out=w12)
  $files <- w11
  $"error out" <- w12
