vi "Remove Property.gvi"   [LabVIEW NXG 5.0.0]
inputs:
  "properties in": "Property.gtype"[], required
  "key": string, required
outputs:
  "properties out": "Property.gtype"[]
types:
  "Property.gtype" = cluster{"key": string, "value": string}
diagram:
  s1 = $"properties in"  # shift register
  for (iteration -> i1) {
    w1 = each element of $"properties in"
    Property Node(instance in=w1) -> ("key"=w2)
    Is Equal(x=w2, y=$key) -> w3
    case (w3) {
      frame False, Default {
        w4 = s1
        w5 = default
      }
      frame True {
        Delete From Array(inArray=s1, length (1)=1, index0=i1) -> w4
        w5 = TRUE
      }
    }
    next s1 = w4
    stop if w5
  }
  $"properties out" <- s1
