vi "Send File (Path).gvi"   [G Web Development Software 22.0.0]
# Send a local file to the Skyline file service defined by configuration. Metadata properties can be specified to be set when the file is created on the Skyline file service. The number of milliseconds to wait before a timeout error is generated is configurable with timeout.
inputs:
  "timeout": i32 = 60000
  "path": path, required
  "properties": "Property.gtype"[]
  "error in": error
  "configuration": "Configuration.gtype"
outputs:
  "id": string
  "error out": error
types:
  "Property.gtype" = cluster{"key": string, "value": string}
  "Client Handle.gtype" = u32
  "Workspace.gtype" = cluster{"id": string, "name": string, "archived?": bool, "default?": bool}
  "Configuration.gtype" = cluster{"Server URL": string, "Session": "Client Handle.gtype", "Raw Session Queue": Queue<"Client Handle.gtype">, "Workspace": "Workspace.gtype"}
  "Multipart Data.gtype" = cluster{"Name": string, "Value": string, "File": path, "Filename": string, "MIME type": string}
uses:
  SystemLinkFileExtensions::Send File Core.gvi
diagram:
  Strip Path(path=$path) -> (name=w1)
  w2 = "Multipart Data.gtype" {"Name"="", "Value"="", "File"=path "", "Filename"="", "MIME type"="application/octet-stream"}
  Property Node(instance in=w2, "MIME type"="application/octet-stream", "File"=$path, "Name"=w1, "Filename"=w1) -> (instance out=w3)
  call "Send File Core.gvi"(timeout=$timeout, file part=w3, properties=$properties, error in=$"error in", configuration=$configuration) -> (id=w4, error out=w5)
  $id <- w4
  $"error out" <- w5
