vi "Send File Ex (File).gvi"   [G Web Development Software 22.0.0]
# Send a local file to the Skyline file service defined by configuration. Metadata properties can be specified to be set when the file is created on the Skyline file service. The number of milliseconds to wait before a timeout error is generated is configurable with timeout.
inputs:
  "file": "NI.JavaScriptReference", required
  "timeout": i32 = 60000
  "properties": "Property.gtype"[]
  "error in": error
  "configuration": "Configuration.gtype"
outputs:
  "id": string
  "error out": error
types:
  "Property.gtype" = cluster{"key": string, "value": string}
  "Client Handle.gtype" = u32
  "Workspace.gtype" = cluster{"id": string, "name": string, "archived?": bool, "default?": bool}
  "Configuration.gtype" = cluster{"Server URL": string, "Session": "Client Handle.gtype", "Raw Session Queue": Queue<"Client Handle.gtype">, "Workspace": "Workspace.gtype"}
  "Multipart Data Ext.gtype" = cluster{"Name": string, "Value": string, "File": "NI.JavaScriptReference", "Filename": string, "MIME type": string}
uses:
  File::Get File Metadata.gvi
  SystemLinkFileExtensions::Support::Send File Core.gvi
diagram:
  call "Get File Metadata.gvi"(file reference in=$file, error in=$"error in") -> (file reference out=w1, file name=w2, error out=w3)
  w4 = "Multipart Data Ext.gtype" {"Name"="", "Value"="", "File"=refnum, "Filename"="", "MIME type"="application/octet-stream"}
  Property Node(instance in=w4, "MIME type"="application/octet-stream", "File"=w1, "Name"=w2, "Filename"=w2) -> (instance out=w5)
  call "Send File Core.gvi"(timeout=$timeout, file part=w5, properties=$properties, error in=w3, configuration=$configuration) -> (id=w6, error out=w7)
  $id <- w6
  $"error out" <- w7
