vi "Set Property Core.gvi"   [G Web Development Software 22.0.0]
inputs:
  "properties in": "Property.gtype"[], required
  "key": string, required
  "value": string, required
outputs:
  "properties out": "Property.gtype"[]
types:
  "Property.gtype" = cluster{"key": string, "value": string}
uses:
  SystemLinkFileExtensions::Get Property Core.gvi
diagram:
  call "Get Property Core.gvi"(properties=$"properties in", key=$key) -> (found?=w1, index=w2)
  case (w1) {
    frame False, Default {
      Property Node(instance in="Property.gtype" {all zero or empty}, "key"=$key, "value"=$value) -> (instance out=w4)
      Insert Into Array(inArray=$"properties in", new=w4) -> w3
    }
    frame True {
      in-place {
        Array Index Replace Read Poser(array=$"properties in") -> (out0[w2]=w5)
        Property Node(instance in=w5, "value"=$value) -> (instance out=w6)
        Array Index Replace Write Poser(_, in=w6) -> (array=w3)
      }
    }
  }
  $"properties out" <- w3
