vi "Set Property.gvi"   [G Web Development Software 22.0.0]
# Writes the property value of the file that corresponds to the key and creates the property if it does not exist.
# You must wire this VI to Update Metadata Properties to reflect the updates on the SystemLink file service.
inputs:
  "file in": "File.gtype", required
  "key": string, required
  "value": string, required
  "error in": error
outputs:
  "file out": "File.gtype"
  "error out": error
types:
  "Property.gtype" = cluster{"key": string, "value": string}
  "Client Handle.gtype" = u32
  "Configuration.gtype" = cluster{"Server URL": string, "Session": "Client Handle.gtype", "Raw Session Queue": Queue<"Client Handle.gtype">, "Workspace": "Workspace.gtype"}
  "File.gtype" = cluster{"id": string, "workspace id": string, "metadata revision": i64, "created": timestamp, "size": i64, "properties": "Property.gtype"[], "configuration": "Configuration.gtype"}
uses:
  SystemLinkFileExtensions::Set Property Core.gvi
diagram:
  case ($"error in") {
    frame No Error {
      in-place {
        Unbundle Bundle Read Poser() -> ("properties"=w3)
        call "Set Property Core.gvi"(properties in=w3, key=$key, value=$value) -> (properties out=w4)
        Unbundle Bundle Write Poser("properties"=w4)
      }
      w2 = $"error in"
    }
    frame Error {
      w1 = $"file in"
      w2 = $"error in"
    }
  }
  $"error out" <- w2
  $"file out" <- w1
