vi "Sort By Session.gvi"   [G Web Development Software 22.0.0]
inputs:
  "file clusters": "File.gtype"[], required
  "error in": error
outputs:
  "sorted file clusters": cluster{"file clusters": "File.gtype"[]}[]
  "error out": error
types:
  "File.gtype" = cluster{"id": string, "workspace id": string, "metadata revision": i64, "created": timestamp, "size": i64, "properties": "Property.gtype"[], "configuration": "Configuration.gtype"}
  T1 = cluster{"session value": u32, "Element 2": i32, "file out": "File.gtype"}
uses:
  SystemLinkFileExtensions::Get Session Value.gvi
diagram:
  case ($"error in") {
    frame No Error {
      Is Empty Array(array=$"file clusters") -> w3
      case (w3) {
        frame False, Default {
          Array Size(array=$"file clusters") -> (size(s)=w4)
          Array Index(array=$"file clusters") -> (out0[_]=w5)
          call "Get Session Value.gvi"(file in=w5) -> (session value=w6)
          s1 = $"file clusters"  # shift register
          for (N = w4) (iteration -> i1) {
            Array Index(array=s1) -> (out0[i1]=w7)
            call "Get Session Value.gvi"(file in=w7) -> (session value=w8)
            Is Not Equal(x=w8, y=w6) -> w9
            stop if w9
          }
          # Optimization for the common case (array of a single configuration). This is about 5 times faster than going through the array sort + split.
          case (w9) {
            frame False, Default {
              Property Node(instance in=cluster{"file clusters": "File.gtype"[]} {all zero or empty}, "file clusters"=s1) -> (instance out=w11)
              # Common case, a single array of tags.
              Build Array(w11) -> w10
              w1 = $"error in"
            }
            frame True {
              for (iteration -> i2) {
                w12 = each element of s1
                call "Get Session Value.gvi"(file in=w12) -> (file out=w14, session value=w15)
                Property Node(instance in=T1 {all zero or empty}, "session value"=w15, "Element 2"=i2, "file out"=w14) -> (instance out=w16)
                append w16 to w13
              }
              # Partition the array based on configuration by sorting and looking for changes in the HTTP session.
              Sort 1D Array(array=w13) -> (sorted array=w17)
              Array Index(array=w17) -> (out0[_]=w18)
              Property Node(instance in=w18) -> ("session value"=w19)
              s2 = w19  # shift register
              for (iteration -> i3) {
                w20 = each element of w13
                Property Node(instance in=w20) -> ("session value"=w23, "file out"=w24)
                Is Not Equal(x=s2, y=w23) -> w25
                append w24 to w21
                append i3 to w22 if w25
                next s2 = w23
              }
              Array Size(array=w21) -> (size(s)=w26)
              Reverse 1D Array(array=w22) -> (reversed array=w27)
              Build Array(w27, 0) -> w28
              s3 = w21  # shift register
              s4 = $"error in"  # shift register
              for {
                w29 = each element of w28
                Subtract(x=w26, y=w29) -> w30
                Delete From Array(inArray=s3, length (1)=w30, index0=w29) -> (outArray=w31, deleted=w32)
                # "Break off" the end of the array.
                w33 = cluster{"file clusters 2": "File.gtype"[]} {all zero or empty}
                Property Node(instance in=w33, "file clusters 2"=w32) -> (instance out=w34)
                append w34 to w10
                next s3 = w31
              }
              w1 = s4
            }
          }
          Coerce To Type(type=cluster{"file clusters 2": "File.gtype"[]}[] [], x=w10) -> w2
        }
        frame True {
          w1 = $"error in"
          w2 = default
        }
      }
    }
    frame Error {
      w1 = $"error in"
      w2 = default
    }
  }
  $"error out" <- w1
  $"sorted file clusters" <- w2
