vi "Execute HTTP Multipart POST.gvi"   [G Web Development Software 22.3.0]
# Executes the HTTP verb (GET, PUT, POST, DELETE) on the web service URL.  The input buffer can be provided as the HTTP request body.  On successful completion, the HTTP response body is returned.
inputs:
  "timeout": i32 = 10000  # timeout specifies the amount of time in milliseconds to wait for a response from the server before the Web request times out. The default value is 10000 ms. A value of -1 defers timeout monitoring to the operating system.
  "URL": string, required
  "data": "Multipart Data Ext.gtype"[], required  # data is the array of clusters specifying the data attributes and values to submit to the server. The POSTMultipart VI determines which data format to accept from the client and which format to send the data to the server based upon the controls specified within data.
  "error in": error
  "configuration": "Configuration.gtype"
outputs:
  "body": string
  "error out": error
types:
  "Client Handle.gtype" = u32
  "Workspace.gtype" = cluster{"id": string, "name": string, "archived?": bool, "default?": bool}
  "Configuration.gtype" = cluster{"Server URL": string, "Session": "Client Handle.gtype", "Raw Session Queue": Queue<"Client Handle.gtype">, "Workspace": "Workspace.gtype"}
  "Multipart Data Ext.gtype" = cluster{"Name": string, "Value": string, "File": "NI.JavaScriptReference", "Filename": string, "MIME type": string}
uses:
  NI::Skyline::Configuration::Open Default Configuration.gvi
  NI::Skyline::Configuration::Check Out Session.gvi
  HTTPExtensions::POST::POST Multipart Ext - String.gvi
  NI::Skyline::Configuration::Check In Session.gvi
  NI::Skyline::Utilities::Parse HTTP Error.gvi
  NI::Skyline::Configuration::Close Default Configuration.gvi
diagram:
  Property Node(instance in=$configuration) -> ("Raw Session Queue"=w1)
  Is Not A Number Or Path Or Refnum(number=w1) -> w2
  # This VI has an NXG substitution that will need to update if modified.
  case (w2) {
    frame False, Default {
      w3 = $"error in"
      w4 = $configuration
      w5 = $URL
      w6 = default
      w7 = default
    }
    frame True {
      call "Open Default Configuration.gvi"(error in=$"error in") -> (configuration=w7, error out=w3)
      Property Node(instance in=w7) -> ("configuration"=w4, "configuration:Server URL"=w8)
      Concatenate Strings(w8, $URL) -> w5
      w6 = TRUE
    }
  }
  call "Check Out Session.gvi"(configuration in=w4, error in=w3) -> (configuration out=w9, raw session=w10, error out=w11)
  call "POST Multipart Ext - String.gvi"(timeout=$timeout, client handle=w10, url=w5, data=$data, error in=w11) -> (status code=w12, client handle out=w13, body=w14, error out=w15)
  $body <- w14
  call "Check In Session.gvi"(configuration in=w9, raw session=w13, error in=w15) -> (error out=w16)
  call "Parse HTTP Error.gvi"(status code=w12, body=w14, URL=w5, error in=w16) -> (error out=w17)
  case (w6) {
    frame False, Default {
      w18 = w17
    }
    frame True {
      call "Close Default Configuration.gvi"(configuration=w7, error in=w17) -> (error out=w18)
    }
  }
  $"error out" <- w18
