vi "Execute HTTP Verb.gvi"   [G Web Development Software 22.3.0]
# Executes the HTTP verb (GET, PUT, POST, DELETE) on the web service URL.  The input buffer can be provided as the HTTP request body.  On successful completion, the HTTP response body is returned.
inputs:
  "timeout": i32 = 10000  # timeout specifies the amount of time in milliseconds to wait for a response from the server before the Web request times out. The default value is 10000 ms. A value of -1 defers timeout monitoring to the operating system.
  "session": "Client Handle.gtype", required
  "URL": string, required
  "error in": error
outputs:
  "body": "NI.JavaScriptReference"
  "error out": error
types:
  "Client Handle.gtype" = u32
uses:
  NI::Skyline::Configuration::Open Default Configuration.gvi
  HTTPExtensions::GET::GET Ext - File.gvi
  File::Read File.gvi
  NI::Skyline::Utilities::Parse HTTP Error.gvi
  NI::Skyline::Configuration::Close Default Configuration.gvi
diagram:
  Is Equal(x=$session, y=0) -> w1
  case (w1) {
    frame False, Default {
      w2 = $"error in"
      w3 = $session
      w4 = $URL
      w5 = default
      w6 = default
    }
    frame True {
      call "Open Default Configuration.gvi"(error in=$"error in") -> (configuration=w5, error out=w2)
      Property Node(instance in=w5) -> ("configuration:Session"=w3, "configuration:Server URL"=w7)
      Concatenate Strings(w7, $URL) -> w4
      w6 = TRUE
    }
  }
  call "GET Ext - File.gvi"(timeout=$timeout, client handle=w3, url=w4, error in=w2) -> (status code=w8, body=w9, error out=w10)
  case (w8) {
    frame 200..299 {
      w11 = w10
      w12 = w9
    }
    frame Default {
      call "Read File.gvi"(file reference in=w9, error in=w10) -> (file reference out=w13, file contents=w14, error out=w15)
      Byte Array To String(error in=w15, unsigned byte array=w14) -> (error out=w16, string=w17)
      Close Reference(error in=w16, reference=w13) -> (error out=w18)
      call "Parse HTTP Error.gvi"(status code=w8, body=w17, URL=w4, error in=w18) -> (error out=w19)
      case (w6) {
        frame False, Default {
          w11 = w19
        }
        frame True {
          call "Close Default Configuration.gvi"(configuration=w5, error in=w19) -> (error out=w11)
        }
      }
      w12 = "NI.JavaScriptReference" constant
    }
  }
  $body <- w12
  $"error out" <- w11
