vi "Send File Core.gvi"   [G Web Development Software 22.0.0]
inputs:
  "timeout": i32
  "file part": "Multipart Data Ext.gtype", required
  "properties": "Property.gtype"[]
  "error in": error
  "configuration": "Configuration.gtype", required
outputs:
  "id": string
  "error out": error
types:
  "Multipart Data Ext.gtype" = cluster{"Name": string, "Value": string, "File": "NI.JavaScriptReference", "Filename": string, "MIME type": string}
  "Client Handle.gtype" = u32
  "Workspace.gtype" = cluster{"id": string, "name": string, "archived?": bool, "default?": bool}
  "Configuration.gtype" = cluster{"Server URL": string, "Session": "Client Handle.gtype", "Raw Session Queue": Queue<"Client Handle.gtype">, "Workspace": "Workspace.gtype"}
  "Property.gtype" = cluster{"key": string, "value": string}
  "File.gtype" = cluster{"id": string, "workspace id": string, "metadata revision": i64, "created": timestamp, "size": i64, "properties": "Property.gtype"[], "configuration": "Configuration.gtype"}
uses:
  NI::Skyline::File::Set Property Core.gvi
  NI::Skyline::Utilities::Get Minion ID.gvi
  NI::Skyline::File::Form URL Upload.gvi
  NI::Skyline::File::Get Version.gvi
  SystemLinkFileExtensions::Support::Execute HTTP Multipart POST.gvi
  NI::Skyline::File::Extract ID From Upload Response.gvi
  NI::Skyline::File::Update Metadata Properties (Single).gvi
  NI::Skyline::JSON::Serialize Properties.gvi
diagram:
  Property Node(instance in=$"file part") -> ("Filename"=w1)
  call "Set Property Core.gvi"(properties in=$properties, key="Name", value=w1) -> (properties out=w2)
  disable {
    frame TARGET_TYPE == "WebServer" {
      # CHANGE: remove minion id for WebVIs
      w3 = w2
    }
    frame 1, Default {
      call "Get Minion ID.gvi"() -> (minion id=w4)
      Is Empty String Or Path(string/path=w4) -> w5
      case (w5) {
        frame False, Default {
          call "Set Property Core.gvi"(properties in=w2, key="minionId", value=w4) -> (properties out=w3)
        }
        frame True {
          w3 = w2
        }
      }
    }
  }
  Property Node(instance in=$configuration) -> ("Server URL"=w6, "Workspace:id"=w7)
  call "Form URL Upload.gvi"(server url=w6, workspace=w7) -> (url=w8)
  call "Get Version.gvi"(configuration=$configuration, error in=$"error in") -> (version=w9, error out=w10)
  case (w9) {
    frame ..1 {
      Build Array($"file part") -> w13
      call "Execute HTTP Multipart POST.gvi"(timeout=$timeout, URL=w8, data=w13, error in=w10, configuration=$configuration) -> (body=w14, error out=w15)
      call "Extract ID From Upload Response.gvi"(body=w14) -> (id=w11)
      # V1 API requires setting the properties in a separate request.
      Property Node(instance in="File.gtype" {all zero or empty}, "properties"=w3, "configuration"=$configuration, "id"=w11) -> (instance out=w16)
      call "Update Metadata Properties (Single).gvi"(file in=w16, error in=w15) -> (error out=w12)
    }
    frame 2.. {
      # V2 API supports sending file metadata as a second part in the same POST.
      w17 = "Multipart Data Ext.gtype" {"Name"="", "Value"="", "File"=refnum, "Filename"="", "MIME type"="application/octet-stream"}
      call "Serialize Properties.gvi"(properties=w3) -> (properties string=w18)
      Property Node(instance in=w17, "MIME type"="application/json", "Name"="metadata", "Value"=w18) -> (instance out=w19)
      Build Array(w19, $"file part") -> w20
      call "Execute HTTP Multipart POST.gvi"(timeout=$timeout, URL=w8, data=w20, error in=w10, configuration=$configuration) -> (body=w21, error out=w12)
      call "Extract ID From Upload Response.gvi"(body=w21) -> (id=w11)
    }
  }
  $id <- w11
  $"error out" <- w12
