vi "Sort By Session.gvi"   [G Web Development Software 22.0.0]
inputs:
  "file clusters": "File.gtype"[], required
  "error in": error
outputs:
  "sorted file clusters": cluster{"file clusters": "File.gtype"[]}[]
  "error out": error
types:
  "File.gtype" = cluster{"id": string, "workspace id": string, "metadata revision": i64, "created": timestamp, "size": i64, "properties": "Property.gtype"[], "configuration": "Configuration.gtype"}
  T1 = cluster{"session value": u32, "Element 2": i32, "file out": "File.gtype"}
uses:
  SystemLinkFileExtensions::Support::Get Session Value.gvi
diagram:
  case ($"error in") {
    frame No Error {
      Is Empty Array(array=$"file clusters") -> w3
      case (w3) {
        frame False, Default {
          Array Size(array=$"file clusters") -> (size(s)=w4)
          Array Index(array=$"file clusters") -> (out0[_]=w5)
          call "Get Session Value.gvi"(file in=w5) -> (session value=w6)
          s1 = $"file clusters"  # shift register
          for (N = w4) (iteration -> i1) {
            Array Index(array=s1) -> (out0[i1]=w7)
            call "Get Session Value.gvi"(file in=w7) -> (session value=w8)
            Is Not Equal(x=w8, y=w6) -> w9
            stop if w9
          }
          # CHANGE: removed explicit coercion
          # Optimization for the common case (array of a single configuration). This is about 5 times faster than going through the array sort + split.
          case (w9) {
            frame False, Default {
              Property Node(instance in=cluster{"file clusters": "File.gtype"[]} {all zero or empty}, "file clusters"=s1) -> (instance out=w10)
              # Common case, a single array of tags.
              Build Array(w10) -> w2
              w1 = $"error in"
            }
            frame True {
              # Partition the array based on configuration by sorting and looking for changes in the HTTP session.
              for (iteration -> i2) {
                w11 = each element of s1
                call "Get Session Value.gvi"(file in=w11) -> (file out=w13, session value=w14)
                Property Node(instance in=T1 {all zero or empty}, "session value"=w14, "Element 2"=i2, "file out"=w13) -> (instance out=w15)
                append w15 to w12
              }
              Sort 1D Array(array=w12) -> (sorted array=w16)
              Array Index(array=w16) -> (out0[_]=w17)
              Property Node(instance in=w17) -> ("session value"=w18)
              s2 = w18  # shift register
              for (iteration -> i3) {
                w19 = each element of w12
                Property Node(instance in=w19) -> ("session value"=w22, "file out"=w23)
                Is Not Equal(x=s2, y=w22) -> w24
                append w23 to w20
                append i3 to w21 if w24
                next s2 = w22
              }
              Array Size(array=w20) -> (size(s)=w25)
              Reverse 1D Array(array=w21) -> (reversed array=w26)
              Build Array(w26, 0) -> w27
              s3 = w20  # shift register
              s4 = $"error in"  # shift register
              for {
                w28 = each element of w27
                Subtract(x=w25, y=w28) -> w29
                # "Break off" the end of the array.
                Delete From Array(inArray=s3, length (1)=w29, index0=w28) -> (outArray=w30, deleted=w31)
                w32 = cluster{"file clusters 2": "File.gtype"[]} {all zero or empty}
                Property Node(instance in=w32, "file clusters 2"=w31) -> (instance out=w33)
                append w33 to w2
                next s3 = w30
              }
              w1 = s4
            }
          }
        }
        frame True {
          w1 = $"error in"
          w2 = default
        }
      }
    }
    frame Error {
      w1 = $"error in"
      w2 = default
    }
  }
  $"error out" <- w1
  $"sorted file clusters" <- w2
