vi "Update Metadata Properties (Single).gvi"   [G Web Development Software 22.0.0]
# Modifies the metadata properties of a file.
inputs:
  "file in": "File.gtype", required
  "error in": error
outputs:
  "file out": "File.gtype"
  "error out": error
types:
  "Property.gtype" = cluster{"key": string, "value": string}
  "Client Handle.gtype" = u32
  "Configuration.gtype" = cluster{"Server URL": string, "Session": "Client Handle.gtype", "Raw Session Queue": Queue<"Client Handle.gtype">, "Workspace": "Workspace.gtype"}
  "File.gtype" = cluster{"id": string, "workspace id": string, "metadata revision": i64, "created": timestamp, "size": i64, "properties": "Property.gtype"[], "configuration": "Configuration.gtype"}
uses:
  SystemLinkFileExtensions::Form URL Update Metadata.gvi
  SystemLinkFileExtensions::Form Request Update Metadata.gvi
  NI::Skyline::Utilities::Execute HTTP Verb.gvi
diagram:
  $"file out" <- $"file in"
  Property Node(instance in=$"file in") -> ("configuration:Session"=w1, "configuration:Server URL"=w2, "id"=w3, "properties"=w4)
  call "Form URL Update Metadata.gvi"(server url=w2, id=w3) -> (url=w5)
  call "Form Request Update Metadata.gvi"(properties=w4) -> (request body=w6)
  call "Execute HTTP Verb.gvi"(session=w1, URL=w5, buffer=w6, error in=$"error in", HTTP verb="POST") -> (error out=w7)
  $"error out" <- w7
