vi "Verify Query Files Workspace Support.gvi"   [LabVIEW NXG 5.0.0]
inputs:
  "configuration": "Configuration.gtype", required
  "error in": error
outputs:
  "error out": error
types:
  "Client Handle.gtype" = u32
  "Workspace.gtype" = cluster{"id": string, "name": string, "archived?": bool, "default?": bool}
  "Configuration.gtype" = cluster{"Server URL": string, "Session": "Client Handle.gtype", "Raw Session Queue": Queue<"Client Handle.gtype">, "Workspace": "Workspace.gtype"}
uses:
  NI::Skyline::Utilities::Get Operation Version.gvi
  NI::G Core::Error::Legacy::Clear Errors.gvi
  NI::G Core::Error::Legacy::Error Cluster From Error Code.gvi
diagram:
  case ($"error in") {
    frame No Error {
      call "Get Operation Version.gvi"(service name="nifile", api version=1, operation="queryFiles", error in=$"error in", configuration=$configuration) -> (version=w2, error out=w3)
      # Query Files has been extended to support workspaces in SystemLink 21.1 (version 2).
      case (w2) {
        frame 2.. {
          w1 = w3
        }
        frame ..1 {
          # No supported version of service.
          # 'Workspace Unsupported' takes precedence over errors due to a missing route, but not other errors.
          # The assumption here is that the route related to workspace support was missing, so that's what we want
          # to report to the user.
          call "Clear Errors.gvi"(specific error code to clear=-251043, error in=w3) -> (error out=w4)
          # Expected URL not found
          call "Clear Errors.gvi"(specific error code to clear=-252217, error in=w4) -> (error out=w5)
          w6 = "-251634: The current web server configuration does not support filtering file queries by workspace."
          call "Error Cluster From Error Code.gvi"(error code=-251634, error message=w6, show call chain?=TRUE, is warning?=FALSE) -> (error out=w7)
          Merge Errors(w5, w7) -> (error out=w1)
        }
      }
    }
    frame Error {
      w1 = $"error in"
    }
  }
  $"error out" <- w1
