vi "Set Uppy Core Options.gvi"   [LabVIEW NXG 3.1.0]
inputs:
  "uppy options in": "uppy options.gtype"
  "max file size": i32 = -1
  "max number of files": i32 = -1
  "allowed file types": string[]  # array of wildcards image/*, exact mime types image/jpeg, or file extensions .jpg Examples: image/* .jpg .jpeg .png .gif
outputs:
  "uppy options out": "uppy options.gtype"
types:
  "option.gtype" = cluster{"propertiesJSON": string}
  "uppy options.gtype" = "option.gtype"[]
  T1 = cluster{"restrictions": cluster{"maxFileSize": i32}}
  T2 = cluster{"restrictions": cluster{"maxNumberOfFiles": i32}}
  T3 = cluster{"restrictions": cluster{"allowedFileTypes": string[]}}
uses:
  Uppy::Support::Append Option.gvi
diagram:
  Is Not Equal(x=$"max file size", y=-1) -> w1
  # Find more options at https://uppy.io/docs/uppy/#Options
  # The restrictions.minNumberOfFiles property is not useful untill https://github.com/transloadit/uppy/issues/1545 is fixed
  # The autoProceed property should be avoided because it causes a console.error message to occur
  case (w1) {
    frame False, Default {
      w2 = $"uppy options in"
    }
    frame True {
      Property Node(instance in=cluster{"core": T1} {all zero or empty}, "core:restrictions:maxFileSize"=$"max file size") -> (instance out=w3)
      Flatten To JSON(anything=w3) -> (JSON string=w4)
      call "Append Option.gvi"(uppy options in=$"uppy options in", propertiesJSON=w4) -> (uppy options out=w2)
    }
  }
  Is Not Equal(x=$"max number of files", y=-1) -> w5
  case (w5) {
    frame False, Default {
      w6 = w2
    }
    frame True {
      Property Node(instance in=cluster{"core": T2} {all zero or empty}, "core:restrictions:maxNumberOfFiles"=$"max number of files") -> (instance out=w7)
      Flatten To JSON(anything=w7) -> (JSON string=w8)
      call "Append Option.gvi"(uppy options in=w2, propertiesJSON=w8) -> (uppy options out=w6)
    }
  }
  Array Size(array=$"allowed file types") -> (size(s)=w9)
  Is Not Equal To 0(x=w9) -> w10
  case (w10) {
    frame False, Default {
      w11 = w6
    }
    frame True {
      Property Node(instance in=cluster{"core": T3} {all zero or empty}, "core:restrictions:allowedFileTypes"=$"allowed file types") -> (instance out=w12)
      Flatten To JSON(anything=w12) -> (JSON string=w13)
      call "Append Option.gvi"(uppy options in=w6, propertiesJSON=w13) -> (uppy options out=w11)
    }
  }
  $"uppy options out" <- w11
