vi "Set Uppy Webcam Options.gvi"   [G Web Development Software 22.3.0]
inputs:
  "uppy options in": "uppy options.gtype"
  "facing mode": "facing modes.gtype" = "user"
  "countdown": bool
  "mirror": bool
outputs:
  "uppy options out": "uppy options.gtype"
types:
  "option.gtype" = cluster{"propertiesJSON": string}
  "uppy options.gtype" = "option.gtype"[]
  "facing modes.gtype" = enum{"user", "environment", "left", "right"}
  T1 = cluster{"countdown": bool, "mirror": bool, "modes": string[], "facingMode": string}
uses:
  Uppy::Support::Append Option.gvi
diagram:
  # Find more options at https://uppy.io/docs/webcam/
  w1 = cluster{"webcam": T1} {"webcam"={"countdown"=FALSE, "mirror"=TRUE, "modes"=["picture"], "facingMode"=""}}
  Format Into String($"facing mode") -> w2
  Property Node(instance in=w1, "webcam:countdown"=$countdown, "webcam:mirror"=$mirror, "webcam:facingMode"=w2) -> (instance out=w3)
  Flatten To Json(anything=w3) -> (JSON string=w4)
  call "Append Option.gvi"(uppy options in=$"uppy options in", propertiesJSON=w4) -> (uppy options out=w5)
  $"uppy options out" <- w5
