vi "CaptureImageToUpload.gviweb"   [LabVIEW NXG 5.0.0]
panel indicators:
  "URL Image": string
  "name": string
  "error out": error
uses:
  FileTasks::Capture Image as File.gvi
  File::Get File Metadata.gvi
  File::File Url::Create File Url.gvi
diagram:
  call "Capture Image as File.gvi"(facing mode="user") -> (file reference=w1, error out=w2)
  call "Get File Metadata.gvi"(file reference in=w1, error in=w2) -> (file reference out=w3, file name=w4, error out=w5)
  call "Create File Url.gvi"(file reference in=w3, error in=w5) -> (file object url=w6, error out=w7)
  $"URL Image" <- w6
  $"error out" <- w7
  $name <- w4
