vi "Create Image File.gvi"   [G Web Development Software 22.0.0]
inputs:
  "error in": error
outputs:
  "error out": error
  "file reference": "NI.JavaScriptReference"
uses:
  WebApp::Support::Create Image Binary.gvi
  File::Create File.gvi
diagram:
  call "Create Image Binary.gvi"() -> (image binary=w1)
  call "Create File.gvi"(file contents=w1, file name="DoctorVI.gif", content type="image/gif", error in=$"error in") -> (file reference=w2, error out=w3)
  $"file reference" <- w2
  $"error out" <- w3
