vi "Selection Tree Clear.gvi"   [G Web Development Software 22.0.0]
inputs:
  "error in": error
  "tree": "TreeControl reference"
outputs:
  "error out": error
diagram:
  s1 = uninitialised  # shift register
  while {
    Is First Call() -> w1
    case (w1) {
      frame False, Default {
        w2 = s1
      }
      frame True {
        w2 = $tree
      }
    }
    next s1 = w2
    stop if TRUE
  }
  Property Node(instance in=s1, "Selection"="", error in=$"error in") -> (error out=w3)
  $"error out" <- w3
