vi "Show Error Dialog.gvi"   [LabVIEW NXG 5.0.0]
inputs:
  "error in": error
diagram:
  case ($"error in") {
    frame Error, Default {
      Property Node(instance in=$"error in") -> ("source"=w1)
      One Button Dialog(message=w1)
    }
    frame No Error { }
  }
