vi "index.gviweb"   [G Web Development Software 22.3.0]
panel controls:
  "image file url": string
  "capture image": bool
  "load local text": bool
  "download some text": bool
  "load local binary": bool
  "download some binary": bool
  "download graph snapshot": bool
  "Tab": i32
  "download tab snapshot": bool
  "post multipart single value": bool
  "post multipart single file": bool
  "post multipart multiple values": bool
  "post multipart multiple files": bool
  "post multipart mixed file and value": bool
  "clear current response": bool
  "Http Extensions": i32
  "post multipart value as file": bool
  "post multipart value as file with type": bool
  "post multipart single file name override": bool
  "post multipart timeout after 3s": bool
  "post multipart timeout multiple after 3s": bool
  "post multipart custom header": bool
  "get text response": bool
  "get binary response": bool
panel indicators:
  "loaded text": string
  "loaded text file name": string
  "number of bytes loaded": i32
  "loaded binary file name": string
  "Graph": f64[]
  "body": string
  "headers": string
  "status code": u32
  "error out": error
types:
  "Multipart Data Ext.gtype" = cluster{"Name": string, "Value": string, "File": "NI.JavaScriptReference", "Filename": string, "MIME type": string}
uses:
  File::File Url::Close File Url.gvi
  WebApp::Support::Show Error Dialog.gvi
  FileTasks::Capture Image as File.gvi
  File::File Url::Create File Url.gvi
  File::Close File.gvi
  FileTasks::Read File Text.gvi
  FileTasks::Download File Text.gvi
  FileTasks::Read File Binary.gvi
  Base64::Base64 Encode.gvi
  WebApp::Support::Create Image Binary.gvi
  FileTasks::Download File Binary.gvi
  Snapshot::Get Image.gvi
  File::Download File.gvi
  HTTPExtensions::POST::POST Multipart Ext - String.gvi
  WebApp::Support::Create Image File.gvi
  NI::HTTP::Open HTTP Handle.gvi
  NI::HTTP::Add Header.gvi
  NI::HTTP::Close HTTP Handle.gvi
  HTTPExtensions::GET::GET Ext - File.gvi
  File::Read File.gvi
diagram:
  for (N = 100) {
    Random Number() -> (number (0 to 1)=w2)
    append w2 to w1
  }
  $Graph <- w1
  while {
    event {
      on "capture image" Value changed {
        sequence {
          frame 0 {
            case ($"image file url") {
              frame Default {
                # make sure to cleanup existing File URL to avoid memory leaks
                call "Close File Url.gvi"(url=$"image file url") -> (error out=w3)
                call "Show Error Dialog.gvi"(error in=w3)
              }
              frame "" { }
            }
          }
          frame 1 {
            call "Capture Image as File.gvi"() -> (file reference=w4, error out=w5)
            call "Create File Url.gvi"(file reference in=w4, error in=w5) -> (file reference out=w6, file object url=w7, error out=w8)
            $"image file url" <- w7
            call "Close File.gvi"(file reference=w6, error in=w8) -> (error out=w9)
            call "Show Error Dialog.gvi"(error in=w9)
          }
        }
      }
      on "load local text" Value changed {
        call "Read File Text.gvi"(allowed file types=[".txt"]) -> (file content=w10, file name=w11, error out=w12)
        $"loaded text" <- w10
        $"loaded text file name" <- w11
        call "Show Error Dialog.gvi"(error in=w12)
      }
      on "download some text" Value changed {
        call "Download File Text.gvi"(file contents="It's true, WebVIs are awesome!", file name="WebVIs Are Awesome.txt") -> (error out=w13)
        call "Show Error Dialog.gvi"(error in=w13)
      }
      on "load local binary" Value changed {
        call "Read File Binary.gvi"() -> (file contents=w14, file name=w15, error out=w16)
        Array Size(array=w14) -> (size(s)=w17)
        $"number of bytes loaded" <- w17
        call "Base64 Encode.gvi"(data=w14, error in=w16) -> (encoded data=w18, error out=w19)
        String Length(string=w18)
        call "Show Error Dialog.gvi"(error in=w19)
        $"loaded binary file name" <- w15
      }
      on "download some binary" Value changed {
        call "Create Image Binary.gvi"() -> (image binary=w20)
        call "Download File Binary.gvi"(file contents=w20, file name="DoctorVI.gif", content type="image/gif") -> (error out=w21)
        call "Show Error Dialog.gvi"(error in=w21)
      }
      on "download graph snapshot" Value changed {
        call "Get Image.gvi"(selector=".my-graph") -> (file reference=w22, error out=w23)
        call "Download File.gvi"(file reference in=w22, error in=w23) -> (file reference out=w24, error out=w25)
        call "Close File.gvi"(file reference=w24, error in=w25) -> (error out=w26)
        call "Show Error Dialog.gvi"(error in=w26)
        # Note that the selector string ".my-graph" matches the HTML Class Attribute "my-graph" but has a period prefix
      }
      on "download tab snapshot" Value changed {
        # Note that the selector string ".my-tab" matches the HTML Class Attribute "my-tab" but has a period prefix
        call "Get Image.gvi"(selector=".my-tab") -> (file reference=w27, error out=w28)
        call "Download File.gvi"(file reference in=w27, error in=w28) -> (file reference out=w29, error out=w30)
        call "Close File.gvi"(file reference=w29, error in=w30) -> (error out=w31)
        call "Show Error Dialog.gvi"(error in=w31)
      }
      on "clear current response" Value changed {
        $headers <- ""
        $body <- ""
        $"status code" <- 0
        $"error out" <- no error
      }
      on "post multipart single value" Value changed {
        Property Node(instance in="Multipart Data Ext.gtype" {all zero or empty}, "Name"="my name", "Value"="my value") -> (instance out=w32)
        Build Array(w32) -> w33
        call "POST Multipart Ext - String.gvi"(url="https://httpbin.org/post", data=w33) -> (status code=w34, headers=w35, body=w36, error out=w37)
        $headers <- w35
        $body <- w36
        $"error out" <- w37
        $"status code" <- w34
      }
      on "post multipart multiple values" Value changed {
        Property Node(instance in="Multipart Data Ext.gtype" {all zero or empty}, "Name"="my name", "Value"="my value") -> (instance out=w38)
        Property Node(instance in="Multipart Data Ext.gtype" {all zero or empty}, "Name"="my other name", "Value"="my other value") -> (instance out=w39)
        Build Array(w38, w39) -> w40
        call "POST Multipart Ext - String.gvi"(url="https://httpbin.org/post", data=w40) -> (status code=w41, headers=w42, body=w43, error out=w44)
        $headers <- w42
        $body <- w43
        $"error out" <- w44
        $"status code" <- w41
      }
      on "post multipart single file" Value changed {
        call "Create Image File.gvi"() -> (file reference=w45)
        Property Node(instance in="Multipart Data Ext.gtype" {all zero or empty}, "Name"="my name", "File"=w45) -> (instance out=w46)
        Build Array(w46) -> w47
        call "POST Multipart Ext - String.gvi"(url="https://httpbin.org/post", data=w47) -> (status code=w48, headers=w49, body=w50, error out=w51)
        $headers <- w49
        $body <- w50
        $"error out" <- w51
        $"status code" <- w48
      }
      on "post multipart multiple files" Value changed {
        call "Create Image File.gvi"() -> (file reference=w52)
        Property Node(instance in="Multipart Data Ext.gtype" {all zero or empty}, "Name"="my name", "File"=w52) -> (instance out=w53)
        call "Create Image File.gvi"() -> (file reference=w54)
        Property Node(instance in="Multipart Data Ext.gtype" {all zero or empty}, "Name"="my other name", "File"=w54) -> (instance out=w55)
        Build Array(w53, w55) -> w56
        call "POST Multipart Ext - String.gvi"(url="https://httpbin.org/post", data=w56) -> (status code=w57, headers=w58, body=w59, error out=w60)
        $headers <- w58
        $body <- w59
        $"error out" <- w60
        $"status code" <- w57
      }
      on "post multipart single file name override" Value changed {
        call "Create Image File.gvi"() -> (file reference=w61)
        Property Node(instance in="Multipart Data Ext.gtype" {all zero or empty}, "Name"="my name", "File"=w61, "Filename"="VeryCoolNameOverride.gif") -> (instance out=w62)
        Build Array(w62) -> w63
        call "POST Multipart Ext - String.gvi"(url="https://httpbin.org/post", data=w63) -> (status code=w64, headers=w65, body=w66, error out=w67)
        $headers <- w65
        $body <- w66
        $"error out" <- w67
        $"status code" <- w64
      }
      on "post multipart mixed file and value" Value changed {
        Property Node(instance in="Multipart Data Ext.gtype" {all zero or empty}, "Name"="my name", "Value"="my value") -> (instance out=w68)
        call "Create Image File.gvi"() -> (file reference=w69)
        Property Node(instance in="Multipart Data Ext.gtype" {all zero or empty}, "Name"="my other name", "File"=w69) -> (instance out=w70)
        Build Array(w68, w70) -> w71
        call "POST Multipart Ext - String.gvi"(url="https://httpbin.org/post", data=w71) -> (status code=w72, headers=w73, body=w74, error out=w75)
        $headers <- w73
        $body <- w74
        $"error out" <- w75
        $"status code" <- w72
      }
      on "post multipart value as file" Value changed {
        Property Node(instance in="Multipart Data Ext.gtype" {all zero or empty}, "Name"="my name", "Value"="my value", "Filename"="awesome file with default octet stream type.bin") -> (instance out=w76)
        Build Array(w76) -> w77
        call "POST Multipart Ext - String.gvi"(url="https://httpbin.org/post", data=w77) -> (status code=w78, headers=w79, body=w80, error out=w81)
        $headers <- w79
        $body <- w80
        $"error out" <- w81
        $"status code" <- w78
      }
      on "post multipart value as file with type" Value changed {
        Property Node(instance in="Multipart Data Ext.gtype" {all zero or empty}, "Name"="my name", "Value"="my value", "Filename"="awesome file with text type.txt", "MIME type"="text/plain") -> (instance out=w82)
        Build Array(w82) -> w83
        call "POST Multipart Ext - String.gvi"(url="https://httpbin.org/post", data=w83) -> (status code=w84, headers=w85, body=w86, error out=w87)
        $headers <- w85
        $body <- w86
        $"error out" <- w87
        $"status code" <- w84
      }
      on "post multipart timeout after 3s" Value changed {
        call "Create Image File.gvi"() -> (file reference=w88)
        Property Node(instance in="Multipart Data Ext.gtype" {all zero or empty}, "Name"="my name", "File"=w88) -> (instance out=w89)
        Build Array(w89) -> w90
        call "POST Multipart Ext - String.gvi"(timeout=3000, url="https://httpbin.org/delay/8", data=w90) -> (status code=w91, headers=w92, body=w93, error out=w94)
        $headers <- w92
        $body <- w93
        $"error out" <- w94
        $"status code" <- w91
      }
      on "post multipart timeout multiple after 3s" Value changed {
        call "Create Image File.gvi"() -> (file reference=w95)
        Property Node(instance in="Multipart Data Ext.gtype" {all zero or empty}, "Name"="my name", "File"=w95) -> (instance out=w96)
        Build Array(w96) -> w97
        call "POST Multipart Ext - String.gvi"(timeout=3000, url="https://httpbin.org/delay/8", data=w97) -> (headers=w98, body=w99, error out=w100)
        call "POST Multipart Ext - String.gvi"(timeout=3000, url="https://httpbin.org/delay/8", data=w97) -> (headers=w101, body=w102, error out=w103)
        call "POST Multipart Ext - String.gvi"(timeout=3000, url="https://httpbin.org/delay/8", data=w97) -> (headers=w104, body=w105, error out=w106)
        Concatenate Strings("\nrequest 1\n", w98, "\nrequest 2\n", w101, "\nrequest 3\n", w104) -> w107
        $headers <- w107
        Concatenate Strings("\nrequest 1\n", w99, "\nrequest 2\n", w102, "\nrequest 3\n", w105) -> w108
        $body <- w108
        # This case should take about 3s to timeut in browser if POST correctly runs re-entrantly
        Merge Errors(w100, w103, w106) -> (error out=w109)
        $"error out" <- w109
        $"status code" <- 999999
      }
      on "post multipart custom header" Value changed {
        call "Open HTTP Handle.gvi"() -> (client handle out=w110, error out=w111)
        call "Add Header.gvi"(client handle=w110, header="Hello", value="World", error in=w111) -> (client handle out=w112, error out=w113)
        Property Node(instance in="Multipart Data Ext.gtype" {all zero or empty}, "Name"="my name", "Value"="my value") -> (instance out=w114)
        Build Array(w114) -> w115
        call "POST Multipart Ext - String.gvi"(client handle=w112, url="https://httpbin.org/post", data=w115, error in=w113) -> (status code=w116, client handle out=w117, headers=w118, body=w119, error out=w120)
        $headers <- w118
        $body <- w119
        call "Close HTTP Handle.gvi"(client handle=w117, error in=w120) -> (error out=w121)
        $"error out" <- w121
        $"status code" <- w116
      }
      on "get text response" Value changed {
        call "GET Ext - File.gvi"(url="https://httpbin.org/encoding/utf8") -> (status code=w122, headers=w123, body=w124, error out=w125)
        $headers <- w123
        call "Read File.gvi"(file reference in=w124, error in=w125) -> (file reference out=w126, file contents=w127, error out=w128)
        Byte Array To String(error in=w128, unsigned byte array=w127) -> (error out=w129, string=w130)
        $body <- w130
        Close Reference(error in=w129, reference=w126) -> (error out=w131)
        $"error out" <- w131
        $"status code" <- w122
      }
      on "get binary response" Value changed {
        call "GET Ext - File.gvi"(url="https://httpbin.org/bytes/8?seed=6") -> (status code=w132, headers=w133, body=w134, error out=w135)
        $headers <- w133
        call "Read File.gvi"(file reference in=w134, error in=w135) -> (file reference out=w136, file contents=w137, error out=w138)
        Close Reference(error in=w138, reference=w136) -> (error out=w139)
        $"error out" <- w139
        $"status code" <- w132
        Is Equal[ComparisonMode=CompareAggregates](x=w137, y=[41, 248, 133, 18, 0, 74, 240, 191]) -> w140
        Select(s=w140, t="binary valid", f="binary invalid") -> w141
        $body <- w141
      }
    }
    stop if FALSE
  }
