vi "index.gviweb"   [G Web Development Software 22.0.0]
panel indicators:
  "headers": string
  "body": string
  "status code": u32
types:
  "Multipart Data Ext.gtype" = cluster{"Name": string, "Value": string, "File": "NI.JavaScriptReference", "Filename": string, "MIME type": string}
uses:
  File::Create File.gvi
  HTTPExtensions::POST Multipart Ext.gvi
  WebApp::Support::Show Error Dialog.gvi
diagram:
  w1 = [71, 73, 70, 56, 57, 97, 1, 0, 1, 0, 0, 255, 0, 44, 0, 0, 0, 0, 1, 0, 1, 0, 0, 2, 0, 59]
  call "Create File.gvi"(file contents=w1, file name="tiniestgifever.gif", content type="image/gif") -> (file reference=w2, error out=w3)
  w4 = [{"Name"="test", "Value"="sdf", "File"=refnum, "Filename"="", "MIME type"=""}, {"Name"="test2", "Value"="sdfsdf", "File"=refnum, "Filename"="hi.txt", "MIME type"=""}, {"Name"="test3", "Value"="fffffff", "File"=refnum, "Filename"="hellowworld.txt", "MIME type"="text/plain"}]
  w5 = "Multipart Data Ext.gtype" {"Name"="file", "Value"="", "File"=refnum, "Filename"="", "MIME type"=""}  # Multipart Data Ext
  Property Node(instance in=w5, "File"=w2) -> (instance out=w6)
  Property Node(instance in=w6, "Filename"="renamed.gif", "Name"="renamedone") -> (instance out=w7)
  Build Array(w4, w6, w7) -> w8
  call "POST Multipart Ext.gvi"(url="https://httpbin.org/post", data=w8, error in=w3) -> (status code=w9, headers=w10, body=w11, error out=w12)
  $headers <- w10
  $body <- w11
  call "Show Error Dialog.gvi"(error in=w12)
  $"status code" <- w9
