vi "snapshot.gviweb"   [G Web Development Software 21.0.0]
panel controls:
  "snapshot": bool
panel indicators:
  "Graph": f64[]
  "URL Image": string
uses:
  File::File Url::Close File Url.gvi
  Snapshot::Get Image - using html-to-image.gvi
  File::File Url::Create File Url.gvi
  File::Download File.gvi
diagram:
  for (N = 100) {
    Random Number() -> (number (0 to 1)=w2)
    append w2 to w1
  }
  $Graph <- w1
  s1 = uninitialised  # shift register
  while {
    event {
      on "snapshot" Value changed {
        call "Close File Url.gvi"(url=s1) -> (error out=w4)
        call "Get Image - using html-to-image.gvi"(selector=".my-graph .webchart-drawing-layer", error in=w4) -> (file reference=w5, error out=w6)
        call "Create File Url.gvi"(file reference in=w5, error in=w6) -> (file object url=w3)
        $"URL Image" <- w3
        call "Download File.gvi"(file reference in=w5)
      }
    }
    next s1 = w3
    stop if FALSE
  }
