vi "Clear Selection.gvi"   [G Web Development Software 22.0.0]
inputs:
  "control references": "Control reference"[]
  "tree": "TreeControl reference"
  "error in": error
outputs:
  "error out": error
uses:
  WebAppSystemLink::Support::Selection Tree Clear.gvi
  WebAppSystemLink::Support::Selection Buttons Disabled.gvi
diagram:
  call "Selection Tree Clear.gvi"(tree=$tree, error in=$"error in") -> (error out=w1)
  call "Selection Buttons Disabled.gvi"(control references=$"control references", disabled=TRUE, error in=w1) -> (error out=w2)
  $"error out" <- w2
