vi "Format files for tree.gvi"   [G Web Development Software 22.0.0]
inputs:
  "id": string
  "file metadata in": "File Metadata.gtype"
outputs:
  "tree data": T1
types:
  T1 = cluster{"name": string, "created": string, "size": string, "id": string}
  "Property.gtype" = cluster{"key": string, "value": string}
  "File Metadata.gtype" = cluster{"name": string, "extension": string, "created": timestamp, "size": i64, "workspace id": string, "properties": "Property.gtype"[]}
diagram:
  Property Node(instance in=$"file metadata in") -> ("name"=w1, "created"=w2, "size"=w3)
  Format Date Time String(time stamp=w2) -> (date/time string=w4)
  Format Into String(w3) -> w5
  Property Node(instance in=T1 {all zero or empty}, "id"=$id, "name"=w1, "created"=w4, "size"=w5) -> (instance out=w6)
  $"tree data" <- w6
