vi "Selection Buttons Disabled.gvi"   [G Web Development Software 22.0.0]
inputs:
  "error in": error
  "control references": "Control reference"[]
  "disabled": bool, required
outputs:
  "error out": error
diagram:
  s1 = uninitialised  # shift register
  while {
    Is First Call() -> w1
    case (w1) {
      frame False, Default {
        w2 = s1
      }
      frame True {
        w2 = $"control references"
      }
    }
    next s1 = w2
    stop if TRUE
  }
  s2 = $"error in"  # shift register
  for {
    w3 = each element of s1
    Property Node(instance in=w3, "Disabled"=$disabled, error in=s2) -> (error out=w4)
    next s2 = w4
    stop if w4
  }
  $"error out" <- s2
