vi "index.gviweb"   [G Web Development Software 21.0.0]
panel controls:
  "query": bool
  "delete": bool
  "clear": bool
  "query filters": i32
  "timestamp": timestamp
  "name": string
  "name operator": T2 = "contains"
  "extension operator": enum{"equal", "not equal"} = "equal"
  "extension": string
  "property operator": T2 = "contains"
  "key": string
  "value": string
  "size operator": T3 = "greater than or equal"
  "size (bytes)": i32
  "created operator": T4 = "greater than or equal"
  "download": bool
  "upload": bool
panel indicators:
  "Files": T1[]
  "last updated": timestamp
types:
  T1 = cluster{"name": string, "created": string, "size": string, "id": string}
  T2 = enum{"contains", "not contains", "equal", "not equal"}
  T3 = enum{"equal", "not equal", "less than", "greater than", "less than or equal", "greater than or equal"}
  T4 = enum{"less than", "greater than", "less than or equal", "greater than or equal"}
uses:
  VireoPatch::Apply Vireo Patch.gvi
  NI::Skyline::Configuration::Open Configuration.gvi
  NI::Skyline::File::Create Filter (Name).gvi
  NI::Skyline::File::Create Filter (Extension).gvi
  NI::Skyline::File::Create Filter (Property).gvi
  NI::Skyline::File::Create Filter (Size in bytes).gvi
  NI::Skyline::File::Create Filter (Created Time Stamp).gvi
  NI::Skyline::File::Query Files.gvi
  NI::Skyline::File::Get File Metadata.gvi
  WebAppSystemLink::Support::Format files for tree.gvi
  WebAppSystemLink::Support::Show Error Dialog.gvi
  WebAppSystemLink::Support::Clear Selection.gvi
  WebAppSystemLink::Support::Selection Buttons Disabled.gvi
  NI::Skyline::File::Open File.gvi
  SystemLinkFileExtensions::Delete File Ext (Single).gvi
  SystemLinkFileExtensions::Download File Ext (Single).gvi
  File::Download File.gvi
  FileTasks::Capture Image as File.gvi
  SystemLinkFileExtensions::Send File Ext (File).gvi
  File::Close File.gvi
diagram:
  call "Apply Vireo Patch.gvi"()
  call "Open Configuration.gvi"(username="admin", password="test") -> (configuration=w1)
  while {
    event {
      on "query" Value changed {
        case ($"query filters") {
          frame 0, Default {
            # no filter selected
            w2 = default
          }
          frame 1 {
            call "Create Filter (Name).gvi"(name=$name, operator=$"name operator") -> (filter out=w2)
          }
          frame 2 {
            call "Create Filter (Extension).gvi"(extension=$extension, operator=$"extension operator") -> (filter out=w2)
          }
          frame 3 {
            call "Create Filter (Property).gvi"(key=$key, value=$value, operator=$"property operator") -> (filter out=w2)
          }
          frame 4 {
            call "Create Filter (Size in bytes).gvi"(size=$"size (bytes)", operator=$"size operator") -> (filter out=w2)
          }
          frame 5 {
            call "Create Filter (Created Time Stamp).gvi"(time stamp=$timestamp, operator=$"created operator") -> (filter out=w2)
          }
        }
        call "Query Files.gvi"(filter in=w2, configuration=w1) -> (files=w3, error out=w4)
        for {
          w5 = each element of w3
          call "Get File Metadata.gvi"(file in=w5) -> (id=w7, metadata=w8)
          call "Format files for tree.gvi"(id=w7, file metadata in=w8) -> (tree data=w9)
          append w9 to w6
        }
        $Files <- w6
        call "Show Error Dialog.gvi"(error in=w4)
        Property Node(instance in=reference to "query", "Value"=FALSE) -> (error out=w10)
        call "Clear Selection.gvi"(error in=w10) -> (error out=w11)
        call "Show Error Dialog.gvi"(error in=w11)
        Get Current Time() -> (current time=w12)
        $"last updated" <- w12
      }
      on "Files" Selection changed {
        Event Data() -> ("SelectedData:id"=w13)
        Is Empty String Or Path(string/path=w13) -> w14
        call "Selection Buttons Disabled.gvi"(disabled=w14) -> (error out=w15)
        call "Show Error Dialog.gvi"(error in=w15)
      }
      on "delete" Value changed {
        Property Node(instance in=reference to "Files") -> ("SelectedData"=w16)
        Property Node(instance in=w16) -> ("id"=w17)
        case (w17) {
          frame Default {
            call "Open File.gvi"(file id=w17, configuration=w1) -> (file=w18, error out=w19)
            call "Delete File Ext (Single).gvi"(file=w18, error in=w19) -> (error out=w20)
            Property Node(instance in=reference to "query", "ValueSignaling"=TRUE, error in=w20) -> (error out=w21)
            call "Show Error Dialog.gvi"(error in=w21)
          }
          frame "" { }
        }
      }
      on "clear" Value changed {
        call "Clear Selection.gvi"() -> (error out=w22)
        call "Show Error Dialog.gvi"(error in=w22)
      }
      on "download" Value changed {
        Property Node(instance in=reference to "Files") -> ("SelectedData"=w23)
        Property Node(instance in=w23) -> ("id"=w24)
        case (w24) {
          frame "" { }
          frame Default {
            call "Open File.gvi"(file id=w24, configuration=w1) -> (file=w25, error out=w26)
            call "Download File Ext (Single).gvi"(file in=w25, error in=w26) -> (file reference=w27, error out=w28)
            call "Get File Metadata.gvi"(file in=w25) -> (metadata=w29)
            Property Node(instance in=w29) -> ("name"=w30)
            call "Download File.gvi"(file reference in=w27, overridden file name (exisiting name)=w30, error in=w28) -> (error out=w31)
            call "Show Error Dialog.gvi"(error in=w31)
          }
        }
      }
      on "upload" Value changed {
        call "Capture Image as File.gvi"() -> (file reference=w32, error out=w33)
        call "Send File Ext (File).gvi"(file=w32, error in=w33, configuration=w1) -> (error out=w34)
        call "Close File.gvi"(file reference=w32, error in=w34) -> (error out=w35)
        Property Node(instance in=reference to "query", "ValueSignaling"=TRUE, error in=w35) -> (error out=w36)
        call "Show Error Dialog.gvi"(error in=w36)
      }
    }
    stop if FALSE
  }
  Property Node(instance in=reference to "query", "Value"=FALSE) -> (error out=w37)
  Property Node(instance in=reference to "Files", "ColumnHeaders"=["name", "created", "size (bytes)", "id"], error in=w37) -> (error out=w38, instance out=w39)
  Build Array(reference to "delete", reference to "clear", reference to "download") -> w40
  call "Clear Selection.gvi"(control references=w40, tree=w39, error in=w38) -> (error out=w41)
  call "Show Error Dialog.gvi"(error in=w41)
