vi "Load File From Drop Target.gvi"   [LabVIEW NXG 5.0.0]
inputs:
  "container": "HtmlContainer reference", required
  "error in": error
outputs:
  "error out": error
  "file contents": u8[]
uses:
  FileDropTarget::Support::FileDropTarget.jsli::LoadFileFromDropTarget
diagram:
  Obtain JavaScript Reference(reference in=$container, error in=$"error in") -> (error out=w1, javascript reference out=w2)
  call "LoadFileFromDropTarget"(container=w2, error in=w1) -> (fileContents=w3, error out=w4)
  $"file contents" <- w3
  $"error out" <- w4
