vi "Main.gviweb"   [LabVIEW NXG 3.0.0]
panel controls:
  "File contents (edit and press save)": string
  "Save": bool
  "Clean-up File": bool
panel indicators:
  "Drop a file here": string
  "Tab": i32
  "Download Updated File": string
uses:
  WebApp::FileManipulation.jsli::Load File From Drop Target
  WebApp::FileManipulation.jsli::Create Object Url From Array
  WebApp::FileManipulation.jsli::Revoke Object Url
diagram:
  call "Load File From Drop Target"(drop target selector="ni-url-image[ni-control-id='46']") -> (file contents=w1, error out=w2)
  Byte Array To String(error in=w2, unsigned byte array=w1) -> (string=w3)
  sequence {
    frame 0 {
      $"File contents (edit and press save)" <- w3
      $Tab <- 1
    }
  }
  while (after w3) {
    event {
      on "Save" Value changed {
        String To Byte Array(string=$"File contents (edit and press save)") -> (unsigned byte array=w5)
        call "Create Object Url From Array"(byte array=w5, content type="text/plain") -> (object url=w6)
        $"Download Updated File" <- w6
        $Tab <- 2
        w4 = default
      }
      on "Clean-up File" Value changed {
        call "Revoke Object Url"(object url=$"Download Updated File")
        w4 = TRUE
      }
    }
    stop if w4
  }
