vi "index.gviweb"   [LabVIEW NXG 5.0.0]
panel controls:
  "File contents (edit and press save)": string
  "Save": bool
  "Clean-up File": bool
panel indicators:
  "Tab": i32
  "Download Updated File": string
uses:
  FileDropTarget::Load File From Drop Target.gvi
  FileDropTarget::Create Object Url FromArray.gvi
  FileDropTarget::Revoke Object Url.gvi
diagram:
  call "Load File From Drop Target.gvi"(container=reference to "drop target") -> (file contents=w1, error out=w2)
  Byte Array To String(error in=w2, unsigned byte array=w1) -> (string=w3)
  sequence {
    frame 0 {
      $"File contents (edit and press save)" <- w3
      $Tab <- 1
    }
  }
  while (after w3) {
    event {
      on "Save" Value changed {
        String To Byte Array(string=$"File contents (edit and press save)") -> (unsigned byte array=w5)
        call "Create Object Url FromArray.gvi"(file contents=w5, content type="text/plain") -> (object url=w6)
        $"Download Updated File" <- w6
        $Tab <- 2
        w4 = default
      }
      on "Clean-up File" Value changed {
        call "Revoke Object Url.gvi"(object url=$"Download Updated File")
        w4 = TRUE
      }
    }
    stop if w4
  }
