vi "Close File.gvi"   [LabVIEW NXG 3.1.0]
inputs:
  "file reference": "file reference.gtype"
  "error in": error
outputs:
  "error out": error
types:
  "file reference.gtype" = string
uses:
  FileApi::Support::FileApi.jsli::CloseFile
diagram:
  call "CloseFile"(fileObjectUrl=$"file reference") -> (error out=w1)
  Merge Errors($"error in", w1) -> (error out=w2)
  $"error out" <- w2
