vi "Get File Metadata.gvi"   [LabVIEW NXG 3.1.0]
inputs:
  "file reference in": "file reference.gtype", required
  "error in": error
outputs:
  "file reference out": "file reference.gtype"
  "error out": error
  "file name": string
types:
  "file reference.gtype" = string
uses:
  FileApi::Support::FileApi.jsli::GetFileMetadata
diagram:
  call "GetFileMetadata"(fileObjectUrl=$"file reference in", error in=$"error in") -> (fileMetadataJSON=w1, error out=w2)
  Unflatten From JSON(JSON string=w1, error in (no error)=w2, type and defaults=cluster{"name": string} {all zero or empty}) -> (error out=w3, value=w4)
  Property Node(instance in=w4) -> ("name"=w5)
  $"file name" <- w5
  $"file reference out" <- $"file reference in"
  $"error out" <- w3
