vi "Capture Image as File.gvi"   [LabVIEW NXG 3.1.0]
inputs:
  "allowed file types": string[]
  "error in": error
  "countdown": bool
  "mirror": bool
outputs:
  "error out": error
  "file reference": "file reference.gtype"
types:
  "file reference.gtype" = string
uses:
  Uppy::Create Uppy.gvi
  Uppy::Set Uppy Core Options.gvi
  Uppy::Set Uppy Dashboard Options.gvi
  Uppy::Set Uppy Webcam Options.gvi
  Uppy::Request Files.gvi
  Uppy::Destroy Uppy.gvi
diagram:
  call "Create Uppy.gvi"(error in=$"error in") -> (uppy reference=w1, error out=w2)
  call "Set Uppy Core Options.gvi"(uppy reference in=w1, error in=w2, max number of files=1, allowed file types=$"allowed file types") -> (uppy reference out=w3, error out=w4)
  call "Set Uppy Dashboard Options.gvi"(uppy reference in=w3, error in=w4, show uppy icon?=FALSE) -> (uppy reference out=w5, error out=w6)
  call "Set Uppy Webcam Options.gvi"(uppy reference in=w5, error in=w6, countdown=$countdown, mirror=$mirror) -> (uppy reference out=w7, error out=w8)
  call "Request Files.gvi"(uppy reference in=w7, error in=w8) -> (uppy reference out=w9, file references=w10, error out=w11)
  Array Index(array=w10) -> (out0[_]=w12)
  $"file reference" <- w12
  call "Destroy Uppy.gvi"(uppy reference=w9, error in=w11) -> (error out=w13)
  $"error out" <- w13
