vi "Download File Binary.gvi"   [LabVIEW NXG 3.1.0]
inputs:
  "file contents": u8[], required
  "file name": string, required
  "content type": string = "application/octect-stream"
  "error in": error
outputs:
  "error out": error
uses:
  FileApi::Create File.gvi
  FileApi::Download File.gvi
  FileApi::Close File.gvi
diagram:
  call "Create File.gvi"(file contents=$"file contents", name=$"file name", content type=$"content type", error in=$"error in") -> (file reference=w1, error out=w2)
  call "Download File.gvi"(file reference in=w1, file name=$"file name", error in=w2) -> (file reference out=w3, error out=w4)
  call "Close File.gvi"(file reference=w3, error in=w4) -> (error out=w5)
  $"error out" <- w5
