vi "Read File Binary.gvi"   [LabVIEW NXG 3.1.0]
inputs:
  "allowed file types": string[]
  "error in": error
outputs:
  "error out": error
  "file contents": u8[]
  "file name": string
uses:
  Uppy::Set Uppy Core Options.gvi
  Uppy::Set Uppy Dashboard Options.gvi
  Uppy::Request Files.gvi
  FileApi::Read File.gvi
  FileApi::Get File Metadata.gvi
  FileApi::Close File.gvi
diagram:
  call "Set Uppy Core Options.gvi"(max number of files=1, allowed file types=$"allowed file types") -> (uppy options out=w1)
  call "Set Uppy Dashboard Options.gvi"(uppy options in=w1, show uppy icon?=FALSE) -> (uppy options out=w2)
  call "Request Files.gvi"(uppy options=w2, error in=$"error in") -> (file references=w3, error out=w4)
  Array Index(array=w3) -> (out0[_]=w5)
  call "Read File.gvi"(file reference in=w5, error in=w4) -> (file reference out=w6, file contents=w7, error out=w8)
  call "Get File Metadata.gvi"(file reference in=w6, error in=w8) -> (file reference out=w9, name=w10, error out=w11)
  call "Close File.gvi"(file reference=w9, error in=w11) -> (error out=w12)
  $"error out" <- w12
  $"file name" <- w10
  $"file contents" <- w7
