vi "Read File Text.gvi"   [LabVIEW NXG 3.1.0]
inputs:
  "error in": error
  "allowed file types": string[]
outputs:
  "error out": error
  "file content": string
uses:
  FileTasks::Read File Binary.gvi
diagram:
  call "Read File Binary.gvi"(allowed file types=$"allowed file types", error in=$"error in") -> (file contents=w1, error out=w2)
  Byte Array To String(error in=w2, unsigned byte array=w1) -> (error out=w3, string=w4)
  $"file content" <- w4
  $"error out" <- w3
