vi "Request Files.gvi"   [LabVIEW NXG 3.1.0]
inputs:
  "error in": error
  "uppy options": "uppy options.gtype"
outputs:
  "file references": "file reference.gtype"[]
  "error out": error
types:
  "file reference.gtype" = string
  "option.gtype" = cluster{"propertiesJSON": string}
  "uppy options.gtype" = "option.gtype"[]
uses:
  Uppy::Support::Uppy.jsli::RequestFiles
diagram:
  Flatten To JSON(anything=$"uppy options") -> (JSON string=w1)
  call "RequestFiles"(jsonArrayOfConfigJSON=w1, error in=$"error in") -> (fileObjectUrlsJSON=w2, error out=w3)
  Unflatten From JSON(JSON string=w2, type and defaults=string[] []) -> (value=w4)
  $"file references" <- w4
  $"error out" <- w3
