vi "Set Uppy Dashboard Options.gvi"   [LabVIEW NXG 3.1.0]
inputs:
  "uppy options in": "uppy options.gtype"
  "show uppy icon?": bool = TRUE
outputs:
  "uppy options out": "uppy options.gtype"
types:
  "option.gtype" = cluster{"propertiesJSON": string}
  "uppy options.gtype" = "option.gtype"[]
  T1 = cluster{"uploadXFiles": cluster{"0": string, "1": string}}
  T2 = cluster{"locale": cluster{"strings": T1}, "proudlyDisplayPoweredByUppy": bool}
uses:
  Uppy::Support::Append Option.gvi
diagram:
  # Find more options at https://uppy.io/docs/dashboard/
  w1 = cluster{"dashboard": T2} {"dashboard"={"locale"={"strings"={"uploadXFiles"={"0"="Open %{smart_count} file", "1"="Open %{smart_count} files"}}}, "proudlyDisplayPoweredByUppy"=TRUE}}
  Property Node(instance in=w1, "dashboard:proudlyDisplayPoweredByUppy"=$"show uppy icon?") -> (instance out=w2)
  Flatten To JSON(anything=w2) -> (JSON string=w3)
  call "Append Option.gvi"(uppy options in=$"uppy options in", propertiesJSON=w3) -> (uppy options out=w4)
  $"uppy options out" <- w4
