vi "Set Uppy Webcam Options.gvi"   [LabVIEW NXG 3.1.0]
inputs:
  "uppy reference in": "uppy reference.gtype", required
  "error in": error
  "countdown": bool
  "mirror": bool
outputs:
  "uppy reference out": "uppy reference.gtype"
  "error out": error
types:
  "uppy reference.gtype" = i32
  T1 = cluster{"countdown": bool, "mirror": bool, "modes": string[]}
uses:
  Uppy::Support::Uppy.jsli::SetUppyOptions
diagram:
  $"uppy reference out" <- $"uppy reference in"
  # Find more options at https://uppy.io/docs/webcam/
  w1 = cluster{"webcam": T1} {"webcam"={"countdown"=FALSE, "mirror"=TRUE, "modes"=["picture"]}}
  Property Node(instance in=w1, "webcam:countdown"=$countdown, "webcam:mirror"=$mirror) -> (instance out=w2)
  Flatten To JSON(anything=w2) -> (JSON string=w3)
  call "SetUppyOptions"(uppyReference=$"uppy reference in", optionsJSON=w3, error in=$"error in") -> (error out=w4)
  $"error out" <- w4
