vi "Append Option.gvi"   [LabVIEW NXG 3.1.0]
inputs:
  "uppy options in": "uppy options.gtype", required
  "propertiesJSON": string, required
outputs:
  "uppy options out": "uppy options.gtype"
types:
  "option.gtype" = cluster{"propertiesJSON": string}
  "uppy options.gtype" = "option.gtype"[]
diagram:
  Property Node(instance in="option.gtype" {all zero or empty}, "propertiesJSON"=$propertiesJSON) -> (instance out=w1)
  Build Array($"uppy options in", w1) -> w2
  $"uppy options out" <- w2
