vi "CaptureImageToUpload.gviweb"   [LabVIEW NXG 3.1.0]
panel indicators:
  "URL Image": string
  "name": string
uses:
  FileTasks::Capture Image as File.gvi
  FileApi::Get File Metadata.gvi
  FileApi::Get File Object Url.gvi
diagram:
  call "Capture Image as File.gvi"(facing mode="user") -> (file reference=w1, error out=w2)
  call "Get File Metadata.gvi"(file reference in=w1, error in=w2) -> (file reference out=w3, file name=w4, error out=w5)
  call "Get File Object Url.gvi"(file reference in=w3, error in=w5) -> (file object url=w6)
  $"URL Image" <- w6
  $name <- w4
