vi "Fire.gviweb"   [LabVIEW NXG 3.1.0]
panel controls:
  "Start Fire": bool
  "Stop Fire": bool
panel indicators:
  "Intensity Graph": i32[][]
  "ms per frame": u32
uses:
  Library::Init Pixel Array.gvi
  Library::Add Fire Source.gvi
  Library::Add Fire Pixel Source.gvi
  Library::Stop Fire.gvi
  Library::Do Fire.gvi
diagram:
  w1 = 80  # Width
  w2 = 42  # Height
  call "Init Pixel Array.gvi"(Width=w1, Height=w2) -> (Pixel Array=w3)
  call "Add Fire Source.gvi"(Pixel Array In=w3, Width=w1) -> (Pixel Array Out=w4)
  w5 = cluster{"Element 1": i32, "Element 2": i32} {all zero or empty}
  # SEQ containing latest mouse click coordinate.
  Obtain Queue(element data type=w5, max queue size=1) -> (queue out=w6)
  Tick Count() -> (timer value=w7)
  s1 = w4  # shift register
  s2 = FALSE  # shift register
  s3 = w7  # shift register
  while {
    Wait(time to wait=4)
    Dequeue Element(queue=w6, timeout in ms=0) -> (element=w8, error out=w9, timed out?=w10)
    case (w10) {
      frame False, Default {
        call "Add Fire Pixel Source.gvi"(Pixel Array In=s1, Width=w1, Height=w2, Click Position=w8) -> (Pixel Array Out=w11)
      }
      frame True {
        w11 = s1
      }
    }
    case ($"Start Fire") {
      frame False, Default {
        w12 = w11
        w13 = s2
      }
      frame True {
        call "Add Fire Source.gvi"(Pixel Array In=w11, Width=w1) -> (Pixel Array Out=w12)
        w13 = FALSE
      }
    }
    Logical Or(w13, $"Stop Fire") -> w14
    case (w14) {
      frame False, Default {
        w15 = w12
        w16 = w13
      }
      frame True {
        call "Stop Fire.gvi"(Pixel Array In=w12, Width=w1, Height=w2) -> (Pixel Array Out=w15)
        w16 = TRUE
      }
    }
    call "Do Fire.gvi"(Pixel Array In=w15, Width=w1, Height=w2) -> (Pixel Array Out=w17)
    Reshape Array(inArray=w17, size=w2, size=w1) -> w18
    Transpose 2D Array(2D array=w18) -> (transposed array=w19)
    for {
      w20 = each element of w19
      Reverse 1D Array(array=w20) -> (reversed array=w22)
      append w22 to w21
    }
    $"Intensity Graph" <- w21
    Tick Count() -> (timer value=w23)
    Subtract(x=w23, y=s3) -> w24
    $"ms per frame" <- w24
    next s1 = w17
    next s2 = w16
    next s3 = w23
    stop if w9
  }
