vi "Add Fire Pixel Source.gvi"   [LabVIEW Conversion 3.1.0]
# Sets the clicked / dragged pixel position to the fire source, creating a basic particle effect.
inputs:
  "Pixel Array In": i32[], required
  "Width": i32, required
  "Height": i32, required
  "Click Position": cluster{"Element 1": i32, "Element 2": i32}, required
outputs:
  "Pixel Array Out": i32[]
diagram:
  Property Node(instance in=$"Click Position") -> ("Element 1"=w1, "Element 2"=w2)
  Reshape Array(inArray=$"Pixel Array In", size=$Height, size=$Width) -> w3
  Replace Array Subset(inArray=w3, index=w2, index=w1, new=36) -> w4
  Multiply($Width, $Height) -> w5
  Reshape Array(inArray=w4, size=w5) -> w6
  $"Pixel Array Out" <- w6
