vi "Add Fire Source.gvi"   [LabVIEW Conversion 3.1.0]
# Sets the bottom row of pixels in the buffer to the fire source (element 36 of the palette).
inputs:
  "Pixel Array In": i32[], required
  "Width": i32, required
outputs:
  "Pixel Array Out": i32[]
diagram:
  Initialize Array(element=36, size=$Width) -> w1
  Array Size(array=$"Pixel Array In") -> (size(s)=w2)
  Subtract(x=w2, y=$Width) -> w3
  Replace Array Subset(inArray=$"Pixel Array In", index=w3, new=w1) -> w4
  $"Pixel Array Out" <- w4
