vi "Do Fire.gvi"   [LabVIEW NXG 3.1.0]
# This is the main fire processing routine. It loops through every pixel of the pixel array except the bottom row (the fire source), and applies the Spread Fire logic.
inputs:
  "Pixel Array In": i32[], required
  "Width": i32, required
  "Height": i32, required
outputs:
  "Pixel Array Out": i32[]
uses:
  Library::Spread Fire.gvi
diagram:
  s1 = $"Pixel Array In"  # shift register
  for (N = $Width) (iteration -> i1) {
    Decrement(x=$Height) -> w1
    s2 = s1  # shift register
    for (N = w1) (iteration -> i2) {
      Increment(x=i2) -> w2
      Multiply($Width, w2) -> w3
      Add(w3, i1) -> w4
      call "Spread Fire.gvi"(Pixel Array In=s2, Width=$Width, Pixel Source=w4) -> (Pixel Array Out=w5)
      next s2 = w5
    }
    next s1 = s2
  }
  $"Pixel Array Out" <- s1
