vi "Init Pixel Array.gvi"   [LabVIEW Conversion 3.1.0]
# Init the pixel buffer 1D array.
inputs:
  "Width": i32, required
  "Height": i32, required
outputs:
  "Pixel Array": i32[]
diagram:
  Multiply($Width, $Height) -> w1
  Initialize Array(element=0, size=w1) -> w2
  $"Pixel Array" <- w2
