vi "Spread Fire.gvi"   [LabVIEW Conversion 3.1.0]
# This is the core of the fire effect, and randomly moves each fire pixel upward while decreasing its intensity (from white hot through the palette to black).
inputs:
  "Pixel Array In": i32[], required
  "Width": i32, required
  "Pixel Source": i32, required
outputs:
  "Pixel Array Out": i32[]
diagram:
  Array Index(array=$"Pixel Array In") -> (out0[$"Pixel Source"]=w1)
  Is Equal To 0(x=w1) -> w2
  case (w2) {
    frame False, Default {
      Random Number() -> (number (0 to 1)=w4)
      Multiply(3, w4) -> w5
      To Long Integer(number=w5) -> w6
      Subtract(x=$"Pixel Source", y=w6) -> w7
      Increment(x=w7) -> w8
      Subtract(x=w8, y=$Width) -> w9
      Logical And(w6, 1) -> w10
      Subtract(x=w1, y=w10) -> w11
      Replace Array Subset(inArray=$"Pixel Array In", index=w9, new=w11) -> w3
    }
    frame True {
      Subtract(x=$"Pixel Source", y=$Width) -> w12
      Replace Array Subset(inArray=$"Pixel Array In", index=w12, new=0) -> w3
    }
  }
  $"Pixel Array Out" <- w3
