vi "Stop Fire.gvi"   [LabVIEW Conversion 3.1.0]
# Removes the fire source by randomly decreasing its intensity until it is removed completely. Repeated calls to Do Fire.vi will then burn up the remainder of the fire.
inputs:
  "Pixel Array In": i32[], required
  "Width": i32, required
  "Height": i32, required
outputs:
  "Pixel Array Out": i32[]
diagram:
  Decrement(x=$Height) -> w1
  s1 = $"Pixel Array In"  # shift register
  s2 = w1  # shift register
  for (N = 6) {
    s3 = s1  # shift register
    s4 = s2  # shift register
    for (N = $Width) (iteration -> i1) {
      Multiply($Width, s4) -> w2
      Add(w2, i1) -> w3
      Array Index(array=s3) -> (out0[w3]=w4)
      Is Greater Than 0(x=w4) -> w5
      case (w5) {
        frame False, Default {
          w6 = s3
        }
        frame True {
          Random Number() -> (number (0 to 1)=w7)
          To Long Integer(number=w7) -> w8
          Subtract(x=w4, y=w8) -> w9
          Replace Array Subset(inArray=s3, index=w3, new=w9) -> w6
        }
      }
      next s3 = w6
    }
    Decrement(x=s4) -> w10
    next s1 = s3
    next s2 = w10
  }
  $"Pixel Array Out" <- s1
