vi "Create GeoCharts.gvi"   [LabVIEW NXG 5.0.0]
inputs:
  "error in": error
  "container reference": "HtmlContainer reference", required
outputs:
  "geochart reference": "geochart reference.gtype"
  "error out": error
types:
  "geochart reference.gtype" = "NI.JavaScriptReference"
uses:
  GoogleCharts::Support::GoogleCharts.jsli::CreateGeoChart
diagram:
  Obtain JavaScript Reference(reference in=$"container reference", error in=$"error in") -> (error out=w1, javascript reference out=w2)
  call "CreateGeoChart"(container=w2, error in=w1) -> (geoChartsReference=w3, error out=w4)
  $"geochart reference" <- w3
  Close Reference(error in=w4, reference=w2) -> (error out=w5)
  $"error out" <- w5
