vi "Plot GeoCharts Data.gvi"   [LabVIEW NXG 5.0.0]
inputs:
  "error in": error
  "geochart reference in": "geochart reference.gtype", required
  "columns": cluster{"label": string, "type": string}[], required
  "rows": string[][], required
outputs:
  "error out": error
  "geochart reference out": "geochart reference.gtype"
types:
  "geochart reference.gtype" = "NI.JavaScriptReference"
uses:
  GoogleCharts::Support::GoogleCharts.jsli::PlotGeoChartData
diagram:
  $"geochart reference out" <- $"geochart reference in"
  Flatten To Json(anything=$columns, error in (no error)=$"error in") -> (JSON string=w1, error out=w2)
  Flatten To Json(anything=$rows, error in (no error)=w2) -> (JSON string=w3, error out=w4)
  call "PlotGeoChartData"(geoChartReference=$"geochart reference in", columnsJSON=w1, rowsJSON=w3, error in=w4) -> (error out=w5)
  $"error out" <- w5
