vi "Load Google Charts.gvi"   [LabVIEW NXG 5.0.0]
inputs:
  "mapsApiKey": string
  "version": string = "current"
  "packages": string[], required
  "error in": error
outputs:
  "error out": error
uses:
  GoogleCharts::Support::GoogleCharts.jsli::Load
diagram:
  Flatten To Json(anything=$packages, error in (no error)=$"error in") -> (JSON string=w1, error out=w2)
  call "Load"(version=$version, packagesJSON=w1, mapsApiKey=$mapsApiKey, error in=w2) -> (error out=w3)
  $"error out" <- w3
