vi "Create Button.gvi"   [LabVIEW NXG 5.0.0]
inputs:
  "error in": error
  "container": "HtmlContainer reference", required
  "value": string
outputs:
  "error out": error
  "wired button reference": "wired button reference.gtype"
types:
  "wired button reference.gtype" = "NI.JavaScriptReference"
uses:
  WiredElements::Support::WiredElements.jsli::IncludeDependencies
  DOM::Build::Create Elements.gvi
  DOM::Values::Append Property as String.gvi
  DOM::Configure::Set Attributes and Properties.gvi
  DOM::Build::Append Children.gvi
diagram:
  Obtain JavaScript Reference(reference in=$container, error in=$"error in") -> (error out=w1, javascript reference out=w2)
  call "IncludeDependencies"(error in=w1) -> (error out=w3)
  call "Create Elements.gvi"(tag names=["wired-button"], error in=w3) -> (element references=w4, error out=w5)
  Array Index(array=w4) -> (out0[_]=w6)
  $"wired button reference" <- w6
  call "Append Property as String.gvi"(name="textContent", value=$value) -> (dom values out=w7)
  call "Set Attributes and Properties.gvi"(element reference in=w6, dom values=w7, error in=w5) -> (element reference out=w8, error out=w9)
  Build Array(w8) -> w10
  call "Append Children.gvi"(parent reference in=w2, child references=w10, error in=w9) -> (parent reference out=w11, error out=w12)
  Close Reference(error in=w12, reference=w11) -> (error out=w13)
  $"error out" <- w13
