vi "Create IFrame.gvi"   [LabVIEW NXG 5.0.0]
inputs:
  "placeholder reference": "HtmlContainer reference", required
  "attributes": "attribute.gtype"[], required
  "error in": error
outputs:
  "error out": error
  "iframe reference": "NI.JavaScriptReference"
types:
  "attribute.gtype" = cluster{"name": string, "value": string}
uses:
  IFrame::Support::IFrame.jsli::CreateIFrame
diagram:
  Flatten To Json(anything=$attributes, error in (no error)=$"error in") -> (JSON string=w1, error out=w2)
  Obtain JavaScript Reference(reference in=$"placeholder reference", error in=w2) -> (error out=w3, javascript reference out=w4)
  call "CreateIFrame"(placeholder=w4, src=w1, error in=w3) -> (iframe=w5, error out=w6)
  Close Reference(error in=w6, reference=w4) -> (error out=w7)
  $"error out" <- w7
  $"iframe reference" <- w5
