vi "Remove IFrame.gvi"   [LabVIEW NXG 5.0.0]
inputs:
  "error in": error
  "iframe reference": "NI.JavaScriptReference", required
outputs:
  "error out": error
uses:
  IFrame::Support::IFrame.jsli::RemoveIFrame
diagram:
  call "RemoveIFrame"(iframeElement=$"iframe reference") -> (error out=w1)
  Merge Errors(w1, $"error in") -> (error out=w2)
  $"error out" <- w2
