vi "index.gviweb"   [LabVIEW NXG 5.0.0]
panel controls:
  "stop": bool
types:
  "attribute.gtype" = cluster{"name": string, "value": string}
uses:
  WebApp::Support::Build YouTube URL.gvi
  IFrame::Create IFrame.gvi
  IFrame::Remove IFrame.gvi
diagram:
  call "Build YouTube URL.gvi"(video id="2R5x5bzp3uk") -> (youtube url=w1)
  Property Node(instance in="attribute.gtype" {all zero or empty}, "name"="src", "value"=w1) -> (instance out=w2)
  w3 = "accelerometer; autoplay; clipboard-write; encrypted-media; gyroscope; picture-in-picture"
  Property Node(instance in="attribute.gtype" {all zero or empty}, "name"="allow", "value"=w3) -> (instance out=w4)
  Property Node(instance in="attribute.gtype" {all zero or empty}, "name"="allowfullscreen", "value"="") -> (instance out=w5)
  Property Node(instance in="attribute.gtype" {all zero or empty}, "name"="style", "value"="border: none;") -> (instance out=w6)
  Build Array(w2, w4, w5, w6) -> w7
  call "Create IFrame.gvi"(placeholder reference=reference to "YouTube Video", attributes=w7) -> (iframe reference=w8, error out=w9)
  while {
    Wait(time to wait=50)
    stop if $stop
  }
  call "Remove IFrame.gvi"(iframe reference=w8, error in=w9)
