vi "Animation Mixer.gvi"   [G Web Development Software 22.3.0]
inputs:
  "dom values in": "dom values.gtype"
outputs:
  "dom values out": "dom values.gtype"
types:
  "dom value type.gtype" = enum{"unknown", "attribute", "absent", "undefined", "boolean", "number", "string"}
  "dom value.gtype" = cluster{"type": "dom value type.gtype", "name": string, "value": string}
  "dom values.gtype" = "dom value.gtype"[]
uses:
  DOM::Configure::Create Style Attribute Value.gvi
  DOM::Values::Append Attribute.gvi
diagram:
  call "Create Style Attribute Value.gvi"(style property names=["loop", "timeScale"], style property values=["repeat", ".5"]) -> (style attribute value=w1)
  call "Append Attribute.gvi"(dom values in=$"dom values in", name="animation-mixer", value=w1) -> (dom values out=w2)
  $"dom values out" <- w2
