vi "Position.gvi"   [LabVIEW NXG 4.0.0]
inputs:
  "dom values in": "dom values.gtype"
  "x": f64, required
  "y": f64, required
  "z": f64, required
outputs:
  "dom values out": "dom values.gtype"
types:
  "dom value type.gtype" = enum{"unknown", "attribute", "absent", "undefined", "boolean", "number", "string"}
  "dom value.gtype" = cluster{"type": "dom value type.gtype", "name": string, "value": string}
  "dom values.gtype" = "dom value.gtype"[]
uses:
  DOM::Values::Append Property as Double.gvi
diagram:
  call "Append Property as Double.gvi"(dom values in=$"dom values in", name="object3D.position.x", value=$x) -> (dom values out=w1)
  call "Append Property as Double.gvi"(dom values in=w1, name="object3D.position.y", value=$y) -> (dom values out=w2)
  call "Append Property as Double.gvi"(dom values in=w2, name="object3D.position.z", value=$z) -> (dom values out=w3)
  $"dom values out" <- w3
