vi "Rotation.gvi"   [LabVIEW NXG 4.0.0]
inputs:
  "dom values in": "dom values.gtype"
  "x": f64
  "y": f64
  "z": f64
outputs:
  "dom values out": "dom values.gtype"
types:
  "dom value type.gtype" = enum{"unknown", "attribute", "absent", "undefined", "boolean", "number", "string"}
  "dom value.gtype" = cluster{"type": "dom value type.gtype", "name": string, "value": string}
  "dom values.gtype" = "dom value.gtype"[]
uses:
  DOM::Values::Append Property as Double.gvi
diagram:
  Divide(x=f64 default, y=180) -> w1
  Multiply($x, w1) -> w2
  call "Append Property as Double.gvi"(dom values in=$"dom values in", name="object3D.rotation.x", value=w2) -> (dom values out=w3)
  Multiply($y, w1) -> w4
  call "Append Property as Double.gvi"(dom values in=w3, name="object3D.rotation.y", value=w4) -> (dom values out=w5)
  Multiply($z, w1) -> w6
  call "Append Property as Double.gvi"(dom values in=w5, name="object3D.rotation.z", value=w6) -> (dom values out=w7)
  $"dom values out" <- w7
