vi "Text.gvi"   [G Web Development Software 22.3.0]
inputs:
  "dom values in": "dom values.gtype"
  "text": string, required
outputs:
  "dom values out": "dom values.gtype"
types:
  "dom value type.gtype" = enum{"unknown", "attribute", "absent", "undefined", "boolean", "number", "string"}
  "dom value.gtype" = cluster{"type": "dom value type.gtype", "name": string, "value": string}
  "dom values.gtype" = "dom value.gtype"[]
uses:
  DOM::Configure::Create Style Attribute Value.gvi
  DOM::Values::Append Attribute.gvi
diagram:
  Build Array($text) -> w1
  call "Create Style Attribute Value.gvi"(style property names=["value"], style property values=w1) -> (style attribute value=w2)
  call "Append Attribute.gvi"(dom values in=$"dom values in", name="text-geometry", value=w2) -> (dom values out=w3)
  $"dom values out" <- w3
