vi "Create and Append Entity.gvi"   [G Web Development Software 22.3.0]
inputs:
  "error in": error
  "dom values": "dom values.gtype"
  "document target reference (global document)": "dom reference.gtype"
  "parent reference in": "dom reference.gtype", required
outputs:
  "entity reference": "dom reference.gtype"
  "error out": error
  "parent reference out": "dom reference.gtype"
types:
  "dom value type.gtype" = enum{"unknown", "attribute", "absent", "undefined", "boolean", "number", "string"}
  "dom value.gtype" = cluster{"type": "dom value type.gtype", "name": string, "value": string}
  "dom values.gtype" = "dom value.gtype"[]
  "dom reference.gtype" = "NI.JavaScriptReference"
uses:
  DOM::Build::Create Elements.gvi
  DOM::Configure::Set Attributes and Properties.gvi
  DOM::Build::Append Children.gvi
diagram:
  $"parent reference out" <- $"parent reference in"
  call "Create Elements.gvi"(tag names=["a-entity"], error in=$"error in", document target reference (global document)=$"document target reference (global document)", inert?=FALSE) -> (element references=w1, error out=w2)
  Array Index(array=w1) -> (out0[_]=w3)
  call "Set Attributes and Properties.gvi"(element reference in=w3, dom values=$"dom values", error in=w2) -> (element reference out=w4, error out=w5)
  Build Array(w4) -> w6
  call "Append Children.gvi"(parent reference in=$"parent reference in", child references=w6, error in=w5) -> (error out=w7)
  $"error out" <- w7
  $"entity reference" <- w4
