vi "Create and Append GLTF Model Entity.gvi"   [LabVIEW NXG 4.0.0]
inputs:
  "parent reference in": "dom reference.gtype", required
  "error in": error
  "src": string, required
  "dom values": "dom values.gtype"
  "document target reference (global document)": "dom reference.gtype"
outputs:
  "entity reference": "dom reference.gtype"
  "parent reference out": "dom reference.gtype"
  "error out": error
types:
  "dom value type.gtype" = enum{"unknown", "attribute", "absent", "undefined", "boolean", "number", "string"}
  "dom value.gtype" = cluster{"type": "dom value type.gtype", "name": string, "value": string}
  "dom values.gtype" = "dom value.gtype"[]
  "dom reference.gtype" = i32
uses:
  DOM::Build::Create Elements.gvi
  DOM::Monitor::Add Event Listener.gvi
  DOM::Values::Append Attribute.gvi
  DOM::Configure::Set Attributes and Properties.gvi
  DOM::Build::Append Children.gvi
  DOM::Monitor::Wait For Event.gvi
  DOM::Monitor::Remove Event Listener.gvi
diagram:
  $"parent reference out" <- $"parent reference in"
  Build Array("a-gltf-model") -> w1
  call "Create Elements.gvi"(tag names=w1, error in=$"error in", document target reference (global document)=$"document target reference (global document)", inert?=FALSE) -> (element references=w2, error out=w3)
  # TODO add check for model-error
  Array Index(array=w2) -> (out0[_]=w4)
  call "Add Event Listener.gvi"(element reference in=w4, event name="model-loaded", error in=w3) -> (element reference out=w5, event manager reference=w6, error out=w7)
  call "Append Attribute.gvi"(dom values in=$"dom values", name="src", value=$src) -> (dom values out=w8)
  call "Set Attributes and Properties.gvi"(element reference in=w5, dom values=w8, error in=w7) -> (element reference out=w9, error out=w10)
  Build Array(w9) -> w11
  call "Append Children.gvi"(parent reference in=$"parent reference in", child references=w11, error in=w10) -> (error out=w12)
  call "Wait For Event.gvi"(event manager reference in=w6, error in=w12) -> (event manager reference out=w13, error out=w14)
  call "Remove Event Listener.gvi"(event manager reference=w13, error in=w14) -> (error out=w15)
  $"error out" <- w15
  $"entity reference" <- w9
