vi "Create and Append Scene.gvi"   [G Web Development Software 22.3.0]
inputs:
  "document target reference (global document)": "dom reference.gtype"
  "error in": error
  "selector": string, required
  "dom values": "dom values.gtype"
  "clear parent content": bool = TRUE
outputs:
  "scene reference": "dom reference.gtype"
  "error out": error
types:
  "dom value type.gtype" = enum{"unknown", "attribute", "absent", "undefined", "boolean", "number", "string"}
  "dom value.gtype" = cluster{"type": "dom value type.gtype", "name": string, "value": string}
  "dom values.gtype" = "dom value.gtype"[]
  "dom reference.gtype" = "NI.JavaScriptReference"
uses:
  DOM::Build::Create Elements.gvi
  DOM::Values::Append Attribute.gvi
  DOM::Configure::Set Attributes and Properties.gvi
  DOM::Tasks::Select Element and Append Content.gvi
diagram:
  call "Create Elements.gvi"(tag names=["a-scene"], error in=$"error in", document target reference (global document)=$"document target reference (global document)", inert?=FALSE) -> (element references=w1, error out=w2)
  call "Append Attribute.gvi"(dom values in=$"dom values", name="embedded") -> (dom values out=w3)
  Array Index(array=w1) -> (out0[_]=w4)
  call "Set Attributes and Properties.gvi"(element reference in=w4, dom values=w3, error in=w2) -> (element reference out=w5, error out=w6)
  call "Select Element and Append Content.gvi"(parent selector=$selector, child dom reference in=w5, clear parent content=$"clear parent content", error in=w6, parent document target reference (global document)=$"document target reference (global document)") -> (child dom reference out=w7, error out=w8)
  $"scene reference" <- w7
  $"error out" <- w8
