vi "Create and Append AR Marker.gvi"   [G Web Development Software 22.3.0]
inputs:
  "parent reference in": "dom reference.gtype"
  "error in": error
  "document target reference (global document)": "dom reference.gtype"
  "dom values": "dom values.gtype"
outputs:
  "parent reference out": "dom reference.gtype"
  "error out": error
  "entity reference": "dom reference.gtype"
types:
  "dom value type.gtype" = enum{"unknown", "attribute", "absent", "undefined", "boolean", "number", "string"}
  "dom value.gtype" = cluster{"type": "dom value type.gtype", "name": string, "value": string}
  "dom values.gtype" = "dom value.gtype"[]
  "dom reference.gtype" = "NI.JavaScriptReference"
uses:
  DOM::Build::Create Elements.gvi
  DOM::Values::Append Attribute.gvi
  DOM::Configure::Set Attributes and Properties.gvi
  DOM::Build::Append Children.gvi
diagram:
  $"parent reference out" <- $"parent reference in"
  call "Create Elements.gvi"(tag names=["a-marker"], error in=$"error in", document target reference (global document)=$"document target reference (global document)", inert?=FALSE) -> (element references=w1, error out=w2)
  call "Append Attribute.gvi"(dom values in=$"dom values", name="type", value="pattern") -> (dom values out=w3)
  call "Append Attribute.gvi"(dom values in=w3, name="url", value="AR/Support/node_modules/ar_js/data/data/patt.hiro") -> (dom values out=w4)
  Array Index(array=w1) -> (out0[_]=w5)
  call "Set Attributes and Properties.gvi"(element reference in=w5, dom values=w4, error in=w2) -> (element reference out=w6, error out=w7)
  Build Array(w6) -> w8
  call "Append Children.gvi"(parent reference in=$"parent reference in", child references=w8, error in=w7) -> (error out=w9)
  $"error out" <- w9
  $"entity reference" <- w6
