vi "Animation Mixer.gvi"   [LabVIEW NXG 4.0.0]
inputs:
  "entity attributes in": "entity attributes.gtype"
outputs:
  "entity attributes out": "entity attributes.gtype"
types:
  "dom value type.gtype" = enum{"unknown", "attribute", "absent", "undefined", "boolean", "number", "string"}
  "dom value.gtype" = cluster{"type": "dom value type.gtype", "name": string, "value": string}
  "dom values.gtype" = "dom value.gtype"[]
  "entity attributes.gtype" = cluster{"dom values": "dom values.gtype"}
uses:
  DOM::Configure::Create Style Attribute Value.gvi
  DOM::Values::Append Attribute.gvi
diagram:
  Property Node(instance in=$"entity attributes in") -> ("dom values"=w1, instance out=w2)
  call "Create Style Attribute Value.gvi"(style property names=["loop", "timeScale"], style property values=["repeat", ".5"]) -> (style attribute value=w3)
  call "Append Attribute.gvi"(dom values in=w1, name="animation-mixer", value=w3) -> (dom values out=w4)
  Property Node(instance in=w2, "dom values"=w4) -> (instance out=w5)
  $"entity attributes out" <- w5
