vi "Rotation.gvi"   [LabVIEW NXG 4.0.0]
inputs:
  "entity attributes in": "entity attributes.gtype"
  "x": f64
  "y": f64
  "z": f64
outputs:
  "entity attributes out": "entity attributes.gtype"
types:
  "dom value type.gtype" = enum{"unknown", "attribute", "absent", "undefined", "boolean", "number", "string"}
  "dom value.gtype" = cluster{"type": "dom value type.gtype", "name": string, "value": string}
  "dom values.gtype" = "dom value.gtype"[]
  "entity attributes.gtype" = cluster{"dom values": "dom values.gtype"}
uses:
  DOM::Values::Append Property as Double.gvi
diagram:
  Property Node(instance in=$"entity attributes in") -> ("dom values"=w1, instance out=w2)
  Divide(x=f64 default, y=180) -> w3
  Multiply($x, w3) -> w4
  call "Append Property as Double.gvi"(dom values in=w1, name="object3D.rotation.x", value=w4) -> (dom values out=w5)
  Multiply($y, w3) -> w6
  call "Append Property as Double.gvi"(dom values in=w5, name="object3D.rotation.y", value=w6) -> (dom values out=w7)
  Multiply($z, w3) -> w8
  call "Append Property as Double.gvi"(dom values in=w7, name="object3D.rotation.z", value=w8) -> (dom values out=w9)
  Property Node(instance in=w2, "dom values"=w9) -> (instance out=w10)
  $"entity attributes out" <- w10
