vi "Destroy Entity.gvi"   [LabVIEW NXG 4.0.0]
inputs:
  "error in": error
  "entity reference": "entity reference.gtype", required
outputs:
  "error out": error
types:
  "entity reference.gtype" = u32
uses:
  DOM::Build::Remove Children.gvi
  DOM::Shared::Close DOM References.gvi
diagram:
  Build Array($"entity reference") -> w1
  call "Remove Children.gvi"(element references=w1) -> (error out=w2)
  call "Close DOM References.gvi"(dom references=w1, error in=w2) -> (error out=w3)
  Merge Errors($"error in", w3) -> (error out=w4)
  $"error out" <- w4
