vi "Include AR Dependencies.gvi"   [LabVIEW NXG 4.0.0]
inputs:
  "error in": error
outputs:
  "error out": error
uses:
  AFrame::Support::Include AFrame Dependencies.gvi
  AR::Support::AugmentedReality.jsli::IncludeARDependencies
diagram:
  call "Include AFrame Dependencies.gvi"(error in=$"error in") -> (error out=w1)
  call "IncludeARDependencies"(error in=w1) -> (error out=w2)
  $"error out" <- w2
