vi "Create Scene.gvi"   [LabVIEW NXG 4.0.0]
inputs:
  "selector": string, required
  "error in": error
outputs:
  "error out": error
  "scene reference": "scene reference.gtype"
types:
  "scene reference.gtype" = i32
uses:
  DOM::Build::Create Elements.gvi
  DOM::Values::Append Property as String.gvi
  AugmentedReality::Support::AugmentedReality.jsli::GetAugmentedRealityDirectoryUrl
  DOM::Configure::Set Attributes and Properties.gvi
  DOM::Monitor::Add Event Listener.gvi
  DOM::Tasks::Select Element and Append Content.gvi
  DOM::Monitor::Wait For Event.gvi
  DOM::Monitor::Remove Event Listener.gvi
  DOM::Configure::Get References.gvi
  DOM::Shared::Close DOM References.gvi
diagram:
  Build Array("iframe") -> w1
  call "Create Elements.gvi"(tag names=w1, error in=$"error in") -> (element references=w2, error out=w3)
  Array Index(array=w2) -> (out0[_]=w4)
  call "Append Property as String.gvi"(name="style.height", value="100%") -> (dom values out=w5)
  call "Append Property as String.gvi"(dom values in=w5, name="style.width", value="100%") -> (dom values out=w6)
  call "GetAugmentedRealityDirectoryUrl"() -> (augmented reality directory url=w7)
  Concatenate Strings(w7, "Support/AugmentedReality.html") -> w8
  call "Append Property as String.gvi"(dom values in=w6, name="src", value=w8) -> (dom values out=w9)
  call "Set Attributes and Properties.gvi"(element reference in=w4, dom values=w9, error in=w3) -> (element reference out=w10, error out=w11)
  call "Add Event Listener.gvi"(element reference in=w10, event name="load", error in=w11) -> (element reference out=w12, event manager reference=w13, error out=w14)
  call "Select Element and Append Content.gvi"(parent selector=$selector, child dom reference in=w12, clear parent content=TRUE, error in=w14) -> (error out=w15)
  call "Wait For Event.gvi"(event manager reference in=w13, error in=w15) -> (event manager reference out=w16, error out=w17)
  call "Remove Event Listener.gvi"(event manager reference=w16, error in=w17) -> (error out=w18)
  call "Get References.gvi"(element reference in=w4, property names=["contentDocument"], error in=w18) -> (element reference out=w19, dom references=w20, error out=w21)
  Build Array(w19) -> w22
  call "Close DOM References.gvi"(dom references=w22, error in=w21) -> (error out=w23)
  $"error out" <- w23
  Array Index(array=w20) -> (out0[_]=w24)
  $"scene reference" <- w24
