vi "Position.gvi"   [LabVIEW NXG 4.0.0]
inputs:
  "entity attributes in": "entity attributes.gtype"
  "x": f64, required
  "y": f64, required
  "z": f64, required
outputs:
  "entity attributes out": "entity attributes.gtype"
types:
  "dom value type.gtype" = enum{"unknown", "attribute", "absent", "undefined", "boolean", "number", "string"}
  "dom value.gtype" = cluster{"type": "dom value type.gtype", "name": string, "value": string}
  "dom values.gtype" = "dom value.gtype"[]
  "entity attributes.gtype" = cluster{"dom values": "dom values.gtype"}
uses:
  DOM::Values::Append Property as Double.gvi
diagram:
  Property Node(instance in=$"entity attributes in") -> ("dom values"=w1, instance out=w2)
  call "Append Property as Double.gvi"(dom values in=w1, name="object3D.position.x", value=$x) -> (dom values out=w3)
  call "Append Property as Double.gvi"(dom values in=w3, name="object3D.position.y", value=$y) -> (dom values out=w4)
  call "Append Property as Double.gvi"(dom values in=w4, name="object3D.position.z", value=$z) -> (dom values out=w5)
  Property Node(instance in=w2, "dom values"=w5) -> (instance out=w6)
  $"entity attributes out" <- w6
