vi "Create GLTF Model Entity.gvi"   [LabVIEW NXG 3.1.0]
inputs:
  "scene reference in": "scene reference.gtype", required
  "error in": error
  "src": string, required
  "entity attributes": "entity attributes.gtype"
outputs:
  "scene reference out": "scene reference.gtype"
  "entity reference": "entity reference.gtype"
  "error out": error
types:
  "entity reference.gtype" = u32
  "property value config.gtype" = cluster{"type": string, "propertyValueJSON": string}
  "property value configs.gtype" = "property value config.gtype"[]
  "attribute value config.gtype" = cluster{"attributeValue": string, "exists": bool}
  "attribute value configs.gtype" = "attribute value config.gtype"[]
  "entity attributes.gtype" = cluster{"property names": string[], "property value configs": "property value configs.gtype", "attribute names": string[], "attribute value configs": "attribute value configs.gtype"}
  "scene reference.gtype" = i32
uses:
  DOM::Shared::Append Attribute Value Config.gvi
  DOM::Build::Create Elements.gvi
  DOM::Monitor::Add Event Listener.gvi
  AugmentedReality::Entity::Update Entity.gvi
  DOM::Tasks::Select Element and Append Content.gvi
  DOM::Monitor::Wait For Event.gvi
  DOM::Monitor::Remove Event Listener.gvi
diagram:
  $"scene reference out" <- $"scene reference in"
  Property Node(instance in=$"entity attributes") -> ("attribute names"=w1, "attribute value configs"=w2, instance out=w3)
  Build Array(w1, "src") -> w4
  call "Append Attribute Value Config.gvi"(attribute value configs in=w2, attribute value=$src) -> (attribute value configs out=w5)
  Property Node(instance in=w3, "attribute names"=w4, "attribute value configs"=w5) -> (instance out=w6)
  Build Array("a-gltf-model") -> w7
  call "Create Elements.gvi"(tag names=w7, error in=$"error in", document target reference (global document)=$"scene reference in", inert?=FALSE) -> (element references=w8, error out=w9)
  # TODO add check for model-error
  Array Index(array=w8) -> (out0[_]=w10)
  call "Add Event Listener.gvi"(element reference in=w10, event name="model-loaded", error in=w9) -> (element reference out=w11, event manager reference=w12, error out=w13)
  call "Update Entity.gvi"(entity reference in=w11, entity attributes=w6, error in=w13) -> (entity reference out=w14, error out=w15)
  call "Select Element and Append Content.gvi"(parent selector="a-marker", child dom reference in=w14, error in=w15, parent document target reference (global document)=$"scene reference in") -> (child dom reference out=w16, error out=w17)
  $"entity reference" <- w16
  call "Wait For Event.gvi"(event manager reference in=w12, error in=w17) -> (event manager reference out=w18, error out=w19)
  call "Remove Event Listener.gvi"(event manager reference=w18, error in=w19) -> (error out=w20)
  $"error out" <- w20
