vi "Update Entity.gvi"   [LabVIEW NXG 4.0.0]
inputs:
  "error in": error
  "entity reference in": "entity reference.gtype", required
  "entity attributes": "entity attributes.gtype", required
outputs:
  "error out": error
  "entity reference out": "entity reference.gtype"
types:
  "entity reference.gtype" = u32
  "dom value type.gtype" = enum{"unknown", "attribute", "absent", "undefined", "boolean", "number", "string"}
  "dom value.gtype" = cluster{"type": "dom value type.gtype", "name": string, "value": string}
  "dom values.gtype" = "dom value.gtype"[]
  "entity attributes.gtype" = cluster{"dom values": "dom values.gtype"}
uses:
  DOM::Configure::Set Attributes and Properties.gvi
diagram:
  $"entity reference out" <- $"entity reference in"
  Property Node(instance in=$"entity attributes") -> ("dom values"=w1)
  call "Set Attributes and Properties.gvi"(element reference in=$"entity reference in", dom values=w1, error in=$"error in") -> (error out=w2)
  $"error out" <- w2
