vi "Hiro Image Url.gvi"   [LabVIEW NXG 3.1.0]
outputs:
  "hiro image url": string
uses:
  AugmentedReality::Support::AugmentedReality.jsli::GetAugmentedRealityDirectoryUrl
diagram:
  call "GetAugmentedRealityDirectoryUrl"() -> (augmented reality directory url=w1)
  Concatenate Strings(w1, "Support/node_modules/ar_js/data/images/hiro.png") -> w2
  $"hiro image url" <- w2
