vi "Create Elements.gvi"   [LabVIEW NXG 5.0.0]
inputs:
  "tag names": string[], required
  "error in": error
  "document target reference (global document)": "dom reference.gtype"
  "inert?": bool = TRUE
outputs:
  "element references": "dom reference.gtype"[]
  "error out": error
types:
  "dom reference.gtype" = "NI.JavaScriptReference"
uses:
  DOM::Support::Default or Global.gvi
  DOM::Support::DOM.jsli::CreateElements
diagram:
  call "Default or Global.gvi"(input target=$"document target reference (global document)") -> (document=w1)
  Flatten To Json(anything=$"tag names") -> (JSON string=w2)
  call "CreateElements"(documentTarget=w1, tagNamesJSON=w2, isInert=$"inert?", error in=$"error in") -> (elements=w3, error out=w4)
  $"element references" <- w3
  $"error out" <- w4
