vi "Get Properties.gvi"   [LabVIEW NXG 4.0.0]
inputs:
  "element reference in": "dom reference.gtype", required
  "property names": string[], required
  "error in": error
outputs:
  "property value configs": "dom values.gtype"
  "error out": error
  "element reference out": "dom reference.gtype"
types:
  "dom reference.gtype" = i32
  "dom value type.gtype" = enum{"unknown", "attribute", "absent", "undefined", "boolean", "number", "string"}
  "dom value.gtype" = cluster{"type": "dom value type.gtype", "name": string, "value": string}
  "dom values.gtype" = "dom value.gtype"[]
uses:
  DOM::Support::DOM.jsli::GetProperties
  DOM::Support::DOM Values from JSON.gvi
diagram:
  $"element reference out" <- $"element reference in"
  Flatten To JSON(anything=$"property names") -> (JSON string=w1)
  call "GetProperties"(elementReference=$"element reference in", propertyNamesJSON=w1, error in=$"error in") -> (propertyValueConfigsJSON=w2, error out=w3)
  call "DOM Values from JSON.gvi"(json=w2, error in=w3) -> (dom values=w4, error out=w5)
  $"property value configs" <- w4
  $"error out" <- w5
