vi "Set Attributes and Properties.gvi"   [LabVIEW NXG 4.0.0]
inputs:
  "element reference in": "dom reference.gtype", required
  "error in": error
  "dom values": "dom values.gtype", required
outputs:
  "error out": error
  "element reference out": "dom reference.gtype"
types:
  "dom reference.gtype" = i32
  "dom value type.gtype" = enum{"unknown", "attribute", "absent", "undefined", "boolean", "number", "string"}
  "dom value.gtype" = cluster{"type": "dom value type.gtype", "name": string, "value": string}
  "dom values.gtype" = "dom value.gtype"[]
uses:
  DOM::Support::DOM Values to JSON.gvi
  DOM::Support::DOM.jsli::SetDomValues
diagram:
  $"element reference out" <- $"element reference in"
  call "DOM Values to JSON.gvi"(dom values=$"dom values", error in=$"error in") -> (json=w1, error out=w2)
  call "SetDomValues"(elementReference=$"element reference in", domValuesJSON=w1, error in=w2) -> (error out=w3)
  $"error out" <- w3
