vi "Wait For Event.gvi"   [LabVIEW NXG 4.0.0]
inputs:
  "event manager reference in": "event manager reference.gtype", required
  "error in": error
outputs:
  "event manager reference out": "event manager reference.gtype"
  "error out": error
  "dom values": "dom values.gtype"
types:
  "event manager reference.gtype" = i32
  "dom value type.gtype" = enum{"unknown", "attribute", "absent", "undefined", "boolean", "number", "string"}
  "dom value.gtype" = cluster{"type": "dom value type.gtype", "name": string, "value": string}
  "dom values.gtype" = "dom value.gtype"[]
uses:
  DOM::Support::DOM.jsli::WaitForEvent
  DOM::Support::DOM Values from JSON.gvi
diagram:
  $"event manager reference out" <- $"event manager reference in"
  call "WaitForEvent"(eventManagerReference=$"event manager reference in", error in=$"error in") -> (propertyValueConfigsJSON=w1, error out=w2)
  call "DOM Values from JSON.gvi"(json=w1, error in=w2) -> (dom values=w3, error out=w4)
  $"dom values" <- w3
  $"error out" <- w4
