vi "Query Selectors.gvi"   [LabVIEW NXG 5.0.0]
inputs:
  "error in": error
  "selectors": string[], required
  "dom target reference in (global document)": "dom reference.gtype"
outputs:
  "element references": "dom reference.gtype"[]
  "error out": error
  "dom target reference out": "dom reference.gtype"
types:
  "dom reference.gtype" = "NI.JavaScriptReference"
uses:
  DOM::Support::Default or Global.gvi
  DOM::Support::DOM.jsli::QuerySelectors
diagram:
  $"dom target reference out" <- $"dom target reference in (global document)"
  call "Default or Global.gvi"(input target=$"dom target reference in (global document)") -> (document=w1)
  Flatten To Json(anything=$selectors) -> (JSON string=w2)
  call "QuerySelectors"(domTarget=w1, selectorsJSON=w2, error in=$"error in") -> (elements=w3, error out=w4)
  $"element references" <- w3
  $"error out" <- w4
