vi "Build DOM Error Cluster.gvi"   [LabVIEW NXG 3.1.0]
inputs:
  "error in": error
  "dom error": "dom error.gtype" = "webvidom_unknown_error"
  "description": string  # error message is the error description to appear in the error out cluster.
  "is error?": bool = TRUE
outputs:
  "error out": error
types:
  "dom error.gtype" = enum{"webvidom_unknown_error"}
uses:
  NI::G Core::Error::Build Error Cluster.gvi
  DOM::Support::Scan for DOM Error.gvi
diagram:
  Property Node(instance in=$"error in") -> ("status"=w1, "code"=w2, instance out=w3)
  Is Equal(x=w2, y=44300) -> w4
  Logical And(w1, w4) -> w5
  w6 = 567000  # WebVI Experiments error code base
  w7 = 0  # WebVI DOM offset
  Add(w6, w7) -> w8
  case (w5) {
    frame False, Default {
      case ($"is error?") {
        frame False, Default {
          # Not setting a new error value so passthrough
          w9 = w3
        }
        frame True {
          Add($"dom error", w8) -> w10
          call "Build Error Cluster.gvi"(error in=w3, code=w10, description=$description) -> (error out=w9)
        }
      }
    }
    frame True {
      call "Scan for DOM Error.gvi"() -> (found dom error?=w11, dom error=w12)
      # Replace the error code if the existing code was 44300 which is the generic Exception occurred during JS error
      case (w11) {
        frame False, Default {
          # JS error not in WebVI DOM format so passthrough
          w9 = w3
        }
        frame True {
          Add(w12, w8) -> w13
          Property Node(instance in=w3, "code"=w13) -> (instance out=w9)
        }
      }
    }
  }
  $"error out" <- w9
