vi "DOM Values from JSON.gvi"   [LabVIEW NXG 4.0.0]
inputs:
  "json": string, required
  "error in": error
outputs:
  "dom values": "dom values.gtype"
  "error out": error
types:
  "dom value type.gtype" = enum{"unknown", "attribute", "absent", "undefined", "boolean", "number", "string"}
  "dom value.gtype" = cluster{"type": "dom value type.gtype", "name": string, "value": string}
  "dom values.gtype" = "dom value.gtype"[]
  T1 = cluster{"type": string, "name": string, "value": string}
diagram:
  Unflatten From JSON(JSON string=$json, error in (no error)=$"error in", type and defaults=T1[] []) -> (error out=w1, value=w2)
  s1 = w1  # shift register
  for {
    w3 = each element of w2
    Property Node(instance in=w3) -> ("name"=w5, "value"=w6, "type"=w7)
    Scan From String(inputString=w7, errIn=s1, default="unknown") -> (errOut=w8, out0=w9)
    Property Node(instance in="dom value.gtype" {all zero or empty}, "name"=w5, "value"=w6, "type"=w9) -> (instance out=w10)
    append w10 to w4
    next s1 = w8
    stop if w8
  }
  $"dom values" <- w4
  $"error out" <- s1
