vi "Default or Global.gvi"   [LabVIEW NXG 5.0.0]
inputs:
  "input target": "NI.JavaScriptReference"
outputs:
  "document": "NI.JavaScriptReference"
uses:
  DOM::Support::DOM.jsli::GetGlobalDocument
diagram:
  s1 = uninitialised  # shift register
  while {
    Is First Call() -> w1
    case (w1) {
      frame False, Default {
        w2 = s1
      }
      frame True {
        call "GetGlobalDocument"() -> (document=w2)
      }
    }
    next s1 = w2
    stop if TRUE
  }
  Is Not A Number Or Path Or Refnum(number=$"input target") -> w3
  Select(s=w3, t=s1, f=$"input target") -> w4
  $document <- w4
