vi "Replace Element Content with IFrame.gvi"   [G Web Development Software 22.3.0]
inputs:
  "selector": string, required
  "url": string, required
  "error in": error
  "parent document target reference (global document)": "dom reference.gtype"
outputs:
  "iframe document": "dom reference.gtype"
  "iframe": "dom reference.gtype"
  "error out": error
types:
  "dom reference.gtype" = "NI.JavaScriptReference"
uses:
  DOM::Build::Create Elements.gvi
  DOM::Values::Append Property as String.gvi
  DOM::Configure::Set Attributes and Properties.gvi
  DOM::Monitor::Add Event Listener.gvi
  DOM::Tasks::Select Element and Append Content.gvi
  DOM::Monitor::Wait For Event.gvi
  DOM::Monitor::Remove Event Listener.gvi
  DOM::Configure::Get References.gvi
diagram:
  Build Array("iframe") -> w1
  call "Create Elements.gvi"(tag names=w1, error in=$"error in") -> (element references=w2, error out=w3)
  Array Index(array=w2) -> (out0[_]=w4)
  call "Append Property as String.gvi"(name="style.height", value="100%") -> (dom values out=w5)
  call "Append Property as String.gvi"(dom values in=w5, name="style.width", value="100%") -> (dom values out=w6)
  call "Append Property as String.gvi"(dom values in=w6, name="src", value=$url) -> (dom values out=w7)
  call "Set Attributes and Properties.gvi"(element reference in=w4, dom values=w7, error in=w3) -> (element reference out=w8, error out=w9)
  call "Add Event Listener.gvi"(element reference in=w8, event name="load", error in=w9) -> (element reference out=w10, event manager reference=w11, error out=w12)
  call "Select Element and Append Content.gvi"(parent selector=$selector, child dom reference in=w10, clear parent content=TRUE, error in=w12, parent document target reference (global document)=$"parent document target reference (global document)") -> (error out=w13)
  call "Wait For Event.gvi"(event manager reference in=w11, error in=w13) -> (event manager reference out=w14, error out=w15)
  call "Remove Event Listener.gvi"(event manager reference=w14, error in=w15) -> (error out=w16)
  call "Get References.gvi"(element reference in=w4, property names=["contentDocument"], error in=w16) -> (element reference out=w17, dom references=w18, error out=w19)
  $iframe <- w17
  $"error out" <- w19
  Array Index(array=w18) -> (out0[_]=w20)
  $"iframe document" <- w20
