vi "Append Property as Boolean.gvi"   [LabVIEW NXG 4.0.0]
inputs:
  "dom values in": "dom values.gtype"
  "value": bool, required
  "name": string
outputs:
  "dom values out": "dom values.gtype"
types:
  "dom value type.gtype" = enum{"unknown", "attribute", "absent", "undefined", "boolean", "double", "integer", "string"}
  "dom value.gtype" = cluster{"type": "dom value type.gtype", "name": string, "value": string}
  "dom values.gtype" = "dom value.gtype"[]
diagram:
  Select(s=$value, t="true", f="false") -> w1
  Property Node(instance in="dom value.gtype" {all zero or empty}, "name"=$name, "value"=w1, "type"="boolean") -> (instance out=w2)
  Build Array($"dom values in", w2) -> w3
  $"dom values out" <- w3
