vi "Append Property as String.gvi"   [LabVIEW NXG 4.0.0]
inputs:
  "dom values in": "dom values.gtype"
  "value": string, required
  "name": string
outputs:
  "dom values out": "dom values.gtype"
types:
  "dom value type.gtype" = enum{"unknown", "attribute", "absent", "undefined", "boolean", "double", "integer", "string"}
  "dom value.gtype" = cluster{"type": "dom value type.gtype", "name": string, "value": string}
  "dom values.gtype" = "dom value.gtype"[]
diagram:
  Property Node(instance in="dom value.gtype" {all zero or empty}, "name"=$name, "value"=$value, "type"="string") -> (instance out=w1)
  Build Array($"dom values in", w1) -> w2
  $"dom values out" <- w2
