vi "index.gviweb"   [G Web Development Software 22.3.0]
panel controls:
  "chassis 1": bool
  "chassis 2": bool
  "chassis 3": bool
panel indicators:
  "my-scene": string
uses:
  AFrame::Support::Include AFrame Dependencies.gvi
  DOM::Build::Create Document Fragment.gvi
  DOM::Search::Query Selectors.gvi
  AFrame::Entity Attributes::Text.gvi
  DOM::Configure::Create Style Attribute Value.gvi
  DOM::Values::Append Attribute.gvi
  DOM::Configure::Set Attributes and Properties.gvi
  AFrame::Scene::Create and Append Scene.gvi
  DOM::Build::Append Children.gvi
diagram:
  call "Include AFrame Dependencies.gvi"()
  $"chassis 1" <- FALSE
  w1 = """<a-assets>
    <img id="grid" src="Support/grid.png"  crossorigin="anonymous">
    <img id="sky" src="Support/sky.jpg" crossorigin="anonymous" />
</a-assets>

<a-entity position="0 0 2" rotation="5 0 0">
    <a-entity
        geometry="primitive: plane; width: 10000; height: 10000;"
        rotation="-90 0 0"
        material="src: #grid; repeat: 10000 10000; transparent: true;metalness:0.6; roughness: 0.4; sphericalEnvMap: #sky;">
    </a-entity>

    <a-gltf-model src="Support/sts.glb" animation="property: rotation; to: 0 360 0; loop: true; dur: 10000; easing:easeInOutQuad" position="-2.5 0 -5">
        <a-entity id="chassisOne" text-geometry="value:offline" position="-1 1.5 0" material="color:red"></a-entity>
        <a-entity text-geometry="value:1" position="-.2 .3 .4" material="color:blue"></a-entity>
    </a-gltf-model>

    <a-gltf-model src="Support/sts.glb" animation="property: rotation; to: 0 360 0; loop: true; dur: 10000; easing:easeInOutQuad" position="0 0 -5">
        <a-entity id="chassisTwo" text-geometry="value:offline" position="-1 1.5 0" material="color:red"></a-entity>
        <a-entity text-geometry="value:2" position="-.2 .3 .4" material="color:blue"></a-entity>
    </a-gltf-model>

    <a-gltf-model src="Support/sts.glb" animation="property: rotation; to: 0 360 0; loop: true; dur: 10000; easing:easeInOutQuad" position="2.5 0 -5">
        <a-entity id="chassisThree" text-geometry="value:offline" position="-1 1.5 0" material="color:red"></a-entity>
        <a-entity text-geometry="value:3" position="-.2 .3 .4" material="color:blue"></a-entity>
    </a-gltf-model>

    <a-entity light="color: #ccccff; intensity: 1; type: ambient;" visible=""></a-entity>
    <a-entity light="color: ffaaff; intensity: 1.5" position="5 5 5"></a-entity>
    <a-entity light="color: white; intensity: 0.5" position="-5 5 15"></a-entity>
    <a-entity light="color: white; type: ambient;"></a-entity>
</a-entity>
<a-sky src="#sky" rotation="0 -90 0"></a-sky>"""
  call "Create Document Fragment.gvi"(content=w1, inert?=FALSE) -> (document fragment reference=w2, error out=w3)
  call "Query Selectors.gvi"(dom target reference in (global document)=w2, selectors=["#chassisOne", "#chassisTwo", "#chassisThree"], error in=w3) -> (dom target reference out=w4, element references=w5, error out=w6)
  while {
    event {
      on "chassis 1" Value changed; "chassis 2" Value changed; "chassis 3" Value changed {
        Event Data() -> ("Index"=w7, "New Value"=w8)
        Array Index(array=w5) -> (out0[w7]=w9)
        Select(s=w8, t="online", f="offline") -> w10
        call "Text.gvi"(text=w10) -> (dom values out=w11)
        Select(s=w8, t=["green"], f=["red"]) -> w12
        call "Create Style Attribute Value.gvi"(style property names=["color"], style property values=w12) -> (style attribute value=w13)
        call "Append Attribute.gvi"(dom values in=w11, name="material", value=w13) -> (dom values out=w14)
        call "Set Attributes and Properties.gvi"(element reference in=w9, dom values=w14)
      }
    }
    stop if FALSE
  }
  $"chassis 2" <- FALSE
  $"chassis 3" <- FALSE
  call "Create and Append Scene.gvi"(selector=".my-scene") -> (scene reference=w15)
  Build Array(w4) -> w16
  call "Append Children.gvi"(parent reference in=w15, child references=w16, error in=w6)
