vi "AugmentedRealityPanel.gviweb"   [LabVIEW NXG 4.0.0]
uses:
  AFrame::Include AFrame Dependencies.gvi
  AR::Include AR Dependencies.gvi
diagram:
  call "Include AFrame Dependencies.gvi"() -> (error out=w1)
  call "Include AR Dependencies.gvi"(error in=w1)
