vi "index.gviweb"   [LabVIEW NXG 4.0.0]
panel controls:
  "Decrypt Data": bool
  "Hyperlink Control": string = "https://sketchfab.com/3d-models/wooden-box-8c2d0108d70b4dc0a4f4bc58a31ed765"
panel indicators:
  "Output": error
uses:
  AR::Create and Append AR Scene.gvi
  AR::Create and Append AR Marker.gvi
  AFrame::Entity::Create and Append GLTF Model Entity.gvi
  AFrame::Entity Attributes::Text.gvi
  AFrame::Entity Attributes::Position.gvi
  AFrame::Entity Attributes::Rotation.gvi
  AFrame::Entity::Create and Append Entity.gvi
  AFrame::Entity Attributes::Animation Mixer.gvi
  DOM::Configure::Set Attributes and Properties.gvi
diagram:
  call "Create and Append AR Scene.gvi"(clear parent content=FALSE, selector=".vrdemo", ar panel url="AugmentedRealityPanel.html") -> (scene reference=w1, error out=w2, ar document target reference=w3)
  call "Create and Append AR Marker.gvi"(parent reference in=w1, error in=w2, document target reference (global document)=w3) -> (entity reference=w4, error out=w5)
  call "Create and Append GLTF Model Entity.gvi"(parent reference in=w4, src="wooden_box/scene.gltf", error in=w5, document target reference (global document)=w3) -> (parent reference out=w6, entity reference=w7, error out=w8)
  call "Text.gvi"(text="1243") -> (dom values out=w9)
  call "Position.gvi"(dom values in=w9, x=-0.75, y=0.2, z=0) -> (dom values out=w10)
  call "Rotation.gvi"(dom values in=w10, x=-90, y=0, z=0) -> (dom values out=w11)
  call "Create and Append Entity.gvi"(parent reference in=w6, dom values=w11, error in=w8, document target reference (global document)=w3) -> (error out=w12)
  s1 = w12  # shift register
  while {
    event (timeout = 100) {
      on "Decrypt Data" Value changed {
        call "Animation Mixer.gvi"() -> (dom values out=w14)
        call "Set Attributes and Properties.gvi"(element reference in=w7, dom values=w14, error in=s1) -> (error out=w13)
      }
      on "Timeout" {
        w13 = s1
      }
    }
    next s1 = w13
    stop if w13
  }
  $Output <- s1
