vi "index.gviweb"   [LabVIEW NXG 4.0.0]
panel controls:
  "line 1": string = "LabVIEW NXG"
  "line 2": string = "WEB MODULE"
  "line 3": string = "WebVIs"
  "Hyperlink Control": string = "https://aframe.io/examples/showcase/hello-metaverse/"
  "Hyperlink Control_2": string = "https://sketchfab.com/models/031875966a5740f18ac4cffa8b14031d#"
panel indicators:
  "URL Image": string
uses:
  AFrame::Support::Include AFrame Dependencies.gvi
  DOM::Build::Create Document Fragment.gvi
  DOM::Search::Query Selectors.gvi
  DOM::Values::Append Attribute.gvi
  AFrame::Scene::Create and Append Scene.gvi
  DOM::Build::Append Children.gvi
  AFrame::Entity Attributes::Text.gvi
  DOM::Configure::Set Attributes and Properties.gvi
diagram:
  call "Include AFrame Dependencies.gvi"()
  w1 = """<a-scene>
    <a-assets>
        <img id="pink" src="Support/pink.jpg" crossorigin="anonymous" />
        <img id="grid" src="Support/grid.png"  crossorigin="anonymous">
        <img id="chrome" src="Support/chrome.jpg" crossorigin="anonymous">
        <img id="sky" src="Support/sky.jpg" crossorigin="anonymous" />
        <a-asset-item id="dawningFont" src="Support/dawningFont.json"></a-asset-item>
        <a-asset-item id="exoFont" src="Support/exoFont.json"></a-asset-item>
        <a-asset-item id="exoItalicFont" src="Support/exoItalicFont.json"></a-asset-item>
        <img id="logo" src="Support/logo.svg" crossorigin="anonymous" />
    </a-assets>

    <a-gltf-model src="Support/sts.glb" position="-6 1 -5" scale="2 2 2" animation="property: rotation; to: 0 360 0; loop: true; dur: 10000; easing:easeInOutQuad">
    </a-gltf-model>

    <a-gltf-model src="Support/eagle.glb" position="7 3 -5" scale="2 2 2" animation="property: rotation; to: 0 360 0; loop: true; dur: 10000; easing:easeInOutQuad">
    </a-gltf-model>

    <a-svg src="#logo" position="0 5 -10" rotation="20 0 0" scale="2 2 2" proportional-scale="2" extrude="0.5" z-factor="0">
    </a-svg>

  </a-svg>
    <a-entity position="-3 1 -4" rotation="5 0 0">
        <a-entity id="lineOne"
            rotation="0 0 5"
            position="-1.5 2 0.2"
            text-geometry="value: LabVIEW NXG; font: #dawningFont; bevelEnabled: true; bevelSize: 0.05; bevelThickness: 0.05; curveSegments: 12; size: 1; height: 0;"
            material="color:lavenderblush; metalness:1; roughness: 0; sphericalEnvMap: #pink;">
        </a-entity>

        <a-entity
            geometry="primitive: plane; width: 10000; height: 10000;"
            rotation="-90 0 0"
            material="src: #grid; repeat: 10000 10000; transparent: true;metalness:0.6; roughness: 0.4; sphericalEnvMap: #sky;">
        </a-entity>

        <a-entity light="color: #ccccff; intensity: 1; type: ambient;" visible=""></a-entity>
        <a-entity light="color: ffaaff; intensity: 1.5" position="5 5 5"></a-entity>
        <a-entity light="color: white; intensity: 0.5" position="-5 5 15"></a-entity>
        <a-entity light="color: white; type: ambient;"></a-entity>

        <a-entity id="lineTwo"
            position="-0.5 0.5 -0.5"
            scale="0.6 1.2 1"
            text-geometry="value: WEB MODULE; font: #exoFont; bevelEnabled: true; bevelSize: 0.1; bevelThickness: 0.1; curveSegments: 1; size: 1.5; height: 0.5;"
            material="color:pink; metalness:0.9; roughness: 0.05; sphericalEnvMap: #chrome;">
        </a-entity>

        <a-entity id="lineThree"
            position="1 0 0.3"
            text-geometry="value: WebVIs; font: #exoItalicFont; style: italic; size: 0.8; weight: bold; height: 0; bevelEnabled: true; bevelSize: 0.02; bevelThickness: 0.02; curveSegments: 1"
            material="shader: flat; color: white;">
        </a-entity>
    </a-entity>
    <a-sky src="#sky" rotation="0 -90 0"></a-sky>
</a-scene>"""
  call "Create Document Fragment.gvi"(content=w1, inert?=FALSE) -> (document fragment reference=w2, error out=w3)
  call "Query Selectors.gvi"(dom target reference in (global document)=w2, selectors=["#lineOne", "#lineTwo", "#lineThree"], error in=w3) -> (dom target reference out=w4, element references=w5, error out=w6)
  call "Append Attribute.gvi"(name="loading-screen", value="enabled: false") -> (dom values out=w7)
  call "Append Attribute.gvi"(dom values in=w7, name="renderer", value="colorManagement: false") -> (dom values out=w8)
  call "Create and Append Scene.gvi"(selector=".my-scene", dom values=w8) -> (scene reference=w9)
  Build Array(w4) -> w10
  call "Append Children.gvi"(parent reference in=w9, child references=w10, error in=w6) -> (error out=w11)
  s1 = w11  # shift register
  while {
    event {
      on "line 1" Value changed; "line 2" Value changed; "line 3" Value changed {
        Event Data() -> ("Index"=w13, "New Value"=w14)
        Array Index(array=w5) -> (out0[w13]=w15)
        call "Text.gvi"(text=w14) -> (dom values out=w16)
        call "Set Attributes and Properties.gvi"(element reference in=w15, dom values=w16, error in=s1) -> (error out=w12)
      }
    }
    next s1 = w12
    stop if s1
  }
