vi "index.gviweb"   [LabVIEW NXG 4.0.0]
panel controls:
  "Height Offset of Box": u32
  "start camera": bool
  "Tab": i32
  "Hyperlink Control": string = "https://sketchfab.com/models/031875966a5740f18ac4cffa8b14031d#"
  "Hyperlink Control_2": string = "https://medium.com/arjs/augmented-reality-in-10-lines-of-html-4e193ea9fdbf"
  "clear model": bool
  "clear scene": bool
panel indicators:
  "URL Image": string
  "Output": error
uses:
  AugmentedReality::Support::Hiro Image Url.gvi
  AugmentedReality::Scene::Create Scene.gvi
  AugmentedReality::Support::Top-Level WebVI Directory Url.gvi
  AugmentedReality::Entity::Create GLTF Model Entity.gvi
  WebApp::Set Model Height.gviweb
  AugmentedReality::Entity::Destroy Entity.gvi
  AugmentedReality::Scene::Destroy Scene.gvi
diagram:
  sequence {
    frame 0 {
      call "Hiro Image Url.gvi"() -> (hiro image url=w1)
      $"URL Image" <- w1
    }
  }
  while (after w1) {
    Wait(time to wait=10)
    stop if $"start camera"
  }
  call "Create Scene.gvi"(selector=".eagle-demo", error in=no error) -> (scene reference=w2, error out=w3)
  call "Top-Level WebVI Directory Url.gvi"() -> (top-level vi directory url=w4)
  Concatenate Strings(w4, "scene.gltf") -> w5
  call "Create GLTF Model Entity.gvi"(scene reference in=w2, src=w5, error in=w3) -> (entity reference=w6, error out=w7)
  s1 = w7  # shift register
  while {
    Wait(time to wait=10)
    call "Set Model Height.gviweb"(gltf model reference=w6, height=$"Height Offset of Box", error in=s1) -> (error out=w8)
    Logical Or(w8, $"clear model") -> w9
    next s1 = w8
    stop if w9
  }
  call "Destroy Entity.gvi"(entity reference=w6, error in=s1) -> (error out=w10)
  while {
    Wait(time to wait=10)
    Logical Or(w10, $"clear scene") -> w11
    stop if w11
  }
  call "Destroy Scene.gvi"(scene reference=w2, error in=w10) -> (error out=w12)
  $Output <- w12
