vi "Get Attribute.gvi"   [LabVIEW NXG 5.0.0]
inputs:
  "input element in": "input element.gtype", required
  "name": string, required
  "error in": error
outputs:
  "input element out": "input element.gtype"
  "error out": error
  "value": string
  "exists": bool
types:
  "input element.gtype" = "NI.JavaScriptReference"
uses:
  InputElement::Support::InputElement.jsli::GetAttribute
diagram:
  $"input element out" <- $"input element in"
  call "GetAttribute"(inputElement=$"input element in", name=$name, error in=$"error in") -> (resultJSON=w1, error out=w2)
  Unflatten From Json(JSON string=w1, error in (no error)=w2, type and defaults=cluster{"value": string, "exists": bool} {all zero or empty}) -> (error out=w3, value=w4)
  Property Node(instance in=w4) -> ("value"=w5, "exists"=w6)
  $value <- w5
  $exists <- w6
  $"error out" <- w3
