vi "Create Input Element.gvi"   [G Web Development Software 22.3.0]
inputs:
  "error in": error
  "placeholder": "HtmlContainer reference", required
  "attributes": cluster{"name": string, "value": string}[] = [{"name"="type", "value"="date"}]
outputs:
  "error out": error
  "input element": "input element.gtype"
types:
  "input element.gtype" = "NI.JavaScriptReference"
uses:
  InputElement::Support::InputElement.jsli::CreateElement
diagram:
  Obtain JavaScript Reference(reference in=$placeholder, error in=$"error in") -> (error out=w1, javascript reference out=w2)
  Flatten To Json(anything=$attributes, error in (no error)=w1) -> (JSON string=w3, error out=w4)
  call "CreateElement"(placeholder=w2, attributesJSON=w3, error in=w4) -> (inputElement=w5, error out=w6)
  $"input element" <- w5
  $"error out" <- w6
