vi "Listen for Events.gvi"   [LabVIEW NXG 5.0.0]
inputs:
  "error in": error
  "event configuration": "event configuration.gtype", required
outputs:
  "error out (warning: blocking)": error
types:
  "event stream reader.gtype" = "NI.JavaScriptReference"
  "event configuration.gtype" = cluster{"event stream reader": "event stream reader.gtype", "change event": "event change"}
uses:
  InputElement::Support::InputElement.jsli::WaitForEvent
diagram:
  Property Node(instance in=$"event configuration") -> ("change event"=w1, "event stream reader"=w2)
  s1 = $"error in"  # shift register
  while {
    call "WaitForEvent"(eventStreamReader=w2, error in=s1) -> (resultJSON=w3, error out=w4)
    Unflatten From Json(JSON string=w3, error in (no error)=w4, type and defaults=cluster{"value": string, "done": bool} {all zero or empty}) -> (error out=w5, value=w6)
    Property Node(instance in=w6) -> ("value"=w7, "done"=w8)
    case (w8) {
      frame True {
        w9 = w5
        w10 = w8
      }
      frame False {
        Generate User Event(error in=w5, event data=w7, user event=w1) -> (error out=w9)
        w10 = w8
      }
    }
    Logical Or(w9, w10) -> w11
    next s1 = w9
    stop if w11
  }
  $"error out (warning: blocking)" <- s1
