vi "index.gviweb"   [G Web Development Software 22.3.0]
panel controls:
  "password value": string
  "date value": string
  "color value": string
  "password get": bool
  "password set": bool
  "date get": bool
  "date set": bool
  "color get": bool
  "color set": bool
panel indicators:
  "password change event": string
  "date change event": string
  "color change event": string
uses:
  InputElement::Create Input Element.gvi
  InputElement::Value Event::Add Event Listener.gvi
  InputElement::Value Event::Listen for Events.gvi
  InputElement::Value::Get Value.gvi
  InputElement::Value::Set Value.gvi
diagram:
  call "Create Input Element.gvi"(placeholder=reference to "password", attributes=[{"name"="type", "value"="password"}]) -> (input element=w1, error out=w2)
  call "Add Event Listener.gvi"(input element in=w1, error in=w2) -> (change user event=w3, input element out=w4, error out=w5, event configuration=w6)
  call "Listen for Events.gvi"(event configuration=w6)
  Register For Events("change"=w3, error in=w5) -> (error out=w7, event registration refnum out=w8)
  s1 = w7  # shift register
  while {
    event (timeout = 100) (dynamic events = w8) {
      on dynamic event 0 {
        Event Data() -> ("event data"=w10)
        $"password change event" <- w10
        w9 = s1
      }
      on "password get" Value changed {
        call "Get Value.gvi"(input element in=w4, error in=s1) -> (value=w11, error out=w9)
        $"password value" <- w11
      }
      on "password set" Value changed {
        call "Set Value.gvi"(input element in=w4, value=$"password value", error in=s1) -> (error out=w9)
      }
      on "Timeout" {
        w9 = s1
      }
    }
    next s1 = w9
    stop if w9
  }
  Property Node(instance in=s1) -> ("source"=w12)
  One Button Dialog(message=w12)
  call "Create Input Element.gvi"(placeholder=reference to "date", attributes=[{"name"="type", "value"="date"}]) -> (input element=w13, error out=w14)
  call "Add Event Listener.gvi"(input element in=w13, error in=w14) -> (change user event=w15, input element out=w16, error out=w17, event configuration=w18)
  call "Listen for Events.gvi"(event configuration=w18)
  Register For Events("change"=w15, error in=w17) -> (error out=w19, event registration refnum out=w20)
  s2 = w19  # shift register
  while {
    event (timeout = 100) (dynamic events = w20) {
      on dynamic event 0 {
        Event Data() -> ("event data"=w22)
        $"date change event" <- w22
        w21 = s2
      }
      on "date get" Value changed {
        call "Get Value.gvi"(input element in=w16, error in=s2) -> (value=w23, error out=w21)
        $"date value" <- w23
      }
      on "date set" Value changed {
        call "Set Value.gvi"(input element in=w16, value=$"date value", error in=s2) -> (error out=w21)
      }
      on "Timeout" {
        w21 = s2
      }
    }
    next s2 = w21
    stop if w21
  }
  Property Node(instance in=s2) -> ("source"=w24)
  One Button Dialog(message=w24)
  call "Create Input Element.gvi"(placeholder=reference to "color", attributes=[{"name"="type", "value"="color"}]) -> (input element=w25, error out=w26)
  call "Add Event Listener.gvi"(input element in=w25, error in=w26) -> (change user event=w27, input element out=w28, error out=w29, event configuration=w30)
  call "Listen for Events.gvi"(event configuration=w30)
  Register For Events("change"=w27, error in=w29) -> (error out=w31, event registration refnum out=w32)
  s3 = w31  # shift register
  while {
    event (timeout = 100) (dynamic events = w32) {
      on dynamic event 0 {
        Event Data() -> ("event data"=w34)
        $"color change event" <- w34
        w33 = s3
      }
      on "color get" Value changed {
        call "Get Value.gvi"(input element in=w28, error in=s3) -> (value=w35, error out=w33)
        $"color value" <- w35
      }
      on "color set" Value changed {
        call "Set Value.gvi"(input element in=w28, value=$"color value", error in=s3) -> (error out=w33)
      }
      on "Timeout" {
        w33 = s3
      }
    }
    next s3 = w33
    stop if w33
  }
  Property Node(instance in=s3) -> ("source"=w36)
  One Button Dialog(message=w36)
