vi "Encode JSON Optimized.gvi"   [LabVIEW NXG 3.1.0]
inputs:
  "json tokens": "JSON Tokens.gtype"
outputs:
  "json string": string
types:
  "Type.gtype" = enum{"Array", "ArrayEnd", "ArrayDouble", "ArrayString", "ArrayBoolean", "Object", "ObjectKey", "ObjectEnd", "Double", "String", "True", "False", "Null"}
  "Token.gtype" = cluster{"type": "Type.gtype", "data": string, "offsets": i32[]}
  "JSON Tokens.gtype" = "Token.gtype"[]
uses:
  JSONParser::Support::Encode JSON Coersion Helper.gvi
diagram:
  call "Encode JSON Coersion Helper.gvi"(JSON Tokens Raw in=$"json tokens") -> (JSON Tokens Raw out=w1)
  Flatten To JSON(anything=w1) -> (JSON string=w2)
  $"json string" <- w2
