vi "Encode JSON.gvi"   [LabVIEW NXG 3.1.0]
inputs:
  "json tokens": "JSON Tokens.gtype", required
  "error in": error
outputs:
  "json string": string
  "error out": error
types:
  "Type.gtype" = enum{"Array", "ArrayEnd", "ArrayDouble", "ArrayString", "ArrayBoolean", "Object", "ObjectKey", "ObjectEnd", "Double", "String", "True", "False", "Null"}
  "Token.gtype" = cluster{"type": "Type.gtype", "data": string, "offsets": i32[]}
  "JSON Tokens.gtype" = "Token.gtype"[]
uses:
  JSONParser::Support::Encode JSON Coersion Helper.gvi
  JSONParser::Support::JSONParser.jsli::JSONStringify
  JSONParser::Support::Concatenate Separator.gvi
diagram:
  # TODO: None of the approaches do validation of the json tokens structure, just assume they are correct. Should probably have some basic (optional?) validation.
  disable {
    frame Enabled {
      call "Encode JSON Coersion Helper.gvi"(JSON Tokens in=$"json tokens") -> (JSON Tokens Raw out=w3)
      # Optimized version doing encoding in JS. Adds overhead for small objects but has a better general case for mid-size to large objects.
      disable {
        frame Disabled {
          # Crashes the runtime when ~20K JSON Tokens are passed to Flatten To JSON. See enabled case for workaround. CAR filed.
          Flatten To JSON(anything=w3, error in (no error)=$"error in") -> (JSON string=w4, error out=w5)
        }
        frame Enabled {
          # Workaround to unwind the outer array to avoid a crash that occurs in the disabled case.
          for (N -> w6) (iteration -> i1) {
            w7 = each element of w3
            Flatten To JSON(anything=w7, error in (no error)=$"error in") -> (JSON string=w9, error out=w5)
            Decrement(x=w6) -> w10
            Is Equal(x=w10, y=i1) -> w11
            Select(s=w11, t="", f=",") -> w12
            Concatenate Strings(w9, w12) -> w13
            append w13 to w8
            stop if w5
          }
          Concatenate Strings("[", w8, "]") -> w4
        }
      }
      call "JSONStringify"(tokensJSON=w4, error in=w5) -> (jsonString=w1, error out=w2)
    }
    frame Disabled {
      w14 = 0  # level
      # Having primarily homogeneous optimized arrays or small objects is fast in G. Heterogeneous arrays or large data sets not consisting of homogeneous optimized arrays are much slower. The optimize case calling to JS may be a better tradeoff. Maybe should use a heuristic to decide which to call?
      s1 = ""  # shift register
      s2 = w14  # shift register
      for (iteration -> i2) {
        w15 = each element of $"json tokens"
        Increment(x=i2) -> w16
        Array Index(array=$"json tokens") -> (out0[w16]=w17)
        Property Node(instance in=w17) -> ("type"=w18)
        Property Node(instance in=w15) -> ("type"=w19, "data"=w20)
        case (w19) {
          frame "Array" {
            Concatenate Strings(s1, "[") -> w21
            Increment(x=s2) -> w22
            w2 = $"error in"
          }
          frame "ArrayEnd" {
            Concatenate Strings(s1, "]") -> w23
            Decrement(x=s2) -> w22
            call "Concatenate Separator.gvi"(partial json string in=w23, next token type=w18, level=w22) -> (partial json string out=w21)
            w2 = $"error in"
          }
          frame "ArrayDouble", "ArrayString", "ArrayBoolean" {
            Concatenate Strings(s1, w20) -> w24
            call "Concatenate Separator.gvi"(partial json string in=w24, next token type=w18, level=s2) -> (partial json string out=w21)
            w22 = s2
            w2 = $"error in"
          }
          frame "Object" {
            Concatenate Strings(s1, "{") -> w21
            Increment(x=s2) -> w22
            w2 = $"error in"
          }
          frame "ObjectKey" {
            Build Array(w20) -> w25
            Flatten To JSON(anything=w25, error in (no error)=$"error in") -> (JSON string=w26, error out=w2)
            String Length(string=w26) -> (length=w27)
            Subtract(x=w27, y=2) -> w28
            # TODO: write a proper json string escape instead
            String Subset(length (rest)=w28, offset (0)=1, string=w26) -> w29
            Concatenate Strings(s1, w29, ":") -> w21
            w22 = s2
          }
          frame "ObjectEnd" {
            Concatenate Strings(s1, "}") -> w30
            Decrement(x=s2) -> w22
            call "Concatenate Separator.gvi"(partial json string in=w30, next token type=w18, level=w22) -> (partial json string out=w21)
            w2 = $"error in"
          }
          frame "Double" {
            Concatenate Strings(s1, w20) -> w31
            call "Concatenate Separator.gvi"(partial json string in=w31, next token type=w18, level=s2) -> (partial json string out=w21)
            w22 = s2
            w2 = $"error in"
          }
          frame "String" {
            Build Array(w20) -> w32
            Flatten To JSON(anything=w32, error in (no error)=$"error in") -> (JSON string=w33, error out=w2)
            String Length(string=w33) -> (length=w34)
            Subtract(x=w34, y=2) -> w35
            # TODO: write a proper json string escape instead
            String Subset(length (rest)=w35, offset (0)=1, string=w33) -> w36
            Concatenate Strings(s1, w36) -> w37
            call "Concatenate Separator.gvi"(partial json string in=w37, next token type=w18, level=s2) -> (partial json string out=w21)
            w22 = s2
          }
          frame "True" {
            Concatenate Strings(s1, "true") -> w38
            call "Concatenate Separator.gvi"(partial json string in=w38, next token type=w18, level=s2) -> (partial json string out=w21)
            w22 = s2
            w2 = $"error in"
          }
          frame "False" {
            Concatenate Strings(s1, "false") -> w39
            call "Concatenate Separator.gvi"(partial json string in=w39, next token type=w18, level=s2) -> (partial json string out=w21)
            w22 = s2
            w2 = $"error in"
          }
          frame "Null" {
            Concatenate Strings(s1, "") -> w40
            call "Concatenate Separator.gvi"(partial json string in=w40, next token type=w18, level=s2) -> (partial json string out=w21)
            w22 = s2
            w2 = $"error in"
          }
        }
        next s1 = w21
        next s2 = w22
        stop if w2
      }
      w1 = s1
    }
  }
  $"json string" <- w1
  $"error out" <- w2
