vi "Concatenate Separator.gvi"   [LabVIEW NXG 3.1.0]
inputs:
  "partial json string in": string, required
  "level": i32, required
  "next token type": "Type.gtype" = "Array", required
outputs:
  "partial json string out": string
types:
  "Type.gtype" = enum{"Array", "ArrayEnd", "ArrayDouble", "ArrayString", "ArrayBoolean", "Object", "ObjectKey", "ObjectEnd", "Double", "String", "True", "False", "Null"}
diagram:
  Is Greater Than 0(x=$level) -> w1
  Is Not Equal(x=$"next token type", y="ArrayEnd") -> w2
  Is Not Equal(x=$"next token type", y="ObjectEnd") -> w3
  Logical And(w1, w2, w3) -> w4
  case (w4) {
    frame False, Default {
      w5 = $"partial json string in"
    }
    frame True {
      Concatenate Strings($"partial json string in", ",") -> w5
    }
  }
  $"partial json string out" <- w5
