vi "JSON Tokens to Encode JSON Tokens.gvi"   [LabVIEW NXG 3.1.0]
inputs:
  "json tokens": "JSON Tokens.gtype", required
outputs:
  "encode json tokens": "Encode JSON Tokens.gtype"
types:
  "JSON Token Type.gtype" = enum{"Array", "ArrayEnd", "ArrayDouble", "ArrayString", "ArrayBoolean", "Object", "ObjectKey", "ObjectEnd", "Double", "String", "True", "False", "Null"}
  "JSON Token.gtype" = cluster{"json token type": "JSON Token Type.gtype", "data": string, "offsets": i32[]}
  "JSON Tokens.gtype" = "JSON Token.gtype"[]
  "Encode JSON Token.gtype" = cluster{"T": u16, "D": string}
  "Encode JSON Tokens.gtype" = "Encode JSON Token.gtype"[]
diagram:
  for {
    w1 = each element of $"json tokens"
    Property Node(instance in=w1) -> ("json token type"=w3, "data"=w4)
    Property Node(instance in="Encode JSON Token.gtype" {all zero or empty}, "T"=w3, "D"=w4) -> (instance out=w5)
    append w5 to w2
  }
  $"encode json tokens" <- w2
