vi "JSON Tree to Encode JSON Tokens.gvi"   [LabVIEW NXG 3.1.0]
inputs:
  "json tree": "JSON Tree.gtype", required
outputs:
  "encode json tokens": "Encode JSON Tokens.gtype"
types:
  "JSON Token Type.gtype" = enum{"Array", "ArrayEnd", "ArrayDouble", "ArrayString", "ArrayBoolean", "Object", "ObjectKey", "ObjectEnd", "Double", "String", "True", "False", "Null"}
  "JSON Token.gtype" = cluster{"json token type": "JSON Token Type.gtype", "data": string, "offsets": i32[]}
  "JSON Tokens.gtype" = "JSON Token.gtype"[]
  "JSON Tree.gtype" = cluster{"json tokens": "JSON Tokens.gtype"}
  "Encode JSON Token.gtype" = cluster{"T": u16, "D": string}
  "Encode JSON Tokens.gtype" = "Encode JSON Token.gtype"[]
diagram:
  Property Node(instance in=$"json tree") -> ("json tokens"=w1)
  for {
    w2 = each element of w1
    Property Node(instance in=w2) -> ("json token type"=w4, "data"=w5)
    Property Node(instance in="Encode JSON Token.gtype" {all zero or empty}, "T"=w4, "D"=w5) -> (instance out=w6)
    append w6 to w3
  }
  $"encode json tokens" <- w3
