vi "stress generate.gvi"   [LabVIEW NXG 3.1.0]
inputs:
  "array size": i32
  "generate faster (size only multiple of 10000)": bool
  "optimize array contents": bool
outputs:
  "generated json": string
diagram:
  case ($"generate faster (size only multiple of 10000)") {
    frame True {
      s1 = ""  # shift register
      for (N = 10000) (iteration -> i1) {
        Format Into String(i1) -> w2
        Concatenate Strings(s1, w2, ",") -> w3
        next s1 = w3
      }
      Quotient And Remainder(x=$"array size", y=10000) -> (floor(x/y)=w4)
      s2 = "["  # shift register
      for (N = w4) {
        Concatenate Strings(s2, s1) -> w5
        next s2 = w5
      }
      w1 = s2
    }
    frame False {
      s3 = "["  # shift register
      for (N = $"array size") (iteration -> i2) {
        Format Into String(i2) -> w6
        Concatenate Strings(s3, w6, ",") -> w7
        next s3 = w7
      }
      w1 = s3
    }
  }
  Select(s=$"optimize array contents", t="-1", f="\"slow\"") -> w8
  Concatenate Strings(w1, w8, "]") -> w9
  $"generated json" <- w9
