vi "test.gviweb"   [LabVIEW NXG 3.1.0]
panel controls:
  "index": i32
panel indicators:
  "element": cluster{"T": u16, "D": string, "O": i32[]}
diagram:
  Unflatten From JSON(JSON string="[{\"T\":0,\"O\":[1]},{\"T\":1}]", type and defaults=cluster{"T": u16, "D": string, "O": i32[]}[] []) -> (value=w1)
  while {
    Wait(time to wait=10)
    Array Index(array=w1) -> (out0[$index]=w2)
    $element <- w2
    stop if FALSE
  }
