vi "index.gviweb"   [LabVIEW NXG 3.1.0]
panel controls:
  "Stop": bool
  "Listbox": i32 = -1
  "Set Locations": bool
  "Locations to set": T1[] = [{"latitude"=30.2643, "longitude"=-97.7393, "text"="Austin Convention Center"}, {"latitude"=30.2653, "longitude"=-97.7472, "text"="ACL Moody theatre"}, {"latitude"=30.269, "longitude"=-97.7421, "text"="Paramount Theatre"}]
types:
  T1 = cluster{"latitude": f64, "longitude": f64, "text": string}
  "marker reference.gtype" = i32
uses:
  Leaflet::Map::Create Map.gvi
  Leaflet::Map::Add Open Street Map Tile Layer.gvi
  Leaflet::Marker::Destroy Marker.gvi
  Leaflet::Marker::Create Marker.gvi
  Leaflet::Marker::Show Marker Popup.gvi
  Leaflet::Map::Destroy Map.gvi
diagram:
  call "Create Map.gvi"(selector=".leaflet-map") -> (map reference=w1, error out=w2)
  call "Add Open Street Map Tile Layer.gvi"(map reference in=w1, error in=w2) -> (map reference out=w3, error out=w4)
  s1 = w4  # shift register
  s2 = "marker reference.gtype"[] []  # shift register
  while {
    case (s1) {
      frame Error, Default {
        w5 = FALSE
        w6 = s1
        w7 = w3
        w8 = s2
      }
      frame No Error {
        event {
          on "Stop" Value changed {
            w5 = $Stop
            w6 = s1
            w8 = s2
            w7 = w3
          }
          on "Set Locations" Value changed {
            s3 = s1  # shift register
            for {
              w9 = each element of s2
              call "Destroy Marker.gvi"(marker reference=w9, error in=s3) -> (error out=w10)
              next s3 = w10
            }
            s4 = s3  # shift register
            for {
              w11 = each element of $"Locations to set"
              Property Node(instance in=w11) -> ("latitude"=w13, "longitude"=w14, "text"=w15)
              call "Create Marker.gvi"(text=w15, map reference=w3, latitude=w13, longitude=w14, error in=s4) -> (marker reference=w16, error out=w17)
              append w16 to w8
              append w15 to w12
              next s4 = w17
            }
            Property Node(instance in=reference to "Listbox", "Items"=w12)
            w5 = default
            w6 = s4
            w7 = w3
          }
          on "Listbox" Value changed {
            Is Greater Or Equal To 0(x=$Listbox) -> w18
            case (w18) {
              frame False, Default {
                w6 = s1
              }
              frame True {
                Array Index(array=s2) -> (out0[$Listbox]=w19)
                call "Show Marker Popup.gvi"(marker reference in=w19, error in=s1) -> (error out=w6)
              }
            }
            w5 = default
            w8 = s2
            w7 = w3
          }
        }
      }
    }
    Logical Or(w6, w5) -> w20
    next s1 = w6
    next s2 = w8
    stop if w20
  }
  call "Destroy Map.gvi"(map reference=w7, error in=s1)
