vi "Classify MobileNet.gvi"   [LabVIEW NXG 3.1.0]
inputs:
  "file reference": "file reference.gtype", required
  "error in": error
  "model reference": "model reference.gtype", required
outputs:
  "error out": error
  "predictions": "predictions.gtype"
types:
  "file reference.gtype" = string
  "model reference.gtype" = i32
  "predictions.gtype" = cluster{"className": string, "probability": f64}[]
uses:
  MobileNet::Support::MobileNet.jsli::ClassifyMobileNet
diagram:
  call "ClassifyMobileNet"(modelReference=$"model reference", fileReference=$"file reference", error in=$"error in") -> (resultsJSON=w1, error out=w2)
  Unflatten From JSON(JSON string=w1, error in (no error)=w2, type and defaults="predictions.gtype" []) -> (error out=w3, value=w4)
  $predictions <- w4
  $"error out" <- w3
