vi "index.gviweb"   [LabVIEW NXG 3.1.0]
panel controls:
  "status": string
panel indicators:
  "predictions": cluster{"className": string, "probability": f64}[]
uses:
  MobileNet::Load MobileNet.gvi
  FileTasks::Capture Image as File.gvi
  MobileNet::Classify MobileNet.gvi
diagram:
  Property Node(instance in=reference to "status", "Value"="loading...") -> (error out=w1)
  call "Load MobileNet.gvi"(error in=w1) -> (model reference=w2, error out=w3)
  Property Node(instance in=reference to "status", "Value"="loaded", error in=w3) -> (error out=w4)
  call "Capture Image as File.gvi"(error in=w4, facing mode="environment") -> (file reference=w5, error out=w6)
  Property Node(instance in=reference to "status", "Value"="classifying", error in=w6) -> (error out=w7)
  call "Classify MobileNet.gvi"(model reference=w2, file reference=w5, error in=w7) -> (predictions=w8)
  $predictions <- w8
