vi "Create Map.gvi"   [LabVIEW NXG 5.1.0]
inputs:
  "placeholder reference": "HtmlContainer reference", required
  "center coordinate (austin, tx)": "coordinate.gtype" = {"latitude"=30.2672, "longitude"=-97.7431}
  "zoom level (from 0-18)": i32 = 13
  "error in": error
outputs:
  "error out": error
  "map reference": "map reference.gtype"
types:
  "map reference.gtype" = "NI.JavaScriptReference"
  "coordinate.gtype" = cluster{"latitude": f64, "longitude": f64}
uses:
  GoogleMap::Support::GoogleMap.jsli::CreateMap
diagram:
  Property Node(instance in=$"center coordinate (austin, tx)") -> ("latitude"=w1, "longitude"=w2)
  Obtain JavaScript Reference(reference in=$"placeholder reference", error in=$"error in") -> (error out=w3, javascript reference out=w4)
  call "CreateMap"(placeholder=w4, lat=w1, lng=w2, zoom=$"zoom level (from 0-18)", error in=w3) -> (map=w5, error out=w6)
  $"map reference" <- w5
  $"error out" <- w6
