vi "Destroy Map.gvi"   [LabVIEW NXG 5.1.0]
inputs:
  "error in": error
  "map reference": "map reference.gtype", required
outputs:
  "error out": error
types:
  "map reference.gtype" = "NI.JavaScriptReference"
uses:
  GoogleMap::Support::GoogleMap.jsli::DestroyMap
diagram:
  call "DestroyMap"(map=$"map reference") -> (error out=w1)
  Close Reference(error in=w1, reference=$"map reference") -> (error out=w2)
  Merge Errors($"error in", w2) -> (error out=w3)
  $"error out" <- w3
