vi "Destroy Marker Group.gvi"   [LabVIEW NXG 5.1.0]
inputs:
  "error in": error
  "marker group reference": "marker group reference.gtype", required
outputs:
  "error out": error
types:
  "marker group reference.gtype" = "NI.JavaScriptReference"
uses:
  GoogleMap::Support::GoogleMap.jsli::DestroyMarkerGroup
diagram:
  call "DestroyMarkerGroup"(markerGroup=$"marker group reference") -> (error out=w1)
  Close Reference(error in=w1, reference=$"marker group reference") -> (error out=w2)
  Merge Errors($"error in", w2) -> (error out=w3)
  $"error out" <- w3
