vi "Create Marker.gvi"   [G Web Development Software 21.0.0]
inputs:
  "error in": error
  "coordinate": "coordinate.gtype", required
  "icon anchor point": "anchor point.gtype"  # A positive or negative pixel offset relative to the marker coordinate where the marker is top-left at x=0, y=0.
  "popup anchor point": "anchor point.gtype"  # A positive or negative pixel offset relative to the marker coordinate where the marker is top-left at x=0, y=0. Ignored when using default icon.
  "popup text": string
  "icon url (default icon)": string  # The icon image url relative to the running top-level VI
outputs:
  "error out": error
  "marker reference": "marker reference.gtype"
types:
  "marker reference.gtype" = "NI.JavaScriptReference"
  "coordinate.gtype" = cluster{"latitude": f64, "longitude": f64}
  "anchor point.gtype" = cluster{"x": i32, "y": i32}
  T1 = cluster{"popupAnchor": "anchor point.gtype", "iconAnchor": "anchor point.gtype", "iconUrl": string, "popupText": string, "coordinate": "coordinate.gtype"}
uses:
  GoogleMap::Support::GoogleMap.jsli::CreateMarker
diagram:
  Property Node(instance in=T1 {all zero or empty}, "coordinate"=$coordinate, "iconUrl"=$"icon url (default icon)", "iconAnchor"=$"icon anchor point", "popupText"=$"popup text", "popupAnchor"=$"popup anchor point") -> (instance out=w1)
  Flatten To Json(anything=w1, enable LabVIEW extensions=FALSE, error in (no error)=$"error in") -> (JSON string=w2, error out=w3)
  call "CreateMarker"(configJSON=w2, error in=w3) -> (marker=w4, error out=w5)
  $"marker reference" <- w4
  $"error out" <- w5
