vi "Destroy Marker.gvi"   [LabVIEW NXG 5.1.0]
inputs:
  "error in": error
  "marker reference": "marker reference.gtype", required
outputs:
  "error out": error
types:
  "marker reference.gtype" = "NI.JavaScriptReference"
uses:
  GoogleMap::Support::GoogleMap.jsli::DestroyMarker
diagram:
  call "DestroyMarker"(marker=$"marker reference") -> (error out=w1)
  Close Reference(error in=w1, reference=$"marker reference") -> (error out=w2)
  Merge Errors($"error in", w2) -> (error out=w3)
  $"error out" <- w3
