vi "Create Polyline Shape.gvi"   [LabVIEW NXG 5.1.0]
inputs:
  "error in": error
  "coordinates": "coordinate.gtype"[], required
  "stroke style": "stroke style.gtype" = {"color"=4278433157, "weight (px)"=2}
outputs:
  "shape reference": "shape reference.gtype"
  "error out": error
types:
  "shape reference.gtype" = "NI.JavaScriptReference"
  "coordinate.gtype" = cluster{"latitude": f64, "longitude": f64}
  "Color.gtype" = u32
  "stroke style.gtype" = cluster{"color": "Color.gtype", "weight (px)": u32}
uses:
  GoogleMap::Support::Create Stroke JSON.gvi
  GoogleMap::Support::GoogleMap.jsli::CreatePolylineShape
diagram:
  Flatten To Json(anything=$coordinates, error in (no error)=$"error in") -> (JSON string=w1, error out=w2)
  call "Create Stroke JSON.gvi"(stroke style=$"stroke style", error in=w2) -> (stroke json=w3, error out=w4)
  call "CreatePolylineShape"(coordinatesJSON=w1, optionsJSON=w3, error in=w4) -> (polyline=w5, error out=w6)
  $"shape reference" <- w5
  $"error out" <- w6
