vi "Destroy Shape.gvi"   [LabVIEW NXG 5.1.0]
inputs:
  "error in": error
  "shape reference": "shape reference.gtype", required
outputs:
  "error out": error
types:
  "shape reference.gtype" = "NI.JavaScriptReference"
uses:
  GoogleMap::Support::GoogleMap.jsli::DestroyShape
diagram:
  call "DestroyShape"(shape=$"shape reference") -> (error out=w1)
  Close Reference(error in=w1, reference=$"shape reference") -> (error out=w2)
  Merge Errors($"error in", w2) -> (error out=w3)
  $"error out" <- w3
