vi "Create Stroke JSON.gvi"   [LabVIEW NXG 5.1.0]
inputs:
  "error in": error
  "stroke style": "stroke style.gtype" = {"color"=4278433157, "weight (px)"=2}, required
outputs:
  "error out": error
  "stroke json": string
types:
  "Color.gtype" = u32
  "stroke style.gtype" = cluster{"color": "Color.gtype", "weight (px)": u32}
  T1 = cluster{"color": string, "opacity": f64, "weight": u32}
uses:
  GoogleMap::Support::Color to RGBA.gvi
diagram:
  Property Node(instance in=$"stroke style") -> ("color"=w1, "weight (px)"=w2)
  call "Color to RGBA.gvi"(Color Constant=w1) -> (red=w3, green=w4, blue=w5, alpha=w6)
  Format Into String(formatString="#%02x%02x%02x", errIn=$"error in", w3, w4, w5) -> (outString=w7, errOut=w8)
  Divide(x=w6, y=255) -> w9
  Property Node(instance in=T1 {all zero or empty}, "color"=w7, "opacity"=w9, "weight"=w2) -> (instance out=w10)
  Flatten To Json(anything=w10, error in (no error)=w8) -> (JSON string=w11, error out=w12)
  $"stroke json" <- w11
  $"error out" <- w12
