vi "Create Map.gvi"   [LabVIEW NXG 5.1.0]
# Create a Leaflet map using the Open Street Maps tileset.
# To use this VI drop a text decoration on your front panel (not a string control) and position it where desired.
# Select the text control and in the HTML Class Attribute field of the right-rail add a class name to uniquely identify the text control. For example the string “my-map” without the quotes.
# Pass the class attribute used to the selector input using CSS Selector syntax. For example, the HTML Class Attribute “my-map” would have the CSS selector syntax “.my-map” without the quotes.
inputs:
  "placeholder reference": "HtmlContainer reference", required
  "center coordinate": "coordinate.gtype" = {"latitude"=30.2672, "longitude"=-97.7431}
  "error in": error
  "zoom level (from 0-18)": i32 = 13
outputs:
  "error out": error
  "map reference": "map reference.gtype"
types:
  "map reference.gtype" = "NI.JavaScriptReference"
  "coordinate.gtype" = cluster{"latitude": f64, "longitude": f64}
uses:
  Leaflet::Support::Leaflet.jsli::CreateMap
diagram:
  Property Node(instance in=$"center coordinate") -> ("latitude"=w1, "longitude"=w2)
  Obtain JavaScript Reference(reference in=$"placeholder reference", error in=$"error in") -> (error out=w3, javascript reference out=w4)
  call "CreateMap"(placeholder=w4, latitude=w1, longitude=w2, zoom level=$"zoom level (from 0-18)", error in=w3) -> (map=w5, error out=w6)
  $"map reference" <- w5
  $"error out" <- w6
