vi "Create Marker.gvi"   [G Web Development Software 21.0.0]
# Adds a marker to the specified latitude and longitude. The text is associated with a popup for the marker that is visible when clicked or when Show Marker Popup is called.
inputs:
  "coordinate": "coordinate.gtype", required
  "error in": error
  "icon url (default icon)": string  # The icon image url relative to the running top-level VI
  "popup text": string
  "icon anchor point": "anchor point.gtype"  # A positive or negative pixel offset relative to the marker coordinate where the marker is top-left at x=0, y=0.
  "popup anchor point": "anchor point.gtype"  # A positive or negative pixel offset relative to the marker coordinate where the marker is top-left at x=0, y=0. Ignored when using default icon.
outputs:
  "marker reference": "marker reference.gtype"
  "error out": error
types:
  "marker reference.gtype" = "NI.JavaScriptReference"
  "coordinate.gtype" = cluster{"latitude": f64, "longitude": f64}
  "anchor point.gtype" = cluster{"x": i32, "y": i32}
  T1 = cluster{"iconUrl": string, "popupText": string, "popupAnchor": "anchor point.gtype", "coordinate": "coordinate.gtype", "iconAnchor": "anchor point.gtype"}
uses:
  Leaflet::Support::Leaflet.jsli::CreateMarker
diagram:
  Property Node(instance in=T1 {all zero or empty}, "coordinate"=$coordinate, "iconUrl"=$"icon url (default icon)", "iconAnchor"=$"icon anchor point", "popupText"=$"popup text", "popupAnchor"=$"popup anchor point") -> (instance out=w1)
  Flatten To Json(anything=w1, enable LabVIEW extensions=FALSE, error in (no error)=$"error in") -> (JSON string=w2, error out=w3)
  call "CreateMarker"(configJSON=w2, error in=w3) -> (marker=w4, error out=w5)
  $"marker reference" <- w4
  $"error out" <- w5
