vi "Destroy Marker.gvi"   [LabVIEW NXG 5.1.0]
# Destroys a marker and removes it from the map
inputs:
  "marker reference": "marker reference.gtype", required
  "error in": error
outputs:
  "error out": error
types:
  "marker reference.gtype" = "NI.JavaScriptReference"
uses:
  Leaflet::Support::Leaflet.jsli::DestroyMarker
diagram:
  call "DestroyMarker"(marker=$"marker reference") -> (error out=w1)
  Close Reference(error in=w1, reference=$"marker reference") -> (error out=w2)
  Merge Errors($"error in", w2) -> (error out=w3)
  $"error out" <- w3
