vi "Create Polyline Shape.gvi"   [LabVIEW NXG 5.1.0]
inputs:
  "error in": error
  "coordinates": "coordinate.gtype"[], required
  "stroke style": "stroke style.gtype" = {"color"=4278433157, "weight (px)"=2}
outputs:
  "error out": error
  "shape reference": "shape reference.gtype"
types:
  "coordinate.gtype" = cluster{"latitude": f64, "longitude": f64}
  "Color.gtype" = u32
  "stroke style.gtype" = cluster{"color": "Color.gtype", "weight (px)": u32}
  "shape reference.gtype" = "NI.JavaScriptReference"
uses:
  Leaflet::Support::Create Stroke JSON.gvi
  Leaflet::Support::Leaflet.jsli::CreatePolylineShape
diagram:
  Flatten To Json(anything=$coordinates, error in (no error)=$"error in") -> (JSON string=w1, error out=w2)
  call "Create Stroke JSON.gvi"(stroke style=$"stroke style", error in=w2) -> (stroke json=w3, error out=w4)
  call "CreatePolylineShape"(coordinatesJSON=w1, strokeJSON=w3, error in=w4) -> (shape=w5, error out=w6)
  $"shape reference" <- w5
  $"error out" <- w6
