vi "Create Mustache.gvi"   [G Web Development Software 22.3.0]
inputs:
  "placeholder reference": "HtmlContainer reference", required
  "error in": error
outputs:
  "mustache reference": "mustache reference.gtype"
  "error out": error
types:
  "mustache reference.gtype" = "NI.JavaScriptReference"
uses:
  Mustache::Support::Mustache.jsli::CreateMustache
diagram:
  Obtain JavaScript Reference(reference in=$"placeholder reference", error in=$"error in") -> (error out=w1, javascript reference out=w2)
  call "CreateMustache"(placeholder=w2, error in=w1) -> (mustacheReference=w3, error out=w4)
  Close Reference(error in=w4, reference=w2) -> (error out=w5)
  $"error out" <- w5
  $"mustache reference" <- w3
