vi "Destroy Mustache.gvi"   [G Web Development Software 22.3.0]
inputs:
  "error in": error
  "mustache reference": "mustache reference.gtype", required
outputs:
  "error out": error
types:
  "mustache reference.gtype" = "NI.JavaScriptReference"
uses:
  Mustache::Support::Mustache.jsli::DestroyMustache
diagram:
  call "DestroyMustache"(mustacheReference=$"mustache reference") -> (error out=w1)
  Close Reference(error in=w1, reference=$"mustache reference") -> (error out=w2)
  Merge Errors($"error in", w2) -> (error out=w3)
  $"error out" <- w3
