vi "index.gviweb"   [G Web Development Software 22.3.0]
panel controls:
  "data": T1 = {"users"=[{"first"="John", "last"="Doe"}, {"first"="Jane", "last"="Doe"}, {"first"="Tarquin", "last"="Fin-tim-lin-bin-whin-bim-lim-bus-stop-F’tang-F’tang-Olé-Biscuitbarrel"}]}
types:
  T1 = cluster{"users": cluster{"first": string, "last": string}[]}
uses:
  Mustache::Create Mustache.gvi
  Mustache::Render Mustache.gvi
diagram:
  w1 = """<style>
table {
  border-collapse: collapse;
  border-spacing: 0;
  width: 100%;
  border: 1px solid #ddd;
}

th, td {
  text-align: left;
  padding: 8px;
}

tr:nth-child(even){
  background-color: #f2f2f2
}
</style>

<table>
<thead>
  <tr>
    <th>First</th>
    <th>Last</th>
  </tr>
</thead>
<tbody>
  {{#users}}
  <tr>
    <td>{{first}}</td>
    <td>{{last}}</td>
  </tr>
  {{/users}}
</tbody>
</table>"""
  call "Create Mustache.gvi"(placeholder reference=reference to "table") -> (mustache reference=w2, error out=w3)
  Flatten To Json(anything=$data, error in (no error)=w3) -> (JSON string=w4, error out=w5)
  call "Render Mustache.gvi"(mustache reference in=w2, template=w1, data json=w4, error in=w5) -> (error out=w6)
  s1 = w6  # shift register
  while {
    event {
      on "data" Value changed {
        Event Data() -> ("New Value"=w8)
        Flatten To Json(anything=w8, error in (no error)=s1) -> (JSON string=w9, error out=w10)
        call "Render Mustache.gvi"(mustache reference in=w2, template=w1, data json=w9, error in=w10) -> (error out=w7)
      }
    }
    next s1 = w7
    stop if w7
  }
