vi "Table Create.gvi"   [G Web Development Software 22.0.0]
inputs:
  "schema": "schema.gtype" = [{"name"="values", "column type"="float"}], required
  "error in": error
outputs:
  "table reference": "table reference.gtype"
  "error out": error
types:
  "column type.gtype" = enum{"string", "float", "integer", "boolean", "date", "datetime"}
  "column.gtype" = cluster{"name": string, "column type": "column type.gtype"}
  "schema.gtype" = "column.gtype"[]
  "table reference.gtype" = "NI.JavaScriptReference"
uses:
  Perspective::Support::Perspective.jsli::TableCreate
diagram:
  s1 = $"error in"  # shift register
  for {
    w1 = each element of $schema
    Property Node(instance in=w1) -> ("name"=w3, "column type"=w4)
    Format Into String(errIn=s1, w4) -> (outString=w5, errOut=w6)
    Property Node(instance in=cluster{"name": string, "type": string} {all zero or empty}, "name"=w3, "type"=w5) -> (instance out=w7)
    append w7 to w2
    next s1 = w6
    stop if w6
  }
  Flatten To Json(anything=w2, error in (no error)=s1) -> (JSON string=w8, error out=w9)
  call "TableCreate"(schemaJSON=w8, error in=w9) -> (table=w10, error out=w11)
  $"table reference" <- w10
  $"error out" <- w11
