vi "Table Update.gvi"   [G Web Development Software 22.0.0]
inputs:
  "error in": error
  "table reference in": "table reference.gtype", required
  "data": variant, required
outputs:
  "table reference out": "table reference.gtype"
  "error out": error
panel indicators:
  "dataprobe": variant
types:
  "table reference.gtype" = "NI.JavaScriptReference"
uses:
  Perspective::Support::Perspective.jsli::TableUpdate
diagram:
  # Requirements:
  # - dataprobe must not be wired to connector pane and name must be unchanged
  # - VI must be named "Table Update.gvi" and be in the "Perspective::Table" namespace
  # - VI must be non reentrant
  sequence {
    frame 0 {
      Set Variant Attribute(name="data", value=$data, variant=variant()) -> (variant out=w1)
    }
    frame 1 {
      $dataprobe <- w1
    }
    frame 2 {
      $"table reference out" <- $"table reference in"
      call "TableUpdate"(table=$"table reference in", error in=$"error in") -> (error out=w2)
      $"error out" <- w2
    }
  }
