vi "Create Viewer.gvi"   [G Web Development Software 22.0.0]
inputs:
  "container": "HtmlContainer reference", required
  "error in": error
outputs:
  "error out": error
  "viewer reference": "viewer reference.gtype"
types:
  "viewer reference.gtype" = "NI.JavaScriptReference"
uses:
  Perspective::Support::Perspective.jsli::CreateViewer
diagram:
  Obtain JavaScript Reference(reference in=$container, error in=$"error in") -> (error out=w1, javascript reference out=w2)
  call "CreateViewer"(container=w2, error in=w1) -> (viewer=w3, error out=w4)
  $"viewer reference" <- w3
  Close Reference(error in=w4, reference=w2) -> (error out=w5)
  $"error out" <- w5
