vi "index.gviweb"   [G Web Development Software 22.0.0]
panel controls:
  "interval (ms)": f64 = 10
uses:
  Perspective::Viewer::Viewer Create.gvi
  Perspective::Table::Table Create.gvi
  Perspective::Viewer::Viewer Load.gvi
  WebApp::Support::Show Error Dialog.gvi
  Perspective::Table::Table Update.gvi
diagram:
  call "Viewer Create.gvi"(container=reference to "HTML Container") -> (viewer reference=w1, error out=w2)
  w3 = [{"name"="x", "column type"="float"}, {"name"="y", "column type"="float"}]
  call "Table Create.gvi"(schema=w3) -> (table reference=w4, error out=w5)
  Merge Errors(w2, w5) -> (error out=w6)
  call "Viewer Load.gvi"(viewer reference in=w1, table reference=w4, error in=w6) -> (error out=w7)
  call "Show Error Dialog.gvi"(error in=w7)
  s1 = w5  # shift register
  while (iteration -> i1) {
    Divide(x=i1, y=f64 default) -> w8
    Sine(x=w8) -> w9
    Multiply(w9, 10) -> w10
    Property Node(instance in=cluster{"x": f64, "y": f64} {all zero or empty}, "x"=i1, "y"=w10) -> (instance out=w11)
    Build Array(w11) -> w12
    call "Table Update.gvi"(table reference in=w4, data=w12, error in=s1) -> (error out=w13)
    Wait(time to wait=$"interval (ms)")
    next s1 = w13
    stop if w13
  }
  call "Show Error Dialog.gvi"(error in=s1)
