vi "Parse File.gvi"   [LabVIEW NXG 3.1.0]
inputs:
  "error in": error
  "uppy file references": "uppy file reference.gtype"[]
  "uppy reference": "uppy reference.gtype"
outputs:
  "value": cluster{"value": f64[]}[]
  "error out": error
types:
  "uppy file reference.gtype" = i32
  "uppy reference.gtype" = i32
uses:
  Uppy::Uppy File::Read Uppy File.gvi
  Uppy::Uppy File::Destroy Uppy Files.gvi
  Uppy::Uppy::Destroy Uppy.gvi
diagram:
  Array Index(array=$"uppy file references") -> (out0[_]=w1)
  call "Read Uppy File.gvi"(uppy file reference in=w1, error in=$"error in") -> (file contents=w2, error out=w3)
  call "Destroy Uppy Files.gvi"(uppy file references=$"uppy file references", error in=w3) -> (error out=w4)
  call "Destroy Uppy.gvi"(uppy reference=$"uppy reference", error in=w4) -> (error out=w5)
  $"error out" <- w5
  Byte Array To String(unsigned byte array=w2) -> (string=w6)
  Unflatten From JSON(JSON string=w6, type and defaults=cluster{"value": f64[]}[] []) -> (value=w7)
  $value <- w7
