vi "Uppy Create and Settings.gvi"   [LabVIEW NXG 3.1.0]
inputs:
  "error in": error
outputs:
  "uppy reference out": "uppy reference.gtype"
  "error out": error
types:
  "uppy reference.gtype" = i32
uses:
  Uppy::Uppy::Create Uppy.gvi
  Uppy::Uppy::Set Uppy Dashboard Options.gvi
diagram:
  call "Create Uppy.gvi"(error in=$"error in") -> (uppy reference=w1, error out=w2)
  call "Set Uppy Dashboard Options.gvi"(uppy reference in=w1, error in=w2, show uppy icon?=FALSE) -> (uppy reference out=w3, error out=w4)
  $"uppy reference out" <- w3
  $"error out" <- w4
