vi "index.gviweb"   [LabVIEW NXG 3.1.0]
panel controls:
  "Load Data": bool
uses:
  ECharts::Core::Create EChart.gvi
  WebApp::Support::3D Settings.gvi
  WebApp::Support::Uppy Create and Settings.gvi
  Uppy::Uppy::Set Uppy Core Options.gvi
  Uppy::Uppy::Request Uppy Files.gvi
  WebApp::Support::Parse File.gvi
  ECharts::Surface Options::Append Surface Series Options.gvi
  ECharts::Core::Update EChart Options.gvi
diagram:
  while {
    event {
      on "Load Data" Value changed {
        call "Create EChart.gvi"(selector=".my-graph") -> (echart reference=w1, error out=w2)
        call "3D Settings.gvi"(echart reference in=w1, error in=w2) -> (echart reference out=w3, error out=w4)
        call "Uppy Create and Settings.gvi"() -> (uppy reference out=w5, error out=w6)
        call "Set Uppy Core Options.gvi"(uppy reference in=w5, error in=w6, max file size=10000000, max number of files=1, allowed file types=[".json"]) -> (uppy reference out=w7, error out=w8)
        call "Request Uppy Files.gvi"(uppy reference in=w7, error in=w8) -> (uppy reference out=w9, uppy file references=w10, error out=w11)
        call "Parse File.gvi"(uppy reference=w9, uppy file references=w10, error in=w11) -> (value=w12)
        call "Append Surface Series Options.gvi"(data=w12) -> (echart options out=w13)
        call "Update EChart Options.gvi"(echart reference in=w3, error in=w4, echart options=w13)
      }
    }
    stop if FALSE
  }
