vi "Enqueue Message (Array).gviweb"   [LabVIEW NXG 3.1.0]
# For a regular message, enqueue the message. For a priority message, enqueue it at the front of the queue.
inputs:
  "message queue in": Queue<T1>, required
  "error in": error
  "message array": string[], required
  "message data array": string[]
  "priority message array": bool[]
outputs:
  "message queue out": Queue<T1>
  "error out": error
types:
  T1 = cluster{"Message": string, "Message Data": string}
diagram:
  $"message queue out" <- $"message queue in"
  # This VI takes an array of messages, message data, and priority message settings, and enqueues those messages. The For Loop auto-indexes on the Message Array only. This allows a user to optionally wire the Message Data Array and Priority Message? Array values.
  s1 = $"error in"  # shift register
  for (iteration -> i1) {
    w1 = each element of $"message array"
    Array Index(array=$"priority message array") -> (out0[i1]=w2)
    Array Index(array=$"message data array") -> (out0[i1]=w3)
    Property Node(instance in=T1 {all zero or empty}, "Message"=w1, "Message Data"=w3) -> (instance out=w4)
    # For a regular message, enqueue the message.  For a priority message, enqueue it at the front of the queue.
    case (w2) {
      frame False, Default {
        Enqueue Element(element=w4, error in=s1, queue=$"message queue in") -> (error out=w5)
      }
      frame True {
        Enqueue Element At Opposite End(element=w4, error in=s1, queue=$"message queue in") -> (error out=w5)
      }
    }
    next s1 = w5
  }
  $"error out" <- s1
