vi "Enqueue Message (Single).gviweb"   [LabVIEW NXG 3.1.0]
# For a regular message, enqueue the message. For a priority message, enqueue it at the front of the queue.
inputs:
  "message queue in": Queue<T1>, required
  "message": string, required
  "message data": string
  "error in": error
  "priority message": bool
outputs:
  "message queue out": Queue<T1>
  "error out": error
types:
  T1 = cluster{"Message": string, "Message Data": string}
diagram:
  $"message queue out" <- $"message queue in"
  Property Node(instance in=T1 {all zero or empty}, "Message"=$message, "Message Data"=$"message data") -> (instance out=w1)
  # For a regular message, enqueue the message.  For a priority message, enqueue it at the front of the queue.
  case ($"priority message") {
    frame False, Default {
      Enqueue Element(element=w1, error in=$"error in", queue=$"message queue in") -> (error out=w2)
    }
    frame True {
      Enqueue Element At Opposite End(element=w1, error in=$"error in", queue=$"message queue in") -> (error out=w2)
    }
  }
  $"error out" <- w2
