vi "Create Plotly.gvi"   [G Web Development Software 22.3.0]
inputs:
  "error in": error
  "container": "HtmlContainer reference", required
outputs:
  "error out": error
  "plot div reference": "plotly div reference.gtype"
types:
  "plotly div reference.gtype" = "NI.JavaScriptReference"
uses:
  Plotly::Support::Plotly.jsli::Create
diagram:
  Obtain JavaScript Reference(reference in=$container, error in=$"error in") -> (error out=w1, javascript reference out=w2)
  call "Create"(container=w2, error in=w1) -> (plotlyDiv=w3, error out=w4)
  $"plot div reference" <- w3
  Close Reference(error in=w4, reference=w2) -> (error out=w5)
  $"error out" <- w5
