vi "Destroy Plotly.gvi"   [G Web Development Software 22.3.0]
inputs:
  "error in": error
  "plotly div reference": "plotly div reference.gtype", required
outputs:
  "error out": error
types:
  "plotly div reference.gtype" = "NI.JavaScriptReference"
uses:
  Plotly::Support::Plotly.jsli::Destroy
diagram:
  call "Destroy"(plotlyDiv=$"plotly div reference") -> (error out=w1)
  Close Reference(error in=w1, reference=$"plotly div reference") -> (error out=w2)
  Merge Errors($"error in", w2) -> (error out=w3)
  $"error out" <- w3
