vi "server.gvi"   [LabVIEW NXG 3.1.0]
panel controls:
  "server response delay ms": u32 = 50
panel indicators:
  "error out": error
  "loop iteration": i32
  "error out_2": error
diagram:
  Get Component Directory() -> (Path=w1)
  Build Path(base path=w1, name or relative path="images") -> (appended path=w2)
  List Folder(path=w2) -> (file names=w3, path out=w4)
  for {
    w5 = each element of w3
    Build Path(base path=w4, name or relative path=w5) -> (appended path=w7)
    Read From Binary File(count=-1, file (use dialog)=w7) -> (data=w8)
    Build Cluster(w8) -> w9
    append w9 to w6
  }
  Tcp Create Listener(port=8087) -> (listener ID=w10)
  while {
    Tcp Wait On Listener(listener ID in=w10) -> (connection ID=w11, error out=w12)
    s1 = w12  # shift register
    while (iteration -> i1) {
      Array Size(array=w6) -> (size(s)=w13)
      Quotient And Remainder(x=i1, y=w13) -> (x-y*floor(x/y)=w14)
      Array Index(array=w6) -> (out0[w14]=w15)
      Property Node(instance in=w15) -> ("Element 1"=w16)
      s2 = ""  # shift register
      s3 = s1  # shift register
      while {
        Tcp Read(bytes to read=10000, connection ID=w11, error in=s3, mode="CRLF") -> (connection ID out=w17, data out=w18, error out=w19)
        Concatenate Strings(s2, w18) -> w20
        Is Equal(x=w18, y="\r\n") -> w21
        Logical Or(w21, w19) -> w22
        next s2 = w20
        next s3 = w19
        stop if w22
      }
      sequence {
        frame 0 {
          Wait(time to wait=$"server response delay ms")
        }
      }
      w23 = "HTTP/1.1 200 OK\r\nConnection:Keep-Alive\r\nContent-Type:image/png\r\nContent-Length:"
      Array Size(array=w16) -> (size(s)=w24)
      Format Into String(w24) -> w25
      Concatenate Strings(w23, w25, "\r\n\r\n") -> w26
      Tcp Write(connection ID=w17, data in=w26, error in=s3) -> (connection ID out=w27, error out=w28)
      Tcp Write Binary(connection ID=w27, data in=w16, error in=w28) -> (connection ID out=w29, error out=w30)
      $"error out" <- w30
      $"loop iteration" <- i1
      next s1 = w30
      stop if w30
    }
    Tcp Close Connection(connection ID=w29, error in=s1) -> (error out=w31)
    $"error out_2" <- w31
    stop if FALSE
  }
