vi "index.gviweb"   [LabVIEW NXG 3.1.0]
panel indicators:
  "URL Image": string
  "loop iteration": i32
uses:
  PreloadImage::Preload Image Url.gvi
diagram:
  while (iteration -> i1) {
    Random Number() -> (number (0 to 1)=w1)
    Multiply(w1, 10000) -> w2
    Format Into String(formatString="http://localhost:8087/%d", w2) -> w3
    call "Preload Image Url.gvi"(image url in=w3, timeout=3) -> (image url out=w4, error out=w5)
    case (w5) {
      frame Error, Default { }
      frame No Error {
        $"URL Image" <- w4
      }
    }
    $"loop iteration" <- i1
    stop if FALSE
  }
