vi "index.gviweb"   [LabVIEW NXG 5.0.0]
panel controls:
  "color palette link": string = "support/resources.html"
uses:
  ServiceWorker::Register Service Worker.gvi
  Manifest::Register Manifest.gvi
diagram:
  call "Register Service Worker.gvi"()
  call "Register Manifest.gvi"()
