vi "resources.gviweb"   [LabVIEW NXG 5.0.0]
panel indicators:
  "NI green image": string
  "NI green image_2": string
  "NI green image_3": string
  "NI green image_4": string
  "NI green image_5": string
uses:
  ServiceWorker::Register Service Worker.gvi
  Manifest::Register Manifest.gvi
diagram:
  call "Register Service Worker.gvi"()
  call "Register Manifest.gvi"()
