vi "Create RGraph.gvi"   [LabVIEW NXG 5.0.0]
inputs:
  "container": "HtmlContainer reference", required
  "value properties json": string
  "options json": string
  "error in": error
  "effect": string = "draw"
  "rgraph constructor name": string
outputs:
  "error out": error
  "rgraph reference": "rgraph reference.gtype"
types:
  "rgraph reference.gtype" = "NI.JavaScriptReference"
uses:
  RGraph::Support::RGraph.jsli::CreateRGraph
diagram:
  Obtain JavaScript Reference(reference in=$container, error in=$"error in") -> (error out=w1, javascript reference out=w2)
  call "CreateRGraph"(container=w2, rgraphConstructorName=$"rgraph constructor name", valuePropertiesJSON=$"value properties json", optionsJSON=$"options json", effect=$effect, error in=w1) -> (rgraph=w3, error out=w4)
  $"rgraph reference" <- w3
  $"error out" <- w4
