vi "Create Pie.gvi"   [LabVIEW NXG 5.0.0]
inputs:
  "container": "HtmlContainer reference", required
  "data": cluster{"Label": string, "Value": f64}[]
  "error in": error
  "plot colors": string[] = ["#7A1619", "#0A8EE2", "#E1B583", " #B6AB25", "#ADDBEE", "#9F8AAF", "#7E7E7E", "#3B0725"]
  "show labels": bool
  "show sticks": bool
outputs:
  "error out": error
  "rgraph reference": "rgraph reference.gtype"
types:
  "rgraph reference.gtype" = "NI.JavaScriptReference"
uses:
  RGraph::Pie::SubVIs::Format Pie Data.gvi
  RGraph::Pie::SubVIs::Format Pie Options.gvi
  RGraph::Advanced::Create RGraph.gvi
diagram:
  w1 = "RGraph.Pie"  # RGraph constructor name
  call "Format Pie Data.gvi"(data=$data) -> (value properties json=w2)
  call "Format Pie Options.gvi"(data=$data, plot colors=$"plot colors", show labels=$"show labels", show sticks=$"show sticks") -> (options json=w3)
  call "Create RGraph.gvi"(container=$container, value properties json=w2, options json=w3, error in=$"error in", rgraph constructor name=w1) -> (rgraph reference=w4, error out=w5)
  $"rgraph reference" <- w4
  $"error out" <- w5
