vi "Format Pie Options.gviweb"   [LabVIEW NXG 3.0.0]
inputs:
  "data": cluster{"Label": string, "Value": f64}[], required
  "plot colors": string[] = ["#7A1619", "#0A8EE2", "#E1B583", " #B6AB25", "#ADDBEE", "#9F8AAF", "#7E7E7E", "#3B0725"]
  "show labels": bool
  "show sticks": bool
outputs:
  "options json": string
types:
  T1 = cluster{"labels": string[], "labelsSticksList": bool, "shadow": bool, "exploded": i32, "strokestyle": string, "colors": string[], "labelsColor": string, "textFont": string, "textSize": i32, "textAccessible": bool}
diagram:
  w1 = T1 {"labels"=[], "labelsSticksList"=TRUE, "shadow"=FALSE, "exploded"=0, "strokestyle"="rgba(0,0,0,0)", "colors"=[""], "labelsColor"="#2B3033", "textFont"="Segoe UI", "textSize"=9, "textAccessible"=FALSE}
  for {
    w2 = each element of $data
    Property Node(instance in=w2) -> ("Label"=w4)
    append w4 to w3
  }
  case ($"show labels") {
    frame False, Default {
      w5 = w1
    }
    frame True {
      Property Node(instance in=w1, "labels"=w3) -> (instance out=w5)
    }
  }
  Property Node(instance in=w5, "labelsSticksList"=$"show sticks", "colors"=$"plot colors") -> (instance out=w6)
  Flatten To JSON(anything=w6) -> (JSON string=w7)
  $"options json" <- w7
