vi "Update Pie.gvi"   [LabVIEW NXG 5.0.0]
inputs:
  "rgraph reference in": "rgraph reference.gtype", required
  "data": cluster{"Label": string, "Value": f64}[] = [{"Label"="Alpha", "Value"=10}, {"Label"="Beta", "Value"=25}, {"Label"="Gamma", "Value"=65}]
  "error in": error
outputs:
  "error out": error
  "rgraph reference out": "rgraph reference.gtype"
types:
  "rgraph reference.gtype" = "NI.JavaScriptReference"
uses:
  RGraph::Pie::SubVIs::Format Pie Data.gvi
  RGraph::Advanced::Update RGraph.gvi
diagram:
  $"rgraph reference out" <- $"rgraph reference in"
  call "Format Pie Data.gvi"(data=$data) -> (value properties json=w1)
  call "Update RGraph.gvi"(rgraph reference in=$"rgraph reference in", value properties json=w1, error in=$"error in") -> (error out=w2)
  $"error out" <- w2
