vi "Generate Random Array.gviweb"   [LabVIEW NXG 3.0.0]
inputs:
  "number of element": i32 = 10
  "max": f64 = 100
  "min": f64
outputs:
  "result": f64[]
diagram:
  for (N = $"number of element") {
    Random Number() -> (number (0 to 1)=w2)
    Subtract(x=$max, y=$min) -> w3
    Increment(x=w3) -> w4
    Multiply(w2, w4) -> w5
    Add(w5, $min) -> w6
    append w6 to w1
  }
  $result <- w1
