vi "Create Pie.gviweb"   [LabVIEW NXG 3.0.0]
inputs:
  "placeholder text": string = "rgraph-webvi-pie", required
  "data": cluster{"Label": string, "Value": f64}[]
  "error in": error
  "plot colors": string[] = ["#7A1619", "#0A8EE2", "#E1B583", " #B6AB25", "#ADDBEE", "#9F8AAF", "#7E7E7E", "#3B0725"]
  "show labels": bool
  "show sticks": bool
outputs:
  "RGraph refnum": i32
  "error out": error
uses:
  RGraphGallery::RGraph Pie API::SubVIs::Format Pie Data.gviweb
  RGraphGallery::RGraph Pie API::SubVIs::Format Pie Options.gviweb
  RGraphGallery::RGraph Core API::Create RGraph.gviweb
diagram:
  call "Format Pie Data.gviweb"(data=$data) -> (value properties json=w1)
  call "Format Pie Options.gviweb"(data=$data, plot colors=$"plot colors", show labels=$"show labels", show sticks=$"show sticks") -> (options json=w2)
  call "Create RGraph.gviweb"(placeholder text=$"placeholder text", value properties json=w1, options json=w2, error in=$"error in", RGraph constructor name="RGraph.Pie") -> (RGraph refnum=w3, error out=w4)
  $"RGraph refnum" <- w3
  $"error out" <- w4
