vi "Format Pie Data.gviweb"   [LabVIEW NXG 3.0.0]
inputs:
  "data": cluster{"Label": string, "Value": f64}[], required
outputs:
  "value properties json": string
diagram:
  for {
    w1 = each element of $data
    Property Node(instance in=w1) -> ("Value"=w3)
    append w3 to w2
  }
  Property Node(instance in=cluster{"data": f64[]} {all zero or empty}, "data"=w2) -> (instance out=w4)
  Flatten To JSON(anything=w4) -> (JSON string=w5)
  $"value properties json" <- w5
