vi "Update Pie.gviweb"   [LabVIEW NXG 3.0.0]
inputs:
  "RGraph refnum": i32
  "data": cluster{"Label": string, "Value": f64}[] = [{"Label"="Alpha", "Value"=10}, {"Label"="Beta", "Value"=25}, {"Label"="Gamma", "Value"=65}]
  "error in": error
outputs:
  "error out": error
uses:
  RGraphGallery::RGraph Pie API::SubVIs::Format Pie Data.gviweb
  RGraphGallery::RGraph Core API::Update RGraph.gviweb
diagram:
  call "Format Pie Data.gviweb"(data=$data) -> (value properties json=w1)
  call "Update RGraph.gviweb"(rgraph refnum=$"RGraph refnum", value properties json=w1, error in=$"error in") -> (error out=w2)
  $"error out" <- w2
