vi "kitchensink.gviweb"   [LabVIEW NXG 3.0.0]
panel controls:
  "Update Delay (ms)": u32 = 500
panel indicators:
  "error bar": error
  "error bipolar": error
  "error fuel": error
  "error funnel": error
  "error gantt": error
  "error gauge": error
  "error hbar": error
  "error hprogress": error
  "error line": error
  "error meter": error
  "error odometer": error
  "error pie": error
  "error radar": error
  "error rose": error
  "error rscatter": error
  "error scatter": error
  "error semicircularprogress": error
  "error thermometer": error
  "error vprogress": error
  "error waterfall": error
types:
  T1 = cluster{"labels": string[], "textFont": string, "textSize": i32, "textAccessible": bool}
  T2 = cluster{"labels": string[], "textBoxed": bool, "shadow": bool, "gutterLeft": i32, "labelsX": i32, "strokestyle": string, "labelsSticks": bool}
  T3 = cluster{"start": f64, "duration": f64, "complete": f64, "label": string, "linewidth": f64, "color": string, "background": string}
  T4 = cluster{"labels": string[], "labelsPercent": bool, "backgroundGridAutofitNumvlines": i32, "xmax": i32}
  T5 = cluster{"labels": string[], "gutterLeftAutosize": bool, "scaleZerostart": bool, "textAccessible": bool}
  T6 = cluster{"labels": string[], "scaleZerostart": bool, "textAccessible": bool, "title": string, "backgroundGridColor": string, "backgroundGridDashed": bool, "textFont": string, "textSize": i32}
  T7 = cluster{"labels": string[], "labelSticksList": bool, "shadow": bool, "exploded": i32, "strokestyle": string, "labelsColor": string, "textFont": string, "textSize": i32, "textAccessible": bool}
  T8 = cluster{"data_webvi_scatter": cluster{"x": f64, "y": f64, "color": string}[][]}
  T9 = cluster{"labels": string[], "xmax": i32, "noyaxis": bool, "tickmarks": string, "ticksize": i32}
  T10 = cluster{"bulbRadius": i32, "scaleVisible": bool, "gutterLeft": i32, "gutterRight": i32}
  T11 = cluster{"labels": string[], "textFont": string, "textSize": i32}
uses:
  RGraphGallery::RGraph Core API::Create RGraph.gviweb
  RGraphGallery::Kitchen Sink SubVIs::Generate Random Array.gviweb
  RGraphGallery::RGraph Core API::Update RGraph.gviweb
diagram:
  Flatten To JSON(anything=cluster{"data": f64[]} {"data"=[12, 18, 10, 9, 6, 20, 18]}) -> (JSON string=w1)
  w2 = T1 {"labels"=["Monday\n(urgh!)", "Tuesday", "Wednesday", "Thursday", "Friday\n(yay!)", "Saturday", "Sunday"], "textFont"="Segoe UI", "textSize"=9, "textAccessible"=TRUE}
  Flatten To JSON(anything=w2) -> (JSON string=w3)
  call "Create RGraph.gviweb"(placeholder text="rgraph-webvi-bar", value properties json=w1, options json=w3, RGraph constructor name="RGraph.Bar") -> (RGraph refnum=w4, error out=w5)
  # To see the properties available for different chart types:
  #
  #
  # https://www.rgraph.net/canvas/docs/charts-index.html
  while {
    Wait(time to wait=$"Update Delay (ms)")
    call "Generate Random Array.gviweb"(number of element=7, max=20, min=5) -> (result=w6)
    Property Node(instance in=cluster{"data": f64[]} {all zero or empty}, "data"=w6) -> (instance out=w7)
    Flatten To JSON(anything=w7) -> (JSON string=w8)
    call "Update RGraph.gviweb"(rgraph refnum=w4, value properties json=w8, error in=w5) -> (error out=w9)
    stop if w9
  }
  $"error bar" <- w9
  w10 = cluster{"labels": string[], "noaxes": bool} {"labels"=["Monday", "Tuesday", "Wednesday", "Thursday", "Friday", "Saturday", "Sunday"], "noaxes"=TRUE}
  Flatten To JSON(anything=w10) -> (JSON string=w11)
  w12 = cluster{"left": f64[], "right": f64[]} {"left"=[8, 4, 6, 5, 2, 5, 8], "right"=[4, 8, 6, 3, 9, 5, 2]}
  Flatten To JSON(anything=w12) -> (JSON string=w13)
  call "Create RGraph.gviweb"(placeholder text="rgraph-webvi-bipolar", value properties json=w13, options json=w11, RGraph constructor name="RGraph.Bipolar") -> (RGraph refnum=w14, error out=w15)
  while {
    Wait(time to wait=$"Update Delay (ms)")
    call "Generate Random Array.gviweb"(number of element=7, max=20, min=5) -> (result=w16)
    Build Array(w16, w16) -> w17
    Property Node(instance in=cluster{"data": f64[][]} {all zero or empty}, "data"=w17) -> (instance out=w18)
    Flatten To JSON(anything=w18) -> (JSON string=w19)
    call "Update RGraph.gviweb"(rgraph refnum=w14, value properties json=w19, error in=w15) -> (error out=w20)
    stop if w20
  }
  $"error bipolar" <- w20
  w21 = cluster{"min": f64, "max": f64, "value": f64} {"min"=0, "max"=100, "value"=56}
  Flatten To JSON(anything=w21) -> (JSON string=w22)
  call "Create RGraph.gviweb"(placeholder text="rgraph-webvi-fuel", value properties json=w22, RGraph constructor name="RGraph.Fuel") -> (RGraph refnum=w23, error out=w24)
  while {
    Wait(time to wait=$"Update Delay (ms)")
    Random Number() -> (number (0 to 1)=w25)
    Multiply(w25, 100) -> w26
    Property Node(instance in=cluster{"value": f64} {all zero or empty}, "value"=w26) -> (instance out=w27)
    Flatten To JSON(anything=w27) -> (JSON string=w28)
    call "Update RGraph.gviweb"(rgraph refnum=w23, value properties json=w28, error in=w24) -> (error out=w29)
    stop if w29
  }
  $"error fuel" <- w29
  w30 = T2 {"labels"=["All potential Customers", "Pre-sale enquiry", "Sale finalised", "Follow up telephone call"], "textBoxed"=FALSE, "shadow"=TRUE, "gutterLeft"=230, "labelsX"=10, "strokestyle"="rgba(0,0,0,0)", "labelsSticks"=TRUE}
  Flatten To JSON(anything=w30) -> (JSON string=w31)
  Flatten To JSON(anything=cluster{"data": f64[]} {"data"=[100, 42, 34, 23]}) -> (JSON string=w32)
  call "Create RGraph.gviweb"(placeholder text="rgraph-webvi-funnel", value properties json=w32, options json=w31, RGraph constructor name="RGraph.Funnel") -> (RGraph refnum=w33, error out=w34)
  while {
    Wait(time to wait=$"Update Delay (ms)")
    call "Generate Random Array.gviweb"(number of element=4, max=100, min=10) -> (result=w35)
    Property Node(instance in=cluster{"data": f64[]} {all zero or empty}, "data"=w35) -> (instance out=w36)
    Flatten To JSON(anything=w36) -> (JSON string=w37)
    call "Update RGraph.gviweb"(rgraph refnum=w33, value properties json=w37, error in=w34) -> (error out=w38)
    stop if w38
  }
  $"error funnel" <- w38
  w39 = cluster{"data": T3[]} {"data"=[{"start"=31, "duration"=28, "complete"=67, "label"="Richard", "linewidth"=0, "color"="red", "background"="pink"}, {"start"=0, "duration"=28, "complete"=50, "label"="Rachel", "linewidth"=0, "color"="red", "background"="pink"}, {"start"=12, "duration"=28, "complete"=45, "label"="Fred", "linewidth"=0, "color"="red", "background"="pink"}, {"start"=59, "duration"=14, "complete"=0, "label"="Barney", "linewidth"=0, "color"="red", "background"="pink"}, {"start"=59, "duration"=21, "complete"=5, "label"="Gloria", "linewidth"=0, "color"="red", "background"="pink"}, {"start"=46, "duration"=31, "complete"=92, "label"="Paul", "linewidth"=0, "color"="red", "background"="pink"}]}
  Flatten To JSON(anything=w39) -> (JSON string=w40)
  w41 = T4 {"labels"=["January", "February", "March", "April"], "labelsPercent"=TRUE, "backgroundGridAutofitNumvlines"=4, "xmax"=122}
  Flatten To JSON(anything=w41) -> (JSON string=w42)
  call "Create RGraph.gviweb"(placeholder text="rgraph-webvi-gantt", value properties json=w40, options json=w42, RGraph constructor name="RGraph.Gantt") -> (RGraph refnum=w43, error out=w44)
  while {
    Wait(time to wait=$"Update Delay (ms)")
    Property Node(instance in=w39) -> ("data"=w45, instance out=w46)
    for {
      w47 = each element of w45
      Random Number() -> (number (0 to 1)=w49)
      Multiply(w49, 100) -> w50
      To Unsigned Long Integer(number=w50) -> w51
      To Double Precision Float(number=w51) -> w52
      Property Node(instance in=w47, "complete"=w52) -> (instance out=w53)
      append w53 to w48
    }
    Property Node(instance in=w46, "data"=w48) -> (instance out=w54)
    Flatten To JSON(anything=w54) -> (JSON string=w55)
    call "Update RGraph.gviweb"(rgraph refnum=w43, value properties json=w55, error in=w44) -> (error out=w56)
    stop if w56
  }
  $"error gantt" <- w56
  w57 = cluster{"min": f64, "max": f64, "value": f64} {"min"=0, "max"=10, "value"=3.29}
  Flatten To JSON(anything=w57) -> (JSON string=w58)
  call "Create RGraph.gviweb"(placeholder text="rgraph-webvi-gauge", value properties json=w58, RGraph constructor name="RGraph.Gauge") -> (RGraph refnum=w59, error out=w60)
  while {
    Wait(time to wait=$"Update Delay (ms)")
    Random Number() -> (number (0 to 1)=w61)
    Multiply(w61, 10) -> w62
    Property Node(instance in=cluster{"value": f64} {all zero or empty}, "value"=w62) -> (instance out=w63)
    Flatten To JSON(anything=w63) -> (JSON string=w64)
    call "Update RGraph.gviweb"(rgraph refnum=w59, value properties json=w64, error in=w60) -> (error out=w65)
    stop if w65
  }
  $"error gauge" <- w65
  Flatten To JSON(anything=cluster{"data": f64[]} {"data"=[5, 8, 6, 4, 3, 2, 1, 6, 8]}) -> (JSON string=w66)
  w67 = T5 {"labels"=["Venus", "Felicity Jones-Arthur", "Cynthia", "Frederick", "Hoolio", "Peter", "Jennifer", "Richard", "Joathan"], "gutterLeftAutosize"=TRUE, "scaleZerostart"=TRUE, "textAccessible"=TRUE}
  Flatten To JSON(anything=w67) -> (JSON string=w68)
  call "Create RGraph.gviweb"(placeholder text="rgraph-webvi-hbar", value properties json=w66, options json=w68, RGraph constructor name="RGraph.HBar") -> (RGraph refnum=w69, error out=w70)
  while {
    Wait(time to wait=$"Update Delay (ms)")
    call "Generate Random Array.gviweb"(number of element=9, max=10, min=1) -> (result=w71)
    Property Node(instance in=cluster{"data": f64[]} {all zero or empty}, "data"=w71) -> (instance out=w72)
    Flatten To JSON(anything=w72) -> (JSON string=w73)
    call "Update RGraph.gviweb"(rgraph refnum=w69, value properties json=w73, error in=w70) -> (error out=w74)
    stop if w74
  }
  $"error hbar" <- w74
  w75 = cluster{"min": f64, "max": f64, "value": f64[]} {"min"=0, "max"=100, "value"=[10, 20, 10, 40]}
  Flatten To JSON(anything=w75) -> (JSON string=w76)
  call "Create RGraph.gviweb"(placeholder text="rgraph-webvi-hprogress", value properties json=w76, RGraph constructor name="RGraph.HProgress") -> (RGraph refnum=w77, error out=w78)
  while {
    Wait(time to wait=$"Update Delay (ms)")
    call "Generate Random Array.gviweb"(number of element=4, max=25, min=1) -> (result=w79)
    Property Node(instance in=cluster{"value": f64[]} {all zero or empty}, "value"=w79) -> (instance out=w80)
    Flatten To JSON(anything=w80) -> (JSON string=w81)
    call "Update RGraph.gviweb"(rgraph refnum=w77, value properties json=w81, error in=w78) -> (error out=w82)
    stop if w82
  }
  $"error hprogress" <- w82
  Flatten To JSON(anything=cluster{"data": f64[]} {"data"=[5, 4, 1, 6, 8, 5, 3]}) -> (JSON string=w83)
  w84 = T6 {"labels"=["Monday", "Tuesday", "Wednesday", "Thursday", "Friday", "Saturday", "Sunday"], "scaleZerostart"=TRUE, "textAccessible"=TRUE, "title"="A basic line chart", "backgroundGridColor"="#aaa", "backgroundGridDashed"=TRUE, "textFont"="Segoe UI", "textSize"=9}
  Flatten To JSON(anything=w84) -> (JSON string=w85)
  call "Create RGraph.gviweb"(placeholder text="rgraph-webvi-line", value properties json=w83, options json=w85, RGraph constructor name="RGraph.Line") -> (RGraph refnum=w86, error out=w87)
  while {
    Wait(time to wait=$"Update Delay (ms)")
    call "Generate Random Array.gviweb"(number of element=7, max=10, min=1) -> (result=w88)
    Build Array(w88) -> w89
    Property Node(instance in=cluster{"original_data": f64[][]} {all zero or empty}, "original_data"=w89) -> (instance out=w90)
    Flatten To JSON(anything=w90) -> (JSON string=w91)
    call "Update RGraph.gviweb"(rgraph refnum=w86, value properties json=w91, error in=w87) -> (error out=w92)
    stop if w92
  }
  $"error line" <- w92
  w93 = cluster{"min": f64, "max": f64, "value": f64} {"min"=0, "max"=100, "value"=45}
  Flatten To JSON(anything=w93) -> (JSON string=w94)
  call "Create RGraph.gviweb"(placeholder text="rgraph-webvi-meter", value properties json=w94, RGraph constructor name="RGraph.Meter") -> (RGraph refnum=w95, error out=w96)
  while {
    Wait(time to wait=$"Update Delay (ms)")
    Random Number() -> (number (0 to 1)=w97)
    Multiply(w97, 100) -> w98
    Property Node(instance in=cluster{"value": f64} {all zero or empty}, "value"=w98) -> (instance out=w99)
    Flatten To JSON(anything=w99) -> (JSON string=w100)
    call "Update RGraph.gviweb"(rgraph refnum=w95, value properties json=w100, error in=w96) -> (error out=w101)
    stop if w101
  }
  $"error meter" <- w101
  w102 = cluster{"min": f64, "max": f64, "value": f64} {"min"=0, "max"=100, "value"=45}
  Flatten To JSON(anything=w102) -> (JSON string=w103)
  call "Create RGraph.gviweb"(placeholder text="rgraph-webvi-odometer", value properties json=w103, RGraph constructor name="RGraph.Odometer") -> (RGraph refnum=w104, error out=w105)
  while {
    Wait(time to wait=$"Update Delay (ms)")
    Random Number() -> (number (0 to 1)=w106)
    Multiply(w106, 100) -> w107
    Property Node(instance in=cluster{"value": f64} {all zero or empty}, "value"=w107) -> (instance out=w108)
    Flatten To JSON(anything=w108) -> (JSON string=w109)
    call "Update RGraph.gviweb"(rgraph refnum=w104, value properties json=w109, error in=w105) -> (error out=w110)
    stop if w110
  }
  $"error odometer" <- w110
  Flatten To JSON(anything=cluster{"data": f64[]} {"data"=[20, 1, 1, 1, 1, 1, 1]}) -> (JSON string=w111)
  w112 = T7 {"labels"=["Monday", "Tuesday", "Wednesday", "Thursday", "Friday", "Saturday", "Sunday"], "labelSticksList"=TRUE, "shadow"=FALSE, "exploded"=0, "strokestyle"="rgba(0,0,0,0)", "labelsColor"="#2B3033", "textFont"="Segoe UI", "textSize"=9, "textAccessible"=FALSE}
  Flatten To JSON(anything=w112) -> (JSON string=w113)
  call "Create RGraph.gviweb"(placeholder text="rgraph-webvi-pie", value properties json=w111, options json=w113, RGraph constructor name="RGraph.Pie") -> (RGraph refnum=w114, error out=w115)
  while {
    Wait(time to wait=$"Update Delay (ms)")
    call "Generate Random Array.gviweb"(number of element=7, max=40, min=15) -> (result=w116)
    Property Node(instance in=cluster{"data": f64[]} {all zero or empty}, "data"=w116) -> (instance out=w117)
    Flatten To JSON(anything=w117) -> (JSON string=w118)
    call "Update RGraph.gviweb"(rgraph refnum=w114, value properties json=w118, error in=w115) -> (error out=w119)
    stop if w119
  }
  $"error pie" <- w119
  w120 = cluster{"labels": string[]} {"labels"=["Jeff", "Luis", "Norman", "Janice", "Bill", "Henry", "Kev"]}
  Flatten To JSON(anything=w120) -> (JSON string=w121)
  Flatten To JSON(anything=cluster{"data": f64[]} {"data"=[4, 3, 8, 4, 6, 7, 5]}) -> (JSON string=w122)
  call "Create RGraph.gviweb"(placeholder text="rgraph-webvi-radar", value properties json=w122, options json=w121, RGraph constructor name="RGraph.Radar") -> (RGraph refnum=w123, error out=w124)
  while {
    Wait(time to wait=$"Update Delay (ms)")
    call "Generate Random Array.gviweb"(number of element=7, max=10, min=1) -> (result=w125)
    Build Array(w125) -> w126
    Property Node(instance in=cluster{"original_data": f64[][]} {all zero or empty}, "original_data"=w126) -> (instance out=w127)
    Flatten To JSON(anything=w127) -> (JSON string=w128)
    call "Update RGraph.gviweb"(rgraph refnum=w123, value properties json=w128, error in=w124) -> (error out=w129)
    stop if w129
  }
  $"error radar" <- w129
  w130 = cluster{"labels": string[]} {"labels"=["Jeff", "Luis", "Norman", "Janice", "Bill", "Henry", "Kev"]}
  Flatten To JSON(anything=w130) -> (JSON string=w131)
  Flatten To JSON(anything=cluster{"data": f64[]} {"data"=[4, 6, 3, 5, 2, 8, 9]}) -> (JSON string=w132)
  call "Create RGraph.gviweb"(placeholder text="rgraph-webvi-rose", value properties json=w132, options json=w131, RGraph constructor name="RGraph.Rose") -> (RGraph refnum=w133, error out=w134)
  while {
    Wait(time to wait=$"Update Delay (ms)")
    call "Generate Random Array.gviweb"(number of element=7, max=10, min=1) -> (result=w135)
    Property Node(instance in=cluster{"data": f64[]} {all zero or empty}, "data"=w135) -> (instance out=w136)
    Flatten To JSON(anything=w136) -> (JSON string=w137)
    call "Update RGraph.gviweb"(rgraph refnum=w133, value properties json=w137, error in=w134) -> (error out=w138)
    stop if w138
  }
  $"error rose" <- w138
  for (N = 360) (iteration -> i1) {
    To Double Precision Float(number=i1) -> w140
    Multiply(w140, 2) -> w141
    w142 = cluster{"x": f64, "y": f64, "color": string} {"x"=0, "y"=0, "color"="green"}
    Property Node(instance in=w142, "x"=w141, "y"=w140) -> (instance out=w143)
    append w143 to w139
  }
  Build Array(w139) -> w144
  Property Node(instance in=T8 {all zero or empty}, "data_webvi_scatter"=w144) -> (instance out=w145)
  Flatten To JSON(anything=w145) -> (JSON string=w146)
  call "Create RGraph.gviweb"(placeholder text="rgraph-webvi-rscatter", value properties json=w146, RGraph constructor name="RGraph.Rscatter") -> (RGraph refnum=w147, error out=w148)
  while {
    Wait(time to wait=$"Update Delay (ms)")
    for (N = 360) (iteration -> i2) {
      To Double Precision Float(number=i2) -> w150
      Random Number() -> (number (0 to 1)=w151)
      Multiply(w150, w151) -> w152
      w153 = cluster{"x": f64, "y": f64, "color": string} {"x"=0, "y"=0, "color"="green"}
      Property Node(instance in=w153, "x"=w152, "y"=w150) -> (instance out=w154)
      append w154 to w149
    }
    Build Array(w149) -> w155
    Property Node(instance in=T8 {all zero or empty}, "data_webvi_scatter"=w155) -> (instance out=w156)
    Flatten To JSON(anything=w156) -> (JSON string=w157)
    call "Update RGraph.gviweb"(rgraph refnum=w147, value properties json=w157, error in=w148) -> (error out=w158)
    stop if w158
  }
  $"error rscatter" <- w158
  w159 = T8 {"data_webvi_scatter"=[[{"x"=25, "y"=45, "color"="red"}, {"x"=51, "y"=23, "color"="orange"}, {"x"=132, "y"=52, "color"="yellow"}, {"x"=166, "y"=52, "color"="green"}, {"x"=311, "y"=5, "color"="blue"}, {"x"=322, "y"=42, "color"="purple"}, {"x"=56, "y"=52, "color"="red"}, {"x"=10, "y"=20, "color"="red"}, {"x"=355, "y"=56, "color"="red"}]]}
  w160 = T9 {"labels"=["Jan", "Feb", "Mar", "Apr", "May", "Jun", "Jul", "Aug", "Sep", "Oct", "Nov", "Dec"], "xmax"=365, "noyaxis"=TRUE, "tickmarks"="circle", "ticksize"=10}
  Flatten To JSON(anything=w160) -> (JSON string=w161)
  Flatten To JSON(anything=w159) -> (JSON string=w162)
  call "Create RGraph.gviweb"(placeholder text="rgraph-webvi-scatter", value properties json=w162, options json=w161, RGraph constructor name="RGraph.Scatter") -> (RGraph refnum=w163, error out=w164)
  while {
    Wait(time to wait=$"Update Delay (ms)")
    Property Node(instance in=w159) -> ("data_webvi_scatter"=w165, instance out=w166)
    for {
      w167 = each element of w165
      for {
        w169 = each element of w167
        Random Number() -> (number (0 to 1)=w171)
        Multiply(w171, 100) -> w172
        Property Node(instance in=w169, "y"=w172) -> (instance out=w173)
        append w173 to w170
      }
      append w170 to w168
    }
    Property Node(instance in=w166, "data_webvi_scatter"=w168) -> (instance out=w174)
    Flatten To JSON(anything=w174) -> (JSON string=w175)
    call "Update RGraph.gviweb"(rgraph refnum=w163, value properties json=w175, error in=w164) -> (error out=w176)
    stop if w176
  }
  $"error scatter" <- w176
  w177 = cluster{"min": f64, "max": f64, "value": f64} {"min"=0, "max"=20, "value"=12}
  Flatten To JSON(anything=w177) -> (JSON string=w178)
  call "Create RGraph.gviweb"(placeholder text="rgraph-webvi-semicircularprogress", value properties json=w178, RGraph constructor name="RGraph.SemiCircularProgress") -> (RGraph refnum=w179, error out=w180)
  while {
    Wait(time to wait=$"Update Delay (ms)")
    Random Number() -> (number (0 to 1)=w181)
    Multiply(w181, 20) -> w182
    Property Node(instance in=cluster{"value": f64} {all zero or empty}, "value"=w182) -> (instance out=w183)
    Flatten To JSON(anything=w183) -> (JSON string=w184)
    call "Update RGraph.gviweb"(rgraph refnum=w179, value properties json=w184, error in=w180) -> (error out=w185)
    stop if w185
  }
  $"error semicircularprogress" <- w185
  w186 = cluster{"min": f64, "max": f64, "value": f64} {"min"=0, "max"=100, "value"=68}
  Flatten To JSON(anything=w186) -> (JSON string=w187)
  w188 = T10 {"bulbRadius"=505, "scaleVisible"=TRUE, "gutterLeft"=200, "gutterRight"=150}
  Flatten To JSON(anything=w188) -> (JSON string=w189)
  call "Create RGraph.gviweb"(placeholder text="rgraph-webvi-thermometer", value properties json=w187, options json=w189, RGraph constructor name="RGraph.Thermometer") -> (RGraph refnum=w190, error out=w191)
  while {
    Wait(time to wait=$"Update Delay (ms)")
    Random Number() -> (number (0 to 1)=w192)
    Multiply(w192, 100) -> w193
    Property Node(instance in=cluster{"value": f64} {all zero or empty}, "value"=w193) -> (instance out=w194)
    Flatten To JSON(anything=w194) -> (JSON string=w195)
    call "Update RGraph.gviweb"(rgraph refnum=w190, value properties json=w195, error in=w191) -> (error out=w196)
    stop if w196
  }
  $"error thermometer" <- w196
  w197 = cluster{"min": f64, "max": f64, "value": f64[]} {"min"=0, "max"=100, "value"=[10, 20, 10, 40]}
  Flatten To JSON(anything=w197) -> (JSON string=w198)
  call "Create RGraph.gviweb"(placeholder text="rgraph-webvi-vprogress", value properties json=w198, RGraph constructor name="RGraph.VProgress") -> (RGraph refnum=w199, error out=w200)
  while {
    Wait(time to wait=$"Update Delay (ms)")
    call "Generate Random Array.gviweb"(number of element=4, max=25, min=1) -> (result=w201)
    Property Node(instance in=cluster{"value": f64[]} {all zero or empty}, "value"=w201) -> (instance out=w202)
    Flatten To JSON(anything=w202) -> (JSON string=w203)
    call "Update RGraph.gviweb"(rgraph refnum=w199, value properties json=w203, error in=w200) -> (error out=w204)
    stop if w204
  }
  $"error vprogress" <- w204
  Flatten To JSON(anything=cluster{"data": f64[]} {"data"=[10, 10, 5, -2, -5, 6, -5]}) -> (JSON string=w205)
  w206 = T11 {"labels"=["Monday", "Tuesday", "Wednesday", "Thursday", "Friday", "Saturday", "Sunday", "Total"], "textFont"="Segoe UI", "textSize"=8}
  Flatten To JSON(anything=w206) -> (JSON string=w207)
  call "Create RGraph.gviweb"(placeholder text="rgraph-webvi-waterfall", value properties json=w205, options json=w207, RGraph constructor name="RGraph.Waterfall") -> (RGraph refnum=w208, error out=w209)
  while {
    Wait(time to wait=$"Update Delay (ms)")
    call "Generate Random Array.gviweb"(number of element=7, max=10, min=-2) -> (result=w210)
    Property Node(instance in=cluster{"data": f64[]} {all zero or empty}, "data"=w210) -> (instance out=w211)
    Flatten To JSON(anything=w211) -> (JSON string=w212)
    call "Update RGraph.gviweb"(rgraph refnum=w208, value properties json=w212, error in=w209) -> (error out=w213)
    stop if w213
  }
  $"error waterfall" <- w213
