vi "pie.gviweb"   [LabVIEW NXG 3.0.0]
panel controls:
  "data": cluster{"Label": string, "Value": f64}[] = [{"Label"="Alpha", "Value"=10}, {"Label"="Beta", "Value"=20}, {"Label"="Gamma", "Value"=40}]
  "More information about RGraph:": string = "https://www.rgraph.net/"
uses:
  RGraphGallery::RGraph Pie API::Create Pie.gviweb
  RGraphGallery::RGraph Pie API::Update Pie.gviweb
diagram:
  call "Create Pie.gviweb"(show labels=TRUE, show sticks=FALSE, placeholder text="rgraph-webvi-pie", data=$data) -> (RGraph refnum=w1, error out=w2)
  # The placeholder on the panel is a Text decoration. Its text must match the value being passed to the "placeholder text" parameter of the Pie functions.
  #
  # Any Text decoration whose text begins with "rgraph-webvi" will show the placeholder styling because of the CSS in the RGraphJSLI.css file.
  #
  # At the end of the <head> section in the HTML view, there are script tags to include required JavaScript support files, as well as a link tag for the CSS file.
  while {
    event {
      on "data" Value changed {
        Event Data() -> ("New Value"=w4)
        call "Update Pie.gviweb"(RGraph refnum=w1, data=w4, error in=w2) -> (error out=w3)
      }
    }
    stop if w3
  }
