vi "Create CKEditor5.gvi"   [LabVIEW NXG 5.0.0]
inputs:
  "container": "HtmlContainer reference", required
  "error in": error
outputs:
  "error out": error
uses:
  CKEditor5::Support::CKEditor5.jsli::Create CKEditor5
diagram:
  Obtain JavaScript Reference(reference in=$container, error in=$"error in") -> (error out=w1, javascript reference out=w2)
  call "Create CKEditor5"(element=w2, error in=w1) -> (error out=w3)
  $"error out" <- w3
