vi "Create Rooster.gvi"   [LabVIEW NXG 5.0.0]
inputs:
  "element": "HtmlContainer reference", required
  "error in": error
  "disabled": bool
outputs:
  "error out": error
  "rooster reference": "rooster reference.gtype"
types:
  "rooster reference.gtype" = "NI.JavaScriptReference"
uses:
  Rooster::Support::Rooster.jsli::CreateRooster
diagram:
  Obtain JavaScript Reference(reference in=$element, error in=$"error in") -> (error out=w1, javascript reference out=w2)
  call "CreateRooster"(element=w2, disabled=$disabled, error in=w1) -> (rooster=w3, error out=w4)
  $"rooster reference" <- w3
  $"error out" <- w4
