vi "index.gviweb"   [LabVIEW NXG 5.0.0]
panel controls:
  "submit": bool
panel indicators:
  "content": string
uses:
  Rooster::Create Rooster.gvi
  Rooster::Get Rooster Content.gvi
  Rooster::Set Rooster Content.gvi
diagram:
  call "Create Rooster.gvi"(element=reference to "rooster input") -> (rooster reference=w1)
  call "Create Rooster.gvi"(disabled=TRUE, element=reference to "rooster output") -> (rooster reference=w2)
  while {
    event {
      on "submit" Value changed {
        call "Get Rooster Content.gvi"(rooster reference in=w1) -> (content=w3)
        $content <- w3
        call "Set Rooster Content.gvi"(rooster reference in=w2, content=w3)
      }
    }
    stop if FALSE
  }
