vi "Create CKEditor.gvi"   [LabVIEW NXG 5.0.0]
inputs:
  "error in": error
  "element": "HtmlContainer reference", required
  "disabled": bool
outputs:
  "error out": error
  "ckeditor reference": "ckeditor reference.gtype"
types:
  "ckeditor reference.gtype" = "NI.JavaScriptReference"
uses:
  CKEditor4::Support::CKEditor4.jsli::CreateCKEditor
diagram:
  Obtain JavaScript Reference(reference in=$element, error in=$"error in") -> (error out=w1, javascript reference out=w2)
  call "CreateCKEditor"(element=w2, disabled=$disabled, error in=w1) -> (editor=w3, error out=w4)
  $"ckeditor reference" <- w3
  $"error out" <- w4
