vi "Destroy CKEditor.gvi"   [LabVIEW NXG 3.1.0]
inputs:
  "error in": error
  "ckeditor reference": "ckeditor reference.gtype", required
outputs:
  "error out": error
types:
  "ckeditor reference.gtype" = i32
uses:
  CKEditor4::Support::CKEditor4.jsli::Destroy
diagram:
  call "Destroy"(editorReference=$"ckeditor reference") -> (error out=w1)
  Merge Errors($"error in", w1) -> (error out=w2)
  $"error out" <- w2
