vi "Create Quill.gvi"   [G Web Development Software 22.3.0]
# Creates a Quill based rich text area.
# Use the supported formats input to enable the formats that will be possible in the quill editor.
# Use the hidden toolbar formats input to hide any of the enabled formats from the toolbar.
inputs:
  "element": "HtmlContainer reference", required
  "error in": error
  "supported formats": string[] = ["font", "size", "spacer", "bold", "italic", "underline", "strike", "spacer", "color", "background", "spacer", "script", "spacer", "code", "link", "spacer", "header", "blockquote", "code-block", "spacer", "list", "indent", "spacer", "direction", "align", "spacer", "formula", "image", "video", "clean"]
  "disabled": bool
  "quill plugins": "quill plugins.gtype"
outputs:
  "quill reference": "quill reference.gtype"
  "error out": error
types:
  "quill reference.gtype" = "NI.JavaScriptReference"
  "quill plugins.gtype" = string[]
uses:
  NI::G Core::Error::Build Error Cluster.gvi
  Quill::Support::Quill.jsli::CreateQuill
diagram:
  Obtain JavaScript Reference(reference in=$element, error in=$"error in") -> (error out=w1, javascript reference out=w2)
  for {
    w3 = each element of $"quill plugins"
    Search 1D Array(1D array=$"supported formats", element=w3) -> (index of element=w4)
    Is Less Than 0(x=w4) -> w5
    stop if w5
  }
  case (w5) {
    frame False, Default {
      w6 = w1
    }
    frame True {
      Concatenate Strings("Make sure plugins are included in quill toolbar. Missing: ", w3) -> w7
      call "Build Error Cluster.gvi"(error in=w1, code=567100, description=w7) -> (error out=w6)
    }
  }
  Flatten To Json(anything=$"supported formats") -> (JSON string=w8)
  call "CreateQuill"(element=w2, formatsJSON=w8, disabled=$disabled, error in=w6) -> (quill=w9, error out=w10)
  $"quill reference" <- w9
  $"error out" <- w10
