vi "Destroy Quill.gvi"   [LabVIEW NXG 3.1.0]
inputs:
  "quill reference": "quill reference.gtype", required
  "error in": error
outputs:
  "error out": error
types:
  "quill reference.gtype" = i32
uses:
  Quill::Support::Quill.jsli::DestroyQuill
diagram:
  call "DestroyQuill"(quillReference=$"quill reference") -> (error out=w1)
  Merge Errors($"error in", w1) -> (error out=w2)
  $"error out" <- w2
