vi "Append Code-Block Plugin.gvi"   [G Web Development Software 22.3.0]
inputs:
  "quill plugins in": "quill plugins.gtype"
  "error in": error
outputs:
  "quill plugins out": "quill plugins.gtype"
  "error out": error
types:
  "quill plugins.gtype" = string[]
uses:
  Quill::Support::Highlight.jsli::ValidateHighlight
diagram:
  Build Array($"quill plugins in", ["code-block"]) -> w1
  $"quill plugins out" <- w1
  call "ValidateHighlight"(error in=$"error in") -> (error out=w2)
  $"error out" <- w2
