vi "Destroy Rooster.gvi"   [LabVIEW NXG 3.1.0]
panel controls:
  "error in": error
  "rooster reference": "rooster reference.gtype"
panel indicators:
  "error out": error
types:
  "rooster reference.gtype" = i32
uses:
  Rooster::Support::Rooster.jsli::DestroyRooster
diagram:
  call "DestroyRooster"(roosterReference=$"rooster reference") -> (error out=w1)
  Merge Errors($"error in", w1) -> (error out=w2)
  $"error out" <- w2
