vi "index.gviweb"   [LabVIEW NXG 3.1.0]
panel controls:
  "submit": bool
panel indicators:
  "rooster input": string
  "rooster output": string
  "content": string
uses:
  Rooster::Create Rooster.gvi
  Rooster::Get Rooster Content.gvi
  Rooster::Set Rooster Content.gvi
diagram:
  call "Create Rooster.gvi"(selector=".my-rooster-input") -> (rooster reference=w1)
  call "Create Rooster.gvi"(disabled=TRUE, selector=".my-rooster-output") -> (rooster reference=w2)
  while {
    event {
      on "submit" Value changed {
        call "Get Rooster Content.gvi"(rooster reference in=w1) -> (content=w3)
        $content <- w3
        call "Set Rooster Content.gvi"(rooster reference in=w2, content=w3)
      }
    }
    stop if FALSE
  }
