vi "Create Trix.gvi"   [LabVIEW NXG 5.0.0]
inputs:
  "element": "HtmlContainer reference", required
  "error in": error
  "disabled": bool
outputs:
  "trix reference": "trix reference.gtype"
  "error out": error
types:
  "trix reference.gtype" = "NI.JavaScriptReference"
uses:
  Trix::Support::Trix.jsli::TrixCreate
diagram:
  Obtain JavaScript Reference(reference in=$element, error in=$"error in") -> (error out=w1, javascript reference out=w2)
  call "TrixCreate"(element=w2, disabled=$disabled, error in=w1) -> (trix=w3, error out=w4)
  $"trix reference" <- w3
  $"error out" <- w4
