vi "Destroy Trix.gvi"   [LabVIEW NXG 3.1.0]
inputs:
  "trix reference": "trix reference.gtype", required
  "error in": error
outputs:
  "error out": error
types:
  "trix reference.gtype" = i32
uses:
  Trix::Support::Trix.jsli::TrixDestroy
diagram:
  call "TrixDestroy"(trixReference=$"trix reference") -> (error out=w1)
  Merge Errors($"error in", w1) -> (error out=w2)
  $"error out" <- w2
