vi "ckeditor.gviweb"   [LabVIEW NXG 3.1.0]
panel controls:
  "Submit": bool
  "Create": bool
  "Destroy": bool
  "Enable": bool
  "Disable": bool
panel indicators:
  "ckeditor input": string
  "ckeditor output": string
  "content": string
uses:
  CKEditor4::Create CKEditor.gvi
  CKEditor4::Get CKEditor Content.gvi
  CKEditor4::Set CKEditor Content.gvi
  CKEditor4::Destroy CKEditor.gvi
  CKEditor4::Set CKEditor Disabled.gvi
diagram:
  call "Create CKEditor.gvi"(disabled=TRUE, selector=".my-ckeditor-output") -> (ckeditor reference=w1)
  call "Create CKEditor.gvi"(selector=".my-ckeditor-input") -> (ckeditor reference=w2)
  s1 = w1  # shift register
  while {
    event {
      on "Submit" Value changed {
        call "Get CKEditor Content.gvi"(ckeditor reference in=w2) -> (content=w4)
        $content <- w4
        call "Set CKEditor Content.gvi"(ckeditor reference in=s1, content=w4) -> (ckeditor reference out=w3)
      }
      on "Create" Value changed {
        call "Create CKEditor.gvi"(disabled=TRUE, selector=".my-ckeditor-output") -> (ckeditor reference=w3)
      }
      on "Destroy" Value changed {
        call "Destroy CKEditor.gvi"(ckeditor reference=s1)
        w3 = default
      }
      on "Enable" Value changed {
        call "Set CKEditor Disabled.gvi"(ckeditor reference in=s1, disabled=FALSE) -> (ckeditor reference out=w3)
      }
      on "Disable" Value changed {
        call "Set CKEditor Disabled.gvi"(ckeditor reference in=s1, disabled=TRUE) -> (ckeditor reference out=w3)
      }
    }
    next s1 = w3
    stop if FALSE
  }
