vi "quill.gviweb"   [LabVIEW NXG 3.1.0]
panel controls:
  "Submit": bool
  "Create": bool
  "Destroy": bool
  "Enable": bool
  "Disable": bool
panel indicators:
  "quill input": string
  "quill output": string
  "deltas json": string
uses:
  Quill::Plugins::Append Code-Block Plugin.gvi
  Quill::Plugins::Append Formula Plugin.gvi
  Quill::Create Quill.gvi
  Quill::Get Quill Content.gvi
  Quill::Set Quill Content.gvi
  Quill::Destroy Quill.gvi
  Quill::Set Quill Disabled.gvi
diagram:
  call "Append Code-Block Plugin.gvi"() -> (quill plugins out=w1, error out=w2)
  call "Append Formula Plugin.gvi"(quill plugins in=w1, error in=w2) -> (quill plugins out=w3, error out=w4)
  call "Create Quill.gvi"(selector=".my-quill-input", quill plugins=w3, error in=w4) -> (quill reference=w5)
  call "Append Code-Block Plugin.gvi"() -> (quill plugins out=w6, error out=w7)
  call "Append Formula Plugin.gvi"(quill plugins in=w6, error in=w7) -> (quill plugins out=w8, error out=w9)
  call "Create Quill.gvi"(disabled=TRUE, selector=".my-quill-output", quill plugins=w8, error in=w9) -> (quill reference=w10)
  s1 = w10  # shift register
  while {
    event {
      on "Submit" Value changed {
        call "Get Quill Content.gvi"(quill reference in=w5) -> (deltas json=w12)
        $"deltas json" <- w12
        call "Set Quill Content.gvi"(quill reference in=s1, deltas json=w12) -> (quill reference out=w11)
      }
      on "Create" Value changed {
        call "Append Code-Block Plugin.gvi"() -> (quill plugins out=w13, error out=w14)
        call "Append Formula Plugin.gvi"(quill plugins in=w13, error in=w14) -> (quill plugins out=w15, error out=w16)
        call "Create Quill.gvi"(disabled=TRUE, selector=".my-quill-output", quill plugins=w15, error in=w16) -> (quill reference=w11)
      }
      on "Destroy" Value changed {
        call "Destroy Quill.gvi"(quill reference=s1)
        w11 = default
      }
      on "Enable" Value changed {
        call "Set Quill Disabled.gvi"(quill reference in=s1, disabled=FALSE) -> (quill reference out=w11)
      }
      on "Disable" Value changed {
        call "Set Quill Disabled.gvi"(quill reference in=s1, disabled=TRUE) -> (quill reference out=w11)
      }
    }
    next s1 = w11
    stop if FALSE
  }
