vi "trix.gviweb"   [LabVIEW NXG 3.1.0]
panel controls:
  "submit": bool
  "Create": bool
  "Destroy": bool
  "Enable": bool
  "Disable": bool
panel indicators:
  "trix input": string
  "trix output": string
  "content": string
uses:
  Trix::Create Trix.gvi
  Trix::Get Trix Content.gvi
  Trix::Set Trix Content.gvi
  Trix::Destroy Trix.gvi
  Trix::Set Trix Disabled.gvi
diagram:
  call "Create Trix.gvi"(disabled=TRUE, selector=".my-trix-output") -> (trix reference=w1)
  call "Create Trix.gvi"(selector=".my-trix-input") -> (trix reference=w2)
  s1 = w1  # shift register
  while {
    event {
      on "submit" Value changed {
        call "Get Trix Content.gvi"(trix reference in=w2) -> (content=w4)
        $content <- w4
        call "Set Trix Content.gvi"(trix reference in=s1, content=w4) -> (trix reference out=w3)
      }
      on "Create" Value changed {
        call "Create Trix.gvi"(disabled=TRUE, selector=".my-trix-output") -> (trix reference=w3)
      }
      on "Destroy" Value changed {
        call "Destroy Trix.gvi"(trix reference=s1)
        w3 = default
      }
      on "Enable" Value changed {
        call "Set Trix Disabled.gvi"(trix reference in=s1, disabled=FALSE) -> (trix reference out=w3)
      }
      on "Disable" Value changed {
        call "Set Trix Disabled.gvi"(trix reference in=s1, disabled=TRUE) -> (trix reference out=w3)
      }
    }
    next s1 = w3
    stop if FALSE
  }
