vi "Create Select Element.gvi"   [LabVIEW NXG 5.1.0]
inputs:
  "error in": error
  "placeholder": "HtmlContainer reference", required
  "options": string[]
outputs:
  "error out": error
  "input element": "select element.gtype"
types:
  "select element.gtype" = "NI.JavaScriptReference"
uses:
  SelectElement::Support::SelectElement.jsli::CreateElement
diagram:
  Obtain JavaScript Reference(reference in=$placeholder, error in=$"error in") -> (error out=w1, javascript reference out=w2)
  Flatten To Json(anything=$options, error in (no error)=w1) -> (JSON string=w3, error out=w4)
  call "CreateElement"(placeholder=w2, attributesJSON=w3, error in=w4) -> (selectElement=w5, error out=w6)
  Close Reference(error in=w6, reference=w2) -> (error out=w7)
  $"error out" <- w7
  $"input element" <- w5
