vi "Get Options.gvi"   [LabVIEW NXG 5.1.0]
inputs:
  "input element in": "select element.gtype", required
  "error in": error
outputs:
  "input element out": "select element.gtype"
  "error out": error
  "options": string[]
types:
  "select element.gtype" = "NI.JavaScriptReference"
uses:
  SelectElement::Support::SelectElement.jsli::GetOptions
diagram:
  $"input element out" <- $"input element in"
  w1 = string[] []  # options
  call "GetOptions"(selectElement=$"input element in", error in=$"error in") -> (resultJSON=w2, error out=w3)
  Unflatten From Json(JSON string=w2, error in (no error)=w3, type and defaults=w1) -> (error out=w4, value=w5)
  $options <- w5
  $"error out" <- w4
