vi "Set Options.gvi"   [LabVIEW NXG 5.1.0]
inputs:
  "input element in": "select element.gtype", required
  "name": string[], required
  "error in": error
outputs:
  "input element out": "select element.gtype"
  "error out": error
types:
  "select element.gtype" = "NI.JavaScriptReference"
uses:
  SelectElement::Support::SelectElement.jsli::SetOptions
diagram:
  $"input element out" <- $"input element in"
  Flatten To Json(anything=$name, error in (no error)=$"error in") -> (JSON string=w1, error out=w2)
  call "SetOptions"(selectElement=$"input element in", options=w1, error in=w2) -> (error out=w3)
  $"error out" <- w3
