vi "Add Event Listener.gvi"   [LabVIEW NXG 5.1.0]
inputs:
  "error in": error
  "input element in": "select element.gtype", required
outputs:
  "event configuration": "event listener configuration.gtype"
  "error out": error
  "change user event": "event change"
  "input element out": "select element.gtype"
types:
  "select element.gtype" = "NI.JavaScriptReference"
  "event listener configuration.gtype" = cluster{"event stream reader": "NI.JavaScriptReference", "error in": error, "change user event": "event change"}
uses:
  SelectElement::Support::SelectElement.jsli::AddEventListener
diagram:
  $"input element out" <- $"input element in"
  call "AddEventListener"(selectElement=$"input element in", name="change", error in=$"error in") -> (eventStreamReader=w1, error out=w2)
  w3 = i32[] []  # selectedOptions
  Create User Event[EventName=change](error in=w2, user event data type=w3) -> (error out=w4, user event out=w5)  # Create User Event: change
  Property Node(instance in="event listener configuration.gtype" {all zero or empty}, "event stream reader"=w1, "change user event"=w5, "error in"=w4) -> (instance out=w6)
  $"event configuration" <- w6
  $"change user event" <- w5
  $"error out" <- w4
