vi "Listen for Events.gvi"   [LabVIEW NXG 5.1.0]
inputs:
  "event configuration": "event listener configuration.gtype", required
outputs:
  "error out (warning: blocking)": error
types:
  "event listener configuration.gtype" = cluster{"event stream reader": "NI.JavaScriptReference", "error in": error, "change user event": "event change"}
uses:
  SelectElement::Support::SelectElement.jsli::WaitForEvent
diagram:
  Property Node(instance in=$"event configuration") -> ("change user event"=w1, "event stream reader"=w2, "error in"=w3)
  # This VI must be reentrant
  s1 = w3  # shift register
  while {
    call "WaitForEvent"(eventStreamReader=w2, error in=s1) -> (resultJSON=w4, error out=w5)
    Unflatten From Json(JSON string=w4, error in (no error)=w5, type and defaults=cluster{"done": bool, "value": i32[]} {all zero or empty}) -> (error out=w6, value=w7)
    Property Node(instance in=w7) -> ("value"=w8, "done"=w9)
    case (w9) {
      frame True {
        w10 = w6
        w11 = w9
      }
      frame False {
        Generate User Event(error in=w6, event data=w8, user event=w1) -> (error out=w10)
        w11 = w9
      }
    }
    Logical Or(w10, w11) -> w12
    next s1 = w10
    stop if w12
  }
  $"error out (warning: blocking)" <- s1
