vi "index.gviweb"   [G Web Development Software 22.3.0]
panel controls:
  "value get": bool
  "value set": bool
  "selected options": i32[]
  "set many options": bool
  "reset options": bool
  "options get": bool
panel indicators:
  "selected options event": i32[]
  "options": string[]
uses:
  SelectElement::Create Select Element.gvi
  SelectElement::Value Event::Add Event Listener.gvi
  SelectElement::Value Event::Listen for Events.gvi
  SelectElement::Value::Get Value.gvi
  SelectElement::Value::Set Value.gvi
  SelectElement::Options::Set Options.gvi
  SelectElement::Options::Get Options.gvi
diagram:
  w1 = ["ever golden", "ever genius", "ever gifted", "ever glory", "ever globe", "ever goods", "ever given", "ever grade", "ever gentle", "ever govern", "ever greet"]
  call "Create Select Element.gvi"(placeholder=reference to "select", options=w1) -> (input element=w2, error out=w3)
  call "Add Event Listener.gvi"(input element in=w2, error in=w3) -> (change user event=w4, input element out=w5, error out=w6, event configuration=w7)
  call "Listen for Events.gvi"(event configuration=w7)
  Register For Events("change"=w4, error in=w6) -> (error out=w8, event registration refnum out=w9)
  s1 = w8  # shift register
  while (iteration -> i1) {
    event (timeout = 100) (dynamic events = w9) {
      on dynamic event 0 {
        Event Data() -> ("event data"=w11)
        $"selected options event" <- w11
        w10 = s1
      }
      on "value get" Value changed {
        call "Get Value.gvi"(input element in=w5, error in=s1) -> (value=w12, error out=w10)
        $"selected options" <- w12
      }
      on "value set" Value changed {
        call "Set Value.gvi"(input element in=w5, value=$"selected options", error in=s1) -> (error out=w10)
      }
      on "Timeout" {
        w10 = s1
      }
      on "set many options" Value changed {
        for (N = 10000) (iteration -> i2) {
          Format Into String(formatString="option%d-%d", i1, i2) -> w14
          append w14 to w13
        }
        call "Set Options.gvi"(input element in=w5, name=w13, error in=s1) -> (error out=w10)
      }
      on "reset options" Value changed {
        call "Set Options.gvi"(input element in=w5, name=w1, error in=s1) -> (error out=w10)
      }
      on "options get" Value changed {
        call "Get Options.gvi"(input element in=w5, error in=s1) -> (options=w15, error out=w10)
        $options <- w15
      }
    }
    next s1 = w10
    stop if w10
  }
  Property Node(instance in=s1) -> ("source"=w16)
  One Button Dialog(message=w16)
