vi "index.gviweb"   [LabVIEW NXG 5.0.0]
panel controls:
  "String In": string
panel indicators:
  "String Out": string
uses:
  SetAttribute::Set Attribute.gvi
diagram:
  while {
    event {
      on "String In" Value changed {
        $"String Out" <- $"String In"
      }
    }
    stop if FALSE
  }
  # This selector finds a control with the class my-string-control and finds the textarea element inside.
  #
  # NOTE: Notice that when the HTML class attribute is configured on the front panel it is not prefixed with a dot, ie "my-string-control" however when used in a selector the class is prefixed with a dot, ie ".my-string-control".
  #
  # To learn more about selectors see: https://developer.mozilla.org/en-US/docs/Learn/CSS/Building_blocks/Selectors
  # WARNING: This approach is manipulating the internal behavior of NI controls. NI only supports configuration through the editor via property pane configuration, property nodes, etc.
  #
  # Directly manipulating an NI control through the JSLI is not reccommend and subject to change in behavior in the future without warning.
  #
  # Instead use the HTML Placeholder Container to develop custom controls with custom behavior.
  call "Set Attribute.gvi"(selector=".my-string-control textarea", attribute name="placeholder", attribute value="Enter up to 20 characters") -> (error out=w1)
  # See attributes on textarea: https://developer.mozilla.org/en-US/docs/Web/HTML/Element/textarea
  call "Set Attribute.gvi"(selector=".my-string-control textarea", attribute name="maxlength", attribute value="20", error in=w1)
