vi "index.gviweb"   [LabVIEW NXG 4.0.0]
panel controls:
  "Text": string = "WebVIs Rock! 🤘"
panel indicators:
  "URL Image": string
uses:
  WebApp::Create SVG Circle with Text.gvi
  SetInnerHtml::Set Inner Html.gvi
diagram:
  while {
    event {
      on "Text" Value changed {
        Event Data() -> ("New Value"=w1)
        # w2: html string
        call "Create SVG Circle with Text.gvi"(text=w1) -> (svg=w2)
        call "Set Inner Html.gvi"(selector=".my-container", html=w2)
      }
    }
    stop if FALSE
  }
  call "Create SVG Circle with Text.gvi"(text=$Text) -> (svg=w3)
  # w3: html string
  call "Set Inner Html.gvi"(selector=".my-container", html=w3)
