vi "snake.gvi"   [LabVIEW NXG 3.0.0]
# Play the classic game snake!
panel controls:
  "Difficulty": u16 = "Intermediate"(85)
  "Max Apples": i32 = 20
panel indicators:
  "XY Graph": "xyplot.gtype"[]
  "direction": f64
  "done": bool
  "Apples Eaten": i32
types:
  "xyplot.gtype" = cluster{"X": i32[], "Y": i32[]}
uses:
  My Computer::next_move.gvi
  My Computer::resolve_apples.gvi
  My Computer::xyplot_delete.gvi
  My Computer::collision_self.gvi
  My Computer::collision_wall.gvi
  My Computer::snake_1.gvi
diagram:
  sequence {
    frame 0 {
      w1 = """Welcome to snake!
-Use the left and right arrow keys to turn
-Eat as many apples as you can without running into the wall or yourself"""
      One Button Dialog(button name ("OK")="Play!", message=w1) -> (true=w2)
      # show instructions
      Not(x=w2) -> w3
      $done <- w3
    }
    frame 1 {
      Decrement(x=8) -> w4
      # input loop
      while {
        w5 = $Difficulty
        event (timeout = w5) {
          on Timeout { }
          on "Panel" Key down {
            Event Data() -> ("Virtual Key"=w6)
            case (w6) {
              frame "ASCII", Default { }
              frame "Right" {
                Decrement(x=$direction) -> w7
                Is Less(x=w7, y=0) -> w8
                Select(s=w8, t=w4, f=w7) -> w9
                $direction <- w9
              }
              frame "Left" {
                Increment(x=$direction) -> w10
                Is Greater(x=w10, y=w4) -> w11
                Select(s=w11, t=0, f=w10) -> w12
                $direction <- w12
              }
            }
          }
        }
        stop if $done
      }
      # game loop
      while {
        Random Number() -> (number (0 to 1)=w13)
        Multiply(w13, 8) -> w14
        # (degrees)
        Round Toward Negative Infinity(x=w14) -> w15
        $direction <- w15
        # world size
        # snake/apple unit
        # initial apples
        # last index ate apple at
        Divide(x=1000, y=2) -> w16
        # initial snake size
        Initialize Array(element=w16, size=25) -> w17
        Initialize Array(element=w16, size=25) -> w18
        # initial snake
        Property Node(instance in="xyplot.gtype" {all zero or empty}, "X"=w17, "Y"=w18) -> (instance out=w19)
        Sign(number=10) -> (-1, 0, 1=w20)
        # movement loop
        # apples
        # eaten
        s1 = w19  # shift register
        s2 = "xyplot.gtype" {all zero or empty}  # shift register
        s3 = w20  # shift register
        s4 = 0  # shift register
        while (iteration -> i1) {
          call "next_move.gvi"(Direction max=8, Direction=$direction, Snake Unit=10, Snake In=s1) -> (X=w21, Y=w22, Snake Out=w23)
          call "resolve_apples.gvi"(Apples In=s2, World Size=1000, Apple Unit=10, Max Apples=$"Max Apples", X=w21, Y=w22) -> (Apples Out=w24, Ate Apple=w25)
          # execute the move
          Property Node(instance in=s1) -> ("X"=w26)
          Array Size(array=w26) -> (size(s)=w27)
          Select(s=w25, t=i1, f=s3) -> w28
          Subtract(x=i1, y=w28) -> w29
          Is Less(x=w29, y=10) -> w30
          # delete when we have not ate an apple in the last 5 moves
          case (w30) {
            frame False, Default {
              call "xyplot_delete.gvi"(XY Plot Input=w23, index=w27) -> (XY Plot Output=w31)
            }
            frame True {
              w31 = w23
            }
          }
          # display the snake and apples
          Build Array(w31, w24) -> w32
          $"XY Graph" <- w32
          call "collision_self.gvi"(Snake Plot=w23) -> (Result=w33)
          call "collision_wall.gvi"(X=w21, Y=w22, World Size=1000) -> (Result=w34)
          Logical Or(w33, w34) -> w35
          Increment(x=s4) -> w36
          Select(s=w25, t=w36, f=s4) -> w37
          $"Apples Eaten" <- w37
          Wait(time to wait=$Difficulty)
          next s1 = w31
          next s2 = w24
          next s3 = w28
          next s4 = w37
          stop if w35
        }
        # show game over
        call "snake_1.gvi"(apples=s4) -> (Result=w38)  # Build Text
        Two Button Dialog(F button name ("Cancel")="No", T button name ("OK")="Yes", message=w38) -> (T Button?=w39)
        Not(x=w39) -> w40
        $done <- w40
        stop if w40
      }
    }
  }
