vi "snake_1.gvi"   [LabVIEW Conversion 3.0.0]
# Creates an output string from a combination of text and parameterized inputs. If the input is not a string, this Express VI converts the input into a string based on the configuration of the Express VI.
# --------------------
# This Express VI is configured as follows:
# Text with parameters:  Game over! Apples eaten: %apples%\nPlay again?
inputs:
  "Beginning Text": string  # Prepends the text you wire to this input to the text the Express VI generates.
  "apples": f64
  "error in (no error)": error
outputs:
  "Result": string  # Returns the resulting data based on the configuration of the Express VI.
  "error out": error
panel controls:
  "Input 2": string
  "Input 3": string
  "Input 4": string
  "Input 5": string
  "Input 6": string
  "Input 7": string
  "Input 8": string
uses:
  NI::G Core::Error::Write Current Call Chain.gvi
diagram:
  w1 = "Game over! Apples eaten: %d\\nPlay again?%s%s%s%s%s%s%s"  # Format String
  Format Into String(formatString=w1, initString=$"Beginning Text", errIn=$"error in (no error)", $apples, $"Input 2", $"Input 3", $"Input 4", $"Input 5", $"Input 6", $"Input 7", $"Input 8") -> (outString=w2, errOut=w3)
  $Result <- w2
  case ($"error in (no error)") {
    frame No Error {
      call "Write Current Call Chain.gvi"(error in=w3) -> (error out=w4)
    }
    frame Error {
      w4 = w3
    }
  }
  $"error out" <- w4
