vi "Function_2.gviweb"   [LabVIEW NXG 2.0.0]
panel indicators:
  "body": string
uses:
  NI::HTTP::Open HTTP Handle.gvi
  NI::HTTP::Add Header.gvi
  NI::HTTP::GET.gvi
  NI::HTTP::Close HTTP Handle.gvi
diagram:
  w1 = "https://www.ncdc.noaa.gov/cdo-web/api/v2/data?datasetid=GHCND&locationid=ZIP:28801&startdate=2010-05-01&enddate=2010-05-01\n"
  call "Open HTTP Handle.gvi"() -> (client handle out=w2, error out=w3)
  call "Add Header.gvi"(client handle=w2, header="Token", value="<token here>", error in=w3) -> (client handle out=w4, error out=w5)
  call "GET.gvi"(client handle=w4, url=w1, error in=w5) -> (client handle out=w6, body=w7, error out=w8)
  call "Close HTTP Handle.gvi"(client handle=w6, error in=w8)
  $body <- w7
