vi "collision_wall.gvi"   [LabVIEW Conversion 5.2.0.5082]
inputs:
  "X": i32, required
  "Y": i32, required
  "World Size": i32, required
outputs:
  "Result": bool
diagram:
  Is Less(x=$X, y=$"World Size") -> w1
  Is Less(x=$Y, y=$"World Size") -> w2
  Is Greater(x=$X, y=-1) -> w3
  Is Greater(x=$Y, y=-1) -> w4
  Logical And[output inverted](w3, w1, w2, w4) -> w5
  $Result <- w5
