vi "snake.gvi"   [LabVIEW NXG 2.0.0]
# Play the classic game snake!
panel controls:
  "Left": bool
  "Right": bool
panel indicators:
  "XY Graph": "xyplot.gtype"[]
  "direction": f64
  "Apples Eaten": i32
types:
  "xyplot.gtype" = cluster{"X": i32[], "Y": i32[]}
uses:
  Application::next_move.gvi
  Application::collision_self.gvi
  Application::collision_wall.gvi
  Application::resolve_apples.gvi
  Application::xyplot_delete.gvi
diagram:
  Decrement(x=8) -> w1
  # input loop
  while {
    case ($Right) {
      frame True {
        Decrement(x=$direction) -> w2
        Is Less(x=w2, y=0) -> w3
        Select(s=w3, t=w1, f=w2) -> w4
        $direction <- w4
      }
      frame False { }
    }
    Wait(time to wait=20)
    case ($Left) {
      frame False, Default { }
      frame True {
        Increment(x=$direction) -> w5
        Is Greater(x=w5, y=w1) -> w6
        Select(s=w6, t=0, f=w5) -> w7
        $direction <- w7
      }
    }
    stop if FALSE
  }
  # game loop
  while {
    # world size
    # initial snake size
    # initial apples
    Divide(x=1000, y=2) -> w8
    Initialize Array(element=w8, size=25) -> w9
    Initialize Array(element=w8, size=25) -> w10
    # initial snake
    Property Node(instance in="xyplot.gtype" {all zero or empty}, "X"=w9, "Y"=w10) -> (instance out=w11)
    Sign(number=10) -> (-1, 0, 1=w12)
    # snake/apple unit
    # apples
    # eaten
    # movement loop
    s1 = w11  # shift register
    s2 = "xyplot.gtype" {all zero or empty}  # shift register
    s3 = w12  # shift register
    s4 = 0  # shift register
    while (iteration -> i1) {
      # execute the move
      Wait(time to wait=50)
      call "next_move.gvi"(Direction max=8, Direction=$direction, Snake Unit=10, Snake In=s1) -> (X=w13, Y=w14, Snake Out=w15)
      call "collision_self.gvi"(Snake Plot=w15) -> (Result=w16)
      call "collision_wall.gvi"(X=w13, Y=w14, World Size=1000) -> (Result=w17)
      Logical Or(w16, w17) -> w18
      call "resolve_apples.gvi"(Apples In=s2, World Size=1000, Apple Unit=10, Max Apples=20, X=w13, Y=w14) -> (Apples Out=w19, Ate Apple=w20)
      Property Node(instance in=s1) -> ("X"=w21)
      Array Size(array=w21) -> (size(s)=w22)
      Select(s=w20, t=i1, f=s3) -> w23
      Subtract(x=i1, y=w23) -> w24
      Is Less(x=w24, y=10) -> w25
      # delete when we have not ate an apple in the last 5 moves
      case (w25) {
        frame False, Default {
          call "xyplot_delete.gvi"(XY Plot Input=w15, index=w22) -> (XY Plot Output=w26)
        }
        frame True {
          w26 = w15
        }
      }
      Build Array(w26, w19) -> w27
      # display the snake and apples
      $"XY Graph" <- w27
      Increment(x=s4) -> w28
      Select(s=w20, t=w28, f=s4) -> w29
      $"Apples Eaten" <- w29
      next s1 = w26
      next s2 = w19
      next s3 = w23
      next s4 = w29
      stop if w18
    }
    Random Number() -> (number (0 to 1)=w30)
    Multiply(w30, 8) -> w31
    Round Toward Negative Infinity(x=w31) -> w32
    # last index ate apple at
    # (degrees)
    $direction <- w32
    stop if FALSE
  }
