vi "snake.gviweb"   [LabVIEW NXG 2.0.0]
panel controls:
  "Left": bool
  "Right": bool
panel indicators:
  "direction": f64
  "Apples Eaten": i32
  "Graph": "xyplot.gtype"[]
  "50ms - real time": u32
  "20ms - real time": u32
types:
  "xyplot.gtype" = cluster{"X": i32[], "Y": i32[]}
uses:
  Application::next_move.gvi
  Application::collision_self.gvi
  Application::collision_wall.gvi
  Application::resolve_apples.gvi
  Application::xyplot_delete.gvi
diagram:
  Tick Count() -> (timer value=w1)
  Decrement(x=8) -> w2
  # input loop
  s1 = w1  # shift register
  while {
    Tick Count() -> (timer value=w3)
    Subtract(x=w3, y=s1) -> w4
    $"20ms - real time" <- w4
    case ($Right) {
      frame True {
        Decrement(x=$direction) -> w5
        Is Less(x=w5, y=0) -> w6
        Select(s=w6, t=w2, f=w5) -> w7
        $direction <- w7
      }
      frame False { }
    }
    Wait(time to wait=20)
    case ($Left) {
      frame False, Default { }
      frame True {
        Increment(x=$direction) -> w8
        Is Greater(x=w8, y=w2) -> w9
        Select(s=w9, t=0, f=w8) -> w10
        $direction <- w10
      }
    }
    next s1 = w3
    stop if FALSE
  }
  # game loop
  while {
    # world size
    # initial snake size
    # initial apples
    Divide(x=1000, y=2) -> w11
    Initialize Array(element=w11, size=25) -> w12
    Initialize Array(element=w11, size=25) -> w13
    # initial snake
    Property Node(instance in="xyplot.gtype" {all zero or empty}, "X"=w12, "Y"=w13) -> (instance out=w14)
    Sign(number=10) -> (-1, 0, 1=w15)
    # snake/apple unit
    # apples
    # eaten
    Tick Count() -> (timer value=w16)
    # movement loop
    s2 = w14  # shift register
    s3 = "xyplot.gtype" {all zero or empty}  # shift register
    s4 = w15  # shift register
    s5 = 0  # shift register
    s6 = w16  # shift register
    while (iteration -> i1) {
      Tick Count() -> (timer value=w17)
      Subtract(x=w17, y=s6) -> w18
      $"50ms - real time" <- w18
      # execute the move
      Wait(time to wait=50)
      call "next_move.gvi"(Direction max=8, Direction=$direction, Snake Unit=10, Snake In=s2) -> (X=w19, Y=w20, Snake Out=w21)
      call "collision_self.gvi"(Snake Plot=w21) -> (Result=w22)
      call "collision_wall.gvi"(X=w19, Y=w20, World Size=1000) -> (Result=w23)
      Logical Or(w22, w23) -> w24
      call "resolve_apples.gvi"(Apples In=s3, World Size=1000, Apple Unit=10, Max Apples=20, X=w19, Y=w20) -> (Apples Out=w25, Ate Apple=w26)
      Property Node(instance in=s2) -> ("X"=w27)
      Array Size(array=w27) -> (size(s)=w28)
      Select(s=w26, t=i1, f=s4) -> w29
      Subtract(x=i1, y=w29) -> w30
      Is Less(x=w30, y=10) -> w31
      # delete when we have not ate an apple in the last 5 moves
      case (w31) {
        frame False, Default {
          call "xyplot_delete.gvi"(XY Plot Input=w21, index=w28) -> (XY Plot Output=w32)
        }
        frame True {
          w32 = w21
        }
      }
      # display the snake and apples
      Build Array(w32, w25) -> w33
      $Graph <- w33
      Increment(x=s5) -> w34
      Select(s=w26, t=w34, f=s5) -> w35
      $"Apples Eaten" <- w35
      next s2 = w32
      next s3 = w25
      next s4 = w29
      next s5 = w35
      next s6 = w17
      stop if w24
    }
    Random Number() -> (number (0 to 1)=w36)
    Multiply(w36, 8) -> w37
    Round Toward Negative Infinity(x=w37) -> w38
    # last index ate apple at
    # (degrees)
    $direction <- w38
    stop if FALSE
  }
