vi "Main.gviweb"   [LabVIEW NXG 2.0.0]
panel controls:
  "left": bool
  "right": bool
panel indicators:
  "direction": f64
  "Score (Apples Eaten)": i32
  "Graph": "xyplot.gtype"[]
  "right out": bool
  "left out": bool
  "snake": "xyplot.gtype"
  "apples": "xyplot.gtype"
  "game runs": i32
types:
  "xyplot.gtype" = cluster{"X": i32[], "Y": i32[]}
uses:
  My Computer::next_move.gvi
  My Computer::resolve_apples.gvi
  My Computer::xyplot_delete.gvi
  My Computer::collision_self.gvi
  My Computer::collision_wall.gvi
diagram:
  Decrement(x=8) -> w1
  while {
    $"left out" <- $left
    case ($left) {
      frame False, Default { }
      frame True {
        Increment(x=$direction) -> w2
        Is Greater(x=w2, y=w1) -> w3
        Select(s=w3, t=0, f=w2) -> w4
        $direction <- w4
      }
    }
    case ($right) {
      frame False, Default { }
      frame True {
        Decrement(x=$direction) -> w5
        Is Less(x=w5, y=0) -> w6
        Select(s=w6, t=w1, f=w5) -> w7
        $direction <- w7
      }
    }
    Wait(time to wait=0)
    $"right out" <- $right
    stop if FALSE
  }
  while (iteration -> i1) {
    Random Number() -> (number (0 to 1)=w8)
    Multiply(w8, 8) -> w9
    # (degrees)
    Round Toward Negative Infinity(x=w9)
    w10 = 1000  # world size
    w11 = 10  # snake/apple unit
    w12 = "xyplot.gtype" {all zero or empty}  # initial apples
    w13 = 10  # last index ate apple at
    Divide(x=w10, y=2) -> w14
    w15 = 25  # initial snake size
    Initialize Array(element=w14, size=w15) -> w16
    Initialize Array(element=w14, size=w15) -> w17
    # w18: initial snake
    Property Node(instance in=w12, "X"=w16, "Y"=w17) -> (instance out=w18)
    w19 = 0  # Apples Eaten
    Sign(number=w13) -> (-1, 0, 1=w20)
    # movement loop
    s1 = w18  # shift register
    s2 = w12  # shift register
    s3 = w20  # shift register
    s4 = w19  # shift register
    while (iteration -> i2) {
      call "next_move.gvi"(Direction max=8, Direction=$direction, Snake Unit=w11, Snake In=s1) -> (X=w21, Y=w22, Snake Out=w23)
      call "resolve_apples.gvi"(Apples In=s2, World Size=w10, Apple Unit=w11, Max Apples=0, X=w21, Y=w22) -> (Apples Out=w24, Ate Apple=w25)
      # execute the move
      Property Node(instance in=s1) -> ("X"=w26)
      Array Size(array=w26) -> (size(s)=w27)
      Select(s=w25, t=i2, f=s3) -> w28
      Subtract(x=i2, y=w28) -> w29
      Is Less(x=w29, y=w13) -> w30
      # delete when we have not ate an apple in the last 5 moves
      case (w30) {
        frame False, Default {
          call "xyplot_delete.gvi"(XY Plot Input=w23, index=w27) -> (XY Plot Output=w31)
        }
        frame True {
          w31 = w23
        }
      }
      Build Array(w31, w24) -> w32
      # display the snake and apples
      $Graph <- w32
      call "collision_self.gvi"(Snake Plot=w23) -> (Result=w33)
      call "collision_wall.gvi"(X=w21, Y=w22, World Size=w10) -> (Result=w34)
      Logical Or(w33, w34) -> w35
      $snake <- w31
      Increment(x=s4) -> w36
      Select(s=w25, t=w36, f=s4) -> w37
      $"Score (Apples Eaten)" <- w37
      $apples <- w24
      Wait(time to wait=125)
      next s1 = w31
      next s2 = w24
      next s3 = w28
      next s4 = w37
      stop if w35
    }
    $"game runs" <- i1
    stop if FALSE
  }
