vi "ccw.gvi"   [LabVIEW Conversion 5.1.0.3763]
inputs:
  "A": i32
  "B": i32
  "C": i32
  "D": i32
  "E": i32
  "F": i32
outputs:
  "Result": bool
diagram:
  Subtract(x=$F, y=$B) -> w1
  Subtract(x=$C, y=$A) -> w2
  Multiply(w1, w2) -> w3
  Subtract(x=$D, y=$B) -> w4
  Subtract(x=$E, y=$A) -> w5
  Multiply(w4, w5) -> w6
  Is Greater(x=w3, y=w6) -> w7
  $Result <- w7
