vi "collision_self.gvi"   [LabVIEW Conversion 5.1.0.3763]
inputs:
  "Snake Plot": "xyplot.gtype", required
outputs:
  "Result": bool
types:
  "xyplot.gtype" = cluster{"X": i32[], "Y": i32[]}
uses:
  My Computer::ccw.gvi
diagram:
  Property Node(instance in=$"Snake Plot") -> ("X"=w1, "Y"=w2)
  Array Size(array=w1) -> (size(s)=w3)
  Is Greater(x=w3, y=2) -> w4
  case (w4) {
    frame False, Default {
      w5 = FALSE
    }
    frame True {
      Array Index(array=w1) -> (out0[0]=w6)
      # A
      Array Index(array=w2) -> (out0[0]=w7)
      Array Index(array=w1) -> (out0[1]=w8)
      # B
      Array Index(array=w2) -> (out0[1]=w9)
      # C
      # D
      s1 = 0  # shift register
      s2 = 0  # shift register
      while (iteration -> i1) {
        w10 = each element of w1
        w11 = each element of w2
        Is Greater(x=i1, y=3) -> w12
        case (w12) {
          frame False, Default {
            w13 = w11
            w14 = w10
            w15 = FALSE
            w5 = FALSE
          }
          frame True {
            # ACD
            call "ccw.gvi"(A=w6, B=w7, C=s1, D=s2, E=w10, F=w11) -> (Result=w16)
            # BCD
            call "ccw.gvi"(A=w8, B=w9, C=s1, D=s2, E=w10, F=w11) -> (Result=w17)
            Is Not Equal(x=w16, y=w17) -> w18
            # ABC
            call "ccw.gvi"(A=w6, B=w7, C=w8, D=w9, E=s1, F=s2) -> (Result=w19)
            # ABD
            call "ccw.gvi"(A=w6, B=w7, C=w8, D=w9, E=w10, F=w11) -> (Result=w20)
            Is Not Equal(x=w19, y=w20) -> w21
            Logical And(w18, w21) -> w15
            w13 = w11
            w14 = w10
            w5 = w15
          }
        }
        Increment(x=i1) -> w22
        Is Greater Or Equal(x=w22, y=w3) -> w23
        Logical Or(w15, w23) -> w24
        next s1 = w14
        next s2 = w13
        stop if w24
      }
    }
  }
  $Result <- w5
