vi "next_move.gvi"   [LabVIEW Conversion 5.1.0.3763]
inputs:
  "Direction max": f64, required
  "Direction": f64, required
  "Snake Unit": i32, required
  "Snake In": "xyplot.gtype", required
outputs:
  "X": i32
  "Y": i32
  "Snake Out": "xyplot.gtype"
types:
  "xyplot.gtype" = cluster{"X": i32[], "Y": i32[]}
uses:
  My Computer::xyplot_insert.gvi
diagram:
  Property Node(instance in=$"Snake In") -> ("X"=w1, "Y"=w2)
  Array Index(array=w1) -> (out0[0]=w3)
  Divide(x=$Direction, y=$"Direction max") -> w4
  Multiply(w4, 6.28318530718) -> w5
  Cosine(x=w5) -> w6
  Multiply(w6, $"Snake Unit") -> w7
  To Long Integer(number=w7) -> w8
  Add(w8, w3) -> w9
  $X <- w9
  Array Index(array=w2) -> (out0[0]=w10)
  Sine(x=w5) -> w11
  Multiply(w11, $"Snake Unit") -> w12
  To Long Integer(number=w12) -> w13
  Add(w13, w10) -> w14
  $Y <- w14
  call "xyplot_insert.gvi"(XY Plot Input=$"Snake In", X'=w9, Y'=w14) -> (XY Plot Output=w15)
  $"Snake Out" <- w15
