vi "resolve_apples.gvi"   [LabVIEW Conversion 5.1.0.3763]
inputs:
  "Apples In": "xyplot.gtype", required
  "World Size": i32, required
  "Apple Unit": i32, required
  "Max Apples": i32, required
  "X": i32, required
  "Y": i32, required
outputs:
  "Apples Out": "xyplot.gtype"
  "Ate Apple": bool
types:
  "xyplot.gtype" = cluster{"X": i32[], "Y": i32[]}
uses:
  My Computer::xyplot_insert.gvi
  My Computer::xyplot_delete.gvi
diagram:
  Property Node(instance in=$"Apples In") -> ("X"=w1)
  Array Size(array=w1) -> (size(s)=w2)
  Is Less(x=w2, y=$"Max Apples") -> w3
  # if there are less apples than max apples, create one
  case (w3) {
    frame False, Default {
      w4 = $"Apples In"
    }
    frame True {
      Random Number() -> (number (0 to 1)=w5)
      Multiply(w5, $"World Size") -> w6
      Random Number() -> (number (0 to 1)=w7)
      Multiply($"World Size", w7) -> w8
      call "xyplot_insert.gvi"(XY Plot Input=$"Apples In", X'=w6, Y'=w8) -> (XY Plot Output=w4)
    }
  }
  Property Node(instance in=w4) -> ("X"=w9, "Y"=w10)
  Array Size(array=w10) -> (size(s)=w11)
  # ate apple?
  while (iteration -> i1) {
    w12 = each element of w9
    w13 = each element of w10
    Subtract(x=w12, y=$"Apple Unit") -> w14
    Is Greater(x=$X, y=w14) -> w15
    Add(w12, $"Apple Unit") -> w16
    Is Less(x=$X, y=w16) -> w17
    Subtract(x=w13, y=$"Apple Unit") -> w18
    Is Greater(x=$Y, y=w18) -> w19
    Add(w13, $"Apple Unit") -> w20
    Is Less(x=$Y, y=w20) -> w21
    Logical And(w15, w17, w19, w21) -> w22
    # eat the apple
    case (w22) {
      frame False, Default {
        w23 = w4
      }
      frame True {
        call "xyplot_delete.gvi"(XY Plot Input=w4, index=i1) -> (XY Plot Output=w23)
      }
    }
    Increment(x=i1) -> w24
    Is Greater Or Equal(x=w24, y=w11) -> w25
    Logical Or(w22, w25) -> w26
    stop if w26
  }
  $"Ate Apple" <- w22
  $"Apples Out" <- w23
