vi "snake.gvi"   [LabVIEW NXG 2.0.0]
# Play the classic game snake!
panel controls:
  "Max Apples": i32 = 20
  "left": bool
  "right": bool
panel indicators:
  "XY Graph": "xyplot.gtype"[]
  "direction": f64
  "Apples Eaten": i32
types:
  "xyplot.gtype" = cluster{"X": i32[], "Y": i32[]}
uses:
  My Computer::next_move.gvi
  My Computer::resolve_apples.gvi
  My Computer::xyplot_delete.gvi
  My Computer::collision_self.gvi
  My Computer::collision_wall.gvi
diagram:
  Decrement(x=8) -> w1
  while {
    case ($left) {
      frame False, Default { }
      frame True {
        Increment(x=$direction) -> w2
        Is Greater(x=w2, y=w1) -> w3
        Select(s=w3, t=0, f=w2) -> w4
        $direction <- w4
      }
    }
    case ($right) {
      frame False, Default { }
      frame True {
        Decrement(x=$direction) -> w5
        Is Less(x=w5, y=0) -> w6
        Select(s=w6, t=w1, f=w5) -> w7
        $direction <- w7
      }
    }
    stop if FALSE
  }
  # game loop
  while {
    Random Number() -> (number (0 to 1)=w8)
    Multiply(w8, 8) -> w9
    # (degrees)
    Round Toward Negative Infinity(x=w9) -> w10
    $direction <- w10
    # snake/apple unit
    # initial apples
    # world size
    # last index ate apple at
    Divide(x=1000, y=2) -> w11
    # initial snake size
    Initialize Array(element=w11, size=25) -> w12
    Initialize Array(element=w11, size=25) -> w13
    # initial snake
    Property Node(instance in="xyplot.gtype" {all zero or empty}, "X"=w12, "Y"=w13) -> (instance out=w14)
    Sign(number=10) -> (-1, 0, 1=w15)
    # movement loop
    # apples
    # eaten
    s1 = w14  # shift register
    s2 = "xyplot.gtype" {all zero or empty}  # shift register
    s3 = w15  # shift register
    s4 = 0  # shift register
    while (iteration -> i1) {
      call "next_move.gvi"(Direction max=8, Direction=$direction, Snake Unit=10, Snake In=s1) -> (X=w16, Y=w17, Snake Out=w18)
      call "resolve_apples.gvi"(Apples In=s2, World Size=1000, Apple Unit=10, Max Apples=$"Max Apples", X=w16, Y=w17) -> (Apples Out=w19, Ate Apple=w20)
      # execute the move
      Property Node(instance in=s1) -> ("X"=w21)
      Array Size(array=w21) -> (size(s)=w22)
      Select(s=w20, t=i1, f=s3) -> w23
      Subtract(x=i1, y=w23) -> w24
      Is Less(x=w24, y=10) -> w25
      # delete when we have not ate an apple in the last 5 moves
      case (w25) {
        frame False, Default {
          call "xyplot_delete.gvi"(XY Plot Input=w18, index=w22) -> (XY Plot Output=w26)
        }
        frame True {
          w26 = w18
        }
      }
      # display the snake and apples
      Build Array(w26, w19) -> w27
      $"XY Graph" <- w27
      call "collision_self.gvi"(Snake Plot=w18) -> (Result=w28)
      call "collision_wall.gvi"(X=w16, Y=w17, World Size=1000) -> (Result=w29)
      Logical Or(w28, w29) -> w30
      Increment(x=s4) -> w31
      Select(s=w20, t=w31, f=s4) -> w32
      $"Apples Eaten" <- w32
      Wait(time to wait=125)
      next s1 = w26
      next s2 = w19
      next s3 = w23
      next s4 = w32
      stop if w30
    }
    stop if FALSE
  }
