vi "xyplot_delete.gvi"   [LabVIEW Conversion 5.1.0.3763]
inputs:
  "XY Plot Input": "xyplot.gtype", required
  "index": i32, required
outputs:
  "XY Plot Output": "xyplot.gtype"
types:
  "xyplot.gtype" = cluster{"X": i32[], "Y": i32[]}
diagram:
  Property Node(instance in=$"XY Plot Input") -> ("X"=w1, "Y"=w2)
  Delete From Array(inArray=w1, index0=$index) -> w3
  Delete From Array(inArray=w2, index0=$index) -> w4
  Property Node(instance in=$"XY Plot Input", "X"=w3, "Y"=w4) -> (instance out=w5)
  $"XY Plot Output" <- w5
