vi "xyplot_insert.gvi"   [LabVIEW Conversion 5.1.0.3763]
inputs:
  "XY Plot Input": "xyplot.gtype", required
  "X'": i32, required
  "Y'": i32, required
  "index": i32
outputs:
  "XY Plot Output": "xyplot.gtype"
types:
  "xyplot.gtype" = cluster{"X": i32[], "Y": i32[]}
diagram:
  Property Node(instance in=$"XY Plot Input") -> ("X"=w1, "Y"=w2)
  Insert Into Array(inArray=w1, index0=$index, new=$"X'") -> w3
  Insert Into Array(inArray=w2, index0=$index, new=$"Y'") -> w4
  Property Node(instance in=$"XY Plot Input", "X"=w3, "Y"=w4) -> (instance out=w5)
  $"XY Plot Output" <- w5
