vi "Set My Sweet Alert Styles.gvi"   [LabVIEW NXG 4.0.0]
inputs:
  "options in": "options.gtype"
outputs:
  "options out": "options.gtype"
types:
  "option.gtype" = cluster{"propertiesJSON": string}
  "options.gtype" = "option.gtype"[]
uses:
  MySweetAlertStyles::Support::MySweetAlertStyles.jsli::SetMySweetAlertStyles
  SweetAlert::Advanced::Configure::Custom Class Options.gvi
diagram:
  call "SetMySweetAlertStyles"()
  # See MySweetAlertStyles.css for how the classes are used
  call "Custom Class Options.gvi"(options in=$"options in", title="my-sweet-alert-title", content="my-sweet-alert-content", confirmButton="my-sweet-alert-button warning", cancelButton="my-sweet-alert-button error", footer="my-sweet-alert-footer") -> (options out=w1)
  $"options out" <- w1
