vi "Base Options.gvi"   [LabVIEW NXG 3.1.0]
inputs:
  "options in": "options.gtype"
  "title": string
  "message": string
  "icon": "icon.gtype" = "none"
  "footer": string
  "animation?": bool = TRUE
  "backdrop?": bool = TRUE
outputs:
  "options out": "options.gtype"
types:
  "icon.gtype" = enum{"none", "success", "info", "question", "warning", "error"}
  "option.gtype" = cluster{"propertiesJSON": string}
  "options.gtype" = "option.gtype"[]
  T1 = cluster{"title": string, "html": string, "icon": string, "footer": string, "animation": bool, "backdrop": bool}
uses:
  SweetAlert::Support::Append Option.gvi
diagram:
  # See available options at https://sweetalert2.github.io/#configuration
  w1 = T1 {"title"="", "html"="", "icon"="", "footer"="", "animation"=TRUE, "backdrop"=TRUE}
  case ($icon) {
    frame "none" {
      w2 = ""
    }
    frame Default {
      Format Into String($icon) -> w2
    }
  }
  Property Node(instance in=w1, "title"=$title, "html"=$message, "icon"=w2, "footer"=$footer, "animation"=$"animation?", "backdrop"=$"backdrop?") -> (instance out=w3)
  Flatten To JSON(anything=w3) -> (JSON string=w4)
  call "Append Option.gvi"(options in=$"options in", propertiesJSON=w4) -> (options out=w5)
  $"options out" <- w5
