vi "Cancel Button Options.gvi"   [LabVIEW NXG 3.1.0]
inputs:
  "options in": "options.gtype"
  "enable?": bool = TRUE
  "text": string = "Cancel"
  "background color": "Color.gtype" = 4289374890
outputs:
  "options out": "options.gtype"
types:
  "Color.gtype" = u32
  "option.gtype" = cluster{"propertiesJSON": string}
  "options.gtype" = "option.gtype"[]
  T1 = cluster{"cancelButtonText": string, "showCancelButton": bool, "cancelButtonColor": string}
uses:
  SweetAlert::Support::Color to CSS hex.gvi
  SweetAlert::Support::Append Option.gvi
diagram:
  # See available options at https://sweetalert2.github.io/#configuration
  call "Color to CSS hex.gvi"(Input=$"background color") -> (Output=w1)
  Property Node(instance in=T1 {all zero or empty}, "showCancelButton"=$"enable?", "cancelButtonText"=$text, "cancelButtonColor"=w1) -> (instance out=w2)
  Flatten To JSON(anything=w2) -> (JSON string=w3)
  call "Append Option.gvi"(options in=$"options in", propertiesJSON=w3) -> (options out=w4)
  $"options out" <- w4
