vi "Custom Class Options.gvi"   [LabVIEW NXG 4.0.0]
inputs:
  "options in": "options.gtype"
  "container": string
  "header": string
  "popup": string
  "title": string
  "closeButton": string
  "icon": string
  "image": string
  "content": string
  "input": string
  "actions": string
  "confirmButton": string
  "cancelButton": string
  "footer": string
  "default button styling?": bool = TRUE
outputs:
  "options out": "options.gtype"
types:
  "option.gtype" = cluster{"propertiesJSON": string}
  "options.gtype" = "option.gtype"[]
  T1 = cluster{"actions": string, "cancelButton": string, "closeButton": string, "confirmButton": string, "container": string, "content": string, "footer": string, "header": string, "icon": string, "image": string, "input": string, "popup": string, "title": string}
  T2 = cluster{"customClass": T1, "buttonsStyling": bool}
uses:
  SweetAlert::Support::Append Option.gvi
diagram:
  w1 = T2 {"customClass"={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}, "buttonsStyling"=TRUE}
  Property Node(instance in=w1, "customClass:actions"=$actions, "customClass:cancelButton"=$cancelButton, "customClass:closeButton"=$closeButton, "customClass:confirmButton"=$confirmButton, "customClass:container"=$container, "customClass:content"=$content, "customClass:footer"=$footer, "customClass:header"=$header, "customClass:icon"=$icon, "customClass:image"=$image, "customClass:input"=$input, "customClass:popup"=$popup, "customClass:title"=$title, "buttonsStyling"=$"default button styling?") -> (instance out=w2)
  Flatten To JSON(anything=w2) -> (JSON string=w3)
  call "Append Option.gvi"(options in=$"options in", propertiesJSON=w3) -> (options out=w4)
  $"options out" <- w4
