vi "Input Select Options.gvi"   [LabVIEW NXG 5.1.0]
inputs:
  "options in": "options.gtype"
  "select options": T1[], required
  "placeholder text": string
  "initial value": string, required
outputs:
  "options out": "options.gtype"
types:
  "option.gtype" = cluster{"propertiesJSON": string}
  "options.gtype" = "option.gtype"[]
  T1 = cluster{"value": string, "display value": string}
  T2 = cluster{"input": string, "inputPlaceholder": string, "inputValue": string, "inputAutoTrim": bool, "inputOptionsArray": cluster{"value": string, "displayValue": string}[]}
uses:
  SweetAlert::Support::Append Option.gvi
diagram:
  # See available options at https://sweetalert2.github.io/#configuration
  Property Node(instance in=T2 {all zero or empty}, "input"="select", "inputPlaceholder"=$"placeholder text", "inputValue"=$"initial value", "inputOptionsArray"=$"select options") -> (instance out=w1)
  Flatten To Json(anything=w1) -> (JSON string=w2)
  call "Append Option.gvi"(options in=$"options in", propertiesJSON=w2) -> (options out=w3)
  $"options out" <- w3
