vi "Input Text Options.gvi"   [LabVIEW NXG 3.1.0]
inputs:
  "options in": "options.gtype"
  "input text type": "input text type.gtype" = "text", required
  "placeholder text": string
  "initial value": string
outputs:
  "options out": "options.gtype"
types:
  "option.gtype" = cluster{"propertiesJSON": string}
  "options.gtype" = "option.gtype"[]
  "input text type.gtype" = enum{"none", "text", "email", "password", "number", "tel", "textarea", "url"}
  T1 = cluster{"input": string, "inputPlaceholder": string, "inputValue": string, "inputAutoTrim": bool}
uses:
  SweetAlert::Support::Append Option.gvi
diagram:
  # See available options at https://sweetalert2.github.io/#configuration
  # Disable inputAutoTrim because behavior is unexpected with password inputs. User can use Trim Whitespace VI
  case ($"input text type") {
    frame "none" {
      w1 = ""
    }
    frame Default {
      Format Into String($"input text type") -> w1
    }
  }
  Property Node(instance in=T1 {all zero or empty}, "input"=w1, "inputPlaceholder"=$"placeholder text", "inputValue"=$"initial value") -> (instance out=w2)
  Flatten To JSON(anything=w2) -> (JSON string=w3)
  call "Append Option.gvi"(options in=$"options in", propertiesJSON=w3) -> (options out=w4)
  $"options out" <- w4
