vi "Modal Window Options.gvi"   [LabVIEW NXG 4.0.0]
inputs:
  "options in": "options.gtype"
  "toast?": bool
  "timer": f64 = -1
  "show timer progress bar?": bool
  "position": "position.gtype" = "center"
  "grow": "grow.gtype" = "default"
outputs:
  "options out": "options.gtype"
types:
  "option.gtype" = cluster{"propertiesJSON": string}
  "options.gtype" = "option.gtype"[]
  "position.gtype" = enum{"top-start", "top", "top-end", "center-start", "center", "center-end", "bottom-start", "bottom", "bottom-end"}
  "grow.gtype" = enum{"default", "row", "column", "fullscreen"}
uses:
  SweetAlert::Support::Append Option.gvi
diagram:
  w1 = cluster{"position": string, "toast": bool} {all zero or empty}
  Format Into String($position) -> w2
  Property Node(instance in=w1, "toast"=$"toast?", "position"=w2) -> (instance out=w3)
  Flatten To JSON(anything=w3) -> (JSON string=w4)
  call "Append Option.gvi"(options in=$"options in", propertiesJSON=w4) -> (options out=w5)
  case ($grow) {
    frame "default" {
      w6 = w5
    }
    frame Default {
      Format Into String($grow) -> w7
      Property Node(instance in=cluster{"grow": string} {all zero or empty}, "grow"=w7) -> (instance out=w8)
      Flatten To JSON(anything=w8) -> (JSON string=w9)
      call "Append Option.gvi"(options in=w5, propertiesJSON=w9) -> (options out=w6)
    }
  }
  Is Greater Than 0(x=$timer) -> w10
  case (w10) {
    frame False, Default {
      w11 = w6
    }
    frame True {
      w12 = cluster{"timer": u32, "timerProgressBar": bool} {all zero or empty}
      Multiply($timer, 1000) -> w13
      To Unsigned 32 Bit Integer(number=w13) -> w14
      Property Node(instance in=w12, "timer"=w14, "timerProgressBar"=$"show timer progress bar?") -> (instance out=w15)
      Flatten To JSON(anything=w15) -> (JSON string=w16)
      call "Append Option.gvi"(options in=w6, propertiesJSON=w16) -> (options out=w11)
    }
  }
  $"options out" <- w11
