vi "Progress Steps Options.gvi"   [LabVIEW NXG 5.1.0]
inputs:
  "options in": "options.gtype"
  "progress steps": string[], required
  "progress index": i32
outputs:
  "options out": "options.gtype"
types:
  "option.gtype" = cluster{"propertiesJSON": string}
  "options.gtype" = "option.gtype"[]
  T1 = cluster{"progressSteps": string[], "currentProgressStep": i32}
uses:
  SweetAlert::Support::Append Option.gvi
diagram:
  # See available options at https://sweetalert2.github.io/#configuration
  Property Node(instance in=T1 {all zero or empty}, "progressSteps"=$"progress steps", "currentProgressStep"=$"progress index") -> (instance out=w1)
  Flatten To Json(anything=w1) -> (JSON string=w2)
  call "Append Option.gvi"(options in=$"options in", propertiesJSON=w2) -> (options out=w3)
  $"options out" <- w3
