vi "Open Sweet Alert.gvi"   [LabVIEW NXG 5.1.0]
inputs:
  "error in": error
  "options": "options.gtype", required
outputs:
  "dismiss reason": "dismiss reason.gtype"
  "value": string
  "error out": error
types:
  "option.gtype" = cluster{"propertiesJSON": string}
  "options.gtype" = "option.gtype"[]
  "dismiss reason.gtype" = enum{"unknown", "success", "backdrop", "cancel", "close", "esc", "timer"}
uses:
  SweetAlert::Support::SweetAlert.jsli::Fire
diagram:
  w1 = cluster{"dismiss": string, "value": string} {"dismiss"="unknown", "value"=""}
  Flatten To Json(anything=$options, error in (no error)=$"error in") -> (JSON string=w2, error out=w3)
  call "Fire"(optionsArrayJSON=w2, error in=w3) -> (resultJSON=w4, error out=w5)
  Unflatten From Json(JSON string=w4, error in (no error)=w5, type and defaults=w1) -> (error out=w6, value=w7)
  Property Node(instance in=w7) -> ("value"=w8, "dismiss"=w9)
  $value <- w8
  w10 = "unknown"  # dismiss reason
  Scan From String(inputString=w9, errIn=w6, default=w10) -> (errOut=w11, out0=w12)
  $"error out" <- w11
  $"dismiss reason" <- w12
