vi "Prompt.gvi"   [LabVIEW NXG 5.1.0]
inputs:
  "error in": error
  "default": string
  "message": string, required
outputs:
  "cancelled?": bool
  "value": string
  "error out": error
uses:
  SweetAlert::Advanced::Configure::Base Options.gvi
  SweetAlert::Advanced::Configure::Confirm Button Options.gvi
  SweetAlert::Advanced::Configure::Cancel Button Options.gvi
  SweetAlert::Advanced::Configure::Input Text Options.gvi
  SweetAlert::Advanced::Operate::Open Sweet Alert.gvi
diagram:
  call "Base Options.gvi"(message=$message) -> (options out=w1)
  call "Confirm Button Options.gvi"(options in=w1) -> (options out=w2)
  call "Cancel Button Options.gvi"(options in=w2) -> (options out=w3)
  call "Input Text Options.gvi"(options in=w3, input text type="text", initial value=$default) -> (options out=w4)
  call "Open Sweet Alert.gvi"(options=w4, error in=$"error in") -> (dismiss reason=w5, value=w6, error out=w7)
  Is Equal(x="success", y=w5) -> w8
  Not(x=w8) -> w9
  $"cancelled?" <- w9
  $"error out" <- w7
  Select(s=w8, t=w6, f=$default) -> w10
  $value <- w10
