vi "Color to CSS hex.gvi"   [LabVIEW NXG 3.1.0]
inputs:
  "Input": "Color.gtype"
outputs:
  "Output": string
types:
  "Color.gtype" = u32
uses:
  SweetAlert::Support::Color to RGBA.gvi
diagram:
  call "Color to RGBA.gvi"(Color Constant=$Input) -> (red=w1, green=w2, blue=w3)
  Format Into String(formatString="#%2x%2x%2x", w1, w2, w3) -> w4
  $Output <- w4
