vi "index.gviweb"   [G Web Development Software 22.3.0]
panel controls:
  "show dialog": bool
  "title": string = "This is an example title"
  "message": string = "This is a message describing the dialog"
  "icon": T2 = "success"
  "footer": string = "<a href=\"#\">Some additional information that may be helpful!</a>"
  "input text type": T3 = "none"
  "placeholder text": string = "Hey friend! enter a value!"
  "initial value": string = "A boring default value"
  "enable confirm button?": bool = TRUE
  "confirm button text": string = "OK"
  "confirm button background color": enum{"default", "red", "blue", "green"} = "default"
  "enable cancel button?": bool = TRUE
  "cancel button background color": enum{"default", "red", "blue", "green"} = "default"
  "cancel button text": string = "Cancel"
  "enable progress steps?": bool = TRUE
  "steps": cluster{"steps": string}[] = [{"steps"="😁"}, {"steps"="😀"}, {"steps"="😅"}, {"steps"="😆"}, {"steps"="😍"}]
  "current steps index": i32 = 1
  "animation?": bool = TRUE
  "backdrop?": bool = TRUE
  "Prompt": bool
  "prompt message": string = "This is a simple prompt!"
  "prompt default": string = "one nice default"
  "toast?": bool
  "timer (seconds)": f64 = 8
  "show timer progress bar?": bool = TRUE
  "position": T4 = "center"
  "grow": enum{"default", "row", "column", "fullscreen"} = "default"
  "Show Styled Dialog": bool
  "input selector": i32
  "default selector option": T5 = "pineapple"
panel indicators:
  "dismiss reason": T1
  "value": string
  "prompt value": string
  "prompt cancelled?": bool
  "styled dialog dismiss reason": T1
types:
  T1 = enum{"unknown", "success", "backdrop", "cancel", "close", "esc", "timer"}
  T2 = enum{"none", "success", "info", "question", "warning", "error"}
  T3 = enum{"none", "text", "email", "password", "number", "tel", "textarea", "url"}
  T4 = enum{"top-start", "top", "top-end", "center-start", "center", "center-end", "bottom-start", "bottom", "bottom-end"}
  T5 = enum{"pen", "apple", "pineapple", "applepen", "pineapplepen", "penpineappleapplepen"}
uses:
  SweetAlert::Advanced::Configure::Base Options.gvi
  SweetAlert::Advanced::Configure::Input Select Options.gvi
  SweetAlert::Advanced::Configure::Input Text Options.gvi
  SweetAlert::Advanced::Configure::Confirm Button Options.gvi
  SweetAlert::Advanced::Configure::Cancel Button Options.gvi
  SweetAlert::Advanced::Configure::Progress Steps Options.gvi
  SweetAlert::Advanced::Configure::Modal Window Options.gvi
  SweetAlert::Advanced::Operate::Open Sweet Alert.gvi
  SweetAlert::Prompt.gvi
  MySweetAlertStyles::Set My Sweet Alert Styles.gvi
diagram:
  while {
    event {
      on "show dialog" Value changed {
        call "Base Options.gvi"(footer=$footer, title=$title, message=$message, icon=$icon, animation?=$"animation?", backdrop?=$"backdrop?") -> (options out=w1)
        case ($"input selector") {
          frame 1 {
            w3 = [{"value"="pen", "display value"="Pen"}, {"value"="apple", "display value"="Apple"}, {"value"="pineapple", "display value"="Pineapple"}, {"value"="applepen", "display value"="Apple Pen"}, {"value"="pineapplepen", "display value"="Pineapple Pen"}, {"value"="penpineappleapplepen", "display value"="Pen Pineapple Apple Pen"}]
            Format Into String($"default selector option") -> w4
            call "Input Select Options.gvi"(options in=w1, select options=w3, placeholder text=$"placeholder text", initial value=w4) -> (options out=w2)
          }
          frame 0, Default {
            call "Input Text Options.gvi"(options in=w1, input text type=$"input text type", placeholder text=$"placeholder text", initial value=$"initial value") -> (options out=w2)
          }
        }
        case ($"confirm button background color") {
          frame "red" {
            w6 = 4294748303  # Color
            w5 = w6
          }
          frame "blue" {
            w7 = 4287870947  # Color
            w5 = w7
          }
          frame "green" {
            w8 = 4291488412  # Color
            w5 = w8
          }
          frame "default" {
            w5 = 4281370070
          }
        }
        call "Confirm Button Options.gvi"(options in=w2, enable?=$"enable confirm button?", text=$"confirm button text", background color=w5) -> (options out=w9)
        case ($"cancel button background color") {
          frame "red" {
            w11 = 4294748303  # Color
            w10 = w11
          }
          frame "blue" {
            w12 = 4287870947  # Color
            w10 = w12
          }
          frame "green" {
            w13 = 4291488412  # Color
            w10 = w13
          }
          frame "default" {
            w10 = 4289374890
          }
        }
        call "Cancel Button Options.gvi"(options in=w9, enable?=$"enable cancel button?", text=$"cancel button text", background color=w10) -> (options out=w14)
        for {
          w15 = each element of $steps
          Property Node(instance in=w15) -> ("steps"=w17)
          append w17 to w16
        }
        case ($"enable progress steps?") {
          frame False, Default {
            w18 = w14
          }
          frame True {
            call "Progress Steps Options.gvi"(options in=w14, progress steps=w16, progress index=$"current steps index") -> (options out=w18)
          }
        }
        call "Modal Window Options.gvi"(options in=w18, toast?=$"toast?", timer=$"timer (seconds)", show timer progress bar?=$"show timer progress bar?", position=$position, grow=$grow) -> (options out=w19)
        call "Open Sweet Alert.gvi"(options=w19) -> (dismiss reason=w20, value=w21)
        $"dismiss reason" <- w20
        $value <- w21
      }
      on "Prompt" Value changed {
        call "Prompt.gvi"(message=$"prompt message", default=$"prompt default") -> (value=w22, cancelled?=w23)
        $"prompt value" <- w22
        $"prompt cancelled?" <- w23
      }
      on "Show Styled Dialog" Value changed {
        call "Base Options.gvi"(footer="Awesome styled footer", title="Awesome styled title", message="Awesome styled message") -> (options out=w24)
        call "Cancel Button Options.gvi"(options in=w24) -> (options out=w25)
        call "Set My Sweet Alert Styles.gvi"(options in=w25) -> (options out=w26)
        call "Open Sweet Alert.gvi"(options=w26) -> (dismiss reason=w27)
        $"styled dialog dismiss reason" <- w27
      }
    }
    stop if FALSE
  }
