vi "Create Synchronous Image.gvi"   [G Web Development Software 21.0.0]
inputs:
  "container": "HtmlContainer reference", required
  "stretch": "stretch.gtype" = "Fit image in space"
  "error in": error
outputs:
  "error out": error
  "synchronous image reference": "synchronous image reference.gtype"
types:
  "stretch.gtype" = enum{"No image scaling", "Fit image in space", "Fill but maintain aspect ratio", "Stretch to fill space"}
  "synchronous image reference.gtype" = "NI.JavaScriptReference"
uses:
  SynchronousImage::Support::SynchronousImage.jsli::Create
diagram:
  Obtain JavaScript Reference(reference in=$container, error in=$"error in") -> (error out=w1, javascript reference out=w2)
  Format Into String(errIn=w1, $stretch) -> (outString=w3, errOut=w4)
  call "Create"(container=w2, stretch=w3, error in=w4) -> (return=w5, error out=w6)
  Close Reference(error in=w6, reference=w2) -> (error out=w7)
  $"error out" <- w7
  $"synchronous image reference" <- w5
