vi "Destroy Synchronous Image.gvi"   [G Web Development Software 21.0.0]
inputs:
  "error in": error
  "synchronous image reference": "synchronous image reference.gtype", required
outputs:
  "error out": error
types:
  "synchronous image reference.gtype" = "NI.JavaScriptReference"
uses:
  SynchronousImage::Support::SynchronousImage.jsli::Destroy
diagram:
  call "Destroy"(synchronousImage=$"synchronous image reference") -> (error out=w1)
  Close Reference(error in=w1, reference=$"synchronous image reference") -> (error out=w2)
  Merge Errors($"error in", w2) -> (error out=w3)
  $"error out" <- w3
