vi "index.gviweb"   [G Web Development Software 21.0.0]
panel controls:
  "Hyperlink Control": string = "https://www.jpl.nasa.gov/nmp/ds2/mission/mission.php"
  "allow caching?": bool = TRUE
panel indicators:
  "current url": string
uses:
  SynchronousImage::Create Synchronous Image.gvi
  SynchronousImage::Update Source By Url.gvi
  SynchronousImage::Destroy Synchronous Image.gvi
  WebApp::Support::example byte array png.gvi
  SynchronousImage::Update Source By Byte Array.gvi
diagram:
  call "Create Synchronous Image.gvi"(container=reference to "Deep Space Two") -> (synchronous image reference=w1, error out=w2)
  s1 = w1  # shift register
  s2 = w2  # shift register
  while (iteration -> i1) {
    Random Number() -> (number (0 to 1)=w3)
    Multiply(w3, 1000000000) -> w4
    To Unsigned 64 Bit Integer(number=w4) -> w5
    Format Into String(formatString="?%0d", w5) -> w6
    Select(s=$"allow caching?", t="", f=w6) -> w7
    Quotient And Remainder(x=i1, y=32) -> (x-y*floor(x/y)=w8)
    Format Into String(formatString="source/deepspacetwo-%d.png%s", w8, w7) -> w9
    call "Update Source By Url.gvi"(synchronous image reference in=s1, url=w9, error in=s2) -> (synchronous image reference out=w10, error out=w11)
    $"current url" <- w9
    Wait(time to wait=100)
    next s1 = w10
    next s2 = w11
    stop if w11
  }
  call "Destroy Synchronous Image.gvi"(synchronous image reference=s1, error in=s2)
  call "Create Synchronous Image.gvi"(container=reference to "Single image from byte array") -> (synchronous image reference=w12, error out=w13)
  call "example byte array png.gvi"() -> (byte array=w14)
  call "Update Source By Byte Array.gvi"(synchronous image reference in=w12, byte array=w14, type="image/png", error in=w13)
