vi "Add Location Event Listener.gvi"   [LabVIEW NXG 5.1.0]
inputs:
  "error in": error
outputs:
  "location event listener configuration": "location event listener configuration.gtype"
  "window location change user event": "event window location change"
  "error out": error
types:
  "location event listener configuration.gtype" = cluster{"event stream reader": "NI.JavaScriptReference", "window location change user event": "event window location change"}
uses:
  URL::Support::URL.jsli::AddLocationEventListener
diagram:
  call "AddLocationEventListener"(error in=$"error in") -> (eventStreamReader=w1, error out=w2)
  w3 = string ""  # url
  Create User Event[EventName="window location change"](error in=w2, user event data type=w3) -> (error out=w4, user event out=w5)  # Create User Event: window location change
  w6 = "location event listener configuration.gtype" {all zero or empty}  # location event listener configuration
  Property Node(instance in=w6, "event stream reader"=w1, "window location change user event"=w5) -> (instance out=w7)
  $"location event listener configuration" <- w7
  $"window location change user event" <- w5
  $"error out" <- w4
