vi "Remove Location Event Listener.gvi"   [LabVIEW NXG 5.1.0]
inputs:
  "error in": error
  "location event listener configuration": "location event listener configuration.gtype", required
outputs:
  "error out": error
types:
  "location event listener configuration.gtype" = cluster{"event stream reader": "NI.JavaScriptReference", "window location change user event": "event window location change"}
uses:
  URL::Support::URL.jsli::RemoveLocationEventListener
diagram:
  Property Node(instance in=$"location event listener configuration") -> ("window location change user event"=w1, "event stream reader"=w2)
  # JSLI node should not have error in to make sure and clean-up resources
  call "RemoveLocationEventListener"(eventStreamReader=w2) -> (error out=w3)
  Close Reference(error in=w3, reference=w2) -> (error out=w4)
  Destroy User Event(error in=w4, user event=w1) -> (error out=w5)
  Merge Errors($"error in", w5) -> (error out=w6)
  $"error out" <- w6
