vi "Get Window Location Search Parameter.gvi"   [LabVIEW NXG 5.1.0]
inputs:
  "error in": error
  "key": string, required
outputs:
  "error out": error
  "value": string
  "exists": bool
uses:
  URL::Location::Get Window Location.gvi
  URL::URL::URL Get Parts.gvi
  URL::Query String::Query String Get Value.gvi
diagram:
  call "Get Window Location.gvi"(error in=$"error in") -> (url=w1, error out=w2)
  call "URL Get Parts.gvi"(url=w1, error in=w2) -> (url parts=w3, error out=w4)
  Property Node(instance in=w3) -> ("search"=w5)
  call "Query String Get Value.gvi"(query string=w5, key=$key, error in=w4) -> (value=w6, exists=w7, error out=w8)
  $value <- w6
  $exists <- w7
  $"error out" <- w8
