vi "Set Window Location Search Parameters.gvi"   [LabVIEW NXG 5.1.0]
inputs:
  "error in": error
  "search parameters": "query string part.gtype"[], required
  "window location set action": "window location set action.gtype" = "set"
outputs:
  "error out": error
types:
  "query string part.gtype" = cluster{"key": string, "value": string}
  "window location set action.gtype" = enum{"set", "push", "replace"}
uses:
  URL::Location::Get Window Location.gvi
  URL::URL::URL Get Parts.gvi
  URL::Query String::Query String Set Value.gvi
  URL::URL::URL Set Search.gvi
  URL::Location::Set Window Location.gvi
diagram:
  call "Get Window Location.gvi"(error in=$"error in") -> (url=w1, error out=w2)
  call "URL Get Parts.gvi"(url=w1, error in=w2) -> (url parts=w3, error out=w4)
  Property Node(instance in=w3) -> ("search"=w5)
  s1 = w4  # shift register
  s2 = w5  # shift register
  for {
    w6 = each element of $"search parameters"
    Property Node(instance in=w6) -> ("key"=w7, "value"=w8)
    call "Query String Set Value.gvi"(query string=s2, key=w7, value=w8, error in=s1) -> (updated query string=w9, error out=w10)
    next s1 = w10
    next s2 = w9
    stop if w10
  }
  call "URL Set Search.gvi"(url=w1, search=s2, error in=s1) -> (updated url=w11, error out=w12)
  call "Set Window Location.gvi"(url=w11, error in=w12, window location set action=$"window location set action") -> (error out=w13)
  $"error out" <- w13
