vi "Window Location Get Hash Parameter.gvi"   [LabVIEW NXG 5.1.0]
inputs:
  "error in": error
  "key": string, required
outputs:
  "value": string
  "exists": bool
  "error out": error
uses:
  URL::Location::Get Window Location.gvi
  URL::URL::URL Parameters::URL Get Hash Parameter.gvi
diagram:
  call "Get Window Location.gvi"(error in=$"error in") -> (url=w1, error out=w2)
  call "URL Get Hash Parameter.gvi"(url=w1, key=$key, error in=w2) -> (value=w3, exists=w4, error out=w5)
  $value <- w3
  $exists <- w4
  $"error out" <- w5
