vi "Window Location Set Search Parameter.gvi"   [LabVIEW NXG 5.1.0]
inputs:
  "error in": error
  "key": string, required
  "window location set action": "window location set action.gtype" = "set"
  "value": string, required
outputs:
  "error out": error
types:
  "window location set action.gtype" = enum{"set", "push", "replace"}
uses:
  URL::Location::Get Window Location.gvi
  URL::URL::URL Parameters::URL Set Search Parameter.gvi
  URL::Location::Set Window Location.gvi
diagram:
  call "Get Window Location.gvi"(error in=$"error in") -> (url=w1, error out=w2)
  call "URL Set Search Parameter.gvi"(url=w1, key=$key, value=$value, error in=w2) -> (updated url=w3, error out=w4)
  call "Set Window Location.gvi"(url=w3, error in=w4, window location set action=$"window location set action") -> (error out=w5)
  $"error out" <- w5
