vi "Parse URL Search Params.gvi"   [LabVIEW NXG 4.0.0]
inputs:
  "error in": error
  "search": string, required
outputs:
  "search params": cluster{"key": string, "value": string}[]
  "error out": error
uses:
  URL::Support::URL.jsli::ParseURLSearchParams
diagram:
  w1 = cluster{"key": string, "value": string}[] []  # search params
  call "ParseURLSearchParams"(search=$search, error in=$"error in") -> (partsJSON=w2, error out=w3)
  Unflatten From JSON(JSON string=w2, error in (no error)=w3, type and defaults=w1) -> (error out=w4, value=w5)
  $"search params" <- w5
  $"error out" <- w4
