vi "Parse URL.gvi"   [LabVIEW NXG 4.0.0]
inputs:
  "error in": error
  "url": string, required
  "base": string
outputs:
  "error out": error
  "url parts": "url parts.gtype"
types:
  "url parts.gtype" = cluster{"href": string, "origin": string, "protocol": string, "username": string, "password": string, "host": string, "hostname": string, "port": string, "pathname": string, "search": string, "hash": string}
uses:
  URL::Support::URL.jsli::ParseURL
diagram:
  call "ParseURL"(url=$url, base=$base, error in=$"error in") -> (partsJSON=w1, error out=w2)
  Unflatten From JSON(JSON string=w1, error in (no error)=w2, type and defaults="url parts.gtype" {all zero or empty}) -> (error out=w3, value=w4)
  $"url parts" <- w4
  $"error out" <- w3
