vi "Create Query String from Parts.gvi"   [LabVIEW NXG 5.1.0]
inputs:
  "error in": error
  "query string parts": "query string part.gtype"[], required
outputs:
  "query string": string
  "error out": error
types:
  "query string part.gtype" = cluster{"key": string, "value": string}
uses:
  URL::Support::URL.jsli::QueryStringFromParts
diagram:
  Flatten To Json(anything=$"query string parts", error in (no error)=$"error in") -> (JSON string=w1, error out=w2)
  call "QueryStringFromParts"(queryStringPartsJSON=w1, error in=w2) -> (queryString=w3, error out=w4)
  $"query string" <- w3
  $"error out" <- w4
