vi "Query String Get Parts.gvi"   [LabVIEW NXG 5.1.0]
inputs:
  "error in": error
  "trim hash": bool = TRUE
  "query string": string, required
outputs:
  "query string parts": "query string part.gtype"[]
  "error out": error
types:
  "query string part.gtype" = cluster{"key": string, "value": string}
uses:
  URL::Support::URL.jsli::QueryStringGetParts
diagram:
  call "QueryStringGetParts"(queryString=$"query string", trimHash=$"trim hash", error in=$"error in") -> (queryStringPartsJSON=w1, error out=w2)
  Unflatten From Json(JSON string=w1, error in (no error)=w2, type and defaults="query string part.gtype"[] []) -> (error out=w3, value=w4)
  $"query string parts" <- w4
  $"error out" <- w3
