vi "Query String Get Parameter.gvi"   [LabVIEW NXG 5.1.0]
inputs:
  "error in": error
  "query string": string, required
  "trim hash": bool = TRUE
  "key": string, required
outputs:
  "value": string
  "exists": bool
  "error out": error
uses:
  URL::Support::URL.jsli::QueryStringGetParameter
diagram:
  call "QueryStringGetParameter"(queryString=$"query string", trimHash=$"trim hash", key=$key, error in=$"error in") -> (resultJSON=w1, error out=w2)
  Unflatten From Json(JSON string=w1, error in (no error)=w2, type and defaults=cluster{"value": string, "exists": bool} {all zero or empty}) -> (error out=w3, value=w4)
  Property Node(instance in=w4) -> ("value"=w5, "exists"=w6)
  $value <- w5
  $exists <- w6
  $"error out" <- w3
