vi "Get Location Hash Parameter.gvi"   [LabVIEW NXG 5.1.0]
inputs:
  "error in": error
  "key": string, required
outputs:
  "value": string
  "exists": bool
  "error out": error
uses:
  URL::Location::Get Window Location.gvi
  URL::URL::URL Get Parts.gvi
  URL::Query String::Query String Get Value.gvi
diagram:
  call "Get Window Location.gvi"(error in=$"error in") -> (url=w1, error out=w2)
  call "URL Get Parts.gvi"(url=w1, error in=w2) -> (url parts=w3, error out=w4)
  Property Node(instance in=w3) -> ("hash"=w5)
  call "Query String Get Value.gvi"(query string=w5, key=$key, error in=w4) -> (value=w6, exists=w7, error out=w8)
  $value <- w6
  $exists <- w7
  $"error out" <- w8
