vi "Query String Get Parameter Array.gvi"   [LabVIEW NXG 5.1.0]
inputs:
  "error in": error
  "trim hash": bool = TRUE
  "query string": string, required
outputs:
  "query string parameter array": "query string parameter.gtype"[]
  "error out": error
types:
  "query string parameter.gtype" = cluster{"key": string, "value": string}
uses:
  URL::Support::URL.jsli::QueryStringGetParameters
diagram:
  call "QueryStringGetParameters"(queryString=$"query string", trimHash=$"trim hash", error in=$"error in") -> (queryStringParametersJSON=w1, error out=w2)
  Unflatten From Json(JSON string=w1, error in (no error)=w2, type and defaults="query string parameter.gtype"[] []) -> (error out=w3, value=w4)
  $"query string parameter array" <- w4
  $"error out" <- w3
