vi "Query String from Parameter Array.gvi"   [LabVIEW NXG 5.1.0]
inputs:
  "error in": error
  "query string parameter array": "query string parameter.gtype"[], required
outputs:
  "query string": string
  "error out": error
types:
  "query string parameter.gtype" = cluster{"key": string, "value": string}
uses:
  URL::Support::URL.jsli::QueryStringFromParameters
diagram:
  Flatten To Json(anything=$"query string parameter array", error in (no error)=$"error in") -> (JSON string=w1, error out=w2)
  call "QueryStringFromParameters"(queryStringParametersJSON=w1, error in=w2) -> (queryString=w3, error out=w4)
  $"query string" <- w3
  $"error out" <- w4
