vi "URL Get Hash Parameter.gvi"   [LabVIEW NXG 5.1.0]
inputs:
  "error in": error
  "key": string, required
  "url": string, required
outputs:
  "value": string
  "exists": bool
  "error out": error
uses:
  URL::URL::Advanced::URL Parts::URL Get Parts.gvi
  URL::URL::Advanced::Query String::Query String Get Parameter.gvi
diagram:
  call "URL Get Parts.gvi"(url=$url, error in=$"error in") -> (url parts=w1, error out=w2)
  Property Node(instance in=w1) -> ("hash"=w3)
  call "Query String Get Parameter.gvi"(query string=w3, key=$key, error in=w2) -> (value=w4, exists=w5, error out=w6)
  $value <- w4
  $exists <- w5
  $"error out" <- w6
