vi "URL Set Search Parameter.gvi"   [LabVIEW NXG 5.1.0]
inputs:
  "error in": error
  "key": string, required
  "url": string, required
  "value": string, required
outputs:
  "error out": error
  "updated url": string
uses:
  URL::URL::Advanced::URL Parts::URL Get Parts.gvi
  URL::URL::Advanced::Query String::Query String Set Parameter.gvi
  URL::URL::Advanced::URL Parts::URL Set Search.gvi
diagram:
  call "URL Get Parts.gvi"(url=$url, error in=$"error in") -> (url parts=w1, error out=w2)
  Property Node(instance in=w1) -> ("search"=w3)
  call "Query String Set Parameter.gvi"(query string=w3, key=$key, value=$value, error in=w2) -> (updated query string=w4, error out=w5)
  call "URL Set Search.gvi"(url=$url, search=w4, error in=w5) -> (updated url=w6, error out=w7)
  $"updated url" <- w6
  $"error out" <- w7
