vi "Window Location Add Event Listener.gvi"   [G Web Development Software 22.3.0]
# Create listener for changes to the current page URL.
inputs:
  "error in": error
outputs:
  "window location event listener configuration": "window location event listener configuration.gtype"
  "window location change user event": "event window location change"
  "error out": error
types:
  "window location event listener configuration.gtype" = cluster{"event stream reader": "NI.JavaScriptReference", "window location change user event": "event window location change"}
  "window location event data.gtype" = cluster{"url": string}
uses:
  URL::Support::URL.jsli::WindowLocationAddEventListener
diagram:
  call "WindowLocationAddEventListener"(error in=$"error in") -> (eventStreamReader=w1, error out=w2)
  Create User Event[EventName="window location change"](error in=w2, user event data type="window location event data.gtype" {all zero or empty}) -> (error out=w3, user event out=w4)  # Create User Event: window location change
  w5 = "window location event listener configuration.gtype" {all zero or empty}  # window location event listener configuration
  Property Node(instance in=w5, "event stream reader"=w1, "window location change user event"=w4) -> (instance out=w6)
  $"window location event listener configuration" <- w6
  $"window location change user event" <- w4
  $"error out" <- w3
