vi "Window Location Listen for Events.gvi"   [G Web Development Software 22.3.0]
# Wait for and emit events for changes to the current page URL.
inputs:
  "error in": error
  "window location event listener configuration": "window location event listener configuration.gtype", required
outputs:
  "error out": error
types:
  "window location event listener configuration.gtype" = cluster{"event stream reader": "NI.JavaScriptReference", "window location change user event": "event window location change"}
  "window location event data.gtype" = cluster{"url": string}
uses:
  URL::Support::URL.jsli::WindowLocationListenForEvents
diagram:
  # This VI must be reentrant
  Property Node(instance in=$"window location event listener configuration") -> ("window location change user event"=w1, "event stream reader"=w2)
  s1 = $"error in"  # shift register
  while {
    call "WindowLocationListenForEvents"(eventStreamReader=w2, error in=s1) -> (resultJSON=w3, error out=w4)
    Unflatten From Json(JSON string=w3, error in (no error)=w4, type and defaults=cluster{"done": bool, "value": string} {all zero or empty}) -> (error out=w5, value=w6)
    Property Node(instance in=w6) -> ("value"=w7, "done"=w8)
    case (w8) {
      frame True {
        w9 = w8
        w10 = w5
      }
      frame False {
        Property Node(instance in="window location event data.gtype" {all zero or empty}, "url"=w7) -> (instance out=w11)
        Generate User Event(error in=w5, event data=w11, user event=w1) -> (error out=w10)
        w9 = w8
      }
    }
    Logical Or(w10, w9) -> w12
    next s1 = w10
    stop if w12
  }
  $"error out" <- s1
