vi "Window Location Remove Event Listener.gvi"   [G Web Development Software 22.3.0]
# Stop listening for page URL change events for the given event listener.
inputs:
  "error in": error
  "window location event listener configuration": "window location event listener configuration.gtype", required
outputs:
  "error out": error
types:
  "window location event listener configuration.gtype" = cluster{"event stream reader": "NI.JavaScriptReference", "window location change user event": "event window location change"}
uses:
  URL::Support::URL.jsli::WindowLocationRemoveEventListener
diagram:
  Property Node(instance in=$"window location event listener configuration") -> ("window location change user event"=w1, "event stream reader"=w2)
  # JSLI node should not have error in to make sure and clean-up resources
  call "WindowLocationRemoveEventListener"(eventStreamReader=w2) -> (error out=w3)
  Close Reference(error in=w3, reference=w2) -> (error out=w4)
  Destroy User Event(error in=w4, user event=w1) -> (error out=w5)
  Merge Errors($"error in", w5) -> (error out=w6)
  $"error out" <- w6
