vi "Window Location Get Hash Parameter.gvi"   [G Web Development Software 22.3.0]
# Read a hash parameter from the current page URL using the window location object.
inputs:
  "error in": error
  "key": string, required
  "top level?": bool
outputs:
  "value": string
  "exists": bool
  "error out": error
uses:
  URL::Window Location::Window Location Get.gvi
  URL::URL::URL Parameters::URL Get Hash Parameter.gvi
diagram:
  call "Window Location Get.gvi"(top level?=$"top level?", error in=$"error in") -> (url=w1, error out=w2)
  call "URL Get Hash Parameter.gvi"(url=w1, key=$key, error in=w2) -> (value=w3, exists=w4, error out=w5)
  $value <- w3
  $exists <- w4
  $"error out" <- w5
