vi "Window Location Set.gvi"   [G Web Development Software 22.3.0]
# Set the current page URL using the window location object.
# Action-specific behavior:
# set (default):
# 	Pushes a new history item onto the history stack and updates url bar.
# 	Causes the browser to reload / navigate to the new URL.
# 		Note: If just the hash is changed in the new URL then the page will not reload but a Location Event will still trigger.
# 	Triggers a Location Event.
# push:
# 	Pushes a new history item onto the history stack and updates url bar.
# 	Browser does not reload / navigate to the new URL.
# 	Does not trigger a Location Event.
# replace:
# 	Replaces the current history item on the history stack and updates url bar.
# 	Browser does not reload / navigate to the new URL.
# 	Does not trigger a Location Event.
inputs:
  "error in": error
  "url": string, required
  "window location set action": "window location set action.gtype" = "set"
  "top level?": bool
outputs:
  "error out": error
types:
  "window location set action.gtype" = enum{"set", "push", "replace"}
uses:
  URL::Support::URL.jsli::WindowLocationSet
diagram:
  Format Into String(errIn=$"error in", $"window location set action") -> (outString=w1, errOut=w2)
  call "WindowLocationSet"(action=w1, url=$url, topLevel=$"top level?", error in=w2) -> (error out=w3)
  $"error out" <- w3
