vi "Join with path segment.gvi"   [LabVIEW NXG 5.1.0]
inputs:
  "path parts": string[]
outputs:
  "pathname": string
diagram:
  s1 = ""  # shift register
  for (N -> w1) (iteration -> i1) {
    w2 = each element of $"path parts"
    Decrement(x=w1) -> w3
    Is Less(x=i1, y=w3) -> w4
    w5 = "/"  # path segment
    Select(s=w4, t=w5, f="") -> w6
    Concatenate Strings(s1, w2, w6) -> w7
    next s1 = w7
  }
  $pathname <- s1
