vi "Split by path segment.gvi"   [LabVIEW NXG 5.1.0]
inputs:
  "pathname": string
outputs:
  "path parts": string[]
diagram:
  Is Equal(x="", y=$pathname) -> w1
  case (w1) {
    frame True {
      w2 = string[] []
    }
    frame False {
      s1 = $pathname  # shift register
      while {
        w3 = "/"  # path segment
        Search Or Split String(search string/char=w3, string=s1) -> (match + rest of string=w4, offset of match=w5, substring before match=w6)
        String Length(string=w3) -> (length=w7)
        String Subset(offset (0)=w7, string=w4) -> w8
        Is Less Than 0(x=w5) -> w9
        append w6 to w2
        next s1 = w8
        stop if w9
      }
    }
  }
  $"path parts" <- w2
