vi "index.gviweb"   [LabVIEW NXG 4.0.0]
panel controls:
  "navigate": bool
panel indicators:
  "window location": string
  "relative url": T1
  "current url": T1
  "search": string
  "search params": cluster{"key": string, "value": string}[]
types:
  T1 = cluster{"href": string, "origin": string, "protocol": string, "username": string, "password": string, "host": string, "hostname": string, "port": string, "pathname": string, "search": string, "hash": string}
uses:
  URL::Get Window Location.gvi
  URL::Parse URL.gvi
  URL::Parse URL Search Params.gvi
  URL::Set Window Location.gvi
diagram:
  call "Get Window Location.gvi"() -> (url=w1)
  $"window location" <- w1
  call "Parse URL.gvi"(url=w1) -> (url parts=w2)
  Property Node(instance in=w2) -> ("search"=w3)
  $search <- w3
  $"current url" <- w2
  call "Parse URL Search Params.gvi"(search=w3) -> (search params=w4)
  $"search params" <- w4
  w5 = "../"  # relative url
  call "Parse URL.gvi"(url=w5, base=w1) -> (url parts=w6)
  $"relative url" <- w6
  while {
    event {
      on "navigate" Value changed {
        call "Set Window Location.gvi"(url="https://www.ni.com")
      }
    }
    stop if FALSE
  }
