vi "index.gviweb"   [LabVIEW NXG 5.1.0]
panel controls:
  "Enter name to share with page": string = "Nigel 🦅"
  "hash": bool
  "search": bool
uses:
  URL::URL::URL Build Relative Path.gvi
  URL::URL::URL Parameters::URL Set Hash Parameter.gvi
  URL::Window Location::Window Location Set.gvi
  WebApp::Support::Show Error Dialog.gvi
  URL::URL::URL Parameters::URL Set Search Parameter.gvi
diagram:
  while {
    event {
      on "hash" Value changed {
        call "URL Build Relative Path.gvi"(relative url="hash.html") -> (url=w1, error out=w2)
        call "URL Set Hash Parameter.gvi"(url=w1, key="data", value=$"Enter name to share with page", error in=w2) -> (updated url=w3, error out=w4)
        call "Window Location Set.gvi"(url=w3, error in=w4) -> (error out=w5)
        call "Show Error Dialog.gvi"(error in=w5)
      }
      on "search" Value changed {
        call "URL Build Relative Path.gvi"(relative url="search.html") -> (url=w6, error out=w7)
        call "URL Set Search Parameter.gvi"(url=w6, key="data", value=$"Enter name to share with page", error in=w7) -> (updated url=w8, error out=w9)
        call "Window Location Set.gvi"(url=w8, error in=w9) -> (error out=w10)
        call "Show Error Dialog.gvi"(error in=w10)
      }
    }
    stop if FALSE
  }
