vi "search.gviweb"   [LabVIEW NXG 5.1.0]
panel indicators:
  "data search parameter": string
uses:
  URL::Window Location::Window Location Parameters::Window Location Get Search Parameter.gvi
  WebApp::Support::Show Error Dialog.gvi
diagram:
  call "Window Location Get Search Parameter.gvi"(key="data") -> (value=w1, exists=w2, error out=w3)
  Select(s=w2, t=w1, f="data parameter missing") -> w4
  $"data search parameter" <- w4
  call "Show Error Dialog.gvi"(error in=w3)
