vi "index.gviweb"   [LabVIEW NXG 5.1.0]
panel controls:
  "main": bool
  "info": bool
panel indicators:
  "views": i32
types:
  "query string part.gtype" = cluster{"key": string, "value": string}
uses:
  URL::Location::Location Event::Add Location Event Listener.gvi
  URL::Location::Location Event::Listen For Location Events.gvi
  WebApp::Support::Show Error Dialog.gvi
  URL::Location::Parameters::Set Window Location Hash Parameters.gvi
  URL::URL::URL Get Parts.gvi
  URL::Query String::Query String Get Value.gvi
  URL::Location::Parameters::Get Window Location Hash Parameter.gvi
diagram:
  call "Add Location Event Listener.gvi"() -> (window location change user event=w1, error out=w2, location event listener configuration=w3)
  call "Listen For Location Events.gvi"(location event listener configuration=w3, error in=w2) -> (error out=w4)
  call "Show Error Dialog.gvi"(error in=w4)
  Register For Events("window location change"=w1, error in=w2) -> (error out=w5, event registration refnum out=w6)
  while {
    event (dynamic events = w6) {
      on "main" Value changed {
        Format Into String("main") -> (outString=w7, errOut=w8)
        Property Node(instance in="query string part.gtype" {"key"="page", "value"=""}, "value"=w7) -> (instance out=w9)
        Build Array(w9) -> w10
        call "Set Window Location Hash Parameters.gvi"(hash parameters=w10, error in=w8) -> (error out=w11)
        call "Show Error Dialog.gvi"(error in=w11)
      }
      on "info" Value changed {
        Format Into String("info") -> (outString=w12, errOut=w13)
        Property Node(instance in="query string part.gtype" {"key"="page", "value"=""}, "value"=w12) -> (instance out=w14)
        Build Array(w14) -> w15
        call "Set Window Location Hash Parameters.gvi"(hash parameters=w15, error in=w13) -> (error out=w16)
        call "Show Error Dialog.gvi"(error in=w16)
      }
      on dynamic event 0 {
        Event Data() -> ("event data"=w17)
        call "URL Get Parts.gvi"(url=w17) -> (url parts=w18, error out=w19)
        Property Node(instance in=w18) -> ("hash"=w20)
        call "Query String Get Value.gvi"(query string=w20, key="page", error in=w19) -> (value=w21, error out=w22)
        Scan From String(inputString=w21, errIn=w22, default="main") -> (errOut=w23, out0=w24)
        Select(s=w23, t="main", f=w24) -> w25
        $views <- w25
      }
    }
    stop if FALSE
  }
  call "Show Error Dialog.gvi"(error in=w5)
  # Read the initial page parameter and update the view
  call "Get Window Location Hash Parameter.gvi"(key="page") -> (value=w26, error out=w27)
  Scan From String(inputString=w26, errIn=w27, default="main") -> (errOut=w28, out0=w29)
  Select(s=w28, t="main", f=w29) -> w30
  $views <- w30
