vi "search.gviweb"   [LabVIEW NXG 5.1.0]
panel controls:
  "main": bool
  "info": bool
panel indicators:
  "views": i32
uses:
  URL::Window Location::Location Event::Window Location Add Event Listener.gvi
  URL::Window Location::Location Event::Window Location Listen for Events.gvi
  WebApp::Support::Show Error Dialog.gvi
  URL::Window Location::Window Location Parameters::Window Location Set Search Parameter.gvi
  URL::Window Location::Window Location Parameters::Window Location Get Search Parameter.gvi
diagram:
  call "Window Location Add Event Listener.gvi"() -> (window location change user event=w1, error out=w2, window location event listener configuration=w3)
  call "Window Location Listen for Events.gvi"(window location event listener configuration=w3, error in=w2) -> (error out=w4)
  call "Show Error Dialog.gvi"(error in=w4)
  Register For Events("window location change"=w1, error in=w2) -> (error out=w5, event registration refnum out=w6)
  while {
    event (dynamic events = w6) {
      on "main" Value changed {
        Format Into String("main") -> (outString=w7, errOut=w8)
        call "Window Location Set Search Parameter.gvi"(key="page", value=w7, error in=w8, window location set action="push") -> (error out=w9)
        call "Show Error Dialog.gvi"(error in=w9)
        $views <- "main"
      }
      on "info" Value changed {
        Format Into String("info") -> (outString=w10, errOut=w11)
        call "Window Location Set Search Parameter.gvi"(key="page", value=w10, error in=w11, window location set action="push") -> (error out=w12)
        call "Show Error Dialog.gvi"(error in=w12)
        $views <- "info"
      }
      on dynamic event 0 {
        call "Window Location Get Search Parameter.gvi"(key="page") -> (value=w13, error out=w14)
        Scan From String(inputString=w13, errIn=w14, default="main") -> (errOut=w15, out0=w16)
        Select(s=w15, t="main", f=w16) -> w17
        $views <- w17
      }
    }
    stop if FALSE
  }
  call "Show Error Dialog.gvi"(error in=w5)
  # Read the initial page parameter and update the view
  call "Window Location Get Search Parameter.gvi"(key="page") -> (value=w18, error out=w19)
  Scan From String(inputString=w18, errIn=w19, default="main") -> (errOut=w20, out0=w21)
  Select(s=w20, t="main", f=w21) -> w22
  $views <- w22
