vi "Read File Binary.gvi"   [LabVIEW NXG 3.1.0]
inputs:
  "allowed file types": string[]
  "error in": error
outputs:
  "error out": error
  "file contents": u8[]
uses:
  Uppy::Create Uppy.gvi
  Uppy::Set Uppy Core Options.gvi
  Uppy::Set Uppy Dashboard Options.gvi
  Uppy::Request Files.gvi
  FileApi::Read File.gvi
  FileApi::Close File.gvi
  Uppy::Destroy Uppy.gvi
diagram:
  call "Create Uppy.gvi"(error in=$"error in") -> (uppy reference=w1, error out=w2)
  call "Set Uppy Core Options.gvi"(uppy reference in=w1, error in=w2, max number of files=1, allowed file types=$"allowed file types") -> (uppy reference out=w3, error out=w4)
  call "Set Uppy Dashboard Options.gvi"(uppy reference in=w3, error in=w4, show uppy icon?=FALSE) -> (uppy reference out=w5, error out=w6)
  call "Request Files.gvi"(uppy reference in=w5, error in=w6) -> (uppy reference out=w7, file references=w8, error out=w9)
  Array Index(array=w8) -> (out0[_]=w10)
  call "Read File.gvi"(uppy file reference in=w10, error in=w9) -> (file contents=w11, error out=w12)
  for {
    w13 = each element of w8
    call "Close File.gvi"(uppy file reference=w13, error in=w12) -> (error out=w14)
  }
  call "Destroy Uppy.gvi"(uppy reference=w7, error in=w14) -> (error out=w15)
  $"error out" <- w15
  $"file contents" <- w11
