vi "Download File Binary.gvi"   [LabVIEW NXG 3.1.0]
inputs:
  "file contents": u8[], required
  "file name": string, required
  "content type": string
  "error in": error
outputs:
  "error out": error
uses:
  Uppy::Uppy Advanced File::Create Uppy File.gvi
  Uppy::Uppy Advanced File::Download Uppy File.gvi
  Uppy::Uppy Advanced File::Destroy Uppy Files.gvi
diagram:
  call "Create Uppy File.gvi"(file contents=$"file contents", content type=$"content type", error in=$"error in") -> (uppy file reference=w1, error out=w2)
  call "Download Uppy File.gvi"(uppy file reference in=w1, file name=$"file name", error in=w2) -> (uppy file reference out=w3, error out=w4)
  Build Array(w3) -> w5
  call "Destroy Uppy Files.gvi"(uppy file references=w5, error in=w4) -> (error out=w6)
  $"error out" <- w6
