vi "Download File Text.gvi"   [LabVIEW NXG 3.1.0]
inputs:
  "error in": error
  "file contents": string, required
  "file name": string, required
  "content type": string
outputs:
  "error out": error
uses:
  Uppy::Uppy Advanced File::Create Uppy File.gvi
  Uppy::Uppy Advanced File::Download Uppy File.gvi
  Uppy::Uppy Advanced File::Destroy Uppy Files.gvi
diagram:
  String To Byte Array(error in (no error)=$"error in", string=$"file contents") -> (error out=w1, unsigned byte array=w2)
  call "Create Uppy File.gvi"(file contents=w2, content type=$"content type", error in=w1) -> (uppy file reference=w3, error out=w4)
  call "Download Uppy File.gvi"(uppy file reference in=w3, file name=$"file name", error in=w4) -> (uppy file reference out=w5, error out=w6)
  Build Array(w5) -> w7
  call "Destroy Uppy Files.gvi"(uppy file references=w7, error in=w6) -> (error out=w8)
  $"error out" <- w8
