vi "Read File Binary.gvi"   [LabVIEW NXG 3.1.0]
inputs:
  "allowed file types": string[]
  "error in": error
outputs:
  "error out": error
  "file contents": u8[]
uses:
  Uppy::Uppy Advanced::Create Uppy.gvi
  Uppy::Uppy Advanced::Set Uppy Core Options.gvi
  Uppy::Uppy Advanced::Set Uppy Dashboard Options.gvi
  Uppy::Uppy Advanced::Request Uppy Files.gvi
  Uppy::Uppy Advanced File::Read Uppy File.gvi
  Uppy::Uppy Advanced File::Destroy Uppy Files.gvi
  Uppy::Uppy Advanced::Destroy Uppy.gvi
diagram:
  call "Create Uppy.gvi"(error in=$"error in") -> (uppy reference=w1, error out=w2)
  call "Set Uppy Core Options.gvi"(uppy reference in=w1, error in=w2, max number of files=1, allowed file types=$"allowed file types") -> (uppy reference out=w3, error out=w4)
  call "Set Uppy Dashboard Options.gvi"(uppy reference in=w3, error in=w4, show uppy icon?=FALSE) -> (uppy reference out=w5, error out=w6)
  call "Request Uppy Files.gvi"(uppy reference in=w5, error in=w6) -> (uppy reference out=w7, uppy file references=w8, error out=w9)
  Array Index(array=w8) -> (out0[_]=w10)
  call "Read Uppy File.gvi"(uppy file reference in=w10, error in=w9) -> (file contents=w11, error out=w12)
  call "Destroy Uppy Files.gvi"(uppy file references=w8, error in=w12) -> (error out=w13)
  call "Destroy Uppy.gvi"(uppy reference=w7, error in=w13) -> (error out=w14)
  $"error out" <- w14
  $"file contents" <- w11
