vi "Request Files.gvi"   [LabVIEW NXG 3.1.0]
inputs:
  "error in": error
  "uppy reference in": "uppy reference.gtype", required
outputs:
  "file references": "file reference.gtype"[]
  "error out": error
  "uppy reference out": "uppy reference.gtype"
types:
  "uppy reference.gtype" = i32
  "file reference.gtype" = string
uses:
  Uppy::Support::Uppy.jsli::RequestFiles
diagram:
  $"uppy reference out" <- $"uppy reference in"
  call "RequestFiles"(uppyReference=$"uppy reference in", error in=$"error in") -> (fileObjectUrlsJSON=w1, error out=w2)
  Unflatten From JSON(JSON string=w1, type and defaults=string[] []) -> (value=w3)
  $"file references" <- w3
  $"error out" <- w2
