vi "Set Uppy Core Options.gvi"   [LabVIEW NXG 3.1.0]
inputs:
  "uppy reference in": "uppy reference.gtype", required
  "error in": error
  "max file size": i32 = -1
  "max number of files": i32 = -1
  "allowed file types": string[]  # array of wildcards image/*, exact mime types image/jpeg, or file extensions .jpg Examples: image/* .jpg .jpeg .png .gif
outputs:
  "error out": error
  "uppy reference out": "uppy reference.gtype"
types:
  "uppy reference.gtype" = i32
  T1 = cluster{"restrictions": cluster{"maxFileSize": i32}}
  T2 = cluster{"restrictions": cluster{"maxNumberOfFiles": i32}}
  T3 = cluster{"restrictions": cluster{"allowedFileTypes": string[]}}
uses:
  Uppy::Support::Uppy.jsli::SetUppyOptions
diagram:
  # Find more options at https://uppy.io/docs/uppy/#Options
  # The restrictions.minNumberOfFiles property is not useful untill https://github.com/transloadit/uppy/issues/1545 is fixed
  # The autoProceed property should be avoided because it causes a console.error message to occur
  $"uppy reference out" <- $"uppy reference in"
  Is Not Equal(x=$"max file size", y=-1) -> w1
  case (w1) {
    frame False, Default {
      w2 = $"error in"
      w3 = $"uppy reference in"
    }
    frame True {
      Property Node(instance in=cluster{"core": T1} {all zero or empty}, "core:restrictions:maxFileSize"=$"max file size") -> (instance out=w4)
      Flatten To JSON(anything=w4) -> (JSON string=w5)
      call "SetUppyOptions"(uppy reference=$"uppy reference in", optionsJSON=w5, error in=$"error in") -> (error out=w2)
      w3 = $"uppy reference in"
    }
  }
  Is Not Equal(x=$"max number of files", y=-1) -> w6
  case (w6) {
    frame False, Default {
      w7 = w2
      w8 = w3
    }
    frame True {
      Property Node(instance in=cluster{"core": T2} {all zero or empty}, "core:restrictions:maxNumberOfFiles"=$"max number of files") -> (instance out=w9)
      Flatten To JSON(anything=w9) -> (JSON string=w10)
      call "SetUppyOptions"(uppy reference=w3, optionsJSON=w10, error in=w2) -> (error out=w7)
      w8 = w3
    }
  }
  Array Size(array=$"allowed file types") -> (size(s)=w11)
  Is Not Equal To 0(x=w11) -> w12
  case (w12) {
    frame False, Default {
      w13 = w7
    }
    frame True {
      Property Node(instance in=cluster{"core": T3} {all zero or empty}, "core:restrictions:allowedFileTypes"=$"allowed file types") -> (instance out=w14)
      Flatten To JSON(anything=w14) -> (JSON string=w15)
      call "SetUppyOptions"(uppy reference=w8, optionsJSON=w15, error in=w7) -> (error out=w13)
    }
  }
  $"error out" <- w13
