vi "Set Uppy Dashboard Options.gvi"   [LabVIEW NXG 3.1.0]
inputs:
  "uppy reference in": "uppy reference.gtype", required
  "error in": error
  "show uppy icon?": bool = TRUE
outputs:
  "error out": error
  "uppy reference out": "uppy reference.gtype"
types:
  "uppy reference.gtype" = i32
  T1 = cluster{"uploadXFiles": cluster{"0": string, "1": string}}
  T2 = cluster{"locale": cluster{"strings": T1}, "proudlyDisplayPoweredByUppy": bool}
uses:
  Uppy::Support::Uppy.jsli::SetUppyOptions
diagram:
  $"uppy reference out" <- $"uppy reference in"
  # Find more options at https://uppy.io/docs/dashboard/
  w1 = cluster{"dashboard": T2} {"dashboard"={"locale"={"strings"={"uploadXFiles"={"0"="Open %{smart_count} file", "1"="Open %{smart_count} files"}}}, "proudlyDisplayPoweredByUppy"=TRUE}}
  Property Node(instance in=w1, "dashboard:proudlyDisplayPoweredByUppy"=$"show uppy icon?") -> (instance out=w2)
  Flatten To JSON(anything=w2) -> (JSON string=w3)
  call "SetUppyOptions"(uppy reference=$"uppy reference in", optionsJSON=w3, error in=$"error in") -> (error out=w4)
  $"error out" <- w4
