vi "Set Uppy Webcam Options.gvi"   [LabVIEW NXG 3.1.0]
inputs:
  "uppy reference in": "uppy reference.gtype", required
  "error in": error
  "countdown": bool
  "mirror": bool
outputs:
  "uppy reference out": "uppy reference.gtype"
  "error out": error
types:
  "uppy reference.gtype" = i32
  T1 = cluster{"webcam": cluster{"countdown": bool, "mirror": bool}}
uses:
  Uppy::Support::Uppy.jsli::SetUppyOptions
diagram:
  $"uppy reference out" <- $"uppy reference in"
  # Find more options at https://uppy.io/docs/webcam/
  Property Node(instance in=T1 {FALSE, TRUE}, "webcam:countdown"=$countdown, "webcam:mirror"=$mirror) -> (instance out=w1)
  Flatten To JSON(anything=w1) -> (JSON string=w2)
  call "SetUppyOptions"(uppy reference=$"uppy reference in", optionsJSON=w2, error in=$"error in") -> (error out=w3)
  $"error out" <- w3
