vi "Destroy Uppy Files.gvi"   [LabVIEW NXG 3.1.0]
inputs:
  "uppy file refnums": "uppy file refnum.gtype"[], required
  "error in": error
outputs:
  "error out": error
types:
  "uppy file refnum.gtype" = i32
uses:
  Uppy::Support::Uppy.jsli::DestroyUppyFiles
diagram:
  call "DestroyUppyFiles"(uppy file refnums=$"uppy file refnums") -> (error out=w1)
  Merge Errors($"error in", w1) -> (error out=w2)
  $"error out" <- w2
