vi "Destroy Uppy.gvi"   [LabVIEW NXG 3.1.0]
inputs:
  "uppy refnum": "uppy refnum.gtype", required
  "error in": error
outputs:
  "error out": error
types:
  "uppy refnum.gtype" = i32
uses:
  Uppy::Support::Uppy.jsli::DestroyUppy
diagram:
  call "DestroyUppy"(uppy refnum=$"uppy refnum") -> (error out=w1)
  Merge Errors($"error in", w1) -> (error out=w2)
  $"error out" <- w2
