vi "Set Uppy Core Options.gvi"   [LabVIEW NXG 3.1.0]
inputs:
  "uppy reference in": "uppy reference.gtype", required
  "error in": error
  "max file size": i32 = -1
  "max number of files": i32 = -1
  "allowed file types": string[]  # array of wildcards image/*, exact mime types image/jpeg, or file extensions .jpg Examples: image/* .jpg .jpeg .png .gif
outputs:
  "error out": error
  "uppy reference out": "uppy reference.gtype"
types:
  "uppy reference.gtype" = i32
  T1 = cluster{"maxFileSize": i32, "maxNumberOfFiles": i32, "allowedFileTypes": string[]}
uses:
  Uppy::Support::Uppy.jsli::SetUppyOptions
diagram:
  $"uppy reference out" <- $"uppy reference in"
  # Find more options at https://uppy.io/docs/uppy/#Options
  # The restrictions.minNumberOfFiles property is not useful untill https://github.com/transloadit/uppy/issues/1545 is fixed
  # The autoProceed property should be avoided because it causes a console.error message to occur
  Property Node(instance in=cluster{"restrictions": T1} {all zero or empty}, "restrictions:maxFileSize"=$"max file size", "restrictions:maxNumberOfFiles"=$"max number of files", "restrictions:allowedFileTypes"=$"allowed file types") -> (instance out=w1)
  Flatten To JSON(anything=w1) -> (JSON string=w2)
  call "SetUppyOptions"(uppy reference=$"uppy reference in", name="core", optionsJSON=w2, error in=$"error in") -> (error out=w3)
  $"error out" <- w3
