vi "Set Uppy Webcam Options.gvi"   [LabVIEW NXG 3.1.0]
inputs:
  "uppy refnum in": "uppy refnum.gtype", required
  "error in": error
  "countdown": bool
  "mirror": bool
outputs:
  "uppy refnum out": "uppy refnum.gtype"
  "error out": error
types:
  "uppy refnum.gtype" = i32
uses:
  Uppy::Support::Uppy.jsli::SetUppyOptions
diagram:
  $"uppy refnum out" <- $"uppy refnum in"
  # Find more options at https://uppy.io/docs/webcam/
  w1 = cluster{"countdown": bool, "mirror": bool} {"countdown"=FALSE, "mirror"=TRUE}
  Property Node(instance in=w1, "countdown"=$countdown, "mirror"=$mirror) -> (instance out=w2)
  Flatten To JSON(anything=w2) -> (JSON string=w3)
  call "SetUppyOptions"(uppy refnum=$"uppy refnum in", name="webcam", optionsJSON=w3, error in=$"error in") -> (error out=w4)
  $"error out" <- w4
