vi "index.gviweb"   [LabVIEW NXG 3.1.0]
panel controls:
  "Button": bool
panel indicators:
  "error out": error
  "Array Constant": u8[]
  "URL Image": string
  "Hyperlink Control": string
uses:
  Uppy::Uppy Advanced::Create Uppy.gvi
  Uppy::Uppy Advanced::Set Uppy Core Options.gvi
  Uppy::Uppy Advanced::Set Uppy Dashboard Options.gvi
  Uppy::Uppy Advanced::Set Uppy Webcam Options.gvi
  Uppy::Uppy Advanced::Request Uppy Files.gvi
  Uppy::Uppy File::Get Uppy File Url.gvi
  Uppy::Uppy File::Download Uppy File.gvi
  Uppy::Uppy File::Read Uppy File.gvi
  Uppy::Uppy File::Destroy Uppy Files.gvi
  Uppy::Uppy Advanced::Destroy Uppy.gvi
diagram:
  while {
    event {
      on "Button" Value changed {
        call "Create Uppy.gvi"() -> (uppy reference=w2, error out=w3)
        call "Set Uppy Core Options.gvi"(uppy reference in=w2, error in=w3, max number of files=1, allowed file types=["image/*"]) -> (uppy reference out=w4, error out=w5)
        call "Set Uppy Dashboard Options.gvi"(uppy reference in=w4, error in=w5, show uppy icon?=FALSE) -> (uppy reference out=w6, error out=w7)
        call "Set Uppy Webcam Options.gvi"(uppy reference in=w6, error in=w7) -> (uppy reference out=w8, error out=w9)
        call "Request Uppy Files.gvi"(uppy reference in=w8, error in=w9) -> (uppy reference out=w10, uppy file references=w11, error out=w12)
        disable {
          frame Enabled {
            Array Index(array=w11) -> (out0[_]=w14)
            call "Get Uppy File Url.gvi"(uppy file reference in=w14, error in=w12) -> (uppy file url=w15, error out=w13)
            $"URL Image" <- w15
            $"Hyperlink Control" <- w15
            call "Download Uppy File.gvi"(uppy file reference in=w14, file name="hello.jpg")
          }
          frame Disabled {
            s1 = w12  # shift register
            for {
              w16 = each element of w11
              call "Read Uppy File.gvi"(uppy file reference in=w16, error in=s1) -> (uppy file reference out=w18, file contents=w19, error out=w20)
              $"Array Constant" <- w19
              append w18 to w17
              next s1 = w20
              stop if w20
            }
            call "Destroy Uppy Files.gvi"(uppy file references=w17, error in=s1) -> (error out=w13)
          }
        }
        call "Destroy Uppy.gvi"(uppy reference=w10, error in=w13) -> (error out=w1)
      }
    }
    stop if w1
  }
  $"error out" <- w1
