vi "Create Video Element.gvi"   [G Web Development Software 22.3.0]
inputs:
  "placeholder html container reference": "HtmlContainer reference", required
  "error in": error
  "source url": string, required
outputs:
  "error out": error
  "video element reference": "video element reference.gtype"
types:
  "video element reference.gtype" = "NI.JavaScriptReference"
uses:
  VideoElement::Support::VideoElement.jsli::Create
diagram:
  Obtain JavaScript Reference(reference in=$"placeholder html container reference", error in=$"error in") -> (error out=w1, javascript reference out=w2)
  call "Create"(placeholder=w2, source=$"source url", error in=w1) -> (videoElement=w3, error out=w4)
  $"video element reference" <- w3
  Close Reference(error in=w4, reference=w2) -> (error out=w5)
  $"error out" <- w5
