vi "Destroy Video Element.gvi"   [G Web Development Software 22.3.0]
inputs:
  "error in": error
  "video element reference": "video element reference.gtype", required
outputs:
  "error out": error
types:
  "video element reference.gtype" = "NI.JavaScriptReference"
uses:
  VideoElement::Support::VideoElement.jsli::Destroy
diagram:
  call "Destroy"(videoElement=$"video element reference") -> (error out=w1)
  Merge Errors($"error in", w1) -> (error out=w2)
  Close Reference(error in=w2, reference=$"video element reference") -> (error out=w3)
  $"error out" <- w3
