vi "Remove Video Event Listener.gvi"   [G Web Development Software 22.3.0]
inputs:
  "error in": error
  "video event stream reference": "video event stream reference.gtype", required
outputs:
  "error out": error
types:
  "video event stream reference.gtype" = "NI.JavaScriptReference"
uses:
  VideoElement::Support::VideoElement.jsli::RemoveEventListener
diagram:
  call "RemoveEventListener"(eventStreamReader=$"video event stream reference") -> (error out=w1)
  Merge Errors($"error in", w1) -> (error out=w2)
  Close Reference(error in=w2, reference=$"video event stream reference") -> (error out=w3)
  $"error out" <- w3
