vi "index.gviweb"   [G Web Development Software 22.3.0]
panel controls:
  "Stop": bool
panel indicators:
  "current time": f64
  "loop iteration": i32
uses:
  VideoElement::Create Video Element.gvi
  VideoElement::Events::Add Video Event Listener.gvi
  VideoElement::Events::Wait for Video Event.gvi
  VideoElement::Events::Remove Video Event Listener.gvi
  VideoElement::Destroy Video Element.gvi
diagram:
  call "Create Video Element.gvi"(placeholder html container reference=reference to "Video", source url="iot-animation.webm") -> (video element reference=w1, error out=w2)
  call "Add Video Event Listener.gvi"(video element reference in=w1, error in=w2) -> (video event stream reference=w3, error out=w4)
  s1 = w4  # shift register
  while (iteration -> i1) {
    call "Wait for Video Event.gvi"(video event stream reference in=w3, error in=s1) -> (video event stream reference out=w5, current time=w6, error out=w7)
    $"current time" <- w6
    Logical Or(w7, $Stop) -> w8
    $"loop iteration" <- i1
    next s1 = w7
    stop if w8
  }
  call "Remove Video Event Listener.gvi"(video event stream reference=w5, error in=s1) -> (error out=w9)
  call "Destroy Video Element.gvi"(video element reference=w1, error in=w9)
