vi "Create VideoJS.gvi"   [LabVIEW NXG 5.0.0]
inputs:
  "error in": error
  "container reference": "HtmlContainer reference", required
outputs:
  "player reference": "player reference.gtype"
  "error out": error
types:
  "player reference.gtype" = "NI.JavaScriptReference"
uses:
  VideoJS::Support::VideoJS.jsli::Create
diagram:
  Obtain JavaScript Reference(reference in=$"container reference", error in=$"error in") -> (error out=w1, javascript reference out=w2)
  call "Create"(container=w2, error in=w1) -> (player=w3, error out=w4)
  $"player reference" <- w3
  Close Reference(error in=w4, reference=w2) -> (error out=w5)
  $"error out" <- w5
