vi "Destory VideoJS.gvi"   [LabVIEW NXG 5.0.0]
inputs:
  "error in": error
  "player reference": "player reference.gtype", required
outputs:
  "error out": error
types:
  "player reference.gtype" = "NI.JavaScriptReference"
uses:
  VideoJS::Support::VideoJS.jsli::Dispose
diagram:
  call "Dispose"(arg=$"player reference") -> (error out=w1)
  Close Reference(error in=w1, reference=$"player reference") -> (error out=w2)
  Merge Errors($"error in", w2) -> (error out=w3)
  $"error out" <- w3
