vi "Index.gviweb"   [LabVIEW NXG 5.0.0]
panel controls:
  "Stop": bool
uses:
  VideoJS::Create VideoJS.gvi
  VideoJS::Set Source.gvi
  VideoJS::Play.gvi
  VideoJS::Destory VideoJS.gvi
diagram:
  w1 = "https://edge02.hdontap.com/ingest02-hd2/falcon_utaustin.stream/playlist.m3u8"
  call "Create VideoJS.gvi"(container reference=reference to "video") -> (player reference=w2, error out=w3)
  call "Set Source.gvi"(player reference in=w2, source url=w1, error in=w3) -> (player reference out=w4, error out=w5)
  call "Play.gvi"(player reference in=w4, error in=w5) -> (player reference out=w6, error out=w7)
  event {
    on "Stop" Value changed {
      call "Destory VideoJS.gvi"(player reference=w6, error in=w7)
    }
  }
