vi "index.gviweb"   [LabVIEW NXG 5.0.0]
panel controls:
  "start": bool
  "win1": bool
  "win2": bool
  "lose1": bool
  "lose2": bool
  "achievment1": bool
  "achievment2": bool
panel indicators:
  "time": waveform<f32>
  "frequency": waveform<f32>
uses:
  WebAudio::AudioNodes::Create Media Stream Audio Source Node.gvi
  WebAudio::Analyser::Create Analyzer.gvi
  WebAudio::AudioContextState::Get Sample Rate.gvi
  WebAudio::Analyser::Get Analyser Frequency Data.gvi
  WebAudio::Analyser::Get Analyser Time Domain Data.gvi
  WebAudio::Buffers::Create Audio Buffer From URL.gvi
  WebAudio::AudioNodes::Get Audio Destination Node.gvi
  WebAudio::Buffers::Play Audio Buffer.gvi
diagram:
  event {
    on "start" Value changed {
      call "Create Media Stream Audio Source Node.gvi"() -> (audio node reference=w1, error out=w2)
    }
  }
  call "Create Analyzer.gvi"(audio node reference=w1, error in=w2) -> (analyser reference=w3, error out=w4)
  call "Get Sample Rate.gvi"(error in=w4) -> (sample rate=w5, error out=w6)
  s1 = w6  # shift register
  while {
    call "Get Analyser Frequency Data.gvi"(analyser reference=w3, error in=s1) -> (frequency data=w7, error out=w8)
    call "Get Analyser Time Domain Data.gvi"(analyser reference=w3, error in=w8) -> (time domain data=w9, error out=w10)
    Reciprocal(x=w5) -> w11
    Multiply(w11, 1000) -> w12
    Build Waveform Node(Y=w9, dt=w12) -> (output waveform=w13)
    $time <- w13
    To Double Precision Float(number=w5) -> w14
    Divide(x=w14, y=2) -> w15
    Array Size(array=w7) -> (size(s)=w16)
    To Double Precision Float(number=w16) -> w17
    Divide(x=w15, y=w17) -> w18
    Build Waveform Node(Y=w7, dt=w18) -> (output waveform=w19)
    $frequency <- w19
    Wait(time to wait=10)
    next s1 = w10
    stop if w10
  }
  Property Node(instance in=s1) -> ("source"=w20)
  One Button Dialog(message=w20)
  call "Create Audio Buffer From URL.gvi"(url="Support/270333__littlerobotsoundfactory__jingle-win-00.wav") -> (audio buffer reference=w21, error out=w22)
  call "Create Audio Buffer From URL.gvi"(url="Support/270319__littlerobotsoundfactory__jingle-win-01.wav") -> (audio buffer reference=w23, error out=w24)
  w25 = "Support/270329__littlerobotsoundfactory__jingle-lose-00.wav"
  call "Create Audio Buffer From URL.gvi"(url=w25) -> (audio buffer reference=w26, error out=w27)
  w28 = "Support/270334__littlerobotsoundfactory__jingle-lose-01.wav"
  call "Create Audio Buffer From URL.gvi"(url=w28) -> (audio buffer reference=w29, error out=w30)
  w31 = "Support/270331__littlerobotsoundfactory__jingle-achievement-00.wav"
  call "Create Audio Buffer From URL.gvi"(url=w31) -> (audio buffer reference=w32, error out=w33)
  w34 = "Support/270330__littlerobotsoundfactory__jingle-achievement-01.wav"
  call "Create Audio Buffer From URL.gvi"(url=w34) -> (audio buffer reference=w35, error out=w36)
  Build Array(w21, w23, w26, w29, w32, w35) -> w37
  Merge Errors(w22, w24, w27, w30, w33, w36) -> (error out=w38)
  call "Get Audio Destination Node.gvi"(error in=w38) -> (destination audio node reference=w39, error out=w40)
  s2 = w40  # shift register
  while {
    event {
      on "achievment1" Value changed; "achievment2" Value changed; "lose1" Value changed; "lose2" Value changed; "win1" Value changed; "win2" Value changed {
        Event Data() -> ("Index"=w42)
        Array Index(array=w37) -> (out0[w42]=w43)
        call "Play Audio Buffer.gvi"(audio buffer reference=w43, destination audio node reference=w39, error in=s2) -> (error out=w41)
      }
    }
    next s2 = w41
    stop if w41
  }
  Property Node(instance in=s2) -> ("source"=w44)
  One Button Dialog(message=w44)
