vi "Get Analyser Frequency Data.gvi"   [LabVIEW NXG 5.0.0]
inputs:
  "error in": error
  "analyser reference": "analyser reference.gtype", required
outputs:
  "frequency data": waveform<f64>
  "error out": error
types:
  "analyser reference.gtype" = "NI.JavaScriptReference"
uses:
  WebAudio::AudioContextState::Get Sample Rate.gvi
  WebAudio::Support::WebAudio.jsli::GetFloatFrequencyData
diagram:
  call "Get Sample Rate.gvi"(error in=$"error in") -> (sample rate=w1, error out=w2)
  call "GetFloatFrequencyData"(analyser=$"analyser reference", error in=w2) -> (floatFrequencyData=w3, error out=w4)
  Divide(x=w1, y=2) -> w5
  Array Size(array=w3) -> (size(s)=w6)
  To Double Precision Float(number=w6) -> w7
  Divide(x=w5, y=w7) -> w8
  Build Waveform Node(Y=w3, dt=w8) -> (output waveform=w9)
  $"frequency data" <- w9
  $"error out" <- w4
