vi "Get Analyser Time Domain Data.gvi"   [LabVIEW NXG 5.0.0]
inputs:
  "error in": error
  "analyser reference": "analyser reference.gtype", required
outputs:
  "time domain data": waveform<f64>
  "error out": error
types:
  "analyser reference.gtype" = "NI.JavaScriptReference"
uses:
  WebAudio::AudioContextState::Get Sample Rate.gvi
  WebAudio::Support::WebAudio.jsli::GetFloatTimeDomainData
diagram:
  call "Get Sample Rate.gvi"(error in=$"error in") -> (sample rate=w1, error out=w2)
  Reciprocal(x=w1) -> w3
  call "GetFloatTimeDomainData"(analyser=$"analyser reference", error in=w2) -> (floatTimeDomainData=w4, error out=w5)
  Build Waveform Node(Y=w4, dt=w3) -> (output waveform=w6)
  $"time domain data" <- w6
  $"error out" <- w5
