vi "Get Sample Rate.gvi"   [LabVIEW NXG 5.0.0]
inputs:
  "error in": error
outputs:
  "sample rate": i32
  "error out": error
uses:
  WebAudio::Support::WebAudio.jsli::GetSampleRate
diagram:
  s1 = uninitialised  # shift register
  while {
    Is First Call() -> w1
    case (w1) {
      frame False, Default {
        w2 = $"error in"
        w3 = s1
      }
      frame True {
        call "GetSampleRate"(error in=$"error in") -> (return=w3, error out=w2)
      }
    }
    next s1 = w3
    stop if TRUE
  }
  $"sample rate" <- s1
  $"error out" <- w2
