vi "Main.gviweb"   [LabVIEW NXG 3.0.0]
panel controls:
  "Button": bool
panel indicators:
  "Graph": f32[]
  "Error Output": error
  "Graph_2": f32[]
uses:
  WebApp::WebAudio.jsli::Start Audio Capture
  WebApp::WebAudio.jsli::Get Audio Data
  WebApp::WebAudio.jsli::Get FFT Data
diagram:
  sequence {
    frame 0 {
      while {
        Wait(time to wait=500)
        stop if $Button
      }
    }
    frame 1 {
      call "Start Audio Capture"() -> (error out=w1)
    }
  }
  s1 = w1  # shift register
  while {
    call "Get Audio Data"(error in=s1) -> (return=w2, error out=w3)
    $Graph <- w2
    next s1 = w3
    stop if w3
  }
  s2 = w1  # shift register
  while {
    call "Get FFT Data"(error in=s2) -> (return=w4, error out=w5)
    $Graph_2 <- w4
    next s2 = w5
    stop if w5
  }
  Merge Errors(s1, s2) -> (error out=w6)
  $"Error Output" <- w6
