vi "BatteryLevel.gviweb"   [G Web Development Software 22.3.0]
panel controls:
  "connect": bool
  "read": bool
  "disconnect": bool
  "start notifications": bool
panel indicators:
  "id": string
  "name": string
  "battery level": u8
uses:
  WebApp::Support::Status Button.gvi
  WebBluetooth::Service::Service UUID (String).gvi
  WebBluetooth::Device::Append Filter.gvi
  WebBluetooth::Device::Request Device.gvi
  WebBluetooth::Device::Get Device Information.gvi
  WebBluetooth::Service::GATT Server Connect.gvi
  WebBluetooth::Service::Get Primary Service.gvi
  WebBluetooth::Characteristic::Characteristic UUID (String).gvi
  WebBluetooth::Characteristic::Get Characteristic.gvi
  WebBluetooth::Characteristic::Read Value.gvi
  WebBluetooth::Service::GATT Server Disconnect.gvi
  WebBluetooth::Characteristic::Start Notifications.gvi
  WebBluetooth::Characteristic::Wait for Notification.gvi
diagram:
  call "Status Button.gvi"(status button action="initialize", button reference=reference to "connect") -> (error out=w1)
  Property Node(instance in=reference to "read", "Disabled"=TRUE, error in=w1) -> (error out=w2)
  Property Node(instance in=reference to "disconnect", "Disabled"=TRUE, error in=w2) -> (error out=w3)
  Property Node(instance in=reference to "start notifications", "Disabled"=TRUE, error in=w3) -> (error out=w4)
  call "Service UUID (String).gvi"(name="battery_service", error in=w4) -> (uuid=w5, error out=w6)
  Build Array(w5) -> w7
  call "Append Filter.gvi"(services=w7) -> (filters out=w8)
  Obtain Queue(element data type="NI.JavaScriptReference" constant, error in=w6) -> (error out=w9, queue out=w10)
  s1 = uninitialised  # shift register
  s2 = uninitialised  # shift register
  s3 = uninitialised  # shift register
  s4 = w9  # shift register
  while {
    event {
      on "connect" Value changed {
        call "Status Button.gvi"(error in=s4, disabled=TRUE, text="Connecting to device") -> (error out=w15)
        call "Request Device.gvi"(filters=w8, error in=w15) -> (device reference=w16, error out=w17)
        call "Get Device Information.gvi"(device reference in=w16, error in=w17) -> (device reference out=w18, id=w19, name=w20, error out=w21)
        call "GATT Server Connect.gvi"(device reference in=w18, error in=w21) -> (device reference out=w13, error out=w22)
        call "Status Button.gvi"(error in=w22, disabled=TRUE, text="Connecting to service") -> (error out=w23)
        call "Service UUID (String).gvi"(name="battery_service", error in=w23) -> (uuid=w24, error out=w25)
        call "Get Primary Service.gvi"(device reference=w13, service uuid=w24, error in=w25) -> (service reference=w14, error out=w26)
        call "Status Button.gvi"(error in=w26, disabled=TRUE, text="Connecting to characteristic") -> (error out=w27)
        call "Characteristic UUID (String).gvi"(name="battery_level", error in=w27) -> (uuid=w28, error out=w29)
        call "Get Characteristic.gvi"(service reference=w14, characteristic uuid=w28, error in=w29) -> (characteristic reference=w12, error out=w30)
        call "Status Button.gvi"(error in=w30, disabled=TRUE, text="Connected") -> (error out=w31)
        Property Node(instance in=reference to "read", "Disabled"=FALSE, error in=w31) -> (error out=w32)
        Property Node(instance in=reference to "disconnect", "Disabled"=FALSE, error in=w32) -> (error out=w33)
        Property Node(instance in=reference to "start notifications", "Disabled"=FALSE, error in=w33) -> (error out=w11)
        $id <- w19
        $name <- w20
      }
      on "read" Value changed {
        call "Read Value.gvi"(characteristic reference=s3, error in=s4) -> (value=w34, error out=w11)
        Array Index(array=w34) -> (out0[_]=w35)
        $"battery level" <- w35
        w12 = s3
        w13 = s1
        w14 = s2
      }
      on "disconnect" Value changed {
        Property Node(instance in=reference to "read", "Disabled"=TRUE, error in=s4) -> (error out=w36)
        Property Node(instance in=reference to "start notifications", "Disabled"=TRUE, error in=w36) -> (error out=w37)
        call "GATT Server Disconnect.gvi"(device reference in=s1, error in=w37) -> (device reference out=w38, error out=w39)
        Build Array(w38, s2, s3) -> w40
        Close Reference(error in=w39, reference=w40) -> (error out=w41)
        Property Node(instance in=reference to "disconnect", "Disabled"=TRUE, "Text"=["Disconnected"], error in=w41) -> (error out=w11)
        w12 = default
        w13 = default
        w14 = default
      }
      on "start notifications" Value changed {
        Property Node(instance in=reference to "start notifications", "Disabled"=TRUE, "Text"=["Starting notifications"], error in=s4) -> (error out=w42)
        call "Start Notifications.gvi"(characteristic reference=s3, error in=w42) -> (characteristic reader reference=w43, error out=w44)
        Enqueue Element(element=w43, error in=w44, queue=w10) -> (error out=w45)
        Property Node(instance in=reference to "start notifications", "Text"=["Notifications started"], error in=w45) -> (error out=w11)
        w12 = s3
        w13 = s1
        w14 = s2
      }
    }
    next s1 = w13
    next s2 = w14
    next s3 = w12
    next s4 = w11
    stop if w11
  }
  call "GATT Server Disconnect.gvi"(device reference in=s1, error in=s4) -> (device reference out=w46, error out=w47)
  Build Array(w46, s2, s3) -> w48
  Close Reference(error in=w47, reference=w48) -> (error out=w49)
  Property Node(instance in=w49) -> ("source"=w50)
  One Button Dialog(message=w50)
  Dequeue Element(queue=w10) -> (element=w51, error out=w52)
  s5 = w52  # shift register
  while {
    call "Wait for Notification.gvi"(characteristic reader reference in=w51, error in=s5) -> (value=w53, error out=w54)
    Array Index(array=w53) -> (out0[_]=w55)
    $"battery level" <- w55
    next s5 = w54
    stop if w54
  }
  Property Node(instance in=s5) -> ("source"=w56)
  One Button Dialog(message=w56)
