vi "Dotti.gviweb"   [G Web Development Software 22.3.0]
panel controls:
  "Connect": bool
  "one": u32
uses:
  WebApp::Support::Set Row Color.gvi
  WebBluetooth::Characteristic::Write Value.gvi
  WebBluetooth::Service::Service UUID (String).gvi
  WebBluetooth::Device::Append Filter.gvi
  WebBluetooth::Device::Request Device.gvi
  WebBluetooth::Service::GATT Server Connect.gvi
  WebBluetooth::Service::Get Primary Service.gvi
  WebBluetooth::Characteristic::Characteristic UUID (String).gvi
  WebBluetooth::Characteristic::Get Characteristic.gvi
diagram:
  s1 = uninitialised  # shift register
  while {
    event {
      on "one" Value changed {
        Event Data() -> ("New Value"=w3)
        for (N = 8) (iteration -> i1) {
          Is Less(x=w3, y=i1) -> w4
          w5 = 4293794853  # Color
          Select(s=w4, t=4278190080, f=w5) -> w6
          Decrement(x=8) -> w7
          Subtract(x=w7, y=i1) -> w8
          call "Set Row Color.gvi"(row number=w8, color=w6) -> (message=w9)
          call "Write Value.gvi"(characteristic reference=s1, value=w9) -> (error out=w10)
          stop if w10
        }
        w2 = s1
      }
      on "Connect" Value changed {
        call "Service UUID (String).gvi"(name="0000fff0-0000-1000-8000-00805f9b34fb") -> (uuid=w11)
        Property Node(instance in=reference to "Connect", "Text"=["connecting"], "Disabled"=TRUE) -> (error out=w12)
        call "Append Filter.gvi"(name prefix="Dotti") -> (filters out=w13)
        Build Array(w11) -> w14
        call "Request Device.gvi"(optional service uuids=w14, filters=w13, error in=w12) -> (device reference=w15, error out=w16)
        call "GATT Server Connect.gvi"(device reference in=w15, error in=w16) -> (device reference out=w17, error out=w18)
        call "Get Primary Service.gvi"(device reference=w17, service uuid=w11, error in=w18) -> (service reference=w19, error out=w20)
        call "Characteristic UUID (String).gvi"(name="0000fff3-0000-1000-8000-00805f9b34fb") -> (uuid=w21)
        call "Get Characteristic.gvi"(service reference=w19, characteristic uuid=w21, error in=w20) -> (characteristic reference=w2, error out=w22)
        Property Node(instance in=reference to "Connect", "Text"=["connected"], error in=w22) -> (error out=w23)
      }
    }
    w1 = w24
    next s1 = w2
    stop if w24
  }
  Property Node(instance in=w1) -> ("source"=w25)
  One Button Dialog(message=w25)
