vi "PuckJSBlink.gviweb"   [G Web Development Software 22.3.0]
panel controls:
  "Connect to Puck.js": bool
  "Toggle LED": bool
uses:
  WebBluetooth::Characteristic::Write Value.gvi
  WebBluetooth::Service::Service UUID (String).gvi
  WebBluetooth::Device::Append Filter.gvi
  WebBluetooth::Device::Request Device.gvi
  WebBluetooth::Service::GATT Server Connect.gvi
  WebBluetooth::Service::Get Primary Service.gvi
  WebBluetooth::Characteristic::Characteristic UUID (String).gvi
  WebBluetooth::Characteristic::Get Characteristic.gvi
diagram:
  s1 = uninitialised  # shift register
  while {
    event {
      on "Toggle LED" Value changed {
        Event Data() -> ("New Value"=w3)
        Select(s=w3, t="LED1.write(1)\n", f="LED1.write(0)\n") -> w4
        String To Byte Array(string=w4) -> (unsigned byte array=w5)
        call "Write Value.gvi"(characteristic reference=s1, value=w5) -> (error out=w6)
        w2 = s1
      }
      on "Connect to Puck.js" Value changed {
        Property Node(instance in=reference to "Connect to Puck.js", "Text"=["connecting"], "Disabled"=TRUE) -> (error out=w7)
        call "Service UUID (String).gvi"(name="6e400001-b5a3-f393-e0a9-e50e24dcca9e", error in=w7) -> (uuid=w8)
        Build Array(w8) -> w9
        call "Append Filter.gvi"(services=w9) -> (filters out=w10)
        call "Request Device.gvi"(filters=w10) -> (device reference=w11, error out=w12)
        call "GATT Server Connect.gvi"(device reference in=w11, error in=w12) -> (device reference out=w13, error out=w14)
        call "Get Primary Service.gvi"(device reference=w13, service uuid=w8, error in=w14) -> (service reference=w15, error out=w16)
        call "Characteristic UUID (String).gvi"(name="6e400002-b5a3-f393-e0a9-e50e24dcca9e") -> (uuid=w17)
        call "Get Characteristic.gvi"(service reference=w15, characteristic uuid=w17, error in=w16) -> (characteristic reference=w2, error out=w18)
        Property Node(instance in=reference to "Connect to Puck.js", "Text"=["connected"], error in=w18) -> (error out=w19)
      }
    }
    w1 = w20
    next s1 = w2
    stop if w20
  }
  Property Node(instance in=w1) -> ("source"=w21)
  One Button Dialog(message=w21)
