vi "Set Column Color.gvi"   [G Web Development Software 22.3.0]
inputs:
  "column number": u8 = 1
  "color": "Color.gtype" = 4278190080
outputs:
  "message": u8[]
types:
  "Color.gtype" = u32
uses:
  WebApp::Support::Color to RGBA.gvi
diagram:
  w1 = [7, 3]  # command
  Increment(x=$"column number") -> w2
  call "Color to RGBA.gvi"(Color Constant=$color) -> (red=w3, green=w4, blue=w5)
  Build Array(w1, w2, w3, w4, w5) -> w6
  $message <- w6
