vi "Set Panel Color.gvi"   [G Web Development Software 22.3.0]
inputs:
  "color": "Color.gtype" = 4278190080
outputs:
  "message": u8[]
types:
  "Color.gtype" = u32
uses:
  WebApp::Support::Color to RGBA.gvi
diagram:
  w1 = [6, 1]  # command
  call "Color to RGBA.gvi"(Color Constant=$color) -> (red=w2, green=w3, blue=w4)
  Build Array(w1, w2, w3, w4) -> w5
  $message <- w5
