vi "Status Button.gvi"   [LabVIEW NXG 5.0.0]
inputs:
  "status button action": "status button action.gtype" = "update"
  "text": string
  "disabled": bool
  "button reference": "BooleanControl reference"
  "error in": error
outputs:
  "error out": error
types:
  "status button action.gtype" = enum{"initialize", "update"}
diagram:
  s1 = uninitialised  # shift register
  while {
    case ($"status button action") {
      frame "initialize" {
        w1 = $"button reference"
        w2 = $"error in"
      }
      frame "update" {
        Build Array($text) -> w3
        Property Node(instance in=s1, "Text"=w3, "Disabled"=$disabled, error in=$"error in") -> (error out=w2, instance out=w1)
      }
    }
    next s1 = w1
    stop if TRUE
  }
  $"error out" <- w2
