vi "Append Filter.gvi"   [LabVIEW NXG 5.0.0]
inputs:
  "filters in": "filters.gtype"
  "services": "uuid.gtype"[]
  "name": string
  "name prefix": string
outputs:
  "filters out": "filters.gtype"
types:
  "filter.gtype" = cluster{"filterParts": string[]}
  "filters.gtype" = "filter.gtype"[]
  "uuid.gtype" = string
diagram:
  Array Size(array=$services) -> (size(s)=w1)
  Is Equal To 0(x=w1) -> w2
  case (w2) {
    frame True {
      w3 = "filter.gtype" {all zero or empty}
    }
    frame False {
      Property Node(instance in="filter.gtype" {all zero or empty}) -> ("filterParts"=w4, instance out=w5)
      Property Node(instance in=cluster{"services": string[]} {all zero or empty}, "services"=$services) -> (instance out=w6)
      Flatten To Json(anything=w6) -> (JSON string=w7)
      Build Array(w4, w7) -> w8
      Property Node(instance in=w5, "filterParts"=w8) -> (instance out=w3)
    }
  }
  Is Empty String Or Path(string/path=$name) -> w9
  case (w9) {
    frame False, Default {
      Property Node(instance in=w3) -> ("filterParts"=w11, instance out=w12)
      Property Node(instance in=cluster{"name": string} {all zero or empty}, "name"=$name) -> (instance out=w13)
      Flatten To Json(anything=w13) -> (JSON string=w14)
      Build Array(w11, w14) -> w15
      Property Node(instance in=w12, "filterParts"=w15) -> (instance out=w10)
    }
    frame True {
      w10 = w3
    }
  }
  Is Empty String Or Path(string/path=$"name prefix") -> w16
  case (w16) {
    frame True {
      w17 = w10
    }
    frame False {
      Property Node(instance in=w10) -> ("filterParts"=w18, instance out=w19)
      Property Node(instance in=cluster{"namePrefix": string} {all zero or empty}, "namePrefix"=$"name prefix") -> (instance out=w20)
      Flatten To Json(anything=w20) -> (JSON string=w21)
      Build Array(w18, w21) -> w22
      Property Node(instance in=w19, "filterParts"=w22) -> (instance out=w17)
    }
  }
  Build Array($"filters in", w17) -> w23
  $"filters out" <- w23
