vi "Stop Notifications.gvi"   [LabVIEW NXG 5.0.0]
inputs:
  "error in": error
  "characteristic reader reference": "characteristic reader reference.gtype", required
outputs:
  "error out": error
types:
  "characteristic reader reference.gtype" = "NI.JavaScriptReference"
uses:
  WebBluetooth::Support::WebBluetooth.jsli::StopCharacteristicNotification
diagram:
  call "StopCharacteristicNotification"(notificationStreamReader=$"characteristic reader reference") -> (error out=w1)
  Merge Errors($"error in", w1) -> (error out=w2)
  $"error out" <- w2
