vi "Get Device Information.gvi"   [LabVIEW NXG 5.0.0]
inputs:
  "device reference in": "device reference.gtype", required
  "error in": error
outputs:
  "error out": error
  "id": string
  "name": string
  "device reference out": "device reference.gtype"
types:
  "device reference.gtype" = "NI.JavaScriptReference"
uses:
  WebBluetooth::Support::WebBluetooth.jsli::GetDeviceInformation
diagram:
  $"device reference out" <- $"device reference in"
  call "GetDeviceInformation"(device=$"device reference in", error in=$"error in") -> (deviceInformationJSON=w1, error out=w2)
  Unflatten From Json(JSON string=w1, error in (no error)=w2, type and defaults=cluster{"id": string, "name": string} {all zero or empty}) -> (error out=w3, value=w4)
  Property Node(instance in=w4) -> ("id"=w5, "name"=w6)
  $id <- w5
  $name <- w6
  $"error out" <- w3
