vi "Set Filter Name Prefix.gvi"   [LabVIEW NXG 3.1.0]
inputs:
  "filter in": "filter.gtype"
  "name prefix": string, required
outputs:
  "filter out": "filter.gtype"
types:
  "filter setting.gtype" = cluster{"name": string, "settingJSON": string}
  "filter.gtype" = cluster{"filterSettings": "filter setting.gtype"[]}
diagram:
  Property Node(instance in=$"filter in") -> ("filterSettings"=w1, instance out=w2)
  w3 = "filter setting.gtype" {"name"="namePrefix", "settingJSON"=""}  # filter setting
  w4 = cluster{"single_property_to_unflatten": string} {all zero or empty}
  Property Node(instance in=w4, "single_property_to_unflatten"=$"name prefix") -> (instance out=w5)
  Flatten To JSON(anything=w5) -> (JSON string=w6)
  Property Node(instance in=w3, "settingJSON"=w6) -> (instance out=w7)
  Build Array(w1, w7) -> w8
  Property Node(instance in=w2, "filterSettings"=w8) -> (instance out=w9)
  $"filter out" <- w9
