vi "Set Filter Name.gvi"   [LabVIEW NXG 3.1.0]
inputs:
  "filter in": "filter.gtype"
  "name": string, required
outputs:
  "filter out": "filter.gtype"
types:
  "filter setting.gtype" = cluster{"name": string, "settingJSON": string}
  "filter.gtype" = cluster{"filterSettings": "filter setting.gtype"[]}
diagram:
  Property Node(instance in=$"filter in") -> ("filterSettings"=w1, instance out=w2)
  w3 = cluster{"single_property_to_unflatten": string} {all zero or empty}
  Property Node(instance in=w3, "single_property_to_unflatten"=$name) -> (instance out=w4)
  Flatten To JSON(anything=w4) -> (JSON string=w5)
  Property Node(instance in="filter setting.gtype" {"name"="name", "settingJSON"=""}, "settingJSON"=w5) -> (instance out=w6)
  Build Array(w1, w6) -> w7
  Property Node(instance in=w2, "filterSettings"=w7) -> (instance out=w8)
  $"filter out" <- w8
