vi "Set Filter Services.gvi"   [LabVIEW NXG 3.1.0]
inputs:
  "filter in": "filter.gtype"
  "service uuids": "uuid.gtype"[], required
outputs:
  "filter out": "filter.gtype"
types:
  "filter setting.gtype" = cluster{"name": string, "settingJSON": string}
  "filter.gtype" = cluster{"filterSettings": "filter setting.gtype"[]}
  "uuid.gtype" = string
diagram:
  Property Node(instance in=$"filter in") -> ("filterSettings"=w1, instance out=w2)
  Flatten To JSON(anything=$"service uuids") -> (JSON string=w3)
  Property Node(instance in="filter setting.gtype" {"name"="services", "settingJSON"=""}, "settingJSON"=w3) -> (instance out=w4)
  Build Array(w1, w4) -> w5
  Property Node(instance in=w2, "filterSettings"=w5) -> (instance out=w6)
  $"filter out" <- w6
