vi "Request Device.gvi"   [LabVIEW NXG 3.1.0]
inputs:
  "filters": "filter.gtype"[]
  "event name": string = "click"
  "accept all devices": bool
  "optional service uuids": "uuid.gtype"[]
  "selector": string, required
  "error in": error
outputs:
  "error out": error
  "device reference": "device reference.gtype"
  "id": string
  "name": string
types:
  "filter setting.gtype" = cluster{"name": string, "settingJSON": string}
  "filter.gtype" = cluster{"filterSettings": "filter setting.gtype"[]}
  "uuid.gtype" = string
  "device reference.gtype" = i32
  T1 = cluster{"reference": i32, "id": string, "name": string}
uses:
  WebBluetooth::Support::WebBluetooth.jsli::RequestDevice
diagram:
  Flatten To JSON(anything=$filters) -> (JSON string=w1)
  Flatten To JSON(anything=$"optional service uuids") -> (JSON string=w2)
  call "RequestDevice"(selector=$selector, event name=$"event name", filters json=w1, accept all devices=$"accept all devices", optional service uuids json=w2, error in=$"error in") -> (device information=w3, error out=w4)
  Unflatten From JSON(JSON string=w3, type and defaults=T1 {all zero or empty}) -> (value=w5)
  Property Node(instance in=w5) -> ("reference"=w6, "id"=w7, "name"=w8)
  $"device reference" <- w6
  $id <- w7
  $name <- w8
  $"error out" <- w4
