vi "BatteryLevel.gviweb"   [LabVIEW NXG 3.0.0]
panel controls:
  "Button": bool
panel indicators:
  "Output": error
  "value": u8[]
types:
  T1 = cluster{"filters": cluster{"services": string[]}[]}
uses:
  WebBluetooth::WebBluetooth.jsli::Request Device
  WebBluetooth::WebBluetooth.jsli::GATT Server Connect
  WebBluetooth::WebBluetooth.jsli::Get Primary Service
  WebBluetooth::WebBluetooth.jsli::Get Characteristic
  WebBluetooth::WebBluetooth.jsli::Read Value
diagram:
  Flatten To JSON(anything=T1 {"filters"=[{"services"=["battery_service"]}]}) -> (JSON string=w1, error out=w2)
  call "Request Device"(options=w1, selector="jqx-toggle-button[ni-control-id='89']", event="click", error in=w2) -> (device refnum=w3, error out=w4)
  call "GATT Server Connect"(device refnum=w3, error in=w4) -> (gatt server refnum=w5, error out=w6)
  call "Get Primary Service"(gatt server refnum=w5, service="battery_service", error in=w6) -> (service refnum=w7, error out=w8)
  call "Get Characteristic"(service refnum=w7, characteristic="battery_level", error in=w8) -> (characteristic refnum=w9, error out=w10)
  call "Read Value"(charcteristic refnum=w9, error in=w10) -> (value=w11, error out=w12)
  $value <- w11
  $Output <- w12
