vi "PuckJSBlink.gviweb"   [LabVIEW NXG 3.0.0]
panel controls:
  "Button": bool
  "Toggle LED": bool
panel indicators:
  "Output": error
types:
  T1 = cluster{"filters": cluster{"services": string[]}[]}
uses:
  WebBluetooth::WebBluetooth.jsli::Request Device
  WebBluetooth::WebBluetooth.jsli::GATT Server Connect
  WebBluetooth::WebBluetooth.jsli::Get Primary Service
  WebBluetooth::WebBluetooth.jsli::Get Characteristic
  WebBluetooth::WebBluetooth.jsli::Write Value
diagram:
  w1 = T1 {"filters"=[{"services"=["6e400001-b5a3-f393-e0a9-e50e24dcca9e"]}]}
  Flatten To JSON(anything=w1) -> (JSON string=w2, error out=w3)
  call "Request Device"(options=w2, selector="jqx-toggle-button[ni-control-id='75']", event="click", error in=w3) -> (device refnum=w4, error out=w5)
  call "GATT Server Connect"(device refnum=w4, error in=w5) -> (gatt server refnum=w6, error out=w7)
  call "Get Primary Service"(gatt server refnum=w6, service="6e400001-b5a3-f393-e0a9-e50e24dcca9e", error in=w7) -> (service refnum=w8, error out=w9)
  call "Get Characteristic"(service refnum=w8, characteristic="6e400002-b5a3-f393-e0a9-e50e24dcca9e", error in=w9) -> (characteristic refnum=w10, error out=w11)
  while {
    event {
      on "Toggle LED" Value changed {
        Event Data() -> ("New Value"=w13)
        Select(s=w13, t="LED1.write(1)\n", f="LED1.write(0)\n") -> w14
        String To Byte Array(string=w14) -> (unsigned byte array=w15)
        call "Write Value"(characteristic refnum=w10, value=w15, error in=w11) -> (error out=w12)
      }
    }
    stop if w11
  }
  $Output <- w12
