vi "Read File.gvi"   [LabVIEW NXG 3.1.0]
inputs:
  "error in": error
  "path on server": string, required
outputs:
  "data": string
  "error out": error
uses:
  node_modules::Include WebVI CLI JS API.gvi
  NodeFS::Support::NodeFS.jsli::ReadFile
diagram:
  call "Include WebVI CLI JS API.gvi"()
  call "ReadFile"(path=$"path on server", error in=$"error in") -> (data=w1, error out=w2)
  $data <- w1
  $"error out" <- w2
