vi "main.gviweb"   [LabVIEW NXG 3.1.0]
uses:
  Console::Console Log.gvi
  NI::WebSockets::Open WebSocket.gvi
  NI::WebSockets::Write String.gvi
  NI::WebSockets::Read String.gvi
  NI::WebSockets::Close WebSocket.gvi
diagram:
  call "Console Log.gvi"(message="Starting WebSocket connection...") -> (error out=w1)
  call "Open WebSocket.gvi"(url="wss://echo.websocket.org/?encoding=text", error in=w1) -> (websocket session out=w2, error out=w3)
  call "Write String.gvi"(websocket session in=w2, string message="Echooo", error in=w3) -> (websocket session out=w4, error out=w5)
  call "Read String.gvi"(websocket session in=w4, timeout=3, error in=w5) -> (websocket session out=w6, string response=w7, error out=w8)
  call "Close WebSocket.gvi"(websocket session in=w6, error in=w8) -> (error out=w9)
  call "Console Log.gvi"(message=w7, error in=w9) -> (error out=w10)
  call "Console Log.gvi"(message="Finished WebSocket connection.", error in=w10)
