vi "main.gviweb"   [LabVIEW NXG 3.1.0]
panel controls:
  "application": "application.gtype"
types:
  "application.gtype" = i32
uses:
  Console::Console Log.gvi
  WebVICLI::Get Working Directory.gvi
  Electron::Initialize Electron.gvi
  Electron::Create Browser Window.gvi
diagram:
  call "Console Log.gvi"(message="Starting Electron application...") -> (error out=w1)
  call "Get Working Directory.gvi"(application=$application, error in=w1) -> (working directory=w2, error out=w3)
  call "Console Log.gvi"(message=w2, error in=w3) -> (error out=w4)
  Concatenate Strings(w2, "\\", "..\\Render_ElectronHelloWorld") -> w5
  call "Initialize Electron.gvi"(client path=w5, error in=w4) -> (error out=w6)
  call "Create Browser Window.gvi"(error in=w6)
