vi "get.gviweb"   [LabVIEW NXG 3.1.0]
panel controls:
  "server": "server.gtype"
types:
  "server.gtype" = i32
  "file.gtype" = cluster{"data": string}
uses:
  node_modules::Get Application Component Path.gvi
  NodeFS::Read File.gvi
  Express::Write Server JSON Response.gviweb
diagram:
  call "Get Application Component Path.gvi"() -> (application component path=w1)
  Concatenate Strings(w1, "/files/helloworld.txt") -> w2
  call "Read File.gvi"(path on server=w2) -> (data=w3)
  Property Node(instance in="file.gtype" {all zero or empty}, "data"=w3) -> (instance out=w4)
  Flatten To JSON(anything=w4) -> (JSON string=w5)
  call "Write Server JSON Response.gviweb"(server=$server, json response=w5)
