vi "main.gviweb"   [LabVIEW NXG 3.1.0]
panel controls:
  "application": "application.gtype"
types:
  "application.gtype" = i32
uses:
  Console::Console Log.gvi
  WebVICLI::Get Working Directory.gvi
  Express::Run Express Application.gvi
  NI::WebSockets::Open WebSocket.gvi
  NI::WebSockets::Write String.gvi
  NI::WebSockets::Read String.gvi
  NI::WebSockets::Close WebSocket.gvi
diagram:
  call "Console Log.gvi"(message="Starting Express application...") -> (error out=w1)
  call "Get Working Directory.gvi"(application=$application, error in=w1) -> (working directory=w2, error out=w3)
  call "Console Log.gvi"(message=w2, error in=w3) -> (error out=w4)
  Concatenate Strings(w2, "\\", "..\\Client_HelloWorld") -> w5
  call "Run Express Application.gvi"(server path=w2, client path=w5, error in=w4) -> (error out=w6)
  call "Console Log.gvi"(message="Finished starting Express application.", error in=w6) -> (error out=w7)
  call "Open WebSocket.gvi"(url="wss://echo.websocket.org/?encoding=text", error in=w7) -> (websocket session out=w8, error out=w9)
  call "Write String.gvi"(websocket session in=w8, string message="Echooo", error in=w9) -> (websocket session out=w10, error out=w11)
  call "Read String.gvi"(websocket session in=w10, timeout=3, error in=w11) -> (websocket session out=w12, string response=w13, error out=w14)
  call "Close WebSocket.gvi"(websocket session in=w12, error in=w14) -> (error out=w15)
  call "Console Log.gvi"(message=w13, error in=w15) -> (error out=w16)
  call "Console Log.gvi"(message="Websocket done", error in=w16)
