vi "main.gviweb"   [LabVIEW NXG 3.1.0]
panel controls:
  "application": "application.gtype"
types:
  "application.gtype" = i32
uses:
  Console::Console Log.gvi
  WebVICLI::Get Working Directory.gvi
  NI::WebSockets::Open WebSocket.gvi
  NI::WebSockets::Write String.gvi
  NI::WebSockets::Read String.gvi
  NI::WebSockets::Close WebSocket.gvi
diagram:
  call "Console Log.gvi"(message="Starting WebSocket connection...") -> (error out=w1)
  call "Get Working Directory.gvi"(application=$application, error in=w1) -> (working directory=w2, error out=w3)
  call "Console Log.gvi"(message=w2, error in=w3) -> (error out=w4)
  call "Open WebSocket.gvi"(url="wss://echo.websocket.org/?encoding=text", error in=w4) -> (websocket session out=w5, error out=w6)
  call "Write String.gvi"(websocket session in=w5, string message="Echooo", error in=w6) -> (websocket session out=w7, error out=w8)
  call "Read String.gvi"(websocket session in=w7, timeout=3, error in=w8) -> (websocket session out=w9, string response=w10, error out=w11)
  call "Close WebSocket.gvi"(websocket session in=w9, error in=w11) -> (error out=w12)
  call "Console Log.gvi"(message=w10, error in=w12) -> (error out=w13)
  call "Console Log.gvi"(message="Finished WebSocket connection.", error in=w13)
