vi "get.gviweb"   [LabVIEW NXG 3.1.0]
panel controls:
  "server": "server.gtype"
types:
  "server.gtype" = i32
  "time.gtype" = cluster{"time": string, "counter": i32, "five": i32}
uses:
  TestUtilitiesFive::Five.gvi
  Express::Write Server JSON Response.gviweb
diagram:
  s1 = uninitialised  # shift register
  while {
    Increment(x=s1) -> w1: i32
    next s1 = w1
    stop if TRUE
  }
  call "Five.gvi"() -> (value=w2)
  Get Current Time() -> (current time=w3)
  Format Into String(w3) -> w4
  # Some state for this endpoint. State like queues, etc are only available within an endpoint.
  Property Node(instance in="time.gtype" {all zero or empty}, "time"=w4, "counter"=s1, "five"=w2) -> (instance out=w5)
  Flatten To JSON(anything=w5) -> (JSON string=w6)
  call "Write Server JSON Response.gviweb"(server=$server, json response=w6)
