vi "Convert to JSON Tree.gvi"   [LabVIEW NXG 3.1.0]
inputs:
  "json": string, required
  "error in": error
outputs:
  "json tree": "json tree.gtype"
  "error out": error
types:
  "json tree.gtype" = cluster{"path": string, "value": string}
uses:
  JSONTree::Support::JSONTree.jsli::ConvertToJsonTree
diagram:
  call "ConvertToJsonTree"(json=$json, error in=$"error in") -> (jsonTreeJSON=w1, error out=w2)
  Unflatten From JSON(JSON string=w1, type and defaults="json tree.gtype" {all zero or empty}) -> (value=w3)
  $"json tree" <- w3
  $"error out" <- w2
