vi "Format JSON for Tree.gvi"   [LabVIEW NXG 5.0.0]
inputs:
  "json": string, required
  "error in": error
outputs:
  "tree": cluster{"location": string, "data": string}[]
  "error out": error
uses:
  TreeFormatter::Support::TreeFormatter.jsli::FormatJSONForTree
diagram:
  call "FormatJSONForTree"(json=$json, error in=$"error in") -> (treeJSON=w1, error out=w2)
  Unflatten From Json(JSON string=w1, error in (no error)=w2, type and defaults=cluster{"location": string, "data": string}[] []) -> (error out=w3, value=w4)
  $tree <- w4
  $"error out" <- w3
