vi "Inspect Panel Values.gvi"   [LabVIEW NXG 3.1.0]
uses:
  DebugProbe::Support::WebVIDebugger.jsli::InspectPanelValues
diagram:
  Call Chain() -> (callchain=w1)
  Flatten To JSON(anything=w1) -> (JSON string=w2)
  call "InspectPanelValues"(callChainJSON=w2)
