vi "Probe.gvi"   [LabVIEW NXG 5.0.0]
inputs:
  "probe": variant, required
  "name": string, required
panel indicators:
  "probeout": variant
uses:
  WebVIDebugger::Support::WebVIDebugger.jsli::ProbeValue
diagram:
  # This VI must not be reentrant
  sequence {
    frame 0 { }
    frame 1 {
      # Terminal name must be "probeout"
      # Terminal must not be on connector pane
      $probeout <- $probe
    }
    frame 2 {
      Call Chain() -> (callchain=w1)
      Flatten To Json(anything=w1) -> (JSON string=w2)
      call "ProbeValue"(name=$name, callChainJSON=w2)
    }
  }
