vi "Inspect Panel Values.gvi"   [LabVIEW NXG 5.0.0]
inputs:
  "name": string, required
uses:
  WebVIDebugger::Support::WebVIDebugger.jsli::InspectPanelValues
diagram:
  Call Chain() -> (callchain=w1)
  Flatten To Json(anything=w1) -> (JSON string=w2)
  # This VI must not be reentrant
  call "InspectPanelValues"(name=$name, callChainJSON=w2)
