vi "index.gviweb"   [LabVIEW NXG 5.0.0]
panel indicators:
  "game state out": "Game State.gtype"
types:
  "Direction.gtype" = enum{"⬆️", "↗️", "➡️", "↘️", "⬇️", "↙️", "⬅️", "↖️"}
  "Edible.gtype" = bool
  "Snake Body.gtype" = bool
  "Entity.gtype" = cluster{"Direction": "Direction.gtype"[], "Edible": "Edible.gtype"[], "Position": "Position.gtype"[], "Snake Body": "Snake Body.gtype"[], "Snake Head": "Snake Head.gtype"[]}
  "User Action.gtype" = enum{"rotate ccw", "rotate cw"}
  "Game State.gtype" = cluster{"World Size": cluster{"Width": u32, "Height": u32}, "Entities": "Entity.gtype"[], "User Actions": Queue<"User Action.gtype">}
uses:
  WebVIDebuggerNXG5::Probe.gvi
diagram:
  # Top-Level WebVIs usually contain a While Loop that never stops so that they can continue running as long as the web page is open in the user's web browser.
  w1 = "Game State.gtype" {"World Size"={"Width"=0, "Height"=0}, "Entities"=[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], "User Actions"=refnum}  # Game State
  s1 = w1  # shift register
  while (iteration -> i1) {
    Wait(time to wait=50)
    Property Node(instance in=s1) -> ("Entities"=w2, instance out=w3)
    Array Index(array=w2) -> (out0[_]=w4)
    Property Node(instance in=w4) -> ("Position"=w5, instance out=w6)
    Array Index(array=w5) -> (out0[_]=w7)
    Property Node(instance in=w7, "X"=i1) -> (instance out=w8)
    Replace Array Subset(inArray=w5, index=_, new=w8) -> w9
    Property Node(instance in=w6, "Position"=w9) -> (instance out=w10)
    Replace Array Subset(inArray=w2, index=_, new=w10) -> w11
    Property Node(instance in=w3, "Entities"=w11) -> (instance out=w12)
    call "Probe.gvi"(probe in=w12)
    $"game state out" <- w12
    next s1 = w12
    stop if FALSE
  }
