vi "webvi-devtools-panel.gviweb"   [LabVIEW NXG 3.1.0]
panel controls:
  "allow updates": bool = TRUE
panel indicators:
  "updates loop count": i32
  "latest message": string
  "event loop count": i32
  "messages": cluster{"path": string, "value": string}[]
uses:
  WebVIDevToolsChrome::Support::WebVIDevTools.jsli::WaitForEvent
  JSONTree::Convert to JSON Tree.gvi
diagram:
  while (iteration -> i1) {
    call "WaitForEvent"() -> (eventData=w1)
    $"latest message" <- w1
    $"event loop count" <- i1
    stop if FALSE
  }
  while (iteration -> i2) {
    case ($"allow updates") {
      frame False, Default { }
      frame True {
        call "Convert to JSON Tree.gvi"(json=$"latest message") -> (json tree=w2, error out=w3)
        case (w3) {
          frame Error, Default { }
          frame No Error {
            $messages <- w2
          }
        }
      }
    }
    Wait(time to wait=1000)
    $"updates loop count" <- i2
    stop if FALSE
  }
