vi "main.gviweb"   [G Web Development Software 21.0.0]
uses:
  NI::G Core::Operating System::Write to System Log.gvi
  WebVINodePath::Get Component Directory.gvi
  WebVINodePath::Resolve.gvi
  WebVINodeElectron::Initialize Electron.gvi
  WebVINodeElectron::Create Browser Window.gvi
diagram:
  call "Write to System Log.gvi"(message="Starting Electron application...") -> (error out=w1)
  call "Get Component Directory.gvi"(error in=w1) -> (working directory=w2, error out=w3)
  call "Write to System Log.gvi"(message=w2, error in=w3) -> (error out=w4)
  call "Resolve.gvi"(base=w2, relative path="../ElectronUI_Default Web Server", error in=w4) -> (absolute path=w5, error out=w6)
  call "Initialize Electron.gvi"(client path=w5, error in=w6) -> (error out=w7)
  call "Create Browser Window.gvi"(error in=w7)
