vi "get.gviweb"   [LabVIEW NXG 5.1.0]
panel controls:
  "server": "server.gtype"
types:
  "server.gtype" = "NI.JavaScriptReference"
  "file.gtype" = cluster{"data": string}
uses:
  WebVINodePath::Get Component Directory.gvi
  WebVINodePath::Resolve.gvi
  WebVINodeFS::Read File.gvi
  WebVINodeExpress::Write Server JSON Response.gvi
diagram:
  call "Get Component Directory.gvi"() -> (working directory=w1, error out=w2)
  call "Resolve.gvi"(base=w1, relative path="files/helloworld.txt", error in=w2) -> (absolute path=w3, error out=w4)
  call "Read File.gvi"(path on server=w3, error in=w4) -> (data=w5)
  Property Node(instance in="file.gtype" {all zero or empty}, "data"=w5) -> (instance out=w6)
  Flatten To Json(anything=w6) -> (JSON string=w7)
  call "Write Server JSON Response.gvi"(server=$server, json response=w7)
