vi "files.gviweb"   [LabVIEW NXG 5.1.0]
panel controls:
  "Path on server": string
  "Get File Contents": bool
panel indicators:
  "body": string
types:
  "file.gtype" = cluster{"data": string}
uses:
  NI::HTTP::GET.gvi
diagram:
  while {
    event {
      on "Get File Contents" Value changed {
        call "GET.gvi"(url="files/") -> (body=w1)
        Unflatten From Json(JSON string=w1, type and defaults="file.gtype" {all zero or empty}) -> (value=w2)
        Property Node(instance in=w2) -> ("data"=w3)
        $body <- w3
      }
    }
    stop if FALSE
  }
