vi "index.gviweb"   [LabVIEW NXG 5.1.0]
panel indicators:
  "client five": i32
  "time": string
  "server counter": i32
  "five": i32
  "loop iteration": i32
types:
  "time.gtype" = cluster{"time": string, "counter": i32, "five": i32}
uses:
  ExpressSharedLibrary::Five.gvi
  NI::HTTP::GET.gvi
diagram:
  while (iteration -> i1) {
    call "Five.gvi"() -> (value=w1)
    $"client five" <- w1
    call "GET.gvi"(url="time/") -> (body=w2)
    Unflatten From Json(JSON string=w2, type and defaults="time.gtype" {all zero or empty}) -> (value=w3)
    Property Node(instance in=w3) -> ("time"=w4, "counter"=w5, "five"=w6)
    $time <- w4
    $"server counter" <- w5
    $five <- w6
    Wait(time to wait=0)
    $"loop iteration" <- i1
    stop if FALSE
  }
