vi "main.gviweb"   [LabVIEW NXG 5.1.0]
uses:
  WebVINodeRobot::Get Screen Size.gvi
  WebVINodeRobot::Move Mouse.gvi
diagram:
  call "Get Screen Size.gvi"() -> (width=w1, height=w2)
  Divide(x=w2, y=2) -> w3
  Subtract(x=w3, y=10) -> w4
  while (iteration -> i1) {
    Is Greater Or Equal(x=i1, y=w1) -> w5
    Multiply(i1, f64 default) -> w6
    Divide(x=w6, y=w1) -> w7
    Sine(x=w7) -> w8
    Multiply(w4, w8) -> w9
    Add(w4, w9) -> w10
    call "Move Mouse.gvi"(x=i1, y=w10)
    stop if w5
  }
