vi "Get Screen Size.gvi"   [LabVIEW NXG 5.1.0]
inputs:
  "error in": error
outputs:
  "error out": error
  "width": i32
  "height": i32
uses:
  WebVINodeRobot::Support::Robot.jsli::GetScreenSize
diagram:
  call "GetScreenSize"(error in=$"error in") -> (screenSizeJSON=w1, error out=w2)
  Unflatten From Json(JSON string=w1, error in (no error)=w2, type and defaults=cluster{"width": i32, "height": i32} {all zero or empty}) -> (error out=w3, value=w4)
  Property Node(instance in=w4) -> ("width"=w5, "height"=w6)
  $width <- w5
  $height <- w6
  $"error out" <- w3
