vi "main.gviweb"   [LabVIEW NXG 3.1.0]
uses:
  TestUtilitiesConsole::Console Log.gvi
  WebVICLI::Get Component Directory.gvi
  NodePath::Resolve.gvi
  Electron::Initialize Electron.gvi
  Electron::Create Browser Window.gvi
diagram:
  call "Console Log.gvi"(message="Starting Electron application...") -> (error out=w1)
  call "Get Component Directory.gvi"(error in=w1) -> (working directory=w2, error out=w3)
  call "Console Log.gvi"(message=w2, error in=w3) -> (error out=w4)
  call "Resolve.gvi"(base=w2, relative path="../TestElectronRender_webvicli-electron", error in=w4) -> (absolute path=w5, error out=w6)
  call "Initialize Electron.gvi"(client path=w5, error in=w6) -> (error out=w7)
  call "Create Browser Window.gvi"(error in=w7)
